# Grasshopper definition 250205_PP3D_Test_Stale.gh (Grasshopper 1.0.8)

py3 = Python3Script()  # -> out, a; inputs ReferenceMesh: Mesh, HeatPoints: list of Point3d, ColdPoints: list of Point3d, IsoFixCurves: list of Curve, TextureScale: Double
# ---------- py3: Python ----------
#! python3
# venv: DDU_SLICER
# r: potpourri3d
# VERSION: 250205

# RHINO GRASSHOPPER IMPORTS
import System
import Rhino
import Grasshopper
import scriptcontext as sc

# PYTHON STANDARD LIBRARY IMPORTS
from itertools import product

# THIRD PARTY MODULE IMPORTS
import potpourri3d as pp3d
import numpy as np


# FUNCTION DEFINITIONS
def rhino_points_to_np_array(points):
    """
    Converts a list of Rhino.Geometry.Point3d objects to a #Nx3 numpy array.
    """
    return np.array([[pt.X, pt.Y, pt.Z] for pt in points])


def rhino_mesh_to_np_arrays(mesh):
    """
    Converts a Rhino.Geometry.Mesh to numpy arrays of vertices and faces.
    """
    if mesh.Faces.QuadCount > 0:
        raise ValueError("Mesh has to be triangular!")
    V = np.array([[v.X, v.Y, v.Z] for _, v in enumerate(mesh.Vertices)])
    F = np.array([[f.A, f.B, f.C] for _, f in enumerate(mesh.Faces)])
    return V, F


def np_array_to_rhino_transform(xform_np_array: np.array):
    """
    Converts a 4x4 numpy array to a Rhino.Geometry.Transform transformation
    matrix.
    """
    if not Rhino:
        raise ValueError("No Rhino instance supplied!")
    rhino_xform = Rhino.Geometry.Transform(1.0)
    for i, j in product(range(4), range(4)):
        rhino_xform[i, j] = xform_np_array[i][j]
    return rhino_xform


def np_array_to_rhino_points(pt_np_array: np.array):
    """
    Converts a Nx3 numpy array to a list of Rhino.Geometry.Point3d objects.
    """
    if not Rhino:
        raise ValueError("No Rhino instance supplied!")
    return [Rhino.Geometry.Point3d(float(v[0]), float(v[1]), float(v[2]))
            for v in pt_np_array]


def np_array_to_rhino_vectors(vec_np_array: np.array):
    """
    Converts a Nx3 numpy array to a list of Rhino.Geometry.Vector3d objects.
    """
    if not Rhino:
        raise ValueError("No Rhino instance supplied!")
    dims = vec_np_array.shape[1]
    assert dims == 2 or dims == 3, "Rhino Vectors can only be 2D or 3D!"
    if dims == 2:
        return [Rhino.Geometry.Vector3d(float(v[0]), float(v[1]), 0.0)
                for v in vec_np_array]
    else:
        return [Rhino.Geometry.Vector3d(float(v[0]), float(v[1]), float(v[2]))
                for v in vec_np_array]


def np_arrays_to_rhino_triangle_mesh(v_np_array: np.array,
                                     f_np_array: np.array):
    """
    Converts a numpy arrays for vertices and faces to a rhino mesh.
    """
    # create rhino mesh from o3d output and add vertices and faces
    rhino_mesh = Rhino.Geometry.Mesh()
    [rhino_mesh.Vertices.Add(float(v[0]), float(v[1]), float(v[2]))
     for v in v_np_array]
    [rhino_mesh.Faces.AddFace(int(f[0]), int(f[1]), int(f[2]))
     for f in f_np_array]

    # compute normals and compact
    rhino_mesh.UnifyNormals()
    rhino_mesh.Normals.ComputeNormals()
    rhino_mesh.Compact()

    return rhino_mesh


class MeshVectorHeatExtendScalarComponent(Grasshopper.Kernel.GH_ScriptInstance):
    def RunScript(self,
            ReferenceMesh: Rhino.Geometry.Mesh,
            HeatPoints: System.Collections.Generic.List[Rhino.Geometry.Point3d],
            ColdPoints: System.Collections.Generic.List[Rhino.Geometry.Point3d],
            IsoFixCurves: System.Collections.Generic.List[Rhino.Geometry.Curve],
            TextureScale: float):
        # RUNSCRIPT METHOD BODY ---------------------
        print(type(HeatPoints))

        # ensure that the user picked feasible sources
        # for v in list(sources):
        #     assert v >= 0, "Vertex index cannot be negative!"
        #     assert v <= mesh.Vertices.Count - 1, ("The index of the "
        #                                         "source vertex cannot "
        #                                         "exceed the vertex "
        #                                         "count!")

        # # sanitize input list lengths
        # assert len(sources) == len(values), ("Number of sources and tangent "
        #                                     "vectors has to correspond!")

        # get vertex and face array
        V, F = rhino_mesh_to_np_arrays(ReferenceMesh)

        # Init vector heat solver
        vhmsolver = pp3d.MeshVectorHeatSolver(V, F)

        return

        # # extend the scalar
        # extended_scalars = [float(v) for v in
        #                     vhmsolver.extend_scalar(sources, values)]

        # # normalize all values for setting texture coordinates
        # vmin = min(extended_scalars)
        # vmax = max(extended_scalars)
        # mult = 1.0 / (vmax - vmin)
        # nrmvalues = [mult * (v - vmin) for v in extended_scalars]

        # # set texture coordinates of output mesh
        # out_mesh = mesh.Duplicate()
        # for i in range(out_mesh.Vertices.Count):
        #     out_mesh.TextureCoordinates.SetTextureCoordinate(
        #                 i,
        #                 Rhino.Geometry.Point2f(0.0, nrmvalues[i] * texture_scale))

        # return out_mesh, extended_scalars, nrmvalues
# ---------- end py3 ----------
