# Grasshopper definition 250313_Clay3DPrinting_Slicer.gh (Grasshopper 1.0.8)
# Copyright: Use it.  Mod it.  Share it. Just please give credit and kepp this party going.
# Copyright: Use it.  Mod it.  Share it. Just please give credit and keep this party going.
# plug-ins: Clipper2

# ----
# EXPERIMENTAL SLICER SETUP FOR CLAY PRINTING: Authors: Max Benjamin Eschenbach, Mirko Dutschke
# 
# Digital Design Unit (DDU)
# Prof. Dr.-Ing. Oliver Tessmann
# Fachbereich Architektur
# Technical University of Darmstadt
# 
# 
# CREDITS:
# ------------
# ORIGINAL GCODE GENERATOR SCRIPT BY TOM SVILANS
# ADAPTED BY MAX BENJAMIN ESCHENBACH
# 
# ORIGINAL HEAT METHOD SCRIPT BY DANIEL PIKER
# ADAPTED FOR NONPLANAR SLICING BY MAX BENJAMIN ESCHENBACH
# 
# ORIGINAL "DefinitionDependencies" COMPONENT BY ANDERS HOLDEN DELEURAN, ADAPTED BY MAX BENJAMIN ESCHENBACH
# 
# ORIGINAL VCF COMPONENT BY ANDERS HOLDEN DELEURAN
# ADAPTED BY MAX BENJAMIN ESCHENBACH
# 
# "MeshPipeChromo" COMPONENT FOR FAST MESH PIPING
# BY CAMERON NEWNHAM, COPYRIGHT 2015-2016
# LICENSED UNDER GNU GPL
# 
# SOME XYLINUS CLUSTERS BY RYAN HOOVER ARE BEING USED
# BY Independent Studio  |  MICA dFab  |  BUGSS
# LEGEND
comments_notes = Panel("USER INTERACTION")
comments_notes_2 = Panel("GEOMETRY PROCESSING")
comments_notes_3 = Panel("VISUALISATION")
comments_notes_4 = Panel("OUTPUT")
comments_notes_5 = Panel("ANALYSIS")
comments_notes_6 = Panel("DO NOT TOUCH")
comments_notes_7 = Panel("CONTROL FLOW")
comments_notes_8 = Panel("ADVANCED FEATURE")

# ----
# comments & notes: Save this File and aso save a .GHX copy of the file to the same folder as this file resides in.
# --> Please use this before pushing a new version to GitHub to make the changes somehow "trackable"
# DEPENDENCIES: DEPENDENCIES:
# 
# - Clipper2GH Components
#   https://www.food4rhino.com/en/app/clipper2gh
autosave_gh_and_ghx = Trigger(Interval=10000, TimerInterval=10000, Target=autosave)  # disabled
autosave = BooleanToggle(True)  # disabled
save = Button()
or = GateOr(A=save, B=autosave)
saveandsaveghx = CSharpScript(Save=or, ArchiveFolder="00_archive")  # -> Message; inputs Save: Boolean, ArchiveFolder: String
# ---------- saveandsaveghx: C# ----------
// Grasshopper Script Instance
#region Usings
using System;
using System.IO;
using System.Linq;
using System.Collections;
using System.Collections.Generic;
using System.Drawing;

using Rhino;
using Rhino.Geometry;

using Grasshopper;
using Grasshopper.Kernel;
using Grasshopper.Kernel.Data;
using Grasshopper.Kernel.Types;
#endregion

public class Script_Instance : GH_ScriptInstance
{
    #region Notes
    /* 
      Members:
        RhinoDoc RhinoDocument
        GH_Document GrasshopperDocument
        IGH_Component Component
        int Iteration

      Methods (Virtual & overridable):
        Print(string text)
        Print(string format, params object[] args)
        Reflect(object obj)
        Reflect(object obj, string method_name)
    */
    #endregion

    private void RunScript(bool Save, string ArchiveFolder, ref object Message)
    {
        // This output will tell us if the save succeeded or failed.
        // The active Grasshopper document in this scripting component context

        DataTree<string> msgOut = new DataTree<string>();
        GH_Path ghp = new GH_Path(0, 1);

        if (!Save)
        {
            return;
        }

        GH_Document doc = this.GrasshopperDocument;
        if (doc == null)
        {
            msgOut.Add("Error: GrasshopperDocument is null", ghp);
            return;
        }

        // Set current and archive filepath
        string originalFilePath = doc.FilePath;
        string ghxFilePath = originalFilePath + "x";
        string archivePath = Path.Combine(Path.GetDirectoryName(ghxFilePath), ArchiveFolder);
        string archiveFilePath = Path.Combine(archivePath, DateTime.Now.ToString("yyMMdd") + "_" + Path.GetFileName(originalFilePath));

        // Only attempt to save when 'saveTrigger' is set to true.
        if (!Save) return;
        
        // Make sure the parent directory exists
        if (!Directory.Exists(Path.GetDirectoryName(ghxFilePath)))
        {
            msgOut.Add("Error: directory does not exist", ghp);
            return;
        }

        // Make sure Archive Directory exists
        // Make sure the parent directory exists
        
        if (!Directory.Exists(Path.GetDirectoryName(archivePath)))
        {
            msgOut.Add("Error: Archive directory does not exist", ghp);
            return;
        }

        // Create a GH_DocumentIO object based on our current GH_Document.
        GH_DocumentIO io = new GH_DocumentIO(doc);
        // Save this document
        io.Save();

        // Write the current document to an XML-based .ghx file
        bool success_a = io.SaveQuiet(ghxFilePath);
        bool success_b = io.SaveQuiet(originalFilePath);
        bool success_c = io.SaveQuiet(archiveFilePath);

        if (success_a & success_b & success_c)
            msgOut.Add($"Files saved successfully:\n{ghxFilePath}\n{archiveFilePath}", ghp);
        else
        {
            if (!success_a)
                msgOut.Add($"Error: failed to save .ghx file:\n{ghxFilePath}", ghp);
            if (!success_c)
                msgOut.Add($"Error: failed to save Archive .gh file:\n{archiveFilePath}", ghp);
        }
        Message = msgOut;
    }
}
# ---------- end saveandsaveghx ----------
panel = Panel(saveandsaveghx)

# ---- group: Check which plugins are being used
plugins = BooleanToggle(False)
definitiondependencies = CSharpScript(Toggle=plugins)  # -> Core, AddOns; inputs Toggle: Boolean
# ---------- definitiondependencies: C# ----------
// Grasshopper Script Instance
#region Usings
using System;
using System.Linq;
using System.Collections;
using System.Collections.Generic;
using System.Drawing;

using Rhino;
using Rhino.Geometry;

using Grasshopper;
using Grasshopper.Kernel;
using Grasshopper.Kernel.Data;
using Grasshopper.Kernel.Types;
#endregion

public class Script_Instance : GH_ScriptInstance
{
    #region Notes
    /* 
      Members:
        RhinoDoc RhinoDocument
        GH_Document GrasshopperDocument
        IGH_Component Component
        int Iteration

      Methods (Virtual & overridable):
        Print(string text)
        Print(string format, params object[] args)
        Reflect(object obj)
        Reflect(object obj, string method_name)

        Author: Giulio Piacentino (updated by Anders Holden Deleuran)
        Updated 2025 by Max Benjamin Eschenbach
        License: Apache License 2.0
        Version: 250307
    */
    #endregion

    private void RunScript(bool Toggle, ref object Core, ref object AddOns)
    {   
        List<string> coreLibs = new List<string>();
        List<string> addLibs = new List<string>();
        if (Toggle)
        {
            Dictionary<string, GH_AssemblyInfo> coreLibraries = new Dictionary<string, GH_AssemblyInfo>();
            Dictionary<string, GH_AssemblyInfo> addonLibraries = new Dictionary<string, GH_AssemblyInfo>();
            Dictionary<string, string> objids = new Dictionary<string, string>();
            GH_ComponentServer server = Grasshopper.Instances.ComponentServer;
            foreach (GH_DocumentObject obj in this.Component.OnPingDocument().Objects)
            {
                if (obj == (GH_DocumentObject) this.Component)
                {
                    continue;
                }
                string objid = obj.ComponentGuid.ToString();
                if (objids.ContainsKey(objid)) continue;
                GH_AssemblyInfo lib = server.FindAssemblyByObject(obj);
                if (lib == null) continue;
                if (coreLibraries.ContainsKey(lib.Id.ToString()) | addonLibraries.ContainsKey(lib.Id.ToString())) continue;
                if (lib.IsCoreLibrary) coreLibraries.Add(lib.Id.ToString(), lib);
                else addonLibraries.Add(lib.Id.ToString(), lib);
            }
            foreach(KeyValuePair<string, GH_AssemblyInfo> entry in coreLibraries)
            {
                coreLibs.Add($"{entry.Value.Name} {entry.Value.Version}");
            }
            foreach(KeyValuePair<string, GH_AssemblyInfo> entry in addonLibraries)
            {
                addLibs.Add($"{entry.Value.Name} {entry.Value.Version}");
            }
        }
        Core = coreLibs;
        AddOns = addLibs;
    }
}
# ---------- end definitiondependencies ----------
grasshoppe_core_libraries = Panel(definitiondependencies.Core)
addon_libraries = Panel(definitiondependencies.AddOns)

# ----
# VIEWCAPTURE &
# DEPENDENCIES
viewcapture = BooleanToggle(False)
openviewcapture = BooleanToggle(True)
viewcapturewidth = Slider(1920, range=0..10000)
viewcaptureheight = Slider(1080, range=0..10000)
vcf = ViewportCaptureToFile(
    Toggle=viewcapture,
    Width=viewcapturewidth,
    Height=viewcaptureheight,
    Grid=Toggle(False),
    WorldAxes=Toggle(False),
    CPlaneAxes=Toggle(False),
    OpenFile=openviewcapture)  # -> Path; inputs Width: Int32, Height: Int32, BackgroundColor: Color
# ---------- vcf: Python ----------
"""
Captures the Rhino viewport to an image file. Places the image in a folder called
Captures in the same directory as the GH definition. Names the image the same as 
the GH defintion followed by _hourMinuteSecond. Edit the script directly to set more options.
Note: Do not use this script with the GH button, freezes up the canvas for some reason.

    Inputs:
        Toggle: Activate the component using a boolean toggle. Do NOT use a Button {item,bool}
        BackgroundColor: Set the color of the Rhino viewport background {item,color,optional}
        Grid: Turn on the grid {item,bool,optional}
        WorldAxes:Turn on the world axes {item,bool,optional}
        CPlaneAxes: Turn on the cplane axes {item,bool,optional}
        OpenFile: If true the image will open in the default application {item,bool,optional}
    Outputs:
        Path: The path of the captured image {item,str}
    Remarks:
        Author: Anders Holden Deleuran (modified by Max Eschenbach)
        License: Apache License 2.0
        Version: 200324
"""
ghenv.Component.Name = "ViewportCaptureToFile"
ghenv.Component.NickName ="VCF"
ghenv.Component.Category = "FAHS"
ghenv.Component.SubCategory = "9 Utilities"

import os
import datetime
import System
import scriptcontext as sc
import Rhino as rc

def checkOrMakeFolder():
    """
    Check/makes a "Captures" folder in the GH def folder and a subfolder
    in the format 'YYMMDD'.
    """
    
    # construct timestamp for subfolder
    date = datetime.date.today()
    yy = str(date.year)[-2:]
    mm = str(date.month).zfill(2)
    dd = str(date.day).zfill(2)
    timestamp = yy + mm + dd
    
    if ghdoc.Path:
        folder = os.path.dirname(ghdoc.Path)
        captureFolder = folder + "\\Captures\\" + timestamp
        if not os.path.isdir(captureFolder):
            os.makedirs(captureFolder)
        return captureFolder

def makeFileName():
    
    """ Make a string with the gh def name + current hourMinuteSecond """
    
    # Make hour minute seconds string
    n = datetime.datetime.now()
    ho,mt,sc = str(n.hour),str(n.minute),str(n.second)
    if len(ho) == 1:
        ho = "0"+ ho
    if len(mt) == 1:
        mt = "0"+mt
    if len(sc) == 1:
        sc = "0"+ sc
    hms = ho+mt+sc
    
    # Get name of GH def
    ghDef = ghenv.LocalScope.ghdoc.Name.strip("*")
    
    # Concatenate and return
    fileName = ghDef + "_" + hms
    
    return fileName

def captureActiveViewToFile(width,height,path,grid,worldAxes,cplaneAxes):
    
    """
    Captures the active view to an image file at the path. Path looks like this:
    "C:\\Users\\adel\\Desktop\\Captures\\foooo_112747.png"
    """
    
    # Set the script context to the current Rhino doc
    sc.doc = rc.RhinoDoc.ActiveDoc
    
    # Get the active view and set image dimensions
    
    activeView = sc.doc.Views.ActiveView
    imageDim = System.Drawing.Size(width, height)
    
    # Perform the capture
    try:
        #imageCap = rc.Display.RhinoView.CaptureToBitmap(activeView,imageDim,grid,worldAxes,cplaneAxes)
        viewcap = rc.Display.ViewCapture()
        viewcap.DrawGrid = grid
        viewcap.DrawGridAxes = worldAxes
        viewcap.DrawAxes = cplaneAxes
        viewcap.Height = height
        viewcap.Width = width
        imageCap = viewcap.CaptureToBitmap(activeView)
        System.Drawing.Bitmap.Save(imageCap, path)
        rc.RhinoApp.WriteLine(path)
        sc.doc = ghdoc
        return path
    except Exception, e:
        print e
        sc.doc = ghdoc
        raise Exception(" Capture failed, check the path")

# Set background color
if BackgroundColor:
    rc.ApplicationSettings.AppearanceSettings.ViewportBackgroundColor = BackgroundColor


# Capture
if Toggle:
    
    if not Width:
        Width = 1920
    if not Height:
        Height = 1080
        
    capFolder = checkOrMakeFolder()
    
    fileName = makeFileName()
    try:
        path = os.path.join(capFolder,fileName + ".png")
        Path = captureActiveViewToFile(Width,Height,path,Grid,WorldAxes,CPlaneAxes)
        if OpenFile:
            os.startfile(path)
    except Exception, e:
        print e
        raise Exception(" Capture failed, save the GH definition")
# ---------- end vcf ----------

# ----
# SETTINGS
comments_notes_9 = Panel("SETTINGS")

# ----
# SLICING SETTINGS
# General
# comments & notes: LAYER_HEIGHT: Controls the layer height of the print. For a 4mm Nozzle should be set to 1.9 mm for best results. You can modify it to create over/undercompressed layers on purpose.
# 
# LINE_WIDTH: Should be set exactly to the width of the nozzle. So 4mm for a 4mm nozzle.
# Seam Adjustment
# Spiralization
spiralize_contours = BooleanToggle(False)
mirkos_spiralization = BooleanToggle(False)
spiral_resolution = Slider(400, range=10..500)
spiral_intro = Slider(0.6, range=0..0.95)
spiral_outro = Slider(0.6, range=0..1)
spiral_ramp_percentage = Slider(100, range=0.01..100)
layer_height = Slider(1.9, range=0.1..5)
skirt_offset = Slider(15, range=0..100)
line_width = Slider(4, range=0.1..10)
bypass_seam_adjustment = BooleanToggle(False)
randomize_seam = BooleanToggle(False)
rnd_seam_seed = Slider(15766, range=0..99999)
adjust_seam = Slider(0, range=0..1)

# ----
# Non-Planar Slicing
# comments & notes: CAREFUL: This is quite an advanced option. If you want to experiment with it - great! You can do awesome things with NP slicing. But it may be still buggy and lead to some frustration ;-)
enable_non_planar_slicing = BooleanToggle(False)

# ----
# ANALYSIS TOOLS
overhang_angle_analysis = BooleanToggle(False)
angle_analysis_resolution = Slider(50, range=0..100)
angle_analysis_threshold_degr = Slider(30, range=0..90)
layer_height_analysis = BooleanToggle(False)

# ----
# JUMP TO ...
# comments & notes: PRINT PATH MANIPULATION BEFORE SPIRAL
# comments & notes: PRINT PATH MANIPULATION AFTER SPIRAL
comments_notes_10 = Panel("EXTRUSION RATE MODIFIER")
comments_notes_11 = Panel("GCODE CREATION")

# ----
# GCODE GENERATION,
# SIMULATION & EXPORT
create_gcode = BooleanToggle(True)
enable_print_simulation = BooleanToggle(False)
hd_printing_visualisation = BooleanToggle(True)
show_printer = BooleanToggle(True)
vis_printing_progress = Slider(100, range=0..100)
save_gcode_to_file = Button()

# ----
# DO NOT CHANGE THIS!
wasp_40100_printing_diameter = Slider(400, range=0..1000)
wasp40100_arm_length = Slider(350, range=0..1500)

# ----
# Floor / Cap / Infill
# INFILL TYPES: INFILL / FLOOR / CAP TYPES
# 0 = CRISS-CROSS
# 1 = OFFSET
print_infill_before_walls = BooleanToggle(False)
add_floor_to_open_objects = BooleanToggle(False)
floor_type = Slider(1, range=0..1)
cap_type = Slider(1, range=0..1)
infill_wall_overlap = Slider(0.2, range=0..1)
cap_layer_count = Slider(0, range=0..10)
infill_fillet_radius = Slider(0.2, range=0..10)
infill_infill_overlap = Slider(0.1, range=0..1)
synthesize_floor_for_custom_curves = BooleanToggle(False)
floor_layer_count = Slider(3, range=0..10)

# ----
# VISUALISATION
# Heads Up Display
# Base Geometry
# Layer Curves
# Print Layers
enable_heads_up_display = BooleanToggle(True)
render_print_geometry = BooleanToggle(True)
render_sharp_features = BooleanToggle(False)
render_layer_curves = BooleanToggle(True)
show_seam_points = BooleanToggle(True)
render_print_layers = BooleanToggle(True)
hd_layer_visualisation = BooleanToggle(True)

# ----
# INPUT & GEOMETRY PIPELINE
# comments & notes: DynamicUpdate: If set to 'True', will listen for changes in the Rhino document while a layer set is referenced.
# 
# CreateAndReference: If clicked, will create a new timestamped layer set and reference it.
# 
# LoadAndReference: If clicked, will try to load a previously created layer set (wherever the tick mark in the Rhino layer window is!).
dynamic_upadte = BooleanToggle(False)
create_and_reference = Button()
load_and_reference = Button()

# ----
# INPUT // CUSTOM CURVE INJECTION
# comments & notes: Using this toggle, you can inject custom curves that will be treated as print curves, without slicing or any other preprocessing of 3D geometry. This is useful if you want to experiment with very elaborate print paths.
# comments & notes: ATTENTION: CURVES NEED TO BE SUPPLIED AS FOLLOWS:
# 
# - CURVES NEED TO BE ORDERED FROM BOTTOM TO TOP!
# - ONE TREE BRANCH PER LAYER
# - IF A LAYER HAS MULTIPLE CURVES (BRANCHING OBJECTS), THEY NEED TO BE IN THE SAME BRANCH
# 
# - PLEASE HAVE A LOOK AT THE DATA STRUCTURE IN THE EXAMPLE TO THE LEFT!
comments_notes_12 = Panel("CUSTOM CURVE INJECTION")
my_example_custom_curves = Curve(Tree({0;0}: [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], {0;1}: [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], {0;2}: [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], {0;3}: [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], {0;4}: [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], {0;5}: [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]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))
inject_custom_curves = BooleanToggle(False)
custom_curves_input = Curve(my_example_custom_curves)
viewer = ParamViewer(custom_curves_input)
panel_2 = Panel(custom_curves_input)

# ----
# PREPROCESSING
# & INPUT REMESHING
# comments & notes: TriRemesh: Will try to convert any input geometry to a homogeneous triangle mesh.
# 
# TriRemeshEdgeLength: Sets the desired edge length of each triangle for the remeshing process.
# 
# TriRemeshPreserveSharpfeatures: If set to 'True', will try to preserve sharp features (creases, pointy edges) during the remeshing process.
# comments & notes: ShrinkWrap: Will try to 'shrinkwrap' any input geometry by contracting a spherical mesh around it. Internal features will be lost!
# 
# RayMesh: Will try to 'prewrap' a spherical mesh around the geometry before shrinkwrapping / remeshing.
# 
# ReBrep: Will compute a Brep representation of a mesh. WARNING: Can take very very long!
tri_remesh = BooleanToggle(False)
trm_preserve_sharp_features = BooleanToggle(False)
trm_edge_length = Slider(3, range=0..100)

# ----
# EXPERIMENTAL
# FEATURES
# BEST LEFT ALONE...
shrink_wrap = BooleanToggle(False)
ray_mesh = BooleanToggle(False)
re_brep = BooleanToggle(False)

panel_3 = Panel("""PrintingGeometry
NonPlanarBoundaries
AttractorGeometry""")
merge = Merge(
    Data1=ColourSwatch(SwatchColor=RGB(0, 0, 0)),
    Data2=ColourSwatch(SwatchColor=RGB(255, 0, 0)),
    Data3=ColourSwatch(SwatchColor=RGB(63, 209, 0)),
    Data4=ColourSwatch(SwatchColor=RGB(255, 0, 208)))

# ----
# DYNAMIC
# GEOMETRY
# INPUT
create_and_reference_2 = Data(create_and_reference)
load_and_reference_2 = Data(load_and_reference)
dynamic_upadte_2 = Data(dynamic_upadte)
pc = PipelineController(
    DynamicUpdate=dynamic_upadte_2,
    CreateAndRef=create_and_reference_2,
    LoadAndRef=load_and_reference_2,
    ParentLayerPrefix="CLAYPRINT_",
    ReferenceLayers=panel_3,
    AssistanceLayers="AssistanceGeometry",
    LayerColours=merge)  # -> AssemblyGeo, CurrentLayers; inputs DynamicUpdate: Boolean, ReferenceLayers: list, AssistanceLayers: list, LayerColours: list of Color
# ---------- pc: Python ----------
"""
Provides an interface to work with interactive geometry pipelines.
    Inputs:
        DynamicUpdate: If True, the component will listen to changes in the Rhino document and update automatically. {item, boolean}
        CreateAndRef: Set to true to create new timestamped pipeline-layers and reference them. {item, boolean}
        LoadAndRef: Set to true to load existing pipeline-layers based on the currently active Rhino layer. {item, boolean}
        ParentLayerPrefix: The prefix for parent pipeline-layers {item, string}
        ReferenceLayers: Specify the referenced layer names here (i.e. connect a panel). {list, string}
        AssistanceLayers: Specify additional non-referenced assistance layers here (i.e. connect a panel). {list, string}
        LayerColours: Use this to specify a color for the layers that are created by the component. {list, string}
    Outputs:
        AssemblyGeo: The geometry in a datatree branched based on the specified layers. {tree, geometry}
        CurrentLayers: The currently referenced layers as strings. {list, string}
    Remarks:
        Author: Max Eschenbach
        License: MIT License
        Version: 200705
"""

# PYTHON STANDARD LIBRARY IMPORTS
from __future__ import division
import time

# GHPYTHON SDK IMPORTS
from ghpythonlib.componentbase import executingcomponent as component
import Grasshopper, GhPython
import System
import Rhino
import rhinoscriptsyntax as rs

# CUSTOM RHINO IMPORTS
import rhinoscriptsyntax as rs
import scriptcontext as sc
from scriptcontext import sticky as st

# ADDITIONAL IMPORTS
from System.Drawing import Color

# GHENV COMPONENT SETTINGS
ghenv.Component.Name = "PipelineController"
ghenv.Component.NickName = "PC"
ghenv.Component.Category = "Cockatoo"
ghenv.Component.SubCategory = "01 Pipeline Controlling"

class PipelineController(component):
    
    # UNIQUE STICKY KEY OR STORING LAYERNAMES
    LNKEY = str(ghenv.Component.InstanceGuid) + "___LAYERNAMES"
    EVKEY = str(ghenv.Component.InstanceGuid) + "___EVENTS"
    FLAG = str(ghenv.Component.InstanceGuid) + "___FLAG"
    
    # COMPONENT UPDATING -------------------------------------------------------
    
    def updateComponent(self):
        # define callback action
        def callBack(e):
            self.ExpireSolution(False)
        # get ghDoc
        ghDoc = self.OnPingDocument()
        # schedule new solution
        ghDoc.ScheduleSolution(1, Grasshopper.Kernel.GH_Document.GH_ScheduleDelegate(callBack))
    
    # EVENT HANDLING -----------------------------------------------------------
    
    def subscribe_to(self, event, func, key):
        if not self.EVKEY in st:
            st[self.EVKEY] = {}
        if key not in st[self.EVKEY]:
            st[self.EVKEY][key] = event
        ukey = str(self.InstanceGuid) + "_" + key
        if ukey not in st:
            st[ukey] = func
            event += st[ukey]
    
    def unsubscribe_all(self):
        if self.EVKEY in st:
            for key in st[self.EVKEY]:
                ukey = str(self.InstanceGuid) + "_" + key
                if ukey in st:
                    st[self.EVKEY][key] -= st[ukey]
                    st.Remove(ukey)
        st[self.EVKEY] = {}
    
    def flagEvent(self, sender, e):
        st[self.FLAG] = True
    
    def updateEvent(self, sender, e):
        if st[self.FLAG] == True:
            st[self.FLAG] = False
            self.updateComponent()
    
    def unsubEvent(self, sender, e):
        self.unsubscribe_all()
    
    # LAYER SET HANDLING -------------------------------------------------------
    
    def CreateReferenceLayers(self, parentPrefix, refLayers, norefLayers, colours):
        # get timestamp
        ts = time.strftime("%y%m%d_%H-%M")
        
        # create parent layer name
        parentLayername = parentPrefix + ts
        self.Message = "Referenced: " + str(parentLayername)
        
        # check if parent layer exists
        sc.doc = Rhino.RhinoDoc.ActiveDoc
        exists = rs.IsLayer(parentLayername)
        
        if exists:
            self.AddRuntimeMessage(self.RuntimeMessageLevel.Remark,
                "Parent Layer already exists! Returning valid existing layers.")
            # get all children layers
            allchildren = rs.LayerChildren(parentLayername)
            # check all children layers for validity
            validchildren = [parentLayername + "::" + vc for vc in refLayers]
            realchildren = []
            for c in allchildren:
                if c in validchildren:
                    realchildren.append(c)
            # set sticky to real found child layers
            st[self.LNKEY] = realchildren
            
            # switch back to ghdoc
            sc.doc = ghdoc
            
            # return layer names
            return realchildren
        else:
            # switch to Rhino doc
            sc.doc = Rhino.RhinoDoc.ActiveDoc
            
            # create parent layer
            parentLayer = rs.AddLayer(parentLayername, Color.Black)
            print parentLayername
            # create referenced layers
            newLayers = []
            for i, rl in enumerate(refLayers + norefLayers):
                lay = rs.AddLayer(parentLayername + '::' + rl, 
                                  colours[i])
                if rl in refLayers:
                    newLayers.append(lay)
            
            # add them to the sticky
            st[self.LNKEY] = newLayers
            
            # switch back to ghdoc
            scdoc = ghdoc
            
            # return layer names/paths
            return newLayers
    
    def LoadCurrentLayers(self, refLayers):
        # switch to RhinoDoc
        sc.doc = Rhino.RhinoDoc.ActiveDoc
        
        # retrieve current layer
        cl = rs.CurrentLayer()
        
        # check childcount
        childcount = rs.LayerChildCount(cl)
        
        # if no children, layer has to be childlayer or unrelated
        if childcount == 0:
            # get parent layer
            parent = rs.ParentLayer(cl)
            # switch back to GhDoc
            sc.doc = ghdoc
            if parent:
                allvalid = [parent + "::" + l for l in refLayers]
                # set message and return all valid children
                self.Message = "Referenced: " + str(parent)
                st[self.LNKEY] = allvalid
                return allvalid
            else:
                st[self.LNKEY] = None
                self.Message = None
                return None
        
        # if no children, layer has to be parent layer
        elif childcount > 0:
            parent = cl
            # switch back to GhDoc and return all valid layers
            scdoc = ghdoc
            if parent:
                allvalid = [parent + "::" + l for l in refLayers]
                # set message and return all valid children
                self.Message = "Referenced: " + str(parent)
                st[self.LNKEY] = allvalid
                return allvalid
        
        else:
            # switch back to GhDoc
            scdoc = ghdoc
            st[self.LNKEY] = None
            return None
    
    def retrieveGeometry(self, layers):
        geometry = []
        
        sc.doc = Rhino.RhinoDoc.ActiveDoc
        
        for i, layer in enumerate(layers):
            objs = [rs.coercegeometry(obj) for obj in rs.ObjectsByLayer(layer)]
            
            if objs == None:
                objs = []
            
            for i, obj in enumerate(objs):
                if type(obj) == Rhino.Geometry.Point:
                    objs[i] = Rhino.Geometry.Point3d(obj.Location)
            
            geometry.append(objs)
        
        sc.doc = ghdoc
        return geometry
    
    def RunScript(self, DynamicUpdate, CreateAndRef, LoadAndRef, ParentLayerPrefix, ReferenceLayers, AssistanceLayers, LayerColours):
        # check for unique key in sticky dictionary
        if not self.LNKEY in st:
            st[self.LNKEY] = None
        
        # define output variables ----------------------------------------------
        AssemblyGeo = Grasshopper.DataTree[object]()
        CurrentLayers = []
        
        # subscribe to events for automatic component updating -----------------
        if DynamicUpdate:
            self.subscribe_to(Rhino.RhinoDoc.BeforeTransformObjects, self.flagEvent, "BeforeTransformObjects")
            self.subscribe_to(Rhino.RhinoDoc.DeleteRhinoObject, self.flagEvent, "DeleteRhinoObject")
            self.subscribe_to(Rhino.RhinoDoc.AddRhinoObject, self.flagEvent, "AddRhinoObject")
            #self.subscribe_to(Rhino.RhinoDoc.LayerTableEvent, self.flagEvent, "LayerTableEvent")
            self.subscribe_to(Rhino.RhinoDoc.UndeleteRhinoObject, self.flagEvent, "UndeleteRhinoObjects")
            self.subscribe_to(Rhino.RhinoApp.Idle, self.updateEvent, "Idle")
            self.subscribe_to(Rhino.RhinoDoc.CloseDocument, self.unsubEvent, "CloseDocument")
            self.subscribe_to(Rhino.RhinoDoc.NewDocument, self.unsubEvent, "NewDocument")
        else:
            self.unsubscribe_all()
        
        # catch missing layer colours ------------------------------------------
        laycount = len(ReferenceLayers + AssistanceLayers)
        if not LayerColours or len(LayerColours) == 0:
            LayerColours = [Color.Black] * laycount
        elif len(LayerColours) < len(ReferenceLayers + AssistanceLayers):
            addCols = [Color.Black] * (laycount - len(LayerColours))
            LayerColours.extend(addCols)
        
        # if create button is pressed, create new layers and reference them ----
        if CreateAndRef == True:
            CurrentLayers = self.CreateReferenceLayers(ParentLayerPrefix,
                                                       ReferenceLayers,
                                                       AssistanceLayers,
                                                       LayerColours)
        # if load button is pressed, load from the current rhino-layer ---------
        elif LoadAndRef == True:
            # retrieve the current layerset based on the active rhino layer
            CurrentLayers = self.LoadCurrentLayers(ReferenceLayers)
        # if no button is pressed, make some checks and run standard procedure -
        elif self.LNKEY in st and st[self.LNKEY] != None:
            layer_names = st[self.LNKEY]
            CurrentLayers = layer_names
        # fall back and return if there are no layer names stored in sticky
        elif st[self.LNKEY] == None:
            try:
                # retrieve the current layerset based on the active rhino layer
                CurrentLayers = self.LoadCurrentLayers(ReferenceLayers)
            except:
                return AssemblyGeo, PipelineGeometry, CurrentLayers
        
        # retrieve all geometry
        if CurrentLayers:
            try:
                allgeometry = self.retrieveGeometry(CurrentLayers)
            except ValueError, errMsg:
                self.AddRuntimeMessage(self.RuntimeMessageLevel.Error,
                                       str(errMsg))
                allgeometry = None
        else:
            self.AddRuntimeMessage(self.RuntimeMessageLevel.Warning,
                "Could not load layerset. Check your current Rhino layer or " +
                "the controllers input parameters")
            allgeometry = None
        
        if allgeometry:
            for i, geo in enumerate(allgeometry):
                AssemblyGeo.AddRange(geo, Grasshopper.Kernel.Data.GH_Path(i))
        
        # return outputs
        return AssemblyGeo, CurrentLayers
# ---------- end pc ----------
comments_notes_13 = Panel("DYNAMIC GEOMETRY INPUT")
assemblygeo = Data(pc.AssemblyGeo)
bang = ExplodeTree(Data=assemblygeo)  # -> Branch0, Branch1, Branch2
nonplanarboundaries = Data(bang.Branch1)
attractorgeometry = Data(bang.Branch2)
printinggeometry = Data(bang.Branch0)

# ----
# CUSTOM CURVE INJECTION
custom_curves = Curve(custom_curves_input)
bbox = BoundingBox(Content=flatten(custom_curves), Plane=PlaneXY(0, 0, 0), UnionBox=True)  # -> Box, Box_2
debox = DeconstructBox(Box=bbox.Box)  # -> Plane, X, Y, Z
volume = Volume(Geometry=bbox.Box)  # -> Volume, Centroid
pdecon = Deconstruct(Point=volume.Centroid)  # -> XComponent, YComponent, ZComponent
dedomain = DeconstructDomain(Domain=debox.Z)  # -> Start, End
pt = ConstructPoint(XCoordinate=pdecon.XComponent, YCoordinate=pdecon.YComponent, ZCoordinate=dedomain.Start)
xy = XYPlane(Origin=Point(0, 0, 0))
vec2pt = Vector2Pt(PointA=pt, PointB=xy, Unitize=False)  # -> Vector, Length
move = Move(Geometry=custom_curves, Motion=vec2pt.Vector)  # -> Geometry, Transform
topoly = CurveToPolyline(Curve=move.Geometry, ToleranceDistance="0.001", ToleranceAngle=0)  # -> Polyline, Segments
custom_curves_at_origin = Curve(topoly.Polyline)

# ----
# DEPRECATED / SAFEKEEPING
findscriptcomponents = Python3Script()  # -> out, a; disabled
# ---------- findscriptcomponents: Python ----------
"""Grasshopper Script Instance"""
import System
import Rhino
import Grasshopper

from pprint import pprint

import ScriptComponents as scomp
import RhinoCodePluginGH as rcpgh


class MyComponent(Grasshopper.Kernel.GH_ScriptInstance):

    def RunScript(self, Toggle):
        # Make GH component warning handler
        wh = Grasshopper.Kernel.GH_RuntimeMessageLevel.Remark
        
        # pprint(dir(scomp.Component_CSNET_Script.CreateSourceForEdit))
        
        cscomp = str(scomp.Component_CSNET_Script).split("'")[1]
        py3comp = str(rcpgh.Components.Python3Component).split("'")[1]
        pprint(dir(rcpgh.Components.Python3Component))
        
        # Iterate the canvas and get to the GHPython components
        TLOC = 0
        comps = ghenv.Component.OnPingDocument().Objects
        for obj in comps:
            obj_str = str(obj.GetType())
            if obj_str == cscomp:
                pprint(obj.NickName)
                pprint(obj.ScriptSource.ScriptCode)
            elif obj_str == py3comp:
                # pprint(obj.Code)
                pass
        
        return
# ---------- end findscriptcomponents ----------

# ----
# comments & notes: connect your input geometry here if you have specified or modeled it manually.
# 
# MAKE SURE THAT THE INPUT HERE IS ONE SINGLE OBJECT (BREP or MESH)!
input_geometry = Geometry(printinggeometry)

# ----
# INPUT GEOMETRY
# comments & notes: filter in case of enabling custom curve injection
# comments & notes: move input geometry to world origin and ensure it is positioned on XY plane (ground)
bbox_2 = BoundingBox(Content=flatten(input_geometry), Plane=PlaneXY(0, 0, 0), UnionBox=True)  # -> Box, Box_2
comments_notes_14 = Panel("INPUT GEOMETRY")
debox_2 = DeconstructBox(Box=bbox_2.Box)  # -> Plane, X, Y, Z
volume_2 = Volume(Geometry=bbox_2.Box)  # -> Volume, Centroid
pdecon_2 = Deconstruct(Point=volume_2.Centroid)  # -> XComponent, YComponent, ZComponent
dedomain_2 = DeconstructDomain(Domain=debox_2.Z)  # -> Start, End
pt_2 = ConstructPoint(XCoordinate=pdecon_2.XComponent, YCoordinate=pdecon_2.YComponent, ZCoordinate=dedomain_2.Start)
xy_2 = XYPlane(Origin=Point(0, 0, 0))
vec2pt_2 = Vector2Pt(PointA=pt_2, PointB=xy_2, Unitize=False)  # -> Vector, Length
inject_custom_curves_2 = Data(inject_custom_curves)
move_2 = Move(Geometry=input_geometry, Motion=vec2pt_2.Vector)  # -> Geometry, Transform
filter = StreamFilter(Gate=inject_custom_curves_2, Stream0=move_2.Geometry)
input_geometry_2 = Geometry(filter)

synthesize_floor_for_custom_curves_2 = Data(synthesize_floor_for_custom_curves)
custom_curves_at_origin_2 = Curve(custom_curves_at_origin)
filter_2 = StreamFilter(Gate=synthesize_floor_for_custom_curves_2, Stream1=custom_curves_at_origin_2)
floor_layer_count_2 = Integer(floor_layer_count)
tstat = TreeStatistics(Tree=filter_2)  # -> Paths, Length, Count
split = SplitList(List=tstat.Paths, Index=floor_layer_count_2)  # -> ListA, ListB
branch = TreeBranch(Tree=filter_2, Path=split.ListA, MaintainPaths=True)
branch_2 = TreeBranch(Tree=filter_2, Path=split.ListB, MaintainPaths=True)
custom_curves_wo_floor_wall_curves = Curve(branch_2)
custom_curves_floor_wall_curves = Curve(branch)

slice_polylines = Data(custom_curves_at_origin)
pcen = PolygonCenter(Polyline=slice_polylines)  # -> CenterV, CenterE, CenterA
avr = Average(Input=pcen.CenterA)
comments_notes_15 = Panel("construct slice planes")
xy_3 = XYPlane(Origin=avr)
custom_curves_slice_planes = Data(xy_3)

# ----
# REMESHING
comments_notes_16 = Panel("REMESHING")

# ----
# CONTROL FLOW
# INPUT GEOMETRY
# comments & notes: check if any input geometry is present
input_geometry_3 = Geometry(input_geometry_2)
custom_curves_2 = Curve(custom_curves_input)
inject_custom_curves_3 = Data(inject_custom_curves)
null = NullItem(Item=input_geometry_3)  # -> NullFlags, InvalidFlags, Description
null_2 = NullItem(Item=flatten(custom_curves_2))  # -> NullFlags, InvalidFlags, Description
or_2 = GateOr(A=null.NullFlags, B=null.InvalidFlags)
ma = MassAddition(Input=null_2.NullFlags)  # -> Result, PartialResults
ma_2 = MassAddition(Input=null_2.InvalidFlags)  # -> Result, PartialResults
or_3 = GateOr(A=ma.Result, B=ma_2.Result)
filter_3 = StreamFilter(Gate=inject_custom_curves_3, Stream0=or_2, Stream1=or_3)
not = GateNot(A=filter_3)
geo_present = Boolean(not)

# ----
# CONTROL FLOW
# INPUT MESH
inject_custom_curves_4 = Data(inject_custom_curves)
geo_present_2 = Boolean(invert(filter_3))
input_geometry_4 = Geometry(input_geometry_2)
and = GateAnd(A=inject_custom_curves_4, B=geo_present_2)
comments_notes_17 = Panel("check input geometry")
meshbrepanalysis = CSharpScript(G=input_geometry_4, T="Input ", CC=and)  # -> IsMesh, Closed, NakedEdges, Info; inputs G: GeometryBase, T: String, CC: Boolean
# ---------- meshbrepanalysis: C# ----------
// Grasshopper Script Instance
#region Usings
using System;
using System.Linq;
using System.Collections;
using System.Collections.Generic;
using System.Drawing;

using Rhino;
using Rhino.Geometry;

using Grasshopper;
using Grasshopper.Kernel;
using Grasshopper.Kernel.Data;
using Grasshopper.Kernel.Types;
#endregion

public class Script_Instance : GH_ScriptInstance
{
    #region Notes
    /* 
      Members:
        RhinoDoc RhinoDocument
        GH_Document GrasshopperDocument
        IGH_Component Component
        int Iteration

      Methods (Virtual & overridable):
        Print(string text)
        Print(string format, params object[] args)
        Reflect(object obj)
        Reflect(object obj, string method_name)
    */
    #endregion

    private void RunScript(
		GeometryBase G,
		string T,
		bool CC,
		ref object IsMesh,
		ref object Closed,
		ref object NakedEdges,
		ref object Info)
    {
        bool msh = true;
        bool clsd = false;
        int nB = 0;

        if (G is Mesh)
        {
        msh = true;
        Mesh tMesh = (Mesh) G;
        clsd = tMesh.IsClosed;
        if (clsd == false)
        {
            Curve[] nEdges = Curve.JoinCurves(Array.ConvertAll(tMesh.GetNakedEdges(), crv => crv.ToPolylineCurve()));
            NakedEdges = nEdges;
            nB = nEdges.Length;
        }
        else
        {
            NakedEdges = new Grasshopper.DataTree<object>();
        }
        IsMesh = msh;
        Closed = clsd;
        }
        else if (G is Brep)
        {
        msh = false;
        Brep tBrep = (Brep) G;
        clsd = tBrep.IsSolid;
        if (clsd == false)
        {
            Curve[] nEdges = Curve.JoinCurves(tBrep.DuplicateNakedEdgeCurves(true, true));
            NakedEdges = nEdges;
            nB = nEdges.Length;
        }
        else
        {
            NakedEdges = new Grasshopper.DataTree<object>();
        }
        IsMesh = msh;
        Closed = clsd;
        }

        string baseStr = "[INFO] {0}Geometry is a{1} {2}{3}!";
        string iclsd = (clsd) ? " closed" : "n open";
        string imsh = (msh) ? "MESH" : "BREP";
        string inb = (nB > 0) ? String.Format(" with {0} boundaries", nB) : "";
        Info = String.Format(baseStr, T, iclsd, imsh, inb);

        if (CC == true)
        {
        IsMesh = msh;
        Closed = clsd;
        NakedEdges = new Grasshopper.DataTree<object>();
        Info = new List<string> {"[INFO] Custom layer CURVES are being used!", "[INFO] Analysis tools DEACTIVATED (Custom Curves)!"};
        }
    }
}
# ---------- end meshbrepanalysis ----------
inmesh_closed = Data(meshbrepanalysis.Info)
input_ismesh = Boolean(meshbrepanalysis.IsMesh)

input_geometry_5 = Geometry(input_geometry_2)
input_ismesh_2 = Boolean(input_ismesh)
gate = StreamGate(Stream=input_geometry_5, Gate=input_ismesh_2)  # -> Target0, Target1
unim = UnifyMesh(Mesh=gate.Target1)  # -> Result, Count
filter_4 = StreamFilter(Gate=input_ismesh_2, Stream0=gate.Target0, Stream1=unim.Result)
input_geometry_6 = Geometry(filter_4)

# ----
# comments & notes: construct ray mesh for shrink wrapping
input_geometry_7 = Geometry(input_geometry_6)
triremeshtoggle = Data(tri_remesh)
raymesh = Data(ray_mesh)
gate_2 = StreamGate(Stream=input_geometry_7, Gate=triremeshtoggle)  # -> Target0, Target1
mjoin = MeshJoin(Meshes=gate_2.Target1)
bbox_3 = BoundingBox(Content=mjoin, Plane=PlaneXY(0, 0, 0), UnionBox=True)  # -> Box, Box_2
boxprop = BoxProperties(Box=bbox_3.Box)  # -> Center, Diagonal, Area, Volume, Degeneracy
volume_3 = Volume(Geometry=bbox_3.Box)  # -> Volume, Centroid
msphere = MeshSphere(Base=volume_3.Centroid, Radius=boxprop.Diagonal, UCount="60", VCount="60")
gate_3 = StreamGate(Stream=msphere, Gate=raymesh)  # -> Target0, Target1
tri = Triangulate(Mesh=gate_3.Target1)  # -> Mesh, Count
demesh = DeconstructMesh(Mesh=tri.Mesh)  # -> Vertices, Faces, Colours, Normals
rev = Reverse(Vector=demesh.Normals)
meshray = MeshRay(Mesh=gate_2.Target1, Point=demesh.Vertices, Direction=rev)  # -> Point, Hit
conmesh = ConstructMesh(Vertices=meshray.Point, Faces=demesh.Faces)
filter_5 = StreamFilter(Gate=raymesh, Stream0=gate_3.Target0, Stream1=conmesh)
shrinkwrapmesh = Mesh(filter_5)
input_geometry_8 = Geometry(gate_2.Target0)

# ----
# comments & notes: extract sharp features using threshold angle between faces
trm_additional_sharp_features = BooleanToggle(False)
trm_addsharp_angle_threshold = Slider(60, range=0..90)
input_ismesh_3 = Boolean(input_ismesh)
input_geometry_9 = Geometry(input_geometry_6)
and_2 = GateAnd(A=input_ismesh_3, B=trm_additional_sharp_features)
gate_4 = StreamGate(Stream=input_geometry_9, Gate=and_2)  # -> Target0, Target1
c_script = CSharpScript(M=gate_4.Target1, A=trm_addsharp_angle_threshold)  # -> E; inputs M: Mesh, A: Double
# ---------- c_script: C# ----------
// Grasshopper Script Instance
#region Usings
using System;
using System.Linq;
using System.Collections;
using System.Collections.Generic;
using System.Drawing;
using System.Threading.Tasks;

using Rhino;
using Rhino.Geometry;
using Rhino.Geometry.Collections;

using Grasshopper;
using Grasshopper.Kernel;
using Grasshopper.Kernel.Data;
using Grasshopper.Kernel.Types;
#endregion

public class Script_Instance : GH_ScriptInstance
{
    #region Notes
    /* 
      Members:
        RhinoDoc RhinoDocument
        GH_Document GrasshopperDocument
        IGH_Component Component
        int Iteration

      Methods (Virtual & overridable):
        Print(string text)
        Print(string format, params object[] args)
        Reflect(object obj)
        Reflect(object obj, string method_name)
    */
    #endregion

    private void RunScript(Mesh M, double A, ref object E)
    {
        // get topology edges
        MeshTopologyEdgeList Edges = M.TopologyEdges;
        MeshFaceNormalList FaceNormals = M.FaceNormals;
        // create list for storing sharp edges
        List<Line> SharpEdges = new List<Line>();
        // loop over all edges
        for (int i = 0; i < Edges.Count; i++)
        {
            // for every edge, get adjacent faces
            int[] fids = Edges.GetConnectedFaces(i);
            // only continue if there are exactly two faces adjacent to this edge
            if (fids.Length == 2)
            {
                // compute angle between face normals
                if (RhinoMath.ToDegrees(Vector3d.VectorAngle(FaceNormals[fids[0]], FaceNormals[fids[1]])) > A)
                {
                SharpEdges.Add(Edges.EdgeLine(i));
                }
            }
        }
        E = SharpEdges;
    }
}
# ---------- end c_script ----------
filter_6 = StreamFilter(Gate=input_ismesh_3, Stream1=c_script)
sharp_features = Curve(filter_6)

# ----
# comments & notes: TriRemesh input Mesh on request. Be careful, you might lose some accuracy!
shrinkwrapmesh_2 = Mesh(shrinkwrapmesh)
trm_preserve_sharp_features_2 = Boolean(trm_preserve_sharp_features)
input_geometry_10 = Geometry(input_geometry_6)
triremesh = Data(tri_remesh)
shrink_wrap_2 = Boolean(shrink_wrap)
iterations = Slider(50, range=0..100)
filter_7 = StreamFilter(Gate=shrink_wrap_2, Stream1=input_geometry_10)
filter_8 = StreamFilter(Gate=shrink_wrap_2, Stream0=input_geometry_10, Stream1=shrinkwrapmesh_2)
trm_edge_length_2 = Data(trm_edge_length)
sharp_features_2 = Curve(sharp_features)
filter_9 = StreamFilter(Gate=triremesh, Stream1=filter_8)
triremesh_2 = TriRemesh(
    Geometry=filter_9,
    Target=filter_7,
    Sharp=trm_preserve_sharp_features_2,
    Features=sharp_features_2,
    Length=trm_edge_length_2,
    Iterations=iterations)  # -> Triangulation, Dual, Creases
unim_2 = UnifyMesh(Mesh=triremesh_2.Triangulation)  # -> Result, Count
triremesh_3 = Mesh(unim_2.Result)
input_geometry_11 = Geometry(input_geometry_8)
triremeshtoggle_2 = Data(triremeshtoggle)
triremesh_4 = Mesh(triremesh_3)
filter_10 = StreamFilter(Gate=triremeshtoggle_2, Stream0=input_geometry_11, Stream1=triremesh_4)
base_geometry = Geometry(filter_10)

# ----
# comments & notes: ReBrep on request
# converts all mesh faces into surfaces and joins them, creating a brep from the mesh. This is a terribly intense and slow process. I don't advise doing it! But the feature is there if you absoluetly need to...
base_geometry_2 = Geometry(base_geometry)
trimmedtriangles = BooleanToggle(True)
rebrep = Boolean(re_brep)
gate_5 = StreamGate(Stream=base_geometry_2, Gate=rebrep)  # -> Target0, Target1
rebrepmesh = CSharpScript(M=gate_5.Target1, TT=trimmedtriangles)  # -> B; inputs M: Mesh, TT: Boolean
# ---------- rebrepmesh: C# ----------
// Grasshopper Script Instance
#region Usings
using System;
using System.Linq;
using System.Collections;
using System.Collections.Generic;
using System.Drawing;

using Rhino;
using Rhino.Geometry;

using Grasshopper;
using Grasshopper.Kernel;
using Grasshopper.Kernel.Data;
using Grasshopper.Kernel.Types;
#endregion

public class Script_Instance : GH_ScriptInstance
{
    #region Notes
    /* 
      Members:
        RhinoDoc RhinoDocument
        GH_Document GrasshopperDocument
        IGH_Component Component
        int Iteration

      Methods (Virtual & overridable):
        Print(string text)
        Print(string format, params object[] args)
        Reflect(object obj)
        Reflect(object obj, string method_name)
    */
    #endregion

    private void RunScript(Mesh M, bool TT, ref object B)
    {
        B = Brep.CreateFromMesh(M, TT);
    }
}
# ---------- end rebrepmesh ----------
filter_11 = StreamFilter(Gate=rebrep, Stream0=gate_5.Target0, Stream1=rebrepmesh)
printing_geometry = Geometry(filter_11)

# ----
# CONTROL FLOW MESHING
panel_4 = Panel("[INFO] ShrinkWrapping during Remeshing...")
inject_custom_curves_5 = Data(inject_custom_curves)
triremesh_5 = Data(tri_remesh)
shrink_wrap_3 = Data(shrink_wrap)
base_mesh = Geometry(base_geometry)
comments_notes_18 = Panel("info & error messages")
filter_12 = StreamFilter(Gate=triremesh_5, Stream1=base_mesh)
filter_13 = StreamFilter(Gate=shrink_wrap_3, Stream0=panel_4, Stream1="[INFO] No ShrinkWrapping is being done.")
ismeshclosed = CSharpScript(M=filter_12)  # -> C, T; inputs M: Mesh
# ---------- ismeshclosed: C# ----------
// Grasshopper Script Instance
#region Usings
using System;
using System.Linq;
using System.Collections;
using System.Collections.Generic;
using System.Drawing;

using Rhino;
using Rhino.Geometry;

using Grasshopper;
using Grasshopper.Kernel;
using Grasshopper.Kernel.Data;
using Grasshopper.Kernel.Types;
#endregion

public class Script_Instance : GH_ScriptInstance
{
    #region Notes
    /* 
      Members:
        RhinoDoc RhinoDocument
        GH_Document GrasshopperDocument
        IGH_Component Component
        int Iteration

      Methods (Virtual & overridable):
        Print(string text)
        Print(string format, params object[] args)
        Reflect(object obj)
        Reflect(object obj, string method_name)
    */
    #endregion

    private void RunScript(Mesh M, ref object C, ref object T)
    {
        if (M.IsClosed == true)
        {
            C = true;
            T = "[INFO] Base Mesh is closed.";
        }
        else
        {
            C = false;
            T = "[INFO] Base Mesh is open and/or disjoint!";
        }
    }
}
# ---------- end ismeshclosed ----------
filter_14 = StreamFilter(Gate=triremesh_5, Stream0="[INFO] No Remeshing is being done...", Stream1="[INFO] Using TriRemesh Pipeline...")
filter_15 = StreamFilter(Gate=triremesh_5, Stream1=ismeshclosed.T)
filter_16 = StreamFilter(Gate=triremesh_5, Stream1=filter_13)
filter_17 = StreamFilter(Gate=inject_custom_curves_5, Stream0=filter_15)
filter_18 = StreamFilter(Gate=inject_custom_curves_5, Stream0=filter_14)
filter_19 = StreamFilter(Gate=inject_custom_curves_5, Stream0=filter_16)
base_mesh_closed = Data(filter_17)
remeshing_info = Data(filter_18)
shrinkwrap_info = Data(filter_19)

# ----
# CONTROL FLOW
# NON-PLANAR SLICING
# comments & notes: check if printing geometry is Mesh or Brep
enable_non_planar_slicing_2 = Data(enable_non_planar_slicing)
inject_custom_curves_6 = Data(inject_custom_curves)
printing_geometry_2 = Geometry(printing_geometry)
geo_present_3 = Boolean(invert(filter_3))
and_3 = GateAnd(A=inject_custom_curves_6, B=geo_present_3)
meshbrepanalysis_2 = CSharpScript(G=printing_geometry_2, T="Printing ", CC=and_3)  # -> IsMesh, Closed, NakedEdges, Info; inputs G: GeometryBase, T: String, CC: Boolean; same code as meshbrepanalysis
printing_geometry_ismesh = Boolean(meshbrepanalysis_2.IsMesh)
printing_geometry_closed = Boolean(meshbrepanalysis_2.Closed)
and_4 = GateAnd(A=enable_non_planar_slicing_2, B=printing_geometry_ismesh, C=invert(printing_geometry_closed))
python = GhPythonScript(A=enable_non_planar_slicing_2, B=printing_geometry_ismesh, C=printing_geometry_closed, D=and_3)  # -> out, INFO; inputs A: Boolean, B: Boolean
# ---------- python: Python ----------
__author__ = "EFESTWIN"
__version__ = "2023.02.07"
import Grasshopper

if A and not B:
    INFO = '[SETTING IGNORED] Non Planar slicing is impossible for BREPs! To use this feature, activate remeshing.'
elif A and B and not C:
    INFO = '[INFO] Performing Non Planar slicing...'
elif A and C:
    INFO = ['[SETTING IGNORED] Non Planar slicing is currently not available for closed objects!',
            '[INFO] Performing parallel slicing...']
elif D:
    INFO = '[INFO] No slicing is being done! Custom CURVES are injected...'
else:
    INFO = '[INFO] Performing parallel slicing...'
# ---------- end python ----------
gate_6 = StreamGate(Stream=printing_geometry_2, Gate=and_4)  # -> Target0, Target1
printing_geometry_3 = Geometry(gate_6.Target0)
printing_geometry_4 = Geometry(gate_6.Target1)
np_slicing_enabled = Boolean(and_4)
pg_meshbrep_info = Data(meshbrepanalysis_2.Info)
info_npslicing = Data(python.INFO)

# ----
# CONTROL FLOW
# MESH/BREP OPEN LOWER BOUNDARY
# comments & notes: CHECK FOR LOWER BOUNDARY
printing_geometry_ismesh_2 = Boolean(printing_geometry_ismesh)
# CONTROL FLOW
# FLOOR SLICING
printing_geometry_5 = Geometry(printing_geometry)
gate_7 = StreamGate(Stream=printing_geometry_5, Gate=printing_geometry_ismesh_2)  # -> Target0, Target1
edges = BrepEdges(Brep=gate_7.Target0)  # -> Naked, Interior, NonManifold
medges = MeshEdges(Mesh=gate_7.Target1)  # -> NakedEdges, InteriorEdges, NonManifoldEdges
filter_20 = StreamFilter(Gate=printing_geometry_ismesh_2, Stream0=edges.Naked, Stream1=medges.NakedEdges)
join = JoinCurves(Curves=filter_20, Preserve=False)
topoly_2 = CurveToPolyline(Curve=join, ToleranceDistance="0.01", ToleranceAngle=0)  # -> Polyline, Segments
pcen_2 = PolygonCenter(Polyline=topoly_2.Polyline)  # -> CenterV, CenterE, CenterA
pdecon_3 = Deconstruct(Point=pcen_2.CenterV)  # -> XComponent, YComponent, ZComponent
sort = SortList(Keys=pdecon_3.ZComponent, ValuesA=join)  # -> Keys, ValuesA
item = ListItem(List=sort.ValuesA, Index=0, Wrap=True)
explode = Explode(Curve=item, Recursive=True)  # -> Segments, Vertices
pdecon_4 = Deconstruct(Point=explode.Vertices)  # -> XComponent, YComponent, ZComponent
avr_2 = Average(Input=pdecon_4.ZComponent)
rtd = RoundToDecimal(Numbers=avr_2, DecimalPlaces="5")  # -> Rounded; inputs Numbers: list, DecimalPlaces: list of Int32
# ---------- rtd: Python ----------
"""
Rounds input numbers to a decimal place.
    Inputs:
        Numbers: The numbers to round. {list, float}
        DecimalPlaces: Number of decimal places for the generated random
                       numbers. Set to 0 for integer numbers.
                       Defaults to 2.
                       {list, int}
    Output:
        Rounded: The number rounded to DecimalPlaces.
                 {list/tree, float/int}
    Remarks:
        Author: Max Eschenbach
        License: MIT License
        Version: 230103
"""

# PYTHON STANDARD LIBRARY IMPORTS
from __future__ import division, print_function

# GHPYTHONLIB SDK IMPORTS
from ghpythonlib.componentbase import executingcomponent as component
import Grasshopper, GhPython
import System
import Rhino

# GHENV COMPONENT SETTINGS
ghenv.Component.Name = "RoundToDecimal"
ghenv.Component.NickName = "RTD"
ghenv.Component.Category = "FindersKeepers"
ghenv.Component.SubCategory = "5 Math"

class RoundToDecimal(component):
    
    def RunScript(self, Numbers, DecimalPlaces):
        
        if not DecimalPlaces:
                DecimalPlaces = [0]
        
        if Numbers and Numbers != [None]:
            rounded = []
            for i, num in enumerate(Numbers):
                # retrieve decimalplaces
                if i < len(DecimalPlaces):
                    dp = DecimalPlaces[i]
                else:
                    dp = DecimalPlaces[-1]
                # round number
                rounded.append(round(num, dp))
        else:
            rounded = Grasshopper.DataTree[object]()
        
        # return outputs if you have them; here I try it for you:
        return rounded
# ---------- end rtd ----------
similar = Similarity(FirstNumber=rtd, SecondNumber="0", Threshold="1")  # -> Similarity, AbsoluteDifference
null_3 = NullItem(Item=rtd)  # -> NullFlags, InvalidFlags, Description
not_2 = GateNot(A=null_3.InvalidFlags)
or_4 = GateOr(A=not_2, B=similar.Similarity)
printing_geometry_has_lower_boundary = Boolean(or_4)

# ----
# comments & notes: CHECK FLOOR LAYER COUNT
floor_layer_count_3 = Integer(floor_layer_count)
larger = LargerThan(FirstNumber=floor_layer_count_3, SecondNumber="0")  # -> LargerThan, OrEqualTo
floor_layer_count_larger_than_zero = Data(larger.LargerThan)

add_floor_to_open_objects_2 = Boolean(add_floor_to_open_objects)

printing_geometry_6 = Geometry(printing_geometry_3)
layer_height_2 = Number(layer_height)
Z = UnitZ(Factor=1)
pt_3 = ConstructPoint(XCoordinate=0, YCoordinate=0, ZCoordinate="0.1")
contour = Contour(Shape=printing_geometry_6, Point=pt_3, Direction=Z, Distance=layer_height_2)
tstat_2 = TreeStatistics(Tree=contour)  # -> Paths, Length, Count
comments_notes_19 = Panel("CONTOURING PRINTING GEOMETRY")
item_2 = ListItem(List=tstat_2.Paths, Index=0, Wrap=True)
dpath = DeconstructPath(Branch=item_2)
lng = ListLength(List=dpath)  # -> expr("x-2", Length)
pshift = ShiftPaths(Data=contour, Offset=lng)
parallel_slice_curves = Data(pshift)

# ----
# CONTROL FLOW
# OPEN CRVS IN FIRST LAYER
# comments & notes: check first layer for open curves, forward boolean for floor addition (no floor possible with open curves...)
# comments & notes: CHECK FIRST LAYER FOR OPEN CURVES
inject_custom_curves_7 = Data(inject_custom_curves)
custom_curves_3 = Curve(custom_curves_input)
slice_polylines_2 = Data(parallel_slice_curves)
filter_21 = StreamFilter(Gate=inject_custom_curves_7, Stream0=slice_polylines_2, Stream1=custom_curves_3)
tstat_3 = TreeStatistics(Tree=filter_21)  # -> Paths, Length, Count
item_3 = ListItem(List=tstat_3.Paths, Index=0, Wrap=True)
branch_3 = TreeBranch(Tree=filter_21, Path=item_3, MaintainPaths=True)
cls = Closed(Curve=branch_3)  # -> Closed, Periodic
ma_3 = MassAddition(Input=cls.Closed)  # -> Result, PartialResults
smaller = SmallerThan(FirstNumber=ma_3.Result, SecondNumber="1")  # -> SmallerThan, OrEqualTo
first_layer_open_curves = Data(smaller.SmallerThan)

# ----
# comments & notes: ADD FLOOR TO NP SLICING?
# comments & notes: ADD FLOOR TO CUSTOM CURVES?
floor_layer_count_larger_than_zero_2 = Data(floor_layer_count_larger_than_zero)
printing_geometry_has_lower_boundary_2 = Boolean(printing_geometry_has_lower_boundary)
synthesize_floor_for_custom_curves_3 = Data(synthesize_floor_for_custom_curves)
floor_layer_count_larger_than_zero_3 = Data(floor_layer_count_larger_than_zero)
add_floor_to_open_objects_3 = Boolean(add_floor_to_open_objects)
first_layer_open_curves_2 = Data(first_layer_open_curves)
printing_geometry_closed_2 = Boolean(printing_geometry_closed)
inject_custom_curves_8 = Data(inject_custom_curves)
first_layer_open_curves_3 = Data(first_layer_open_curves)
np_slicing_enabled_2 = Boolean(np_slicing_enabled)
not_3 = GateNot(A=first_layer_open_curves_2)
not_4 = GateNot(A=printing_geometry_closed_2)
not_5 = GateNot(A=first_layer_open_curves_3)
and_5 = GateAnd(A=inject_custom_curves_8, B=synthesize_floor_for_custom_curves_3, C=floor_layer_count_larger_than_zero_2, D=not_3)
and_6 = GateAnd(
    A=np_slicing_enabled_2,
    B=not_4,
    C=floor_layer_count_larger_than_zero_3,
    D=add_floor_to_open_objects_3,
    E=printing_geometry_has_lower_boundary_2,
    F=not_5)
or_5 = GateOr(A=and_6, B=and_5)
filter_22 = StreamFilter(Gate=or_5, Stream0="False", Stream1="True")
add_floor_custom_curves_enabled = Boolean(and_5)
add_floor_slicing_enabled = Boolean(filter_22)

# ----
# comments & notes: PARALLEL FLOOR SLICING ENABLED?
floor_layer_count_larger_than_zero_4 = Data(floor_layer_count_larger_than_zero)
printing_geometry_closed_3 = Boolean(printing_geometry_closed)
first_layer_open_curves_4 = Data(first_layer_open_curves)
not_6 = GateNot(A=first_layer_open_curves_4)
or_6 = GateOr(A=printing_geometry_closed_3, B=add_floor_to_open_objects_2)
and_7 = GateAnd(A=or_6, B=floor_layer_count_larger_than_zero_4, C=not_6)
regular_floor_slicing_enabled = Boolean(and_7)

floor_layer_count_larger_than_zero_5 = Data(floor_layer_count_larger_than_zero)
layer_height_3 = Number(layer_height)
floor_layer_count_4 = Integer(floor_layer_count)
series = Series(Start="0.1", Step=layer_height_3, Count=floor_layer_count_4)
Z_2 = UnitZ(Factor=1)
filter_23 = StreamFilter(Gate=floor_layer_count_larger_than_zero_5, Stream1=series)
xy_4 = XYPlane(Origin=Point(0, 0, 0))
amp = Amplitude(Vector=Z_2, Amplitude=filter_23)
move_3 = Move(Geometry=xy_4, Motion=amp)  # -> flatten(Geometry), Transform
floor_slice_planes = Plane(graft(move_3.Geometry))

# ----
# comments & notes: split mesh with plane if additional floor is enabled
floor_slicing_enabled = Boolean(add_floor_slicing_enabled)
printing_geometry_7 = Geometry(printing_geometry_4)
floor_slice_planes_2 = Plane(flatten(floor_slice_planes))
layer_height_4 = Data(layer_height)
filter_24 = StreamFilter(Gate=floor_slicing_enabled, Stream1=floor_slice_planes_2)
filter_25 = StreamFilter(Gate=floor_slicing_enabled, Stream1=printing_geometry_7)
item_4 = ListItem(List=filter_24, Index=0, Wrap=True)  # -> Item1, Item
Z_3 = UnitZ(Factor=layer_height_4)
move_4 = Move(Geometry=item_4.Item1, Motion=Z_3)  # -> Geometry, Transform
msplit = MeshSplitPlane(Mesh=filter_25, Plane=move_4.Geometry)  # -> Above, Below
filter_26 = StreamFilter(Gate=floor_slicing_enabled, Stream0=printing_geometry_7, Stream1=msplit.Above)
printing_geometry_addfloorfiltered = Geometry(filter_26)

add_floor_slicing_enabled_2 = Boolean(add_floor_slicing_enabled)
printing_geometry_ismesh_3 = Boolean(printing_geometry_ismesh)
printing_geometry_8 = Geometry(printing_geometry)
filter_27 = StreamFilter(Gate=add_floor_slicing_enabled_2, Stream1=printing_geometry_8)
gate_8 = StreamGate(Stream=filter_27, Gate=printing_geometry_ismesh_3)  # -> Target0, Target1
gate_9 = StreamGate(Stream=floor_slice_planes, Gate=printing_geometry_ismesh_3)  # -> Target0, Target1
sec = MeshPlane(Mesh=gate_8.Target1, Plane=gate_9.Target1)
sec_2 = BrepPlane(Brep=gate_8.Target0, Plane=gate_9.Target0)  # -> Curves, Points
filter_28 = StreamFilter(Gate=printing_geometry_ismesh_3, Stream0=sec_2.Curves, Stream1=sec)
tstat_4 = TreeStatistics(Tree=filter_28)  # -> Paths, Length, Count
dpath_2 = DeconstructPath(Branch=tstat_4.Paths)
lng_2 = ListLength(List=dpath_2)
larger_2 = LargerThan(FirstNumber=lng_2, SecondNumber="2")  # -> LargerThan, OrEqualTo
ma_4 = MassAddition(Input=flatten(larger_2.LargerThan))  # -> Result, PartialResults
larger_3 = LargerThan(FirstNumber=ma_4.Result, SecondNumber="0")  # -> LargerThan, OrEqualTo
gate_10 = StreamGate(Stream=filter_28, Gate=larger_3.LargerThan)  # -> Target0, Target1
pshift_2 = ShiftPaths(Data=gate_10.Target1, Offset=expr("x*-1", "1"))
filter_29 = StreamFilter(Gate=larger_3.LargerThan, Stream0=gate_10.Target0, Stream1=pshift_2)
slice_curves_addfloor = Data(filter_29)

# ----
# ADDITIONAL FLOOR SLICING FOR
# OPEN OBJECT FLOOR ADDITION
# AND NP MESH FLOOR ADDITION
comments_notes_20 = Panel("FLOOR SLICING")

add_floor_slicing_enabled_3 = Boolean(add_floor_slicing_enabled)
slice_curves_addfloor_2 = Data(slice_curves_addfloor)
parallel_slice_curves_2 = Data(parallel_slice_curves)
filter_30 = StreamFilter(Gate=add_floor_slicing_enabled_3, Stream0=parallel_slice_curves_2, Stream1=slice_curves_addfloor_2)
slice_curves = Data(filter_30)

# ----
# comments & notes: check curve length. only accept curves that are longer than (average length * 0.01)
slice_curves_2 = Data(slice_curves)
len = Length(Curve=slice_curves_2)
ma_5 = MassAddition(Input=flatten(len))  # -> Result, PartialResults
lng_3 = ListLength(List=flatten(len))
division = Division(A=ma_5.Result, B=lng_3)
multiplication = Multiplication(A=division, B="0.01")
larger_4 = LargerThan(FirstNumber=len, SecondNumber=multiplication)  # -> LargerThan, OrEqualTo
dispatch = Dispatch(List=slice_curves_2, DispatchPattern=larger_4.LargerThan)  # -> ListA, ListB
slice_curves_length_thresholded = Data(dispatch.ListA)

# ----
# comments & notes: extract low and high boundaries to use as heat/cold points
printing_geometry_addfloorfiltered_2 = Geometry(printing_geometry_addfloorfiltered)
medges_2 = MeshEdges(Mesh=printing_geometry_addfloorfiltered_2)  # -> NakedEdges, InteriorEdges, NonManifoldEdges
join_2 = JoinCurves(Curves=medges_2.NakedEdges, Preserve=False)
pcen_3 = PolygonCenter(Polyline=join_2)  # -> CenterV, CenterE, CenterA
pdecon_5 = Deconstruct(Point=pcen_3.CenterV)  # -> XComponent, YComponent, ZComponent
sort_2 = SortList(Keys=pdecon_5.ZComponent, ValuesA=join_2)  # -> Keys, ValuesA
open_boundaries_sorted = Curve(sort_2.ValuesA)
open_boundaries_zvalues = Data(sort_2.Keys)

# ----
# PLANAR SLICING
comments_notes_21 = Panel("PLANAR SLICING")

# ----
# comments & notes: convert all contour curves to polylines with a resolution of 0.01 mm, cull all points within 0.001 mm tolerance, reduce polyline with a deviation of 0.025 mm
slice_curves_length_thresholded_2 = Data(slice_curves_length_thresholded)
topoly_3 = CurveToPolyline(Curve=graft(slice_curves_length_thresholded_2), ToleranceDistance="0.01", ToleranceAngle=0)  # -> Polyline, Segments
explode_2 = Explode(Curve=topoly_3.Polyline, Recursive=True)  # -> Segments, Vertices
cullpt = CullDuplicates(Points=explode_2.Vertices, Tolerance="0.001", CullMode=3)  # -> Points, Indices, Valence
pshift_3 = ShiftPaths(Data=cullpt.Points, Offset=-2)
cls_2 = Closed(Curve=topoly_3.Polyline)  # -> Closed, Periodic
pline = PolyLine(Vertices=pshift_3, Closed=cls_2.Closed)
redpline = Reduce(Polyline=pline, Tolerance="0.025")  # -> Polyline, Reduction
pshift_4 = ShiftPaths(Data=redpline.Polyline, Offset=-1)
slice_polylines_3 = Data(pshift_4)

# ----
# comments & notes: check if there is only one boundary. then check if this is near the bottom / the bottom boundary and create a control flow boolean from this info.
printing_geometry_floorfiltered = Geometry(printing_geometry_addfloorfiltered)
open_boundaries_sorted_2 = Curve(open_boundaries_sorted)
lng_4 = ListLength(List=open_boundaries_sorted_2)
equals = Equality(FirstNumber=lng_4, SecondNumber="1")  # -> Equality, Inequality
filter_31 = StreamFilter(Gate=equals.Equality, Stream1=printing_geometry_floorfiltered)
open_boundaries_zvalues_2 = Data(open_boundaries_zvalues)
bbox_4 = BoundingBox(Content=filter_31, Plane=PlaneXY(0, 0, 0), UnionBox=True)  # -> Box, Box_2
debox_3 = DeconstructBox(Box=bbox_4.Box)  # -> Plane, X, Y, Z
filter_32 = StreamFilter(Gate=equals.Equality, Stream1=open_boundaries_zvalues_2)
dedomain_3 = DeconstructDomain(Domain=debox_3.Z)  # -> Start, End
division_2 = Division(A=filter_32, B=dedomain_3.End)
smaller_2 = SmallerThan(FirstNumber=division_2, SecondNumber="0.1")  # -> SmallerThan, OrEqualTo
and_8 = GateAnd(A=equals.Equality, B=smaller_2.OrEqualTo)
np_only_bot_boundary = Boolean(and_8)

# ----
# comments & notes: get low/high points for heat and cold points definition
open_boundaries_sorted_3 = Curve(open_boundaries_sorted)
explode_3 = Explode(Curve=open_boundaries_sorted_3, Recursive=True)  # -> Segments, Vertices
cullpt_2 = CullDuplicates(Points=explode_3.Vertices, Tolerance="0.001", CullMode=3)  # -> simplify(Points), Indices, Valence
tstat_5 = TreeStatistics(Tree=cullpt_2.Points)  # -> Paths, Length, Count
item_5 = ListItem(List=tstat_5.Paths, Index=0, Wrap=True)  # -> Item1, Item
# NON-PLANAR SLICING FOR OPEN OBJECTS
# comments & notes: catch cases where input is
# - more boundaries?
branch_4 = TreeBranch(Tree=cullpt_2.Points, Path=item_5.Item1, MaintainPaths=True)
branch_5 = TreeBranch(Tree=cullpt_2.Points, Path=item_5.Item, MaintainPaths=True)
highpts = Point(branch_4)
lowpts = Point(branch_5)

# ----
# comments & notes: WHAT TO DO ABOUT OPEN CURVES/SURFACES??
slice_polylines_4 = Data(slice_polylines_3)
cls_3 = Closed(Curve=slice_polylines_4)  # -> Closed, Periodic
lng_5 = ListLength(List=slice_polylines_4)
larger_5 = LargerThan(FirstNumber=lng_5, SecondNumber="1")  # -> LargerThan, OrEqualTo
not_7 = GateNot(A=cls_3.Closed)
ma_6 = MassAddition(Input=larger_5.LargerThan)  # -> Result, PartialResults
ma_7 = MassAddition(Input=not_7)  # -> Result, PartialResults
larger_6 = LargerThan(FirstNumber=ma_6.Result, SecondNumber="1")  # -> LargerThan, OrEqualTo
larger_7 = LargerThan(FirstNumber=ma_7.Result, SecondNumber="0")  # -> LargerThan, OrEqualTo
and_9 = GateAnd(A=larger_7.LargerThan, B=larger_6.LargerThan)  # -> flatten(Result)
ma_8 = MassAddition(Input=and_9)  # -> Result, PartialResults
larger_8 = LargerThan(FirstNumber=ma_8.Result, SecondNumber="0")  # -> LargerThan, OrEqualTo
branching_curves = Data(larger_8.LargerThan)
gate_11 = StreamGate(Stream=slice_polylines_4, Gate=branching_curves)  # -> Target0, Target1
orderbranchingslices = CSharpScript(Slices=gate_11.Target1)  # -> out, OrderedSlices; inputs Slices: tree of Curve
# ---------- orderbranchingslices: C# ----------
// Grasshopper Script Instance
#region Usings
using System;
using System.Linq;
using System.Collections;
using System.Collections.Generic;
using System.Drawing;

using Rhino;
using Rhino.Geometry;
using Rhino.Collections;

using Grasshopper;
using Grasshopper.Kernel;
using Grasshopper.Kernel.Data;
using Grasshopper.Kernel.Types;
#endregion

public class Script_Instance : GH_ScriptInstance
{
    #region Notes
    /* 
      Members:
        RhinoDoc RhinoDocument
        GH_Document GrasshopperDocument
        IGH_Component Component
        int Iteration

      Methods (Virtual & overridable):
        Print(string text)
        Print(string format, params object[] args)
        Reflect(object obj)
        Reflect(object obj, string method_name)
    */
    #endregion

    private void RunScript(DataTree<Curve> Slices, ref object OrderedSlices)
    {
        double tol = Rhino.RhinoDoc.ActiveDoc.ModelAbsoluteTolerance;
        DataTree<Brep> SliceSurfaces = new DataTree<Brep>();
        for (int i = 0; i < Slices.BranchCount; i++)
        {
            GH_Path ghp = new GH_Path(Slices.Paths[i]);
            Brep[] planarBreps = Brep.CreatePlanarBreps(Slices.Branches[i], tol);
            if (planarBreps != null && planarBreps.Length > 0)
            {
                SliceSurfaces.AddRange(planarBreps, ghp);
            }
            
        }
        OrderedSlices = OrderSliceSurfaces(SliceSurfaces);
    }

    public Point3d GetSurfaceCentroid(Brep srf)
    {
        Curve[] borders = srf.DuplicateEdgeCurves(false);
        Point3d centroid_sum = new Point3d(0, 0, 0);
        for (int i = 0; i < borders.Length; i++)
        {

        centroid_sum += borders[i].ToPolyline(0.1, 0, 0, 0).ToPolyline().CenterPoint();
        }
        return centroid_sum / borders.Length;
    }

    public DataTree<Brep> OrderSliceSurfaces(DataTree<Brep> SliceSurfaces)
    {
        // loop over datatree and ensure correct order
        for (int i = 0; i < SliceSurfaces.BranchCount - 1; i++)
        {
        // get branches
        var this_branch = SliceSurfaces.Branches[i];
        var next_branch = SliceSurfaces.Branches[i + 1];

        // case 1: this branch one curve and next branch one curve
        if (this_branch.Count == 1 && next_branch.Count == 1)
        {
            Print("Case 1, 1 -> 1 (nothing done)");
            // nothing needs to be done
        }
            // case 2: this branch one curve and next branch multiple curves
        else if (this_branch.Count == 1 && next_branch.Count > 1)
        {
            Print("Case 2, 1 -> N");
            // loop over next branch and find all centerpoints to compare against
            Point3dList ptL = new Point3dList();
            for (int k = 0; k < next_branch.Count; k++)
            {
            //Point3d cpB = AreaMassProperties.Compute(next_branch[k]).Centroid;
            Point3d cpB = GetSurfaceCentroid(next_branch[k]);
            ptL.Add(cpB);
            }
            // create new list for storage
            List<Brep> OrderedNextBranch = new List<Brep>();
            // get curve centerpoint
            // Point3d cpA = AreaMassProperties.Compute(this_branch[0]).Centroid;
            Point3d cpA = GetSurfaceCentroid(this_branch[0]);
            // compare against point3dlist of other centerpoints
            int idx = ptL.ClosestIndex(cpA);
            OrderedNextBranch.Add((Brep) next_branch[idx].Duplicate());
            next_branch.RemoveAt(idx);
            OrderedNextBranch.AddRange(next_branch);
            // clear data
            ptL.Clear();
            // restructure next branch of contours tree
            SliceSurfaces.Branches[i + 1].Clear();
            SliceSurfaces.Branches[i + 1].AddRange(OrderedNextBranch);
        }
            // case 3: this branch and next branch have multiple curves but the same count
        else if (this_branch.Count > 1 && this_branch.Count == next_branch.Count)
        {
            Print("Case 3, N -> N");
            // create new list for storage
            List<Brep> OrderedNextBranch = new List<Brep>();
            // loop over all curves in this branch
            for (int j = 0; j < this_branch.Count; j++)
            {
            if (next_branch.Count < 1) break;
            // loop over next branch and find all centerpoints to compare against
            Point3dList ptL = new Point3dList();
            for (int k = 0; k < next_branch.Count; k++)
            {
                //Point3d cpB = AreaMassProperties.Compute(next_branch[k]).Centroid;
                Point3d cpB = GetSurfaceCentroid(next_branch[k]);
                ptL.Add(cpB);
            }
            // get curve centerpoint
            //Point3d cpA = AreaMassProperties.Compute(this_branch[j]).Centroid;
            Point3d cpA = GetSurfaceCentroid(this_branch[j]);
            // compare against point3dlist of other centerpoints
            int idx = ptL.ClosestIndex(cpA);
            // add closest item to ordered list
            OrderedNextBranch.Add((Brep) next_branch[idx].Duplicate());
            // remove closest item from candidates
            next_branch.RemoveAt(idx);
            // clear data
            ptL.Clear();
            }
            // restructure next branch of contours tree
            SliceSurfaces.Branches[i + 1].Clear();
            SliceSurfaces.Branches[i + 1].AddRange(OrderedNextBranch);
        }
            // case 4: this branch has more curves than next branch
        else if (this_branch.Count > 1 && next_branch.Count > 1 && this_branch.Count > next_branch.Count)
        {
            Print("Case 4, N -> M>N (VERIFY!)");
            // create new list for storage
            List<Brep> OrderedNextBranch = new List<Brep>();
            // loop over all curves in this branch
            for (int j = 0; j < this_branch.Count; j++)
            {
            if (next_branch.Count < 1) break;
            // loop over next branch and find all centerpoints to compare against
            Point3dList ptL = new Point3dList();
            for (int k = 0; k < next_branch.Count; k++)
            {
                //Point3d cpB = AreaMassProperties.Compute(next_branch[k]).Centroid;
                Point3d cpB = GetSurfaceCentroid(next_branch[k]);
                ptL.Add(cpB);
            }
            // get curve centerpoint
            //Point3d cpA = AreaMassProperties.Compute(this_branch[j]).Centroid;
            Point3d cpA = GetSurfaceCentroid(this_branch[j]);
            // compare against point3dlist of other centerpoints
            int idx = ptL.ClosestIndex(cpA);
            // add closest item to ordered list
            OrderedNextBranch.Add((Brep) next_branch[idx].Duplicate());
            // remove closest item from candidates
            next_branch.RemoveAt(idx);
            // clear data
            ptL.Clear();
            }
            // restructure next branch of contours tree
            SliceSurfaces.Branches[i + 1].Clear();
            SliceSurfaces.Branches[i + 1].AddRange(OrderedNextBranch);
        }
            // case 5: this branch has less curves than next branch
        else if (this_branch.Count > 1 && next_branch.Count > 1 && this_branch.Count < next_branch.Count)
        {
            Print("Case 5, N -> M<N (VERIFY)");
            // loop over next branch and find all centerpoints to compare against
            Point3dList ptL = new Point3dList();
            for (int k = 0; k < next_branch.Count; k++)
            {
            //Point3d cpB = AreaMassProperties.Compute(next_branch[k]).Centroid;
            Point3d cpB = GetSurfaceCentroid(next_branch[k]);
            ptL.Add(cpB);
            }
            // create new list for storage
            List<Brep> OrderedNextBranch = new List<Brep>();
            // create duplicate list for looping
            List<Brep> next_branch_dup = new List<Brep>(next_branch);
            // loop over all curves in this branch
            for (int j = 0; j < this_branch.Count; j++)
            {
            // get curve centerpoint
            //Point3d cpA = AreaMassProperties.Compute(this_branch[j]).Centroid;
            Point3d cpA = GetSurfaceCentroid(this_branch[j]);
            // compare against point3dlist of other centerpoints
            int idx = ptL.ClosestIndex(cpA);
            // add closest curve based on comparison to new list
            OrderedNextBranch.Add((Brep) next_branch[idx].Duplicate());
            next_branch_dup.Remove(next_branch[idx]);
            }
            // add remaining curves from next branch to list
            OrderedNextBranch.AddRange(next_branch_dup);
            // clear data
            ptL.Clear();
            // restructure next branch of contours tree
            SliceSurfaces.Branches[i + 1].Clear();
            SliceSurfaces.Branches[i + 1].AddRange(OrderedNextBranch);
        }
            // case 6: this branch has multiple curves but next branch only has one
        else if (this_branch.Count > 1 && next_branch.Count == 1)
        {
            Print("Case 6, N -> 1 (nothing done)");
        }
        }

        return SliceSurfaces;
    }
}
# ---------- end orderbranchingslices ----------
panel_5 = Panel(orderbranchingslices.out)
ordered_slice_srfs = Data(orderbranchingslices.OrderedSlices)

slice_polylines_5 = Data(slice_polylines_3)
pcen_4 = PolygonCenter(Polyline=slice_polylines_5)  # -> CenterV, CenterE, CenterA
avr_3 = Average(Input=pcen_4.CenterA)
xy_5 = XYPlane(Origin=avr_3)
slice_planes = Data(xy_5)

# ----
# comments & notes: if there is only a bottom boundary, these need to be the heatpoints. if there's bottom and top boundary, bottom will be coldppints and top will be heatpoints
only_bot_boundary = Boolean(np_only_bot_boundary)
highpts_2 = Point(highpts)
lowpts_2 = Point(lowpts)
# comments & notes: NON-PLANAR SLICING FOR OPEN OBJECTS
printing_geometry_addfloorfiltered_3 = Geometry(printing_geometry_addfloorfiltered)
miniterations = Slider(2000, range=0..5000)
demesh_2 = DeconstructMesh(Mesh=printing_geometry_addfloorfiltered_3)  # -> Vertices, Faces, Colours, Normals
texturescale = Slider(5, range=0.01..100)
iterationspervertex = Slider(0.2, range=0..1)
filter_33 = StreamFilter(Gate=only_bot_boundary, Stream0=highpts_2, Stream1=lowpts_2)
filter_34 = StreamFilter(Gate=only_bot_boundary, Stream0=lowpts_2)
open_boundaries_sorted_4 = Curve(open_boundaries_sorted)
lng_6 = ListLength(List=demesh_2.Vertices)
coldpts = Point(filter_34)
heatpts = Point(filter_33)
multiplication_2 = Multiplication(A=lng_6, B=iterationspervertex)
max = Maximum(A=miniterations, B=multiplication_2)
heatmethodstatic = HeatMethodStatic(
    RefMesh=printing_geometry_addfloorfiltered_3,
    HeatPoints=heatpts,
    ColdPoints=coldpts,
    IsoFixCurves=open_boundaries_sorted_4,
    TextureScale=texturescale,
    Threshold="1e-6",
    MaxIterations=max)  # -> HeatMesh, Values, Gradient; inputs RefMesh: Mesh, HeatPoints: list of Point3d, ColdPoints: list of Point3d, IsoFixCurves: list of Polyline, TextureScale: Double, Threshold: Double, MaxIterations: Int32
# ---------- heatmethodstatic: C# ----------
// Grasshopper Script Instance
#region Usings

using System;
using System.Linq;
using System.Collections;
using System.Collections.Generic;
using System.Drawing;
using System.Threading.Tasks;

using Rhino;
using Rhino.Geometry;

using Grasshopper;
using Grasshopper.Kernel;
using Grasshopper.Kernel.Data;
using Grasshopper.Kernel.Types;

#r "KangarooSolver.dll"
using KPlankton;
#endregion

public class Script_Instance : GH_ScriptInstance
{
    #region Notes
    /* 
      Members:
        RhinoDoc RhinoDocument
        GH_Document GrasshopperDocument
        IGH_Component Component
        int Iteration

      Methods (Virtual & overridable):
        Print(string text)
        Print(string format, params object[] args)
        Reflect(object obj)
        Reflect(object obj, string method_name)
    */

    /*
    Original Script by Daniel Piker 03/07/2020
    Modified by Max Benjamin Eschenbach May 2021
    version: 250307
    */
    #endregion

    

    private void RunScript(
		Mesh RefMesh,
		List<Point3d> HeatPoints,
		List<Point3d> ColdPoints,
		List<Polyline> IsoFixCurves,
		double TextureScale,
		double Threshold,
		int MaxIterations,
		ref object HeatMesh,
		ref object Values,
		ref object Gradient)
    {
        // set component params
        this.Component.Name = "HeatMethodStatic";
        this.Component.NickName = "HeatMethodStatic";
        this.Component.Category = "FindersKeepers";
        this.Component.SubCategory = "1 Mesh";
        this.Component.Description = ("Static Geodesic Distance Solver using the heat method. Connect at least a " +
        "mesh and some HeatPoints and set MaxIterations to a value of your choice.\n----\n" +
        "This is an implementation of 'The Heat Method for Distance Computation' by Keenan Crane, Clarisse " +
        "Weischedel and Max Wardetzky.\nhttps://www.cs.cmu.edu/~kmcrane/Projects/HeatMethod/\n----\n" +
        "Based on a implementation by Daniel Piker\nsee https://discourse.mcneel.com/t/heat-method/105135/30");
        // set component param descriptions
        this.Component.Params.Input[0].Description = "The mesh for geodesic distance computation. \n{item, Mesh}";
        this.Component.Params.Input[1].Description = ("The points from which the heat spreads during the heat " +
        "diffusion step. The value of these points will stay 1 during the heat diffusion step.\n{list, Point3d}");
        this.Component.Params.Input[2].Description = ("The points that will stay cold during the heat diffusion " +
        "step. Their value will be 0 during this step.\n{list, Point3d}");
        this.Component.Params.Input[3].Description = ("Defines one or many polylines where the iso value will " +
        "be the same at every point of the polyline.\n----\nNOTE - The iso values are allowed to change but " +
        "will stay the same across the whole polyline!\n{list, Polyline}");
        this.Component.Params.Input[4].Description = ("Scaling factor for the TextureCoordinates. " +
        "Defaults to 1.0\n{item, float}");
        this.Component.Params.Input[5].Description = ("Maximum iterations to run the heat diffusion and poisson " +
        "setp for. Defaults to 200.\n{item, int}");

        // set defaults
        bool abort = false;
        if (RefMesh == null)
        {
        this.Component.AddRuntimeMessage(GH_RuntimeMessageLevel.Warning,
            "Input Parameter RefMesh failed to collect data!");
        abort = true;
        }

        if (MaxIterations == 0) MaxIterations = 200;
        if (abort)
        {
        HeatMesh = new DataTree<Object>();
        Values = new DataTree<Object>();
        Gradient = new DataTree<Object>();
        return;
        }

        // init variables
        double[] values;
        double[][] storedweights;
        int[][] storedneighbours;
        Vector3d[] gradient;
        Vector3d[] edgeGradient;
        int[] fix;
        int[][] equalize;
        Mesh ResultMesh;

        // init vars for threshold tracking
        double heat_avg = 0;
        double poisson_avg = 0;
        bool converged = false;

        // INITIALIZE HEAT METHOD -----------------------------------------------

        // convert all quads to triangles
        RefMesh.Faces.ConvertQuadsToTriangles();

        // get kplankton mesh
        KPlanktonMesh ReferencePMesh = KPlankton.RhinoSupport.ToKPlanktonMesh(RefMesh);

        int vc = ReferencePMesh.Vertices.Count;
        storedweights = new double[vc][];
        storedneighbours = new int[vc][];
        values = new double[vc];
        fix = new int[vc];
        equalize = new int[IsoFixCurves.Count][];
        for(int i = 0;i < vc;i++)
        {
            storedweights[i] = ComputeCotanWeights(ReferencePMesh, i);
            storedneighbours[i] = ReferencePMesh.Vertices.GetVertexNeighbours(i);
            for(int j = 0;j < HeatPoints.Count;j++)
            {
                if(ReferencePMesh.Vertices[i].ToPoint3d().DistanceToSquared(HeatPoints[j]) < Rhino.RhinoDoc.ActiveDoc.ModelAbsoluteTolerance)
                {
                    values[i] = 1;
                    fix[i] = 1;
                }
            }
            for(int j = 0;j < ColdPoints.Count;j++)
            {
                if(ReferencePMesh.Vertices[i].ToPoint3d().DistanceToSquared(ColdPoints[j]) < Rhino.RhinoDoc.ActiveDoc.ModelAbsoluteTolerance)
                {
                    values[i] = 0;
                    fix[i] = 2;
                }
            }
        }

        for(int i = 0;i < IsoFixCurves.Count;i++)
        {
            Polyline thisPoly = IsoFixCurves[i];
            int polyCount = thisPoly.Count;
            if(thisPoly[thisPoly.Count - 1].Equals(thisPoly[0])) polyCount--;//don't count first point twice for closed curves
            equalize[i] = new int[polyCount];
            for(int j = 0;j < polyCount;j++)
            {
                for(int k = 0;k < vc;k++)
                {
                    if(ReferencePMesh.Vertices[k].ToPoint3d().DistanceToSquared(thisPoly[j]) < Rhino.RhinoDoc.ActiveDoc.ModelAbsoluteTolerance)
                    {
                        equalize[i][j] = k;
                        break;
                    }
                }
            }
        }

        gradient = new Vector3d[vc];
        ResultMesh = RefMesh.DuplicateMesh();

        edgeGradient = null;

        // HEAT DIFFUSION -----------------------------------------------------

        int heat_iters = 0;
        for(int k = 0; k < MaxIterations; k++)
        {
        heat_iters += 1;
        double[] newValues = new double[values.Length];
        Parallel.For(0, ReferencePMesh.Vertices.Count,
            i => {

            if(fix[i] == 0)
            {
            int[] neighbours = storedneighbours[i];
            double[] weights = storedweights[i];
            double newValue = 0;
            for(int j = 0;j < neighbours.Length;j++)
            {
                newValue += weights[j] * values[neighbours[j]];
            }
            newValues[i] = newValue;
            }
            else newValues[i] = values[i];
            });

        for(int i = 0; i < equalize.Length; i++)
        {
            double avg = 0;
            for(int j = 0;j < equalize[i].Length;j++)avg += newValues[equalize[i][j]];
            avg /= equalize[i].Length;
            for(int j = 0;j < equalize[i].Length;j++) newValues[equalize[i][j]] = avg;
        }
        values = newValues;

        // track average heat value change
        double this_heat_avg = System.Linq.Enumerable.Average(values);
        double heat_avg_change = Math.Abs(this_heat_avg - heat_avg);
        heat_avg = this_heat_avg;

        // break if threshold is reached
        if (heat_avg <= Threshold)
        {
            converged = true;
            break;
        }
        }

        double min = values.Min();
        double max = values.Max();
        double mult = 1.0 / (max - min);
        for(int i = 0;i < values.Length;i++) values[i] = mult * (values[i] - min);

        edgeGradient = null;

        // POISSON AVERAGING --------------------------------------------------

        if(edgeGradient == null)
        {
        gradient = ComputeGradients(ReferencePMesh, values);
        double avgGradientLength = 0;
        for(int i = 0;i < gradient.Length;i++)
        {
            avgGradientLength += gradient[i].Length;
        }
        avgGradientLength /= gradient.Length;

        edgeGradient = new Vector3d[ReferencePMesh.Halfedges.Count / 2];
        for(int i = 0;i < ReferencePMesh.Halfedges.Count / 2;i++)
        {
            int start = ReferencePMesh.Halfedges[2 * i].StartVertex;
            int end = ReferencePMesh.Halfedges[(2 * i) + 1].StartVertex;
            Vector3d sv = gradient[start];
            Vector3d ev = gradient[end];
            Vector3d thisEdgeGradient = sv + ev;
            thisEdgeGradient.Unitize();
            thisEdgeGradient *= avgGradientLength;
            edgeGradient[i] = thisEdgeGradient;
        }
        }

        int ps_iters = 0;
        for(int k = 0; k < MaxIterations; k++)
        {
        ps_iters++;
        double[] heChange = new double[ReferencePMesh.Halfedges.Count];
        Parallel.For(0, ReferencePMesh.Halfedges.Count / 2,
            i => {
            int start = ReferencePMesh.Halfedges[2 * i].StartVertex;
            int end = ReferencePMesh.Halfedges[(2 * i) + 1].StartVertex;
            Vector3d edgeVector = ReferencePMesh.Vertices[end].ToPoint3d() - ReferencePMesh.Vertices[start].ToPoint3d();
            double projected = edgeVector * edgeGradient[i];
            double currentDifference = values[end] - values[start];
            double change = currentDifference - projected;
            heChange[2 * i] = 1 * change;
            heChange[(2 * i) + 1] = -1 * change;
            });

        Parallel.For(0, ReferencePMesh.Vertices.Count,
            i => {
            {
            {
                double[] weights = storedweights[i];
                int[] halfedges = ReferencePMesh.Vertices.GetHalfedges(i);
                for(int j = 0;j < halfedges.Length;j++)
                {
                values[i] += heChange[halfedges[j]] * weights[j];
                }
            }
            }
            });

        double this_poisson_avg = 0;
        for(int i = 0;i < equalize.Length;i++)
        {
            double avg = 0;
            for(int j = 0;j < equalize[i].Length;j++)avg += values[equalize[i][j]];
            avg /= equalize[i].Length;
            for(int j = 0;j < equalize[i].Length;j++) values[equalize[i][j]] = avg;
            this_poisson_avg = avg;
        }

        // track average value change for poisson step
        double poisson_avg_change = Math.Abs(this_poisson_avg - poisson_avg);
        poisson_avg = this_poisson_avg;

        /*
        if (poisson_avg_change <= Threshold)
        {
            converged = true;
            break;
        }
        */
        }

        if (converged == true)
        {
        this.Component.Message = String.Format("Converged.\n{0} Heat Diffusion iterations", heat_iters);
        }
        else
        {
        this.Component.Message = "MaxIterations reached!";
        }


        // SET TEXTURE COORDINATES ----------------------------------------------

        for(int i = 0;i < ResultMesh.Vertices.Count;i++)
        {
        ResultMesh.TextureCoordinates.SetTextureCoordinate(i, new Point2f(0, (float) (values[i] * TextureScale)));
        }

        // OUTPUT ----------------------------------------------------------------

        // input mesh with adjusted texture coordinates
        HeatMesh = ResultMesh;
        // the scalar values and gradient vectors per vertex
        Values = values;
        Gradient = gradient;
    }

    private static Vector3d[] ComputeGradients(KPlanktonMesh KPM, double[] values)
    {
        // compute halfedge gradients
        Vector3d[] halfedgeGradients = new Vector3d[KPM.Halfedges.Count];
        for(int i = 0;i < KPM.Halfedges.Count / 2;i++)
        {
        int start = KPM.Halfedges[2 * i].StartVertex;
        int end = KPM.Halfedges[2 * i + 1].StartVertex;
        Vector3d v = KPM.Vertices[end].ToPoint3d() - KPM.Vertices[start].ToPoint3d();
        double lengthSquared = v.SquareLength;
        double diff = values[end] - values[start];
        Vector3d edgeGradient = v * (diff / lengthSquared);
        halfedgeGradients[2 * i] = halfedgeGradients[2 * i + 1] = edgeGradient;
        }

        // compute vertex gradients from halfedge gradients
        Vector3d[] vertexGradients = new Vector3d[KPM.Vertices.Count];
        for(int i = 0;i < KPM.Vertices.Count;i++)
        {
        double[] weights = ComputeCotanWeights(KPM, i);
        Vector3d gradient = new Vector3d();
        int[] halfedges = KPM.Vertices.GetHalfedges(i);
        for(int j = 0;j < halfedges.Length;j++)
        {
            gradient += halfedgeGradients[halfedges[j]] * weights[j];
        }
        vertexGradients[i] = gradient;
        }
        return vertexGradients;
    }

    private static double[] ComputeCotanWeights(KPlanktonMesh KPM, int i)
    {
        int[] Neighbours = KPM.Vertices.GetVertexNeighbours(i);
        Point3d Vertex = KPM.Vertices[i].ToPoint3d();
        int valence = KPM.Vertices.GetValence(i);
        Point3d[] NeighbourPts = new Point3d[valence];
        Vector3d[] Radial = new Vector3d[valence];
        Vector3d[] Around = new Vector3d[valence];
        double[] CotWeight = new double[valence];
        double WeightSum = 0;
        for (int j = 0; j < valence; j++)
        {
        NeighbourPts[j] = KPM.Vertices[Neighbours[j]].ToPoint3d();
        Radial[j] = NeighbourPts[j] - Vertex;
        }
        for (int j = 0; j < valence; j++)
        {
        Around[j] = NeighbourPts[(j + 1) % valence] - NeighbourPts[j];
        }
        int[] halfEdges = KPM.Vertices.GetHalfedges(i);
        for (int j = 0; j < Neighbours.Length; j++)
        {
        int previous = (j + valence - 1) % valence;
        int next = (j + 1) % valence;

        Vector3d Cross1 = Vector3d.CrossProduct(Radial[previous], Around[previous]);
        double Dot1 = Radial[previous] * Around[previous];
        double cwa = Math.Abs(Dot1 / Cross1.Length);

        Vector3d Cross2 = Vector3d.CrossProduct(Radial[next], Around[j]);
        double Dot2 = Radial[next] * Around[j];
        double cwb = Math.Abs(Dot2 / Cross2.Length);

        if(KPM.Halfedges[halfEdges[j]].AdjacentFace == -1){cwa = 0;}
        if(KPM.Halfedges[KPM.Halfedges.GetPairHalfedge(halfEdges[j])].AdjacentFace == -1){cwb = 0;}
        CotWeight[j] = cwa + cwb;
        WeightSum += CotWeight[j];
        }
        for (int j = 0; j < CotWeight.Length; j++) CotWeight[j] /= WeightSum;
        return CotWeight;
    }

}
# ---------- end heatmethodstatic ----------
heatvalues = Data(heatmethodstatic.Values)
heatmesh = Mesh(heatmethodstatic.HeatMesh)

# ----
# comments & notes: filter out open slice curves and <null>'s from ordered slice-surfaces
ordered_slice_srfs_2 = Brep(ordered_slice_srfs)
slice_polylines_6 = Data(slice_polylines_3)
branching_curves_2 = Data(branching_curves)
slice_planes_2 = Data(slice_planes)
null_4 = NullItem(Item=ordered_slice_srfs_2)  # -> NullFlags, InvalidFlags, Description
cls_4 = Closed(Curve=slice_polylines_6)  # -> Closed, Periodic
filter_35 = StreamFilter(Gate=branching_curves_2, Stream1=null_4.InvalidFlags)
filter_36 = StreamFilter(Gate=branching_curves_2, Stream1=null_4.NullFlags)
or_7 = GateOr(A=filter_36, B=filter_35, C=invert(cls_4.Closed))
dispatch_2 = Dispatch(List=slice_planes_2, DispatchPattern=or_7)  # -> ListA, ListB
dispatch_3 = Dispatch(List=slice_polylines_6, DispatchPattern=or_7)  # -> ListA, ListB
dispatch_4 = Dispatch(List=ordered_slice_srfs_2, DispatchPattern=or_7)  # -> ListA, ListB
clean = CleanTree(RemoveNulls=True, RemoveInvalid=True, RemoveEmpty=True, Tree=dispatch_2.ListB)
clean_2 = CleanTree(RemoveNulls=True, RemoveInvalid=True, RemoveEmpty=True, Tree=dispatch_3.ListB)
clean_3 = CleanTree(RemoveNulls=True, RemoveInvalid=True, RemoveEmpty=True, Tree=dispatch_4.ListB)
clean_4 = CleanTree(RemoveNulls=True, RemoveInvalid=True, RemoveEmpty=True, Tree=dispatch_3.ListA)
ordered_slice_srfs_closed = Data(clean_3)
slice_curves_open = Curve(clean_4)
slice_curves_closed = Curve(clean_2)
slice_planes_3 = Data(clean)

# ----
# comments & notes: iso-contouring based on heatmesh texture coordinates
# comments & notes: "reverse" the order of the data tree (non-planar contour curves) if there is only a bottom boundary (high values will be at the bottom instead of at the top, hence curves need to be reversed in order).
np_only_bot_boundary_2 = Boolean(np_only_bot_boundary)
layer_height_5 = Data(layer_height)
heatmesh_2 = Mesh(heatmesh)
bbox_5 = BoundingBox(Content=heatmesh_2, Plane=PlaneXY(0, 0, 0), UnionBox=True)  # -> Box, Box_2
debox_4 = DeconstructBox(Box=bbox_5.Box)  # -> Plane, X, Y, Z
dedomain_4 = DeconstructDomain(Domain=debox_4.Z)  # -> Start, End
subtraction = Subtraction(A=dedomain_4.End, B=dedomain_4.Start)
division_3 = Division(A=subtraction, B=layer_height_5)
round = Round(Number=division_3)  # -> Nearest, Floor, Ceiling
isocontourmeshcount = IsoContourMeshCount(InMesh=heatmesh_2, Count=round.Ceiling)  # -> out, Contours, DebuggingOut; inputs InMesh: Mesh, Count: Int32
# ---------- isocontourmeshcount: C# ----------
// Grasshopper Script Instance
#region Usings
using System;
using System.Linq;
using System.Collections;
using System.Collections.Generic;
using System.Drawing;

using Rhino;
using Rhino.Geometry;

using System.Threading.Tasks;
using System.Collections.Concurrent;
using Rhino.Collections;

using Grasshopper;
using Grasshopper.Kernel;
using Grasshopper.Kernel.Data;
using Grasshopper.Kernel.Types;
#endregion

public class Script_Instance : GH_ScriptInstance
{
    #region Notes
    /* 
      Members:
        RhinoDoc RhinoDocument
        GH_Document GrasshopperDocument
        IGH_Component Component
        int Iteration

      Methods (Virtual & overridable):
        Print(string text)
        Print(string format, params object[] args)
        Reflect(object obj)
        Reflect(object obj, string method_name)
    */
    #endregion

    private void RunScript(
		Mesh InMesh,
		int Count,
		ref object Contours,
		ref object DebuggingOut)
    {
        
    /*
    Original Script by Daniel Piker 03/07/2020
    Modified by Max Benjamin Eschenbach May 2024
    version: 250307
    */

    // set component params
    this.Component.Name = "IsoContourMeshCount";
    this.Component.NickName = "IsoContourMeshCount";
    this.Component.Category = "FindersKeepers";
    this.Component.SubCategory = "1 Mesh";

    // sanitize data input
    if (InMesh == null)
    {
      this.Component.AddRuntimeMessage(GH_RuntimeMessageLevel.Warning,
        "Input Parameter InMesh failed to collect data!");
      Contours = new Grasshopper.DataTree<PolylineCurve>();
    }
    // only do something if mesh is present
    if (InMesh != null && Count > 0)
    {
      // Contours = OrderSliceCurves(CreateContours(InMesh, Count));
      var UnorderedContours = CreateContours(InMesh, Count);
      Contours = OrderSliceCurves(UnorderedContours);
    }
    else
    {
      this.Component.AddRuntimeMessage(GH_RuntimeMessageLevel.Warning, "Input Parameters failed to collect data!");
    }
    }

  public List<Curve> FindBoundaries(Mesh M)
  {
    // get naked mesh edges
    Polyline[] NakedEdges = M.GetNakedEdges();

    // join all the resulting naked edges
    Curve[] Boundaries = Curve.JoinCurves(NakedEdges.Select(pl => pl.ToPolylineCurve()));

    return Boundaries.ToList();
  }

  public DataTree<PolylineCurve> CreateContours(Mesh M, int Count)
  {
    // subtract from the count to make count match the outcome
    Count -= 2;

    // init concurrent bag for storing contours
    List<PolylineCurve>[] contours = new List<PolylineCurve>[Count];

    // extract gradient from texture coordinates
    double[] values = new double[M.Vertices.Count];
    for(int i = 0; i < M.Vertices.Count; i++) values[i] = M.TextureCoordinates[i].Y;

    // get bounds of gradient value domain
    double target_min = values.Min();
    double target_max = values.Max();

    // compute stepsize for iso values
    // increment count to avoid catching boundary extremes
    // (they will be found later)
    double stepsize = (target_max - target_min) / (Count + 1.0);

    // create contours in parallel
    Parallel.For(0, Count,
      j => {
      // compute current iso value
      double iso = target_min + ((j + 1) * stepsize);

      // init list for geometry storage
      List<Curve> curves = new List<Curve>();

      // loop over all faces
      for(int i = 0; i < M.Faces.Count; i++)
      {
        int va = M.Faces[i].A;
        int vb = M.Faces[i].B;
        int vc = M.Faces[i].C;

        double a = M.TextureCoordinates[va].Y - iso;
        double b = M.TextureCoordinates[vb].Y - iso;
        double c = M.TextureCoordinates[vc].Y - iso;

        Point3d pa = M.Vertices.Point3dAt(va);
        Point3d pb = M.Vertices.Point3dAt(vb);
        Point3d pc = M.Vertices.Point3dAt(vc);

        List<Point3d> ends = new List<Point3d>();

        // find line segment
        if(a < 0 != b < 0)
        {
          double wa = b / (b - a);
          double wb = 1 - wa;
          ends.Add(wa * pa + wb * pb);
        }
        if(a < 0 != c < 0)
        {
          double wa = c / (c - a);
          double wc = 1 - wa;
          ends.Add(wa * pa + wc * pc);
        }
        if(c < 0 != b < 0)
        {
          double wb = c / (c - b);
          double wc = 1 - wb;
          ends.Add(wb * pb + wc * pc);
        }

        // if line segment is complete add it to list
        if(ends.Count == 2)
        {
          curves.Add(new LineCurve(ends[0], ends[1]));
        }
      }

      // join contour lines
      Curve[] jcrvs = Curve.JoinCurves(curves);

      // init list for storing closed curves
      List<PolylineCurve> clsdcrvs = new List<PolylineCurve>();

      // only add closed curves
      for (int i = 0; i < jcrvs.Length; i++)
      {
        if (jcrvs[i].IsClosed)
        {
          clsdcrvs.Add(jcrvs[i] as PolylineCurve);
        }
      }
      // add list of closed curves to array
      contours[j] = clsdcrvs;

      // end parallel for
      });

    // convert array results to datatree for output
    DataTree<PolylineCurve> ContourTree = new DataTree<PolylineCurve>();
    for (int i = 0; i < contours.Length; i++)
    {
      // create path in datatre
      // increment i because of intentionally missing extremes
      GH_Path path = new GH_Path(0, i + 1);
      ContourTree.AddRange(contours[i], path);
    }

    // find extreme boundaries seperately
    // this is necessary because of stability issues
    // with the iso routine near the boundaries
    List<Curve> Boundaries = FindBoundaries(M);

    // loop through boundaries and for every boundary
    // find the corresponding tree path
    for (int i = 0; i < Boundaries.Count; i++)
    {
      // init vars for closest branch and minimum distance
      int closestBranch = 0;
      double minDist = double.MaxValue;
      // get closest point on every contour curve
      for (int j = 1; j < ContourTree.BranchCount; j++)
      {
        Point3d onCrv;
        Point3d onObj;
        int wG;
        // get cp pair for every branch
        bool ret = Boundaries[i].ClosestPoints(ContourTree.Branches[j], out onCrv, out onObj, out wG);
        // measure distance
        double dist = onCrv.DistanceTo(onObj);
        // set minimum distance
        if (dist < minDist)
        {
          minDist = dist;
          closestBranch = j;
        }
      }
      // correct closest branch
      if (closestBranch == 1)
      {
        closestBranch = 0;
      }
      else if (closestBranch == ContourTree.BranchCount - 1)
      {
        closestBranch = Count + 1;
      }
      else
      {
        continue;
      }

      //Print(closestBranch.ToString());

      // insert into contour tree
      GH_Path ghp = new GH_Path(0, closestBranch);
      ContourTree.EnsurePath(ghp);
      ContourTree.Add(Boundaries[i] as PolylineCurve, ghp);
    }

    // return tree with closed contour curves
    return ContourTree;
  }

  public DataTree<PolylineCurve> OrderSliceCurves(DataTree<PolylineCurve> ContourCurves)
  {
    // create copy of datatree to avoid messing up things
    DataTree<PolylineCurve> SliceCurves = new DataTree<PolylineCurve>(ContourCurves);

    // loop over datatree and ensure correct order
    for (int i = 0; i < SliceCurves.BranchCount - 1; i++)
    {
      // get branches
      var this_branch = SliceCurves.Branches[i];
      var next_branch = SliceCurves.Branches[i + 1];

      // case 1: this branch one curve and next branch one curve
      if (this_branch.Count == 1 && next_branch.Count == 1)
      {
        //Print("Case 1, 1 -> 1 (nothing done)");
        // nothing needs to be done
      }
        // case 2: this branch one curve and next branch multiple curves
      else if (this_branch.Count == 1 && next_branch.Count > 1)
      {
        //Print("Case 2, 1 -> N");
        // loop over next branch and find all centerpoints to compare against

        Point3dList ptL = new Point3dList();
        for (int k = 0; k < next_branch.Count; k++)
        {
          Point3d cpB = next_branch[k].ToPolyline().CenterPoint();
          ptL.Add(cpB);
        }
        // create new list for storage
        List<PolylineCurve> OrderedNextBranch = new List<PolylineCurve>();
        // get curve centerpoint
        Point3d cpA = this_branch[0].ToPolyline().CenterPoint();
        // compare against point3dlist of other centerpoints
        int idx = ptL.ClosestIndex(cpA);
        OrderedNextBranch.Add(next_branch[idx].Duplicate() as PolylineCurve);
        next_branch.RemoveAt(idx);
        OrderedNextBranch.AddRange(next_branch);
        // clear data
        ptL.Clear();
        // restructure next branch of contours tree
        SliceCurves.Branches[i + 1].Clear();
        SliceCurves.Branches[i + 1].AddRange(OrderedNextBranch);
      }
        // case 3: this branch and next branch have multiple curves but the same count
      else if (this_branch.Count > 1 && this_branch.Count == next_branch.Count)
      {
        //Print("Case 3, N -> N");
        // create new list for storage
        List<PolylineCurve> OrderedNextBranch = new List<PolylineCurve>();
        // loop over all curves in this branch
        for (int j = 0; j < this_branch.Count; j++)
        {
          if (next_branch.Count < 1) break;
          // loop over next branch and find all centerpoints to compare against
          Point3dList ptL = new Point3dList();
          for (int k = 0; k < next_branch.Count; k++)
          {
            Point3d cpB = next_branch[k].ToPolyline().CenterPoint();
            ptL.Add(cpB);
          }
          // get curve centerpoint
          Point3d cpA = this_branch[j].ToPolyline().CenterPoint();
          // compare against point3dlist of other centerpoints
          int idx = ptL.ClosestIndex(cpA);
          // add closest item to ordered list
          OrderedNextBranch.Add(next_branch[idx].Duplicate() as PolylineCurve);
          // remove closest item from candidates
          next_branch.RemoveAt(idx);
          // clear data
          ptL.Clear();
        }
        // restructure next branch of contours tree
        SliceCurves.Branches[i + 1].Clear();
        SliceCurves.Branches[i + 1].AddRange(OrderedNextBranch);
      }
        // case 4: this branch has more curves than next branch
      else if (this_branch.Count > 1 && next_branch.Count > 1 && this_branch.Count > next_branch.Count)
      {
        //Print("Case 4, N -> M>N (VERIFY!)");
        // create new list for storage
        List<PolylineCurve> OrderedNextBranch = new List<PolylineCurve>();
        // loop over all curves in this branch
        for (int j = 0; j < this_branch.Count; j++)
        {
          if (next_branch.Count < 1) break;
          // loop over next branch and find all centerpoints to compare against
          Point3dList ptL = new Point3dList();
          for (int k = 0; k < next_branch.Count; k++)
          {
            
            // Point3d cpB = AreaMassProperties.Compute(next_branch[k]).Centroid;
            Point3d cpB = next_branch[k].ToPolyline().CenterPoint();
            ptL.Add(cpB);
          }
          // get curve centerpoint
          //  Point3d cpA = AreaMassProperties.Compute(this_branch[j]).Centroid;
          Point3d cpA = this_branch[j].ToPolyline().CenterPoint();
          // compare against point3dlist of other centerpoints
          int idx = ptL.ClosestIndex(cpA);
          // add closest item to ordered list
          OrderedNextBranch.Add(next_branch[idx].Duplicate() as PolylineCurve);
          // remove closest item from candidates
          next_branch.RemoveAt(idx);
          // clear data
          ptL.Clear();
        }
        // restructure next branch of contours tree
        SliceCurves.Branches[i + 1].Clear();
        SliceCurves.Branches[i + 1].AddRange(OrderedNextBranch);
      }
        // case 5: this branch has less curves than next branch
      else if (this_branch.Count > 1 && next_branch.Count > 1 && this_branch.Count < next_branch.Count)
      {
        //Print("Case 5, N -> M<N (VERIFY)");
        // loop over next branch and find all centerpoints to compare against
        Point3dList ptL = new Point3dList();
        for (int k = 0; k < next_branch.Count; k++)
        {
          Point3d cpB = next_branch[k].ToPolyline().CenterPoint();
          ptL.Add(cpB);
        }
        // create new list for storage
        List<PolylineCurve> OrderedNextBranch = new List<PolylineCurve>();
        // create duplicate list for looping
        List<PolylineCurve> next_branch_dup = new List<PolylineCurve>(next_branch);
        // loop over all curves in this branch
        for (int j = 0; j < this_branch.Count; j++)
        {
          // get curve centerpoint
          Point3d cpA = this_branch[j].ToPolyline().CenterPoint();
          // compare against point3dlist of other centerpoints
          int idx = ptL.ClosestIndex(cpA);
          // add closest curve based on comparison to new list
          OrderedNextBranch.Add(next_branch[idx].Duplicate() as PolylineCurve);
          next_branch_dup.Remove(next_branch[idx]);
        }
        // add remaining curves from next branch to list
        OrderedNextBranch.AddRange(next_branch_dup);
        // clear data
        ptL.Clear();
        // restructure next branch of contours tree
        SliceCurves.Branches[i + 1].Clear();
        SliceCurves.Branches[i + 1].AddRange(OrderedNextBranch);
      }
        // case 6: this branch has multiple curves but next branch only has one
      else if (this_branch.Count > 1 && next_branch.Count == 1)
      {
        //Print("Case 6, N -> 1 (nothing done)");
      }
    }

    return SliceCurves;
  }

}
# ---------- end isocontourmeshcount ----------
panel_6 = Panel(isocontourmeshcount.out)
contours = Data(isocontourmeshcount.Contours)
filter_37 = StreamFilter(Gate=np_only_bot_boundary_2, Stream1=contours)
tstat_6 = TreeStatistics(Tree=filter_37)  # -> reverse(Paths), Length, Count
branch_6 = TreeBranch(Tree=filter_37, Path=tstat_6.Paths, MaintainPaths=False)
filter_38 = StreamFilter(Gate=np_only_bot_boundary_2, Stream0=contours, Stream1=branch_6)
contours_2 = Data(filter_38)

# ----
# comments & notes: ensure all curves are counter-clock-wise (CCW)
# comments & notes: use a property of planar breps to easily decide which curves are inside and which are outside
ordered_slice_srfs_closed_2 = Data(ordered_slice_srfs_closed)
branching_curves_3 = Data(branching_curves)
slice_polylines_7 = Data(slice_curves_closed)
inneroutercurves = CSharpScript(SliceSurfaces=ordered_slice_srfs_closed_2)  # -> InnerCurves, OuterCurves; inputs SliceSurfaces: tree of Brep; same code as inneroutercurves
filter_39 = StreamFilter(Gate=branching_curves_3, Stream0=slice_polylines_7, Stream1=inneroutercurves.OuterCurves)
pcen_5 = PolygonCenter(Polyline=filter_39)  # -> CenterV, CenterE, CenterA
pcen_6 = PolygonCenter(Polyline=inneroutercurves.InnerCurves)  # -> CenterV, CenterE, CenterA
Z_4 = UnitZ(Factor=1)
Z_5 = UnitZ(Factor=1)
pl = PlaneNormal(Origin=pcen_5.CenterA, ZAxis=Z_4)
pl_2 = PlaneNormal(Origin=pcen_6.CenterV, ZAxis=Z_5)
crvensureccw = CSharpScript(Crv=inneroutercurves.InnerCurves, Pln=pl_2)  # -> CCWCrv; inputs Crv: Curve, Pln: Plane
# ---------- crvensureccw: C# ----------
// Grasshopper Script Instance
#region Usings
using System;
using System.Linq;
using System.Collections;
using System.Collections.Generic;
using System.Drawing;

using Rhino;
using Rhino.Geometry;

using Grasshopper;
using Grasshopper.Kernel;
using Grasshopper.Kernel.Data;
using Grasshopper.Kernel.Types;
#endregion

public class Script_Instance : GH_ScriptInstance
{
    #region Notes
    /* 
      Members:
        RhinoDoc RhinoDocument
        GH_Document GrasshopperDocument
        IGH_Component Component
        int Iteration

      Methods (Virtual & overridable):
        Print(string text)
        Print(string format, params object[] args)
        Reflect(object obj)
        Reflect(object obj, string method_name)
    */
    #endregion

    private void RunScript(Curve Crv, Plane Pln, ref object CCWCrv)
    {
        if (Crv.ClosedCurveOrientation(Pln) == CurveOrientation.Clockwise)
        {
            Crv.Reverse();
        }
        CCWCrv = Crv;
    }
}
# ---------- end crvensureccw ----------
crvensureccw_2 = CSharpScript(Crv=filter_39, Pln=pl)  # -> CCWCrv; inputs Crv: Curve, Pln: Plane; same code as crvensureccw
clean_5 = CleanTree(RemoveNulls=True, RemoveInvalid=True, RemoveEmpty=False, Tree=crvensureccw)
slice_curves_clsd_outer = Curve(crvensureccw_2)
slice_curves_clsd_inner = Curve(clean_5)

# ----
# comments & notes: increment paths if floor is added to open, np-sliced object to prevent merging errors with synthesized floor layers
add_floor_to_open_objects_4 = Data(add_floor_to_open_objects)
contours_3 = Data(contours_2)
filter_40 = StreamFilter(Gate=add_floor_to_open_objects_4, Stream1=contours_3)
tstat_7 = TreeStatistics(Tree=filter_40)  # -> Paths, Length, Count
dpath_3 = DeconstructPath(Branch=tstat_7.Paths)
lng_7 = ListLength(List=dpath_3)  # -> expr("x-1", Length)
floor_layer_count_5 = Data(floor_layer_count)
split_2 = SplitList(List=dpath_3, Index=lng_7)  # -> ListA, ListB
addition = Addition(A=split_2.ListB, B=floor_layer_count_5)
merge_2 = Merge(Data1=split_2.ListA, Data2=addition)
path = ConstructPath(Indices=merge_2)  # -> flatten(Branch)
replace = ReplacePaths(Data=filter_40, Search=tstat_7.Paths, Replace=path)
filter_41 = StreamFilter(Gate=add_floor_to_open_objects_4, Stream0=contours_3, Stream1=replace)
np_slice_curves = Curve(filter_41)

# ----
# comments & notes: dispatch these curves, explode and join to get a single curve again
# comments & notes: check if input curve has self intersections (for example when creating a self-intersecting loft to control infill design)
slice_curves_clsd_outer_2 = Curve(slice_curves_clsd_outer)
slice_curves_length_thresholded_3 = Data(slice_curves_length_thresholded)
tstat_8 = TreeStatistics(Tree=slice_curves_clsd_outer_2)  # -> Paths, Length, Count
branch_7 = TreeBranch(Tree=slice_curves_length_thresholded_3, Path=tstat_8.Paths, MaintainPaths=True)
cx = CurveSelf(Curve=branch_7)  # -> Points, Params
pshift_5 = ShiftPaths(Data=cx.Points, Offset=-1)
lng_8 = ListLength(List=pshift_5)
larger_9 = LargerThan(FirstNumber=lng_8, SecondNumber="0")  # -> LargerThan, OrEqualTo
dispatch_5 = Dispatch(List=slice_curves_clsd_outer_2, DispatchPattern=larger_9.LargerThan)  # -> ListA, ListB
explode_4 = Explode(Curve=dispatch_5.ListA, Recursive=True)  # -> Segments, Vertices
pshift_6 = ShiftPaths(Data=explode_4.Segments, Offset=-1)
clean_6 = CleanTree(RemoveNulls=True, RemoveInvalid=True, RemoveEmpty=True, Tree=pshift_6)
join_3 = JoinCurves(Curves=clean_6, Preserve=False)
pshift_7 = ShiftPaths(Data=join_3, Offset=-1)
merge_3 = Merge(Data1=pshift_7, Data2=dispatch_5.ListB)
slice_curves_clsd_outer_rejoined = Curve(merge_3)

# ----
# comments & notes: NEW ALGORITHM TO CLASSIFY LAYERS
# TO BE VERIFIED!
regular_floor_slicing_enabled_2 = Boolean(regular_floor_slicing_enabled)
threshold = Slider(5, range=0..100)
slice_curves_clsd_inner_2 = Curve(slice_curves_clsd_inner)
slice_curves_clsd_outer_3 = Curve(slice_curves_clsd_outer_rejoined)
floor_layer_count_6 = Data(floor_layer_count)
cap_layer_count_2 = Data(cap_layer_count)
classifyclayprintlayers = CSharpScript(
    InnerCurves=slice_curves_clsd_inner_2,
    OuterCurves=slice_curves_clsd_outer_3,
    FloorLayerCount=floor_layer_count_6,
    CapLayerCount=cap_layer_count_2,
    FloorEnabled=regular_floor_slicing_enabled_2,
    Threshold=threshold,
    Debug=Toggle(True))  # -> DebugMessage, OuterFloorLayers, InnerFloorLayers, OuterRegularLayers, InnerRegularLayers, OuterOverhangLayers, InnerOverhangLayers, OuterCapLayers, InnerCapLayers; inputs InnerCurves: tree of Curve, OuterCurves: tree of Curve, FloorLayerCount: Int32, CapLayerCount: Int32, FloorEnabled: Boolean, Threshold: Double, Debug: Boolean
# ---------- classifyclayprintlayers: C# ----------
// Grasshopper Script Instance
#region Usings
using System;
using System.Linq;
using System.Collections;
using System.Collections.Generic;
using System.Drawing;

using Rhino;
using Rhino.Geometry;

using Grasshopper;
using Grasshopper.Kernel;
using Grasshopper.Kernel.Data;
using Grasshopper.Kernel.Types;
using TreeExtensions;
#endregion

public class Script_Instance : GH_ScriptInstance
{
    #region Notes
    /* 
      Members:
        RhinoDoc RhinoDocument
        GH_Document GrasshopperDocument
        IGH_Component Component
        int Iteration

      Methods (Virtual & overridable):
        Print(string text)
        Print(string format, params object[] args)
        Reflect(object obj)
        Reflect(object obj, string method_name)
    */
    #endregion

    private void RunScript(
		DataTree<Curve> InnerCurves,
		DataTree<Curve> OuterCurves,
		int FloorLayerCount,
		int CapLayerCount,
		bool FloorEnabled,
		double Threshold,
		bool Debug,
		ref object DebugMessage,
		ref object OuterFloorLayers,
		ref object InnerFloorLayers,
		ref object OuterRegularLayers,
		ref object InnerRegularLayers,
		ref object OuterOverhangLayers,
		ref object InnerOverhangLayers,
		ref object OuterCapLayers,
		ref object InnerCapLayers)
    {
        // Output DataTrees (OuterCurves)
        DataTree<Curve> OuterFloors = new DataTree<Curve>();
        DataTree<Curve> OuterRegulars = new DataTree<Curve>();
        DataTree<Curve> OuterOverhangs = new DataTree<Curve>();
        DataTree<Curve> OuterCaps = new DataTree<Curve>();
        // Output DataTrees (InnerCurves)
        DataTree<Curve> InnerFloors = new DataTree<Curve>();
        DataTree<Curve> InnerRegulars = new DataTree<Curve>();
        DataTree<Curve> InnerOverhangs = new DataTree<Curve>();
        DataTree<Curve> InnerCaps = new DataTree<Curve>();
        // Debugging Message(s)
        DataTree<string> ReportMessages = new DataTree<string>();
        // DataTree Paths
        GH_Path lastPath;
        GH_Path thisPath;
        GH_Path nextPath;
        // Outer Layers
        List<Curve> lastLayer;
        List<Curve> thisLayer;
        List<Curve> nextLayer;
        // Inner Layers
        List<Curve> lastInnerLayer;
        List<Curve> thisInnerLayer;
        List<Curve> nextInnerLayer;
        
        // Loop over all outercurve branches in pairs
        if (OuterCurves.BranchCount == FloorLayerCount || InnerCurves.BranchCount == FloorLayerCount)
        {
            if (OuterCurves.BranchCount == FloorLayerCount)
            {
                OuterFloors = OuterCurves;
            }
            if (InnerCurves.BranchCount == FloorLayerCount)
            {
                InnerFloors = InnerCurves;
            }
            DebugMessage = ReportMessages;
            OuterFloorLayers = OuterFloors;
            OuterRegularLayers = OuterRegulars;
            OuterOverhangLayers = OuterOverhangs;
            OuterCapLayers = OuterCaps;
            InnerFloorLayers = InnerFloors;
            InnerRegularLayers = InnerRegulars;
            InnerOverhangLayers = InnerOverhangs;
            InnerCapLayers = InnerCaps;
            return;
        }
        
        for (int i = 0; i < OuterCurves.BranchCount - 1; i++)
        {
            // THIS LAYER'S DATA ------------------------------------------------------
            thisPath = new GH_Path(OuterCurves.Paths[i]);
            thisLayer = OuterCurves.Branches[i];
            // FIRST LAYER(S) FLOOR DEFINITION -----------------------------------------
            if (i == 0 | i < FloorLayerCount)
            {
                // ADD INITIAL LAYER TO FLOORS
                if (FloorEnabled && FloorLayerCount > 0)
                {
                    OuterFloors.AddRange(thisLayer, thisPath);
                    InnerFloors.AddRangeGracefully(InnerCurves.Branch(thisPath), thisPath);
                    continue;
                }
                else
                {
                    // THISLAYER IS REGULAR/SPARSE LAYER
                    OuterRegulars.AddRange(thisLayer, thisPath);
                    InnerRegulars.AddRangeGracefully(InnerCurves.Branch(thisPath), thisPath);
                    continue;
                }
                
            }
            // GET NEXT AND LAST LAYER DATA ------------------------------------------
            // Paths
            lastPath = new GH_Path(OuterCurves.Paths[i - 1]);
            nextPath = new GH_Path(OuterCurves.Paths[i + 1]);
            // Layers
            lastLayer = OuterCurves.Branches[i - 1];
            nextLayer = OuterCurves.Branches[i + 1];
            // AREA COMPUTATION AND DIFFERENC -----------------------------------------
            // Get cumulative area of outer layer curves
            double lastArea = this.GetLayerArea(lastLayer);
            double thisArea = this.GetLayerArea(thisLayer);
            double nextArea = this.GetLayerArea(nextLayer);
            // Compute area difference between outer layers
            double diffLast = thisArea - lastArea;
            double diffNext = thisArea - nextArea;
            // Compute percentage difference
            double percLast = (diffLast / thisArea) * 100;
            double percNext = (diffNext / thisArea) * 100;
            // REPORT MESSAGE
            if (Debug)
            {
                ReportMessages.Add(
                    string.Format(
                        "LAST {2} <- {0}% <--| {3} THIS {3} |--> {1}% -> {4} NEXT",
                        Math.Round(percLast, 2).ToString(),
                        Math.Round(percNext, 2).ToString(),
                        lastPath.ToString(),
                        thisPath.ToString(),
                        nextPath.ToString()
                    ), new GH_Path(0, 1)
                );
            }
            
            // CAP CLASSIFICATION --------------------------------------------------------
            if ((percNext > 0) && (Math.Abs(percNext) > Threshold) && CapLayerCount > 0)
            {
                // THISLAYER IS LARGER THAN NEXT LAYER --> THISLAYER IS CAP LAYER
                OuterCaps.AddRange(thisLayer, thisPath);
                InnerCaps.AddRangeGracefully(InnerCurves.Branch(thisPath), thisPath);
                // RE-CLASSIFY CAPS BACKWARDS
                for (int j = 1; j < CapLayerCount && (i - j) >= 0; j++) 
                {
                    GH_Path prevPath = new GH_Path(OuterCurves.Paths[i - j]);
                    List<Curve> prevLayer = OuterCurves.Branches[i - j];
                    // Add to CAP and remove REGULAR - Leave as is if it is already a FLOOR
                    if (!OuterFloors.Paths.Contains(prevPath) & !InnerFloors.Paths.Contains(prevPath)) 
                    {
                        OuterCaps.AddRange(prevLayer, prevPath);
                        InnerCaps.AddRangeGracefully(InnerCurves.Branch(prevPath), prevPath);
                        OuterRegulars.RemovePath(prevPath);
                        InnerRegulars.RemovePath(prevPath);
                        OuterOverhangs.RemovePath(prevPath);
                        InnerOverhangs.RemovePath(prevPath);
                    }
                }
                continue;
            }
            // LAST LAYER(S) CAP CLASSIFICATION --------------------------------------------
            if (i >= OuterCurves.BranchCount - 2)
            {
                if (CapLayerCount > 0)
                {
                    OuterCaps.AddRange(nextLayer, nextPath);
                    InnerCaps.AddRangeGracefully(InnerCurves.Branch(nextPath), nextPath);
                    // RE-CLASSIFY CAPS BACKWARDS
                    for (int j = 1; j < CapLayerCount && (i + 1 - j) >= 0; j++) 
                    {
                        GH_Path prevPath = new GH_Path(OuterCurves.Paths[i + 1 - j]);
                        List<Curve> prevLayer = OuterCurves.Branches[i + 1 - j];
                        // Add to CAP and remove REGULAR - Leave as is if it is already a FLOOR
                        if (!OuterFloors.Paths.Contains(prevPath) & !InnerFloors.Paths.Contains(prevPath)) 
                        {
                            OuterCaps.AddRange(prevLayer, prevPath);
                            InnerCaps.AddRangeGracefully(InnerCurves.Branch(prevPath), prevPath);
                            OuterRegulars.RemovePath(prevPath);
                            InnerRegulars.RemovePath(prevPath);
                            OuterOverhangs.RemovePath(prevPath);
                            InnerOverhangs.RemovePath(prevPath);
                        }
                    }
                }
                else
                {
                    // THISLAYER IS REGULAR/SPARSE LAYER
                    OuterRegulars.AddRange(thisLayer, thisPath);
                    InnerRegulars.AddRangeGracefully(InnerCurves.Branch(thisPath), thisPath);
                    OuterRegulars.AddRange(nextLayer, nextPath);
                    InnerRegulars.AddRangeGracefully(InnerCurves.Branch(nextPath), nextPath);
                }
                continue;
                
            }
            // OVERHANG CLASSIFICATION ---------------------------------------------------
            else if ((percLast > 0) && (Math.Abs(percLast) > Threshold))
            {
                // THISLAYER IS LARGER THAN LAST LAYER --> THISLAYER IS OVERHANG LAYER
                OuterOverhangs.AddRange(thisLayer, thisPath);
                InnerOverhangs.AddRangeGracefully(InnerCurves.Branch(thisPath), thisPath);
            }
            // REGULAR / SPARSE CLASSIFICATION ------------------------------------------
            else
            {
                // THISLAYER IS REGULAR/SPARSE LAYER
                OuterRegulars.AddRange(thisLayer, thisPath);
                InnerRegulars.AddRangeGracefully(InnerCurves.Branch(thisPath), thisPath);
            }

        }
        // Set outputs
        DebugMessage = ReportMessages;
        OuterFloorLayers = OuterFloors;
        OuterRegularLayers = OuterRegulars;
        OuterOverhangLayers = OuterOverhangs;
        OuterCapLayers = OuterCaps;
        InnerFloorLayers = InnerFloors;
        InnerRegularLayers = InnerRegulars;
        InnerOverhangLayers = InnerOverhangs;
        InnerCapLayers = InnerCaps;
    }

    private double GetLayerArea(List<Curve> Layer)
    {
        double LayerArea = 0.0;
        for (int i = 0; i < Layer.Count; i++)
        {
            AreaMassProperties amp = AreaMassProperties.Compute(Layer[i]);
            LayerArea += amp.Area;
        }
        return LayerArea;
    }
}

    namespace TreeExtensions
    {
        public static class DataTreeExtensions
        {
            public static void AddRangeGracefully(this DataTree<Curve> tree, IEnumerable<Curve> data, GH_Path path)
            {
                try
                {
                    tree.AddRange(data, path);
                }
                catch (ArgumentNullException)
                {
                    tree.RemovePath(path);
                }
            }
        }
    }
# ---------- end classifyclayprintlayers ----------
panel_7 = Panel(classifyclayprintlayers.DebugMessage)
inner_layers_overhang = Data(classifyclayprintlayers.InnerOverhangLayers)
outer_layers_overhang = Data(classifyclayprintlayers.OuterOverhangLayers)
outer_layers_regular = Data(classifyclayprintlayers.OuterRegularLayers)
inner_layers_regular = Data(classifyclayprintlayers.InnerRegularLayers)
outer_layers_floor = Data(classifyclayprintlayers.OuterFloorLayers)
inner_layers_floor = Data(classifyclayprintlayers.InnerFloorLayers)
outer_layers_cap = Data(classifyclayprintlayers.OuterCapLayers)
inner_layers_cap = Data(classifyclayprintlayers.InnerCapLayers)
merge_4 = Merge(Data1=inner_layers_regular, Data2=inner_layers_overhang)
merge_5 = Merge(Data1=outer_layers_regular, Data2=outer_layers_overhang)

# ----
# comments & notes: COMPUTE INFILL AND FLOOR/CAP OFFSET DISTANCES
infill_wall_overlap_2 = Data(infill_wall_overlap)
infill_infill_overlap_2 = Data(infill_infill_overlap)
linewidth = Data(line_width)
subtraction_2 = Subtraction(A=linewidth, B=infill_wall_overlap_2)
subtraction_3 = Subtraction(A=linewidth, B=infill_infill_overlap_2)
offset_w_infill_wall_overlap = Data(subtraction_2)
offset_w_infill_infill_overlap = Data(subtraction_3)

# ----
# comments & notes: CREATE CAP INFILL BASE CURVES
custom_curves_floorcurves = Curve(custom_curves_floor_wall_curves)
offset_w_infill_wall_overlap_2 = Data(offset_w_infill_wall_overlap)
inner_layers_cap_2 = Data(inner_layers_cap)
outer_layers_cap_2 = Data(outer_layers_cap)
slice_planes_4 = Data(slice_planes_3)
tstat_9 = TreeStatistics(Tree=outer_layers_cap_2)  # -> Paths, Length, Count
tstat_10 = TreeStatistics(Tree=inner_layers_cap_2)  # -> Paths, Length, Count
c2offset = Clipper2Offset(Polylines=outer_layers_cap_2, Distance=offset_w_infill_wall_overlap_2, JoinType=1, EndType=0, MiterLimit=2, Precision=6)  # -> Holes, Outer, ClipperPaths
c2offset_2 = Clipper2Offset(Polylines=inner_layers_cap_2, Distance=offset_w_infill_wall_overlap_2, JoinType=1, EndType=0, MiterLimit=2, Precision=6)  # -> Holes, Outer, ClipperPaths
branch_8 = TreeBranch(Tree=slice_planes_4, Path=tstat_9.Paths, MaintainPaths=True)
branch_9 = TreeBranch(Tree=slice_planes_4, Path=tstat_10.Paths, MaintainPaths=True)
pshift_8 = ShiftPaths(Data=c2offset_2.Outer, Offset=-1)
pshift_9 = ShiftPaths(Data=c2offset.Holes, Offset=-1)
redpline_2 = Reduce(Polyline=pshift_8, Tolerance="0.025")  # -> Polyline, Reduction
redpline_3 = Reduce(Polyline=pshift_9, Tolerance="0.025")  # -> Polyline, Reduction
project = Project(Geometry=redpline_3.Polyline, Plane=branch_8)  # -> Geometry, Transform
project_2 = Project(Geometry=redpline_2.Polyline, Plane=branch_9)  # -> Geometry, Transform
outer_cap_infill_basecrvs = Curve(project.Geometry)
inner_cap_infill_basecrvs = Curve(project_2.Geometry)

# ----
# comments & notes: CREATE FLOOR INFILL BASE CURVES
custom_curves_slice_planes_2 = Data(custom_curves_slice_planes)
inner_layers_floor_2 = Data(inner_layers_floor)
slice_planes_5 = Data(slice_planes_3)
add_floor_custom_curves_enabled_2 = Boolean(add_floor_custom_curves_enabled)
offset_w_infill_wall_overlap_3 = Data(offset_w_infill_wall_overlap)
custom_curves_floorcurves_2 = Curve(custom_curves_floor_wall_curves)
outer_layers_floor_2 = Data(outer_layers_floor)
filter_42 = StreamFilter(Gate=add_floor_custom_curves_enabled_2, Stream0=slice_planes_5, Stream1=custom_curves_slice_planes_2)
filter_43 = StreamFilter(Gate=add_floor_custom_curves_enabled_2, Stream0=outer_layers_floor_2, Stream1=custom_curves_floorcurves_2)
tstat_11 = TreeStatistics(Tree=inner_layers_floor_2)  # -> Paths, Length, Count
tstat_12 = TreeStatistics(Tree=filter_43)  # -> Paths, Length, Count
c2offset_3 = Clipper2Offset(Polylines=filter_43, Distance=offset_w_infill_wall_overlap_3, JoinType=1, EndType=0, MiterLimit=2, Precision=6)  # -> Holes, Outer, ClipperPaths
c2offset_4 = Clipper2Offset(
    Polylines=inner_layers_floor_2,
    Distance=offset_w_infill_wall_overlap_3,
    JoinType=1,
    EndType=0,
    MiterLimit=2,
    Precision=6)  # -> Holes, Outer, ClipperPaths
branch_10 = TreeBranch(Tree=filter_42, Path=tstat_12.Paths, MaintainPaths=True)
branch_11 = TreeBranch(Tree=filter_42, Path=tstat_11.Paths, MaintainPaths=True)
pshift_10 = ShiftPaths(Data=c2offset_4.Outer, Offset=-1)
pshift_11 = ShiftPaths(Data=c2offset_3.Holes, Offset=-1)
redpline_4 = Reduce(Polyline=pshift_10, Tolerance="0.025")  # -> Polyline, Reduction
redpline_5 = Reduce(Polyline=pshift_11, Tolerance="0.025")  # -> Polyline, Reduction
project_3 = Project(Geometry=redpline_5.Polyline, Plane=branch_10)  # -> Geometry, Transform
project_4 = Project(Geometry=redpline_4.Polyline, Plane=branch_11)  # -> Geometry, Transform
outer_floor_infill_basecrvs = Curve(project_3.Geometry)
inner_floor_infill_basecrvs = Curve(project_4.Geometry)

inner_floor_infill_basecrvs_2 = Curve(inner_floor_infill_basecrvs)
outer_floor_infill_basecrvs_2 = Curve(outer_floor_infill_basecrvs)
floor_type_2 = Integer(floor_type)
comments_notes_23 = Panel("FLOOR INFILL GATE")
gate_12 = StreamGate(Stream=outer_floor_infill_basecrvs_2, Gate=floor_type_2)  # -> Target0, Target1
gate_13 = StreamGate(Stream=inner_floor_infill_basecrvs_2, Gate=floor_type_2)  # -> Target0, Target1
outer_floor_infill_basecrvs_3 = Curve(gate_12.Target0)
outer_floor_infill_basecrvs_4 = Curve(gate_12.Target1)
inner_floor_infill_basecrvs_3 = Curve(gate_13.Target0)
inner_floor_infill_basecrvs_4 = Curve(gate_13.Target1)

# ----
# comments & notes: FLOOR CRISS-CROSS INFILL
# BY XYLINUS
inner_floor_infill_basecrvs_5 = Curve(inner_floor_infill_basecrvs_3)
offset_w_infill_infill_overlap_2 = Data(offset_w_infill_infill_overlap)
outer_floor_infill_basecrvs_5 = Curve(outer_floor_infill_basecrvs_3)
full_ratio_on_floor_cap = Panel("1")
infill_fillet_radius_2 = Data(infill_fillet_radius)
null_5 = NullItem(Item=flatten(inner_floor_infill_basecrvs_5))  # -> NullFlags, InvalidFlags, Description
or_8 = GateOr(A=null_5.NullFlags, B=null_5.InvalidFlags)
rdiff = RegionDifference(CurvesA=outer_floor_infill_basecrvs_5, CurvesB=inner_floor_infill_basecrvs_5)
ma_9 = MassAddition(Input=or_8)  # -> Result, PartialResults
pshift_12 = ShiftPaths(Data=rdiff, Offset=-1)
bool = Boolean(invert(ma_9.Result))
filter_44 = StreamFilter(Gate=bool, Stream0=outer_floor_infill_basecrvs_5, Stream1=pshift_12)
infill_basecrvs_merged = Curve(filter_44)
tstat_13 = TreeStatistics(Tree=infill_basecrvs_merged)  # -> Paths, Length, Count
infill = CurveInfill(
    C=infill_basecrvs_merged,
    extrusion_width_or_xylinus_config=offset_w_infill_infill_overlap_2,
    infill_ratio_0_1=full_ratio_on_floor_cap)
lng_9 = ListLength(List=tstat_13.Paths)
path_mapper = PathMapper(infill, source="{A}", target="{0;A}")
equals_2 = Equality(FirstNumber=lng_9, SecondNumber="1")  # -> Equality, Inequality
gate_14 = StreamGate(Stream=path_mapper, Gate=equals_2.Equality)  # -> Target0, Target1
tstat_14 = TreeStatistics(Tree=gate_14.Target1)  # -> Paths, Length, Count
replace_2 = ReplacePaths(Data=gate_14.Target1, Search=tstat_14.Paths, Replace=tstat_13.Paths)
infill_fillet_radius_3 = Data(infill_fillet_radius_2)
filter_45 = StreamFilter(Gate=equals_2.Equality, Stream0=gate_14.Target0, Stream1=replace_2)
fillet = Fillet(Curve=filter_45, Radius=infill_fillet_radius_3)
explode_5 = Explode(Curve=fillet, Recursive=True)  # -> Segments, Vertices
pshift_13 = ShiftPaths(Data=explode_5.Segments, Offset=-1)
join_4 = JoinCurves(Curves=pshift_13, Preserve=False)
pshift_14 = ShiftPaths(Data=join_4, Offset=-1)
topoly_4 = CurveToPolyline(Curve=pshift_14, ToleranceDistance=Slider(0.01, range=0.001..0.5), ToleranceAngle=0)  # -> Polyline, Segments
floor_infill_curves_0 = Curve(topoly_4.Polyline)

add_floor_custom_curves_enabled_3 = Boolean(add_floor_custom_curves_enabled)
custom_curves_slice_planes_3 = Data(custom_curves_slice_planes)
outer_infill_base_crv_1 = Curve(outer_floor_infill_basecrvs_4)
inner_infill_base_crvs_1 = Curve(inner_floor_infill_basecrvs_4)
slice_planes_6 = Data(slice_planes_3)
offset_w_infill_infill_overlap_3 = Data(offset_w_infill_infill_overlap)
comments_notes_24 = Panel("FLOOR OFFSET INFILL")
filter_46 = StreamFilter(Gate=add_floor_custom_curves_enabled_3, Stream0=slice_planes_6, Stream1=custom_curves_slice_planes_3)
create_offset_infill = CREATE_OFFSET_INFILL(
    outer_infill_base_curves=outer_infill_base_crv_1,
    inner_infill_base_curves=inner_infill_base_crvs_1,
    slice_planes=filter_46,
    offset=offset_w_infill_infill_overlap_3)
floor_infill_curves_1 = Curve(create_offset_infill)

# ----
# comments & notes: COLLECT FLOOR INFILL CURVES
floor_infill_curves_0_2 = Curve(floor_infill_curves_0)
floor_infill_curves_1_2 = Curve(floor_infill_curves_1)
floor_type_3 = Integer(floor_type)
filter_47 = StreamFilter(Gate=floor_type_3, Stream0=floor_infill_curves_0_2, Stream1=floor_infill_curves_1_2)
pcen_7 = PolygonCenter(Polyline=filter_47)  # -> CenterV, CenterE, CenterA
Z_6 = UnitZ(Factor=1)
pl_3 = PlaneNormal(Origin=pcen_7.CenterA, ZAxis=Z_6)
crvensureccw_3 = CSharpScript(Crv=filter_47, Pln=pl_3)  # -> CCWCrv; inputs Crv: Curve, Pln: Plane; same code as crvensureccw
floor_infill_curves = Curve(crvensureccw_3)

# ----
# SPIRALIZE CONTOURS
comments_notes_25 = Panel("SPIRALIZE CONTOURS")

# ----
# VISUALIZATION OF
# PRINTING, LAYER AND GCODE GEOMETRY
# CONTROL FLOW FOR
# PRINT GEO / CUSTOM CURVES
# comments & notes: CONTROL FLOW FOR
# PRINT GEO / CUSTOM CURVES
render_print_geometry_2 = Data(render_print_geometry)
inject_custom_curves_9 = Data(inject_custom_curves)
and_10 = GateAnd(A=render_print_geometry_2, B=invert(inject_custom_curves_9))
render_print_geometry_and_not_inject_cus = Boolean(and_10)  # "RENDER_PRINT_GEOMETRY_AND_NOT_INJECT_CUSTOM_CURVES"

# ----
# PRINT PATH MANIPULATION
# OF SPIRALIZED CURVE
# comments & notes: PRINT PATH MANIPULATION
# OF SPIRALIZED CURVE
enable_ppm_after_spiral = BooleanToggle(False)

# ----
# comments & notes: EMOD functionality has been deprecated and has to be re-implemented if needed (it was not working well anyway...)
complete_emod_values = Data()
enableextrusionratemod = Boolean()
filter_48 = StreamFilter(Gate=enableextrusionratemod, Stream1=complete_emod_values)

show_printer_2 = Data(show_printer)
enable_print_simulation_2 = Data(enable_print_simulation)
wasp_40100_printing_diameter_2 = Data(wasp_40100_printing_diameter)
wasp40100_arm_length_2 = Data(wasp40100_arm_length)

# ----
# HUD & INFO/ERROR STREAM
# comments & notes: Info & Error Stream collection
panel_8 = Panel("[ERROR] No input geometry is present!")
base_mesh_closed_2 = Data(base_mesh_closed)
pg_meshbrep_info_2 = Data(pg_meshbrep_info)
shrinkwrap_info_2 = Data(shrinkwrap_info)
remeshing_info_2 = Data(remeshing_info)
inmesh_closed_2 = Data(inmesh_closed)
info_npslicing_2 = Data(info_npslicing)
enable_heads_up_display_2 = Data(enable_heads_up_display)
geo_present_4 = Boolean(geo_present)
textsize = Slider(16, range=0..30)

printing_geometry_has_lower_boundary_3 = Boolean(printing_geometry_has_lower_boundary)
panel_9 = Panel("[SETTING IGNORED] Additional Floor option is only available if there is a lower boundary in the brep/mesh!")
panel_10 = Panel("[SETTING IGNORED] Additional Floor option is only available for open objects!")
floor_layer_count_7 = Integer(floor_layer_count)
format = Format(Format="[INFO] {0} Floor Layers are being added.", Culture=127, Data0=floor_layer_count_7)

add_floor_to_open_objects_5 = Boolean(add_floor_to_open_objects)
printing_geometry_closed_4 = Boolean(printing_geometry_closed)
python_2 = GhPythonScript(A=printing_geometry_closed_4, B=add_floor_to_open_objects_5, C=printing_geometry_has_lower_boundary_3)  # -> out, O
# ---------- python_2: Python ----------
if A == True and B == True:
    O = 0
elif A == False and B == True:
    if C == False:
        O = 1
    else:
        O = 2
# ---------- end python_2 ----------
comments_notes_26 = Panel("CREATE INFO MESSAGES")

filter_49 = StreamFilter(Gate=python_2.O, Stream0=panel_10, Stream1=panel_9)
filter_50 = StreamFilter(Gate=0, Stream0=filter_49, Stream1=format)

floor_info = Data(filter_50)

floor_info_2 = Data(floor_info)

# ----
# comments & notes: SPARSE CRISS-CROSS INFILL WITH BOUNDARY CURVE CONTINUATION
number_slider = Slider(19, range=0..20)  # disabled
innerregularlayers = Data(merge_4)  # disabled
outerregularlayers = Data(merge_5)  # disabled
pcen_8 = PolygonCenter(Polyline=outerregularlayers)  # -> CenterV, CenterE, CenterA; disabled
xy_6 = XYPlane(Origin=pcen_8.CenterV)  # disabled
sparse_infill_base_crvs = Data(outerregularlayers)  # disabled
sparse_infill_inner_basecrvs = Data(innerregularlayers)  # disabled
slice_planes_7 = Data(xy_6)  # disabled
number_slider_2 = Slider(54.6, range=0..90)  # disabled
xy_7 = XYPlane(Origin=Point(0, 0, 0))  # disabled
sparse_infill_inner_basecrvs_2 = Data(sparse_infill_inner_basecrvs)  # disabled
prot = RotatePlane(Plane=xy_7, Angle=degrees(number_slider_2))  # disabled
bbox_6 = BoundingBox(Content=flatten(sparse_infill_base_crvs), Plane=prot, UnionBox=True)  # -> Box, Box_2; disabled
line_distance = Slider(3.5, range=0..10)  # disabled
debox_5 = DeconstructBox(Box=bbox_6.Box)  # -> Plane, X, Y, Z; disabled
panel_11 = Panel("2")  # disabled
range = Range(Domain=debox_5.X, Steps=panel_11)  # disabled
range_2 = Range(Domain=debox_5.Y, Steps=panel_11)  # disabled
dedomain_5 = DeconstructDomain(Domain=debox_5.X)  # -> Start, End; disabled
subtraction_4 = Subtraction(A=dedomain_5.End, B=dedomain_5.Start)  # disabled
item_6 = ListItem(List=range, Index=0, Wrap=True)  # -> Item, Item1; disabled
item_7 = ListItem(List=range_2, Index=0, Wrap=True)  # -> Item, Item1; disabled
division_4 = Division(A=subtraction_4, B=line_distance)  # disabled
pt_4 = PointOriented(BasePlane=prot, UComponent=item_6.Item1, VComponent=item_7.Item1, WComponent=0)  # disabled
round_2 = Round(Number=division_4)  # -> Nearest, Floor, Ceiling; disabled
pl_origin = PlaneOrigin(Base=prot, Origin=pt_4)  # disabled
division_5 = Division(A=subtraction_4, B=round_2.Floor)  # disabled
dedomain_6 = DeconstructDomain(Domain=debox_5.Y)  # -> Start, End; disabled
subtraction_5 = Subtraction(A=dedomain_6.End, B=dedomain_6.Start)  # disabled
deplane = DeconstructPlane(Plane=pl_origin)  # -> Origin, XAxis, YAxis, ZAxis; disabled
amp_2 = Amplitude(Vector=deplane.XAxis, Amplitude=division_5)  # disabled
amp_3 = Amplitude(Vector=deplane.XAxis, Amplitude=expr("x*-0.5", subtraction_4))  # disabled
arrlinear = LinearArray(Geometry=pt_4, Direction=amp_2, Count=round_2.Ceiling)  # -> Geometry, Transform; disabled
move_5 = Move(Geometry=arrlinear.Geometry, Motion=amp_3)  # -> Geometry, Transform; disabled
amp_4 = Amplitude(Vector=deplane.YAxis, Amplitude=expr("x*-0.5", subtraction_5))  # disabled
line = LineSDL(Start=move_5.Geometry, Direction=deplane.YAxis, Length=subtraction_5)  # disabled
move_6 = Move(Geometry=line, Motion=amp_4)  # -> Geometry, Transform; disabled
tstat_15 = TreeStatistics(Tree=slice_planes_7)  # -> Paths, Length, Count; disabled
panel_12 = Panel("""0
1""")  # disabled
number_slider_3 = Slider(0, range=0..1)  # disabled
number_slider_4 = Slider(1, range=0..1)  # disabled
panel_13 = Panel("0.000")  # disabled
dom = ConstructDomain(DomainStart=number_slider_3, DomainEnd=number_slider_4)  # disabled
branchindex = Slider(12, range=0..25)  # disabled
branchindex_2 = Slider(1, range=0..25)  # disabled
number_slider_5 = Slider(0.087, range=0.001..1)  # disabled

dedomain_7 = DeconstructDomain(Domain=debox_5.X)  # -> Start, End; disabled
subtraction_6 = Subtraction(A=dedomain_7.End, B=dedomain_7.Start)  # disabled
division_6 = Division(A=subtraction_6, B=line_distance)  # disabled
round_3 = Round(Number=division_6)  # -> Nearest, Floor, Ceiling; disabled
division_7 = Division(A=subtraction_6, B=round_3.Floor)  # disabled
dedomain_8 = DeconstructDomain(Domain=debox_5.X)  # -> Start, End; disabled
subtraction_7 = Subtraction(A=dedomain_8.End, B=dedomain_8.Start)  # disabled
amp_5 = Amplitude(Vector=deplane.YAxis, Amplitude=division_7)  # disabled
amp_6 = Amplitude(Vector=deplane.YAxis, Amplitude=expr("x*-0.5", subtraction_6))  # disabled
arrlinear_2 = LinearArray(Geometry=pt_4, Direction=amp_5, Count=round_3.Ceiling)  # -> Geometry, Transform; disabled
move_7 = Move(Geometry=arrlinear_2.Geometry, Motion=amp_6)  # -> Geometry, Transform; disabled
amp_7 = Amplitude(Vector=deplane.XAxis, Amplitude=expr("x*-0.5", subtraction_7))  # disabled
line_2 = LineSDL(Start=move_7.Geometry, Direction=deplane.XAxis, Length=subtraction_7)  # disabled
move_8 = Move(Geometry=line_2, Motion=amp_7)  # -> Geometry, Transform; disabled

inner_cap_infill_basecrvs_2 = Curve(inner_cap_infill_basecrvs)
outer_cap_infill_basecrvs_2 = Curve(outer_cap_infill_basecrvs)
printing_geometry_closed_5 = Boolean(printing_geometry_closed)
np_slicing_enabled_3 = Boolean(np_slicing_enabled)
cap_type_2 = Integer(cap_type)
comments_notes_27 = Panel("CAP INFILL GATE")

# ----
# INFILL & FLOOR GENERATION
or_9 = GateOr(A=printing_geometry_closed_5, B=invert(np_slicing_enabled_3))

filter_51 = StreamFilter(Gate=or_9, Stream1=outer_cap_infill_basecrvs_2)
filter_52 = StreamFilter(Gate=or_9, Stream1=inner_cap_infill_basecrvs_2)
gate_15 = StreamGate(Stream=filter_51, Gate=cap_type_2)  # -> Target0, Target1
gate_16 = StreamGate(Stream=filter_52, Gate=cap_type_2)  # -> Target0, Target1
outer_cap_infill_basecrvs_3 = Curve(gate_15.Target0)
outer_cap_infill_basecrvs_4 = Curve(gate_15.Target1)
inner_cap_infill_basecrvs_3 = Curve(gate_16.Target0)
inner_cap_infill_basecrvs_4 = Curve(gate_16.Target1)

# ----
# comments & notes: CAP CRISS-CROSS INFILL
# BY XYLINUS
inner_cap_infill_basecrvs_5 = Curve(inner_cap_infill_basecrvs_3)
outer_cap_infill_basecrvs_5 = Curve(outer_cap_infill_basecrvs_3)
infill_fillet_radius_4 = Data(infill_fillet_radius)
line_width_2 = Data(line_width)
null_6 = NullItem(Item=flatten(inner_cap_infill_basecrvs_5))  # -> NullFlags, InvalidFlags, Description
or_10 = GateOr(A=null_6.NullFlags, B=null_6.InvalidFlags)
ma_10 = MassAddition(Input=or_10)  # -> Result, PartialResults
rdiff_2 = RegionDifference(CurvesA=outer_cap_infill_basecrvs_5, CurvesB=inner_cap_infill_basecrvs_5)
bool_2 = Boolean(invert(ma_10.Result))
pshift_15 = ShiftPaths(Data=rdiff_2, Offset=-1)
filter_53 = StreamFilter(Gate=bool_2, Stream0=outer_cap_infill_basecrvs_5, Stream1=pshift_15)
infill_basecrvs_merged_2 = Curve(filter_53)
full_ratio_on_floor_cap_2 = Panel("1")
tstat_16 = TreeStatistics(Tree=infill_basecrvs_merged_2)  # -> Paths, Length, Count
infill_2 = CurveInfill(C=infill_basecrvs_merged_2, extrusion_width_or_xylinus_config=line_width_2, infill_ratio_0_1=full_ratio_on_floor_cap_2)
lng_10 = ListLength(List=tstat_16.Paths)
path_mapper_2 = PathMapper(infill_2, source="{A}", target="{0;A}")
equals_3 = Equality(FirstNumber=lng_10, SecondNumber="1")  # -> Equality, Inequality
gate_17 = StreamGate(Stream=path_mapper_2, Gate=equals_3.Equality)  # -> Target0, Target1
tstat_17 = TreeStatistics(Tree=gate_17.Target1)  # -> Paths, Length, Count
replace_3 = ReplacePaths(Data=gate_17.Target1, Search=tstat_17.Paths, Replace=tstat_16.Paths)
filter_54 = StreamFilter(Gate=equals_3.Equality, Stream0=gate_17.Target0, Stream1=replace_3)
fillet_2 = Fillet(Curve=filter_54, Radius=infill_fillet_radius_4)
explode_6 = Explode(Curve=fillet_2, Recursive=True)  # -> Segments, Vertices
pshift_16 = ShiftPaths(Data=explode_6.Segments, Offset=-1)
join_5 = JoinCurves(Curves=pshift_16, Preserve=False)
pshift_17 = ShiftPaths(Data=join_5, Offset=-1)
topoly_5 = CurveToPolyline(Curve=pshift_17, ToleranceDistance=Slider(0.01, range=0.001..0.5), ToleranceAngle=0)  # -> Polyline, Segments
cap_infill_curves_0 = Curve(topoly_5.Polyline)

offset_w_infill_infill_overlap_4 = Data(offset_w_infill_infill_overlap)
inner_cap_infill_basecrvs_6 = Curve(inner_cap_infill_basecrvs_4)
outer_cap_infill_basecrvs_6 = Curve(outer_cap_infill_basecrvs_4)
slice_planes_8 = Data(slice_planes_3)
create_offset_infill_2 = CREATE_OFFSET_INFILL(
    outer_infill_base_curves=outer_cap_infill_basecrvs_6,
    inner_infill_base_curves=inner_cap_infill_basecrvs_6,
    slice_planes=slice_planes_8,
    offset=offset_w_infill_infill_overlap_4)
cap_infill_curves_1 = Curve(create_offset_infill_2)

# ----
# comments & notes: COLLECT CAP INFILL CURVES
cap_infill_curves_0_2 = Curve(cap_infill_curves_0)
cap_infill_curves_1_2 = Curve(cap_infill_curves_1)
cap_type_3 = Integer(cap_type)
filter_55 = StreamFilter(Gate=cap_type_3, Stream0=cap_infill_curves_0_2, Stream1=cap_infill_curves_1_2)
pcen_9 = PolygonCenter(Polyline=filter_55)  # -> CenterV, CenterE, CenterA
Z_7 = UnitZ(Factor=1)
pl_4 = PlaneNormal(Origin=pcen_9.CenterA, ZAxis=Z_7)
crvensureccw_4 = CSharpScript(Crv=filter_55, Pln=pl_4)  # -> CCWCrv; inputs Crv: Curve, Pln: Plane; same code as crvensureccw
cap_infill_curves = Curve(crvensureccw_4)

# ----
# UNIFY AND MERGE WALL SLICE
# CURVES (INNER & OUTER WALLS!)
# comments & notes: UNIFY AND MERGE WALL SLICE CURVES (INNER & OUTER WALLS!)
slice_curves_clsd_outer_4 = Curve(slice_curves_clsd_outer)
outer_wall_curves = Curve(slice_curves_clsd_outer_4)
slice_curves_clsd_inner_3 = Curve(slice_curves_clsd_inner)
merge_6 = Merge(Data1=slice_curves_clsd_inner_3, Data2=slice_curves_clsd_outer_4)
tstat_18 = TreeStatistics(Tree=slice_curves_clsd_inner_3)  # -> Paths, Length, Count
branch_12 = TreeBranch(Tree=merge_6, Path=tstat_18.Paths, MaintainPaths=True)
outer_wall_curves_2 = Curve(outer_wall_curves)

# ----
# WE DON'T KNOW IF THIS FIX WORKS, YET!: FIND LEAVES (BRANCHES THAT HAVE 0 AT THE END)
# REMOVE LEAVES TO AVOID DOUBLE LAYERS!
tstat_19 = TreeStatistics(Tree=branch_12)  # -> Paths, Length, Count
compare = PathCompare(Path=tstat_19.Paths, Mask="{*;*;0}")
item_8 = ListItem(List=tstat_19.Paths, Index=0, Wrap=True)
dispatch_6 = Dispatch(List=tstat_19.Paths, DispatchPattern=compare)  # -> ListA, ListB
panel_14 = Panel(compare)
dpath_4 = DeconstructPath(Branch=item_8)
lng_11 = ListLength(List=dpath_4)
branch_13 = TreeBranch(Tree=branch_12, Path=dispatch_6.ListA, MaintainPaths=True)
larger_10 = LargerThan(FirstNumber=lng_11, SecondNumber="2")  # -> LargerThan, OrEqualTo
pshift_18 = ShiftPaths(Data=branch_13, Offset=-1)
filter_56 = StreamFilter(Gate=larger_10.LargerThan, Stream0=branch_12, Stream1=pshift_18)

merged_wall_curves = Curve(filter_56)
tstat_20 = TreeStatistics(Tree=merged_wall_curves)  # -> Paths, Length, Count
culltreepaths = CSharpScript(T=outer_wall_curves_2, P=tstat_20.Paths)  # -> out, C; inputs T: tree, P: list
# ---------- culltreepaths: C# ----------
// Grasshopper Script Instance
#region Usings
using System;
using System.Linq;
using System.Collections;
using System.Collections.Generic;
using System.Drawing;

using Rhino;
using Rhino.Geometry;

using Grasshopper;
using Grasshopper.Kernel;
using Grasshopper.Kernel.Data;
using Grasshopper.Kernel.Types;
#endregion

public class Script_Instance : GH_ScriptInstance
{
    #region Notes
    /* 
      Members:
        RhinoDoc RhinoDocument
        GH_Document GrasshopperDocument
        IGH_Component Component
        int Iteration

      Methods (Virtual & overridable):
        Print(string text)
        Print(string format, params object[] args)
        Reflect(object obj)
        Reflect(object obj, string method_name)
    */
    #endregion

    private void RunScript(DataTree<object> T, List<object> P, ref object C)
    {
        DataTree<object> NewTree = new DataTree<object>(T);
        if (P != null)
        {
            for (int i = 0; i < P.Count; i++)
            {
                // cast gh path to object
                GH_Path ghp = (GH_Path) P[i];
                // remove path from tree
                NewTree.RemovePath(ghp);
            }
        }
        C = NewTree;
    }
}
# ---------- end culltreepaths ----------
merge_7 = Merge(Data1=merged_wall_curves, Data2=culltreepaths.C)
unified_wall_curves = Curve(merge_7)

custom_curves_floor_wall_curves_2 = Curve(custom_curves_floor_wall_curves)
unified_wall_curves_2 = Curve(unified_wall_curves)
add_floor_custom_curves_enabled_4 = Boolean(add_floor_custom_curves_enabled)
filter_57 = StreamFilter(Gate=add_floor_custom_curves_enabled_4, Stream0=unified_wall_curves_2, Stream1=custom_curves_floor_wall_curves_2)
unified_wall_curves_3 = Data(filter_57)

# ----
# CONTROL FLOW
# - PARALLEL WALL CURVES
# - NP SLICE CURVES
# - INJECT CUSTOM CURVES
# comments & notes: inject custom printing curves based on toggle
custom_curves_wo_floor_wall_curves_2 = Curve(custom_curves_wo_floor_wall_curves)
synthesize_floor_for_custom_curves_4 = Data(synthesize_floor_for_custom_curves)
custom_curves_at_origin_3 = Curve(custom_curves_at_origin)
inject_custom_curves_10 = Data(inject_custom_curves)
unified_wall_curves_4 = Curve(unified_wall_curves_3)
np_slicing_enabled_4 = Boolean(np_slicing_enabled)
np_slice_curves_2 = Data(np_slice_curves)
filter_58 = StreamFilter(Gate=np_slicing_enabled_4, Stream0=unified_wall_curves_4, Stream1=np_slice_curves_2)
filter_59 = StreamFilter(
    Gate=synthesize_floor_for_custom_curves_4,
    Stream0=custom_curves_at_origin_3,
    Stream1=custom_curves_wo_floor_wall_curves_2)
filter_60 = StreamFilter(Gate=inject_custom_curves_10, Stream0=filter_58, Stream1=filter_59)
slice_curves_3 = Curve(filter_60)

# ----
# SEAM ADJUSTMENT
# comments & notes: adjust seam of all printing curves based on input params
slice_curves_4 = Curve(slice_curves_3)
comments_notes_29 = Panel("synchronize curve direction")
item_9 = ListItem(List=flatten(slice_curves_4), Index=0, Wrap=True)
flip = FlipCurve(Curve=slice_curves_4, Guide=item_9)  # -> Curve, Flag
lng_12 = ListLength(List=flip.Curve)  # -> flatten(Length)
larger_11 = LargerThan(FirstNumber=lng_12, SecondNumber="1")  # -> LargerThan, OrEqualTo
ma_11 = MassAddition(Input=larger_11.LargerThan)  # -> Result, PartialResults
spiralize_contours_2 = Data(spiralize_contours)
randomize_seam_2 = Boolean(randomize_seam)
adjust_seam_2 = Data(adjust_seam)
rnd_seam_seed_2 = Data(rnd_seam_seed)
boolbranches = Boolean(ma_11.Result)
panel_15 = Panel("[SETTING IGNORED] Seam randomization is not applicable with spiralization.")
python_3 = GhPythonScript(A=randomize_seam_2, B=spiralize_contours_2, C=boolbranches)  # -> R
# ---------- python_3: Python ----------
__author__ = "EFESTWIN"
__version__ = "2023.04.24"

if not A:
    R = 0
elif A and not B:
    R = 2
elif A and C:
    R = 2
else:
    R = 1
# ---------- end python_3 ----------
adjustseam = CSharpScript(Curves=flip.Curve, SeamAdjust=adjust_seam_2, Randomize=python_3, Seed=rnd_seam_seed_2)  # -> OutCurves; inputs Curves: tree of Curve, SeamAdjust: Double, Randomize: Boolean, Seed: Int32
# ---------- adjustseam: C# ----------
// Grasshopper Script Instance
#region Usings
using System;
using System.Linq;
using System.Collections;
using System.Collections.Generic;
using System.Drawing;

using Rhino;
using Rhino.Geometry;

using Grasshopper;
using Grasshopper.Kernel;
using Grasshopper.Kernel.Data;
using Grasshopper.Kernel.Types;
#endregion

public class Script_Instance : GH_ScriptInstance
{
    #region Notes
    /* 
      Members:
        RhinoDoc RhinoDocument
        GH_Document GrasshopperDocument
        IGH_Component Component
        int Iteration

      Methods (Virtual & overridable):
        Print(string text)
        Print(string format, params object[] args)
        Reflect(object obj)
        Reflect(object obj, string method_name)
    */
    #endregion

    private void RunScript(
		DataTree<Curve> Curves,
		double SeamAdjust,
		bool Randomize,
		int Seed,
		ref object OutCurves)
    {
        if (Curves != null && Curves.DataCount > 0)
        {
            // reparametrize domain of first input curve
            Curves.Branches[0][0].Domain = new Rhino.Geometry.Interval(0.0, 1.0);
            // use adjust value for first seam adjustment
            Curves.Branches[0][0].ChangeClosedCurveSeam(SeamAdjust);
            // get initial sample point
            Point3d samplePt = Curves.Branches[0][0].PointAtStart;
            // create random instance with seed
            Random RandSeam = new Random(Seed);

            // loop over all branches of curves
            for (int i = 0; i < Curves.BranchCount; i++)
            {
                for (int j = 0; j < Curves.Branches[i].Count; j++)
                {
                    // skip the first curve in the first branch
                    // because it is already preprocessed before the loop
                    if (i == 0 && j == 0) continue;
                    // skip open curves
                    if (!Curves.Branches[i][j].IsClosed) continue;
                    // init parameter var
                    double t;
                    // reparametrize domain
                    Curves.Branches[i][j].Domain = new Rhino.Geometry.Interval(0.0, 1.0);
                    if (Randomize)
                    {
                        Curves.Branches[i][j].ChangeClosedCurveSeam(RandSeam.NextDouble());
                    }
                    else
                    {
                        // get cp based on sample point
                        Curves.Branches[i][j].ClosestPoint(samplePt, out t);
                        // set seam
                        Curves.Branches[i][j].ChangeClosedCurveSeam(t);
                    }
                    // reparam again
                    Curves.Branches[i][j].Domain = new Rhino.Geometry.Interval(0.0, 1.0);
                }
                // set sample point for next branch
                samplePt = Curves.Branches[i][0].PointAtStart;
            }
        }
        else
        {
            Curves = new DataTree<Curve>();
        }
        OutCurves = Curves;
    }
}
# ---------- end adjustseam ----------
bypass_seam_adjustment_2 = Data(bypass_seam_adjustment)
filter_61 = StreamFilter(Gate=python_3, Stream1=panel_15, Stream2="[INFO] Seam is randomized.")
filter_62 = StreamFilter(Gate=bypass_seam_adjustment_2, Stream0=filter_61, Stream1="[INFO] Seam adjustment is bypassed!")
filter_63 = StreamFilter(Gate=bypass_seam_adjustment_2, Stream0=adjustseam, Stream1=flip.Curve)
info_randomization = Data(filter_62)
slice_curves_5 = Curve(filter_63)

# ----
# comments & notes: create unified floor layers by extracting floor branches from wall curves and then merging the two
floor_infill_curves_2 = Curve(floor_infill_curves)
print_infill_before_walls_2 = Data(print_infill_before_walls)
unified_wall_curves_5 = Data(unified_wall_curves_3)
tstat_21 = TreeStatistics(Tree=floor_infill_curves_2)  # -> Paths, Length, Count
branch_14 = TreeBranch(Tree=unified_wall_curves_5, Path=tstat_21.Paths, MaintainPaths=True)
merge_8 = Merge(Data1=branch_14, Data2=floor_infill_curves_2)
merge_9 = Merge(Data1=floor_infill_curves_2, Data2=branch_14)
filter_64 = StreamFilter(Gate=print_infill_before_walls_2, Stream0=merge_8, Stream1=merge_9)
unified_wall_floor_layers = Geometry(filter_64)

info_randomization_2 = Data(info_randomization)

entwine = Entwine(Branch00=move_6.Geometry, Branch01=move_8.Geometry, FlattenInputs=True)  # disabled

# ----
# comments & notes: MAKE LINE DIRECTIONS ALTERNATING
panel_16 = Panel("""True
False""")  # disabled
trimmedlines = Data(entwine)  # disabled
lng_13 = ListLength(List=trimmedlines)  # disabled
repeat = RepeatData(Data=panel_16, Length=lng_13)  # disabled
dispatch_7 = Dispatch(List=trimmedlines, DispatchPattern=repeat)  # -> ListA, ListB; disabled
flip_2 = FlipCurve(Curve=dispatch_7.ListB)  # -> Curve, Flag; disabled
weave = Weave(Pattern=panel_16, Stream0=flip_2.Curve, Stream1=dispatch_7.ListA, NullGaps=False)  # disabled

tstat_22 = TreeStatistics(Tree=weave)  # -> Paths, Length, Count; disabled
repeat_2 = RepeatData(Data=tstat_22.Paths, Length=tstat_15.Count)  # disabled
branch_15 = TreeBranch(Tree=weave, Path=repeat_2, MaintainPaths=False)  # disabled
tstat_23 = TreeStatistics(Tree=branch_15)  # -> Paths, Length, Count; disabled
replace_4 = ReplacePaths(Data=branch_15, Search=tstat_23.Paths, Replace=tstat_15.Paths)  # disabled
infill_lines_raw = Data(replace_4)  # disabled

sparse_infill_base_crvs_2 = Data(sparse_infill_base_crvs)  # disabled
infill_lines_raw_2 = Data(infill_lines_raw)  # disabled
slice_planes_9 = Data(slice_planes_7)  # disabled
project_5 = Project(Geometry=infill_lines_raw_2, Plane=slice_planes_9)  # -> Geometry, Transform; disabled
tstat_24 = TreeStatistics(Tree=sparse_infill_base_crvs_2)  # -> Paths, Length, Count; disabled
dup = DuplicateData(Data=graft(tstat_24.Paths), Number=graft(tstat_24.Length), Order=True)  # -> flatten(Data); disabled
branch_16 = TreeBranch(Tree=project_5.Geometry, Path=dup, MaintainPaths=False)  # disabled
sparse_infill_base_crvs_3 = Data(sparse_infill_base_crvs_2)  # disabled
tstat_25 = TreeStatistics(Tree=graft(sparse_infill_base_crvs_2))  # -> Paths, Length, Count; disabled
tstat_26 = TreeStatistics(Tree=branch_16)  # -> Paths, Length, Count; disabled
replace_5 = ReplacePaths(Data=branch_16, Search=tstat_26.Paths, Replace=tstat_25.Paths)  # disabled
trim = TrimWithRegions(Curve=replace_5, Regions=graft(sparse_infill_base_crvs_3), Plane=graft(slice_planes_9))  # -> Inside, Outside; disabled
pshift_19 = ShiftPaths(Data=trim.Inside, Offset=-1)  # disabled

sparse_infill_base_crvs_4 = Data(sparse_infill_base_crvs_2)  # disabled
processinfillcurves = CSharpScript(OuterCurves=sparse_infill_base_crvs_2, InfillCurves=pshift_19)  # -> out, Bounds, SplitParams; inputs OuterCurves: Curve, InfillCurves: list of Curve; disabled
# ---------- processinfillcurves: C# ----------
    Grasshopper.DataTree<double> splitparams = new Grasshopper.DataTree<double>();

    double tS;
    OuterCurve.ClosestPoint(InfillCurves[0].PointAtNormalizedLength(0.5), out tS);
    OuterCurve.ChangeClosedCurveSeam(tS);

    for (int i = 0; i < InfillCurves.Count; i++)
    {
      double tA;
      OuterCurve.ClosestPoint(InfillCurves[i].PointAtStart, out tA);
      double tB;
      OuterCurve.ClosestPoint(InfillCurves[i].PointAtEnd, out tB);

      splitparams.Add(tA, new Grasshopper.Kernel.Data.GH_Path(0, i));
      splitparams.Add(tB, new Grasshopper.Kernel.Data.GH_Path(0, i));
    }
    Bounds = OuterCurve;
    SplitParams = splitparams;
# ---------- end processinfillcurves ----------
lng_14 = ListLength(List=trim.Inside)  # disabled
item_10 = ListItem(List=processinfillcurves.SplitParams, Index=0, Wrap=True)  # -> Item, Item1; disabled
clean_7 = CleanTree(RemoveNulls=True, RemoveInvalid=True, RemoveEmpty=True, Tree=pshift_19)  # disabled
consec = ConsecutiveDomains(Numbers=flatten(item_10.Item), Additive=invert(True))  # disabled
consec_2 = ConsecutiveDomains(Numbers=flatten(item_10.Item1), Additive=invert(True))  # disabled
lng_15 = ListLength(List=consec)  # disabled
repeat_3 = RepeatData(Data=panel_12, Length=lng_15)  # disabled
p_n_c = PickNChoose(Pattern=repeat_3, Stream0=consec, Stream1=consec_2)  # disabled
panel_17 = Panel(p_n_c)  # disabled
subcrv = SubCurve(BaseCurve=processinfillcurves.Bounds, Domain=graft(p_n_c))  # disabled
connectinfillcurves = CSharpScript(OuterCurves=graft(sparse_infill_base_crvs_4), InfillCurves=pshift_19)  # -> out, ConnectedCurves; inputs OuterCurves: tree of Curve, InfillCurves: tree of Curve; disabled
# ---------- connectinfillcurves: C# ----------
// Grasshopper Script Instance
#region Usings
using System;
using System.Linq;
using System.Collections;
using System.Collections.Generic;
using System.Drawing;

using Rhino;
using Rhino.Geometry;

using Grasshopper;
using Grasshopper.Kernel;
using Grasshopper.Kernel.Data;
using Grasshopper.Kernel.Types;
#endregion

public class Script_Instance : GH_ScriptInstance
{
    #region Notes
    /* 
      Members:
        RhinoDoc RhinoDocument
        GH_Document GrasshopperDocument
        IGH_Component Component
        int Iteration

      Methods (Virtual & overridable):
        Print(string text)
        Print(string format, params object[] args)
        Reflect(object obj)
        Reflect(object obj, string method_name)
    */
    #endregion

    private void RunScript(
		DataTree<Curve> OuterCurves,
		DataTree<Curve> InfillCurves,
		ref object ConnectedCurves)
    {

        List<Curve> infill;
        Curve bounds;
        Curve inline_A;
        Curve inline_B;
        Curve subcrv;
        Curve[] splitcurves;
        double tS;
        double tA;
        double tB;

        List<Curve> joinedCurves = new List<Curve>();

        DataTree<Curve> OutputCurves = new DataTree<Curve>();

        // LOOP OVER INFILLCURVES
        for (int i = 0; i < InfillCurves.BranchCount; i++)
        {
            infill = InfillCurves.Branches[i];
            bounds = OuterCurves.Branches[i][0];
            // Loop over infillcurves
            for (int j = 0; j < infill.Count - 1; j++)
            {
                inline_A = infill[j];
                inline_B = infill[j + 1];
                if (j == 0)
                {
                    // Get CP of first InfillCurve START-Point
                    bounds.ClosestPoint(inline_A.PointAtStart, out tS);
                    bounds.ChangeClosedCurveSeam(tS);
                    bounds.Domain = new Rhino.Geometry.Interval(0.0, 1.0);
                }

                // get subcurve from THIS endpoint to NEXT startpoint
                // build consecutive curve from that (in script / out script?)
                bounds.ClosestPoint(inline_A.PointAtEnd, out tA);
                bounds.ClosestPoint(inline_B.PointAtStart, out tB);
                if (tA > tB)
                {
                    splitcurves = bounds.Split(new double[2]{tB, tA});
                    Array.Sort(splitcurves, new CurveComparer());
                    subcrv = splitcurves[0];
                    subcrv.Reverse();
                }
                else
                {
                    splitcurves = bounds.Split(new double[2]{tA, tB});
                    Array.Sort(splitcurves, new CurveComparer());
                    subcrv = splitcurves[0];
                }

                // join inline A with subcrv and continue
                if (j == 0)
                {
                    joinedCurves = Curve.JoinCurves(new Curve[2]{inline_A, subcrv}).ToList();
                }
                else
                {
                    if (joinedCurves != null)
                    {
                        if (j == infill.Count - 2)
                        {
                            joinedCurves = Curve.JoinCurves(new Curve[4]{joinedCurves[0], inline_A, subcrv, inline_B}).ToList();
                        }
                        else
                        {
                            joinedCurves = Curve.JoinCurves(new Curve[3]{joinedCurves[0], inline_A, subcrv}).ToList();
                        }
                    }
                }
            }
            OutputCurves.AddRange(joinedCurves, InfillCurves.Paths[i]);
        }
        ConnectedCurves = OutputCurves;
    }
    
}

public class CurveComparer : IComparer<Curve>
    {
        // Call CaseInsensitiveComparer.Compare with the parameters reversed.
        public int Compare(Curve x, Curve y)
        {
            double a = x.GetLength();
            double b = y.GetLength();
            if (a - b < 0) { return -1; }
            else if (a - b > 0) { return 1; }
            else { return 0; }
        }
    }
# ---------- end connectinfillcurves ----------
data = Data(subcrv)  # disabled
data_2 = Data(clean_7)  # disabled
join_6 = JoinCurves(Curves=flatten([data, data_2]), Preserve=False)  # disabled
subcrv_2 = SubCurve(BaseCurve=reparameterize(join_6), Domain=dom)  # disabled
datatree = Data(subcrv)  # disabled
datatree_2 = Data(connectinfillcurves.ConnectedCurves)  # disabled
tstat_27 = TreeStatistics(Tree=datatree)  # -> Paths, Length, Count; disabled
tstat_28 = TreeStatistics(Tree=datatree_2)  # -> Paths, Length, Count; disabled
item_11 = ListItem(List=tstat_27.Paths, Index=branchindex, Wrap=True)  # disabled
item_12 = ListItem(List=tstat_28.Paths, Index=branchindex_2, Wrap=True)  # disabled
branch_17 = TreeBranch(Tree=datatree, Path=item_11, MaintainPaths=True)  # disabled
branch_18 = TreeBranch(Tree=datatree_2, Path=item_12, MaintainPaths=True)  # disabled
end = EndPoints(Curve=branch_18)  # -> Start, End; disabled
eval = EvaluateCurve(Curve=reparameterize(branch_18), Parameter=number_slider_5)  # -> Point, Tangent, Angle; disabled
data_3 = Data(end.End)  # disabled
data_4 = Data(end.Start)  # disabled

# ----
# PRINT PATH MANIPULATION
# OF INDIVIDUAL LAYERS
# BEFORE SPIRALIZATION
# comments & notes: PRINT PATH MANIPULATION
# OF INDIVIDUAL LAYERS BEFORE SPIRALIZATION
enable_ppm_before_spiral = BooleanToggle(False)
manipulated_slice_curves = Data()

enable_ppm_before_spiral_2 = Data(enable_ppm_before_spiral)
slice_curves_6 = Data(slice_curves_5)
gate_18 = StreamGate(Stream=slice_curves_6, Gate=enable_ppm_before_spiral_2)  # -> Target0, Target1
# comments & notes: here you can script your own print path manipulation BEFORE any spiralization. Pay attention to the datasrtucture the print paths are in. Each Path of the DataTree contains the curves of one printing layer.
slice_curves_7 = Data(gate_18.Target1)

slice_curves_8 = Data(slice_curves_7)

enableprintpathmanipulation_beforespiral = Data(enable_ppm_before_spiral_2)
manipulated_slice_curves_2 = Data(manipulated_slice_curves)
filter_65 = StreamFilter(Gate=enableprintpathmanipulation_beforespiral, Stream0=gate_18.Target0, Stream1=manipulated_slice_curves_2)
slice_curves_9 = Data(filter_65)

# ----
# CONTROL FLOW
# CONTOUR SPIRALIZATION
slice_curves_10 = Curve(slice_curves_9)
lng_16 = ListLength(List=slice_curves_10)
larger_12 = LargerThan(FirstNumber=flatten(lng_16), SecondNumber="1")  # -> LargerThan, OrEqualTo
panel_18 = Panel("[SETTING IGNORED] Spiralization is only available for open and non-branching objects!")
printing_geometry_closed_6 = Boolean(printing_geometry_closed)
inject_custom_curves_11 = Data(inject_custom_curves)
ma_12 = MassAddition(Input=larger_12.LargerThan)  # -> Result, PartialResults
spiralize_contours_3 = Data(spiralize_contours)
larger_13 = LargerThan(FirstNumber=ma_12.Result, SecondNumber="1")  # -> LargerThan, OrEqualTo
panel_19 = Panel("[SETTING IGNORED] Mirkos Spiralization method is only available with planar printing paths!")
mirkos_spiralization_2 = Data(mirkos_spiralization)
and_11 = GateAnd(A=spiralize_contours_3, B=invert(printing_geometry_closed_6), C=invert(larger_13.LargerThan))
and_12 = GateAnd(C=spiralize_contours_3, A=inject_custom_curves_11, B=invert(larger_13.LargerThan))
filter_66 = StreamFilter(Gate=spiralize_contours_3, Stream1=panel_18)
np_slicing_enabled_5 = Boolean(np_slicing_enabled)
filter_67 = StreamFilter(Gate=inject_custom_curves_11, Stream0=and_11, Stream1=and_12)
filter_68 = StreamFilter(Gate=inject_custom_curves_11, Stream0=and_11, Stream1=and_12)
equals_4 = Equality(FirstNumber=mirkos_spiralization_2, SecondNumber="1")  # -> Equality, Inequality
and_13 = GateAnd(C=spiralize_contours_3, A=mirkos_spiralization_2, B=np_slicing_enabled_5)
equals_5 = Equality(FirstNumber=np_slicing_enabled_5, SecondNumber="0")  # -> Equality, Inequality
filter_69 = StreamFilter(Gate=filter_68, Stream0=filter_66, Stream1="[INFO] Spiralizing Contours...")
gate_19 = StreamGate(Stream=slice_curves_10, Gate=filter_67)  # -> Target0, Target1
filter_70 = StreamFilter(Gate=and_13, Stream1=panel_19)
and_14 = GateAnd(C=spiralize_contours_3, A=equals_4.Equality, B=equals_5.Equality)
filter_71 = StreamFilter(Gate=and_14, Stream0=filter_70, Stream1="[INFO] Using Mirkos Spiralization Method...")
topoly_6 = CurveToPolyline(Curve=gate_19.Target0, ToleranceDistance="0.01", ToleranceAngle=0)  # -> Polyline, Segments
mirkos_spiralization_enabled = Data(and_14)
info_mirko_spiralize = Data(filter_71)
info_spiralize_contours = Data(filter_69)
spiralization_enabled = Boolean(filter_68)
slice_curves_11 = Curve(gate_19.Target1)
slice_curves_12 = Curve(topoly_6.Polyline)

# ----
# comments & notes: create uniform resolution and this/next datastructure for spralization
slice_curves_13 = Curve(flatten(slice_curves_11))
spiral_resolution_2 = Integer(spiral_resolution)
spiral_intro_2 = Number(spiral_intro)
divide = DivideCurve(Curve=slice_curves_13, Count=spiral_resolution_2, Kinks=False)  # -> Points, Tangents, Parameters
tstat_29 = TreeStatistics(Tree=divide.Points)  # -> Paths, Length, Count
shift = ShiftList(List=tstat_29.Paths, Shift="1", Wrap=False)
shift_2 = ShiftList(List=tstat_29.Paths, Shift="-1", Wrap=False)
branch_19 = TreeBranch(Tree=divide.Points, Path=shift, MaintainPaths=True)
branch_20 = TreeBranch(Tree=divide.Points, Path=shift_2, MaintainPaths=True)
lng_17 = ListLength(List=branch_19)
lng_18 = ListLength(List=branch_20)
multiplication_3 = Multiplication(A=lng_17, B=spiral_intro_2)
multiplication_4 = Multiplication(A=lng_18, B=spiral_intro_2)
round_4 = Round(Number=multiplication_3)  # -> Nearest, Floor, Ceiling
spiral_points_a_raw = Data(branch_20)
round_5 = Round(Number=multiplication_4)  # -> Nearest, Floor, Ceiling
min = Minimum(A=lng_17, B=round_4.Nearest)
min_2 = Minimum(A=lng_18, B=round_5.Nearest)
shift_3 = ShiftList(List=branch_19, Shift=min, Wrap=True)
shift_4 = ShiftList(List=spiral_points_a_raw, Shift=min_2, Wrap=True)
pshift_20 = ShiftPaths(Data=shift_3, Offset=-1)
pshift_21 = ShiftPaths(Data=shift_4, Offset=-1)
item_13 = ListItem(List=pshift_20, Index=0, Wrap=True)
item_14 = ListItem(List=pshift_21, Index=0, Wrap=True)
merge_10 = Merge(Data1=pshift_20, Data2=item_13)
merge_11 = Merge(Data1=pshift_21, Data2=item_14)
tstat_30 = TreeStatistics(Tree=merge_10)  # -> Paths, Length, Count
item_15 = ListItem(List=tstat_30.Paths, Index=0, Wrap=True)  # -> Item1, Item
branch_21 = TreeBranch(Tree=merge_10, Path=item_15.Item1, MaintainPaths=True)
merge_12 = Merge(Data1=merge_11, Data2=branch_21)
spiral_points_zinterp = Data(merge_12)
spiral_points_b = Data(merge_10)
spiral_points_a = Data(merge_11)

# ----
# comments & notes: create base spiralizing paths
spiral_ramp_percentage_2 = Data(spiral_ramp_percentage)
spiral_points_a_2 = Data(spiral_points_a)
spiral_points_b_2 = Data(spiral_points_b)
lng_19 = ListLength(List=spiral_points_a_2)
multiplication_5 = Multiplication(A=spiral_ramp_percentage_2, B="0.01")
subtraction_8 = Subtraction(A="1", B=multiplication_5)
multiplication_6 = Multiplication(A=lng_19, B=subtraction_8)
round_6 = Round(Number=multiplication_6)  # -> Nearest, Floor, Ceiling
subtraction_9 = Subtraction(A=lng_19, B="1")
min_3 = Minimum(A=round_6.Nearest, B=subtraction_9)
split_3 = SplitList(List=spiral_points_a_2, Index=min_3)  # -> ListA, ListB
split_4 = SplitList(List=spiral_points_b_2, Index=min_3)  # -> ListA, ListB
subtraction_10 = Subtraction(A=lng_19, B=round_6.Nearest)
dom_2 = ConstructDomain(DomainStart="0", DomainEnd="1")
vec2pt_3 = Vector2Pt(PointA=split_3.ListB, PointB=split_4.ListB, Unitize=False)  # -> Vector, Length
range_3 = Range(Domain=dom_2, Steps=expr("x-1", subtraction_10))
multiplication_7 = Multiplication(A=vec2pt_3.Vector, B=range_3)
move_9 = Move(Geometry=split_3.ListB, Motion=multiplication_7)  # -> Geometry, Transform
merge_13 = Merge(Data1=split_3.ListA, Data2=move_9.Geometry)
pshift_22 = ShiftPaths(Data=merge_13, Offset=-1)
pline_2 = PolyLine(Vertices=pshift_22, Closed=False)
spiralcontours_base = Data(pline_2)

# ----
# comments & notes: create base spiralizing paths with Mirko's method
spiral_points_zinterp_2 = Data(spiral_points_zinterp)
pdecon_6 = Deconstruct(Point=flatten(spiral_points_zinterp_2))  # -> XComponent, YComponent, ZComponent
sort_3 = SortList(Keys=pdecon_6.ZComponent)  # -> Keys, ValuesA
item_16 = ListItem(List=sort_3.Keys, Index=0, Wrap=True)  # -> Item1, Item
Z_8 = UnitZ(Factor=item_16.Item1)
pt_5 = Point(Point(0, 0, 0))
lng_20 = ListLength(List=pdecon_6.ZComponent)
move_10 = Move(Geometry=pt_5, Motion=Z_8)  # -> Geometry, Transform
subtraction_11 = Subtraction(A=lng_20, B=1)
ln = Line(StartPoint=pt_5, EndPoint=move_10.Geometry)
divide_2 = DivideCurve(Curve=ln, Count=subtraction_11, Kinks=False)  # -> Points, Tangents, Parameters
pdecon_7 = Deconstruct(Point=divide_2.Points)  # -> XComponent, YComponent, ZComponent
pt_6 = ConstructPoint(XCoordinate=pdecon_6.XComponent, YCoordinate=pdecon_6.YComponent, ZCoordinate=pdecon_7.ZComponent)
pline_3 = PolyLine(Vertices=pt_6, Closed=False)
spiralcontours_base_zinterp = Data(pline_3)

# ----
# comments & notes: create intro on first layer
spiral_points_a_raw_2 = Data(spiral_points_a_raw)
tstat_31 = TreeStatistics(Tree=spiral_points_a_raw_2)  # -> Paths, Length, Count
item_17 = ListItem(List=tstat_31.Paths, Index="0", Wrap=True)
branch_22 = TreeBranch(Tree=spiral_points_a_raw_2, Path=item_17, MaintainPaths=True)
item_18 = ListItem(List=branch_22, Index=0, Wrap=True)
merge_14 = Merge(Data1=flatten(branch_22), Data2=flatten(item_18))
lng_21 = ListLength(List=merge_14)
spiral_intro_3 = Number(spiral_intro)
multiplication_8 = Multiplication(A=lng_21, B=spiral_intro_3)
subtraction_12 = Subtraction(A=lng_21, B="1")
round_7 = Round(Number=multiplication_8)  # -> Nearest, Floor, Ceiling
min_4 = Minimum(A=subtraction_12, B=round_7.Ceiling)
split_5 = SplitList(List=merge_14, Index=min_4)  # -> ListA, ListB
pline_4 = PolyLine(Vertices=split_5.ListA, Closed=False)
spiralcontours_botextension = Data(pline_4)

# ----
# comments & notes: create extension on last layer
spiral_points_b_3 = Data(spiral_points_b)
tstat_32 = TreeStatistics(Tree=spiral_points_b_3)  # -> Paths, Length, Count
item_19 = ListItem(List=tstat_32.Paths, Index="-1", Wrap=True)
branch_23 = TreeBranch(Tree=spiral_points_b_3, Path=item_19, MaintainPaths=True)
lng_22 = ListLength(List=branch_23)
spiral_outro_2 = Number(spiral_outro)
multiplication_9 = Multiplication(A=lng_22, B=spiral_outro_2)
subtraction_13 = Subtraction(A=lng_22, B="1")
round_8 = Round(Number=multiplication_9)  # -> Nearest, Floor, Ceiling
min_5 = Minimum(A=subtraction_13, B=round_8.Nearest)
split_6 = SplitList(List=branch_23, Index=min_5)  # -> ListA, ListB
pline_5 = PolyLine(Vertices=split_6.ListA, Closed=False)
spiralcontours_topextension = Data(pline_5)

spiralcontours_base_zinterp_2 = Data(spiralcontours_base_zinterp)
mirkos_spiralization_enabled_2 = Data(mirkos_spiralization_enabled)
spiralcontours_base_2 = Data(spiralcontours_base)
spiralcontours_botextension_2 = Data(spiralcontours_botextension)
spiralcontours_topextension_2 = Data(spiralcontours_topextension)
filter_72 = StreamFilter(Gate=mirkos_spiralization_enabled_2, Stream0=spiralcontours_base_2, Stream1=spiralcontours_base_zinterp_2)
merge_15 = Merge(Data1=flatten(spiralcontours_botextension_2), Data2=flatten(filter_72), Data3=flatten(spiralcontours_topextension_2))  # -> flatten(Result)
join_7 = JoinCurves(Curves=merge_15, Preserve=False)
spiral_curve = Data(join_7)

enableprintpathmanipulation_afterspiral = Data(enable_ppm_after_spiral)
spiral_curve_2 = Data(spiral_curve)
gate_20 = StreamGate(Stream=spiral_curve_2, Gate=enableprintpathmanipulation_afterspiral)  # -> Target0, Target1
spiral_curve_3 = Data(gate_20.Target1)

# ----
# comments & notes: THIS IS JUST A FAIRLY SIMPLE EXAMPLE ...
spiral_curve_4 = Data(spiral_curve_3)
divlength = DivideLength(Curve=spiral_curve_4, Length=Slider(1, range=1..50))  # -> Points, Tangents, Parameters
partition = PartitionList(List=divlength.Points, Size=Slider(2, range=0..10))
geo = Geometry([<brep referenced from the Rhino model> x3])
printing_geometry_9 = Geometry(printing_geometry)
mesh = MeshBrep(
    Brep=geo,
    Settings={GridMaxCount=0, GridMinCount=16, JaggedSeams=False, MaxEdgeLength=0, MinEdgeLength=0.0001, MinTolerance=0, Refine=True, RefineAngle=0, RelativeTolerance=0.65, SimplePlanes=True, Tolerance=0})
split_7 = SplitList(List=partition, Index="2")  # -> ListA, ListB
pdecon_8 = Deconstruct(Point=split_7.ListA)  # -> XComponent, YComponent, ZComponent
bnd = Bounds(Numbers=flatten(pdecon_8.ZComponent))
crv = Curve(<curve referenced from the Rhino model>)
remap = RemapNumbers(Value=pdecon_8.ZComponent, Source=bnd, Target=Domain(0, 1))  # -> Mapped, Clipped
mjoin_2 = MeshJoin(Meshes=mesh)
graph = GraphMapper(remap.Mapped, x0=0, x1=1, y0=0, y1=1, container_name="Bezier", cpx=[0, 0.2527412176, 0.7872578502, 1], cpy=[0, 1, 1, 0])
pull = PullPoint(Point=split_7.ListA, Geometry=mjoin_2, ClosestOnly=True)  # -> ClosestPoint, Distance, Index
dom_3 = ConstructDomain(DomainStart="0", DomainEnd=Slider(5, range=-100..100))
dom_4 = ConstructDomain(DomainStart="0", DomainEnd="1")
bnd_2 = Bounds(Numbers=flatten(pull.Distance))
remap_2 = RemapNumbers(Value=pull.Distance, Source=bnd_2, Target=dom_4)  # -> Mapped, Clipped
remap_3 = RemapNumbers(Value=graph, Source="0 To 1", Target=dom_3)  # -> Mapped, Clipped
meshcp = MeshClosestPoint(Point=split_7.ListA, Mesh=printing_geometry_9)  # -> Point, Index, Parameter
multiplication_10 = Multiplication(A=remap_2.Mapped, B=remap_3.Mapped)
meval = MeshEval(Mesh=printing_geometry_9, Parameter=meshcp.Parameter)  # -> Point, Normal, Colour
amp_8 = Amplitude(Vector=meval.Normal, Amplitude=multiplication_10)
devec = DeconstructVector(Vector=amp_8)  # -> XComponent, YComponent, ZComponent
vec = VectorXYZ(XComponent=devec.XComponent, YComponent=devec.YComponent, ZComponent=0)  # -> Vector, Length
move_11 = Move(Geometry=split_7.ListA, Motion=vec.Vector)  # -> Geometry, Transform
merge_16 = Merge(Data1=move_11.Geometry, Data2=split_7.ListB)  # -> flatten(Result)
intcrv = Interpolate(Vertices=merge_16, Degree=3, Periodic=False, KnotStyle=1)  # -> Curve, Length, Domain
divide_3 = DivideCurve(Count=10, Kinks=False)  # -> Points, Tangents, Parameters
topoly_7 = CurveToPolyline(Curve=intcrv.Curve, ToleranceDistance=Slider(0.01, range=0..1), ToleranceAngle=0)  # -> Polyline, Segments
manipulated_printpath = Data(topoly_7.Polyline)

enableprintpathmanipulation_afterspiral_2 = Data(enableprintpathmanipulation_afterspiral)
manipulated_printpath_2 = Data(manipulated_printpath)
filter_73 = StreamFilter(Gate=enableprintpathmanipulation_afterspiral_2, Stream0=gate_20.Target0, Stream1=manipulated_printpath_2)
spiral_curve_5 = Data(filter_73)

# ----
# comments & notes: merge spiral and floor curves if floor is enabled
unified_wall_floor_layers_2 = Geometry(unified_wall_floor_layers)
spiral_curve_6 = Data(spiral_curve_5)
null_7 = NullItem(Item=unified_wall_floor_layers_2)  # -> NullFlags, InvalidFlags, Description
tstat_33 = TreeStatistics(Tree=spiral_curve_6)  # -> Paths, Length, Count
tstat_34 = TreeStatistics(Tree=unified_wall_floor_layers_2)  # -> Paths, Length, Count
or_11 = GateOr(A=null_7.NullFlags, B=null_7.InvalidFlags)
item_20 = ListItem(List=tstat_34.Paths, Index=0, Wrap=True)  # -> Item1, Item
not_8 = GateNot(A=or_11)
dpath_5 = DeconstructPath(Branch=item_20.Item1)
lng_23 = ListLength(List=dpath_5)  # -> expr("x-1", Length)
split_8 = SplitList(List=dpath_5, Index=lng_23)  # -> ListA, ListB
addition_2 = Addition(A=split_8.ListB, B="1")
merge_17 = Merge(Data1=split_8.ListA, Data2=addition_2)
path_2 = ConstructPath(Indices=merge_17)
replace_6 = ReplacePaths(Data=spiral_curve_6, Search=tstat_33.Paths, Replace=path_2)
filter_74 = StreamFilter(Gate=not_8, Stream0=spiral_curve_6, Stream1=replace_6)
merge_18 = Merge(Data1=unified_wall_floor_layers_2, Data2=filter_74)
slice_curves_spiralized_floormerged = Curve(merge_18)

# ----
# comments & notes: merge final slice curves (from parallel slicing & addfloor slicing) with all infill curves
print_infill_before_walls_3 = Data(print_infill_before_walls)
slice_curves_14 = Curve(slice_curves_12)
floor_infill_curves_3 = Curve(floor_infill_curves)
cap_infill_curves_2 = Curve(cap_infill_curves)
merge_19 = Merge(Data1=floor_infill_curves_3, Data2=cap_infill_curves_2)
merge_20 = Merge(Data1=slice_curves_14, Data2=merge_19)
merge_21 = Merge(Data1=merge_19, Data2=slice_curves_14)
filter_75 = StreamFilter(Gate=print_infill_before_walls_3, Stream0=merge_20, Stream1=merge_21)
unified_slice_curves = Data(filter_75)

# ----
# CREATE SKIRT BASE CURVE
slice_curves_spiralized_floormerged_2 = Data(slice_curves_spiralized_floormerged)
skirt_polyline_tolerance = Slider(0.1, range=0..0.1)
skirt_entry_length = Slider(10, range=0..100)
# MERGE CURVES AND SLICES
# TO GET FINAL PRINTING CURVES
unified_slice_curves_2 = Curve(unified_slice_curves)
open_wall_curves = Curve(slice_curves_open)
# comments & notes: MERGE CURVES AND SLICES TO GET FINAL PRINTING CURVES
merge_22 = Merge(Data1=unified_slice_curves_2, Data2=open_wall_curves, Data3=slice_curves_spiralized_floormerged_2)
tstat_35 = TreeStatistics(Tree=merge_22)  # -> Paths, Length, Count
item_21 = ListItem(List=tstat_35.Paths, Index=0, Wrap=True)  # -> Item, Item1, Item2, Item3
branch_24 = TreeBranch(Tree=merge_22, Path=[item_21.Item, item_21.Item1, item_21.Item2, item_21.Item3], MaintainPaths=True)  # -> flatten(Branch)
project_6 = Project(Geometry=branch_24, Plane=PlaneXY(0, 0, 0))  # -> Geometry, Transform
comments_notes_30 = Panel("create skirt curve")
explode_7 = Explode(Curve=project_6.Geometry, Recursive=True)  # -> Segments, flatten(Vertices)
hull = ConvexHull(Points=explode_7.Vertices, Plane=PlaneXY(0, 0, 0))  # -> Hull, HullZ, Indices
skirt_offset_2 = Data(skirt_offset)
xy_8 = XYPlane(Origin=Point(0, 0, 0))
offset = OffsetCurve(Curve=hull.HullZ, Distance=skirt_offset_2, Plane=xy_8, Corners=1)
skirt_base_crv = Data(offset)

# ----
# comments & notes: merge slices or spiral with open remaining printing curves
slice_curves_spiralized_floormerged_3 = Data(slice_curves_spiralized_floormerged)
spiralization_enabled_2 = Boolean(spiralization_enabled)
unified_slice_curves_3 = Curve(unified_slice_curves)
open_wall_curves_2 = Curve(slice_curves_open)
np_slicing_enabled_6 = Boolean(np_slicing_enabled)
gate_21 = StreamGate(Stream=slice_curves_spiralized_floormerged_3, Gate=np_slicing_enabled_6)  # -> Target0, Target1
gate_22 = StreamGate(Stream=unified_slice_curves_3, Gate=np_slicing_enabled_6)  # -> Target0, Target1
merge_23 = Merge(Data1=gate_21.Target0, Data2=open_wall_curves_2)
merge_24 = Merge(Data1=gate_22.Target0, Data2=open_wall_curves_2)
filter_76 = StreamFilter(Gate=np_slicing_enabled_6, Stream0=merge_23, Stream1=slice_curves_spiralized_floormerged_3)
filter_77 = StreamFilter(Gate=np_slicing_enabled_6, Stream0=merge_24, Stream1=unified_slice_curves_3)
filter_78 = StreamFilter(Gate=spiralization_enabled_2, Stream0=filter_77, Stream1=filter_76)
unified_layer_printing_curves = Geometry(filter_78)

skirt_polyline_tolerance_2 = Data(skirt_polyline_tolerance)

# ----
# comments & notes: create skirt entry line
# comments & notes: move seam to midpt of longest segment
skirt_base_crv_2 = Data(skirt_base_crv)
explode_8 = Explode(Curve=skirt_base_crv_2, Recursive=True)  # -> Segments, Vertices
len_2 = Length(Curve=explode_8.Segments)
sort_4 = SortList(Keys=len_2, ValuesA=explode_8.Segments)  # -> Keys, reverse(ValuesA)
item_22 = ListItem(List=sort_4.ValuesA, Index=0, Wrap=True)
eval_2 = EvaluateCurve(Curve=reparameterize(item_22), Parameter="0.5")  # -> Point, Tangent, Angle
crv_cp = CurveClosestPoint(Point=eval_2.Point, Curve=reparameterize(skirt_base_crv_2))  # -> Point, Parameter, Distance
seam = Seam(Curve=reparameterize(skirt_base_crv_2), Seam=crv_cp.Parameter)
len_3 = Length(Curve=seam)
pcen_10 = PolygonCenter(Polyline=seam)  # -> CenterV, CenterE, CenterA
end_2 = EndPoints(Curve=seam)  # -> Start, End
skirt_entry_length_2 = Data(skirt_entry_length)
subtraction_14 = Subtraction(A=len_3, B="1.0")
vec2pt_4 = Vector2Pt(PointA=pcen_10.CenterV, PointB=end_2.Start, Unitize=False)  # -> Vector, Length
eval_3 = EvaluateLength(Curve=reparameterize(seam), Length=subtraction_14, Normalized=invert(True))  # -> Point, Tangent, Parameter
amp_9 = Amplitude(Vector=unitize(vec2pt_4.Vector), Amplitude=skirt_entry_length_2)
dom_5 = ConstructDomain(DomainStart="0", DomainEnd=eval_3.Parameter)
move_12 = Move(Geometry=end_2.Start, Motion=amp_9)  # -> Geometry, Transform
subcrv_3 = SubCurve(BaseCurve=reparameterize(seam), Domain=dom_5)
ln_2 = Line(StartPoint=move_12.Geometry, EndPoint=end_2.Start)
merge_25 = Merge(Data1=flatten(ln_2), Data2=flatten(subcrv_3))
skirt_polyline_tolerance_3 = Data(skirt_polyline_tolerance_2)
join_8 = JoinCurves(Curves=merge_25, Preserve=False)
fillet_3 = Fillet(Curve=join_8, Radius="2.0")
topoly_8 = CurveToPolyline(Curve=fillet_3, ToleranceDistance=skirt_polyline_tolerance_3, ToleranceAngle=0)  # -> Polyline, Segments
skirt_curve = Curve(topoly_8.Polyline)

# ----
# CORRECT MODEL PLACEMENT
# comments & notes: center printing geometry to catch cases where the original input object is "flying" or "below 0"
# comments & notes: move everything (!) by 1x layer height to avoid starting the print at ZMAX (0)
unified_layer_printing_curves_2 = Geometry(unified_layer_printing_curves)
skirt_curve_2 = Curve(skirt_curve)
bbox_7 = BoundingBox(Content=flatten(unified_layer_printing_curves_2), Plane=PlaneXY(0, 0, 0), UnionBox=True)  # -> Box, Box_2
volume_4 = Volume(Geometry=bbox_7.Box)  # -> Volume, Centroid
debox_6 = DeconstructBox(Box=bbox_7.Box)  # -> Plane, X, Y, Z
pdecon_9 = Deconstruct(Point=volume_4.Centroid)  # -> XComponent, YComponent, ZComponent
dedomain_9 = DeconstructDomain(Domain=debox_6.Z)  # -> Start, End
pt_7 = ConstructPoint(XCoordinate=pdecon_9.XComponent, YCoordinate=pdecon_9.YComponent, ZCoordinate=dedomain_9.Start)
xy_9 = XYPlane(Origin=Point(0, 0, 0))
vec2pt_5 = Vector2Pt(PointA=pt_7, PointB=xy_9, Unitize=False)  # -> Vector, Length
move_13 = Move(Geometry=unified_layer_printing_curves_2, Motion=vec2pt_5.Vector)  # -> Geometry, Transform
move_14 = Move(Geometry=skirt_curve_2, Motion=vec2pt_5.Vector)  # -> Geometry, Transform
layer_height_6 = Number(layer_height)
Z_9 = UnitZ(Factor=layer_height_6)
move_15 = Move(Geometry=move_14.Geometry, Motion=Z_9)  # -> Geometry, Transform
move_16 = Move(Geometry=move_13.Geometry, Motion=Z_9)  # -> Geometry, Transform
unified_layer_printing_curves_3 = Geometry(move_16.Geometry)
skirt_curve_3 = Curve(move_15.Geometry)

# ----
# comments & notes: CREATE  OFFSET VECTOR & LEADERS
# CREATE  OFFSET VECTOR & LEADERS
# comments & notes: construct a leader and a corresponding plane for the annotation
# comments & notes: compute offset vector for visualisation
unified_layer_printing_curves_4 = Geometry(unified_layer_printing_curves_3)
inject_custom_curves_12 = Data(inject_custom_curves)
printing_geometry_10 = Geometry(printing_geometry)
filter_79 = StreamFilter(Gate=inject_custom_curves_12, Stream0=printing_geometry_10, Stream1=flatten(unified_layer_printing_curves_4))
bbox_8 = BoundingBox(Content=filter_79, Plane=PlaneXY(0, 0, 0), UnionBox=True)  # -> Box, Box_2
debox_7 = DeconstructBox(Box=bbox_8.Box)  # -> Plane, X, Y, Z
dedomain_10 = DeconstructDomain(Domain=debox_7.X)  # -> Start, End
subtraction_15 = Subtraction(A=dedomain_10.End, B=dedomain_10.Start)
X = UnitX(Factor=1)
multiplication_11 = Multiplication(A=subtraction_15, B="0.5")
Y = UnitY(Factor=1)  # -> expr("x*-1", UnitVector)
dedomain_11 = DeconstructDomain(Domain=debox_7.Y)  # -> Start, End
X_2 = UnitX(Factor=1)
amp_10 = Amplitude(Vector=X, Amplitude=subtraction_15)  # -> expr("x*2", Vector)
addition_3 = Addition(A=dedomain_10.Start, B=multiplication_11)
addition_4 = Addition(A=X_2, B=Y)
amp_11 = Amplitude(Vector=Y, Amplitude=Slider(20, range=0..100))
pt_8 = ConstructPoint(XCoordinate=addition_3, YCoordinate=expr("x*1.5", dedomain_11.Start), ZCoordinate=0)
amp_12 = Amplitude(Vector=addition_4, Amplitude=Slider(120, range=0..200))
move_17 = Move(Geometry=pt_8, Motion=amp_11)  # -> Geometry, Transform
move_18 = Move(Geometry=move_17.Geometry, Motion=expr("x*0.5", amp_12))  # -> Geometry, Transform
xy_10 = XYPlane(Origin=move_18.Geometry)
move_19 = Move(Geometry=move_17.Geometry, Motion=amp_12)  # -> Geometry, Transform
align = AlignPlane(Plane=xy_10, Direction=addition_4)  # -> Plane, Angle
deplane_2 = DeconstructPlane(Plane=align.Plane)  # -> Origin, XAxis, YAxis, ZAxis
merge_26 = Merge(Data1=pt_8, Data2=move_17.Geometry, Data3=move_19.Geometry)
move_20 = Move(Geometry=align.Plane, Motion=expr("x*1.5", deplane_2.YAxis))  # -> Geometry, Transform
pline_6 = PolyLine(Vertices=merge_26, Closed=False)
vis_offset_vector = Vector(amp_10)
vis_leader_plane = Data(move_20.Geometry)
vis_leader = Curve(pline_6)

# ----
# LAYER HEIGHT ANALYSIS
inject_custom_curves_13 = Data(inject_custom_curves)
layer_height_analysis_2 = Data(layer_height_analysis)
spiralization_enabled_3 = Boolean(spiralization_enabled)
slice_curves_15 = Curve(slice_curves_5)
spiralcontours_base_3 = Data(spiralcontours_base)
filter_80 = StreamFilter(Gate=spiralization_enabled_3, Stream0=slice_curves_15, Stream1=spiralcontours_base_3)
filter_81 = StreamFilter(Gate=inject_custom_curves_13, Stream0=layer_height_analysis_2, Stream1="False")
filter_82 = StreamFilter(Gate=filter_81, Stream1=filter_80)
orderbranchingslicecurves = CSharpScript(C=filter_82)  # -> out, OC; inputs C: tree of Curve
# ---------- orderbranchingslicecurves: C# usings ----------
using Rhino.Collections;
# ---------- orderbranchingslicecurves: C# ----------
    DataTree<PolylineCurve> PLCS = new DataTree<PolylineCurve>();

    for (int i = 0; i < C.BranchCount; i++)
    {
      for (int j = 0; j < C.Branches[i].Count; j++)
      {
        PLCS.Add(C.Branches[i][j].ToPolyline(0.1, 0, 0, 0), C.Paths[i]);
      }
    }

    OC = OrderSliceCurves(PLCS);
# ---------- orderbranchingslicecurves: C# additional code ----------
  public DataTree<PolylineCurve> OrderSliceCurves(DataTree<PolylineCurve> ContourCurves)
  {
    // create copy of datatree to avoid messing up things
    DataTree<PolylineCurve> SliceCurves = new DataTree<PolylineCurve>(ContourCurves);

    // loop over datatree and ensure correct order
    for (int i = 0; i < SliceCurves.BranchCount - 1; i++)
    {
      // get branches
      var this_branch = SliceCurves.Branches[i];
      var next_branch = SliceCurves.Branches[i + 1];

      // case 1: this branch one curve and next branch one curve
      if (this_branch.Count == 1 && next_branch.Count == 1)
      {
        //Print("Case 1, 1 -> 1 (nothing done)");
        // nothing needs to be done
      }
        // case 2: this branch one curve and next branch multiple curves
      else if (this_branch.Count == 1 && next_branch.Count > 1)
      {
        //Print("Case 2, 1 -> N");
        // loop over next branch and find all centerpoints to compare against

        Point3dList ptL = new Point3dList();
        for (int k = 0; k < next_branch.Count; k++)
        {
          Point3d cpB = next_branch[k].ToPolyline().CenterPoint();
          ptL.Add(cpB);
        }
        // create new list for storage
        List<PolylineCurve> OrderedNextBranch = new List<PolylineCurve>();
        // get curve centerpoint
        Point3d cpA = this_branch[0].ToPolyline().CenterPoint();
        // compare against point3dlist of other centerpoints
        int idx = ptL.ClosestIndex(cpA);
        OrderedNextBranch.Add(next_branch[idx].Duplicate() as PolylineCurve);
        next_branch.RemoveAt(idx);
        OrderedNextBranch.AddRange(next_branch);
        // clear data
        ptL.Clear();
        // restructure next branch of contours tree
        SliceCurves.Branches[i + 1].Clear();
        SliceCurves.Branches[i + 1].AddRange(OrderedNextBranch);
      }
        // case 3: this branch and next branch have multiple curves but the same count
      else if (this_branch.Count > 1 && this_branch.Count == next_branch.Count)
      {
        //Print("Case 3, N -> N");
        // create new list for storage
        List<PolylineCurve> OrderedNextBranch = new List<PolylineCurve>();
        // loop over all curves in this branch
        for (int j = 0; j < this_branch.Count; j++)
        {
          if (next_branch.Count < 1) break;
          // loop over next branch and find all centerpoints to compare against
          Point3dList ptL = new Point3dList();
          for (int k = 0; k < next_branch.Count; k++)
          {
            Point3d cpB = next_branch[k].ToPolyline().CenterPoint();
            ptL.Add(cpB);
          }
          // get curve centerpoint
          Point3d cpA = this_branch[j].ToPolyline().CenterPoint();
          // compare against point3dlist of other centerpoints
          int idx = ptL.ClosestIndex(cpA);
          // add closest item to ordered list
          OrderedNextBranch.Add(next_branch[idx].Duplicate() as PolylineCurve);
          // remove closest item from candidates
          next_branch.RemoveAt(idx);
          // clear data
          ptL.Clear();
        }
        // restructure next branch of contours tree
        SliceCurves.Branches[i + 1].Clear();
        SliceCurves.Branches[i + 1].AddRange(OrderedNextBranch);
      }
        // case 4: this branch has more curves than next branch
      else if (this_branch.Count > 1 && next_branch.Count > 1 && this_branch.Count > next_branch.Count)
      {
        //Print("Case 4, N -> M>N (VERIFY!)");
        // create new list for storage
        List<PolylineCurve> OrderedNextBranch = new List<PolylineCurve>();
        // loop over all curves in this branch
        for (int j = 0; j < this_branch.Count; j++)
        {
          if (next_branch.Count < 1) break;
          // loop over next branch and find all centerpoints to compare against
          Point3dList ptL = new Point3dList();
          for (int k = 0; k < next_branch.Count; k++)
          {
            Point3d cpB = AreaMassProperties.Compute(next_branch[k]).Centroid;
            ptL.Add(cpB);
          }
          // get curve centerpoint
          Point3d cpA = AreaMassProperties.Compute(this_branch[j]).Centroid;
          // compare against point3dlist of other centerpoints
          int idx = ptL.ClosestIndex(cpA);
          // add closest item to ordered list
          OrderedNextBranch.Add(next_branch[idx].Duplicate() as PolylineCurve);
          // remove closest item from candidates
          next_branch.RemoveAt(idx);
          // clear data
          ptL.Clear();
        }
        // restructure next branch of contours tree
        SliceCurves.Branches[i + 1].Clear();
        SliceCurves.Branches[i + 1].AddRange(OrderedNextBranch);
      }
        // case 5: this branch has less curves than next branch
      else if (this_branch.Count > 1 && next_branch.Count > 1 && this_branch.Count < next_branch.Count)
      {
        //Print("Case 5, N -> M<N (VERIFY)");
        // loop over next branch and find all centerpoints to compare against
        Point3dList ptL = new Point3dList();
        for (int k = 0; k < next_branch.Count; k++)
        {
          Point3d cpB = next_branch[k].ToPolyline().CenterPoint();
          ptL.Add(cpB);
        }
        // create new list for storage
        List<PolylineCurve> OrderedNextBranch = new List<PolylineCurve>();
        // create duplicate list for looping
        List<PolylineCurve> next_branch_dup = new List<PolylineCurve>(next_branch);
        // loop over all curves in this branch
        for (int j = 0; j < this_branch.Count; j++)
        {
          // get curve centerpoint
          Point3d cpA = this_branch[j].ToPolyline().CenterPoint();
          // compare against point3dlist of other centerpoints
          int idx = ptL.ClosestIndex(cpA);
          // add closest curve based on comparison to new list
          OrderedNextBranch.Add(next_branch[idx].Duplicate() as PolylineCurve);
          next_branch_dup.Remove(next_branch[idx]);
        }
        // add remaining curves from next branch to list
        OrderedNextBranch.AddRange(next_branch_dup);
        // clear data
        ptL.Clear();
        // restructure next branch of contours tree
        SliceCurves.Branches[i + 1].Clear();
        SliceCurves.Branches[i + 1].AddRange(OrderedNextBranch);
      }
        // case 6: this branch has multiple curves but next branch only has one
      else if (this_branch.Count > 1 && next_branch.Count == 1)
      {
        //Print("Case 6, N -> 1 (nothing done)");
      }
    }

    return SliceCurves;
  }
# ---------- end orderbranchingslicecurves ----------
contourdeviation = CSharpScript(Contours=orderbranchingslicecurves.OC)  # -> out, MinDist, MaxDist, MinA, MaxA, MinB, MaxB; inputs Contours: tree of Curve
# ---------- contourdeviation: C# usings ----------
using System.Linq;
# ---------- contourdeviation: C# ----------
    DataTree<object> minDistances = new DataTree<object>();
    DataTree<object> maxDistances = new DataTree<object>();
    DataTree<object> minA = new DataTree<object>();
    DataTree<object> maxA = new DataTree<object>();
    DataTree<object> minB = new DataTree<object>();
    DataTree<object> maxB = new DataTree<object>();

    if (Contours != null)
    {
      for (int i = 0; i < Contours.BranchCount - 1; i++)
      {
        // measure distance from one curve to the next branch
        // branch can have one or many curves
        var this_branch = Contours.Branches[i];
        var next_branch = Contours.Branches[i + 1];

        // create path for output
        GH_Path ghp = new GH_Path(i);

        // case 1: both branches have one contour
        if (this_branch.Count == 1 && next_branch.Count == 1)
        {
          // get results
          List<object> results = GetMinMaxDistContours(this_branch[0], next_branch[0]);

          // add to output trees
          minDistances.Add((double) results[0], ghp);
          maxDistances.Add((double) results[1], ghp);
          minA.Add((Point3d) results[2], ghp);
          minB.Add((Point3d) results[3], ghp);
          maxA.Add((Point3d) results[4], ghp);
          maxB.Add((Point3d) results[5], ghp);
        }
          // case 2: both branches have multiple, but identical number of contours
        else if (this_branch.Count > 1 && this_branch.Count == next_branch.Count)
        {
          // compute min, max distance for every pair of contours

          //loop through branch pairs
          for (int j = 0; j < this_branch.Count; j++)
          {
            // get results
            List<object> results = GetMinMaxDistContours(this_branch[j], next_branch[j]);

            // add to output trees
            minDistances.Add((double) results[0], ghp);
            maxDistances.Add((double) results[1], ghp);
            minA.Add((Point3d) results[2], ghp);
            minB.Add((Point3d) results[3], ghp);
            maxA.Add((Point3d) results[4], ghp);
            maxB.Add((Point3d) results[5], ghp);
          }
        }
        // case 3: this branch has one contour, next branch has multiple contours
        // --> generate points on this branch's contour, pull cps for every other contour

        // case 4: this branch has multiple contours, next branch has one contour
        // --> generate points on next branch, pull cps for every contour in this branch

        // case 5: both branches have multiple contours but each has different number of contours
      }
      MinDist = minDistances;
      MaxDist = maxDistances;
      MinA = minA;
      MinB = minB;
      MaxA = maxA;
      MaxB = maxB;
    }
# ---------- contourdeviation: C# additional code ----------
  public List<object> GetMinMaxDistContours(Curve contourA, Curve contourB)
  {
    // init vars
    double minDist;
    double maxDist;

    Point3d minPtA = Point3d.Unset;
    Point3d minPtB = Point3d.Unset;

    Point3d maxPtA = Point3d.Unset;
    Point3d maxPtB = Point3d.Unset;

    // compute min, max distance
    double len = Math.Max(contourA.GetLength(), contourB.GetLength());
    int res = (int) Math.Round(len / 1.0, 0);

    Point3d[] ptA;
    contourA.DivideByCount(res, true, out ptA);

    minDist = double.MaxValue;
    maxDist = double.MinValue;

    for (int j = 0; j < ptA.Length; j++)
    {
      double tB;
      contourB.ClosestPoint(ptA[j], out tB);
      Point3d ptB = contourB.PointAt(tB);

      double dist = ptB.Z - ptA[j].Z;

      if (dist < minDist)
      {
        minDist = dist;
        minPtA = new Point3d(ptA[j]);
        minPtB = new Point3d(ptB);
      }

      if (dist > maxDist)
      {
        maxDist = dist;
        maxPtA = new Point3d(ptA[j]);
        maxPtB = new Point3d(ptB);
      }
    }
    return new List<object>{minDist, maxDist, minPtA, minPtB, maxPtA, maxPtB};
  }
# ---------- end contourdeviation ----------
ln_3 = Line(StartPoint=contourdeviation.MinA, EndPoint=contourdeviation.MinB)  # -> flatten(Line)
ln_4 = Line(StartPoint=contourdeviation.MaxA, EndPoint=contourdeviation.MaxB)  # -> flatten(Line)
vis_offset_vector_2 = Vector(vis_offset_vector)
move_21 = Move(Geometry=ln_4, Motion=expr("x*2", vis_offset_vector_2))  # -> Geometry, Transform
move_22 = Move(Geometry=ln_3, Motion=expr("x*2", vis_offset_vector_2))  # -> Geometry, Transform
avr_4 = Average(Input=[contourdeviation.MinDist, contourdeviation.MaxDist])  # -> flatten(ArithmeticMean)
comments_notes_31 = Panel("LAYER HEIGHT ANALYSIS")
avr_5 = Average(Input=avr_4)
bnd_3 = Bounds(Numbers=flatten([contourdeviation.MinDist, contourdeviation.MaxDist]))
bnd_4 = Bounds(Numbers=avr_4)
len_4 = Length(Curve=move_21.Geometry)
len_5 = Length(Curve=move_22.Geometry)
maxlines = Data(move_21.Geometry)
minlines = Data(move_22.Geometry)
panel_20 = Panel(bnd_3)
panel_21 = Panel(bnd_4)
panel_22 = Panel(avr_5)
dedomain_12 = DeconstructDomain(Domain=bnd_3)  # -> Start, End
format_2 = Format(Format="Average: {0}", Culture=127, Data0=panel_22)
format_3 = Format(Format="Average Bounds: {0}", Culture=127, Data0=panel_21)
format_4 = Format(Format="Extremes: {0}", Culture=127, Data0=panel_20)
gradient = Gradient(LowerLimit=dedomain_12.Start, UpperLimit=dedomain_12.End, Parameter=len_5, stops=[0: RGB(0, 0, 255), 1: RGB(255, 0, 0)])
gradient_2 = Gradient(LowerLimit=dedomain_12.Start, UpperLimit=dedomain_12.End, Parameter=len_4, stops=[0: RGB(0, 0, 255), 1: RGB(255, 0, 0)])
merge_27 = Merge(Data1=format_4, Data2=format_3, Data3=format_2)
eval_4 = EvaluateCurve(Curve=reparameterize(minlines), Parameter=0.5)  # -> Point, Tangent, Angle
number_slider_6 = Slider(2, range=0..10)
eval_5 = EvaluateCurve(Curve=reparameterize(maxlines), Parameter=0.5)  # -> Point, Tangent, Angle
filter_83 = StreamFilter(Gate=filter_81, Stream1=merge_27)
average = Panel(merge_27)
rtd_2 = RoundToDecimal(Numbers=len_5, DecimalPlaces=2)  # -> Rounded; inputs Numbers: list, DecimalPlaces: list of Int32
# ---------- rtd_2: Python ----------
"""
Rounds input numbers to a decimal place.
    Inputs:
        Numbers: The numbers to round. {list, float}
        DecimalPlaces: Number of decimal places for the generated random
                       numbers. Set to 0 for integer numbers.
                       Defaults to 2.
                       {list, int}
    Output:
        Rounded: The number rounded to DecimalPlaces.
                 {list/tree, float/int}
    Remarks:
        Author: Max Eschenbach
        License: MIT License
        Version: 230103
"""

# PYTHON STANDARD LIBRARY IMPORTS
from __future__ import division, print_function

# GHPYTHONLIB SDK IMPORTS
from ghpythonlib.componentbase import executingcomponent as component
import Grasshopper, GhPython
import System
import Rhino

# GHENV COMPONENT SETTINGS
ghenv.Component.Name = "RoundToDecimal"
ghenv.Component.NickName = "RTD"
ghenv.Component.Category = "FindersKeepers"
ghenv.Component.SubCategory = "5 Math"

class RoundToDecimal(component):
    
    def RunScript(self, Numbers, DecimalPlaces):
        
        if not DecimalPlaces:
                DecimalPlaces = [0]
        
        if Numbers:
            rounded = []
            for i, num in enumerate(Numbers):
                # retrieve decimalplaces
                if i < len(DecimalPlaces):
                    dp = DecimalPlaces[i]
                else:
                    dp = DecimalPlaces[-1]
                # round number
                rounded.append(round(num, dp))
        else:
            rounded = Grasshopper.DataTree[object]()
        
        # return outputs if you have them; here I try it for you:
        return rounded
# ---------- end rtd_2 ----------
rtd_3 = RoundToDecimal(Numbers=len_4, DecimalPlaces=2)  # -> Rounded; inputs Numbers: list, DecimalPlaces: list of Int32; same code as rtd_2
layerheightanalysis = Data(filter_83)
curvepreviewlw = CSharpScript(Curves=minlines, Colors=gradient, Thickness=number_slider_6)  # inputs Curves: list of Curve, Colors: list of Color, Thickness: list of Int32
# ---------- curvepreviewlw: C# ----------
// Grasshopper Script Instance
#region Usings
using System;
using System.Linq;
using System.Collections;
using System.Collections.Generic;
using System.Drawing;

using Rhino;
using Rhino.Geometry;

using Grasshopper;
using Grasshopper.Kernel;
using Grasshopper.Kernel.Data;
using Grasshopper.Kernel.Types;
#endregion

public class Script_Instance : GH_ScriptInstance
{
    #region Notes
    /* 
      Members:
        RhinoDoc RhinoDocument
        GH_Document GrasshopperDocument
        IGH_Component Component
        int Iteration

      Methods (Virtual & overridable):
        Print(string text)
        Print(string format, params object[] args)
        Reflect(object obj)
        Reflect(object obj, string method_name)

        Author: Max Benjamin Eschenbach
        License: MIT License
        Version: 250313
    */
    #endregion

    List<Curve> drawCurves;
    List<Color> drawColors;
    List<int> drawThickness;

    private void RunScript(
		List<Curve> Curves,
		List<Color> Colors,
		List<int> Thickness)
    {
        this.drawCurves = new List<Curve>();   
        this.drawColors = new List<Color>();
        this.drawThickness = new List<int>();

        if (Curves == null) return;
        if (Colors == null) this.drawColors = new List<Color>{Color.Black};
        else this.drawColors = Colors;

        if (Thickness == null) this.drawThickness = new List<int>{1};
        else this.drawThickness = Thickness;

        for (int i = 0; i < Curves.Count; i++)
        {
            if (Curves[i] != null)
            {
                this.drawCurves.Add(Curves[i]);
            }
            else
            {
                continue;
            }
            if (Colors == null || i >= Colors.Count || Colors[i] == null)
            {
                this.drawColors.Add(drawColors.Last());
            }
            else
            {
                this.drawColors.Add(Colors[i]);
            }
            if (Thickness == null || i >= Thickness.Count || Thickness[i] == null)
            {
                this.drawThickness.Add(drawThickness.Last());
            }
            else
            {
                this.drawThickness.Add(Thickness[i]);
            }
        }
    }

    override public void DrawViewportWires(IGH_PreviewArgs args)
    {
        if (this.drawCurves != null)
        {
            try
            {
                for (int i = 0; i < this.drawCurves.Count; i++)
                {
                    args.Display.DrawCurve(
                        this.drawCurves[i],
                        this.drawColors[i],
                        this.drawThickness[i]
                    );
                }
                
            }
            catch (Exception e)
            {
                this.AddRuntimeMessage(GH_RuntimeMessageLevel.Warning, "Error while drawing Preview!");
                this.Print(e.ToString());
            }
        }
        else
        {
            return;
        }
    }
}
# ---------- end curvepreviewlw ----------
curvepreviewlw_2 = CSharpScript(Curves=maxlines, Colors=gradient_2, Thickness=number_slider_6)  # inputs Curves: list of Curve, Colors: list of Color, Thickness: list of Int32; same code as curvepreviewlw
tag = TextTag(Location=eval_4.Point, Text=rtd_2, Colour=gradient)
tag_2 = TextTag(Location=eval_5.Point, Text=rtd_3, Colour=gradient_2)

# ----
# OVERHANG ANGLE ANALYSIS
overhang_angle_analysis_2 = Data(overhang_angle_analysis)
inject_custom_curves_14 = Data(inject_custom_curves)
slice_curves_16 = Curve(slice_curves_5)
filter_84 = StreamFilter(Gate=inject_custom_curves_14, Stream0=overhang_angle_analysis_2, Stream1="False")
filter_85 = StreamFilter(Gate=filter_84, Stream1=slice_curves_16)
tstat_36 = TreeStatistics(Tree=filter_85)  # -> Paths, Length, Count
angle_analysis_threshold_degr_2 = Data(angle_analysis_threshold_degr)
angle_analysis_resolution_2 = Data(angle_analysis_resolution)
shift_5 = ShiftList(List=tstat_36.Paths, Shift=-1, Wrap=False)
shift_6 = ShiftList(List=tstat_36.Paths, Shift=1, Wrap=False)
branch_25 = TreeBranch(Tree=filter_85, Path=shift_5, MaintainPaths=True)
branch_26 = TreeBranch(Tree=filter_85, Path=shift_6, MaintainPaths=True)
comments_notes_32 = Panel("OVERHANG ANGLE ANALYSIS")
divide_4 = DivideCurve(Curve=branch_26, Count=angle_analysis_resolution_2, Kinks=False)  # -> Points, Tangents, Parameters
pshift_23 = ShiftPaths(Data=divide_4.Points, Offset=-1)
crv_cp_2 = CurveClosestPoint(Point=pshift_23, Curve=branch_25)  # -> Point, Parameter, Distance
vis_offset_vector_3 = Vector(vis_offset_vector)
vec2pt_6 = Vector2Pt(PointA=crv_cp_2.Point, PointB=pshift_23, Unitize=False)  # -> Vector, Length
Z_10 = UnitZ(Factor=1)
ln_5 = Line(StartPoint=crv_cp_2.Point, EndPoint=pshift_23)
move_23 = Move(Geometry=ln_5, Motion=expr("x*3", vis_offset_vector_3))  # -> flatten(Geometry), Transform
angle = Angle(VectorA=vec2pt_6.Vector, VectorB=Z_10)  # -> Angle, Reflex
deg = Degrees(Radians=angle.Angle)  # -> flatten(Degrees)
multiplication_12 = Multiplication(A=angle_analysis_threshold_degr_2, B="0.75")
gradient_3 = Gradient(
    LowerLimit="0",
    UpperLimit=angle_analysis_threshold_degr_2,
    Parameter=deg,
    stops=[0: RGB(0, 128, 0), 0.5: RGB(255, 255, 0), 1: RGB(255, 0, 0)])
larger_14 = LargerThan(FirstNumber=deg, SecondNumber=multiplication_12)  # -> LargerThan, OrEqualTo
vis_leader_plane_2 = Data(vis_leader_plane)
vis_leader_2 = Curve(vis_leader)
sort_5 = SortList(Keys=deg)  # -> reverse(Keys), ValuesA
filter_86 = StreamFilter(Gate=filter_84, Stream1=vis_leader_2)
filter_87 = StreamFilter(Gate=filter_84, Stream1=vis_leader_plane_2)
item_23 = ListItem(List=sort_5.Keys, Index=0, Wrap=True)
dispatch_8 = Dispatch(List=move_23.Geometry, DispatchPattern=larger_14.LargerThan)  # -> ListA, ListB
rtd_4 = RoundToDecimal(Numbers=item_23, DecimalPlaces=2)  # -> Rounded; inputs Numbers: list, DecimalPlaces: list of Int32; same code as rtd_2
dispatch_9 = Dispatch(List=deg, DispatchPattern=larger_14.LargerThan)  # -> ListA, ListB
dispatch_10 = Dispatch(List=gradient_3, DispatchPattern=larger_14.LargerThan)  # -> ListA, ListB
move_24 = Move(Geometry=filter_86, Motion=expr("x*3", vis_offset_vector_3))  # -> Geometry, Transform
move_25 = Move(Geometry=filter_87, Motion=expr("x*3", vis_offset_vector_3))  # -> Geometry, Transform
swatch = ColourSwatch(SwatchColor=RGB(0, 0, 0))
eval_6 = EvaluateCurve(Curve=reparameterize(dispatch_8.ListA), Parameter=0.5)  # -> Point, Tangent, Angle
rtd_5 = RoundToDecimal(Numbers=dispatch_9.ListA, DecimalPlaces=2)  # -> Rounded; inputs Numbers: list, DecimalPlaces: list of Int32; same code as rtd_2
format_5 = Format(Format="Most Extreme Overhang: {0}°", Culture=127, Data0=rtd_4)
curvepreviewlw_3 = CSharpScript(Curves=move_23.Geometry, Colors=gradient_3, Thickness=Slider(3, range=0..10))  # inputs Curves: list of Curve, Colors: list of Color, Thickness: list of Int32; same code as curvepreviewlw
curvepreviewlw_4 = CSharpScript(Curves=move_24.Geometry, Colors=swatch)  # inputs Curves: list of Curve, Colors: list of Color, Thickness: list of Int32; same code as curvepreviewlw
tag_3 = TextTag3D(Location=move_25.Geometry, Text="Overhang Analysis", Size=Slider(8, range=0..10), Colour=swatch, Justification=8)
filter_88 = StreamFilter(Gate=filter_84, Stream1=format_5)
panel_23 = Panel(format_5)
tag_4 = TextTag(Location=eval_6.Point, Text=rtd_5, Colour=dispatch_10.ListA)
overhanganalysis = Data(filter_88)

# ----
# NON-PLANAR SLICING HEAT
# MESH SIMULATION VISUALIZATION
# comments & notes: NON-PLANAR SLICING HEAT MESH SIMULATION VISUALIZATION
# comments & notes: re-construct mesh with heat simulation colors
# comments & notes: only show heat colored mesh if NP slicing is enabled
# comments & notes: move mesh according to visualization offset vector
heatmesh_3 = Mesh(heatmesh)
heatvalues_2 = Data(heatvalues)
np_only_bot_boundary_3 = Boolean(np_only_bot_boundary)
bnd_5 = Bounds(Numbers=heatvalues_2)
dedomain_13 = DeconstructDomain(Domain=bnd_5)  # -> Start, End
filter_89 = StreamFilter(Gate=np_only_bot_boundary_3, Stream0=dedomain_13.Start, Stream1=dedomain_13.End)
filter_90 = StreamFilter(Gate=np_only_bot_boundary_3, Stream0=dedomain_13.End, Stream1=dedomain_13.Start)
gradient_4 = Gradient(
    LowerLimit=filter_89,
    UpperLimit=filter_90,
    Parameter=heatvalues_2,
    stops=[0: RGB(234, 38, 0), 0.25: RGB(234, 126, 0), 0.5: RGB(254, 244, 84), 0.75: RGB(173, 203, 249), 1: RGB(75, 107, 169)])
demesh_3 = DeconstructMesh(Mesh=heatmesh_3)  # -> Vertices, Faces, Colours, Normals
conmesh_2 = ConstructMesh(Vertices=demesh_3.Vertices, Faces=demesh_3.Faces, Colours=gradient_4)
vis_offset_vector_4 = Vector(vis_offset_vector)
np_slicing_enabled_7 = Boolean(np_slicing_enabled)
move_26 = Move(Geometry=conmesh_2, Motion=vis_offset_vector_4)  # -> Geometry, Transform
filter_91 = StreamFilter(Gate=np_slicing_enabled_7, Stream1=move_26.Geometry)
heatmesh_colored = Mesh(filter_91)

# ----
# NON-PLANAR SLICING HEAT
# MESH SIMULATION VISUALIZATION
# comments & notes: VISUALIZE DETECTED SHARP FEATURES (TRI-REMESHING)
sharp_features_3 = Curve(sharp_features)
# comments & notes: VISUALIZATION OF
# PRINTING, LAYER AND GCODE GEOMETRY
render_sharp_features_2 = Data(render_sharp_features)
vis_offset_vector_5 = Vector(vis_offset_vector)
move_27 = Move(Geometry=sharp_features_3, Motion=vis_offset_vector_5)  # -> Geometry, Transform
weight = Slider(2, range=0..5)
filter_92 = StreamFilter(Gate=render_sharp_features_2, Stream1=move_27.Geometry)
curvepreviewlw_5 = CSharpScript(Curves=filter_92, Colors=ColourSwatch(SwatchColor=RGB(255, 0, 0)), Thickness=weight)  # inputs Curves: list of Curve, Colors: list of Color, Thickness: list of Int32; same code as curvepreviewlw

# ----
# INPUT GEOMETRY
# LEADER & ANNOTATION
comments_notes_33 = Panel("""INPUT GEOMETRY
LEADER & ANNOTATION""")
vis_leader_plane_3 = Data(vis_leader_plane)
vis_leader_3 = Curve(vis_leader)
swatch_2 = ColourSwatch(SwatchColor=RGB(0, 0, 0))
curvepreviewlw_6 = CSharpScript(Curves=vis_leader_3, Colors=swatch_2)  # inputs Curves: list of Curve, Colors: list of Color, Thickness: list of Int32; same code as curvepreviewlw
tag_5 = TextTag3D(Location=vis_leader_plane_3, Text="Input Geometry", Size=Slider(8, range=0..10), Colour=swatch_2, Justification=8)

# ----
# comments & notes: visualize naked mesh/brep edges with magenta
# VISUALIZE MESH/BREP EDGES
# comments & notes: visualize interior mesh/brep edges with black
# comments & notes: extract brep/mesh edges and split in naked and interior edges
printing_geometry_11 = Geometry(printing_geometry)
vis_offset_vector_6 = Vector(vis_offset_vector)
render_print_geometry_and_not_inject_cus_2 = Boolean(render_print_geometry_and_not_inject_cus)  # "RENDER_PRINT_GEOMETRY_AND_NOT_INJECT_CUSTOM_CURVES"
custom_curves_at_origin_4 = Curve(custom_curves_at_origin)
comments_notes_34 = Panel("VISUALIZE MESH/BREP EDGES")
move_28 = Move(Geometry=printing_geometry_11, Motion=vis_offset_vector_6)  # -> Geometry, Transform
ismesh = CSharpScript(G=move_28.Geometry)  # -> M; inputs G: GeometryBase
# ---------- ismesh: C# ----------
// Grasshopper Script Instance
#region Usings
using System;
using System.Linq;
using System.Collections;
using System.Collections.Generic;
using System.Drawing;

using Rhino;
using Rhino.Geometry;

using Grasshopper;
using Grasshopper.Kernel;
using Grasshopper.Kernel.Data;
using Grasshopper.Kernel.Types;
#endregion

public class Script_Instance : GH_ScriptInstance
{
    #region Notes
    /* 
      Members:
        RhinoDoc RhinoDocument
        GH_Document GrasshopperDocument
        IGH_Component Component
        int Iteration

      Methods (Virtual & overridable):
        Print(string text)
        Print(string format, params object[] args)
        Reflect(object obj)
        Reflect(object obj, string method_name)
    */
    #endregion

    private void RunScript(GeometryBase G, ref object M)
    {
        if (G is Mesh)
        {
            M = true;
        }
        else if (G is Brep)
        {
            M = false;
        }
    }
}
# ---------- end ismesh ----------
move_29 = Move(Geometry=custom_curves_at_origin_4, Motion=vis_offset_vector_6)  # -> Geometry, Transform
gate_23 = StreamGate(Stream=move_28.Geometry, Gate=ismesh)  # -> Target0, Target1
medges_3 = MeshEdges(Mesh=gate_23.Target1)  # -> NakedEdges, InteriorEdges, NonManifoldEdges
edges_2 = BrepEdges(Brep=gate_23.Target0)  # -> Naked, Interior, NonManifold
filter_93 = StreamFilter(Gate=ismesh, Stream0=edges_2.Naked, Stream1=medges_3.NakedEdges)
filter_94 = StreamFilter(Gate=ismesh, Stream0=edges_2.Interior, Stream1=medges_3.InteriorEdges)
filter_95 = StreamFilter(Gate=render_print_geometry_and_not_inject_cus_2, Stream1=filter_93)
filter_96 = StreamFilter(Gate=render_print_geometry_and_not_inject_cus_2, Stream0=move_29.Geometry, Stream1=filter_94)
weight_2 = Slider(2, range=0..5)
weight_3 = Slider(1, range=0..5)
curvepreviewlw_7 = CSharpScript(Curves=flatten(filter_96), Colors=ColourSwatch(SwatchColor=RGB(0, 0, 0)), Thickness=weight_3)  # inputs Curves: list of Curve, Colors: list of Color, Thickness: list of Int32; same code as curvepreviewlw
curvepreviewlw_8 = CSharpScript(Curves=filter_95, Colors=ColourSwatch(SwatchColor=RGB(255, 0, 230)), Thickness=weight_2)  # inputs Curves: list of Curve, Colors: list of Color, Thickness: list of Int32; same code as curvepreviewlw

# ----
# comments & notes: RENDER PRINT GEOMETRY (MESH/BREP)
# RENDER PRINT GEOMETRY
# (MESH/BREP)
render_print_geometry_and_not_inject_cus_3 = Boolean(render_print_geometry_and_not_inject_cus)  # "RENDER_PRINT_GEOMETRY_AND_NOT_INJECT_CUSTOM_CURVES"
printing_geometry_12 = Geometry(printing_geometry)
vis_offset_vector_7 = Vector(vis_offset_vector)
move_30 = Move(Geometry=printing_geometry_12, Motion=vis_offset_vector_7)  # -> Geometry, Transform
np_slicing_enabled_8 = Boolean(np_slicing_enabled)
filter_97 = StreamFilter(Gate=render_print_geometry_and_not_inject_cus_3, Stream1=move_30.Geometry)
filter_98 = StreamFilter(Gate=np_slicing_enabled_8, Stream0=filter_97)
preview = CustomPreview(Geometry=filter_98, Material=ColourSwatch(SwatchColor=RGB(242, 242, 242)))

# ----
# PRINTING GEOMETRY
# LEADER & ANNOTATION
render_print_geometry_and_not_inject_cus_4 = Boolean(render_print_geometry_and_not_inject_cus)  # "RENDER_PRINT_GEOMETRY_AND_NOT_INJECT_CUSTOM_CURVES"
comments_notes_35 = Panel("""PRINTING GEOMETRY
LEADER & ANNOTATION""")
vis_offset_vector_8 = Vector(vis_offset_vector)
vis_offset_vector_9 = Vector(vis_offset_vector)
vis_leader_plane_4 = Data(vis_leader_plane)
vis_leader_4 = Curve(vis_leader)
move_31 = Move(Geometry=vis_leader_4, Motion=vis_offset_vector_8)  # -> Geometry, Transform
move_32 = Move(Geometry=vis_leader_plane_4, Motion=vis_offset_vector_9)  # -> Geometry, Transform
weight_4 = Slider(1, range=0..5)
swatch_3 = ColourSwatch(SwatchColor=RGB(0, 0, 0))
filter_99 = StreamFilter(Gate=render_print_geometry_and_not_inject_cus_4, Stream0="Injected Custom Curves", Stream1="Printing Geometry")
curvepreviewlw_9 = CSharpScript(Curves=move_31.Geometry, Colors=swatch_3, Thickness=weight_4)  # inputs Curves: list of Curve, Colors: list of Color, Thickness: list of Int32; same code as curvepreviewlw
tag_6 = TextTag3D(Location=move_32.Geometry, Text=filter_99, Size=Slider(8, range=0..10), Colour=swatch_3, Justification=8)

# ----
# MERGE LAYERS AND SKIRT
# comments & notes: merge layer curves with skirt curve (insert skirt into first layer branch)
layer_printing_curves = Geometry(unified_layer_printing_curves_3)
skirt_curve_4 = Curve(skirt_curve_3)
tstat_37 = TreeStatistics(Tree=layer_printing_curves)  # -> Paths, Length, Count
tstat_38 = TreeStatistics(Tree=skirt_curve_4)  # -> Paths, Length, Count
item_24 = ListItem(List=tstat_37.Paths, Index=0, Wrap=True)
replace_7 = ReplacePaths(Data=skirt_curve_4, Search=tstat_38.Paths, Replace=item_24)
merge_28 = Merge(Data1=replace_7, Data2=layer_printing_curves)
printing_curves = Curve(merge_28)

# ----
# REDUCE POLYLINES
# comments & notes: reduce polylines by removing insignificant vertices, making computation more efficient.
reduce = BooleanToggle(True)
printing_curves_2 = Curve(printing_curves)
gate_24 = StreamGate(Stream=printing_curves_2, Gate=reduce)  # -> Target0, Target1
redpline_6 = Reduce(Polyline=gate_24.Target1, Tolerance=Slider(0.01, range=0.001..1))  # -> Polyline, Reduction
filter_100 = StreamFilter(Gate=reduce, Stream0=gate_24.Target0, Stream1=redpline_6.Polyline)
printing_curves_3 = Curve(filter_100)

# ----
# CONTROL FLOW
# FLOOR LAYER PAUSE
# comments & notes: check if first layer has been skipped and adjust floor layer count accordingly
floor_layer_count_8 = Data(floor_layer_count)
printing_curves_4 = Geometry(printing_curves_3)
tstat_39 = TreeStatistics(Tree=printing_curves_4)  # -> Paths, Length, Count
item_25 = ListItem(List=tstat_39.Paths, Index=0, Wrap=True)
dpath_6 = DeconstructPath(Branch=item_25)
ma_13 = MassAddition(Input=dpath_6)  # -> Result, PartialResults
larger_15 = LargerThan(FirstNumber=ma_13.Result, SecondNumber="0")  # -> LargerThan, OrEqualTo
subtraction_16 = Subtraction(A=floor_layer_count_8, B=ma_13.Result)
filter_101 = StreamFilter(Gate=larger_15.LargerThan, Stream0=floor_layer_count_8, Stream1=subtraction_16)
real_floor_layer_count = Data(filter_101)

# ----
# GCODE CREATION
# DEVELOPMENT NOTES
# ---------------------------------------------------
# 3RD ITERATION OF GCODE GENERATOR
# ORIGINAL BY TOM SVILANS
# EDITED & EXTENDED BY MAX ESCHENBACH
# 
# 
# NOTES BY MAX
# ---------------------------------------------------
# GCODE Reference
# ------
# https://reprap.org/wiki/G-code
# 
# 
# Command Reference for Floor Pause
# ------
# G92 E0 ; Reset Extrusion Distance
# G1 X38.394 Y45.456 Z15.000 E0.000 F3000 ; Move to Pause position
# G04 P10000 ; DWELL
# 
# 
# First Test Evals 2023 Extrusion Rate
# ------
# Feed Setting: 15-20 %
# Adapt ExtrusionRate
# 15 % = 0,156
# 20 % = 0,208
# 
# 
# 4mm Nozzle Cura Settings (very old...)
# ------
# Line Width: 3.5
# Layer Height: 1.9
# Print Speed: 50 mm/s
# 
# 
# ORIGINAL NOTES BY TOM
# ---------------------------------------------------
# Wasp (60100), 4mm, 2mm lh, extrusion rate: 2.7
# Wasp (40100), 4mm, 2mm lh, extrusion rate: 0.28
# for 4mm 2.7
# for 2mm 1/4 of 2.7
# Toms original comment: I have since been working with an extrusion rate of 0.1 for the 40100 with the new extruder as it handles a much firmer material (c# tool)
layer_height_7 = Number(layer_height)
line_width_3 = Data(line_width)
printing_curves_5 = Curve(printing_curves_3)
create_gcode_2 = Data(create_gcode)
retractextension = Slider(6, range=0..10)
curveextensionretraction = BooleanToggle(True)
pauseafterfloor = BooleanToggle(True)
floor_slicing_enabled_2 = Boolean(add_floor_slicing_enabled)
pausetime_ms = Slider(30000, range=0..99999)
linewidth_2 = Panel(line_width_3)
print_speed_mm_min = Panel("3000")
retraction_speed_mm_min = Panel("1500")
z_hop_distance = Panel("1.0")
travel_speed_mm_min = Panel("6000")
layerheight = Panel(layer_height_7)
new_extrusion_rate_250312 = Panel("0.16")
retraction_constant = Panel("5.0")
real_floor_layer_count_2 = Data(real_floor_layer_count)
initial_extrusion_constant = Panel("6.0")
filter_102 = StreamFilter(Gate=create_gcode_2, Stream1=printing_curves_5)
and_15 = GateAnd(A=floor_slicing_enabled_2, B=pauseafterfloor)
extrusion_rate_230316 = Panel("0.208")
generategcode = CSharpScript(
    Paths=filter_102,
    PrintSpeed=print_speed_mm_min,
    TravelSpeed=travel_speed_mm_min,
    RetractionSpeed=retraction_speed_mm_min,
    ExtrusionRate=new_extrusion_rate_250312,
    InitExtrusionConstant=initial_extrusion_constant,
    RetractionConstant=retraction_constant,
    LayerHeight=layerheight,
    LineWidth=linewidth_2,
    RetractExtension=retractextension,
    CurveExtensionRetraction=curveextensionretraction,
    ZHopDistance=z_hop_distance,
    FloorLayerCount=real_floor_layer_count_2,
    PauseAfterFloor=and_15,
    PauseTime=pausetime_ms,
    ExtrusionRateMod=filter_48)  # -> out, GCODE; inputs Paths: tree of Polyline, PrintSpeed: Double, TravelSpeed: Double, RetractionSpeed: Double, ExtrusionRate: Double, InitExtrusionConstant: Double, RetractionConstant: Double, LayerHeight: Double, LineWidth: Double, RetractExtension: Double, CurveExtensionRetraction: Boolean, ZHopDistance: Double, FloorLayerCount: Int32, PauseAfterFloor: Boolean, PauseTime: Int32, ExtrusionRateMod: tree of Double
# ---------- generategcode: C# ----------
using System;
using System.Collections;
using System.Collections.Generic;

using Rhino;
using Rhino.Geometry;

using Grasshopper;
using Grasshopper.Kernel;
using Grasshopper.Kernel.Data;
using Grasshopper.Kernel.Types;
using System.Linq;
/// <summary>
/// This class will be instantiated on demand by the Script component.
/// </summary>
public class Script_Instance : GH_ScriptInstance
{
  #region Notes
    /* 
      Members:
        RhinoDoc RhinoDocument
        GH_Document GrasshopperDocument
        IGH_Component Component
        int Iteration

      Methods (Virtual & overridable):
        Print(string text)
        Print(string format, params object[] args)
        Reflect(object obj)
        Reflect(object obj, string method_name)
    */
    #endregion

  private void RunScript(
		DataTree<Polyline> Paths,
		double PrintSpeed,
		double TravelSpeed,
		double RetractionSpeed,
		double ExtrusionRate,
		double InitExtrusionConstant,
		double RetractionConstant,
		double LayerHeight,
		double LineWidth,
		double RetractExtension,
		bool CurveExtensionRetraction,
		double ZHopDistance,
		int FloorLayerCount,
		bool PauseAfterFloor,
		int PauseTime,
		DataTree<double> ExtrusionRateMod,
		ref object GCODE)
  {

    // catch empty paths ttree and return empty tree
    if (Paths.DataCount < 1)
    {
      GCODE = new Grasshopper.DataTree<object>();
      return;
    }

    // check if extrusion rate modified values correspond
    bool e_mod = true;
    int ptsum = 0;
    for (int i = 0; i < Paths.BranchCount; i++)
    {
      foreach (Polyline pl in Paths.Branches[i])
      {
        ptsum += pl.Count;
      }
    }
    if (ptsum != ExtrusionRateMod.DataCount)
    {
      e_mod = false;
      Print("ExtrusionRateMod values do not correspond with supplied Paths. " +
        "Constant ExtrusionRate will be used!");
    }

    // init list for storing GCODE strings
    List<string> gcode = new List<string>();

    // get all data from Paths input
    List<Polyline> paths = Paths.AllData();

    // compute union bbx with each layer
    BoundingBox bbx = BoundingBox.Empty;
    foreach (Polyline path in paths)
    {
      bbx.Union(path.BoundingBox);
    }

    // compute offset value from bbx
    Vector3d offset = new Vector3d(-bbx.Center.X, -bbx.Center.Y, 0);
    Print("Offset: {0}", offset);

    // SET CONSTANTS -----------------------------------------------
    // value for safe approach before first layer
    double z_safety = 5.0;

    // initial extrusion rate constant and retraction constant
    double extrusion_rate_extra = InitExtrusionConstant;
    double retraction_amount = RetractionConstant;

    // CREATE HEADER -----------------------------------------------
    Point3d p0 = paths[0][0] + offset;
    gcode.AddRange(new string[]
      {
      "; GCODE Generation Script by: Arkitekturens Teknologi (AT) + SuperFormLab",
      "; Modified, adapted and extended by: Max Eschenbach, DDU - Digital Design Unit, TU Darmstadt",
      string.Format("; Created by : {0}", System.Environment.UserName),
      string.Format("; File name  : {0}", GrasshopperDocument.DisplayName),
      string.Format("; Date time  : {0}", System.DateTime.Now.ToString("yyyy-MM-ddTHH\\:mm\\:ss")),
      ";",
      "M105 ; get extruder temperature",
      "M109 S0 ; set extruder temp to 0 (deactivate)",
      "M82 ; use absolute distances for extrusion",
      "G90 ; use absolute coordintes",
      "M106 S0 ; set fan speed to 0 (deactivate)",
      "M107 ; fan off",
      "M104 S0 T0 ; set hotend temperature to 0 (deactivate)",
      "G28 ; home all axes",
      "T0 ; set extruder to extruder 0 (first and only one)",
      "G21 ; set units to millimetres",
      // "M204 S200 ; set acceleration",
      "G92 E0 ; reset E distance",
      "; approach the first vertex using z safety height",
      string.Format("G0 X0.0 Y0.0 Z{0:0.000} F{1}", p0.Z + z_safety, 3000),
      "; approach first point with x and y coordinates",
      string.Format("G1 X{0:0.000} Y{1:0.000} Z{2:0.000}", p0.X, p0.Y, p0.Z + z_safety),
      "; --- END HEADER ---",
      });


    // CREATE PRINT PATHS GCODE  ------------------------------------
    Point3d temp = Paths.Branches[0][0][0];
    double emod_value = 1.0;

    // LOOP OVER ALL LAYERS (BRANCHES)
    for (int i = 0; i < Paths.BranchCount; i++)
    {
      // pause after floor printing on request
      if (PauseAfterFloor && FloorLayerCount > 0 && i == FloorLayerCount)
      {
        // add marker to GCODE out
        gcode.Add(string.Format("; ///// PAUSE AFTER FLOOR FOR {0} ms /////", PauseTime));
        // reset extrusion distance
        gcode.Add(string.Format("G92 E0 ; Reset Extrusion Distance"));
        // move 5mm upwards from last point
        gcode.Add(string.Format("G0 X{0:0.000} Y{1:0.000} Z{2:0.000} E{3:0.000} F{4}",
          p0.X, p0.Y, p0.Z + 5.0, 0.000, PrintSpeed));
        // move to pause position
        gcode.Add(string.Format("G0 X{0:0.000} Y{1:0.000} Z{2:0.000} E{3:0.000} F{4}",
          0.000, 0.000, p0.Z + 100.0, 0.000, PrintSpeed));
        // execute pause command
        gcode.Add(string.Format("G04 P{0:0} ; Dwell / Pause", PauseTime));
      }

      // add layer marker to GCODE out
      gcode.Add(string.Format("; ///// LAYER {0} /////", i + 1));

      // LOOP OVER ALL CURVES IN LAYER (BRANCH)
      for (int j = 0; j < Paths.Branches[i].Count; j++)
      {
        // set current path
        Polyline path = Paths.Branches[i][j];
        PolylineCurve pathcrv = path.ToPolylineCurve();
        // reset extrusion distance
        double ExtrusionDist = 0.0;
        // translate path according to offset
        path.Transform(Transform.Translation(offset));
        pathcrv.Transform(Transform.Translation(offset));
        // get first vertex
        p0 = path.First();
        // format first vertex to GCODE
        gcode.Add(string.Format("G1 X{0:0.000} Y{1:0.000} Z{2:0.000} E{3:0.000} F{4}",
          p0.X, p0.Y, p0.Z + ZHopDistance, ExtrusionDist, TravelSpeed));
        // set extrusion on first vertex (no distance here!)
        ExtrusionDist += extrusion_rate_extra;
        // set temporary vertex
        temp = p0;
        // loop over all vertices in path
        for (int k = 0; k < path.Count; k++)
        {

          // get point distance to previous point
          double ptDist = temp.DistanceTo(path[k]);
          if (k > 0 && ptDist < Rhino.RhinoDoc.ActiveDoc.ModelAbsoluteTolerance)
          {
            Print("Point Distance below tolerance, point is skipped!");
            continue;
          }

          // compute extrusion rate modified (if applicable)
          if (e_mod == true)
          {
            emod_value = ExtrusionRateMod.Branches[i][k];
          }

          // set extrusion distance based on pt distance and emod
          ExtrusionDist += ptDist * (ExtrusionRate * emod_value);

          // compile GCODE string
          // for first vertex use half print speed
          gcode.Add(string.Format("G1 X{0:0.000} Y{1:0.000} Z{2:0.000} E{3:0.000} F{4}",
            path[k].X, path[k].Y, path[k].Z, ExtrusionDist, (k == 0) ? PrintSpeed * 0.5 :  PrintSpeed));

          // set new temp vertex
          temp = path[k];
        }

        // retract on last vertex or extend during retraction move
        if (RetractExtension > 0.0)
        {
          if (CurveExtensionRetraction && path.IsClosedWithinTolerance(0.01) && path.Length > RetractExtension)
          {
            // move retractextension amount along the curve

            // find point on curve that is RetractionExtension mm along crv
            double ret_end_t;
            bool _suc = pathcrv.LengthParameter(RetractExtension, out ret_end_t);
            PolylineCurve subcrv = pathcrv.Split(new List<double>{0.0, ret_end_t})[0] as PolylineCurve;
            Polyline subpl = subcrv.ToPolyline();

            temp = subpl.First;
            for (int k = 1; k < subpl.Count; k++)
            {
              double ptDist = temp.DistanceTo(subpl[k]);
              if (k > 0 && ptDist < Rhino.RhinoDoc.ActiveDoc.ModelAbsoluteTolerance)
              {
                Print("Point Distance below tolerance, point is skipped!");
                continue;
              }

              // compute retraction amount for point
              ExtrusionDist -= (ptDist / RetractExtension) * retraction_amount;

              // create retraction gcode
              gcode.Add(string.Format("G1 X{0:0.000} Y{1:0.000} Z{2:0.000} E{3:0.000} F{4} ; RetractExtensionClosedCurve",
                subpl[k].X, subpl[k].Y, subpl[k].Z, ExtrusionDist, RetractionSpeed));

              // set new temp vertex
              temp = subpl[k];
            }

            // create z-hop gcode
            gcode.Add(string.Format("G1 X{0:0.000} Y{1:0.000} Z{2:0.000} E{3:0.000} F{4} ; Z-Hop",
              subpl.Last.X, subpl.Last.Y, subpl.Last.Z + ZHopDistance, ExtrusionDist, RetractionSpeed));
          }
          else
          {
            // move retract extension amount in direction of last move and retract
            Vector3d rvec = new Vector3d(path.Last - path[path.Count - 2]);
            rvec.Unitize();
            p0 = path.Last + (rvec * RetractExtension);
            ExtrusionDist -= retraction_amount;
            gcode.Add(string.Format("G1 X{0:0.000} Y{1:0.000} Z{2:0.000} E{3:0.000} F{4} ; RetractExtension",
              p0.X, p0.Y, p0.Z, ExtrusionDist, RetractionSpeed));

            gcode.Add(string.Format("G1 X{0:0.000} Y{1:0.000} Z{2:0.000} E{3:0.000} F{4} ; Z-Hop",
              p0.X, p0.Y, p0.Z + ZHopDistance, ExtrusionDist, RetractionSpeed));
          }
        }
        else
        {
          // use last point for retraction move and move upwards
          p0 = path.Last();
          ExtrusionDist -= retraction_amount;
          gcode.Add(string.Format("G1 X{0:0.000} Y{1:0.000} Z{2:0.000} E{3:0.000} F{4} ; Z-Hop with retraction",
            p0.X, p0.Y, p0.Z + ZHopDistance, ExtrusionDist, RetractionSpeed));
        }

        // reset extrusion distance
        gcode.Add(string.Format("G92 E0 ; Reset Extrusion Distance"));
      }
    }

    // CREATE FOOTER -----------------------------------------------------
    gcode.AddRange(new string[]
      {
      "G1 E-1 ; retract",
      "G92 E0 ; reset E value",
      "M104 S0 ; turn off extruder",
      "M140 S0 ; turn off bed",
      "G28 X0 Y0 ; home all axes",
      "M84; disable motors",
      "M82 ; absolute extrusion mode",
      "; --- END OF GCODE ---",
      });

    // set gcode to output
    GCODE = gcode;
  }

}
# ---------- end generategcode ----------
panel_24 = Panel(generategcode.out)
print_speed_mm_min_2 = Data(print_speed_mm_min)
gcode = Data(generategcode.GCODE)

# ----
# MATERIAL AMOUNT CALCULATION
# TESTED WEIGHT PARAMETERS: Intersecting Wall 937g
# Mirko Schlaufen 383g
# Vase 541g
line_width_4 = Data(line_width)
layer_height_8 = Number(layer_height)
printing_curves_6 = Geometry(printing_curves_3)
filletfactor = Slider(0.45, range=0..1)
dom_6 = ConstructDomain(DomainStart=expr("x*-0.5", line_width_4), DomainEnd=expr("x*0.5", line_width_4))
dom_7 = ConstructDomain(DomainStart=expr("x*-0.5", layer_height_8), DomainEnd=expr("x*0.5", layer_height_8))
min_6 = Minimum(A=line_width_4, B=layer_height_8)
len_6 = Length(Curve=printing_curves_6)  # -> flatten(Length)
multiplication_13 = Multiplication(A=min_6, B=filletfactor)
ma_14 = MassAddition(Input=len_6)  # -> Result, PartialResults
rectangle = Rectangle(Plane=PlaneXY(0, 0, 0), XSize=dom_6, YSize=dom_7, Radius=multiplication_13)  # -> Rectangle, Length
area = Area(Geometry=rectangle.Rectangle)  # -> Area, Centroid
printing_curves_length_mm = Data(ma_14.Result)
print_profile_area_mm2 = Data(area.Area)
comments_notes_37 = Panel("MATERIAL AMOUNT CALCULATION")
multiplication_14 = Multiplication(A=printing_curves_length_mm, B=print_profile_area_mm2)
multiplication_15 = Multiplication(A=multiplication_14, B="0.001")
specific_weight_clay_in_g_cm3 = Panel("1.99")
addpercentage = Slider(20, range=0..100)
print_volume_mm3 = Data(multiplication_14)
print_volume_cm3 = Data(multiplication_15)
multiplication_16 = Multiplication(A=print_volume_cm3, B=specific_weight_clay_in_g_cm3)
num = Number(expr("x*0.01", addpercentage))
multiplication_17 = Multiplication(A=multiplication_16, B=num)
addition_5 = Addition(A=multiplication_16, B=multiplication_17)
rtd_6 = RoundToDecimal(Numbers=addition_5, DecimalPlaces="2")  # -> Rounded; inputs Numbers: list, DecimalPlaces: list of Int32; same code as rtd_2
print_weight_in_g = Panel(rtd_6)
format_6 = Format(Format="[INFO] Approximate Material Weight is {0} g.", Culture=127, Data0=rtd_6)
info_approximate_print_weight = Data(format_6)
approximate_print_weight = Data(rtd_6)

# ----
# GCODE VERIFICATION
# AND ANALYSIS
# comments & notes: GCODE VERIFICATION AND ANALYSIS
panel_25 = Panel(""";FLAVOR:Marlin
;TIME:949
;Filament used: 37.628m
;Layer height: 1.9
;MINX:-63.357
;MINY:-66.77
;MINZ:1.9
;MAXX:57.392
;MAXY:53.98
;MAXZ:53.2
;Generated with Cura_SteamEngine 5.0.0
M105
M109 S0
M82 ;absolute extrusion mode
G90 ; absolute programming
M106 S0 ; set fan speed to 0 (deactivate)
M104 S0 T0 ; set hotend temperature to 0 (deactivate)
G28 ; home all axes
T0 ; set extruder to extruder 0 (first and only one)
G92 E0
G92 E0
G1 F4800 E-0.01
;LAYER_COUNT:29
;LAYER:0
M107
G0 F3000 X45.961 Y53.98 Z1.9
;TYPE:SKIRT
G1 F4800 E0
G1 F3000 X-53.191 Y52.722 E103.65331
G1 X-53.895 Y52.701 E104.38954
G1 X-54.775 Y52.634 E105.31208
G1 X-55.646 Y52.489 E106.23508
G1 X-56.5 Y52.265 E107.15797
G1 X-57.33 Y51.965 E108.08052
G1 X-58.13 Y51.591 E109.00364
G1 X-58.893 Y51.146 E109.92695
G1 X-59.612 Y50.634 E110.84962
G1 X-60.282 Y50.059 E111.77253
G1 X-60.898 Y49.425 E112.69656
G1 X-61.453 Y48.739 E113.61894
G1 X-61.944 Y48.005 E114.54204
G1 X-62.367 Y47.23 E115.46498
G1 X-62.718 Y46.42 E116.38776
G1 X-62.994 Y45.581 E117.31101
G1 X-63.193 Y44.721 E118.23374
G1 X-63.313 Y43.846 E119.15695
G1 X-63.354 Y43.051 E119.98908
G1 X-63.357 Y42.426 E120.6424
G1 X-62.101 Y-56.542 E224.10337
G1 X-62.086 Y-57.229 E224.82167
G1 X-62.026 Y-58.11 E225.74472
G1 X-61.888 Y-58.982 E226.66758
G1 X-61.671 Y-59.838 E227.59067
G1 X-61.377 Y-60.67 E228.51308
G1 X-61.01 Y-61.473 E229.43597
G1 X-60.571 Y-62.239 E230.35886
G1 X-60.065 Y-62.963 E231.28218
G1 X-59.495 Y-63.637 E232.20489
G1 X-58.867 Y-64.258 E233.1281
G1 X-58.185 Y-64.819 E234.05121
G1 X-57.455 Y-65.315 E234.97376
G1 X-56.683 Y-65.744 E235.89697
G1 X-55.876 Y-66.102 E236.81982
G1 X-55.039 Y-66.384 E237.74307
G1 X-54.18 Y-66.59 E238.66646
G1 X-53.307 Y-66.718 E239.58877
G1 X-52.433 Y-66.766 E240.50375
G1 X-52.022 Y-66.77 E240.9334
G1 X47.184 Y-65.512 E344.64315
G1 X47.888 Y-65.494 E345.37929
G1 X48.769 Y-65.431 E346.30257
G1 X49.64 Y-65.289 E347.22505
G1 X50.495 Y-65.069 E348.14791
G1 X51.327 Y-64.773 E349.07101
G1 X52.128 Y-64.402 E349.99376
G1 X52.893 Y-63.96 E350.9173
G1 X53.615 Y-63.451 E351.84072
G1 X54.287 Y-62.879 E352.76318
G1 X54.905 Y-62.248 E353.68643
G1 X55.463 Y-61.564 E354.60916
G1 X55.958 Y-60.833 E355.532
G1 X56.383 Y-60.059 E356.45502
G1 X56.738 Y-59.251 E357.37756
G1 X57.017 Y-58.413 E358.3008
G1 X57.22 Y-57.554 E359.22346
G1 X57.344 Y-56.68 E360.14621
G1 X57.388 Y-55.856 E361.00878
G1 X57.392 Y-55.266 E361.62553
G1 X56.136 Y43.71 E465.09485
G1 X56.121 Y44.43 E465.84764
G1 X56.063 Y45.311 E466.77056
G1 X55.925 Y46.183 E467.69341
G1 X55.709 Y47.039 E468.61625
G1 X55.416 Y47.872 E469.53929
G1 X55.049 Y48.675 E470.46219
G1 X54.611 Y49.442 E471.38547
G1 X54.105 Y50.166 E472.30879
G1 X53.536 Y50.841 E473.23162
G1 X52.909 Y51.462 E474.15409
G1 X52.227 Y52.024 E475.07786
G1 X51.498 Y52.521 E476.00014
G1 X50.727 Y52.951 E476.92294
G1 X49.92 Y53.309 E477.84579
G1 X49.083 Y53.593 E478.76971
G1 X48.225 Y53.799 E479.69208
G1 X47.351 Y53.928 E480.61558
G1 X46.508 Y53.976 E481.49821
G1 X45.961 Y53.98 E482.07001
G1 F4800 E482.06001
;MESH:PRINTSUGI_CONN_01.stl
G0 F3000 X44.651 Y42.463
;TYPE:WALL-OUTER
G1 F4800 E482.07001
G1 F3000 X45.875 Y-54.028 E582.94151
G1 X-50.616 Y-55.252 E683.81302
G1 X-51.84 Y41.239 E784.68452
G1 X44.651 Y42.463 E885.55602
G0 X44.676 Y40.464
G0 X41.368 Y39.095
;TYPE:SKIN
G1 X41.938 Y-5.826 E932.51635
G1 X42.507 Y-50.745 E979.47457
G1 X-47.333 Y-51.884 E1073.39313
G1 X-48.472 Y37.956 E1167.31168
G1 X41.368 Y39.095 E1261.23023
G1 F4800 E1261.22023
G0 F3000 X40.727 Y-48.368
G1 F4800 E1261.23023
G1 F3000 X40.071 Y-49.024 E1262.19999
G0 X35.057 Y-49.088
G1 X40.665 Y-43.48 E1270.49028
G0 X40.602 Y-38.593
G1 X30.044 Y-49.151 E1286.09814
G0 X25.03 Y-49.215
G1 X40.541 Y-33.704 E1309.02801
G0 X40.479 Y-28.817
G1 X20.017 Y-49.278 E1339.27619
G0 X15.004 Y-49.342
G1 X40.416 Y-23.929 E1376.84342
G0 X40.355 Y-19.041
G1 X9.99 Y-49.406 E1421.73191
G0 X4.977 Y-49.469
G1 X40.293 Y-14.154 E1473.93871
G0 X40.23 Y-9.266
G1 X-0.035 Y-49.532 E1533.46309
G0 X-5.048 Y-49.596
G1 X40.169 Y-4.378 E1600.30799
G0 X40.107 Y0.509
G1 X-10.062 Y-49.66 E1674.47268
G0 X-15.075 Y-49.723
G1 X40.044 Y5.396 E1755.95494
G0 X39.983 Y10.284
G1 X-20.088 Y-49.787 E1844.75773
G0 X-25.102 Y-49.851
G1 X39.921 Y15.172 E1940.88105
G0 X39.858 Y20.059
G1 X-30.115 Y-49.914 E2044.32193
G0 X-35.129 Y-49.978
G1 X39.797 Y24.948 E2155.08483
G0 X39.735 Y29.835
G1 X-40.142 Y-50.041 E2273.16603
G0 X-45.155 Y-50.104
G1 X39.672 Y34.723 E2398.56554
G0 X37.292 Y37.292
G1 X-45.662 Y-45.662 E2521.1962
G0 X-45.724 Y-40.774
G1 X32.279 Y37.229 E2636.50782
G0 X27.266 Y37.166
G1 X-45.785 Y-35.886 E2744.49964
G0 X-45.848 Y-30.998
G1 X22.253 Y37.102 E2845.17242
G0 X17.239 Y37.038
G1 X-45.909 Y-26.11 E2938.52393
G0 X-45.971 Y-21.223
G1 X12.226 Y36.975 E3024.55713
G0 X7.213 Y36.911
G1 X-46.033 Y-16.334 E3103.2698
G0 X-46.095 Y-11.447
G1 X2.199 Y36.848 E3174.66342
G0 X-2.813 Y36.784
G1 X-46.157 Y-6.559 E3238.73799
G0 X-46.219 Y-1.671
G1 X-7.826 Y36.72 E3295.49278
G0 X-12.84 Y36.657
G1 X-46.28 Y3.216 E3344.92778
G0 X-46.343 Y8.104
G1 X-17.853 Y36.593 E3387.04372
G0 X-22.867 Y36.529
G1 X-46.404 Y12.992 E3421.8384
G0 X-46.466 Y17.879
G1 X-27.88 Y36.466 E3449.31477
G0 X-32.893 Y36.402
G1 X-46.528 Y22.768 E3469.47062
G0 X-46.59 Y27.655
G1 X-37.907 Y36.338 E3482.30667
G0 X-42.92 Y36.275
G1 X-46.652 Y32.543 E3487.82367
G1 F4800 E3487.81367
;MESH:NONMESH
G0 F600 X-46.652 Y32.543 Z3.8
G0 F3000 X45.263 Y-5.783
;TIME_ELAPSED:78.082594
;LAYER:1
;TYPE:WALL-OUTER
;MESH:PRINTSUGI_CONN_01.stl
G1 F4800 E3487.82367
G1 F3000 X45.875 Y-54.028 E3538.2589
G1 X-50.616 Y-55.252 E3639.13041
G1 X-51.84 Y41.239 E3740.00191
G1 X44.651 Y42.463 E3840.87341
G1 X45.263 Y-5.783 E3891.30969
G0 X45.288 Y-7.782
G1 F4800 E3891.29969
G0 F3000 X42.507 Y-50.745
;TYPE:SKIN
G1 F4800 E3891.30969
G1 F3300 X-2.414 Y-51.315 E3938.27001
G92 E0
G1 X-47.333 Y-51.884 E46.95822
G1 X-48.472 Y37.956 E140.87678
G1 X41.368 Y39.095 E234.79533
G1 X42.507 Y-50.745 E328.71388
G1 F4800 E328.70388
G0 F3000 X-43.954 Y-50.09
G1 F4800 E328.71388
G1 F3300 X-45.626 Y-48.418 E331.18559
G0 F3000 X-45.69 Y-43.405
G1 F3300 X-39.066 Y-50.028 E340.97709
G0 F3000 X-34.178 Y-49.966
G1 F3300 X-45.753 Y-38.392 E358.08765
G0 F3000 X-45.816 Y-33.378
G1 F3300 X-29.291 Y-49.904 E382.51724
G0 F3000 X-24.403 Y-49.842
G1 F3300 X-45.88 Y-28.365 E414.26663
G0 F3000 X-45.944 Y-23.352
G1 F3300 X-19.515 Y-49.781 E453.33655
G0 F3000 X-14.627 Y-49.718
G1 F3300 X-46.007 Y-18.339 E499.72477
G0 F3000 X-46.07 Y-13.326
G1 F3300 X-9.74 Y-49.656 E553.43131
G0 F3000 X-4.852 Y-49.595
G1 F3300 X-46.134 Y-8.312 E614.45911
G0 F3000 X-46.198 Y-3.299
G1 F3300 X0.035 Y-49.532 E682.80523
G0 F3000 X4.923 Y-49.471
G1 F3300 X-46.261 Y1.713 E758.47039
G0 F3000 X-46.324 Y6.726
G1 F3300 X9.811 Y-49.409 E841.4546
G0 F3000 X14.698 Y-49.346
G1 F3300 X-46.388 Y11.74 E931.75786
G0 F3000 X-46.451 Y16.753
G1 F3300 X19.586 Y-49.285 E1029.38091
G0 F3000 X24.474 Y-49.223
G1 F3300 X-46.515 Y21.766 E1134.32374
G0 F3000 X-46.578 Y26.779
G1 F3300 X29.361 Y-49.16 E1246.58415
G0 F3000 X34.25 Y-49.099
G1 F3300 X-46.642 Y31.792 E1366.16583
G0 F3000 X-46.135 Y36.235
G1 F3300 X39.137 Y-49.037 E1492.22318
G0 F3000 X40.691 Y-45.641
G1 F3300 X-41.246 Y36.297 E1613.35116
G0 F3000 X-36.359 Y36.359
G1 F3300 X40.628 Y-40.628 E1727.16082
G0 F3000 X40.564 Y-35.614
G1 F3300 X-31.471 Y36.421 E1833.64996
G0 F3000 X-26.583 Y36.483
G1 F3300 X40.5 Y-30.601 E1932.8193
G0 F3000 X40.437 Y-25.588
G1 F3300 X-21.696 Y36.545 E2024.67034
G0 F3000 X-16.808 Y36.607
G1 F3300 X40.373 Y-20.574 E2109.20085
G0 F3000 X40.31 Y-15.561
G1 F3300 X-11.92 Y36.669 E2186.41231
G0 F3000 X-7.032 Y36.731
G1 F3300 X40.246 Y-10.547 E2256.30325
G0 F3000 X40.182 Y-5.534
G1 F3300 X-2.145 Y36.793 E2318.87513
G0 F3000 X2.742 Y36.855
G1 F3300 X40.119 Y-.521 E2374.1287
G0 F3000 X40.056 Y4.491
G1 F3300 X7.63 Y36.917 E2422.06397
G0 F3000 X12.517 Y36.979
G1 F3300 X39.992 Y9.504 E2462.68018
G0 F3000 X39.928 Y14.518
G1 F3300 X17.405 Y37.041 E2495.97587
G0 F3000 X22.293 Y37.103
G1 F3300 X39.865 Y19.531 E2521.95251
G0 F3000 X39.801 Y24.545
G1 F3300 X27.181 Y37.165 E2540.60862
G0 F3000 X32.068 Y37.227
G1 F3300 X39.737 Y29.558 E2551.94568
G0 F3000 X39.674 Y34.571
G1 F3300 X36.956 Y37.289 E2555.96369
G1 F4800 E2555.95369
;MESH:NONMESH
G0 F600 X36.956 Y37.289 Z5.7
G0 F3000 X-5.51 Y40.601
;TIME_ELAPSED:139.048552
;LAYER:2
;TYPE:FILL
;MESH:PRINTSUGI_CONN_01.stl
G1 F4800 E2555.96369
G1 F3000 X-50.041 Y-3.93 E2621.79374
G0 X-50.096 Y0.43
G1 X-35.555 Y-53.835 E2680.51891
G0 X-28.983 Y-53.752
G1 X-49.477 Y-48.26 E2702.69745
G0 X-49.421 Y-52.807
G1 X43.455 Y40.069 E2839.99578
G0 X43.512 Y35.526
G1 X23.213 Y40.965 E2861.9631
G0 X19.556 Y40.919
G1 X-49.732 Y-28.369 E2964.39136
G1 X-49.709 Y-30.081
G1 X35.572 Y-52.932 E3056.68149
G1 X36.667 Y-52.918
G1 X11.55 Y40.818 E3158.12166
G1 F4800 E3158.11166
G0 F3000 X-6.504 Y40.589
G1 F4800 E3158.12166
G1 F3000 X18.612 Y-53.148 E3259.56258
G0 X24.559 Y-53.071
G1 X44.386 Y-33.245 E3288.87203
G0 X44.435 Y-37.19
G1 X-49.94 Y-11.902 E3391.00367
G1 F4800 E3390.99367
G0 F3000 X-50.17 Y6.277
G1 F4800 E3391.00367
G1 F3000 X44.204 Y-19.01 E3493.13402
G0 X44.13 Y-13.156
G1 X29.606 Y41.047 E3551.79198
G1 F4800 E3551.78198
G0 F3000 X43.743 Y17.347
G1 F4800 E3551.79198
G1 F3000 X-41.341 Y40.145 E3643.86887
G1 X-42.616 Y40.13
G1 X-17.499 Y-53.606 E3745.30904
G1 F4800 E3745.29904
G0 F3000 X-25.573 Y-53.708
G1 F4800 E3745.30904
G1 F3000 X43.765 Y15.631 E3847.81195
G1 F4800 E3847.80195
G0 F3000 X43.974 Y-.831
G1 F4800 E3847.81195
G1 F3000 X-50.401 Y24.456 E3949.94331
G0 X-50.351 Y20.508
G92 E0
G1 X-30.577 Y40.283 E29.23259
G0 X-24.56 Y40.36
G1 X0.556 Y-53.377 E130.6735
G1 X-.506 Y-53.39
G1 X44.076 Y-8.807 E196.57968
G0 X45.263 Y-5.783
;TYPE:WALL-OUTER
G1 X45.875 Y-54.028 E247.01491
G1 X-50.616 Y-55.252 E347.88641
G1 X-51.84 Y41.239 E448.75792
G1 X44.651 Y42.463 E549.62942
G1 X45.263 Y-5.783 E600.06569
G0 X45.288 Y-7.782
G1 F4800 E600.05569
;MESH:NONMESH
G0 F600 X45.288 Y-7.782 Z7.6
G0 F3000 X-5.51 Y40.601
;TIME_ELAPSED:182.317632
;LAYER:3
;TYPE:FILL
;MESH:PRINTSUGI_CONN_01.stl
G1 F4800 E600.06569
G1 F3000 X-50.041 Y-3.93 E665.89574
G0 X-50.096 Y0.43
G1 X-35.555 Y-53.835 E724.62091
G0 X-28.983 Y-53.752
G1 X-49.477 Y-48.26 E746.79946
G0 X-49.421 Y-52.807
G1 X43.455 Y40.069 E884.09779
G0 X43.512 Y35.526
G1 X23.213 Y40.965 E906.06511
G0 X19.556 Y40.919
G1 X-49.732 Y-28.369 E1008.49336
G1 X-49.709 Y-30.081
G1 X35.572 Y-52.932 E1100.7835
G1 X36.667 Y-52.918
G1 X11.55 Y40.818 E1202.22367
G1 F4800 E1202.21367
G0 F3000 X-6.504 Y40.589
G1 F4800 E1202.22367
G1 F3000 X18.612 Y-53.148 E1303.66458
G0 X24.559 Y-53.071
G1 X44.386 Y-33.245 E1332.97404
G0 X44.435 Y-37.19
G1 X-49.94 Y-11.902 E1435.10567
G1 F4800 E1435.09567
G0 F3000 X-50.17 Y6.277
G1 F4800 E1435.10567
G1 F3000 X44.204 Y-19.01 E1537.23602
G0 X44.13 Y-13.156
G1 X29.606 Y41.047 E1595.89399
G1 F4800 E1595.88399
G0 F3000 X43.743 Y17.347
G1 F4800 E1595.89399
G1 F3000 X-41.341 Y40.145 E1687.97087
G1 X-42.616 Y40.13
G1 X-17.499 Y-53.606 E1789.41105
G1 F4800 E1789.40105
G0 F3000 X-25.573 Y-53.708
G1 F4800 E1789.41105
G1 F3000 X43.765 Y15.631 E1891.91395
G1 F4800 E1891.90395
G0 F3000 X43.974 Y-.831
G1 F4800 E1891.91395
G1 F3000 X-50.401 Y24.456 E1994.04531
G0 X-50.351 Y20.508
G1 X-30.577 Y40.283 E2023.2779
G0 X-24.56 Y40.36
G1 X0.556 Y-53.377 E2124.71881
G1 X-.506 Y-53.39
G1 X44.076 Y-8.807 E2190.625
G0 X45.263 Y-5.783
;TYPE:WALL-OUTER
G1 X45.875 Y-54.028 E2241.06023
G1 X-50.616 Y-55.252 E2341.93173
G1 X-51.84 Y41.239 E2442.80323
G1 X44.651 Y42.463 E2543.67473
G1 X45.263 Y-5.783 E2594.11101
G0 X45.288 Y-7.782
G1 F4800 E2594.10101
;MESH:NONMESH
G0 F600 X45.288 Y-7.782 Z9.5
G0 F3000 X-5.51 Y40.601
;TIME_ELAPSED:225.589684
;LAYER:4
;TYPE:FILL
;MESH:PRINTSUGI_CONN_01.stl
G1 F4800 E2594.11101
G1 F3000 X-50.04 Y-3.928 E2659.93884
G0 X-50.095 Y0.427
G1 X-35.555 Y-53.835 E2718.66071
G0 X-28.983 Y-53.752
G1 X-49.477 Y-48.26 E2740.83926
G0 X-49.421 Y-52.807
G1 X43.455 Y40.069 E2878.13758
G0 X43.512 Y35.526
G1 X23.213 Y40.965 E2900.1049
G0 X19.556 Y40.919
G1 X-49.73 Y-28.367 E3002.5302
G1 X-49.708 Y-30.081
G1 X35.572 Y-52.932 E3094.81933
G1 X36.667 Y-52.918
G1 X11.55 Y40.818 E3196.2595
G1 F4800 E3196.2495
G0 F3000 X-6.504 Y40.589
G1 F4800 E3196.2595
G1 F3000 X18.612 Y-53.148 E3297.70041
G0 X24.559 Y-53.071
G1 X44.386 Y-33.245 E3327.00987
G0 X44.435 Y-37.19
G1 X-49.939 Y-11.902 E3429.14049
G1 F4800 E3429.13049
G0 F3000 X-50.169 Y6.276
G1 F4800 E3429.14049
G1 F3000 X44.204 Y-19.01 E3531.26956
G0 X44.13 Y-13.156
G1 X29.606 Y41.047 E3589.92753
G1 F4800 E3589.91753
G0 F3000 X43.743 Y17.347
G1 F4800 E3589.92753
G1 F3000 X-41.341 Y40.145 E3682.00441
G1 X-42.616 Y40.13
G1 X-17.499 Y-53.606 E3783.44459
G1 F4800 E3783.43459
G0 F3000 X-25.573 Y-53.708
G1 F4800 E3783.44459
G1 F3000 X43.765 Y15.631 E3885.9475
G1 F4800 E3885.9375
G0 F3000 X43.974 Y-.831
G1 F4800 E3885.9475
G1 F3000 X-50.401 Y24.456 E3988.07886
G0 X-50.351 Y20.508
G92 E0
G1 X-30.577 Y40.283 E29.23259
G0 X-24.56 Y40.36
G1 X0.556 Y-53.377 E130.6735
G1 X-.506 Y-53.39
G1 X44.076 Y-8.807 E196.57968
G0 X45.263 Y-5.783
;TYPE:WALL-OUTER
G1 X45.875 Y-54.028 E247.01491
G1 X-50.617 Y-55.252 E347.88746
G1 X-51.257 Y-4.737 E400.69573
G1 X-51.263 Y-3.637 E401.84559
G1 X-51.28 Y-2.834 E402.68517
G1 X-51.84 Y41.239 E448.75901
G1 X44.651 Y42.463 E549.63051
G1 X45.263 Y-5.783 E600.06679
G0 X45.288 Y-7.782
G1 F4800 E600.05679
;MESH:NONMESH
G0 F600 X45.288 Y-7.782 Z11.4
G0 F3000 X-5.51 Y40.601
;TIME_ELAPSED:268.858480
;LAYER:5
;TYPE:FILL
;MESH:PRINTSUGI_CONN_01.stl
G1 F4800 E600.06679
G1 F3000 X-50.036 Y-3.924 E665.88871
G0 X-50.094 Y0.423
G1 X-35.555 Y-53.835 E724.60626
G0 X-28.981 Y-53.752
G1 X-49.478 Y-48.26 E746.78784
G0 X-49.422 Y-52.808
G1 X43.455 Y40.069 E884.08765
G0 X43.512 Y35.526
G1 X23.213 Y40.965 E906.05497
G0 X19.556 Y40.919
G1 X-49.731 Y-28.368 E1008.48174
G1 X-49.709 Y-30.081
G1 X35.572 Y-52.932 E1100.77188
G1 X36.667 Y-52.918
G1 X11.55 Y40.818 E1202.21205
G1 F4800 E1202.20205
G0 F3000 X-6.504 Y40.589
G1 F4800 E1202.21205
G1 F3000 X18.612 Y-53.148 E1303.65296
G0 X24.559 Y-53.071
G1 X44.386 Y-33.245 E1332.96242
G0 X44.435 Y-37.19
G1 X-49.939 Y-11.902 E1435.09304
G1 F4800 E1435.08304
G0 F3000 X-50.168 Y6.276
G1 F4800 E1435.09304
G1 F3000 X44.204 Y-19.01 E1537.2211
G0 X44.13 Y-13.156
G1 X29.606 Y41.047 E1595.87907
G1 F4800 E1595.86907
G0 F3000 X43.743 Y17.347
G1 F4800 E1595.87907
G1 F3000 X-41.341 Y40.145 E1687.95596
G1 X-42.616 Y40.13
G1 X-17.499 Y-53.606 E1789.39613
G1 F4800 E1789.38613
G0 F3000 X-25.573 Y-53.708
G1 F4800 E1789.39613
G1 F3000 X43.765 Y15.631 E1891.89904
G1 F4800 E1891.88904
G0 F3000 X43.974 Y-.831
G1 F4800 E1891.89904
G1 F3000 X-50.4 Y24.455 E1994.02912
G0 X-50.35 Y20.509
G1 X-30.577 Y40.283 E2023.26023
G0 X-24.56 Y40.36
G1 X0.556 Y-53.377 E2124.70114
G1 X-.506 Y-53.39
G1 X44.076 Y-8.807 E2190.60732
G0 X45.263 Y-5.783
;TYPE:WALL-OUTER
G1 X45.875 Y-54.028 E2241.04255
G1 X-50.617 Y-55.252 E2341.9151
G1 X-51.263 Y-4.111 E2395.37776
G1 X-51.273 Y-2.845 E2396.70117
G1 X-51.289 Y-2.094 E2397.48638
G1 X-51.84 Y41.239 E2442.78663
G1 X44.651 Y42.463 E2543.65813
G1 X45.263 Y-5.783 E2594.09441
G0 X45.288 Y-7.782
G1 F4800 E2594.08441
;MESH:NONMESH
G0 F600 X45.288 Y-7.782 Z13.3
G0 F3000 X-27.355 Y-5.992
;TIME_ELAPSED:312.180207
;LAYER:6
;TYPE:FILL
;MESH:PRINTSUGI_CONN_01.stl
G1 F4800 E2594.09441
G1 F3000 X19.556 Y40.919 E2663.44281
G0 X23.213 Y40.965
G1 X43.512 Y35.526 E2685.41013
G0 X43.455 Y40.069
G1 X-49.422 Y-52.808 E2822.70993
G0 X-49.479 Y-48.26
G1 X-28.981 Y-53.752 E2844.89252
G0 X-25.573 Y-53.708
G1 X43.765 Y15.631 E2947.39543
G1 X43.743 Y17.347
G1 X-41.341 Y40.145 E3039.47231
G1 X-42.616 Y40.13
G1 X-30.554 Y-4.885 E3088.18711
G1 F4800 E3088.17711
G0 F3000 X-30.483 Y-17.115
G1 F4800 E3088.18711
G1 F3000 X-28.89 Y-17.542 E3089.91108
G0 X-26.827 Y-18.793
G1 X-17.499 Y-53.606 E3127.58528
G1 F4800 E3127.57528
G0 F3000 X-.506 Y-53.39
G1 F4800 E3127.58528
G1 F3000 X44.076 Y-8.807 E3193.49146
G0 X44.13 Y-13.156
G1 X29.606 Y41.047 E3252.14943
G1 F4800 E3252.13943
G0 F3000 X11.55 Y40.818
G1 F4800 E3252.14943
G1 F3000 X36.667 Y-52.918 E3353.5896
G1 X35.572 Y-52.932
G1 X-49.709 Y-30.081 E3445.87973
G1 X-49.732 Y-28.369
G1 X-40.539 Y-19.176 E3459.46972
G1 F4800 E3459.45972
G0 F3000 X-46.403 Y-13.35
G1 F4800 E3459.46972
G1 F3000 X-35.555 Y-53.835 E3503.28215
G1 F4800 E3503.27215
G0 F3000 X0.556 Y-53.377
G1 F4800 E3503.28215
G1 F3000 X-24.56 Y40.36 E3604.72306
G0 X-30.577 Y40.283
G1 X-50.351 Y20.508 E3633.95565
G0 X-50.401 Y24.456
G1 X43.974 Y-.831 E3736.08701
G1 F4800 E3736.07701
G0 F3000 X44.204 Y-19.01
G1 F4800 E3736.08701
G1 F3000 X-50.169 Y6.276 E3838.21608
G1 F4800 E3838.20608
G0 F3000 X-45.271 Y0.84
G1 F4800 E3838.21608
G1 F3000 X-5.51 Y40.601 E3896.99465
G1 X-6.504 Y40.589
G1 X18.612 Y-53.148 E3998.43556
G0 X24.559 Y-53.071
G92 E0
G1 X44.386 Y-33.245 E29.30946
G0 X44.435 Y-37.19
G1 X-23.606 Y-18.958 E102.94278
G1 F4800 E102.93278
G0 F3000 X-51.27 Y-3.594
;TYPE:WALL-OUTER
G1 F4800 E102.94278
G1 F3000 X-51.281 Y-2.088 E104.51707
G1 X-51.301 Y-1.242 E105.40165
G1 X-51.84 Y41.239 E149.81121
G1 X44.651 Y42.463 E250.68271
G1 X45.875 Y-54.028 E351.55421
G1 X-50.617 Y-55.252 E452.42676
G1 X-51.27 Y-3.594 E506.4299
G0 X-51.281 Y-2.088
G0 X-51.292 Y-1.594
G1 F4800 E506.4199
G0 F3000 X-24.911 Y-18.317
;TYPE:SKIN
G1 F4800 E506.4299
G1 F3600 X-25.514 Y-18.185 E507.07515
G1 X-26.013 Y-18.059 E507.61313
G1 X-26.444 Y-17.761 E508.16087
G1 X-26.831 Y-17.495 E508.65175
G1 X-27.441 Y-17.172 E509.37326
G1 X-28.062 Y-16.894 E510.08448
G1 X-28.362 Y-16.484 E510.61554
G1 X-28.669 Y-16.206 E511.04847
G1 X-29.12 Y-15.977 E511.5772
G1 X-29.562 Y-15.858 E512.05568
G1 X-30.039 Y-15.855 E512.5543
G1 X-30.513 Y-15.987 E513.06864
G1 X-31.473 Y-16.406 E514.16356
G1 X-32.015 Y-16.547 E514.74897
G1 X-33.06 Y-16.751 E515.86195
G1 X-33.488 Y-16.899 E516.33533
G1 X-33.868 Y-17.155 E516.81428
G1 X-34.114 Y-17.424 E517.19533
G1 X-34.343 Y-17.843 E517.69446
G1 X-34.42 Y-18.106 E517.98092
G1 X-34.449 Y-18.624 E518.52324
G1 X-34.453 Y-18.892 E518.80341
G1 X-35.373 Y-19.615 E520.02653
G1 X-36.296 Y-20.317 E521.23871
G1 X-36.536 Y-20.423 E521.51296
G1 X-37.244 Y-20.526 E522.26083
G1 X-37.768 Y-20.513 E522.80875
G1 X-38.88 Y-20.372 E523.98044
G1 X-39.125 Y-20.269 E524.25826
G1 X-39.465 Y-19.119 E525.51181
G1 X-39.571 Y-18.655 E526.00933
G1 X-39.527 Y-18.14 E526.54962
G1 X-39.475 Y-17.55 E527.16875
G1 X-39.547 Y-17.029 E527.71853
G1 X-39.714 Y-16.642 E528.15913
G1 X-39.978 Y-16.298 E528.6124
G1 X-40.3 Y-16.041 E529.04306
G1 X-40.732 Y-15.847 E529.53808
G1 X-41.151 Y-15.778 E529.98197
G1 X-41.676 Y-15.835 E530.53398
G1 X-41.937 Y-15.873 E530.80968
G1 X-42.853 Y-15.103 E532.06055
G1 X-43.459 Y-14.7 E532.8213
G1 X-43.769 Y-14.483 E533.21685
G1 X-43.836 Y-13.87 E533.86144
G1 X-44.026 Y-13.39 E534.40107
G1 X-44.353 Y-12.981 E534.94845
G1 X-44.711 Y-12.726 E535.4079
G1 X-45.392 Y-12.438 E536.1808
G1 X-45.703 Y-12.344 E536.52042
G1 X-46.236 Y-12.315 E537.07839
G1 X-46.657 Y-12.291 E537.51918
G1 X-47.524 Y-11.962 E538.48853
G1 X-47.842 Y-11.765 E538.87956
G1 X-47.942 Y-3.812 E547.1936
G1 X-47.956 Y-2.109 E548.97383
G1 X-47.971 Y-1.605 E549.5009
G1 X-48.024 Y2.627 E553.92501
G1 X-47.697 Y2.27 E554.43108
G1 X-47.193 Y1.513 E555.38172
G1 X-47.087 Y1.242 E555.6859
G1 X-46.785 Y0.725 E556.31177
G1 X-46.382 Y0.373 E556.8711
G1 X-46.045 Y0.129 E557.30601
G1 X-45.194 Y-.818 E558.63689
G1 X-45.068 Y-1.017 E558.8831
G1 X-45.006 Y-1.472 E559.36312
G1 X-44.773 Y-1.999 E559.96544
G1 X-44.351 Y-2.447 E560.60878
G1 X-43.943 Y-2.789 E561.16529
G1 X-43.305 Y-3.163 E561.93834
G1 X-42.643 Y-3.449 E562.69215
G1 X-42.173 Y-3.697 E563.24765
G1 X-41.685 Y-3.818 E563.77321
G1 X-41.15 Y-3.923 E564.34312
G1 X-40.436 Y-4.11 E565.11465
G1 X-39.707 Y-4.222 E565.88563
G1 X-38.76 Y-4.297 E566.87864
G1 X-38.256 Y-4.263 E567.40667
G1 X-37.793 Y-4.103 E567.91874
G1 X-36.994 Y-3.724 E568.84314
G1 X-36.275 Y-3.489 E569.63385
G1 X-35.438 Y-3.414 E570.51228
G1 X-35.08 Y-3.426 E570.88671
G1 X-34.181 Y-3.773 E571.89402
G1 X-33.697 Y-4.079 E572.49259
G1 X-33.229 Y-4.428 E573.10285
G1 X-32.756 Y-4.83 E573.75173
G1 X-32.264 Y-5.187 E574.38715
G1 X-31.781 Y-5.53 E575.00639
G1 X-31.36 Y-5.75 E575.50293
G1 X-30.736 Y-5.925 E576.18038
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""")  # disabled
analyzegcode = BooleanToggle(True)  # disabled
gcode_2 = Data(gcode)  # disabled
filter_103 = StreamFilter(Gate=analyzegcode, Stream1=gcode_2)  # disabled
parsegcode = CSharpScript(GCODE=filter_103)  # -> out, G, X, Y, Z, E, F; inputs GCODE: list of String; disabled
# ---------- parsegcode: C# ----------
// Grasshopper Script Instance
#region Usings
using System;
using System.Linq;
using System.Collections;
using System.Collections.Generic;
using System.Drawing;
using System.Text.RegularExpressions;

using Rhino;
using Rhino.Geometry;

using Grasshopper;
using Grasshopper.Kernel;
using Grasshopper.Kernel.Data;
using Grasshopper.Kernel.Types;
#endregion

public class Script_Instance : GH_ScriptInstance
{
    #region Notes
    /* 
      Members:
        RhinoDoc RhinoDocument
        GH_Document GrasshopperDocument
        IGH_Component Component
        int Iteration

      Methods (Virtual & overridable):
        Print(string text)
        Print(string format, params object[] args)
        Reflect(object obj)
        Reflect(object obj, string method_name)
    */
    #endregion

    private void RunScript(
		List<string> GCODE,
		ref object G,
		ref object X,
		ref object Y,
		ref object Z,
		ref object E,
		ref object F)
    {
        List<string> _G = new List<string>();
        List<double> _X = new List<double>();
        List<double> _Y = new List<double>();
        List<double> _Z = new List<double>();
        List<double> _E = new List<double>();
        List<double> _F = new List<double>();

        double Ztemp = 0.0;
        double Etemp = 0.0;
        double Ftemp = 0.0;

        Regex re_colon_a = new Regex(" ;");
        Regex re_colon_b = new Regex(" |;");

        var cult = System.Globalization.CultureInfo.InvariantCulture;

        for (int i = 0; i < GCODE.Count; i++)
        {
        string ln = GCODE[i];

        if (ln.StartsWith(";"))
        {
            continue;
        }
        else if (ln.StartsWith("G0") || ln.StartsWith("G1"))
        {
            if (ln.Contains("X") && ln.Contains("Y"))
            {
            _G.Add(ln.Substring(1, 1));
            }
            else
            {
            continue;
            }

            string[] preparts = re_colon_a.Split(ln);
            string[] parts = re_colon_b.Split(preparts[0]);

            // loop over all string parts
            for (int j = 0; j < parts.Length; j++)
            {
            string part = parts[j];

            // catch X values
            if (part.StartsWith("X")) _X.Add(double.Parse(part.Substring(1), cult));

            // catch Y values
            if (part.StartsWith("Y")) _Y.Add(double.Parse(part.Substring(1), cult));

            // catch Z values
            if (part.StartsWith("Z"))
            {
                double Zval = double.Parse(part.Substring(1), cult);
                _Z.Add(Zval);
                Ztemp = Zval;
            }

            // catch E values
            if (part.StartsWith("E"))
            {
                double Eval = double.Parse(part.Substring(1), cult);
                _E.Add(Eval);
                Etemp = Eval;
            }

            // catch F values
            if (part.StartsWith("F"))
            {
                double Fval = double.Parse(part.Substring(1), cult);
                _F.Add(Fval);
                Ftemp = Fval;
            }
            }
            // catch missing Z values
            if (ln.Contains("X") && ln.Contains("Y") && !ln.Contains("Z")) _Z.Add(Ztemp);

            // catch missing E values
            if (!ln.Contains("E")) _E.Add(Etemp);

            // catch missing F values
            if (!ln.Contains("F")) _F.Add(Ftemp);
        }
        else
        {
            Print(ln);
        }
        }

        G = _G;
        X = _X;
        Y = _Y;
        Z = _Z;
        E = _E;
        F = _F;
    }
}
# ---------- end parsegcode ----------
gcode_3 = Data(panel_25)  # disabled
number_slider_7 = Slider(1000, range=0..1000)  # disabled
pt_9 = ConstructPoint(XCoordinate=parsegcode.X, YCoordinate=parsegcode.Y, ZCoordinate=parsegcode.Z)  # disabled
shift_7 = ShiftList(List=parsegcode.E, Shift=-1, Wrap=False)  # disabled
shift_8 = ShiftList(List=parsegcode.E, Shift=1, Wrap=False)  # disabled
shift_9 = ShiftList(List=pt_9, Shift=-1, Wrap=False)  # disabled
shift_10 = ShiftList(List=pt_9, Shift=1, Wrap=False)  # disabled
shift_11 = ShiftList(List=parsegcode.F, Shift=1, Wrap=False)  # disabled
item_26 = ListItem(List=shift_7, Index=number_slider_7, Wrap=True)  # disabled
item_27 = ListItem(List=shift_8, Index=number_slider_7, Wrap=True)  # disabled
ln_6 = Line(StartPoint=shift_9, EndPoint=shift_10)  # disabled
item_28 = ListItem(List=shift_11, Index=number_slider_7, Wrap=True)  # disabled
item_29 = ListItem(List=ln_6, Index=number_slider_7, Wrap=True)  # disabled
subtraction_17 = Subtraction(A=item_27, B=item_26)  # disabled
panel_26 = Panel("0")  # disabled
len_7 = Length(Curve=item_29)  # disabled
max_2 = Maximum(A=panel_26, B=subtraction_17)  # disabled
division_8 = Division(A=max_2, B=len_7)  # disabled
extrusionrate = Panel(division_8)  # disabled
f_value = Panel(item_28)  # disabled
move_length = Panel(len_7)  # disabled
e_value = Panel(item_27)  # disabled

# ----
# comments & notes: SAVE GCODE TO FILE
save_gcode_to_file_2 = Data(save_gcode_to_file)
gcode_4 = Data(gcode)
sg = SaveGCODE(Save=save_gcode_to_file_2, GCODE=gcode_4)  # inputs GCODE: list
# ---------- sg: Python ----------
"""
Saves GCODE to a specified file.
    Inputs:
        Save: Set to True to save the GCODE to a file. Connect a button here,
              ideally. {item, bool}
        GCODE: The GCODE to save to a file. {list, str}
    Remarks:
        Author: Max Eschenbach, based on an example by McNeel Forum User "spb"
        License: Apache License 2.0
        Version: 230203
"""

# PYTHON STANDARD LIBRARY IMPORTS
from __future__ import division, print_function
from os.path import abspath, basename, dirname, normpath

# GHPYTHON SDK IMPORTS
from ghpythonlib.componentbase import executingcomponent as component
import Grasshopper, GhPython
import System
import Rhino
import rhinoscriptsyntax as rs

# GHENV COMPONENT SETTINGS
ghenv.Component.Name = "SaveGCODE"
ghenv.Component.NickName ="SG"
ghenv.Component.Category = "FindersKeepers"
ghenv.Component.SubCategory = "9 Utilities"

class SaveGCODE(component):
    
    def SaveFileDialog(self, title=None, filter=None, folder=None,
                       filename=None, extension=None):
        """
        Opens a SaveFileDialog with the specified settings and lets the user
        pick a file. Returns the full path of the picked file.
        
        Based on:
        https://discourse.mcneel.com/t/rhino-ui-openfiledialog-showopendialog-
        with-multiselect-true-not-working/40068
        """
        
        fd = Rhino.UI.SaveFileDialog()
        if title:
            fd.Title = title
        if filter:
            fd.Filter = filter
        if folder:
            fd.InitialDirectory = folder
        if filename:
            fd.FileName = filename
        if extension:
            fd.DefaultExt = extension
        if fd.ShowSaveDialog():
            return normpath(abspath(fd.FileName))
        
        # return None if something goes wrong while picking the file
        return None
    
    def RunScript(self, Save, GCODE):
        # on button click, execute save
        if Save and GCODE:
            if not GCODE or GCODE == [None]:
                Rhino.UI.Dialogs.ShowMessage("No GCODE to save!", "Warning")
                return
            fp = self.SaveFileDialog(
                                "Save GCODE File",
                                "GCODE Files (*.gcode)",
                                dirname(self.OnPingDocument().FilePath),
                                None,
                                ".gcode")
            # write gcode to selected file
            if fp:
                # mac os file extension fix
                if not fp.endswith(".gcode"):
                    fp = fp + ".gcode"
                # write every line to file
                with open(fp, "w") as f:
                    for l in GCODE:
                        f.write(l + "\n")
                # report success
                rml = self.RuntimeMessageLevel.Remark
                self.AddRuntimeMessage(rml,
                                       ("Successfully wrote {0} "
                                        "lines to {1}!".format(len(GCODE),
                                                               basename(fp))))
        elif not GCODE:
            rml = self.RuntimeMessageLevel.Warning
            self.AddRuntimeMessage(rml,
                                   "Parameter GCODE failed to collect data!")
# ---------- end sg ----------
# ----
# comments & notes: COMPUTE GCODE GEOMETRY FOR VISUALISATION
gcode_5 = Data(gcode)
parsegcode_2 = CSharpScript(GCODE=gcode_5)  # -> out, G, X, Y, Z, E, F; inputs GCODE: list of String; same code as parsegcode
vis_printing_progress_2 = Data(vis_printing_progress)
pt_10 = ConstructPoint(XCoordinate=parsegcode_2.X, YCoordinate=parsegcode_2.Y, ZCoordinate=parsegcode_2.Z)
retractioncolor = ColourSwatch(SwatchColor=RGB(68, 194, 0))
extrusioncolor = ColourSwatch(SwatchColor=RGB(255, 94, 0))
travelcolor = ColourSwatch(SwatchColor=RGB(0, 85, 255))
classifymovements = CSharpScript(
    ProgressPercentage=vis_printing_progress_2,
    Points=pt_10,
    E=parsegcode_2.E,
    ExtrusionColor=extrusioncolor,
    TravelColor=travelcolor,
    RetractionColor=retractioncolor)  # -> out, MoveLines, MoveLinesProg, Colors, ColorsProg, PrintLines, PrintPolyLines; inputs ProgressPercentage: Double, Points: list of Point3d, E: list of Double, ExtrusionColor: Color, TravelColor: Color, RetractionColor: Color
# ---------- classifymovements: C# ----------
// Grasshopper Script Instance
#region Usings
using System;
using System.Linq;
using System.Collections;
using System.Collections.Generic;
using System.Drawing;

using Rhino;
using Rhino.Geometry;

using Grasshopper;
using Grasshopper.Kernel;
using Grasshopper.Kernel.Data;
using Grasshopper.Kernel.Types;
#endregion

public class Script_Instance : GH_ScriptInstance
{

    #region Notes
    /* 
        Members:
        RhinoDoc RhinoDocument
        GH_Document GrasshopperDocument
        IGH_Component Component
        int Iteration

        Methods (Virtual & overridable):
        Print(string text)
        Print(string format, params object[] args)
        Reflect(object obj)
        Reflect(object obj, string method_name)
    */
    #endregion

    private void RunScript(
		double ProgressPercentage,
		List<Point3d> Points,
		List<double> E,
		Color ExtrusionColor,
		Color TravelColor,
		Color RetractionColor,
		ref object MoveLines,
		ref object MoveLinesProg,
		ref object Colors,
		ref object ColorsProg,
		ref object PrintLines,
		ref object PrintPolyLines)
    {
        List<LineCurve> _MoveLines = new List<LineCurve>();
        List<LineCurve> _MoveLinesProg = new List<LineCurve>();
        List<LineCurve> _PrintLines = new List<LineCurve>();
        List<System.Drawing.Color> _Colors = new List<System.Drawing.Color>();
        List<System.Drawing.Color> _ColorsProg = new List<System.Drawing.Color>();
        List<Polyline> _PrintPolyLines = new List<Polyline>();

        Polyline pl_temp = new Polyline();

        int SplitIndex = (int) Math.Round((ProgressPercentage / 100.0) * Points.Count, 0);

        for (int i = 0; i < Points.Count - 1; i++)
        {
        // construct line curve
        LineCurve ln = new LineCurve(Points[i], Points[i + 1]);
        _MoveLines.Add(ln);

        if (i < SplitIndex) { _MoveLinesProg.Add(ln); }

        // set flags
        bool travel = E[i + 1] == 0 || E[i] == E[i + 1];
        bool retract = E[i + 1] < E[i];
        bool approach = E[i] == 0 && E[i + 1] > 0;

        // evaluate flags
        if (travel || approach)
        {
            _Colors.Add(TravelColor);
            if (i < SplitIndex) { _ColorsProg.Add(TravelColor); }

            // finish print polyline if it has at least two vertices
            if (pl_temp.Count > 1 && i <= SplitIndex)
            {
            _PrintPolyLines.Add(pl_temp.Duplicate());
            pl_temp = new Polyline();
            }
        }
        else if (retract)
        {
            _Colors.Add(RetractionColor);
            if (i < SplitIndex) { _ColorsProg.Add(RetractionColor); }

            // finish print polyline if it has at least two vertices
            if (pl_temp.Count > 1 && i <= SplitIndex)
            {
            _PrintPolyLines.Add(pl_temp.Duplicate());
            pl_temp = new Polyline();
            }
        }
        else
        {
            _Colors.Add(ExtrusionColor);
            if (i < SplitIndex) { _ColorsProg.Add(ExtrusionColor); }

            _PrintLines.Add(ln);

            // add points to print polyline
            if (i < SplitIndex)
            {
            if (pl_temp.Count == 0)
            {
                // add A point if this is the start of the PPL
                pl_temp.Add(Points[i]);
            }
            // always add B point
            pl_temp.Add(Points[i + 1]);
            }
        }

        // catch unfinished PPL and finalize it
        if (pl_temp.Count > 0 && i == Points.Count - 2)
        {
            _PrintPolyLines.Add(pl_temp.Duplicate());
            pl_temp = new Polyline();
        }

        MoveLines = _MoveLines;
        MoveLinesProg = _MoveLinesProg;
        Colors = _Colors;
        ColorsProg = _ColorsProg;
        PrintLines = _PrintLines;
        PrintPolyLines = _PrintPolyLines;
        }
    }

}
# ---------- end classifymovements ----------
item_30 = ListItem(List=classifymovements.MoveLines, Index=0, Wrap=True)  # -> Item1, Item
end_3 = EndPoints(Curve=item_30.Item1)  # -> Start, End
movelines_prog = Data(classifymovements.MoveLinesProg)
printpolylines = Data(classifymovements.PrintPolyLines)
colors_prog = Data(classifymovements.ColorsProg)
gcode_last_pt = Data(end_3.End)
movelines = Data(classifymovements.MoveLines)
printlines = Data(classifymovements.PrintLines)
colors = Data(classifymovements.Colors)

# ----
# PRINTING TIME APPROXIMATION
print_speed_mm_min_3 = Data(print_speed_mm_min_2)
printing_time_correction_factor = Slider(1.45, range=0..2)
movelines_2 = Data(movelines)
null_8 = NullItem(Item=movelines_2)  # -> NullFlags, InvalidFlags, Description
lng_24 = ListLength(List=movelines_2)
equals_6 = Equality(FirstNumber=lng_24, SecondNumber="0")  # -> Equality, Inequality
ma_15 = MassAddition(Input=[null_8.NullFlags, null_8.InvalidFlags])  # -> Result, PartialResults
or_12 = GateOr(A=ma_15.Result, C=equals_6.Equality)
filter_104 = StreamFilter(Gate=or_12, Stream0=movelines_2)
len_8 = Length(Curve=filter_104)
ma_16 = MassAddition(Input=len_8)  # -> Result, PartialResults
filter_105 = StreamFilter(Gate=or_12, Stream0=printing_time_correction_factor)
division_9 = Division(A=ma_16.Result, B=print_speed_mm_min_3)
multiplication_18 = Multiplication(A=division_9, B=filter_105)
rtd_7 = RoundToDecimal(Numbers=multiplication_18, DecimalPlaces="2")  # -> Rounded; inputs Numbers: list, DecimalPlaces: list of Int32; same code as rtd_2
comments_notes_38 = Panel("PRINTING TIME APPROXIMATION")
division_10 = Division(A=rtd_7, B="60")
round_9 = Round(Number=division_10)  # -> Nearest, Floor, Ceiling
subtraction_18 = Subtraction(A=division_10, B=round_9.Floor)
approximate_printing_time_in_minutes = Panel(rtd_7)
multiplication_19 = Multiplication(A=subtraction_18, B="60")
panel_27 = Panel("[INFO] Approximate Printing Time is {0} hours, {1} minutes, {2} seconds.")
round_10 = Round(Number=multiplication_19)  # -> Nearest, Floor, Ceiling
subtraction_19 = Subtraction(A=multiplication_19, B=round_10.Floor)
multiplication_20 = Multiplication(A=subtraction_19, B="60")
filter_106 = StreamFilter(Gate=or_12, Stream0=panel_27)
round_11 = Round(Number=multiplication_20)  # -> Nearest, Floor, Ceiling
format_7 = Format(Format=filter_106, Culture=127, Data0=round_9.Floor, Data1=round_10.Floor, Data2=round_11.Floor)
info_approximate_print_time = Data(format_7)
approximate_print_time = Data(rtd_7)

info_approximate_print_weight_2 = Data(info_approximate_print_weight)
info_approximate_print_time_2 = Data(info_approximate_print_time)
info_spiralize_contours_2 = Data(info_spiralize_contours)
info_mirko_spiralize_2 = Data(info_mirko_spiralize)
merge_29 = Merge(
    Data1=flatten(inmesh_closed_2),
    Data2=flatten(remeshing_info_2),
    Data3=flatten(shrinkwrap_info_2),
    Data4=flatten(base_mesh_closed_2),
    Data5=flatten(pg_meshbrep_info_2),
    Data6=flatten(info_npslicing_2),
    Data7=flatten(floor_info_2),
    Data8=flatten(info_randomization_2),
    Data9=flatten(info_spiralize_contours_2),
    Data10=flatten(info_mirko_spiralize_2),
    Data11=flatten(info_approximate_print_weight_2),
    Data12=flatten(info_approximate_print_time_2))  # -> flatten(Result)
filter_107 = StreamFilter(Gate=geo_present_4, Stream0=panel_8, Stream1=merge_29)
info_error_stream = Panel(filter_107)
layerheightanalysis_2 = Data(layerheightanalysis)
overhanganalysis_2 = Data(overhanganalysis)
filter_108 = StreamFilter(Gate=enable_heads_up_display_2, Stream1=filter_107)
clayprintinghud = CSharpScript(
    INFO=filter_108,
    LHA=layerheightanalysis_2,
    OHA=overhanganalysis_2,
    MarginH=Slider(20, range=0..100),
    MarginV=Slider(40, range=0..100),
    Font="Titillium",
    TextSize=textsize,
    TextColor=ColourSwatch(SwatchColor=RGB(0, 0, 0)),
    ErrorColor=ColourSwatch(SwatchColor=RGB(255, 0, 0)),
    WarningColor=ColourSwatch(SwatchColor=RGB(255, 132, 0)),
    IgnoColor=ColourSwatch(SwatchColor=RGB(61, 61, 61)),
    ThrowDebugError=Toggle(True))  # inputs INFO: list of String, LHA: list of String, OHA: list of String, MarginH: Int32, MarginV: Int32, Font: String, TextSize: Int32, TextColor: Color, ErrorColor: Color, WarningColor: Color, IgnoColor: Color, ThrowDebugError: Boolean
# ---------- clayprintinghud: C# ----------
// Grasshopper Script Instance
#region Usings
using System;
using System.Linq;
using System.Collections;
using System.Collections.Generic;
using System.Drawing;

using Rhino;
using Rhino.Geometry;

using Grasshopper;
using Grasshopper.Kernel;
using Grasshopper.Kernel.Data;
using Grasshopper.Kernel.Types;
#endregion

public class Script_Instance : GH_ScriptInstance
{
    #region Notes
    /* 
      Members:
        RhinoDoc RhinoDocument
        GH_Document GrasshopperDocument
        IGH_Component Component
        int Iteration

      Methods (Virtual & overridable):
        Print(string text)
        Print(string format, params object[] args)
        Reflect(object obj)
        Reflect(object obj, string method_name)
    */
    #endregion

    List<string> INFO;
    List<string> LHA;
    List<string> OHA;

    int hmargin;
    int vmargin;
    string font;
    int txtsize;
    Color txtcolor;
    Color errcolor;
    Color warncolor;
    Color ignocolor;
    bool throwerror;

    private void RunScript(
		List<string> INFO,
		List<string> LHA,
		List<string> OHA,
		int MarginH,
		int MarginV,
		string Font,
		int TextSize,
		Color TextColor,
		Color ErrorColor,
		Color WarningColor,
		Color IgnoColor,
		bool ThrowDebugError)
    {
        // data
        this.INFO = INFO;
        this.LHA = LHA;
        this.OHA = OHA;
        
        // settings
        this.hmargin = MarginH;
        this.vmargin = MarginV;
        this.font = Font;
        this.txtsize = TextSize;
        this.txtcolor = TextColor;
        this.errcolor = ErrorColor;
        this.warncolor = WarningColor;
        this.ignocolor = IgnoColor;
        this.throwerror = ThrowDebugError;

    }

    override public void DrawViewportWires(IGH_PreviewArgs args)
    {
        if (args.Display.Viewport.Id == args.Document.RhinoDocument.Views.ActiveView.ActiveViewportID)
        {
            Point2d anchor_pt = new Point2d(this.hmargin, this.vmargin);
            

            // INFO, WARNING & ERROR STREAM
            if (this.INFO != null)
            {
                // Headline
                args.Display.Draw2dText(
                    "INFO & ERROR STREAM",
                    this.txtcolor,
                    anchor_pt,
                    false,
                    this.txtsize,
                    this.font + " Bold"
                );
                anchor_pt += new Point2d(0, this.txtsize * 1.25);
                // Stream
                foreach (string infostring in this.INFO)
                {
                    args.Display.Draw2dText(
                        infostring,
                        this.GetTextColor(infostring),
                        anchor_pt,
                        false,
                        this.txtsize,
                        this.font
                    );
                    anchor_pt += new Point2d(0, this.txtsize * 1.25);
                }


            }

            // LAYER HEIGHT ANALYSIS
            if (this.LHA != null)
            {
                anchor_pt += new Point2d(0, this.txtsize * 1.5);
                // Headline
                args.Display.Draw2dText(
                    "LAYER HEIGHT ANALYSIS",
                    this.txtcolor,
                    anchor_pt,
                    false,
                    this.txtsize,
                    this.font + " Bold"
                );
                anchor_pt += new Point2d(0, this.txtsize * 1.25);
                // Stream
                foreach (string lhastring in this.LHA)
                {
                    args.Display.Draw2dText(
                        lhastring,
                        this.txtcolor,
                        anchor_pt,
                        false,
                        this.txtsize,
                        this.font
                    );
                    anchor_pt += new Point2d(0, this.txtsize * 1.25);
                }
            }

            // OVERHANG ANALYSIS
            if (this.OHA != null)
            {
                if (this.INFO != null && this.LHA != null) { anchor_pt += new Point2d(0, this.txtsize * 4.5); }
                else if (this.INFO != null && this.LHA == null) { anchor_pt += new Point2d(0, this.txtsize * 1.5); }
                // Headline
                args.Display.Draw2dText(
                    "OVERHANG ANALYSIS",
                    this.txtcolor,
                    anchor_pt,
                    false,
                    this.txtsize,
                    this.font + " Bold"
                );
                anchor_pt += new Point2d(0, this.txtsize * 1.25);
                // Stream
                foreach (string ohastring in this.OHA)
                {
                    args.Display.Draw2dText(
                        ohastring,
                        this.txtcolor,
                        anchor_pt,
                        false,
                        this.txtsize,
                        this.font
                    );
                    anchor_pt += new Point2d(0, this.txtsize * 1.25);
                }
            }

        }
    }

    private Color GetTextColor(string infostring)
    {
        Color col = Color.Black;
        // options
        if (infostring.StartsWith("[INFO]")) { return this.txtcolor; }
        else if (infostring.StartsWith("[ERROR]")) { return this.errcolor; }
        else if (infostring.StartsWith("[WARNING]")) { return this.warncolor; }
        else if (infostring.StartsWith("[SETTING IGNORED]")) { return this.ignocolor; }
        else { return this.txtcolor; }
    }
}
# ---------- end clayprintinghud ----------

# ----
# PRINT LAYER
# VISUALISATION
printing_curves_7 = Geometry(flatten(printing_curves_3))
vis_offset_vector_10 = Vector(vis_offset_vector)
vis_leader_plane_5 = Data(vis_leader_plane)
layer_height_9 = Number(layer_height)
render_layer_curves_2 = Data(render_layer_curves)
render_print_layers_2 = Data(render_print_layers)
line_width_5 = Data(line_width)
overhangangleanalysis = Boolean(filter_84)
vis_leader_5 = Curve(vis_leader)
filter_109 = StreamFilter(Gate=overhangangleanalysis, Stream0="3", Stream1="4")
multiplication_21 = Multiplication(A=vis_offset_vector_10, B=filter_109)
move_33 = Move(Geometry=printing_curves_7, Motion=multiplication_21)  # -> Geometry, Transform
filter_110 = StreamFilter(Gate=render_print_layers_2, Stream1=move_33.Geometry)
comments_notes_39 = Panel("PRINT LAYER VISUALISATION")
redpline_7 = Reduce(Polyline=filter_110, Tolerance=Slider(0.1, range=0..1))  # -> Polyline, Reduction
filter_111 = StreamFilter(Gate=render_print_layers_2, Stream1=vis_leader_plane_5)
filter_112 = StreamFilter(Gate=render_print_layers_2, Stream1=vis_leader_5)
move_34 = Move(Geometry=printing_curves_7, Motion=expr("x*2", vis_offset_vector_10))  # -> Geometry, Transform
hd_layer_visualisation_2 = Data(hd_layer_visualisation)
filter_113 = StreamFilter(Gate=render_layer_curves_2, Stream1=move_34.Geometry)
gate_25 = StreamGate(Stream=redpline_7.Polyline, Gate=hd_layer_visualisation_2)  # -> Target0, Target1
filter_114 = StreamFilter(Gate=render_layer_curves_2, Stream1=vis_leader_5)
filter_115 = StreamFilter(Gate=render_layer_curves_2, Stream1=vis_leader_plane_5)
move_35 = Move(Geometry=filter_112, Motion=multiplication_21)  # -> Geometry, Transform
move_36 = Move(Geometry=filter_111, Motion=multiplication_21)  # -> Geometry, Transform
swatch_4 = ColourSwatch(SwatchColor=RGB(0, 0, 0))
leader_text_size = Slider(8, range=0..10)
curvepreviewlw_10 = CSharpScript(Curves=move_35.Geometry, Colors=swatch_4)  # inputs Curves: list of Curve, Colors: list of Color, Thickness: list of Int32; same code as curvepreviewlw
tag_7 = TextTag3D(Location=move_36.Geometry, Text="Print Layer Simulation", Size=leader_text_size, Colour=swatch_4, Justification=8)
divlength_2 = DivideLength(Curve=reparameterize(flatten(gate_25.Target1)), Length=Slider(200, range=0..1000))  # -> Points, Tangents, Parameters
move_37 = Move(Geometry=filter_114, Motion=expr("x*2", vis_offset_vector_10))  # -> Geometry, Transform
move_38 = Move(Geometry=filter_115, Motion=expr("x*2", vis_offset_vector_10))  # -> Geometry, Transform
numsegments = Slider(10, range=0..10)
line_width_6 = Data(line_width)
shatter = Shatter(Curve=reparameterize(graft(gate_25.Target1)), Parameters=divlength_2.Parameters)  # -> flatten(Segments)
subsegments = Slider(10, range=0..100)
accuracy = Slider(1, range=0..1)
capstyle = Slider(3, range=0..3)
multiplication_22 = Multiplication(A=line_width_6, B="0.5")
curvepreviewlw_11 = CSharpScript(Curves=filter_113, Colors=ColourSwatch(SwatchColor=RGB(217, 212, 212)), Thickness=Slider(2, range=0..10))  # inputs Curves: list of Curve, Colors: list of Color, Thickness: list of Int32; same code as curvepreviewlw
curvepreviewlw_12 = CSharpScript(Curves=move_37.Geometry)  # inputs Curves: list of Curve, Colors: list of Color, Thickness: list of Int32
# ---------- curvepreviewlw_12: C# ----------
// Grasshopper Script Instance
#region Usings
using System;
using System.Linq;
using System.Collections;
using System.Collections.Generic;
using System.Drawing;

using Rhino;
using Rhino.Geometry;

using Grasshopper;
using Grasshopper.Kernel;
using Grasshopper.Kernel.Data;
using Grasshopper.Kernel.Types;
#endregion

public class Script_Instance : GH_ScriptInstance
{
    #region Notes
    /* 
      Members:
        RhinoDoc RhinoDocument
        GH_Document GrasshopperDocument
        IGH_Component Component
        int Iteration

      Methods (Virtual & overridable):
        Print(string text)
        Print(string format, params object[] args)
        Reflect(object obj)
        Reflect(object obj, string method_name)
    */
    #endregion

    List<Curve> drawCurves;
    List<Color> drawColors;
    List<int> drawThickness;

    private void RunScript(
		List<Curve> Curves,
		List<Color> Colors,
		List<int> Thickness)
    {
        if (Curves == null) return;
        this.drawCurves = new List<Curve>();     

        if (Colors == null) this.drawColors = new List<Color>{Color.Black};
        else this.drawColors = Colors;

        if (Thickness == null) this.drawThickness = new List<int>{1};
        else this.drawThickness = Thickness;

        for (int i = 0; i < Curves.Count; i++)
        {
            if (Curves[i] != null)
            {
                this.drawCurves.Add(Curves[i]);
            }
            else
            {
                continue;
            }
            if (Colors == null || i >= Colors.Count || Colors[i] == null)
            {
                this.drawColors.Add(drawColors.Last());
            }
            else
            {
                this.drawColors.Add(Colors[i]);
            }
            if (Thickness == null || i >= Thickness.Count || Thickness[i] == null)
            {
                this.drawThickness.Add(drawThickness.Last());
            }
            else
            {
                this.drawThickness.Add(Thickness[i]);
            }
        }
    }

    override public void DrawViewportWires(IGH_PreviewArgs args)
    {
        if (this.drawCurves != null)
        {
            try
            {
                for (int i = 0; i < this.drawCurves.Count; i++)
                {
                    args.Display.DrawCurve(
                        this.drawCurves[i],
                        this.drawColors[i],
                        this.drawThickness[i]
                    );
                }
                
            }
            catch (Exception e)
            {
                this.AddRuntimeMessage(GH_RuntimeMessageLevel.Warning, "Error while drawing Preview!");
                this.Print(e.ToString());
            }
        }
    }
}
# ---------- end curvepreviewlw_12 ----------
tag_8 = TextTag3D(
    Location=move_38.Geometry,
    Text="Printing Layers",
    Size=leader_text_size,
    Colour=ColourSwatch(SwatchColor=RGB(0, 0, 0)),
    Justification=8)
hd_layer_visualisation_3 = Data(hd_layer_visualisation_2)
meshpipe = CSharpScript(Curves=shatter, Radius=multiplication_22, SubSegments=subsegments, Accuracy=accuracy, CapStyle=capstyle)  # -> M; inputs Curves: list of Curve, Radius: Double, SubSegments: Int32, Accuracy: Int32, CapStyle: Int32
# ---------- meshpipe: C# usings ----------
using System.Threading.Tasks;
using System.Collections.Concurrent;
# ---------- meshpipe: C# ----------
    ConcurrentBag<Mesh> MeshPipesBag = new ConcurrentBag<Mesh>();
    MeshPipeCapStyle mpcs = (MeshPipeCapStyle) CapStyle;

    if (Curves.Count > 20)
    {
      // create pipes in parallel
      Parallel.For(0, Curves.Count,
        i => {
        // create mesh pipe
        Mesh MeshPipe = Mesh.CreateFromCurvePipe(Curves[i], Radius, SubSegments, Accuracy, mpcs, true);
        // add to tree
        MeshPipesBag.Add(MeshPipe);
        });
    }
    else
    {
      // create pipes sequential
      for (int i = 0; i < Curves.Count; i++)
      {
        // create mesh pipe
        Mesh MeshPipe = Mesh.CreateFromCurvePipe(Curves[i], Radius, SubSegments, Accuracy, mpcs, true);
        // add to tree
        MeshPipesBag.Add(MeshPipe);
      }
    }
    M = MeshPipesBag.ToArray();
# ---------- end meshpipe ----------
meshpipechromo = CSharpScript(P=gate_25.Target0, N=numsegments, R=multiplication_22, C=Toggle(True))  # -> M; inputs P: list of Curve, N: Int32, R: Double, C: Boolean
# ---------- meshpipechromo: C# ----------
    ﻿/*
     *      ___  _  _  ____   __   _  _   __  ____   __  ____  __  ____
     *     / __)/ )( \(  _ \ /  \ ( \/ ) /  \(    \ /  \(  _ \(  )/ ___)
     *    ( (__ ) __ ( )   /(  O )/ \/ \(  O )) D ((  O ))   / )( \___ \
     *     \___)\_)(_/(__\_) \__/ \_)(_/ \__/(____/ \__/(__\_)(__)(____/
     *
     *    Copyright Cameron Newnham 2015-2016
     *
     *    This program is free software: you can redistribute it and/or modify
     *    it under the terms of the GNU General Public License as published by
     *    the Free Software Foundation, either version 3 of the License, or
     *    (at your option) any later version.
     *
     *    This program is distributed in the hope that it will be useful,
     *    but WITHOUT ANY WARRANTY; without even the implied warranty of
     *    MERCHANTABILITY or FITNESS FOR A PARTICULAR PURPOSE.  See the
     *    GNU General Public License for more details.
     *
     *    You should have received a copy of the GNU General Public License
     *    along with this program.  If not, see <http://www.gnu.org/licenses/>.
     *
     */

    List<Polyline> pls = new List<Polyline>();

    foreach (var c in P)
    {
      Polyline p;
      if (c.TryGetPolyline(out p)) {
        pls.Add(p);
      }
      else
      {
        this.Component.AddRuntimeMessage(GH_RuntimeMessageLevel.Error, "Input must be polylines.");
        return;
      }
    }
    Mesh _M = GetPiped(pls, N, R, C);
    _M.UnifyNormals();
    M = new GH_Mesh(_M);
# ---------- meshpipechromo: C# additional code ----------
  public Mesh GetPiped(List<Polyline> polylines, int numSides, double radius, bool cap)
  {
    var pt = new Point3d(radius, 0, 0);
    Polyline polygon = new Polyline();

    Point3d curr = new Point3d(pt);
    polygon.Add(curr);
    var xfm = Transform.Rotation(Math.PI * 2 / (double) numSides, Point3d.Origin);
    for (int i = 0; i < numSides; i++)
    {
      var pNew = new Point3d(curr);
      pNew.Transform(xfm);

      polygon.Add(pNew);
      curr = pNew;
    }

    var multimesh = new Mesh[polylines.Count];

    System.Threading.Tasks.Parallel.For(0, polylines.Count, pc => {
      Polyline pl = polylines[pc];
      List<Plane> frames = new List<Plane>();
      for (int i = 0; i < pl.Count; i++)
      {
        Point3d o = pl[i];
        Vector3d dir = Vector3d.Unset;
        if (i == 0)
        {
          if (!pl.IsClosed)
          {
            dir = pl[1] - pl[0];
            dir.Unitize();
          }
          else
          {
            Vector3d prevDir = pl[0] - pl[pl.Count - 2];
            Vector3d nextDir = pl[1] - pl[0];
            prevDir.Unitize();
            nextDir.Unitize();
            dir = (prevDir + nextDir) / 2;
            dir.Unitize();
          }
        }
        else if (i == pl.Count - 1)
        {
          if (!pl.IsClosed)
          {
            dir = pl[pl.Count - 1] - pl[pl.Count - 2];
            dir.Unitize();
          }
        }
        else
        {
          Vector3d prevDir = pl[i] - pl[i - 1];
          Vector3d nextDir = pl[i + 1] - pl[i];
          prevDir.Unitize();
          nextDir.Unitize();
          dir = (prevDir + nextDir) / 2;
          dir.Unitize();
        }

        if (frames.Count > 0)
        {
          if (dir != Vector3d.Unset)
          {
            var prevFrame = frames.Last();
            var newPlane = new Plane(o, dir);
            double rotAng = Vector3d.VectorAngle(prevFrame.XAxis, newPlane.XAxis, newPlane);
            newPlane.Rotate(-rotAng, newPlane.ZAxis);
            frames.Add(newPlane);
          }
        }
        else
        {
          frames.Add(new Plane(o, dir));
        }
      }

      Mesh mesh = new Mesh();
      Mesh capm = null;
      var poly = new Polyline(polygon);
      poly.Transform(Transform.PlaneToPlane(Plane.WorldXY, frames.First()));

      int[] lastVerts = new int[numSides];
      for (int p = 0; p < poly.Count - 1; p++)
      {
        lastVerts[p] = mesh.Vertices.Add(poly[p]);
      }

      int[] firstVerts = lastVerts;

      if (cap && !pl.IsClosed)
      {
        capm = Mesh.CreateFromClosedPolyline(poly);
      }

      for (int i = 1; i < frames.Count; i++)
      {
        poly = new Polyline(polygon);
        poly.Transform(Transform.PlaneToPlane(Plane.WorldXY, frames[i]));

        int[] newVerts = new int[numSides];
        for (int p = 0; p < poly.Count - 1; p++)
        {
          newVerts[p] = mesh.Vertices.Add(poly[p]);
        }

        for (int v = 1; v <= numSides; v++)
        {

          if (v == numSides)
          {
            mesh.Faces.AddFace(lastVerts[v - 1], lastVerts[0], newVerts[0], newVerts[v - 1]);
          }
          else
          {
            mesh.Faces.AddFace(lastVerts[v - 1], lastVerts[v], newVerts[v], newVerts[v - 1]);

          }
        }

        lastVerts = newVerts;
      }

      if (pl.IsClosed)
      {

        // resolve any twists
        for (int v = 1; v <= numSides; v++)
        {
          if (v == numSides)
          {
            mesh.Faces.AddFace(lastVerts[v - 1], lastVerts[0], firstVerts[0], firstVerts[v - 1]);
          }
          else
          {
            mesh.Faces.AddFace(lastVerts[v - 1], lastVerts[v], firstVerts[v], firstVerts[v - 1]);

          }
        }
      } else if (cap)
      {
        capm.Append(Mesh.CreateFromClosedPolyline(poly));
        mesh.Append(capm);
      }

      multimesh[pc] = mesh;
      });

    Mesh combined = new Mesh();

    foreach (var m in multimesh)
    {
      combined.Append(m);
    }

    combined.Normals.ComputeNormals();

    return combined;
  }
# ---------- end meshpipechromo ----------
clean_8 = CombineClean(Meshes=meshpipechromo)
filter_116 = StreamFilter(Gate=hd_layer_visualisation_3, Stream0=clean_8, Stream1=meshpipe)
preview_2 = CustomPreview(Geometry=filter_116, Material=ColourSwatch(SwatchColor=RGB(230, 230, 230)))

# ----
# comments & notes: COMPUTE GCODE OFFSET VECTOR FOR VISUALISATION
overhang_angle_analysis_3 = Boolean(filter_84)
render_print_layers_3 = Data(render_print_layers)
vis_offset_vector_11 = Vector(vis_offset_vector)
filter_117 = StreamFilter(Gate=overhang_angle_analysis_3, Stream0="4.5", Stream1="5.5")
subtraction_20 = Subtraction(A=filter_117, B="1")
filter_118 = StreamFilter(Gate=render_print_layers_3, Stream0=subtraction_20, Stream1=filter_117)
multiplication_23 = Multiplication(A=vis_offset_vector_11, B=filter_118)
gcode_offset_vector = Data(multiplication_23)

# ----
# GCODE VISUALISATION
comments_notes_40 = Panel("GCODE VISUALISATION")
enable_print_simulation_3 = Data(enable_print_simulation)
gcode_offset_vector_2 = Data(gcode_offset_vector)
movelines_progvis = Data(movelines_prog)
vis_leader_plane_6 = Data(vis_leader_plane)
colors_progvis = Data(colors_prog)
vis_leader_6 = Curve(vis_leader)
move_39 = Move(Geometry=vis_leader_6, Motion=gcode_offset_vector_2)  # -> Geometry, Transform
move_40 = Move(Geometry=vis_leader_plane_6, Motion=gcode_offset_vector_2)  # -> Geometry, Transform
swatch_5 = ColourSwatch(SwatchColor=RGB(0, 0, 0))
filter_119 = StreamFilter(Gate=enable_print_simulation_3, Stream0=movelines_progvis)
filter_120 = StreamFilter(Gate=enable_print_simulation_3, Stream0=colors_progvis)
move_41 = Move(Geometry=filter_119, Motion=gcode_offset_vector_2)  # -> Geometry, Transform
curvepreviewlw_13 = CSharpScript(Curves=move_39.Geometry, Colors=swatch_5)  # inputs Curves: list of Curve, Colors: list of Color, Thickness: list of Int32; same code as curvepreviewlw_12
tag_9 = TextTag3D(Location=move_40.Geometry, Text="GCODE Simulation", Size=Slider(8, range=0..10), Colour=swatch_5, Justification=8)
curvepreviewlw_14 = CSharpScript(Curves=move_41.Geometry, Colors=filter_120, Thickness=Slider(3, range=0..10))  # inputs Curves: list of Curve, Colors: list of Color, Thickness: list of Int32; same code as curvepreviewlw

# ----
# PRINTING SIM & MESH
# VISUALISATION
# OF GCODE PATHS
# comments & notes: PRINTING SIM & MESH VISUALISATION OF GCODE PATHS
printpolylines_progvis = Data(printpolylines)
enable_print_simulation_4 = Data(enable_print_simulation)
gcode_offset_vector_3 = Data(gcode_offset_vector)
filter_121 = StreamFilter(Gate=enable_print_simulation_4, Stream1=printpolylines_progvis)
move_42 = Move(Geometry=filter_121, Motion=gcode_offset_vector_3)  # -> Geometry, Transform
hd_printing_visualisation_2 = Data(hd_printing_visualisation)
redpline_8 = Reduce(Polyline=move_42.Geometry, Tolerance=Slider(0.1, range=0..1))  # -> Polyline, Reduction
gate_26 = StreamGate(Stream=redpline_8.Polyline, Gate=hd_printing_visualisation_2)  # -> Target0, Target1
divlength_3 = DivideLength(Curve=reparameterize(flatten(gate_26.Target1)), Length=Slider(200, range=0..1000))  # -> Points, Tangents, Parameters
numsegments_2 = Slider(10, range=0..10)
line_width_7 = Data(line_width)
subsegments_2 = Slider(10, range=0..100)
shatter_2 = Shatter(Curve=reparameterize(graft(gate_26.Target1)), Parameters=divlength_3.Parameters)  # -> flatten(Segments)
accuracy_2 = Slider(1, range=0..1)
capstyle_2 = Slider(3, range=0..3)
multiplication_24 = Multiplication(A=line_width_7, B="0.5")
hd_printing_visualisation_3 = Data(hd_printing_visualisation_2)
meshpipechromo_2 = CSharpScript(P=gate_26.Target0, N=numsegments_2, R=multiplication_24, C=Toggle(True))  # -> M; inputs P: list of Curve, N: Int32, R: Double, C: Boolean; same code as meshpipechromo
meshpipe_2 = CSharpScript(Curves=shatter_2, Radius=multiplication_24, SubSegments=subsegments_2, Accuracy=accuracy_2, CapStyle=capstyle_2)  # -> M; inputs Curves: list of Curve, Radius: Double, SubSegments: Int32, Accuracy: Int32, CapStyle: Int32; same code as meshpipe
filter_122 = StreamFilter(Gate=hd_printing_visualisation_3, Stream0=meshpipechromo_2, Stream1=meshpipe_2)
preview_3 = CustomPreview(Geometry=filter_122, Material=ColourSwatch(SwatchColor=RGB(230, 230, 230)))

enable_print_simulation_5 = Data(enable_print_simulation_2)
gcode_last_pt_2 = Point(gcode_last_pt)
gcode_offset_vector_4 = Data(gcode_offset_vector)
home_pt = Point(Point(0, 0, 500))
layer_height_10 = Number(layer_height)
Z_11 = UnitZ(Factor=layer_height_10)
filter_123 = StreamFilter(Gate=enable_print_simulation_5, Stream1=home_pt)
filter_124 = StreamFilter(Gate=enable_print_simulation_5, Stream1=gcode_last_pt_2)
gcode_last_pt_3 = Point(filter_124)
move_43 = Move(Geometry=filter_123, Motion=gcode_offset_vector_4)  # -> Geometry, Transform
move_44 = Move(Geometry=gcode_last_pt_3, Motion=gcode_offset_vector_4)  # -> Geometry, Transform
null_9 = NullItem(Item=move_44.Geometry)  # -> NullFlags, InvalidFlags, Description
or_13 = GateOr(A=null_9.NullFlags, B=null_9.InvalidFlags)
filter_125 = StreamFilter(Gate=or_13, Stream0=move_44.Geometry, Stream1=move_43.Geometry)
move_45 = Move(Geometry=filter_125, Motion=Z_11)  # -> Geometry, Transform
gcode_pt = Point(move_45.Geometry)

gcode_pt_2 = Point(gcode_pt)
xy_11 = XYPlane(Origin=gcode_pt_2)
cir = Circle(Plane=xy_11, Radius=expr("x*0.5", Slider(4, range=0..10)))
Z_12 = UnitZ(Factor=Slider(15, range=0..100))
offset_2 = OffsetCurve(Curve=cir, Distance=Slider(0.5, range=0..1), Corners=1)
boundary = BoundarySurfaces(Edges=flatten([cir, offset_2]))
Z_13 = UnitZ(Factor=Slider(26, range=0..100))
move_46 = Move(Geometry=offset_2, Motion=Z_13)  # -> Geometry, Transform
extr = Extrude(Base=boundary, Direction=Z_12)
darc = DeconstructArc(Arc=move_46.Geometry)  # -> BasePlane, Radius, Angle
move_47 = Move(Geometry=offset_2, Motion=Z_12)  # -> Geometry, Transform
polygon = Polygon(Plane=darc.BasePlane, Radius=Slider(12, range=0..100), Segments=6, FilletRadius=0)  # -> Polygon, Length
Z_14 = UnitZ(Factor=Slider(15, range=0..100))
merge_30 = Merge(Data1=move_47.Geometry, Data2=polygon.Polygon)
move_48 = Move(Geometry=darc.BasePlane, Motion=Z_14)  # -> Geometry, Transform
extr_2 = Extrude(Base=polygon.Polygon, Direction=Z_14)
loft = Loft(Curves=merge_30, Options={Adjust=False, Closed=False, LoftEnds=0, LoftSimp=0, LoftType=0, Rebuild=10, Refit=0.01})
cutplane_extruderfixtures = Data(move_48.Geometry)
nozzle_transition = Data(loft)
nozzle_toppart = Data(extr_2)
nozzle_bot = Data(extr)

cir_2 = Circle(Plane=cutplane_extruderfixtures, Radius=Slider(30, range=0..100))
seam_2 = Seam(Curve=reparameterize(cir_2), Seam=Slider(0.25, range=0..1))
boundary_2 = BoundarySurfaces(Edges=cir_2)
extrudermount_srf = Data(boundary_2)
divide_5 = DivideCurve(Curve=seam_2, Count="3", Kinks=False)  # -> Points, Tangents, Parameters
extruder_attachmentpts = Data(divide_5.Points)

extrudermount_srf_2 = Data(extrudermount_srf)
showprinter = Data(show_printer_2)
nozzle_bot_2 = Data(nozzle_bot)
nozzle_transition_2 = Data(nozzle_transition)
nozzle_toppart_2 = Data(nozzle_toppart)
merge_31 = Merge(Data1=nozzle_bot_2, Data2=nozzle_transition_2, Data3=nozzle_toppart_2, Data4=extrudermount_srf_2)  # -> flatten(Result)
filter_126 = StreamFilter(Gate=showprinter, Stream1=merge_31)
preview_4 = CustomPreview(Geometry=filter_126, Material=ColourSwatch(SwatchColor=RGB(184, 184, 184)))

# ----
# VISUALIZE
# SEAM POINTS
show_seam_points_2 = Data(show_seam_points)
spiralization_enabled_4 = Boolean(spiralization_enabled)
slice_curves_17 = Curve(slice_curves_12)
spiralcontours_base_4 = Data(spiralcontours_base)
vis_offset_vector_12 = Vector(expr("x*2", vis_offset_vector))
filter_127 = StreamFilter(Gate=spiralization_enabled_4, Stream0=slice_curves_17, Stream1=spiralcontours_base_4)
and_16 = GateAnd(A=show_seam_points_2, B=invert(spiralization_enabled_4))
end_4 = EndPoints(Curve=filter_127)  # -> Start, End
item_31 = ListItem(List=flatten(end_4.Start), Index=0, Wrap=True)
layer_height_11 = Data(layer_height)
pdecon_10 = Deconstruct(Point=item_31)  # -> XComponent, YComponent, ZComponent
subtraction_21 = Subtraction(A=layer_height_11, B=pdecon_10.ZComponent)
Z_15 = UnitZ(Factor=subtraction_21)
addition_6 = Addition(A=vis_offset_vector_12, B=Z_15)

smaller_3 = SmallerThan(FirstNumber=pdecon_10.ZComponent, SecondNumber=layer_height_11)  # -> SmallerThan, OrEqualTo

filter_128 = StreamFilter(Gate=smaller_3.SmallerThan, Stream0=vis_offset_vector_12, Stream1=addition_6)
move_49 = Move(Geometry=end_4.Start, Motion=filter_128)  # -> Geometry, Transform
filter_129 = StreamFilter(Gate=show_seam_points_2, Stream1=move_49.Geometry)
dots = DotDisplay(Point=filter_129, Colour=ColourSwatch(SwatchColor=RGB(0, 0, 0)), Size=Slider(1, range=0..1))

gcode_offset_vector_5 = Data(gcode_offset_vector)
xy_12 = XYPlane(Origin=Point(0, 0, 0))
wasp_40100_printing_diameter_3 = Data(wasp_40100_printing_diameter_2)
printingsimulation = Data(enable_print_simulation_2)
Y_2 = UnitY(Factor=expr("(x-10)*0.5", wasp_40100_printing_diameter_3))

# ----
# PRINTER SIM / VISUALIZATION
move_50 = Move(Geometry=xy_12, Motion=gcode_offset_vector_5)  # -> Geometry, Transform
comments_notes_41 = Panel("PRINTER SIM & VISUALISATION")

move_51 = Move(Geometry=move_50.Geometry, Motion=Y_2)  # -> Geometry, Transform
cir_3 = Circle(Plane=move_50.Geometry, Radius=expr("x*0.5", wasp_40100_printing_diameter_3))
crv_cp_3 = CurveClosestPoint(Point=move_51.Geometry, Curve=reparameterize(cir_3))  # -> Point, Parameter, Distance
seam_3 = Seam(Curve=reparameterize(cir_3), Seam=crv_cp_3.Parameter)
filter_130 = StreamFilter(Gate=printingsimulation, Stream1=seam_3)
boundary_3 = BoundarySurfaces(Edges=seam_3)
wasp40100_printing_area_srf = Data(boundary_3)
wasp40100_printing_area_crv = Data(filter_130)

wasp40100_printing_area_srf_2 = Data(wasp40100_printing_area_srf)
showprinter_2 = Data(show_printer_2)
filter_131 = StreamFilter(Gate=showprinter_2, Stream1=wasp40100_printing_area_srf_2)
preview_5 = CustomPreview(Geometry=filter_131, Material=ColourSwatch(SwatchColor=RGB(227, 227, 227)))

wasp40100_printing_area_crv_2 = Data(wasp40100_printing_area_crv)
divide_6 = DivideCurve(Curve=wasp40100_printing_area_crv_2, Count="3", Kinks=False)  # -> Points, Tangents, Parameters
Z_16 = UnitZ(Factor=1)
line_3 = LineSDL(Start=divide_6.Points, Direction=Z_16, Length=Slider(1000, range=0..1000))
wasp40100_z_axis_crvs = Data(line_3)

wasp40100_arm_length_3 = Data(wasp40100_arm_length_2)
cutplane_extruderfixtures_2 = Data(cutplane_extruderfixtures)
wasp40100_z_axis_crvs_2 = Data(wasp40100_z_axis_crvs)
extruder_attachmentpts_2 = Data(extruder_attachmentpts)
plx = LinePlane(Line=wasp40100_z_axis_crvs_2, Plane=cutplane_extruderfixtures_2)  # -> Point, ParamL, ParamP
ln_7 = Line(StartPoint=extruder_attachmentpts_2, EndPoint=plx.Point)
len_9 = Length(Curve=ln_7)
vec2pt_7 = Vector2Pt(PointA=extruder_attachmentpts_2, PointB=plx.Point, Unitize=False)  # -> Vector, Length
Z_17 = UnitZ(Factor=1)
rtrig = RightTrigonometry(PLength=len_9, RLength=wasp40100_arm_length_3)  # -> Alpha, Beta, PLength, QLength, RLength
pl_5 = ConstructPlane(Origin=extruder_attachmentpts_2, XAxis=vec2pt_7.Vector, YAxis=Z_17)
rotate = Rotate(Geometry=ln_7, Angle=rtrig.Alpha, Plane=pl_5)  # -> Geometry, Transform
end_5 = EndPoints(Curve=rotate.Geometry)  # -> Start, End
wasp40100_arm_length_4 = Data(wasp40100_arm_length_3)
vec2pt_8 = Vector2Pt(PointA=end_5.Start, PointB=end_5.End, Unitize=False)  # -> unitize(Vector), Length
line_4 = LineSDL(Start=extruder_attachmentpts_2, Direction=vec2pt_8.Vector, Length=wasp40100_arm_length_4)
wasp40100_arm_crv = Data(line_4)

subsegments_3 = Slider(10, range=0..100)
wasp40100_arm_crv_2 = Data(wasp40100_arm_crv)
accuracy_3 = Slider(1, range=0..1)
wasp40100_z_axis_crvs_3 = Data(wasp40100_z_axis_crvs)
wasp40100_arm_crv_3 = Data(wasp40100_arm_crv)
capstyle_3 = Slider(3, range=0..3)
showprinter_3 = Data(show_printer_2)
merge_32 = Merge(Data1=wasp40100_z_axis_crvs_3, Data2=wasp40100_arm_crv_2)  # -> flatten(Result)
filter_132 = StreamFilter(Gate=showprinter_3, Stream1=wasp40100_arm_crv_3)
meshpipe_3 = CSharpScript(Curves=filter_132, Radius=Slider(4, range=0..10), SubSegments=subsegments_3, Accuracy=accuracy_3, CapStyle=capstyle_3)  # -> M; inputs Curves: list of Curve, Radius: Double, SubSegments: Int32, Accuracy: Int32, CapStyle: Int32; same code as meshpipe
curvepreviewlw_15 = CSharpScript(Curves=merge_32, Colors=ColourSwatch(SwatchColor=RGB(191, 191, 191)), Thickness=Slider(2, range=0..10))  # inputs Curves: list of Curve, Colors: list of Color, Thickness: list of Int32; same code as curvepreviewlw
preview_6 = CustomPreview(Geometry=meshpipe_3, Material=ColourSwatch(SwatchColor=RGB(191, 191, 191)))

# ==== cluster CurveInfill: Take the given curve and creates an infill (based on the extrusion width and infill ratio) of the curve as a polyline. This polyline can be then be converted into g code.

C = ClusterInput()
trim_to = TrimTo(data_to_trim=simplify(C), branch_depth=1, F=False)
crv = Curve(trim_to)
join = JoinCurves(Curves=crv, Preserve=False)
trim = TrimTree(Tree=join, Depth=1)
boundary = BoundarySurfaces(Edges=trim)  # -> graft(Surfaces)

extrusion_width_or_xylinus_config = ClusterInput()  # input either the extrusion width in mm, or a Xlinus Config
extrusion_width = Data(extrusion_width_or_xylinus_config)
setting = ConfigSetting(config=extrusion_width, setting_number=3)  # -> flatten(setting_2)

# ---- group: infill ratio
infill_ratio_0_1 = ClusterInput()  # infill ratio
division = Division(A=1, B=infill_ratio_0_1)
multiplication = Multiplication(A=setting, B=division)

# ----
tstat = TreeStatistics(Tree=crv)  # -> Paths, Length, Count
long = LongestList(ListA=tstat.Paths, ListB=[0, 1], PaddingMode=4)  # -> ListA, simplify(graft(ListB))
larger = LargerThan(FirstNumber=tstat.Count, SecondNumber=1)  # -> LargerThan, OrEqualTo
filter = StreamFilter(Gate=larger.LargerThan, Stream0=0, Stream1=long.ListB)
trim_2 = TrimTree(Tree=boundary, Depth=1)

# ---- group: create lines for infill
bbox = BoundingBox(Content=flatten(boundary), Plane=PlaneXY(0, 0, 0), UnionBox=True)  # -> Box, Box_2
box = EvaluateBox(Box=bbox.Box, UParameter=0.5, VParameter=0.5, WParameter=0.5)  # -> Plane, Point, Include
rotate = Rotate(Geometry=bbox.Box, Angle=1.570796327, Plane=box.Plane)  # -> Geometry, Transform
bbox_2 = BoundingBox(Content=flatten([rotate.Geometry, bbox.Box]), Plane=PlaneXY(0, 0, 0), UnionBox=True)  # -> Box, Box_2
box_corners = BoxCorners(Box=flatten(bbox_2.Box))  # -> CornerA, CornerB, CornerC, CornerD, CornerE, CornerF, CornerG, CornerH
ln = Line(StartPoint=box_corners.CornerA, EndPoint=box_corners.CornerC)

# ----
ln_2 = Line(StartPoint=box_corners.CornerB, EndPoint=box_corners.CornerD)
p_n_c = PickNChoose(Pattern=filter, Stream0=ln, Stream1=ln_2)
long_2 = LongestList(ListA=trim_2, ListB=p_n_c, PaddingMode=2)  # -> ListA, graft(ListB)

# ---- group: create lines for infill (continued)
divlength = DivideLength(Curve=long_2.ListB, Length=multiplication)  # -> Points, Tangents, Parameters
pl = PlaneNormal(Origin=divlength.Points, ZAxis=long_2.ListB)
trim_3 = TrimTree(Tree=pl, Depth=1)
sec = BrepPlane(Brep=boundary, Plane=trim_3)  # -> Curves, Points
clean = CleanTree(RemoveNulls=True, RemoveInvalid=True, RemoveEmpty=True, Tree=sec.Curves)

# ----
path_mapper = PathMapper(clean, source="{A;B;C}(i)", target="{A;B;i}(C)")

# ---- group: split at nulls to establish consecutive lines
data = Data(path_mapper)
null = NullItem(Item=data)  # -> NullFlags, InvalidFlags, Description
lng = ListLength(List=data)
series = Series(Start=0, Step=1, Count=lng)
item = ListItem(List=series, Index=0, Wrap=True)  # -> Item1, Item
cull = CullPattern(List=series, CullPattern=null.NullFlags)
merge = Merge(Data1=item.Item, Data2=cull, Data3=item.Item1)
consec = ConsecutiveDomains(Numbers=merge, Additive=False)

# ----
trim_4 = TrimTree(Tree=consec, Depth=2)

# ---- group: split at nulls to establish consecutive lines (continued)
subset = SubList(List=data, Domain=trim_4, Wrap=True)  # -> List, Index
clean_2 = CleanTree(RemoveNulls=True, RemoveInvalid=True, RemoveEmpty=True, Tree=subset.List)

# ---- group: flip every other curve to make zig zags
dispatch = Dispatch(List=clean_2, DispatchPattern=[True, False])  # -> ListA, ListB
flip = FlipCurve(Curve=dispatch.ListB)  # -> Curve, Flag
weave = Weave(Pattern=[0, 1], Stream0=dispatch.ListA, Stream1=flip.Curve, NullGaps=False)
end = EndPoints(Curve=weave)  # -> Start, End
weave_2 = Weave(Pattern=[0, 1], Stream0=end.Start, Stream1=end.End, NullGaps=False)

# ---- group: split at long line shifts
data_2 = Data(weave_2)
lng_2 = ListLength(List=data_2)
series_2 = Series(Start=0, Step=1, Count=lng_2)
item_2 = ListItem(List=series_2, Index=0, Wrap=True)  # -> Item1, Item

# ---- group: split at long line shifts / if the distance between the end of one line and the start of the next is greater than X * the layer width then create a break
shift = ShiftList(List=data_2, Shift=1, Wrap=True)
dist = Distance(PointA=data_2, PointB=shift)
sift = SiftPattern(List=dist, SiftPattern=[0, 1])  # -> Output0, Output1
multiplication_2 = Multiplication(A=multiplication, B=Slider(2.5, range=0..10))
larger_2 = LargerThan(FirstNumber=sift.Output1, SecondNumber=multiplication_2)  # -> LargerThan, OrEqualTo

# ---- group: split at long line shifts
replace = ReplaceItems(List=larger_2.LargerThan, Item=True, Indices=-1, Wrap=True)
trim_5 = TrimTree(Tree=replace, Depth=1)

cull_2 = CullPattern(List=series_2, CullPattern=trim_5)
merge_2 = Merge(Data1=item_2.Item, Data2=cull_2)
consec_2 = ConsecutiveDomains(Numbers=merge_2, Additive=False)

# ---- group: split at long line shifts / increase start of domain by one unless it is 0
dedomain = DeconstructDomain(Domain=consec_2)  # -> Start, End
addition = Addition(A=dedomain.Start, B=1)
eval = Evaluate(F="if(x=1,0,x)", x=addition)
dom = ConstructDomain(DomainStart=eval, DomainEnd=dedomain.End)

# ---- group: split at long line shifts
trim_6 = TrimTree(Tree=dom, Depth=2)
subset_2 = SubList(List=data_2, Domain=trim_6, Wrap=False)  # -> List, Index
clean_3 = CleanTree(Tree=subset_2.List, CleanInvalid=True, CleanEmpty=False)
prune = PruneTree(Tree=clean_3, Minimum=1, Maximum=0)
pline = PolyLine(Vertices=prune, Closed=False)
trim_to_2 = TrimTo(data_to_trim=pline, branch_depth=1, F=False)
D = ClusterOutput(trim_to_2)

# ==== cluster CREATE_OFFSET_INFILL

slice_planes = ClusterInput()
outer_infill_base_curves = ClusterInput()
inner_infill_base_curves = ClusterInput()
offset = ClusterInput()
slice_planes_2 = Data(slice_planes)
outer_infill_base_curves_2 = Curve(outer_infill_base_curves)
inner_infill_base_curves_2 = Curve(inner_infill_base_curves)
offset_2 = Data(offset)

comments_notes = Panel("OFFSET INFILL")
outer_infill_base_curves_3 = Curve(outer_infill_base_curves_2)

null = NullItem(Item=flatten(inner_infill_base_curves_2))  # -> NullFlags, InvalidFlags, Description
or = GateOr(A=null.NullFlags, B=null.InvalidFlags)
tstat = TreeStatistics(Tree=outer_infill_base_curves_2)  # -> Paths, Length, Count
c2bool = Clipper2Boolean(PolylinesA=outer_infill_base_curves_2, PolylinesB=inner_infill_base_curves_2, Operation=1, Precision=6)
ma = MassAddition(Input=or)  # -> Result, PartialResults
branch = TreeBranch(Tree=slice_planes_2, Path=tstat.Paths, MaintainPaths=True)
pshift = ShiftPaths(Data=c2bool, Offset=-1)
bool = Boolean(invert(ma.Result))
project = Project(Geometry=pshift, Plane=branch)  # -> Geometry, Transform
filter = StreamFilter(Gate=bool, Stream0=outer_infill_base_curves_2, Stream1=project.Geometry)
infill_basecrvs_merged = Curve(filter)
bbox = BoundingBox(Content=infill_basecrvs_merged, Plane=PlaneXY(0, 0, 0), UnionBox=True)  # -> Box, Box_2
tstat_2 = TreeStatistics(Tree=infill_basecrvs_merged)  # -> Paths, Length, Count
debox = DeconstructBox(Box=bbox.Box)  # -> Plane, X, Y, Z
branch_2 = TreeBranch(Tree=slice_planes_2, Path=tstat_2.Paths, MaintainPaths=True)
dedomain = DeconstructDomain(Domain=debox.X)  # -> Start, End
dedomain_2 = DeconstructDomain(Domain=debox.Y)  # -> Start, End
subtraction = Subtraction(A=dedomain.End, B=dedomain.Start)
subtraction_2 = Subtraction(A=dedomain_2.End, B=dedomain_2.Start)
max = Maximum(A=subtraction, B=subtraction_2)
division = Division(A=max, B="2")
offset_3 = Data(offset_2)
division_2 = Division(A=division, B=offset_3)
inner_infill_base_crvs = Curve(inner_infill_base_curves_2)
round = Round(Number=division_2)  # -> Nearest, Floor, Ceiling
series = Series(Start=offset_3, Step=offset_3, Count=round.Ceiling)
null_2 = NullItem(Item=flatten(inner_infill_base_crvs))  # -> NullFlags, InvalidFlags, Description
pshift_2 = ShiftPaths(Data=series, Offset=-1)
comments_notes_2 = Panel("create infill offsets")
or_2 = GateOr(A=null_2.NullFlags, B=null_2.InvalidFlags)
c2offset = Clipper2Offset(Polylines=infill_basecrvs_merged, Distance=pshift_2, JoinType=1, EndType=4, MiterLimit=2, Precision=6)  # -> Holes, Outer, ClipperPaths
ma_2 = MassAddition(Input=or_2)  # -> Result, PartialResults
pshift_3 = ShiftPaths(Data=c2offset.Holes, Offset=-1)
pshift_4 = ShiftPaths(Data=c2offset.Outer, Offset=-1)
bool_2 = Boolean(invert(ma_2.Result))
inner_infill_base_crvs_2 = Curve(inner_infill_base_curves_2)

# ----
# comments & notes: sort crvs in inner and outer
infill_basecrvs_merged_2 = Curve(infill_basecrvs_merged)
boundary = BoundarySurfaces(Edges=infill_basecrvs_merged_2)
inneroutercurves = CSharpScript(SliceSurfaces=boundary)  # -> InnerCurves, OuterCurves; inputs SliceSurfaces: tree of Brep
# ---------- inneroutercurves: C# ----------
// Grasshopper Script Instance
#region Usings
using System;
using System.Linq;
using System.Collections;
using System.Collections.Generic;
using System.Drawing;

using Rhino;
using Rhino.Geometry;

using Grasshopper;
using Grasshopper.Kernel;
using Grasshopper.Kernel.Data;
using Grasshopper.Kernel.Types;
#endregion

public class Script_Instance : GH_ScriptInstance
{
    #region Notes
    /* 
      Members:
        RhinoDoc RhinoDocument
        GH_Document GrasshopperDocument
        IGH_Component Component
        int Iteration

      Methods (Virtual & overridable):
        Print(string text)
        Print(string format, params object[] args)
        Reflect(object obj)
        Reflect(object obj, string method_name)
    */
    #endregion

    private void RunScript(
		DataTree<Brep> SliceSurfaces,
		ref object InnerCurves,
		ref object OuterCurves)
    {

        DataTree<Curve> iLoops = new DataTree<Curve>();
        DataTree<Curve> oLoops = new DataTree<Curve>();
        List<Brep> Breps;
        for (int i = 0; i < SliceSurfaces.BranchCount; i++)
        {
            Breps = SliceSurfaces.Branches[i];
            for (int j = 0; j < Breps.Count; j++)
            {
                int fc = Breps[j].Faces.Count;
                for (int k = 0; k < fc; k++)
                {
                    BrepFace bface = Breps[j].Faces[k];
                    int iCount = 0;
                    foreach (BrepLoop floop in bface.Loops)
                    {
                        if (floop.LoopType == BrepLoopType.Inner)
                        {
                            iLoops.Add(floop.To3dCurve(), SliceSurfaces.Paths[i]);
                        }
                        else if (floop.LoopType == BrepLoopType.Outer)
                        {
                            oLoops.Add(floop.To3dCurve(), SliceSurfaces.Paths[i]);
                        }
                    }
                }
            }
        }
        InnerCurves = iLoops;
        OuterCurves = oLoops;
    }
}
# ---------- end inneroutercurves ----------
pcen = PolygonCenter(Polyline=inneroutercurves.InnerCurves)  # -> CenterV, CenterE, CenterA
pcen_2 = PolygonCenter(Polyline=inneroutercurves.OuterCurves)  # -> CenterV, CenterE, CenterA
Z = UnitZ(Factor=1)
pl = PlaneNormal(Origin=pcen_2.CenterA, ZAxis=Z)
pl_2 = PlaneNormal(Origin=pcen.CenterV, ZAxis=Z)
crvensureccw = GhPythonScript(Crv=inneroutercurves.InnerCurves, Pln=pl_2)  # -> CCWCrv; inputs Crv: Curve, Pln: Plane
# ---------- crvensureccw: Python ----------
__author__ = "Max Eschenbach"
__version__ = "2022.05.19"

import Rhino
import Grasshopper

if Crv and Pln:
    if Crv.ClosedCurveOrientation(Pln) == Rhino.Geometry.CurveOrientation.Clockwise:
        Crv.Reverse()
    CCWCrv = Crv
else:
    CCWCrv = Grasshopper.DataTree[object]()
# ---------- end crvensureccw ----------
crvensureccw_2 = GhPythonScript(Crv=inneroutercurves.OuterCurves, Pln=pl)  # -> CCWCrv; inputs Crv: Curve, Pln: Plane; same code as crvensureccw
clean = CleanTree(RemoveNulls=True, RemoveInvalid=True, RemoveEmpty=False, Tree=crvensureccw)
outercrvs = Curve(crvensureccw_2)
innercrvs = Curve(clean)

trim = TrimWithRegions(Curve=pshift_4, Regions=outer_infill_base_curves_3)  # -> Inside, Outside
pshift_5 = ShiftPaths(Data=trim.Inside, Offset=-1)
trim_2 = TrimWithRegions(Curve=pshift_3, Regions=pshift_5)  # -> Inside, Outside
pshift_6 = ShiftPaths(Data=trim_2.Outside, Offset=-1)
merge = Merge(Data1=pshift_6, Data2=pshift_5)

null_3 = NullItem(Item=pshift_5)  # -> flatten(NullFlags), flatten(InvalidFlags), Description
ma_3 = MassAddition(Input=null_3.InvalidFlags)  # -> Result, PartialResults
larger = LargerThan(FirstNumber=ma_3.Result, SecondNumber="0")  # -> LargerThan, OrEqualTo
not = GateNot(A=larger.LargerThan)

and = GateAnd(A=bool_2, B=not)
filter_2 = StreamFilter(Gate=and, Stream0=pshift_3, Stream1=merge)

project_2 = Project(Geometry=filter_2, Plane=branch_2)  # -> reverse(Geometry), Transform
gate = StreamGate(Stream=project_2.Geometry, Gate=bool_2)  # -> Target0, Target1
trim_3 = TrimWithRegions(Curve=gate.Target1, Regions=inner_infill_base_crvs_2)  # -> Inside, Outside
pshift_7 = ShiftPaths(Data=trim_3.Outside, Offset=-1)
filter_3 = StreamFilter(Gate=bool_2, Stream0=gate.Target0, Stream1=pshift_7)
merge_2 = Merge(Data1=innercrvs, Data2=filter_3, Data3=outercrvs)
infill_curves = Curve(merge_2)

infill_curves_2 = ClusterOutput(infill_curves)

# ==== cluster ConfigSetting: If an individual specific setting is input in S, it will be returned. Otherwise the config (C) setting, matching the input ID will be passed. The ID is an integer matching the branch number of the desired setting. The returned setting will have the data structure matching the input ID. Is anything other than a Xylinus Config is input to C, that data will simply be passed to S.
config = ClusterInput()
setting_number = ClusterInput()  # input an integer matching the branch number of the desired setting.
data = Data(config)
int = Integer(setting_number)

# ---- group: is it a config?
branch = TreeBranch(Tree=data, Path="{0}", MaintainPaths=True)
tmatch = MatchText(Text=branch, RegEx="config", Case=False)
int_2 = Integer(tmatch)
null = NullItem(Item=int_2)  # -> NullFlags, InvalidFlags, Description
filter = StreamFilter(Gate=null.NullFlags, Stream0=int_2, Stream1=0)

# ----
path = ConstructPath(Indices=int)

# ---- group: if so, pull the requested setting
branch_2 = TreeBranch(Tree=data, Path=path, MaintainPaths=True)

# ---- group: otherwise, just pass the input data
filter_2 = StreamFilter(Gate=filter, Stream0=data, Stream1=branch_2)
data_2 = Data(filter_2)

# ---- group: if something is passed in the Setting, use that value.
setting = ClusterInput()  # Individual specific setting. Will override the config setting.
data_3 = Data(setting)
null_coalescing = NullCoalescing(primary_data=data_3, secondary_data=data_2)

# ---- group: make the data structure match what is expected from the input
replace = ReplacePaths(Data=flatten(null_coalescing), Search="{0}", Replace=path)
setting_2 = ClusterOutput(replace)

# ==== cluster TrimTo: Trim the branches of a tree to a target length.
branch_depth = ClusterInput()  # The target branch depth. A flat terr is 0. {0} is one. {0;0} is two. etc.
data_to_trim = ClusterInput()
int = Integer(branch_depth)
data = Data(data_to_trim)
tstat = TreeStatistics(Tree=data)  # -> Paths, Length, Count
F = ClusterInput()
trim_front = Boolean(F)
split = TextSplit(Text=tstat.Paths, Separators="{;}")
empty = Text("")
mindex = MemberIndex(Set=split, Member=empty)  # -> Index, Count
cull_i = CullIndex(List=split, Indices=mindex.Index, Wrap=True)
dom = ConstructDomain(DomainStart=0, DomainEnd=expr("x-1", int))

lng = ListLength(List=cull_i)
subtraction = Subtraction(A=lng, B=int)

max = Maximum(A=0, B=subtraction)

dom_2 = ConstructDomain(DomainStart=max, DomainEnd=expr("x-1", lng))

filter = StreamFilter(Gate=trim_front, Stream0=dom, Stream1=dom_2)
subset = SubList(List=cull_i, Domain=filter, Wrap=False)  # -> List, Index
path = ConstructPath(Indices=subset.List)  # -> flatten(Branch)
replace = ReplacePaths(Data=data, Search=tstat.Paths, Replace=path)
D = ClusterOutput(replace)

# ==== cluster NullCoalescing: Passes the primary data input, unless it is null. In which case it passes the secondary data input to the output. (Like the ?? operator in C#)
primary_data = ClusterInput()  # If this input is not null, it will be passed tot he output.
secondary_data = ClusterInput()  # If the input to the primary data is null, this will be passed to the output.
data = Data(primary_data)
data_2 = Data(secondary_data)
null = NullItem(Item=data)  # -> NullFlags, InvalidFlags, Description
filter = StreamFilter(Gate=null.NullFlags, Stream0=data, Stream1=data_2)
data_3 = Data(filter)
data_4 = ClusterOutput(data_3)
