# Grasshopper definition 250517_DDU_Clay3DPrinting_Slicer.gh (Grasshopper 1.0.8)
# Copyright: Use it.  Mod it.  Share it. Just please give credit and kepp this party going.
# Copyright: Use it.  Mod it.  Share it. Just please give credit and keep this party going.
# plug-ins: Clipper2

# ----
# LEGEND
comments_notes = Panel("USER INTERACTION")
comments_notes_2 = Panel("GEOMETRY PROCESSING")
# EXPERIMENTAL SLICER SETUP FOR CLAY PRINTING: Author: Max Benjamin Eschenbach
# Contributors: Mirko Dutschke, Iyad Ghazal
# 
# Digital Design Unit (DDU)
# Prof. Dr.-Ing. Oliver Tessmann
# Fachbereich Architektur
# Technical University of Darmstadt
# 
# 
# CREDITS:
# ------------
# - Original GCODE Generator Script by Tom Svilans (CITA Copenhagen); adapted by Max Benjamin Eschenbach, 2023
# 
# - Original Heat Method Script by Daniel Piker ([McNeel Discourse Link](https://discourse.mcneel.com/t/heat-method/105135)); adapted for Non-Planar Slicing by Max Benjamin Eschenbach, 2023
# 
# - Original "DefinitionDependencies" GhPython Component by Anders Holden Deleuran; adapted by Max Benjamin Eschenbach, 2025
# 
# - Original "ViewCaptureToFile" GhPython Component by Anders Holden Deleuran; adapted by Max Benjamin Eschenbach, 2025
# 
# - "MeshPipeChromo" C# Component for fast mesh piping by Cameron Newnham ([Chromodoris Plugin](https://github.com/camnewnham/ChromodorisGH)), Copyright 2015-2016; Licensed and distributed under GNU GPL
# 
# - The definition uses some Components taken from [Xylinus](https://www.food4rhino.com/en/app/xylinus-novel-control-3d-printing#) by Ryan Hoover (Independent Studio / MICA dFab / BUGSS)
comments_notes_3 = Panel("VISUALISATION")
comments_notes_4 = Panel("OUTPUT")
comments_notes_5 = Panel("ANALYSIS")
comments_notes_6 = Panel("CONTROL FLOW")
comments_notes_7 = Panel("ADVANCED FEATURE")
comments_notes_8 = Panel("DO NOT TOUCH")
comments_notes_9 = Panel("WALL CURVES")
comments_notes_10 = Panel("FLOOR INFILL")
comments_notes_11 = Panel("SPARSE INFILL")
comments_notes_12 = Panel("CAP INFILL")

# ----
# DEPENDENCIES
# (PLUGINS USED)
plugins = BooleanToggle(False)
definitiondependencies = DefinitionDependencies(Toggle=plugins)  # -> Core, AddOns; inputs Toggle: Boolean
# ---------- definitiondependencies: C# ----------
#region Usings
using System;
using System.Linq;
using System.Collections;
using System.Collections.Generic;
using System.Drawing;

using Rhino;
using Rhino.Geometry;

using Grasshopper;
using Grasshopper.Kernel;
using Grasshopper.Kernel.Data;
using Grasshopper.Kernel.Types;
#endregion

public class Script_Instance : GH_ScriptInstance
{
    #region Notes
    /* 
      Members:
        RhinoDoc RhinoDocument
        GH_Document GrasshopperDocument
        IGH_Component Component
        int Iteration

      Methods (Virtual & overridable):
        Print(string text)
        Print(string format, params object[] args)
        Reflect(object obj)
        Reflect(object obj, string method_name)

    Author: Giulio Piacentino (updated by Anders Holden Deleuran)
    Updated 2025 by Max Benjamin Eschenbach
    License: Apache License 2.0
    Version: 250307
    */
    #endregion

    private void RunScript(bool Toggle, ref object Core, ref object AddOns)
    {   
        // set component params
        this.Component.Name = "DefinitionDependencies";
        this.Component.NickName = "DefinitionDependencies";
        this.Component.Category = "DDUClayPrintingSlicer";
        this.Component.SubCategory = "0 Development";

        List<string> coreLibs = new List<string>();
        List<string> addLibs = new List<string>();
        if (Toggle)
        {
            Dictionary<string, GH_AssemblyInfo> coreLibraries = new Dictionary<string, GH_AssemblyInfo>();
            Dictionary<string, GH_AssemblyInfo> addonLibraries = new Dictionary<string, GH_AssemblyInfo>();
            Dictionary<string, string> objids = new Dictionary<string, string>();
            GH_ComponentServer server = Grasshopper.Instances.ComponentServer;
            foreach (GH_DocumentObject obj in this.Component.OnPingDocument().Objects)
            {
                if (obj == (GH_DocumentObject) this.Component)
                {
                    continue;
                }
                string objid = obj.ComponentGuid.ToString();
                if (objids.ContainsKey(objid)) continue;
                GH_AssemblyInfo lib = server.FindAssemblyByObject(obj);
                if (lib == null) continue;
                if (coreLibraries.ContainsKey(lib.Id.ToString()) | addonLibraries.ContainsKey(lib.Id.ToString())) continue;
                if (lib.IsCoreLibrary) coreLibraries.Add(lib.Id.ToString(), lib);
                else addonLibraries.Add(lib.Id.ToString(), lib);
            }
            foreach(KeyValuePair<string, GH_AssemblyInfo> entry in coreLibraries)
            {
                coreLibs.Add($"{entry.Value.Name} {entry.Value.Version}");
            }
            foreach(KeyValuePair<string, GH_AssemblyInfo> entry in addonLibraries)
            {
                addLibs.Add($"{entry.Value.Name} {entry.Value.Version}");
            }
        }
        Core = coreLibs;
        AddOns = addLibs;
    }
}
# ---------- end definitiondependencies ----------
grasshoppe_core_libraries = Panel(definitiondependencies.Core)
addon_libraries = Panel(definitiondependencies.AddOns)

# ----
# SAVE GHX-COPY OF CURRENT DOCUMENT
# comments & notes: Save this File and aso save a .GHX copy of the file to the same folder as this file resides in.
# --> Please use this before pushing a new version to GitHub to make the changes somehow "trackable"
autosave_gh_and_ghx = Trigger(Interval=10000, TimerInterval=10000, Target=autosave)  # disabled
autosave = BooleanToggle(True)  # disabled
save = Button()
or = GateOr(A=save, B=autosave)
saveandsaveghx = SaveAndSaveGHX(Save=or, ArchiveFolder="00_archive")  # -> Message; inputs Save: Boolean, ArchiveFolder: String
# ---------- saveandsaveghx: C# ----------
#region Usings
using System;
using System.IO;
using System.Linq;
using System.Collections;
using System.Collections.Generic;
using System.Drawing;

using Rhino;
using Rhino.Geometry;

using Grasshopper;
using Grasshopper.Kernel;
using Grasshopper.Kernel.Data;
using Grasshopper.Kernel.Types;
#endregion

public class Script_Instance : GH_ScriptInstance
{
    #region Notes
    /* 
      Members:
        RhinoDoc RhinoDocument
        GH_Document GrasshopperDocument
        IGH_Component Component
        int Iteration

      Methods (Virtual & overridable):
        Print(string text)
        Print(string format, params object[] args)
        Reflect(object obj)
        Reflect(object obj, string method_name)

    Author: Max Eschenbach
    License: MIT License
    Version: 250312
    */
    #endregion

    private void RunScript(bool Save, string ArchiveFolder, ref object Message)
    {
        // set component params
        this.Component.Name = "SaveAndSaveGHX";
        this.Component.NickName = "SaveAndSaveGHX";
        this.Component.Category = "DDUClayPrintingSlicer";
        this.Component.SubCategory = "0 Development";

        // This output will tell us if the save succeeded or failed.
        // The active Grasshopper document in this scripting component context

        DataTree<string> msgOut = new DataTree<string>();
        GH_Path ghp = new GH_Path(0, 1);

        if (!Save)
        {
            return;
        }

        GH_Document doc = this.GrasshopperDocument;
        if (doc == null)
        {
            msgOut.Add("Error: GrasshopperDocument is null", ghp);
            return;
        }

        // Set current and archive filepath
        string originalFilePath = doc.FilePath;
        string ghxFilePath = originalFilePath + "x";
        string archivePath = Path.Combine(Path.GetDirectoryName(ghxFilePath), ArchiveFolder);
        string archiveFilePath = Path.Combine(archivePath, DateTime.Now.ToString("yyMMdd") + "_" + Path.GetFileName(originalFilePath));

        // Only attempt to save when 'saveTrigger' is set to true.
        if (!Save) return;
        
        // Make sure the parent directory exists
        if (!Directory.Exists(Path.GetDirectoryName(ghxFilePath)))
        {
            msgOut.Add("Error: directory does not exist", ghp);
            return;
        }

        // Make sure Archive Directory exists
        // Make sure the parent directory exists
        
        if (!Directory.Exists(Path.GetDirectoryName(archivePath)))
        {
            msgOut.Add("Error: Archive directory does not exist", ghp);
            return;
        }

        // Create a GH_DocumentIO object based on our current GH_Document.
        GH_DocumentIO io = new GH_DocumentIO(doc);
        // Save this document
        io.Save();

        // Write the current document to an XML-based .ghx file
        bool success_a = io.SaveQuiet(ghxFilePath);
        bool success_b = io.SaveQuiet(originalFilePath);
        bool success_c = io.SaveQuiet(archiveFilePath);

        if (success_a & success_b & success_c)
            msgOut.Add($"Files saved successfully:\n{ghxFilePath}\n{archiveFilePath}", ghp);
        else
        {
            if (!success_a)
                msgOut.Add($"Error: failed to save .ghx file:\n{ghxFilePath}", ghp);
            if (!success_c)
                msgOut.Add($"Error: failed to save Archive .gh file:\n{archiveFilePath}", ghp);
        }
        Message = msgOut;
    }
}
# ---------- end saveandsaveghx ----------
panel = Panel(saveandsaveghx)

# ----
# ANALYSIS TOOLS
# comments & notes: OVERHANG_ANGLE_ANALYSIS: If set to True, will display overhang angle analysis.
# 
# OVERHANG_OFFSET_ANALYSIS: If set to True, will display overhang offset analysis.
# 
# OVERHANG_ANALYSIS_RESOLUTION: This sets the resolution of the sampling of each layer.
# NOTE: Applies to BOTH (!) OVERHANG analyses!
# 
# ANGLE_ANALYSIS_THRESHOLD (DEGR): Sets the angle threshold (in degrees!) after which the overhang angle analysis will turn red.
# 
# OFFSET_ANALYSIS_THRESHOLD (mm): Sets the distance threshold (in millimeters) after which the overhang offset analysis will turn red.
# 
# OVERHANG_OFFSET_MAXDIST: Will filter out "false positive" offset distances that result from weird plane intersections.
# NOTE: Set this to approximately 3 * LINE_WIDTH.
# comments & notes: LAYER_HEIGHT_ANALYSIS: If set to True, will display layer height analysis. This can be used (especially when NP-Slicing) to identify and check compressed/expanded layers.
overhang_angle_analysis = BooleanToggle(False)
angle_analysis_threshold_degr = Slider(30, range=0..90)
overhang_analysis_resolution = Slider(50, range=0..100)
layer_height_analysis = BooleanToggle(False)

overhang_offset_analysis = BooleanToggle(False)
offset_analysis_threshold_mm = Slider(1.6, range=1..50)
overhang_offset_maxdist = Slider(6, range=1..50)

# ----
# SEAM ADJUSTMENT
# comments & notes: BYPASS_SEAM_ADJUSTMENT: Will turn off any seam adjustment or randomization in this step.
# 
# ADJUST_SEAM: Normalized Curve Parameter to adjust the seam to.
# comments & notes: RANDOMIZE_SEAM: Randomizes the seam in every layer. NOT recommended!
# 
# RND_SEAM_SEED: The seed value for seam randomization.
bypass_seam_adjustment = BooleanToggle(False)
adjust_seam = Slider(0, range=0..1)
randomize_seam = BooleanToggle(False)
rnd_seam_seed = Slider(15766, range=0..99999)

# ----
# comments & notes: SLICE_MAKE_CLOSED_TOLERANCE: Sometimes you end up with open slice curves where just a tiny fraction of the curve is missing. Thi sproduces garbage down the road. Use this slider to brute-force-close slice curves with a gap below this tolerance.
# If set to 0 is out of effect!
slice_make_closed_tolerance = Slider(0.25, range=0..2)

# ----
# BASIC SLICING
# comments & notes: LAYER_HEIGHT: Controls the layer height of the print. For a 4mm Nozzle should be set to 1.9 mm for best results. You can modify it to create over/undercompressed layers on purpose.
# 
# LINE_WIDTH: Should be set exactly to the width of the nozzle. So 4mm for a 4mm nozzle.
# comments & notes: SKIRT_OFFSET: The distance between the skirt and the actual print in mm. (Recommendation is to leave it like this).
layer_height = Slider(1.9, range=0.1..5)
line_width = Slider(4, range=0.1..10)
skirt_offset = Slider(15, range=0..100)

# ----
# BASIC INFILL SETTINGS
# (APPLY TO ALL INFILLS)
# comments & notes: INFILL_FILLET_RADIUS: All infill geometry will be filleted with this radius to accelerate printing time.
# 
# INFILL_INFILL_OVERLAP: Amount in mm that printed infill should overlap with other infill to make the bond really (water-)tight.
# 
# INFILL_WALL_OVERLAP: Amount in mm that printed infill should overlap with the wall/perimeter of the layer to make the bond really (water-)tight.
# comments & notes: PRINT_INFILL_BEFORE_WALLS: If set to True, infill geometry will be printed before printing the perimeter.
print_infill_before_walls = BooleanToggle(False)
infill_infill_overlap = Slider(0.1, range=0..1)
infill_fillet_radius = Slider(0.2, range=0..10)
infill_wall_overlap = Slider(0.2, range=0..1)

# ----
# DEPENDENCIES: DEPENDENCIES:
# 
# - Clipper2GH Components
#   https://www.food4rhino.com/en/app/clipper2gh
# SETTINGS
comments_notes_13 = Panel("SETTINGS")

# ----
# SPIRALIZATION
# SETTINGS
# comments & notes: SPIRALIZE_CONTOURS: If set to True, will create a continuous spiralized curve that connects all individual layers. This is only possible if the object is NOT branching!
# 
# MIRKOS_SPIRALIZATION: Special spiralization mode by Mirko Dutschke that does not interpolate XY values, works better for some geometries. The setting is additional!
# comments & notes: SPIRAL_RESOLUTION: Controls the resolution of the layer sampling during spiralization. (To successfully interpolate, all layer curves are sampled to this number of points.)
# 
# SPIRAL_RAMP_PERCENTAGE: Controls the percentage of interpolation. For example 100% will result in every layer being fully interpolated with its next layer. 10% will result in a "ramp" at the end of each layer that transitions to the next layer with 10% of curve length.
# comments & notes: SPIRAL_INTRO: Controls the amount of the first layer that is printed without interpolating Z-values. This is used to avoid adherence issues.
# TIP: Only dial this up if SPIRAL_RAMP_PERCENTAGE is set to high values (e.g. 75%), otherwise you will get a lumping of material.
# 
# SPIRAL_OUTRO: Controls the amount of the LAST layer that is printed without interpolating Z-values to smooth out the spiralization path.
spiral_ramp_percentage = Slider(25, range=0.01..100)
spiral_resolution = Slider(800, range=10..1000)
spiral_intro = Slider(0.05, range=0..0.95)
spiral_outro = Slider(0.8, range=0..1)
mirkos_spiralization = BooleanToggle(False)
spiralize_contours = BooleanToggle(False)

# ----
# DO NOT CHANGE THIS!
wasp_40100_printing_diameter = Slider(400, range=0..1000)
wasp40100_arm_length = Slider(350, range=0..1500)

# ----
# FLOOR INFILL
# SETTINGS
# comments & notes: ADD_FLOOR_TO_OPEN_OBJECTS: If set to True, will synthesize floor layers (according to set count) for open meshes/breps. Also works with NP-slicing.
# 
# SYNTHESIZE_FLOOR_FOR_CUSTOM_CURVES: If set to True, will try to synthesize floor layers (according to set count) from custom curve input.
# This is separate from the open object setting!
add_floor_to_open_objects = BooleanToggle(False)
synthesize_floor_for_custom_curves = BooleanToggle(False)
floor_type = Slider(0, range=0..1)
floor_layer_count = Slider(2, range=0..10)
infill_types = Panel("""0 = CRISS-CROSS
1 = OFFSET""")

# ----
# OTHER VIZ SETTINGS
leader_text_size = Slider(8, range=0..10)
leader_curve_weight = Slider(1, range=0..10)

# ----
# VISUALIZATION
# SETTINGS
# comments & notes: ENABLE_HEADS_UP_DISPLAY: If set to True, will display a HUD with info messages and data regarding the slicing process. RECOMMENDED!
# comments & notes: RENDER_PRINT_GEOMETRY: Will visualize the (input) print geometry after preprocessing is done.
# 
# RENDER_SHARP_FEATURES: Will render the sharp features of the incoming printing geometry in RED.
# comments & notes: RENDER_LAYER_CURVES: Will visualize the slice layers as curves.
# 
# SHOW_SEAM_POINTS: Will visualize the seam points. Useful for adjusting the seam.
# comments & notes: RENDER_PRINT_LAYERS: Will render the print layers in 3D as mesh-pipes.
# 
# HD_LAYER_VISUALISATION: If this is set to True, the meshing quality of the visualization will be more accurate.
enable_heads_up_display = BooleanToggle(True)
render_print_geometry = BooleanToggle(True)
render_sharp_features = BooleanToggle(False)
render_layer_curves = BooleanToggle(True)
show_seam_points = BooleanToggle(True)
render_print_layers = BooleanToggle(True)
hd_layer_visualisation = BooleanToggle(True)

# ----
# INPUT & GEOMETRY PIPELINE
# comments & notes: DYNAMIC_UPADTE: If set to 'True', will listen for changes in the Rhino document while a layer set is referenced.
# 
# CREATE_AND_REFERENCE: If clicked, will create a new timestamped layer set and reference it.
# 
# LOAD_AND_REFERENCE: If clicked, will try to load a previously created layer set (wherever the tick mark in the Rhino layer window is!).
dynamic_upadte = BooleanToggle(False)
create_and_reference = Button()
load_and_reference = Button()

# ----
# TRI-REMESHING
# comments & notes: TRI_REMESH: Will try to convert any input geometry to a homogeneous triangle mesh.
# 
# TRM_EDGE_LENGTH: Sets the desired edge length of each triangle for the remeshing process.
# 
# TRM_PRESERVE_SHARP_FEATURES: If set to 'True', will try to preserve sharp features (creases, pointy edges) during the remeshing process.
# comments & notes: TRM_ADDITIONAL_SHARP_FEATURES: If set to True, will try to identify additional sharp features based on the set angle threshold.
# 
# TRM_ADDSHARP_ANGLE_THRESHOLD: Sets the angle for additional sharp feature classification.
trm_addsharp_angle_threshold = Slider(60, range=0..90)
trm_additional_sharp_features = BooleanToggle(False)
tri_remesh = BooleanToggle(False)
trm_preserve_sharp_features = BooleanToggle(False)
trm_edge_length = Slider(3, range=0..100)

# ----
# BACK-FORTH ON
# OPEN CURVES
# comments & notes: ENABLE_BACK_FORTH_ON_OPEN_CURVES: If set to True, will try to print OPEN CURVES at the top of the model in a "back-and-forth" logic as an alternative to spiralization.
# 
# NOTE: This will only work if there is only one open curve per layer!
enable_back_forth_on_open_curves = BooleanToggle(False)

dduclayprintingslicer_icon_path = Panel("..\resources\250317_DDU_ClayPrintingSlicer_ComponentIcon_24x24.jpg")

# ----
# SCRIPT SOURCE & USROBJ EXPORT
dduclayprintingslicer_source_folder = Panel("..\grasshopper_userobjects_src")
dduclayprintingslicer_userobjects_folder = Panel("..\grasshopper_userobjects")
exportscriptsandsource = ExportScriptsAndSource(
    RunComponentAnalysis=Toggle(False),
    ExportUserObjectsAndSource=Toggle(False),
    Category="DDUClayPrintingSlicer",
    UserObjFolder=dduclayprintingslicer_userobjects_folder,
    SourceFolder=dduclayprintingslicer_source_folder,
    IconPath=dduclayprintingslicer_icon_path)  # -> out, OldScriptsDebug, CategoryDebug, VersionDebug, InfoMessages; inputs RunComponentAnalysis: Boolean, ExportUserObjectsAndSource: Boolean, Category: String, IconPath: String
# ---------- exportscriptsandsource: Python ----------
import System
import Rhino
import Grasshopper

import os
from pprint import pprint

import GhPython as ghpy
import ScriptComponents as scomp
import RhinoCodePluginGH as rcpgh

# GHENV COMPONENT SETTINGS
ghenv.Component.Name = "ExportScriptsAndSource"
ghenv.Component.NickName = "ExportScriptsAndSource"
ghenv.Component.Category = "DDUClayPrintingSlicer"
ghenv.Component.SubCategory = "0 Development"


class ExportScriptsAndSource(Grasshopper.Kernel.GH_ScriptInstance):
    """
    Author: Max Benjamin Eschenbach (based on a Python Script by Anders Holden Deleuran)
    License: MIT License
    Version: 250415
    """

    def get_source_version(self, source):
        """
        Attempts to get the first instance of the word "version" (or, "Version")
        in a multi line string. Then attempts to extract an integer from this line
        where the word "version" exists. So format version YYMMDD in the
        docstring like so (or any other integer system):
            Version: 160121
        """
        # Get first line with version in it
        src_lower = source.lower()
        version_str = [ln for ln in src_lower.split('\n') if "version" in ln]
        if version_str:
            # Get the first substring integer and return it
            version_int = [int(s) for s in version_str[0].split() if s.isdigit()]
            if version_int:
                return int(version_int[0])
        else:
            return None

    def process_document_objects(self, ghdocument, verbose=False):
        """
        Processes GH_Document object and return a list of all script components
        """
        # get all document objects
        comps = list(ghdocument.Objects)

        # types of python components
        ghpycomp = ghpy.Component.ZuiPythonComponent
        ipycomp = rcpgh.Components.IronPython2Component
        py3comp = rcpgh.Components.Python3Component

        # types of csharp components
        cscomp = scomp.Component_CSNET_Script
        cs9comp = rcpgh.Components.CSharpComponent

        # cluster component
        clustercomp = Grasshopper.Kernel.Special.GH_Cluster

        # extract component type strings
        ghpycomp_str = str(ghpycomp).split("'")[1]
        cscomp_str = str(cscomp).split("'")[1]
        ipycomp_str = str(ipycomp).split("'")[1]
        py3comp_str = str(py3comp).split("'")[1]
        cs9comp_str = str(cs9comp).split("'")[1]
        clustercomp_str = str(clustercomp).split("'")[1]

        # define script types
        id_ghpycomp = 'GHPY'
        id_cscomp = 'CS'
        id_ipycomp = 'IPY2'
        id_py3comp = 'PY3'
        id_cs9comp = 'CS9'

        # init dict for script component storage
        script_components = {}

        # loop over all document components
        # store all component objects in a dictionary to check
        # - are all "same" scripts the same code?
        # - are there scripts without category or version attribute?
        # - separate old from new scripts, dont export old scripts!
        for obj in comps:
            # extract basic info
            name = obj.Name
            nickname = obj.NickName
            iguid = str(obj.InstanceGuid)
            # extract type string
            objtype_str = str(obj.GetType())
            # OLD GHPYTHON COMPONENT
            if objtype_str == ghpycomp_str:
                source = obj.Code
                if source:
                    print(f'Found Source for OLD GHPY Component "{nickname}" ({iguid})') if verbose else None
                    scriptcomp = [id_ghpycomp, nickname, name, obj, source]
                    script_components[iguid] = scriptcomp
            # OLD C# COMPONENT
            elif objtype_str == cscomp_str:
                source = obj.ScriptSource.ScriptCode
                if source:
                    print(f'Found Source for OLD CS Component "{nickname}" ({iguid})') if verbose else None
                    scriptcomp = [id_cscomp, nickname, name, obj, source]
                    script_components[iguid] = scriptcomp
            # NEW C#9 COMPONENT
            elif objtype_str == cs9comp_str:
                bres, source = obj.TryGetSource()
                if bres:
                    print(f'Found Source for CS9 Component "{nickname}" ({iguid})') if verbose else None
                    scriptcomp = [id_cs9comp, nickname, name, obj, source]
                    script_components[iguid] = scriptcomp
            # NEW IRONPYTHON COMPONENT
            elif objtype_str == ipycomp_str:
                bres, source = obj.TryGetSource()
                if bres:
                    print(f'Found Source for IPY2 Component "{nickname}" ({iguid})') if verbose else None
                    scriptcomp = [id_ipycomp, nickname, name, obj, source]
                    script_components[iguid] = scriptcomp
            # NEW PYTHON3 COMPONENT
            elif objtype_str == py3comp_str:
                bres, source = obj.TryGetSource()
                if bres:
                    print(f'Found Source for PY3 Component "{nickname}" ({iguid})') if verbose else None
                    scriptcomp = [id_py3comp, nickname, name, obj, source]
                    script_components[iguid] = scriptcomp
            # CLUSTER COMPONENT
            elif objtype_str == clustercomp_str:
                # RECURSIVELY STEP THROUGH CLUSTERS AND LOOK FOR SCRIPTS AGAIN...
                print(f'Processing CLUSTER "{nickname}" ({name}, {iguid}) ...') if verbose else None
                cluster_scripts = self.process_document_objects(obj.Document(''), verbose=verbose)
                # add cluster script dict to main dict
                script_components.update(cluster_scripts)

        return script_components

    def process_script_components(self, script_components: dict, set_category: str):
        """
        Process found script components and get unique components.
        """
        unique_script_components = {}

        OldScriptsDebug = []
        CategoryDebug = []
        VersionDebug = []
        InfoMessages = []

        for iguid, values in script_components.items():
            script_type, nickname, name, obj, source = values
            category = obj.Category
            version = self.get_source_version(source)
            script_id = nickname + ' ' + name
            # NOT SEEN YET SCRIPT COMPONENTS
            if script_id not in unique_script_components:
                if script_type == 'GHPY':
                    OldScriptsDebug.append(f'{script_type} - {nickname} ({name})')
                    OldScriptsDebug.append('    - IS AN OLD GHPYTHON SCRIPT!')
                elif script_type == 'CS':
                    OldScriptsDebug.append(f'{script_type} - {nickname} ({name})')
                    OldScriptsDebug.append('    - IS AN OLD C# SCRIPT!')
                if category != set_category:
                    if category == 'Maths':
                        CategoryDebug.append(f'{script_type} - {nickname} ({name})')
                        CategoryDebug.append(f'    - HAS NO CATEGORY ({category})!')
                    else:
                        CategoryDebug.append(f'{script_type} - {nickname} ({name})')
                        CategoryDebug.append(f'    - {category} OUT OF SET CATEGORY {set_category}!')
                if version is None:
                    VersionDebug.append(' '.join([script_type, nickname, name]))
                    VersionDebug.append('    - HAS NO VERSION!')
                else:
                    InfoMessages.append(f'{script_type} - {nickname} ({name})')
                    unique_script_components[script_id] = values
            # ALREADY SEEN SCRIPT COMPONENTS
            else:
                existing_obj = unique_script_components[script_id][3]
                existing_source = unique_script_components[script_id][4]
                existing_version = self.get_source_version(existing_source)
                if version is None:
                    VersionDebug.append(f'{script_type} - {nickname} ({name})')
                    VersionDebug.append('    - HAS NO VERSION!')
                elif existing_version is None and version is not None:
                    VersionDebug.append(f'{script_type} - {nickname} ({name})')
                    VersionDebug.append(f'    - VERSION {version} > ALREADY FOUND VERSION {existing_version}!')
                    # REPLACE FOUND "NONE" VERSION WITH NAMED VERSION!
                    raise
                elif version < existing_version:
                    VersionDebug.append(f'{script_type} - {nickname} ({name})')
                    VersionDebug.append(f'    - VERSION {version} < {existing_version}! Continuing...')
                    # REPLACE THE SOURCE OF THE LOWER VERSION WITH HIGHER VERSION SOURCE!
                    continue
                elif version > existing_version:
                    VersionDebug.append(f'{script_type} - {nickname} ({name})')
                    VersionDebug.append(f'    - VERSION {version} > ALREADY FOUND VERSION {existing_version}!')
                    # REPLACE THE OBJECT IN DICT WITH NEWER VERSION
                    raise
        return unique_script_components, OldScriptsDebug, CategoryDebug, VersionDebug, InfoMessages

    def export_scriptcomp_usrobj(self, scriptcomp, usrobjpath, iconpath=''):
        """
        Automates the creation of a GHPython user object. Based on this thread:
        http://www.grasshopper3d.com/forum/topics/change-the-default-values-for-userobject-popup-menu
        scriptcomp = [script_type, nickname, name, obj, source]
        """
        try:
            # Make a user object
            uo = Grasshopper.Kernel.GH_UserObject()
            # Get component object
            obj = scriptcomp[3]
            # Process icon
            if iconpath:
                obj.SetIconOverride(System.Drawing.Bitmap.FromFile(iconpath))
            uo.Icon = obj.Icon_24x24
            # Set its properties based on the GHPython component properties
            uo.BaseGuid = obj.ComponentGuid
            uo.Exposure = ghenv.Component.Exposure.primary
            uo.Description.Name = obj.Name
            uo.Description.Description = obj.Description
            uo.Description.Category = obj.Category
            uo.Description.SubCategory = obj.SubCategory
            # Set the user object data and save to file
            uo.SetDataFromObject(obj)
            uo.Path = os.path.join(usrobjpath, obj.Category + '_' + obj.Name + '.ghuser')
            uo.SaveToFile()
        except Exception as e:
            print(e)
            return False
        return True

    def export_scriptcomp_source(self, scriptcomp, srcpath):
        """
        Export the source code of a script component
        scriptcomp = [script_type, nickname, name, obj, source]
        """
        # Get code and lines of code
        script_type = scriptcomp[0]
        name = scriptcomp[2]
        obj = scriptcomp[3]
        source = scriptcomp[4]
        code = source.replace('\r', '')
        lines = code.splitlines()
        loc = len(lines)
        # Check/make source file folder
        srcpath = os.path.join(srcpath)
        if not os.path.isdir(srcpath):
            os.makedirs(srcpath)
        # Write code to file
        if script_type == 'PY3' or script_type == 'IPY2':
            ext = '.py'
        elif script_type == 'CS9':
            ext = '.cs'
        else:
            # DO NOT EXPORT OLD SCRIPTS!
            ext = None
        if ext:
            src_file = os.path.join(srcpath, obj.Category + '_' + name + ext)
            with open(src_file, 'w') as f:
                f.write(code)
        return loc

    def RunScript(self,
            RunComponentAnalysis: bool,
            ExportUserObjectsAndSource: bool,
            Category: str,
            UserObjFolder,
            SourceFolder,
            IconPath: str):
        # Init outputs
        OldScriptsDebug = Grasshopper.DataTree[object]()
        CategoryDebug = Grasshopper.DataTree[object]()
        VersionDebug = Grasshopper.DataTree[object]()
        InfoMessages = Grasshopper.DataTree[object]()

        # Iterate the canvas and get to the GHPython components
        grasshopper_document = ghenv.Component.OnPingDocument()
        gh_dir = os.path.dirname(grasshopper_document.FilePath)

        usrobjpath = os.path.normpath(os.path.abspath(os.path.join(gh_dir, UserObjFolder)))
        srcpath = os.path.normpath(os.path.abspath(os.path.join(gh_dir, SourceFolder)))
        iconpath = os.path.normpath(os.path.abspath(os.path.join(gh_dir, IconPath)))

        if RunComponentAnalysis:
            # loop over all objects on the grasshopper canvas
            # and identify the components to export scriptsource from
            script_components = self.process_document_objects(grasshopper_document, verbose=False)

            # - are all "same" scripts the same code?
            # - are there scripts without category or version attribute?
            # - separate old from new scripts, dont export old scripts!
            (unique_script_components,
             OldScriptsDebug,
             CategoryDebug,
             VersionDebug,
             InfoMessages) = self.process_script_components(script_components, Category)

        # HERE LOOP OVER UNIQUE COMPONENTS
        if ExportUserObjectsAndSource and RunComponentAnalysis:
            # - SAVE USEROBJECT
            # - SAVE SOURCE
            for script_id, scriptcomp in unique_script_components.items():
                loc = self.export_scriptcomp_source(scriptcomp, srcpath)
                res = self.export_scriptcomp_usrobj(scriptcomp, usrobjpath, iconpath)
                print(res, loc)
        elif ExportUserObjectsAndSource and not RunComponentAnalysis:
            rml = ghenv.Component.RuntimeMessageLevel.Warning
            ghenv.Component.AddRuntimeMessage(
                rml,
                'UserObjects and Source cannot be exported without running Component Analysis!')

        return OldScriptsDebug, CategoryDebug, VersionDebug, InfoMessages
# ---------- end exportscriptsandsource ----------
print_out = Panel(exportscriptsandsource.out)
oldscriptsdebug = Panel(exportscriptsandsource.OldScriptsDebug)
versiondebug = Panel(exportscriptsandsource.VersionDebug)
categorydebug = Panel(exportscriptsandsource.CategoryDebug)
infomessages = Panel(exportscriptsandsource.InfoMessages)

# ----
# CAP INFILL
# SETTINGS
infill_types_2 = Panel("""0 = CRISS-CROSS
1 = OFFSET""")
cap_type = Slider(0, range=0..1)
cap_layer_count = Slider(0, range=0..10)

# ----
# GCODE GENERATION,
# SIMULATION & EXPORT
# comments & notes: CREATE_GCODE: If set to True, will create GCODE for the currently processed geometry according to the settings.
# comments & notes: PAUSE_PRINT_AFTER_FLOOR: Will pause the print for a few seconds after printing the floor to enable correction of the floor layers by hand / sponging the floor with water to seal it.
# 
# FLOOR_PAUSE_TIME: Controls the puase time in seconds!
# comments & notes: ENABLE_PRINT_SIMULATION: If set to True, will visualize the printing process in 3D using mesh piping instead of only showing the rendered GCODE.
# 
# HD_PRINTING_VISUALISATION: If this is set to True, the meshing quality of the visualization will be more accurate.
# 
# SHOW_PRINTER: If set to True, show the extruder and simplified printer.
# 
# VIS_PRINTING_PROGRESS: Control up to which point the print should be shown. You can control the printing simulation using this slider.
# BONUS: Animate this slider to create an animation of the printing process!
# comments & notes: SAVE_GCODE_TO_FILE: Click this to open a SaveFile dialog and save your created GCODE to a file for transfer to the printer.
create_gcode = BooleanToggle(False)
pause_print_after_floor = BooleanToggle(True)
floor_pause_time_seconds = Slider(45, range=0..240)
enable_print_simulation = BooleanToggle(False)
hd_printing_visualisation = BooleanToggle(True)
show_printer = BooleanToggle(True)
vis_printing_progress = Slider(100, range=0..100)
save_gcode_to_file = Button()

# ----
# NON-PLANAR
# SLICING
# comments & notes: CAREFUL: This is quite an advanced option. If you want to experiment with it - great! You can do awesome things with NP slicing. But it may be still buggy and lead to some frustration ;-)
enable_non_planar_slicing = BooleanToggle(False)

# ----
# EXPERIMENTAL
# INPUT REMESHING
# comments & notes: SHRINK_WRAP: Will try to 'shrinkwrap' any input geometry by contracting a spherical mesh around it. Internal features will be lost!
# 
# RAY_MESH: Will try to 'prewrap' a spherical mesh around the geometry before shrinkwrapping / remeshing.
# 
# RE_BREP: Will compute a Brep representation of a mesh. WARNING: Can take very very long!
# EXPERIMENTAL
# FEATURES
# BEST LEFT ALONE...
shrink_wrap = BooleanToggle(False)
ray_mesh = BooleanToggle(False)
re_brep = BooleanToggle(False)

panel_2 = Panel("""PrintingGeometry
NonPlanarBoundaries
AttractorGeometry""")
merge = Merge(
    Data1=ColourSwatch(SwatchColor=RGB(0, 0, 0)),
    Data2=ColourSwatch(SwatchColor=RGB(255, 0, 0)),
    Data3=ColourSwatch(SwatchColor=RGB(63, 209, 0)),
    Data4=ColourSwatch(SwatchColor=RGB(255, 0, 208)))

# ----
# DYNAMIC
# GEOMETRY
# INPUT
create_and_reference_2 = Data(create_and_reference)
load_and_reference_2 = Data(load_and_reference)
dynamic_upadte_2 = Data(dynamic_upadte)
pipelinecontroller = PipelineController(
    DynamicUpdate=dynamic_upadte_2,
    CreateAndRef=create_and_reference_2,
    LoadAndRef=load_and_reference_2,
    ParentLayerPrefix="CLAYPRINT_",
    ReferenceLayers=panel_2,
    AssistanceLayers="AssistanceGeometry",
    LayerColours=merge)  # -> AssemblyGeo, CurrentLayers; inputs DynamicUpdate: Boolean, CreateAndRef: Boolean, LoadAndRef: Boolean, ParentLayerPrefix: String, ReferenceLayers: list of String, AssistanceLayers: list of String, LayerColours: list of Color
# ---------- pipelinecontroller: Python ----------
# PYTHON STANDARD LIBRARY IMPORTS
import time

# RHINO SDK IMPORTS
import Grasshopper
import System
import Rhino
import rhinoscriptsyntax as rs

# CUSTOM RHINO IMPORTS
import scriptcontext as sc
from scriptcontext import sticky as st

# ADDITIONAL IMPORTS
from System.Drawing import Color

# GHENV COMPONENT SETTINGS
ghenv.Component.Name = "PipelineController"
ghenv.Component.NickName = "PipelineController"
ghenv.Component.Category = "DDUClayPrintingSlicer"
ghenv.Component.SubCategory = "9 Utilities"


class PipelineController(Grasshopper.Kernel.GH_ScriptInstance):
    """
    Author: Max Benjamin Eschenbach
    License: MIT License
    Version: 250314
    """

    # UNIQUE STICKY KEY OR STORING LAYERNAMES
    LNKEY = str(ghenv.Component.InstanceGuid) + "___LAYERNAMES"
    EVKEY = str(ghenv.Component.InstanceGuid) + "___EVENTS"
    FLAG = str(ghenv.Component.InstanceGuid) + "___FLAG"

    # COMPONENT UPDATING -------------------------------------------------------

    def updateComponent(self):
        # define callback action
        def callBack(e):
            ghenv.Component.ExpireSolution(False)
        # schedule new solution
        ghdoc.ScheduleSolution(1, Grasshopper.Kernel.GH_Document.GH_ScheduleDelegate(callBack))

    # EVENT HANDLING -----------------------------------------------------------

    def subscribe_to(self, event, func, key):
        if self.EVKEY not in st:
            st[self.EVKEY] = {}
        if key not in st[self.EVKEY]:
            st[self.EVKEY][key] = event
        ukey = str(ghenv.Component.InstanceGuid) + "_" + key
        if ukey not in st:
            st[ukey] = func
            event += st[ukey]

    def unsubscribe_all(self):
        if self.EVKEY in st:
            for key in st[self.EVKEY]:
                ukey = str(ghenv.Component.InstanceGuid) + "_" + key
                if ukey in st:
                    st[self.EVKEY][key] -= st[ukey]
                    st.pop(ukey)
        st[self.EVKEY] = {}

    def flagEvent(self, sender, e):
        st[self.FLAG] = True

    def updateEvent(self, sender, e):
        if st[self.FLAG] == True:
            st[self.FLAG] = False
            self.updateComponent()

    def unsubEvent(self, sender, e):
        self.unsubscribe_all()

    # LAYER SET HANDLING -------------------------------------------------------

    def CreateReferenceLayers(self, parentPrefix, refLayers, norefLayers, colours):
        # get timestamp
        ts = time.strftime("%y%m%d_%H-%M")
        # create parent layer name
        parentLayername = parentPrefix + ts
        ghenv.Component.Message = "Referenced: " + str(parentLayername)
        # check if parent layer exists
        sc.doc = Rhino.RhinoDoc.ActiveDoc
        exists = rs.IsLayer(parentLayername)
        if exists:
            ghenv.Component.AddRuntimeMessage(ghenv.Component.RuntimeMessageLevel.Remark,
                "Parent Layer already exists! Returning valid existing layers.")
            # get all children layers
            allchildren = rs.LayerChildren(parentLayername)
            # check all children layers for validity
            validchildren = [parentLayername + "::" + vc for vc in refLayers]
            realchildren = []
            for c in allchildren:
                if c in validchildren:
                    realchildren.append(c)
            # set sticky to real found child layers
            st[self.LNKEY] = realchildren

            # switch back to ghdoc
            sc.doc = ghdoc
            # return layer names
            return realchildren
        else:
            # switch to Rhino doc
            sc.doc = Rhino.RhinoDoc.ActiveDoc
            # create parent layer
            parentLayer = rs.AddLayer(parentLayername, Color.Black)
            print(parentLayername)
            # create referenced layers
            newLayers = []
            for i, rl in enumerate(refLayers + norefLayers):
                lay = rs.AddLayer(parentLayername + '::' + rl,
                                  colours[i])
                if rl in refLayers:
                    newLayers.append(lay)
            # add them to the sticky
            st[self.LNKEY] = newLayers
            # switch back to ghdoc
            sc.doc = ghdoc
            # return layer names/paths
            return newLayers

    def LoadCurrentLayers(self, refLayers):
        # switch to RhinoDoc
        sc.doc = Rhino.RhinoDoc.ActiveDoc
        # retrieve current layer
        cl = rs.CurrentLayer()
        # check childcount
        childcount = rs.LayerChildCount(cl)
        # if no children, layer has to be childlayer or unrelated
        if childcount == 0:
            # get parent layer
            parent = rs.ParentLayer(cl)
            # switch back to GhDoc
            sc.doc = ghdoc
            if parent:
                allvalid = [parent + "::" + lay for lay in refLayers]
                # set message and return all valid children
                ghenv.Component.Message = "Referenced: " + str(parent)
                st[self.LNKEY] = allvalid
                return allvalid
            else:
                st[self.LNKEY] = None
                ghenv.Component.Message = None
                return None
        # if no children, layer has to be parent layer
        elif childcount > 0:
            parent = cl
            # switch back to GhDoc and return all valid layers
            sc.doc = ghdoc
            if parent:
                allvalid = [parent + "::" + lay for lay in refLayers]
                # set message and return all valid children
                ghenv.Component.Message = "Referenced: " + str(parent)
                st[self.LNKEY] = allvalid
                return allvalid
        else:
            # switch back to GhDoc
            sc.doc = ghdoc
            st[self.LNKEY] = None
            return None

    def retrieveGeometry(self, layers):
        geometry = []
        # switch to rhinodoc
        sc.doc = Rhino.RhinoDoc.ActiveDoc
        # loop over layers
        for i, layer in enumerate(layers):
            objs = [rs.coercegeometry(obj) for obj in rs.ObjectsByLayer(layer)]
            if objs is None:
                objs = []
            for i, obj in enumerate(objs):
                if type(obj) == Rhino.Geometry.Point:
                    objs[i] = Rhino.Geometry.Point3d(obj.Location)
            geometry.append(objs)
        # switch back to ghdoc
        sc.doc = ghdoc
        return geometry

    def RunScript(self,
            DynamicUpdate: bool,
            CreateAndRef: bool,
            LoadAndRef: bool,
            ParentLayerPrefix: str,
            ReferenceLayers: list[str],
            AssistanceLayers: list[str],
            LayerColours: list[System.Drawing.Color]):
        # check for unique key in sticky dictionary
        if self.LNKEY not in st:
            st[self.LNKEY] = None
        # define output variables ----------------------------------------------
        AssemblyGeo = Grasshopper.DataTree[object]()
        CurrentLayers = []
        # subscribe to events for automatic component updating -----------------
        if DynamicUpdate:
            self.subscribe_to(Rhino.RhinoDoc.BeforeTransformObjects, self.flagEvent, "BeforeTransformObjects")
            self.subscribe_to(Rhino.RhinoDoc.DeleteRhinoObject, self.flagEvent, "DeleteRhinoObject")
            self.subscribe_to(Rhino.RhinoDoc.AddRhinoObject, self.flagEvent, "AddRhinoObject")
            # self.subscribe_to(Rhino.RhinoDoc.LayerTableEvent, self.flagEvent, "LayerTableEvent")
            self.subscribe_to(Rhino.RhinoDoc.UndeleteRhinoObject, self.flagEvent, "UndeleteRhinoObjects")
            self.subscribe_to(Rhino.RhinoApp.Idle, self.updateEvent, "Idle")
            self.subscribe_to(Rhino.RhinoDoc.CloseDocument, self.unsubEvent, "CloseDocument")
            self.subscribe_to(Rhino.RhinoDoc.NewDocument, self.unsubEvent, "NewDocument")
        else:
            self.unsubscribe_all()
        # catch missing layer colours ------------------------------------------
        laycount = len(ReferenceLayers + AssistanceLayers)
        if not LayerColours or len(LayerColours) == 0:
            LayerColours = [Color.Black] * laycount
        elif len(LayerColours) < len(ReferenceLayers + AssistanceLayers):
            addCols = [Color.Black] * (laycount - len(LayerColours))
            LayerColours.extend(addCols)
        # if create button is pressed, create new layers and reference them ----
        if CreateAndRef is True:
            CurrentLayers = self.CreateReferenceLayers(ParentLayerPrefix,
                                                       ReferenceLayers,
                                                       AssistanceLayers,
                                                       LayerColours)
        # if load button is pressed, load from the current rhino-layer ---------
        elif LoadAndRef is True:
            # retrieve the current layerset based on the active rhino layer
            CurrentLayers = self.LoadCurrentLayers(ReferenceLayers)
        # if no button is pressed, make some checks and run standard procedure -
        elif self.LNKEY in st and st[self.LNKEY] is not None:
            layer_names = st[self.LNKEY]
            CurrentLayers = layer_names
        # fall back and return if there are no layer names stored in sticky
        elif st[self.LNKEY] is None:
            try:
                # retrieve the current layerset based on the active rhino layer
                CurrentLayers = self.LoadCurrentLayers(ReferenceLayers)
            except Exception:
                return AssemblyGeo, CurrentLayers
        # retrieve all geometry
        if CurrentLayers:
            try:
                allgeometry = self.retrieveGeometry(CurrentLayers)
            except ValueError as errMsg:
                ghenv.Component.AddRuntimeMessage(ghenv.Component.RuntimeMessageLevel.Error,
                                       str(errMsg))
                allgeometry = None
        else:
            ghenv.Component.AddRuntimeMessage(ghenv.Component.RuntimeMessageLevel.Warning,
                "Could not load layerset. Check your current Rhino layer or " +
                "the controllers input parameters")
            allgeometry = None
        if allgeometry:
            for i, geo in enumerate(allgeometry):
                AssemblyGeo.AddRange(geo, Grasshopper.Kernel.Data.GH_Path(i))
        # return outputs
        return AssemblyGeo, CurrentLayers
# ---------- end pipelinecontroller ----------
comments_notes_14 = Panel("DYNAMIC GEOMETRY INPUT")
assemblygeo = Data(pipelinecontroller.AssemblyGeo)
bang = ExplodeTree(Data=assemblygeo)  # -> Branch0, Branch1, Branch2
nonplanarboundaries = Data(bang.Branch1)
attractorgeometry = Data(bang.Branch2)
printinggeometry = Data(bang.Branch0)

# ----
# VIEWCAPTURE
save_viewcapture = BooleanToggle(False)
viewcapturewidth = Slider(1920, range=0..10000)
viewcaptureheight = Slider(1080, range=0..10000)
open_viewcapture_after_saving = BooleanToggle(False)
viewcapturetofile = ViewCaptureToFile(
    Toggle=save_viewcapture,
    Width=viewcapturewidth,
    Height=viewcaptureheight,
    Grid=Toggle(False),
    WorldAxes=Toggle(False),
    CPlaneAxes=Toggle(False),
    OpenFile=open_viewcapture_after_saving)  # -> Path; inputs Toggle: Boolean, Width: Int32, Height: Int32, BackgroundColor: Color, Grid: Boolean, WorldAxes: Boolean, CPlaneAxes: Boolean, OpenFile: Boolean
# ---------- viewcapturetofile: Python ----------
# PYTHON STANDARD LIBRARY IMPORTS
import os
import datetime

# RHINO SDK IMPORTS
import System
import Rhino
import Grasshopper
import scriptcontext as sc

# GHENV COMPONENT SETTINGS
ghenv.Component.Name = "ViewCaptureToFile"
ghenv.Component.NickName = "ViewCaptureToFile"
ghenv.Component.Category = "DDUClayPrintingSlicer"
ghenv.Component.SubCategory = "8 Visualisation"


class ViewCaptureToFile(Grasshopper.Kernel.GH_ScriptInstance):
    """
    Author: Max Eschenbach (based on a GhPython Script by Anders Holden Deleuran)
    License: MIT License
    Version: 250314
    """

    def checkOrMakeFolder(self):
        """
        Check/makes a "Captures" folder in the GH def folder and a subfolder
        in the format 'YYMMDD'.
        """
        # construct timestamp for subfolder
        date = datetime.date.today()
        yy = str(date.year)[-2:]
        mm = str(date.month).zfill(2)
        dd = str(date.day).zfill(2)
        timestamp = yy + mm + dd
        docpath = ghdoc.Path
        if docpath:
            folder = os.path.dirname(docpath)
            captureFolder = folder + "\\Captures\\" + timestamp
            if not os.path.isdir(captureFolder):
                os.makedirs(captureFolder)
            return captureFolder

    def makeFileName(self):
        """ Make a string with the gh def name + current hourMinuteSecond """
        # Make hour minute seconds string
        n = datetime.datetime.now()
        ho, mt, sc = str(n.hour), str(n.minute), str(n.second)
        if len(ho) == 1:
            ho = "0" + ho
        if len(mt) == 1:
            mt = "0" + mt
        if len(sc) == 1:
            sc = "0" + sc
        hms = ho + mt + sc
        # Get name of GH def
        ghDef = ghdoc.Name.strip("*")
        # Concatenate and return
        fileName = ghDef + "_" + hms
        return fileName

    def captureActiveViewToFile(
            self,
            width,
            height,
            path,
            grid,
            worldAxes,
            cplaneAxes):
        """
        Captures the active view to an image file at the path.
        Path looks like this:
        "C:\\Users\\user\\Desktop\\Captures\\foo_bar.png"
        """
        # Set the script context to the current Rhino doc
        sc.doc = Rhino.RhinoDoc.ActiveDoc
        # Get the active view and set image dimensions
        activeView = sc.doc.Views.ActiveView
        # Perform the capture
        try:
            viewcap = Rhino.Display.ViewCapture()
            viewcap.DrawGrid = grid
            viewcap.DrawGridAxes = worldAxes
            viewcap.DrawAxes = cplaneAxes
            viewcap.Height = height
            viewcap.Width = width
            imageCap = viewcap.CaptureToBitmap(activeView)
            System.Drawing.Bitmap.Save(imageCap, path)
            Rhino.RhinoApp.WriteLine(path)
            sc.doc = ghdoc
            return path
        except Exception as e:
            print(e)
            sc.doc = ghdoc
            raise Exception(" Capture failed, check the path")

    def RunScript(self,
            Toggle: bool,
            Width: int,
            Height: int,
            BackgroundColor: System.Drawing.Color,
            Grid: bool,
            WorldAxes: bool,
            CPlaneAxes: bool,
            OpenFile: bool):
        # Set background color
        if BackgroundColor:
            Rhino.ApplicationSettings.AppearanceSettings.ViewportBackgroundColor = BackgroundColor
        # Capture
        Path = Grasshopper.DataTree[object]()
        if Toggle:
            if not Width:
                Width = 1920
            if not Height:
                Height = 1080
            capFolder = self.checkOrMakeFolder()
            fileName = self.makeFileName()
            try:
                path = os.path.join(capFolder, fileName + ".png")
                Path = self.captureActiveViewToFile(Width, Height, path, Grid, WorldAxes, CPlaneAxes)
                if OpenFile:
                    os.startfile(path)
            except Exception as e:
                print(e)
                raise Exception(" Capture failed, save the GH definition")
        # return outputs if you have them; here I try it for you:
        return Path
# ---------- end viewcapturetofile ----------
panel_3 = Panel(viewcapturetofile)

# ----
# INPUT // CUSTOM CURVE INJECTION
# comments & notes: Using this toggle, you can inject custom curves that will be treated as print curves, without slicing or any other preprocessing of 3D geometry. This is useful if you want to experiment with very elaborate print paths.
# comments & notes: ATTENTION: CURVES NEED TO BE SUPPLIED AS FOLLOWS:
# 
# - CURVES NEED TO BE ORDERED FROM BOTTOM TO TOP!
# - ONE TREE BRANCH PER LAYER
# - IF A LAYER HAS MULTIPLE CURVES (BRANCHING OBJECTS), THEY NEED TO BE IN THE SAME BRANCH
# 
# - PLEASE HAVE A LOOK AT THE DATA STRUCTURE IN THE EXAMPLE TO THE LEFT!
inject_custom_curves = BooleanToggle(False)
my_example_custom_curves = Curve(Tree({0;0}: [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], {0;1}: [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], {0;2}: [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], {0;3}: [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], {0;4}: [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], {0;5}: [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]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))
custom_curves_input = Curve(my_example_custom_curves)
viewer = ParamViewer(custom_curves_input)
comments_notes_15 = Panel("CUSTOM CURVE INJECTION")
panel_4 = Panel(custom_curves_input)

# ----
# comments & notes: connect your input geometry here if you have specified or modeled it manually.
# 
# MAKE SURE THAT THE INPUT HERE IS ONE SINGLE OBJECT (BREP or MESH)!
input_geometry = Geometry(printinggeometry)

# ----
# INPUT GEOMETRY
# comments & notes: filter in case of enabling custom curve injection
# comments & notes: move input geometry to world origin and ensure it is positioned on XY plane (ground)
bbox = BoundingBox(Content=flatten(input_geometry), Plane=PlaneXY(0, 0, 0), UnionBox=True)  # -> Box, Box_2
comments_notes_16 = Panel("INPUT GEOMETRY")
debox = DeconstructBox(Box=bbox.Box)  # -> Plane, X, Y, Z
volume = Volume(Geometry=bbox.Box)  # -> Volume, Centroid
pdecon = Deconstruct(Point=volume.Centroid)  # -> XComponent, YComponent, ZComponent
dedomain = DeconstructDomain(Domain=debox.Z)  # -> Start, End
pt = ConstructPoint(XCoordinate=pdecon.XComponent, YCoordinate=pdecon.YComponent, ZCoordinate=dedomain.Start)
xy = XYPlane(Origin=Point(0, 0, 0))
vec2pt = Vector2Pt(PointA=pt, PointB=xy, Unitize=False)  # -> Vector, Length
inject_custom_curves_2 = Data(inject_custom_curves)
move = Move(Geometry=input_geometry, Motion=vec2pt.Vector)  # -> Geometry, Transform
filter = StreamFilter(Gate=inject_custom_curves_2, Stream0=move.Geometry)
input_geometry_2 = Geometry(filter)

# ----
# CUSTOM CURVE INJECTION
custom_curves = Curve(custom_curves_input)
bbox_2 = BoundingBox(Content=flatten(custom_curves), Plane=PlaneXY(0, 0, 0), UnionBox=True)  # -> Box, Box_2
debox_2 = DeconstructBox(Box=bbox_2.Box)  # -> Plane, X, Y, Z
volume_2 = Volume(Geometry=bbox_2.Box)  # -> Volume, Centroid
pdecon_2 = Deconstruct(Point=volume_2.Centroid)  # -> XComponent, YComponent, ZComponent
dedomain_2 = DeconstructDomain(Domain=debox_2.Z)  # -> Start, End
pt_2 = ConstructPoint(XCoordinate=pdecon_2.XComponent, YCoordinate=pdecon_2.YComponent, ZCoordinate=dedomain_2.Start)
xy_2 = XYPlane(Origin=Point(0, 0, 0))
vec2pt_2 = Vector2Pt(PointA=pt_2, PointB=xy_2, Unitize=False)  # -> Vector, Length
move_2 = Move(Geometry=custom_curves, Motion=vec2pt_2.Vector)  # -> Geometry, Transform
topoly = CurveToPolyline(Curve=move_2.Geometry, ToleranceDistance="0.01", ToleranceAngle=0)  # -> Polyline, Segments
custom_curves_at_origin = Curve(topoly.Polyline)

synthesize_floor_for_custom_curves_2 = Data(synthesize_floor_for_custom_curves)
custom_curves_at_origin_2 = Curve(custom_curves_at_origin)
filter_2 = StreamFilter(Gate=synthesize_floor_for_custom_curves_2, Stream1=custom_curves_at_origin_2)
floor_layer_count_2 = Integer(floor_layer_count)
tstat = TreeStatistics(Tree=filter_2)  # -> Paths, Length, Count
split = SplitList(List=tstat.Paths, Index=floor_layer_count_2)  # -> ListA, ListB
branch = TreeBranch(Tree=filter_2, Path=split.ListA, MaintainPaths=True)
branch_2 = TreeBranch(Tree=filter_2, Path=split.ListB, MaintainPaths=True)
custom_curves_wo_floor_wall_curves = Curve(branch_2)
custom_curves_floor_wall_curves = Curve(branch)

# ----
# REMESHING
comments_notes_17 = Panel("REMESHING")

slice_polylines = Data(custom_curves_at_origin)
pcen = PolygonCenter(Polyline=slice_polylines)  # -> CenterV, CenterE, CenterA
avr = Average(Input=pcen.CenterA)
comments_notes_18 = Panel("construct slice planes")
xy_3 = XYPlane(Origin=avr)
custom_curves_slice_planes = Data(xy_3)

# ----
# comments & notes: CHECK FLOOR LAYER COUNT
floor_layer_count_3 = Integer(floor_layer_count)
larger = LargerThan(FirstNumber=floor_layer_count_3, SecondNumber="0")  # -> LargerThan, OrEqualTo
floor_layer_count_larger_than_zero = Data(larger.LargerThan)

# ----
# CONTROL FLOW
# INPUT GEOMETRY
# comments & notes: check if any input geometry is present
input_geometry_3 = Geometry(input_geometry_2)
custom_curves_2 = Curve(custom_curves_input)
inject_custom_curves_3 = Data(inject_custom_curves)
null = NullItem(Item=input_geometry_3)  # -> NullFlags, InvalidFlags, Description
null_2 = NullItem(Item=flatten(custom_curves_2))  # -> NullFlags, InvalidFlags, Description
or_2 = GateOr(A=null.NullFlags, B=null.InvalidFlags)
ma = MassAddition(Input=null_2.NullFlags)  # -> Result, PartialResults
ma_2 = MassAddition(Input=null_2.InvalidFlags)  # -> Result, PartialResults
or_3 = GateOr(A=ma.Result, B=ma_2.Result)
filter_3 = StreamFilter(Gate=inject_custom_curves_3, Stream0=or_2, Stream1=or_3)
not = GateNot(A=filter_3)
geo_present = Boolean(not)

# ----
# CONTROL FLOW
# INPUT MESH
inject_custom_curves_4 = Data(inject_custom_curves)
geo_present_2 = Boolean(invert(filter_3))
input_geometry_4 = Geometry(input_geometry_2)
and = GateAnd(A=inject_custom_curves_4, B=geo_present_2)
comments_notes_19 = Panel("check input geometry")
meshbrepanalysis = MeshBrepAnalysis(G=input_geometry_4, T="Input ", CC=and)  # -> IsMesh, Closed, NakedEdges, Info; inputs G: GeometryBase, T: String, CC: Boolean
# ---------- meshbrepanalysis: C# ----------
#region Usings
using System;
using System.Linq;
using System.Collections;
using System.Collections.Generic;
using System.Drawing;

using Rhino;
using Rhino.Geometry;

using Grasshopper;
using Grasshopper.Kernel;
using Grasshopper.Kernel.Data;
using Grasshopper.Kernel.Types;
#endregion

public class Script_Instance : GH_ScriptInstance
{
    #region Notes
    /* 
      Members:
        RhinoDoc RhinoDocument
        GH_Document GrasshopperDocument
        IGH_Component Component
        int Iteration

      Methods (Virtual & overridable):
        Print(string text)
        Print(string format, params object[] args)
        Reflect(object obj)
        Reflect(object obj, string method_name)

    Author: Max Benjamin Eschenbach
    License: MIT License
    Version: 250314
    */
    #endregion

    private void RunScript(
		GeometryBase G,
		string T,
		bool CC,
		ref object IsMesh,
		ref object Closed,
		ref object NakedEdges,
		ref object Info)
    {
        // set component params
        this.Component.Name = "MeshBrepAnalysis";
        this.Component.NickName = "MeshBrepAnalysis";
        this.Component.Category = "DDUClayPrintingSlicer";
        this.Component.SubCategory = "9 Utilities";

        bool msh = true;
        bool clsd = false;
        int nB = 0;

        if (G is Mesh)
        {
        msh = true;
        Mesh tMesh = (Mesh) G;
        clsd = tMesh.IsClosed;
        if (clsd == false)
        {
            Curve[] nEdges = Curve.JoinCurves(Array.ConvertAll(tMesh.GetNakedEdges(), crv => crv.ToPolylineCurve()));
            NakedEdges = nEdges;
            nB = nEdges.Length;
        }
        else
        {
            NakedEdges = new Grasshopper.DataTree<object>();
        }
        IsMesh = msh;
        Closed = clsd;
        }
        else if (G is Brep)
        {
        msh = false;
        Brep tBrep = (Brep) G;
        clsd = tBrep.IsSolid;
        if (clsd == false)
        {
            Curve[] nEdges = Curve.JoinCurves(tBrep.DuplicateNakedEdgeCurves(true, true));
            NakedEdges = nEdges;
            nB = nEdges.Length;
        }
        else
        {
            NakedEdges = new Grasshopper.DataTree<object>();
        }
        IsMesh = msh;
        Closed = clsd;
        }

        string baseStr = "[INFO] {0}Geometry is a{1} {2}{3}!";
        string iclsd = (clsd) ? " closed" : "n open";
        string imsh = (msh) ? "MESH" : "BREP";
        string inb = (nB > 0) ? String.Format(" with {0} boundaries", nB) : "";
        Info = String.Format(baseStr, T, iclsd, imsh, inb);

        if (CC == true)
        {
        IsMesh = msh;
        Closed = clsd;
        NakedEdges = new Grasshopper.DataTree<object>();
        Info = new List<string> {"[INFO] Custom layer CURVES are being used!", "[INFO] Analysis tools DEACTIVATED (Custom Curves)!"};
        }
    }
}
# ---------- end meshbrepanalysis ----------
inmesh_closed = Data(meshbrepanalysis.Info)
input_ismesh = Boolean(meshbrepanalysis.IsMesh)

input_geometry_5 = Geometry(input_geometry_2)
input_ismesh_2 = Boolean(input_ismesh)
gate = StreamGate(Stream=input_geometry_5, Gate=input_ismesh_2)  # -> Target0, Target1
unim = UnifyMesh(Mesh=gate.Target1)  # -> Result, Count
filter_4 = StreamFilter(Gate=input_ismesh_2, Stream0=gate.Target0, Stream1=unim.Result)
input_geometry_6 = Geometry(filter_4)

# ----
# comments & notes: construct ray mesh for shrink wrapping
input_geometry_7 = Geometry(input_geometry_6)
triremeshtoggle = Data(tri_remesh)
raymesh = Data(ray_mesh)
gate_2 = StreamGate(Stream=input_geometry_7, Gate=triremeshtoggle)  # -> Target0, Target1
mjoin = MeshJoin(Meshes=gate_2.Target1)
bbox_3 = BoundingBox(Content=mjoin, Plane=PlaneXY(0, 0, 0), UnionBox=True)  # -> Box, Box_2
boxprop = BoxProperties(Box=bbox_3.Box)  # -> Center, Diagonal, Area, Volume, Degeneracy
volume_3 = Volume(Geometry=bbox_3.Box)  # -> Volume, Centroid
msphere = MeshSphere(Base=volume_3.Centroid, Radius=boxprop.Diagonal, UCount="60", VCount="60")
gate_3 = StreamGate(Stream=msphere, Gate=raymesh)  # -> Target0, Target1
tri = Triangulate(Mesh=gate_3.Target1)  # -> Mesh, Count
demesh = DeconstructMesh(Mesh=tri.Mesh)  # -> Vertices, Faces, Colours, Normals
rev = Reverse(Vector=demesh.Normals)
meshray = MeshRay(Mesh=gate_2.Target1, Point=demesh.Vertices, Direction=rev)  # -> Point, Hit
conmesh = ConstructMesh(Vertices=meshray.Point, Faces=demesh.Faces)
filter_5 = StreamFilter(Gate=raymesh, Stream0=gate_3.Target0, Stream1=conmesh)
shrinkwrapmesh = Mesh(filter_5)
input_geometry_8 = Geometry(gate_2.Target0)

# ----
# comments & notes: extract sharp features using threshold angle between faces
input_geometry_9 = Geometry(input_geometry_6)
input_ismesh_3 = Boolean(input_ismesh)
triremesh = Data(tri_remesh)
trm_additional_sharp_features_2 = Data(trm_additional_sharp_features)
trm_addsharp_angle_threshold_2 = Data(trm_addsharp_angle_threshold)
and_2 = GateAnd(A=input_ismesh_3, C=triremesh, B=trm_additional_sharp_features_2)
gate_4 = StreamGate(Stream=input_geometry_9, Gate=and_2)  # -> Target0, Target1
findsharpmeshfeatures = FindSharpMeshFeatures(M=gate_4.Target1, A=trm_addsharp_angle_threshold_2)  # -> E; inputs M: Mesh, A: Double
# ---------- findsharpmeshfeatures: C# ----------
#region Usings
using System;
using System.Linq;
using System.Collections;
using System.Collections.Generic;
using System.Drawing;
using System.Threading.Tasks;

using Rhino;
using Rhino.Geometry;
using Rhino.Geometry.Collections;

using Grasshopper;
using Grasshopper.Kernel;
using Grasshopper.Kernel.Data;
using Grasshopper.Kernel.Types;
#endregion

public class Script_Instance : GH_ScriptInstance
{
    #region Notes
    /* 
      Members:
        RhinoDoc RhinoDocument
        GH_Document GrasshopperDocument
        IGH_Component Component
        int Iteration

      Methods (Virtual & overridable):
        Print(string text)
        Print(string format, params object[] args)
        Reflect(object obj)
        Reflect(object obj, string method_name)

    Author: Max Benjamin Eschenbach
    License: MIT License
    Version: 250314
    */
    #endregion

    private void RunScript(Mesh M, double A, ref object E)
    {
        // set component params
        this.Component.Name = "FindSharpMeshFeatures";
        this.Component.NickName = "FindSharpMeshFeatures";
        this.Component.Category = "DDUClayPrintingSlicer";
        this.Component.SubCategory = "6 Analysis";

        if (M != null)
        {
            // get topology edges
            MeshTopologyEdgeList Edges = M.TopologyEdges;
            MeshFaceNormalList FaceNormals = M.FaceNormals;
            // create list for storing sharp edges
            List<Line> SharpEdges = new List<Line>();
            // loop over all edges
            for (int i = 0; i < Edges.Count; i++)
            {
                // for every edge, get adjacent faces
                int[] fids = Edges.GetConnectedFaces(i);
                // only continue if there are exactly two faces adjacent to this edge
                if (fids.Length == 2)
                {
                    // compute angle between face normals
                    if (RhinoMath.ToDegrees(Vector3d.VectorAngle(FaceNormals[fids[0]], FaceNormals[fids[1]])) > A)
                    {
                    SharpEdges.Add(Edges.EdgeLine(i));
                    }
                }
            }
            E = SharpEdges;
        }
        else
        {
            E = new DataTree<object>();
        }
    }
}
# ---------- end findsharpmeshfeatures ----------
filter_6 = StreamFilter(Gate=input_ismesh_3, Stream1=findsharpmeshfeatures)
sharp_features = Curve(filter_6)

# ----
# comments & notes: TriRemesh input Mesh on request. Be careful, you might lose some accuracy!
shrinkwrapmesh_2 = Mesh(shrinkwrapmesh)
trm_preserve_sharp_features_2 = Boolean(trm_preserve_sharp_features)
input_geometry_10 = Geometry(input_geometry_6)
triremesh_2 = Data(tri_remesh)
shrink_wrap_2 = Boolean(shrink_wrap)
iterations = Slider(50, range=0..100)
filter_7 = StreamFilter(Gate=shrink_wrap_2, Stream1=input_geometry_10)
filter_8 = StreamFilter(Gate=shrink_wrap_2, Stream0=input_geometry_10, Stream1=shrinkwrapmesh_2)
trm_edge_length_2 = Data(trm_edge_length)
sharp_features_2 = Curve(sharp_features)
filter_9 = StreamFilter(Gate=triremesh_2, Stream1=filter_8)
triremesh_3 = TriRemesh(
    Geometry=filter_9,
    Target=filter_7,
    Sharp=trm_preserve_sharp_features_2,
    Features=sharp_features_2,
    Length=trm_edge_length_2,
    Iterations=iterations)  # -> Triangulation, Dual, Creases
unim_2 = UnifyMesh(Mesh=triremesh_3.Triangulation)  # -> Result, Count
triremesh_4 = Mesh(unim_2.Result)
input_geometry_11 = Geometry(input_geometry_8)
triremeshtoggle_2 = Data(triremeshtoggle)
triremesh_5 = Mesh(triremesh_4)
filter_10 = StreamFilter(Gate=triremeshtoggle_2, Stream0=input_geometry_11, Stream1=triremesh_5)
base_geometry = Geometry(filter_10)

# ----
# comments & notes: ReBrep on request
# converts all mesh faces into surfaces and joins them, creating a brep from the mesh. This is a terribly intense and slow process. I don't advise doing it! But the feature is there if you absoluetly need to...
base_geometry_2 = Geometry(base_geometry)
trimmedtriangles = BooleanToggle(True)
rebrep = Boolean(re_brep)
gate_5 = StreamGate(Stream=base_geometry_2, Gate=rebrep)  # -> Target0, Target1
rebrepmesh = ReBrepMesh(M=gate_5.Target1, TT=trimmedtriangles)  # -> B; inputs M: Mesh, TT: Boolean
# ---------- rebrepmesh: C# ----------
#region Usings
using System;
using System.Linq;
using System.Collections;
using System.Collections.Generic;
using System.Drawing;

using Rhino;
using Rhino.Geometry;

using Grasshopper;
using Grasshopper.Kernel;
using Grasshopper.Kernel.Data;
using Grasshopper.Kernel.Types;
#endregion

public class Script_Instance : GH_ScriptInstance
{
    #region Notes
    /* 
      Members:
        RhinoDoc RhinoDocument
        GH_Document GrasshopperDocument
        IGH_Component Component
        int Iteration

      Methods (Virtual & overridable):
        Print(string text)
        Print(string format, params object[] args)
        Reflect(object obj)
        Reflect(object obj, string method_name)

    Author: Max Benjamin Eschenbach
    License: MIT License
    Version: 250314
    */
    #endregion

    private void RunScript(Mesh M, bool TT, ref object B)
    {
        this.Component.Name = "ReBrepMesh";
        this.Component.NickName = "ReBrepMesh";
        this.Component.Category = "DDUClayPrintingSlicer";
        this.Component.SubCategory = "9 Utilities";

        if (M != null)
        {
            B = Brep.CreateFromMesh(M, TT);
        }
        else
        {
            B = new DataTree<object>();
        }
        
    }
}
# ---------- end rebrepmesh ----------
filter_11 = StreamFilter(Gate=rebrep, Stream0=gate_5.Target0, Stream1=rebrepmesh)
printing_geometry = Geometry(filter_11)

# ----
# CONTROL FLOW MESHING
panel_5 = Panel("[INFO] ShrinkWrapping during Remeshing...")
inject_custom_curves_5 = Data(inject_custom_curves)
triremesh_6 = Data(tri_remesh)
shrink_wrap_3 = Data(shrink_wrap)
base_mesh = Geometry(base_geometry)
comments_notes_20 = Panel("info & error messages")
filter_12 = StreamFilter(Gate=triremesh_6, Stream1=base_mesh)
filter_13 = StreamFilter(Gate=shrink_wrap_3, Stream0=panel_5, Stream1="[INFO] No ShrinkWrapping is being done.")
ismeshclosed = IsMeshClosed(M=filter_12)  # -> C, T; inputs M: Mesh
# ---------- ismeshclosed: C# ----------
#region Usings
using System;
using System.Linq;
using System.Collections;
using System.Collections.Generic;
using System.Drawing;

using Rhino;
using Rhino.Geometry;

using Grasshopper;
using Grasshopper.Kernel;
using Grasshopper.Kernel.Data;
using Grasshopper.Kernel.Types;
#endregion

public class Script_Instance : GH_ScriptInstance
{
    #region Notes
    /* 
      Members:
        RhinoDoc RhinoDocument
        GH_Document GrasshopperDocument
        IGH_Component Component
        int Iteration

      Methods (Virtual & overridable):
        Print(string text)
        Print(string format, params object[] args)
        Reflect(object obj)
        Reflect(object obj, string method_name)

    Author: Max Benjamin Eschenbach
    License: MIT License
    Version: 250314
    */
    #endregion

    private void RunScript(Mesh M, ref object C, ref object T)
    {
        // set component params
        this.Component.Name = "IsMeshClosed";
        this.Component.NickName = "IsMeshClosed";
        this.Component.Category = "DDUClayPrintingSlicer";
        this.Component.SubCategory = "9 Utilities";

        if (M != null)
        {
            if (M.IsClosed == true)
            {
                C = true;
                T = "[INFO] Base Mesh is closed.";
            }
            else
            {
                C = false;
                T = "[INFO] Base Mesh is open and/or disjoint!";
            }
        }
        C = new DataTree<object>();
        T = new DataTree<object>();
        
    }
}
# ---------- end ismeshclosed ----------
filter_14 = StreamFilter(Gate=triremesh_6, Stream0="[INFO] No Remeshing is being done...", Stream1="[INFO] Using TriRemesh Pipeline...")
filter_15 = StreamFilter(Gate=triremesh_6, Stream1=ismeshclosed.T)
filter_16 = StreamFilter(Gate=triremesh_6, Stream1=filter_13)
filter_17 = StreamFilter(Gate=inject_custom_curves_5, Stream0=filter_15)
filter_18 = StreamFilter(Gate=inject_custom_curves_5, Stream0=filter_14)
filter_19 = StreamFilter(Gate=inject_custom_curves_5, Stream0=filter_16)
base_mesh_closed = Data(filter_17)
remeshing_info = Data(filter_18)
shrinkwrap_info = Data(filter_19)

# ----
# CONTROL FLOW
# NON-PLANAR SLICING
# comments & notes: check if printing geometry is Mesh or Brep
enable_non_planar_slicing_2 = Data(enable_non_planar_slicing)
inject_custom_curves_6 = Data(inject_custom_curves)
printing_geometry_2 = Geometry(printing_geometry)
geo_present_3 = Boolean(geo_present)
and_3 = GateAnd(A=inject_custom_curves_6, B=geo_present_3)
meshbrepanalysis_2 = MeshBrepAnalysis(G=printing_geometry_2, T="Printing ", CC=and_3)  # -> IsMesh, Closed, NakedEdges, Info; inputs G: GeometryBase, T: String, CC: Boolean; same code as meshbrepanalysis
printing_geometry_ismesh = Boolean(meshbrepanalysis_2.IsMesh)
printing_geometry_closed = Boolean(meshbrepanalysis_2.Closed)
and_4 = GateAnd(A=enable_non_planar_slicing_2, B=printing_geometry_ismesh, C=invert(printing_geometry_closed))
nonplanarslicinginfo = NonPlanarSlicingInfo(
    NPSlicingEnabled=enable_non_planar_slicing_2,
    PrintingGeoIsMesh=printing_geometry_ismesh,
    PrintingGeometryClosed=printing_geometry_closed,
    InjectCustomCurves=and_3)  # -> INFO; inputs NPSlicingEnabled: Boolean, PrintingGeoIsMesh: Boolean, PrintingGeometryClosed: Boolean, InjectCustomCurves: Boolean
# ---------- nonplanarslicinginfo: Python ----------
import System
import Rhino
import Grasshopper
import rhinoscriptsyntax as rs

# GHENV COMPONENT SETTINGS
ghenv.Component.Name = "NonPlanarSlicingInfo"
ghenv.Component.NickName = "NonPlanarSlicingInfo"
ghenv.Component.Category = "DDUClayPrintingSlicer"
ghenv.Component.SubCategory = "9 Utilities"

class NonPlanarSlicingInfo(Grasshopper.Kernel.GH_ScriptInstance):
    """
    Author: Max Benjamin Eschenbach
    License: MIT License
    Version: 250314
    """
    
    def RunScript(self,
            NPSlicingEnabled: bool,
            PrintingGeoIsMesh: bool,
            PrintingGeometryClosed: bool,
            InjectCustomCurves: bool):
        INFO = Grasshopper.DataTree[object]()
        if NPSlicingEnabled and not PrintingGeoIsMesh:
            INFO = '[SETTING IGNORED] Non Planar slicing is impossible for BREPs! To use this feature, activate remeshing.'
        elif NPSlicingEnabled and PrintingGeoIsMesh and not PrintingGeometryClosed:
            INFO = '[INFO] Performing Non Planar slicing...'
        elif NPSlicingEnabled and PrintingGeometryClosed:
            INFO = ['[SETTING IGNORED] Non Planar slicing is currently not available for closed objects!',
                    '[INFO] Performing parallel slicing...']
        elif InjectCustomCurves:
            INFO = '[INFO] No slicing is being done! Custom CURVES are injected...'
        else:
            INFO = '[INFO] Performing parallel slicing...'
        return INFO
# ---------- end nonplanarslicinginfo ----------
gate_6 = StreamGate(Stream=printing_geometry_2, Gate=and_4)  # -> Target0, Target1
printing_geometry_3 = Geometry(gate_6.Target0)
printing_geometry_4 = Geometry(gate_6.Target1)
np_slicing_enabled = Boolean(and_4)
pg_meshbrep_info = Data(meshbrepanalysis_2.Info)
info_npslicing = Data(nonplanarslicinginfo)

# ----
# CONTROL FLOW
# MESH/BREP OPEN LOWER BOUNDARY
# comments & notes: CHECK FOR LOWER BOUNDARY
printing_geometry_ismesh_2 = Boolean(printing_geometry_ismesh)
# CONTROL FLOW
# FLOOR SLICING
printing_geometry_5 = Geometry(printing_geometry)
gate_7 = StreamGate(Stream=printing_geometry_5, Gate=printing_geometry_ismesh_2)  # -> Target0, Target1
edges = BrepEdges(Brep=gate_7.Target0)  # -> Naked, Interior, NonManifold
medges = MeshEdges(Mesh=gate_7.Target1)  # -> NakedEdges, InteriorEdges, NonManifoldEdges
filter_20 = StreamFilter(Gate=printing_geometry_ismesh_2, Stream0=edges.Naked, Stream1=medges.NakedEdges)
join = JoinCurves(Curves=filter_20, Preserve=False)
topoly_2 = CurveToPolyline(Curve=join, ToleranceDistance="0.01", ToleranceAngle=0)  # -> Polyline, Segments
pcen_2 = PolygonCenter(Polyline=topoly_2.Polyline)  # -> CenterV, CenterE, CenterA
pdecon_3 = Deconstruct(Point=pcen_2.CenterV)  # -> XComponent, YComponent, ZComponent
sort = SortList(Keys=pdecon_3.ZComponent, ValuesA=join)  # -> Keys, ValuesA
item = ListItem(List=sort.ValuesA, Index=0, Wrap=True)
explode = Explode(Curve=item, Recursive=True)  # -> Segments, Vertices
pdecon_4 = Deconstruct(Point=explode.Vertices)  # -> XComponent, YComponent, ZComponent
avr_2 = Average(Input=pdecon_4.ZComponent)
rtd = RoundToDecimal(Numbers=avr_2, DecimalPlaces="5")  # -> Rounded; inputs Numbers: list of Double, DecimalPlaces: list of Int32
# ---------- rtd: Python ----------
# PYTHON STANDARD LIBRARY IMPORTS
from __future__ import division, print_function

# GHPYTHONLIB SDK IMPORTS
import Grasshopper
import System
import Rhino

# GHENV COMPONENT SETTINGS
ghenv.Component.Name = "RoundToDecimal"
ghenv.Component.NickName = "RTD"
ghenv.Component.Category = "DDUClayPrintingSlicer"
ghenv.Component.SubCategory = "9 Utilities"

class RoundToDecimal(Grasshopper.Kernel.GH_ScriptInstance):
    """
    Author: Max Benjamin Eschenbach
    License: MIT License
    Version: 250423
    """

    def RunScript(self,
            Numbers: System.Collections.Generic.List[float],
            DecimalPlaces: System.Collections.Generic.List[int]):
        
        if not DecimalPlaces:
            DecimalPlaces = [0]
        else:
            DecimalPlaces = list(DecimalPlaces)

        if Numbers and Numbers != [None]:
            rounded = []
            for i, num in enumerate(Numbers):
                # retrieve decimalplaces
                if i < len(DecimalPlaces):
                    dp = DecimalPlaces[i]
                else:
                    dp = DecimalPlaces[-1]
                # round number
                rounded.append(round(num, dp))
        else:
            rounded = Grasshopper.DataTree[object]()

        # return outputs if you have them; here I try it for you:
        return rounded
# ---------- end rtd ----------
similar = Similarity(FirstNumber=rtd, SecondNumber="0", Threshold="1")  # -> Similarity, AbsoluteDifference
null_3 = NullItem(Item=rtd)  # -> NullFlags, InvalidFlags, Description
not_2 = GateNot(A=null_3.InvalidFlags)
or_4 = GateOr(A=not_2, B=similar.Similarity)
printing_geometry_has_lower_capsurface = Boolean(or_4)

printing_geometry_has_lower_capsurface_2 = Boolean(printing_geometry_has_lower_capsurface)
add_floor_to_open_objects_2 = Boolean(add_floor_to_open_objects)
printing_geometry_closed_2 = Boolean(printing_geometry_closed)
panel_6 = Panel("[SETTING IGNORED] Additional Floor option is only available if there is a lower boundary in the brep/mesh!")
panel_7 = Panel("[SETTING IGNORED] Additional Floor option is only available for open objects!")
additionalfloorinfo = AdditionalFloorInfo(
    PrintingGeometryClosed=printing_geometry_closed_2,
    AddFloorToOpenObjects=add_floor_to_open_objects_2,
    PrintingGeometryHasLowerBoundary=printing_geometry_has_lower_capsurface_2)  # -> GATE; inputs PrintingGeometryClosed: Boolean, AddFloorToOpenObjects: Boolean, PrintingGeometryHasLowerBoundary: Boolean
# ---------- additionalfloorinfo: Python ----------
import System
import Rhino
import Grasshopper

import rhinoscriptsyntax as rs

# GHENV COMPONENT SETTINGS
ghenv.Component.Name = "AdditionalFloorInfo"
ghenv.Component.NickName = "AdditionalFloorInfo"
ghenv.Component.Category = "DDUClayPrintingSlicer"
ghenv.Component.SubCategory = "9 Utilities"

class AdditionalFloorInfo(Grasshopper.Kernel.GH_ScriptInstance):
    """
    Author: Max Benjamin Eschenbach
    License: MIT License
    Version: 250314
    """
    def RunScript(self,
            PrintingGeometryClosed: bool,
            AddFloorToOpenObjects: bool,
            PrintingGeometryHasLowerBoundary: bool):
        GATE = 0
        if PrintingGeometryClosed is True and AddFloorToOpenObjects is True:
            GATE = 1
        elif PrintingGeometryClosed is False and AddFloorToOpenObjects is True:
            if PrintingGeometryHasLowerBoundary is False:
                GATE = 2
            else:
                GATE = 3
        return GATE
# ---------- end additionalfloorinfo ----------
floor_layer_count_4 = Integer(floor_layer_count)
format = Format(Format="[INFO] {0} Floor Layers are being added.", Culture=127, Data0=floor_layer_count_4)
filter_21 = StreamFilter(Gate=additionalfloorinfo, Stream1=panel_7, Stream2=panel_6)
comments_notes_21 = Panel("CREATE INFO MESSAGES")
filter_22 = StreamFilter(Gate=0, Stream0=filter_21, Stream1=format)
floor_info = Data(filter_22)

# ----
# VERIFY!
printing_geometry_has_lower_capsurface_3 = Boolean(printing_geometry_has_lower_capsurface)
not_3 = GateNot(A=printing_geometry_has_lower_capsurface_3)

panel_8 = Panel("[SETTING IGNORED] Mirkos Spiralization method is only available with planar printing paths!")
# CONTROL FLOW
# BACK-FORTH STITCHING OPEN CURVES
panel_9 = Panel("[INFO] Using Mirkos Spiralization Method...")
mirkos_spiralization_2 = Data(mirkos_spiralization)
spiralize_contours_2 = Data(spiralize_contours)
np_slicing_enabled_2 = Boolean(np_slicing_enabled)
equals = Equality(FirstNumber=mirkos_spiralization_2, SecondNumber="1")  # -> Equality, Inequality
and_5 = GateAnd(C=spiralize_contours_2, A=mirkos_spiralization_2, B=np_slicing_enabled_2)
equals_2 = Equality(FirstNumber=np_slicing_enabled_2, SecondNumber="0")  # -> Equality, Inequality
filter_23 = StreamFilter(Gate=and_5, Stream1=panel_8)
and_6 = GateAnd(C=spiralize_contours_2, A=equals.Equality, B=equals_2.Equality)
filter_24 = StreamFilter(Gate=and_6, Stream0=filter_23, Stream1=panel_9)
mirkos_spiralization_enabled = Data(and_6)
info_mirko_spiralize = Data(filter_24)

printing_geometry_6 = Geometry(printing_geometry_3)
layer_height_2 = Number(layer_height)
Z = UnitZ(Factor=1)
pt_3 = ConstructPoint(XCoordinate=0, YCoordinate=0, ZCoordinate="0.1")
contour = Contour(Shape=printing_geometry_6, Point=pt_3, Direction=Z, Distance=layer_height_2)
tstat_2 = TreeStatistics(Tree=contour)  # -> Paths, Length, Count
comments_notes_22 = Panel("CONTOURING PRINTING GEOMETRY")
item_2 = ListItem(List=tstat_2.Paths, Index=0, Wrap=True)
dpath = DeconstructPath(Branch=item_2)
lng = ListLength(List=dpath)  # -> expr("x-2", Length)
pshift = ShiftPaths(Data=contour, Offset=lng)
parallel_slice_curves = Data(pshift)

# ----
# CONTROL FLOW
# OPEN CRVS IN FIRST LAYER
# comments & notes: check first layer for open curves, forward boolean for floor addition (no floor possible with open curves...)
# comments & notes: CHECK FIRST LAYER FOR OPEN CURVES
inject_custom_curves_7 = Data(inject_custom_curves)
custom_curves_3 = Curve(custom_curves_input)
slice_polylines_2 = Data(parallel_slice_curves)
filter_25 = StreamFilter(Gate=inject_custom_curves_7, Stream0=slice_polylines_2, Stream1=custom_curves_3)
tstat_3 = TreeStatistics(Tree=filter_25)  # -> Paths, Length, Count
item_3 = ListItem(List=tstat_3.Paths, Index=0, Wrap=True)
branch_3 = TreeBranch(Tree=filter_25, Path=item_3, MaintainPaths=True)
cls = Closed(Curve=branch_3)  # -> Closed, Periodic
ma_3 = MassAddition(Input=cls.Closed)  # -> Result, PartialResults
smaller = SmallerThan(FirstNumber=ma_3.Result, SecondNumber="1")  # -> SmallerThan, OrEqualTo
first_layer_open_curves = Data(smaller.SmallerThan)

# ----
# comments & notes: PARALLEL FLOOR SLICING ENABLED?
printing_geometry_has_lower_capsurface_4 = Boolean(printing_geometry_has_lower_capsurface)
floor_layer_count_larger_than_zero_2 = Data(floor_layer_count_larger_than_zero)
add_floor_to_open_objects_3 = Boolean(add_floor_to_open_objects)
printing_geometry_closed_3 = Boolean(printing_geometry_closed)
first_layer_open_curves_2 = Data(first_layer_open_curves)
not_4 = GateNot(A=first_layer_open_curves_2)
or_5 = GateOr(A=printing_geometry_closed_3, B=add_floor_to_open_objects_3, C=printing_geometry_has_lower_capsurface_4)
and_7 = GateAnd(A=or_5, B=floor_layer_count_larger_than_zero_2, C=not_4)
regular_floor_slicing_enabled = Boolean(and_7)

# ----
# comments & notes: ADD FLOOR TO NP SLICING?
# comments & notes: ADD FLOOR TO CUSTOM CURVES?
floor_layer_count_larger_than_zero_3 = Data(floor_layer_count_larger_than_zero)
synthesize_floor_for_custom_curves_3 = Data(synthesize_floor_for_custom_curves)
floor_layer_count_larger_than_zero_4 = Data(floor_layer_count_larger_than_zero)
add_floor_to_open_objects_4 = Boolean(add_floor_to_open_objects)
first_layer_open_curves_3 = Data(first_layer_open_curves)
printing_geometry_closed_4 = Boolean(printing_geometry_closed)
inject_custom_curves_8 = Data(inject_custom_curves)
first_layer_open_curves_4 = Data(first_layer_open_curves)
np_slicing_enabled_3 = Boolean(np_slicing_enabled)
not_5 = GateNot(A=first_layer_open_curves_3)
not_6 = GateNot(A=printing_geometry_closed_4)
not_7 = GateNot(A=first_layer_open_curves_4)
and_8 = GateAnd(A=inject_custom_curves_8, B=synthesize_floor_for_custom_curves_3, C=floor_layer_count_larger_than_zero_3, D=not_5)
and_9 = GateAnd(A=np_slicing_enabled_3, B=not_6, C=floor_layer_count_larger_than_zero_4, D=add_floor_to_open_objects_4, E=not_3, F=not_7)
or_6 = GateOr(A=and_9, B=and_8)
filter_26 = StreamFilter(Gate=or_6, Stream0="False", Stream1="True")
add_floor_custom_curves_enabled = Boolean(and_8)
add_floor_slicing_enabled = Boolean(filter_26)

floor_layer_count_larger_than_zero_5 = Data(floor_layer_count_larger_than_zero)
layer_height_3 = Number(layer_height)
floor_layer_count_5 = Integer(floor_layer_count)
series = Series(Start="0.1", Step=layer_height_3, Count=floor_layer_count_5)
Z_2 = UnitZ(Factor=1)
filter_27 = StreamFilter(Gate=floor_layer_count_larger_than_zero_5, Stream1=series)
xy_4 = XYPlane(Origin=Point(0, 0, 0))
amp = Amplitude(Vector=Z_2, Amplitude=filter_27)
move_3 = Move(Geometry=xy_4, Motion=amp)  # -> flatten(Geometry), Transform
floor_slice_planes = Plane(graft(move_3.Geometry))

# ----
# comments & notes: split mesh with plane if additional floor is enabled
floor_slicing_enabled = Boolean(add_floor_slicing_enabled)
printing_geometry_7 = Geometry(printing_geometry_4)
floor_slice_planes_2 = Plane(flatten(floor_slice_planes))
layer_height_4 = Data(layer_height)
filter_28 = StreamFilter(Gate=floor_slicing_enabled, Stream1=floor_slice_planes_2)
filter_29 = StreamFilter(Gate=floor_slicing_enabled, Stream1=printing_geometry_7)
item_4 = ListItem(List=filter_28, Index=0, Wrap=True)  # -> Item1, Item
Z_3 = UnitZ(Factor=layer_height_4)
move_4 = Move(Geometry=item_4.Item1, Motion=Z_3)  # -> Geometry, Transform
msplit = MeshSplitPlane(Mesh=filter_29, Plane=move_4.Geometry)  # -> Above, Below
filter_30 = StreamFilter(Gate=floor_slicing_enabled, Stream0=printing_geometry_7, Stream1=msplit.Above)
printing_geometry_addfloorfiltered = Geometry(filter_30)

add_floor_slicing_enabled_2 = Boolean(add_floor_slicing_enabled)
printing_geometry_ismesh_3 = Boolean(printing_geometry_ismesh)
printing_geometry_8 = Geometry(printing_geometry)
filter_31 = StreamFilter(Gate=add_floor_slicing_enabled_2, Stream1=printing_geometry_8)
gate_8 = StreamGate(Stream=filter_31, Gate=printing_geometry_ismesh_3)  # -> Target0, Target1
gate_9 = StreamGate(Stream=floor_slice_planes, Gate=printing_geometry_ismesh_3)  # -> Target0, Target1
sec = MeshPlane(Mesh=gate_8.Target1, Plane=gate_9.Target1)
sec_2 = BrepPlane(Brep=gate_8.Target0, Plane=gate_9.Target0)  # -> Curves, Points
filter_32 = StreamFilter(Gate=printing_geometry_ismesh_3, Stream0=sec_2.Curves, Stream1=sec)
tstat_4 = TreeStatistics(Tree=filter_32)  # -> Paths, Length, Count
dpath_2 = DeconstructPath(Branch=tstat_4.Paths)
lng_2 = ListLength(List=dpath_2)
larger_2 = LargerThan(FirstNumber=lng_2, SecondNumber="2")  # -> LargerThan, OrEqualTo
ma_4 = MassAddition(Input=flatten(larger_2.LargerThan))  # -> Result, PartialResults
larger_3 = LargerThan(FirstNumber=ma_4.Result, SecondNumber="0")  # -> LargerThan, OrEqualTo
gate_10 = StreamGate(Stream=filter_32, Gate=larger_3.LargerThan)  # -> Target0, Target1
pshift_2 = ShiftPaths(Data=gate_10.Target1, Offset=expr("x*-1", "1"))
filter_33 = StreamFilter(Gate=larger_3.LargerThan, Stream0=gate_10.Target0, Stream1=pshift_2)
slice_curves_addfloor = Data(filter_33)

# ----
# ADDITIONAL FLOOR SLICING FOR
# OPEN OBJECT FLOOR ADDITION
# AND NP MESH FLOOR ADDITION
comments_notes_23 = Panel("FLOOR SLICING")

add_floor_slicing_enabled_3 = Boolean(add_floor_slicing_enabled)
slice_curves_addfloor_2 = Data(slice_curves_addfloor)
parallel_slice_curves_2 = Data(parallel_slice_curves)
filter_34 = StreamFilter(Gate=add_floor_slicing_enabled_3, Stream0=parallel_slice_curves_2, Stream1=slice_curves_addfloor_2)
slice_curves = Data(filter_34)

# ----
# comments & notes: extract low and high boundaries to use as heat/cold points
printing_geometry_addfloorfiltered_2 = Geometry(printing_geometry_addfloorfiltered)
medges_2 = MeshEdges(Mesh=printing_geometry_addfloorfiltered_2)  # -> NakedEdges, InteriorEdges, NonManifoldEdges
join_2 = JoinCurves(Curves=medges_2.NakedEdges, Preserve=False)
pcen_3 = PolygonCenter(Polyline=join_2)  # -> CenterV, CenterE, CenterA
pdecon_5 = Deconstruct(Point=pcen_3.CenterV)  # -> XComponent, YComponent, ZComponent
sort_2 = SortList(Keys=pdecon_5.ZComponent, ValuesA=join_2)  # -> Keys, ValuesA
open_boundaries_sorted = Curve(sort_2.ValuesA)
open_boundaries_zvalues = Data(sort_2.Keys)

# ----
# comments & notes: check curve length. only accept curves that are longer than (average length * 0.01)
slice_curves_2 = Data(slice_curves)
len = Length(Curve=slice_curves_2)
ma_5 = MassAddition(Input=flatten(len))  # -> Result, PartialResults
lng_3 = ListLength(List=flatten(len))
division = Division(A=ma_5.Result, B=lng_3)
multiplication = Multiplication(A=division, B="0.01")
larger_4 = LargerThan(FirstNumber=len, SecondNumber=multiplication)  # -> LargerThan, OrEqualTo
dispatch = Dispatch(List=slice_curves_2, DispatchPattern=larger_4.LargerThan)  # -> ListA, ListB
slice_curves_length_thresholded = Data(dispatch.ListA)

# ----
# PLANAR SLICING
comments_notes_24 = Panel("PLANAR SLICING")

# ----
# comments & notes: check if there is only one boundary. then check if this is near the bottom / the bottom boundary and create a control flow boolean from this info.
printing_geometry_floorfiltered = Geometry(printing_geometry_addfloorfiltered)
open_boundaries_sorted_2 = Curve(open_boundaries_sorted)
lng_4 = ListLength(List=open_boundaries_sorted_2)
equals_3 = Equality(FirstNumber=lng_4, SecondNumber="1")  # -> Equality, Inequality
filter_35 = StreamFilter(Gate=equals_3.Equality, Stream1=printing_geometry_floorfiltered)
open_boundaries_zvalues_2 = Data(open_boundaries_zvalues)
bbox_4 = BoundingBox(Content=filter_35, Plane=PlaneXY(0, 0, 0), UnionBox=True)  # -> Box, Box_2
debox_3 = DeconstructBox(Box=bbox_4.Box)  # -> Plane, X, Y, Z
filter_36 = StreamFilter(Gate=equals_3.Equality, Stream1=open_boundaries_zvalues_2)
dedomain_3 = DeconstructDomain(Domain=debox_3.Z)  # -> Start, End
division_2 = Division(A=filter_36, B=dedomain_3.End)
smaller_2 = SmallerThan(FirstNumber=division_2, SecondNumber="0.1")  # -> SmallerThan, OrEqualTo
and_10 = GateAnd(A=equals_3.Equality, B=smaller_2.OrEqualTo)
np_only_bot_boundary = Boolean(and_10)

# ----
# comments & notes: get low/high points for heat and cold points definition
open_boundaries_sorted_3 = Curve(open_boundaries_sorted)
explode_2 = Explode(Curve=open_boundaries_sorted_3, Recursive=True)  # -> Segments, Vertices
cullpt = CullDuplicates(Points=explode_2.Vertices, Tolerance="0.001", CullMode=3)  # -> simplify(Points), Indices, Valence
tstat_5 = TreeStatistics(Tree=cullpt.Points)  # -> Paths, Length, Count
item_5 = ListItem(List=tstat_5.Paths, Index=0, Wrap=True)  # -> Item1, Item
# NON-PLANAR SLICING FOR OPEN OBJECTS
branch_4 = TreeBranch(Tree=cullpt.Points, Path=item_5.Item1, MaintainPaths=True)
branch_5 = TreeBranch(Tree=cullpt.Points, Path=item_5.Item, MaintainPaths=True)
# comments & notes: catch cases where input is
# - more boundaries?
highpts = Point(branch_4)
lowpts = Point(branch_5)

# ----
# comments & notes: convert all contour curves to polylines with a resolution of 0.01 mm, cull all points within 0.001 mm tolerance, reduce polyline with a deviation of 0.025 mm
slice_curves_length_thresholded_2 = Data(slice_curves_length_thresholded)
topoly_3 = CurveToPolyline(Curve=graft(slice_curves_length_thresholded_2), ToleranceDistance="0.01", ToleranceAngle=0)  # -> Polyline, Segments
explode_3 = Explode(Curve=topoly_3.Polyline, Recursive=True)  # -> Segments, Vertices
cullpt_2 = CullDuplicates(Points=explode_3.Vertices, Tolerance="0.001", CullMode=3)  # -> Points, Indices, Valence
pshift_3 = ShiftPaths(Data=cullpt_2.Points, Offset=-2)
cls_2 = Closed(Curve=topoly_3.Polyline)  # -> Closed, Periodic
pline = PolyLine(Vertices=pshift_3, Closed=cls_2.Closed)
redpline = Reduce(Polyline=pline, Tolerance="0.025")  # -> Polyline, Reduction
pshift_4 = ShiftPaths(Data=redpline.Polyline, Offset=-1)
slice_polylines_3 = Data(pshift_4)

# ----
# comments & notes: brute force-close slice polylines with chunks missing
slice_make_closed_tolerance_2 = Data(slice_make_closed_tolerance)
slice_polylines_4 = Data(slice_polylines_3)
closeslice = CloseSlice(P=slice_polylines_4, t=slice_make_closed_tolerance_2)  # -> CP, R; inputs P: Polyline, t: Double
# ---------- closeslice: C# ----------
#region Usings
using System;
using System.Linq;
using System.Collections;
using System.Collections.Generic;
using System.Drawing;

using Rhino;
using Rhino.Geometry;

using Grasshopper;
using Grasshopper.Kernel;
using Grasshopper.Kernel.Data;
using Grasshopper.Kernel.Types;
#endregion

public class Script_Instance : GH_ScriptInstance
{
    #region Notes
    /* 
      Members:
        RhinoDoc RhinoDocument
        GH_Document GrasshopperDocument
        IGH_Component Component
        int Iteration

      Methods (Virtual & overridable):
        Print(string text)
        Print(string format, params object[] args)
        Reflect(object obj)
        Reflect(object obj, string method_name)

        Author: Max Benjamin Eschenbach
        License: MIT License
        Version: 250505
    */
    #endregion

    private void RunScript(Polyline P, double t, ref object CP, ref object R)
    {
        // GHENV COMPONENT SETTINGS
        this.Component.Name = "CloseSlice";
        this.Component.NickName = "CloseSlice";
        this.Component.Category = "DDUClayPrintingSlicer";
        this.Component.SubCategory = "1 Slicing";

        Polyline Slice;
        if (P == null)
        {
            CP = new DataTree<object>();
            R = new DataTree<object>();
            return;
        }
        if (t == null)
        {
            t = 0;
        }

        Slice = P.Duplicate();

        if (Slice.IsClosed)
        {
            CP = Slice;
            R = true;
        }
        else
        {
            if (t == 0)
            {
                Slice.Add(new Point3d(Slice[0]));
                CP = Slice;
                R = true;
            }
            else if (t > 0.0 && Slice[0].DistanceTo(Slice.Last) < t)
            {
                Slice.Add(new Point3d(Slice[0]));
                CP = Slice;
                R = true;
            }
            else if (t > 0.0 && Slice[0].DistanceTo(Slice.Last) > t)
            {
                CP = Slice;
                R = false;
            }
        }
    }
}
# ---------- end closeslice ----------
slice_polylines_5 = Data(closeslice.CP)

# ----
# comments & notes: if there is only a bottom boundary, these need to be the heatpoints. if there's bottom and top boundary, bottom will be coldppints and top will be heatpoints
only_bot_boundary = Boolean(np_only_bot_boundary)
highpts_2 = Point(highpts)
lowpts_2 = Point(lowpts)
# comments & notes: NON-PLANAR SLICING FOR OPEN OBJECTS
printing_geometry_addfloorfiltered_3 = Geometry(printing_geometry_addfloorfiltered)
demesh_2 = DeconstructMesh(Mesh=printing_geometry_addfloorfiltered_3)  # -> Vertices, Faces, Colours, Normals
miniterations = Slider(2000, range=0..5000)
texturescale = Slider(5, range=0.01..100)
iterationspervertex = Slider(0.2, range=0..1)
filter_37 = StreamFilter(Gate=only_bot_boundary, Stream0=highpts_2, Stream1=lowpts_2)
filter_38 = StreamFilter(Gate=only_bot_boundary, Stream0=lowpts_2)
open_boundaries_sorted_4 = Curve(open_boundaries_sorted)
lng_5 = ListLength(List=demesh_2.Vertices)
coldpts = Point(filter_38)
heatpts = Point(filter_37)
multiplication_2 = Multiplication(A=lng_5, B=iterationspervertex)
max = Maximum(A=miniterations, B=multiplication_2)
heatmethodstatic = HeatMethodStatic(
    RefMesh=printing_geometry_addfloorfiltered_3,
    HeatPoints=heatpts,
    ColdPoints=coldpts,
    IsoFixCurves=open_boundaries_sorted_4,
    TextureScale=texturescale,
    Threshold="1e-6",
    MaxIterations=max)  # -> HeatMesh, Values, Gradient; inputs RefMesh: Mesh, HeatPoints: list of Point3d, ColdPoints: list of Point3d, IsoFixCurves: list of Polyline, TextureScale: Double, Threshold: Double, MaxIterations: Int32
#   port RefMesh: The mesh for geodesic distance computation.
#   port HeatPoints: The points from which the heat spreads during the heat diffusion step. The value of these points will stay 1 during the heat diffusion step.
#   port ColdPoints: The points that will stay cold during the heat diffusion step. Their value will be 0 during this step.
#   port IsoFixCurves: Defines one or many polylines where the iso value will be the same at every point of the polyline. NOTE: The iso values are allowed to change but will stay the same across the whole polyline!
#   port TextureScale: Scaling factor for the TextureCoordinates. Defaults to 1.0
#   port Threshold: Threshold for the Heat Diffusion Step.
#   port MaxIterations: Maximum iterations to run the heat diffusion and poisson step for. Defaults to 200.
# ---------- heatmethodstatic: C# ----------
#region Usings
using System;
using System.Linq;
using System.Collections;
using System.Collections.Generic;
using System.Drawing;
using System.Threading.Tasks;

using Rhino;
using Rhino.Geometry;

using Grasshopper;
using Grasshopper.Kernel;
using Grasshopper.Kernel.Data;
using Grasshopper.Kernel.Types;

#r "KangarooSolver.dll"
using KPlankton;
#endregion

public class Script_Instance : GH_ScriptInstance
{
    #region Notes
    /* 
      Members:
        RhinoDoc RhinoDocument
        GH_Document GrasshopperDocument
        IGH_Component Component
        int Iteration

      Methods (Virtual & overridable):
        Print(string text)
        Print(string format, params object[] args)
        Reflect(object obj)
        Reflect(object obj, string method_name)
    
        Author: Original Script by Daniel Piker 03/07/2020, Modified by Max Benjamin Eschenbach May 2021
        License: MIT License
        Version: 250314
    */
    #endregion

    private void RunScript(
		Mesh RefMesh,
		List<Point3d> HeatPoints,
		List<Point3d> ColdPoints,
		List<Polyline> IsoFixCurves,
		double TextureScale,
		double Threshold,
		int MaxIterations,
		ref object HeatMesh,
		ref object Values,
		ref object Gradient)
    {
        // set component params
        this.Component.Name = "HeatMethodStatic";
        this.Component.NickName = "HeatMethodStatic";
        this.Component.Category = "DDUClayPrintingSlicer";
        this.Component.SubCategory = "1 Slicing";

        // set defaults
        bool abort = false;
        if (RefMesh == null)
        {
        this.Component.AddRuntimeMessage(GH_RuntimeMessageLevel.Warning,
            "Input Parameter RefMesh failed to collect data!");
        abort = true;
        }

        if (MaxIterations == 0) MaxIterations = 200;
        if (abort)
        {
        HeatMesh = new DataTree<Object>();
        Values = new DataTree<Object>();
        Gradient = new DataTree<Object>();
        return;
        }

        // init variables
        double[] values;
        double[][] storedweights;
        int[][] storedneighbours;
        Vector3d[] gradient;
        Vector3d[] edgeGradient;
        int[] fix;
        int[][] equalize;
        Mesh ResultMesh;

        // init vars for threshold tracking
        double heat_avg = 0;
        double poisson_avg = 0;
        bool converged = false;

        // INITIALIZE HEAT METHOD -----------------------------------------------

        // convert all quads to triangles
        RefMesh.Faces.ConvertQuadsToTriangles();

        // get kplankton mesh
        KPlanktonMesh ReferencePMesh = KPlankton.RhinoSupport.ToKPlanktonMesh(RefMesh);

        int vc = ReferencePMesh.Vertices.Count;
        storedweights = new double[vc][];
        storedneighbours = new int[vc][];
        values = new double[vc];
        fix = new int[vc];
        equalize = new int[IsoFixCurves.Count][];
        for(int i = 0;i < vc;i++)
        {
            storedweights[i] = ComputeCotanWeights(ReferencePMesh, i);
            storedneighbours[i] = ReferencePMesh.Vertices.GetVertexNeighbours(i);
            for(int j = 0;j < HeatPoints.Count;j++)
            {
                if(ReferencePMesh.Vertices[i].ToPoint3d().DistanceToSquared(HeatPoints[j]) < Rhino.RhinoDoc.ActiveDoc.ModelAbsoluteTolerance)
                {
                    values[i] = 1;
                    fix[i] = 1;
                }
            }
            for(int j = 0;j < ColdPoints.Count;j++)
            {
                if(ReferencePMesh.Vertices[i].ToPoint3d().DistanceToSquared(ColdPoints[j]) < Rhino.RhinoDoc.ActiveDoc.ModelAbsoluteTolerance)
                {
                    values[i] = 0;
                    fix[i] = 2;
                }
            }
        }

        for(int i = 0;i < IsoFixCurves.Count;i++)
        {
            Polyline thisPoly = IsoFixCurves[i];
            int polyCount = thisPoly.Count;
            if(thisPoly[thisPoly.Count - 1].Equals(thisPoly[0])) polyCount--;//don't count first point twice for closed curves
            equalize[i] = new int[polyCount];
            for(int j = 0;j < polyCount;j++)
            {
                for(int k = 0;k < vc;k++)
                {
                    if(ReferencePMesh.Vertices[k].ToPoint3d().DistanceToSquared(thisPoly[j]) < Rhino.RhinoDoc.ActiveDoc.ModelAbsoluteTolerance)
                    {
                        equalize[i][j] = k;
                        break;
                    }
                }
            }
        }

        gradient = new Vector3d[vc];
        ResultMesh = RefMesh.DuplicateMesh();

        edgeGradient = null;

        // HEAT DIFFUSION -----------------------------------------------------

        int heat_iters = 0;
        for(int k = 0; k < MaxIterations; k++)
        {
        heat_iters += 1;
        double[] newValues = new double[values.Length];
        Parallel.For(0, ReferencePMesh.Vertices.Count,
            i => {

            if(fix[i] == 0)
            {
            int[] neighbours = storedneighbours[i];
            double[] weights = storedweights[i];
            double newValue = 0;
            for(int j = 0;j < neighbours.Length;j++)
            {
                newValue += weights[j] * values[neighbours[j]];
            }
            newValues[i] = newValue;
            }
            else newValues[i] = values[i];
            });

        for(int i = 0; i < equalize.Length; i++)
        {
            double avg = 0;
            for(int j = 0;j < equalize[i].Length;j++)avg += newValues[equalize[i][j]];
            avg /= equalize[i].Length;
            for(int j = 0;j < equalize[i].Length;j++) newValues[equalize[i][j]] = avg;
        }
        values = newValues;

        // track average heat value change
        double this_heat_avg = System.Linq.Enumerable.Average(values);
        double heat_avg_change = Math.Abs(this_heat_avg - heat_avg);
        heat_avg = this_heat_avg;

        // break if threshold is reached
        if (heat_avg <= Threshold)
        {
            converged = true;
            break;
        }
        }

        double min = values.Min();
        double max = values.Max();
        double mult = 1.0 / (max - min);
        for(int i = 0;i < values.Length;i++) values[i] = mult * (values[i] - min);

        edgeGradient = null;

        // POISSON AVERAGING --------------------------------------------------

        if(edgeGradient == null)
        {
        gradient = ComputeGradients(ReferencePMesh, values);
        double avgGradientLength = 0;
        for(int i = 0;i < gradient.Length;i++)
        {
            avgGradientLength += gradient[i].Length;
        }
        avgGradientLength /= gradient.Length;

        edgeGradient = new Vector3d[ReferencePMesh.Halfedges.Count / 2];
        for(int i = 0;i < ReferencePMesh.Halfedges.Count / 2;i++)
        {
            int start = ReferencePMesh.Halfedges[2 * i].StartVertex;
            int end = ReferencePMesh.Halfedges[(2 * i) + 1].StartVertex;
            Vector3d sv = gradient[start];
            Vector3d ev = gradient[end];
            Vector3d thisEdgeGradient = sv + ev;
            thisEdgeGradient.Unitize();
            thisEdgeGradient *= avgGradientLength;
            edgeGradient[i] = thisEdgeGradient;
        }
        }

        int ps_iters = 0;
        for(int k = 0; k < MaxIterations; k++)
        {
        ps_iters++;
        double[] heChange = new double[ReferencePMesh.Halfedges.Count];
        Parallel.For(0, ReferencePMesh.Halfedges.Count / 2,
            i => {
            int start = ReferencePMesh.Halfedges[2 * i].StartVertex;
            int end = ReferencePMesh.Halfedges[(2 * i) + 1].StartVertex;
            Vector3d edgeVector = ReferencePMesh.Vertices[end].ToPoint3d() - ReferencePMesh.Vertices[start].ToPoint3d();
            double projected = edgeVector * edgeGradient[i];
            double currentDifference = values[end] - values[start];
            double change = currentDifference - projected;
            heChange[2 * i] = 1 * change;
            heChange[(2 * i) + 1] = -1 * change;
            });

        Parallel.For(0, ReferencePMesh.Vertices.Count,
            i => {
            {
            {
                double[] weights = storedweights[i];
                int[] halfedges = ReferencePMesh.Vertices.GetHalfedges(i);
                for(int j = 0;j < halfedges.Length;j++)
                {
                values[i] += heChange[halfedges[j]] * weights[j];
                }
            }
            }
            });

        double this_poisson_avg = 0;
        for(int i = 0;i < equalize.Length;i++)
        {
            double avg = 0;
            for(int j = 0;j < equalize[i].Length;j++)avg += values[equalize[i][j]];
            avg /= equalize[i].Length;
            for(int j = 0;j < equalize[i].Length;j++) values[equalize[i][j]] = avg;
            this_poisson_avg = avg;
        }

        // track average value change for poisson step
        double poisson_avg_change = Math.Abs(this_poisson_avg - poisson_avg);
        poisson_avg = this_poisson_avg;

        /*
        if (poisson_avg_change <= Threshold)
        {
            converged = true;
            break;
        }
        */
        }

        if (converged == true)
        {
        this.Component.Message = String.Format("Converged.\n{0} Heat Diffusion iterations", heat_iters);
        }
        else
        {
        this.Component.Message = "MaxIterations reached!";
        }


        // SET TEXTURE COORDINATES ----------------------------------------------

        for(int i = 0;i < ResultMesh.Vertices.Count;i++)
        {
        ResultMesh.TextureCoordinates.SetTextureCoordinate(i, new Point2f(0, (float) (values[i] * TextureScale)));
        }

        // OUTPUT ----------------------------------------------------------------

        // input mesh with adjusted texture coordinates
        HeatMesh = ResultMesh;
        // the scalar values and gradient vectors per vertex
        Values = values;
        Gradient = gradient;
    }

    private static Vector3d[] ComputeGradients(KPlanktonMesh KPM, double[] values)
    {
        // compute halfedge gradients
        Vector3d[] halfedgeGradients = new Vector3d[KPM.Halfedges.Count];
        for(int i = 0;i < KPM.Halfedges.Count / 2;i++)
        {
        int start = KPM.Halfedges[2 * i].StartVertex;
        int end = KPM.Halfedges[2 * i + 1].StartVertex;
        Vector3d v = KPM.Vertices[end].ToPoint3d() - KPM.Vertices[start].ToPoint3d();
        double lengthSquared = v.SquareLength;
        double diff = values[end] - values[start];
        Vector3d edgeGradient = v * (diff / lengthSquared);
        halfedgeGradients[2 * i] = halfedgeGradients[2 * i + 1] = edgeGradient;
        }

        // compute vertex gradients from halfedge gradients
        Vector3d[] vertexGradients = new Vector3d[KPM.Vertices.Count];
        for(int i = 0;i < KPM.Vertices.Count;i++)
        {
        double[] weights = ComputeCotanWeights(KPM, i);
        Vector3d gradient = new Vector3d();
        int[] halfedges = KPM.Vertices.GetHalfedges(i);
        for(int j = 0;j < halfedges.Length;j++)
        {
            gradient += halfedgeGradients[halfedges[j]] * weights[j];
        }
        vertexGradients[i] = gradient;
        }
        return vertexGradients;
    }

    private static double[] ComputeCotanWeights(KPlanktonMesh KPM, int i)
    {
        int[] Neighbours = KPM.Vertices.GetVertexNeighbours(i);
        Point3d Vertex = KPM.Vertices[i].ToPoint3d();
        int valence = KPM.Vertices.GetValence(i);
        Point3d[] NeighbourPts = new Point3d[valence];
        Vector3d[] Radial = new Vector3d[valence];
        Vector3d[] Around = new Vector3d[valence];
        double[] CotWeight = new double[valence];
        double WeightSum = 0;
        for (int j = 0; j < valence; j++)
        {
        NeighbourPts[j] = KPM.Vertices[Neighbours[j]].ToPoint3d();
        Radial[j] = NeighbourPts[j] - Vertex;
        }
        for (int j = 0; j < valence; j++)
        {
        Around[j] = NeighbourPts[(j + 1) % valence] - NeighbourPts[j];
        }
        int[] halfEdges = KPM.Vertices.GetHalfedges(i);
        for (int j = 0; j < Neighbours.Length; j++)
        {
        int previous = (j + valence - 1) % valence;
        int next = (j + 1) % valence;

        Vector3d Cross1 = Vector3d.CrossProduct(Radial[previous], Around[previous]);
        double Dot1 = Radial[previous] * Around[previous];
        double cwa = Math.Abs(Dot1 / Cross1.Length);

        Vector3d Cross2 = Vector3d.CrossProduct(Radial[next], Around[j]);
        double Dot2 = Radial[next] * Around[j];
        double cwb = Math.Abs(Dot2 / Cross2.Length);

        if(KPM.Halfedges[halfEdges[j]].AdjacentFace == -1){cwa = 0;}
        if(KPM.Halfedges[KPM.Halfedges.GetPairHalfedge(halfEdges[j])].AdjacentFace == -1){cwb = 0;}
        CotWeight[j] = cwa + cwb;
        WeightSum += CotWeight[j];
        }
        for (int j = 0; j < CotWeight.Length; j++) CotWeight[j] /= WeightSum;
        return CotWeight;
    }

}
# ---------- end heatmethodstatic ----------
heatvalues = Data(heatmethodstatic.Values)
heatmesh = Mesh(heatmethodstatic.HeatMesh)

# ----
# comments & notes: WHAT TO DO ABOUT OPEN CURVES/SURFACES??
slice_polylines_6 = Data(slice_polylines_5)
cls_3 = Closed(Curve=slice_polylines_6)  # -> Closed, Periodic
lng_6 = ListLength(List=slice_polylines_6)
larger_5 = LargerThan(FirstNumber=lng_6, SecondNumber="1")  # -> LargerThan, OrEqualTo
ma_6 = MassAddition(Input=flatten(larger_5.LargerThan))  # -> Result, PartialResults
ma_7 = MassAddition(Input=cls_3.Closed)  # -> Result, PartialResults
larger_6 = LargerThan(FirstNumber=ma_7.Result, SecondNumber="0")  # -> LargerThan, OrEqualTo
larger_7 = LargerThan(FirstNumber=ma_6.Result, SecondNumber="1")  # -> LargerThan, OrEqualTo
and_11 = GateAnd(A=larger_6.LargerThan, B=larger_7.LargerThan)  # -> flatten(Result)
ma_8 = MassAddition(Input=and_11)  # -> Result, PartialResults
larger_8 = LargerThan(FirstNumber=ma_8.Result, SecondNumber="0")  # -> LargerThan, OrEqualTo
branching_curves = Data(larger_8.LargerThan)
gate_11 = StreamGate(Stream=slice_polylines_6, Gate=branching_curves)  # -> Target0, Target1
orderbranchingslices = OrderBranchingSlices(Slices=gate_11.Target1)  # -> out, OrderedSlices; inputs Slices: tree of Curve
# ---------- orderbranchingslices: C# ----------
// Grasshopper Script Instance
#region Usings
using System;
using System.Linq;
using System.Collections;
using System.Collections.Generic;
using System.Drawing;

using Rhino;
using Rhino.Geometry;
using Rhino.Collections;

using Grasshopper;
using Grasshopper.Kernel;
using Grasshopper.Kernel.Data;
using Grasshopper.Kernel.Types;
#endregion

public class Script_Instance : GH_ScriptInstance
{
    #region Notes
    /* 
      Members:
        RhinoDoc RhinoDocument
        GH_Document GrasshopperDocument
        IGH_Component Component
        int Iteration

      Methods (Virtual & overridable):
        Print(string text)
        Print(string format, params object[] args)
        Reflect(object obj)
        Reflect(object obj, string method_name)

    Author: Max Benjamin Eschenbach
    License: MIT License
    Version: 250314
    */
    #endregion

    private void RunScript(DataTree<Curve> Slices, ref object OrderedSlices)
    {
        // set component params
        this.Component.Name = "OrderBranchingSlices";
        this.Component.NickName = "OrderBranchingSlices";
        this.Component.Category = "DDUClayPrintingSlicer";
        this.Component.SubCategory = "2 Slice Processing";

        double tol = Rhino.RhinoDoc.ActiveDoc.ModelAbsoluteTolerance;
        DataTree<Brep> SliceSurfaces = new DataTree<Brep>();
        for (int i = 0; i < Slices.BranchCount; i++)
        {
            GH_Path ghp = new GH_Path(Slices.Paths[i]);
            Brep[] planarBreps = Brep.CreatePlanarBreps(Slices.Branches[i], tol);
            if (planarBreps != null && planarBreps.Length > 0)
            {
                SliceSurfaces.AddRange(planarBreps, ghp);
            }
            
        }
        OrderedSlices = OrderSliceSurfaces(SliceSurfaces);
    }

    public Point3d GetSurfaceCentroid(Brep srf)
    {
        Curve[] borders = srf.DuplicateEdgeCurves(false);
        Point3d centroid_sum = new Point3d(0, 0, 0);
        for (int i = 0; i < borders.Length; i++)
        {

        centroid_sum += borders[i].ToPolyline(0.1, 0, 0, 0).ToPolyline().CenterPoint();
        }
        return centroid_sum / borders.Length;
    }

    public DataTree<Brep> OrderSliceSurfaces(DataTree<Brep> SliceSurfaces)
    {
        // loop over datatree and ensure correct order
        for (int i = 0; i < SliceSurfaces.BranchCount - 1; i++)
        {
        // get branches
        var this_branch = SliceSurfaces.Branches[i];
        var next_branch = SliceSurfaces.Branches[i + 1];

        // case 1: this branch one curve and next branch one curve
        if (this_branch.Count == 1 && next_branch.Count == 1)
        {
            Print("Case 1, 1 -> 1 (nothing done)");
            // nothing needs to be done
        }
            // case 2: this branch one curve and next branch multiple curves
        else if (this_branch.Count == 1 && next_branch.Count > 1)
        {
            Print("Case 2, 1 -> N");
            // loop over next branch and find all centerpoints to compare against
            Point3dList ptL = new Point3dList();
            for (int k = 0; k < next_branch.Count; k++)
            {
            //Point3d cpB = AreaMassProperties.Compute(next_branch[k]).Centroid;
            Point3d cpB = GetSurfaceCentroid(next_branch[k]);
            ptL.Add(cpB);
            }
            // create new list for storage
            List<Brep> OrderedNextBranch = new List<Brep>();
            // get curve centerpoint
            // Point3d cpA = AreaMassProperties.Compute(this_branch[0]).Centroid;
            Point3d cpA = GetSurfaceCentroid(this_branch[0]);
            // compare against point3dlist of other centerpoints
            int idx = ptL.ClosestIndex(cpA);
            OrderedNextBranch.Add((Brep) next_branch[idx].Duplicate());
            next_branch.RemoveAt(idx);
            OrderedNextBranch.AddRange(next_branch);
            // clear data
            ptL.Clear();
            // restructure next branch of contours tree
            SliceSurfaces.Branches[i + 1].Clear();
            SliceSurfaces.Branches[i + 1].AddRange(OrderedNextBranch);
        }
            // case 3: this branch and next branch have multiple curves but the same count
        else if (this_branch.Count > 1 && this_branch.Count == next_branch.Count)
        {
            Print("Case 3, N -> N");
            // create new list for storage
            List<Brep> OrderedNextBranch = new List<Brep>();
            // loop over all curves in this branch
            for (int j = 0; j < this_branch.Count; j++)
            {
            if (next_branch.Count < 1) break;
            // loop over next branch and find all centerpoints to compare against
            Point3dList ptL = new Point3dList();
            for (int k = 0; k < next_branch.Count; k++)
            {
                //Point3d cpB = AreaMassProperties.Compute(next_branch[k]).Centroid;
                Point3d cpB = GetSurfaceCentroid(next_branch[k]);
                ptL.Add(cpB);
            }
            // get curve centerpoint
            //Point3d cpA = AreaMassProperties.Compute(this_branch[j]).Centroid;
            Point3d cpA = GetSurfaceCentroid(this_branch[j]);
            // compare against point3dlist of other centerpoints
            int idx = ptL.ClosestIndex(cpA);
            // add closest item to ordered list
            OrderedNextBranch.Add((Brep) next_branch[idx].Duplicate());
            // remove closest item from candidates
            next_branch.RemoveAt(idx);
            // clear data
            ptL.Clear();
            }
            // restructure next branch of contours tree
            SliceSurfaces.Branches[i + 1].Clear();
            SliceSurfaces.Branches[i + 1].AddRange(OrderedNextBranch);
        }
            // case 4: this branch has more curves than next branch
        else if (this_branch.Count > 1 && next_branch.Count > 1 && this_branch.Count > next_branch.Count)
        {
            Print("Case 4, N -> M>N (VERIFY!)");
            // create new list for storage
            List<Brep> OrderedNextBranch = new List<Brep>();
            // loop over all curves in this branch
            for (int j = 0; j < this_branch.Count; j++)
            {
            if (next_branch.Count < 1) break;
            // loop over next branch and find all centerpoints to compare against
            Point3dList ptL = new Point3dList();
            for (int k = 0; k < next_branch.Count; k++)
            {
                //Point3d cpB = AreaMassProperties.Compute(next_branch[k]).Centroid;
                Point3d cpB = GetSurfaceCentroid(next_branch[k]);
                ptL.Add(cpB);
            }
            // get curve centerpoint
            //Point3d cpA = AreaMassProperties.Compute(this_branch[j]).Centroid;
            Point3d cpA = GetSurfaceCentroid(this_branch[j]);
            // compare against point3dlist of other centerpoints
            int idx = ptL.ClosestIndex(cpA);
            // add closest item to ordered list
            OrderedNextBranch.Add((Brep) next_branch[idx].Duplicate());
            // remove closest item from candidates
            next_branch.RemoveAt(idx);
            // clear data
            ptL.Clear();
            }
            // restructure next branch of contours tree
            SliceSurfaces.Branches[i + 1].Clear();
            SliceSurfaces.Branches[i + 1].AddRange(OrderedNextBranch);
        }
            // case 5: this branch has less curves than next branch
        else if (this_branch.Count > 1 && next_branch.Count > 1 && this_branch.Count < next_branch.Count)
        {
            Print("Case 5, N -> M<N (VERIFY)");
            // loop over next branch and find all centerpoints to compare against
            Point3dList ptL = new Point3dList();
            for (int k = 0; k < next_branch.Count; k++)
            {
            //Point3d cpB = AreaMassProperties.Compute(next_branch[k]).Centroid;
            Point3d cpB = GetSurfaceCentroid(next_branch[k]);
            ptL.Add(cpB);
            }
            // create new list for storage
            List<Brep> OrderedNextBranch = new List<Brep>();
            // create duplicate list for looping
            List<Brep> next_branch_dup = new List<Brep>(next_branch);
            // loop over all curves in this branch
            for (int j = 0; j < this_branch.Count; j++)
            {
            // get curve centerpoint
            //Point3d cpA = AreaMassProperties.Compute(this_branch[j]).Centroid;
            Point3d cpA = GetSurfaceCentroid(this_branch[j]);
            // compare against point3dlist of other centerpoints
            int idx = ptL.ClosestIndex(cpA);
            // add closest curve based on comparison to new list
            OrderedNextBranch.Add((Brep) next_branch[idx].Duplicate());
            next_branch_dup.Remove(next_branch[idx]);
            }
            // add remaining curves from next branch to list
            OrderedNextBranch.AddRange(next_branch_dup);
            // clear data
            ptL.Clear();
            // restructure next branch of contours tree
            SliceSurfaces.Branches[i + 1].Clear();
            SliceSurfaces.Branches[i + 1].AddRange(OrderedNextBranch);
        }
            // case 6: this branch has multiple curves but next branch only has one
        else if (this_branch.Count > 1 && next_branch.Count == 1)
        {
            Print("Case 6, N -> 1 (nothing done)");
        }
        }

        return SliceSurfaces;
    }
}
# ---------- end orderbranchingslices ----------
panel_10 = Panel(orderbranchingslices.out)
ordered_slice_srfs = Data(orderbranchingslices.OrderedSlices)

slice_polylines_7 = Data(slice_polylines_5)
pcen_4 = PolygonCenter(Polyline=slice_polylines_7)  # -> CenterV, CenterE, CenterA
avr_3 = Average(Input=pcen_4.CenterA)
xy_5 = XYPlane(Origin=avr_3)
slice_planes = Data(xy_5)

# ----
# comments & notes: iso-contouring based on heatmesh texture coordinates
# comments & notes: "reverse" the order of the data tree (non-planar contour curves) if there is only a bottom boundary (high values will be at the bottom instead of at the top, hence curves need to be reversed in order).
np_only_bot_boundary_2 = Boolean(np_only_bot_boundary)
layer_height_5 = Data(layer_height)
heatmesh_2 = Mesh(heatmesh)
bbox_5 = BoundingBox(Content=heatmesh_2, Plane=PlaneXY(0, 0, 0), UnionBox=True)  # -> Box, Box_2
debox_4 = DeconstructBox(Box=bbox_5.Box)  # -> Plane, X, Y, Z
dedomain_4 = DeconstructDomain(Domain=debox_4.Z)  # -> Start, End
subtraction = Subtraction(A=dedomain_4.End, B=dedomain_4.Start)
division_3 = Division(A=subtraction, B=layer_height_5)
round = Round(Number=division_3)  # -> Nearest, Floor, Ceiling
isocontourmeshcount = IsoContourMeshCount(InMesh=heatmesh_2, Count=round.Ceiling)  # -> out, Contours, DebuggingOut; inputs InMesh: Mesh, Count: Int32
# ---------- isocontourmeshcount: C# ----------
// Grasshopper Script Instance
#region Usings
using System;
using System.Linq;
using System.Collections;
using System.Collections.Generic;
using System.Drawing;

using Rhino;
using Rhino.Geometry;

using System.Threading.Tasks;
using System.Collections.Concurrent;
using Rhino.Collections;

using Grasshopper;
using Grasshopper.Kernel;
using Grasshopper.Kernel.Data;
using Grasshopper.Kernel.Types;
#endregion

public class Script_Instance : GH_ScriptInstance
{
    #region Notes
    /* 
      Members:
        RhinoDoc RhinoDocument
        GH_Document GrasshopperDocument
        IGH_Component Component
        int Iteration

      Methods (Virtual & overridable):
        Print(string text)
        Print(string format, params object[] args)
        Reflect(object obj)
        Reflect(object obj, string method_name)

    Original Script by Daniel Piker 03/07/2020
    Modified by Max Benjamin Eschenbach May 2024
    Version: 250314
    */
    #endregion

    private void RunScript(
		Mesh InMesh,
		int Count,
		ref object Contours,
		ref object DebuggingOut)
    {
    // set component params
    this.Component.Name = "IsoContourMeshCount";
    this.Component.NickName = "IsoContourMeshCount";
    this.Component.Category = "DDUClayPrintingSlicer";
    this.Component.SubCategory = "1 Slicing";

    // sanitize data input
    if (InMesh == null)
    {
      this.Component.AddRuntimeMessage(GH_RuntimeMessageLevel.Warning,
        "Input Parameter InMesh failed to collect data!");
      Contours = new Grasshopper.DataTree<PolylineCurve>();
    }
    // only do something if mesh is present
    if (InMesh != null && Count > 0)
    {
      // Contours = OrderSliceCurves(CreateContours(InMesh, Count));
      var UnorderedContours = CreateContours(InMesh, Count);
      Contours = OrderSliceCurves(UnorderedContours);
    }
    else
    {
      this.Component.AddRuntimeMessage(GH_RuntimeMessageLevel.Warning, "Input Parameters failed to collect data!");
    }
    }

  public List<Curve> FindBoundaries(Mesh M)
  {
    // get naked mesh edges
    Polyline[] NakedEdges = M.GetNakedEdges();

    // join all the resulting naked edges
    Curve[] Boundaries = Curve.JoinCurves(NakedEdges.Select(pl => pl.ToPolylineCurve()));

    return Boundaries.ToList();
  }

  public DataTree<PolylineCurve> CreateContours(Mesh M, int Count)
  {
    // subtract from the count to make count match the outcome
    Count -= 2;

    // init concurrent bag for storing contours
    List<PolylineCurve>[] contours = new List<PolylineCurve>[Count];

    // extract gradient from texture coordinates
    double[] values = new double[M.Vertices.Count];
    for(int i = 0; i < M.Vertices.Count; i++) values[i] = M.TextureCoordinates[i].Y;

    // get bounds of gradient value domain
    double target_min = values.Min();
    double target_max = values.Max();

    // compute stepsize for iso values
    // increment count to avoid catching boundary extremes
    // (they will be found later)
    double stepsize = (target_max - target_min) / (Count + 1.0);

    // create contours in parallel
    Parallel.For(0, Count,
      j => {
      // compute current iso value
      double iso = target_min + ((j + 1) * stepsize);

      // init list for geometry storage
      List<Curve> curves = new List<Curve>();

      // loop over all faces
      for(int i = 0; i < M.Faces.Count; i++)
      {
        int va = M.Faces[i].A;
        int vb = M.Faces[i].B;
        int vc = M.Faces[i].C;

        double a = M.TextureCoordinates[va].Y - iso;
        double b = M.TextureCoordinates[vb].Y - iso;
        double c = M.TextureCoordinates[vc].Y - iso;

        Point3d pa = M.Vertices.Point3dAt(va);
        Point3d pb = M.Vertices.Point3dAt(vb);
        Point3d pc = M.Vertices.Point3dAt(vc);

        List<Point3d> ends = new List<Point3d>();

        // find line segment
        if(a < 0 != b < 0)
        {
          double wa = b / (b - a);
          double wb = 1 - wa;
          ends.Add(wa * pa + wb * pb);
        }
        if(a < 0 != c < 0)
        {
          double wa = c / (c - a);
          double wc = 1 - wa;
          ends.Add(wa * pa + wc * pc);
        }
        if(c < 0 != b < 0)
        {
          double wb = c / (c - b);
          double wc = 1 - wb;
          ends.Add(wb * pb + wc * pc);
        }

        // if line segment is complete add it to list
        if(ends.Count == 2)
        {
          curves.Add(new LineCurve(ends[0], ends[1]));
        }
      }

      // join contour lines
      Curve[] jcrvs = Curve.JoinCurves(curves);

      // init list for storing closed curves
      List<PolylineCurve> clsdcrvs = new List<PolylineCurve>();

      // only add closed curves
      for (int i = 0; i < jcrvs.Length; i++)
      {
        if (jcrvs[i].IsClosed)
        {
          clsdcrvs.Add(jcrvs[i] as PolylineCurve);
        }
      }
      // add list of closed curves to array
      contours[j] = clsdcrvs;

      // end parallel for
      });

    // convert array results to datatree for output
    DataTree<PolylineCurve> ContourTree = new DataTree<PolylineCurve>();
    for (int i = 0; i < contours.Length; i++)
    {
      // create path in datatre
      // increment i because of intentionally missing extremes
      GH_Path path = new GH_Path(0, i + 1);
      ContourTree.AddRange(contours[i], path);
    }

    // find extreme boundaries seperately
    // this is necessary because of stability issues
    // with the iso routine near the boundaries
    List<Curve> Boundaries = FindBoundaries(M);

    // loop through boundaries and for every boundary
    // find the corresponding tree path
    for (int i = 0; i < Boundaries.Count; i++)
    {
      // init vars for closest branch and minimum distance
      int closestBranch = 0;
      double minDist = double.MaxValue;
      // get closest point on every contour curve
      for (int j = 1; j < ContourTree.BranchCount; j++)
      {
        Point3d onCrv;
        Point3d onObj;
        int wG;
        // get cp pair for every branch
        bool ret = Boundaries[i].ClosestPoints(ContourTree.Branches[j], out onCrv, out onObj, out wG);
        // measure distance
        double dist = onCrv.DistanceTo(onObj);
        // set minimum distance
        if (dist < minDist)
        {
          minDist = dist;
          closestBranch = j;
        }
      }
      // correct closest branch
      if (closestBranch == 1)
      {
        closestBranch = 0;
      }
      else if (closestBranch == ContourTree.BranchCount - 1)
      {
        closestBranch = Count + 1;
      }
      else
      {
        continue;
      }

      //Print(closestBranch.ToString());

      // insert into contour tree
      GH_Path ghp = new GH_Path(0, closestBranch);
      ContourTree.EnsurePath(ghp);
      ContourTree.Add(Boundaries[i] as PolylineCurve, ghp);
    }

    // return tree with closed contour curves
    return ContourTree;
  }

  public DataTree<PolylineCurve> OrderSliceCurves(DataTree<PolylineCurve> ContourCurves)
  {
    // create copy of datatree to avoid messing up things
    DataTree<PolylineCurve> SliceCurves = new DataTree<PolylineCurve>(ContourCurves);

    // loop over datatree and ensure correct order
    for (int i = 0; i < SliceCurves.BranchCount - 1; i++)
    {
      // get branches
      var this_branch = SliceCurves.Branches[i];
      var next_branch = SliceCurves.Branches[i + 1];

      // case 1: this branch one curve and next branch one curve
      if (this_branch.Count == 1 && next_branch.Count == 1)
      {
        //Print("Case 1, 1 -> 1 (nothing done)");
        // nothing needs to be done
      }
        // case 2: this branch one curve and next branch multiple curves
      else if (this_branch.Count == 1 && next_branch.Count > 1)
      {
        //Print("Case 2, 1 -> N");
        // loop over next branch and find all centerpoints to compare against

        Point3dList ptL = new Point3dList();
        for (int k = 0; k < next_branch.Count; k++)
        {
          Point3d cpB = next_branch[k].ToPolyline().CenterPoint();
          ptL.Add(cpB);
        }
        // create new list for storage
        List<PolylineCurve> OrderedNextBranch = new List<PolylineCurve>();
        // get curve centerpoint
        Point3d cpA = this_branch[0].ToPolyline().CenterPoint();
        // compare against point3dlist of other centerpoints
        int idx = ptL.ClosestIndex(cpA);
        OrderedNextBranch.Add(next_branch[idx].Duplicate() as PolylineCurve);
        next_branch.RemoveAt(idx);
        OrderedNextBranch.AddRange(next_branch);
        // clear data
        ptL.Clear();
        // restructure next branch of contours tree
        SliceCurves.Branches[i + 1].Clear();
        SliceCurves.Branches[i + 1].AddRange(OrderedNextBranch);
      }
        // case 3: this branch and next branch have multiple curves but the same count
      else if (this_branch.Count > 1 && this_branch.Count == next_branch.Count)
      {
        //Print("Case 3, N -> N");
        // create new list for storage
        List<PolylineCurve> OrderedNextBranch = new List<PolylineCurve>();
        // loop over all curves in this branch
        for (int j = 0; j < this_branch.Count; j++)
        {
          if (next_branch.Count < 1) break;
          // loop over next branch and find all centerpoints to compare against
          Point3dList ptL = new Point3dList();
          for (int k = 0; k < next_branch.Count; k++)
          {
            Point3d cpB = next_branch[k].ToPolyline().CenterPoint();
            ptL.Add(cpB);
          }
          // get curve centerpoint
          Point3d cpA = this_branch[j].ToPolyline().CenterPoint();
          // compare against point3dlist of other centerpoints
          int idx = ptL.ClosestIndex(cpA);
          // add closest item to ordered list
          OrderedNextBranch.Add(next_branch[idx].Duplicate() as PolylineCurve);
          // remove closest item from candidates
          next_branch.RemoveAt(idx);
          // clear data
          ptL.Clear();
        }
        // restructure next branch of contours tree
        SliceCurves.Branches[i + 1].Clear();
        SliceCurves.Branches[i + 1].AddRange(OrderedNextBranch);
      }
        // case 4: this branch has more curves than next branch
      else if (this_branch.Count > 1 && next_branch.Count > 1 && this_branch.Count > next_branch.Count)
      {
        //Print("Case 4, N -> M>N (VERIFY!)");
        // create new list for storage
        List<PolylineCurve> OrderedNextBranch = new List<PolylineCurve>();
        // loop over all curves in this branch
        for (int j = 0; j < this_branch.Count; j++)
        {
          if (next_branch.Count < 1) break;
          // loop over next branch and find all centerpoints to compare against
          Point3dList ptL = new Point3dList();
          for (int k = 0; k < next_branch.Count; k++)
          {
            
            // Point3d cpB = AreaMassProperties.Compute(next_branch[k]).Centroid;
            Point3d cpB = next_branch[k].ToPolyline().CenterPoint();
            ptL.Add(cpB);
          }
          // get curve centerpoint
          //  Point3d cpA = AreaMassProperties.Compute(this_branch[j]).Centroid;
          Point3d cpA = this_branch[j].ToPolyline().CenterPoint();
          // compare against point3dlist of other centerpoints
          int idx = ptL.ClosestIndex(cpA);
          // add closest item to ordered list
          OrderedNextBranch.Add(next_branch[idx].Duplicate() as PolylineCurve);
          // remove closest item from candidates
          next_branch.RemoveAt(idx);
          // clear data
          ptL.Clear();
        }
        // restructure next branch of contours tree
        SliceCurves.Branches[i + 1].Clear();
        SliceCurves.Branches[i + 1].AddRange(OrderedNextBranch);
      }
        // case 5: this branch has less curves than next branch
      else if (this_branch.Count > 1 && next_branch.Count > 1 && this_branch.Count < next_branch.Count)
      {
        //Print("Case 5, N -> M<N (VERIFY)");
        // loop over next branch and find all centerpoints to compare against
        Point3dList ptL = new Point3dList();
        for (int k = 0; k < next_branch.Count; k++)
        {
          Point3d cpB = next_branch[k].ToPolyline().CenterPoint();
          ptL.Add(cpB);
        }
        // create new list for storage
        List<PolylineCurve> OrderedNextBranch = new List<PolylineCurve>();
        // create duplicate list for looping
        List<PolylineCurve> next_branch_dup = new List<PolylineCurve>(next_branch);
        // loop over all curves in this branch
        for (int j = 0; j < this_branch.Count; j++)
        {
          // get curve centerpoint
          Point3d cpA = this_branch[j].ToPolyline().CenterPoint();
          // compare against point3dlist of other centerpoints
          int idx = ptL.ClosestIndex(cpA);
          // add closest curve based on comparison to new list
          OrderedNextBranch.Add(next_branch[idx].Duplicate() as PolylineCurve);
          next_branch_dup.Remove(next_branch[idx]);
        }
        // add remaining curves from next branch to list
        OrderedNextBranch.AddRange(next_branch_dup);
        // clear data
        ptL.Clear();
        // restructure next branch of contours tree
        SliceCurves.Branches[i + 1].Clear();
        SliceCurves.Branches[i + 1].AddRange(OrderedNextBranch);
      }
        // case 6: this branch has multiple curves but next branch only has one
      else if (this_branch.Count > 1 && next_branch.Count == 1)
      {
        //Print("Case 6, N -> 1 (nothing done)");
      }
    }

    return SliceCurves;
  }

}
# ---------- end isocontourmeshcount ----------
panel_11 = Panel(isocontourmeshcount.out)
contours = Data(isocontourmeshcount.Contours)
filter_39 = StreamFilter(Gate=np_only_bot_boundary_2, Stream1=contours)
tstat_6 = TreeStatistics(Tree=filter_39)  # -> reverse(Paths), Length, Count
branch_6 = TreeBranch(Tree=filter_39, Path=tstat_6.Paths, MaintainPaths=False)
filter_40 = StreamFilter(Gate=np_only_bot_boundary_2, Stream0=contours, Stream1=branch_6)
contours_2 = Data(filter_40)

# ----
# comments & notes: filter out open slice curves and <null>'s from ordered slice-surfaces
ordered_slice_srfs_2 = Brep(ordered_slice_srfs)
slice_polylines_8 = Data(slice_polylines_5)
branching_curves_2 = Data(branching_curves)
slice_planes_2 = Data(slice_planes)
null_4 = NullItem(Item=ordered_slice_srfs_2)  # -> NullFlags, InvalidFlags, Description
cls_4 = Closed(Curve=slice_polylines_8)  # -> Closed, Periodic
filter_41 = StreamFilter(Gate=branching_curves_2, Stream1=null_4.InvalidFlags)
filter_42 = StreamFilter(Gate=branching_curves_2, Stream1=null_4.NullFlags)
or_7 = GateOr(A=filter_42, B=filter_41, C=invert(cls_4.Closed))
dispatch_2 = Dispatch(List=slice_planes_2, DispatchPattern=or_7)  # -> ListA, ListB
dispatch_3 = Dispatch(List=slice_polylines_8, DispatchPattern=or_7)  # -> ListA, ListB
dispatch_4 = Dispatch(List=ordered_slice_srfs_2, DispatchPattern=or_7)  # -> ListA, ListB
clean = CleanTree(RemoveNulls=True, RemoveInvalid=True, RemoveEmpty=True, Tree=dispatch_2.ListB)
clean_2 = CleanTree(RemoveNulls=True, RemoveInvalid=True, RemoveEmpty=True, Tree=dispatch_3.ListB)
clean_3 = CleanTree(RemoveNulls=True, RemoveInvalid=True, RemoveEmpty=True, Tree=dispatch_4.ListB)
clean_4 = CleanTree(RemoveNulls=True, RemoveInvalid=True, RemoveEmpty=True, Tree=dispatch_3.ListA)
ordered_slice_srfs_closed = Data(clean_3)
slice_curves_open = Curve(clean_4)
slice_curves_closed = Curve(clean_2)
slice_planes_3 = Data(clean)

# ----
# comments & notes: ensure that all non-planar slices are ccw by constructing a plane from sample points and comparing dot products
contours_3 = Data(contours_2)
divide = DivideCurve(Curve=contours_3, Count="20", Kinks=False)  # -> Points, Tangents, Parameters
pcen_5 = PolygonCenter(Polyline=contours_3)  # -> CenterV, CenterE, CenterA
plfit = PlaneFit(Points=divide.Points)  # -> Plane, Deviation
pshift_5 = ShiftPaths(Data=plfit.Plane, Offset=-1)
deplane = DeconstructPlane(Plane=pshift_5)  # -> Origin, XAxis, YAxis, unitize(ZAxis)
Z_4 = UnitZ(Factor=1)
dprod = DotProduct(VectorA=deplane.ZAxis, VectorB=Z_4, Unitize=False)
smaller_3 = SmallerThan(FirstNumber=dprod, SecondNumber="0")  # -> SmallerThan, OrEqualTo
dispatch_5 = Dispatch(List=pshift_5, DispatchPattern=smaller_3.SmallerThan)  # -> ListA, ListB
clean_5 = CleanTree(RemoveNulls=True, RemoveInvalid=True, RemoveEmpty=True, Tree=dispatch_5.ListA)
clean_6 = CleanTree(RemoveNulls=True, RemoveInvalid=True, RemoveEmpty=True, Tree=dispatch_5.ListB)
pflip = FlipPlane(Plane=clean_5, ReverseX=False, ReverseY=False, SwapAxes=True)
merge_2 = Merge(Data1=pflip, Data2=clean_6)
X = UnitX(Factor=1)
align = AlignPlane(Plane=merge_2, Direction=X)  # -> Plane, Angle
pl_origin = PlaneOrigin(Base=align.Plane, Origin=pcen_5.CenterV)
crvensureccw = CrvEnsureCCW(Crv=contours_3, Pln=pl_origin)  # -> CCWCrv; inputs Crv: Curve, Pln: Plane; same code as crvensureccw
contours_4 = Data(crvensureccw)

# ----
# comments & notes: ensure all curves are counter-clock-wise (CCW)
# comments & notes: use a property of planar breps to easily decide which curves are inside and which are outside
slice_curves_open_2 = Curve(slice_curves_open)
ordered_slice_srfs_closed_2 = Data(ordered_slice_srfs_closed)
branching_curves_3 = Data(branching_curves)
slice_polylines_9 = Data(slice_curves_closed)
inneroutercurves = InnerOuterCurves(SliceSurfaces=ordered_slice_srfs_closed_2)  # -> InnerCurves, OuterCurves; inputs SliceSurfaces: tree of Brep; same code as inneroutercurves
filter_43 = StreamFilter(Gate=branching_curves_3, Stream0=slice_polylines_9, Stream1=inneroutercurves.OuterCurves)
pcen_6 = PolygonCenter(Polyline=filter_43)  # -> CenterV, CenterE, CenterA
pcen_7 = PolygonCenter(Polyline=inneroutercurves.InnerCurves)  # -> CenterV, CenterE, CenterA
Z_5 = UnitZ(Factor=1)
Z_6 = UnitZ(Factor=1)
pcen_8 = PolygonCenter(Polyline=slice_curves_open_2)  # -> CenterV, CenterE, CenterA
Z_7 = UnitZ(Factor=1)
pl = PlaneNormal(Origin=pcen_6.CenterA, ZAxis=Z_5)
pl_2 = PlaneNormal(Origin=pcen_7.CenterV, ZAxis=Z_6)
pl_3 = PlaneNormal(Origin=pcen_8.CenterV, ZAxis=Z_7)
crvensureccw_2 = CrvEnsureCCW(Crv=inneroutercurves.InnerCurves, Pln=pl_2)  # -> CCWCrv; inputs Crv: Curve, Pln: Plane; same code as crvensureccw
crvensureccw_3 = CrvEnsureCCW(Crv=filter_43, Pln=pl)  # -> CCWCrv; inputs Crv: Curve, Pln: Plane; same code as crvensureccw
crvensureccw_4 = CrvEnsureCCW(Crv=slice_curves_open_2, Pln=pl_3)  # -> CCWCrv; inputs Crv: Curve, Pln: Plane; same code as crvensureccw
clean_7 = CleanTree(RemoveNulls=True, RemoveInvalid=True, RemoveEmpty=False, Tree=crvensureccw_2)
slice_curves_clsd_outer = Curve(crvensureccw_3)
slice_curves_clsd_inner = Curve(clean_7)
slice_curves_open_3 = Curve(crvensureccw_4)

# ----
# comments & notes: get datastructure details for control flow
slice_curves_open_4 = Curve(slice_curves_open_3)
tstat_7 = TreeStatistics(Tree=slice_curves_open_4)  # -> Paths, Length, Count
slice_curves_open_branch_length = Data(tstat_7.Length)
slice_curves_open_paths = Data(tstat_7.Paths)

# ----
# comments & notes: check if datatree paths are in the correct structure and align
slice_curves_open_paths_2 = Data(slice_curves_open_paths)
slice_curves_open_5 = Curve(slice_curves_open_3)
dpath_3 = DeconstructPath(Branch=slice_curves_open_paths_2)
match = MatchTree(Tree=dpath_3, Guide=slice_curves_open_5)
lng_7 = ListLength(List=match)
lng_8 = ListLength(List=flatten(slice_curves_open_paths_2))
smaller_4 = SmallerThan(FirstNumber=lng_7, SecondNumber="2")  # -> SmallerThan, OrEqualTo
ma_9 = MassAddition(Input=flatten(smaller_4.OrEqualTo))  # -> Result, PartialResults
equals_4 = Equality(FirstNumber=lng_8, SecondNumber=ma_9.Result)  # -> Equality, Inequality
datatree_paths_align = Data(equals_4.Equality)

# ----
# comments & notes: check if we have one open curve per branch or more
slice_curves_open_branch_length_2 = Data(slice_curves_open_branch_length)
slice_curves_open_paths_3 = Data(slice_curves_open_paths)
lng_9 = ListLength(List=flatten(slice_curves_open_paths_3))
equals_5 = Equality(FirstNumber=slice_curves_open_branch_length_2, SecondNumber="1")  # -> Equality, Inequality
ma_10 = MassAddition(Input=equals_5.Equality)  # -> Result, PartialResults
equals_6 = Equality(FirstNumber=lng_9, SecondNumber=ma_10.Result)  # -> Equality, Inequality
one_open_curve_per_branch = Data(equals_6.Equality)

# ----
# comments & notes: dispatch these curves, explode and join to get a single curve again
# comments & notes: check if input curve has self intersections (for example when creating a self-intersecting loft to control infill design)
slice_curves_clsd_outer_2 = Curve(slice_curves_clsd_outer)
slice_curves_length_thresholded_3 = Data(slice_curves_length_thresholded)
tstat_8 = TreeStatistics(Tree=slice_curves_clsd_outer_2)  # -> Paths, Length, Count
branch_7 = TreeBranch(Tree=slice_curves_length_thresholded_3, Path=tstat_8.Paths, MaintainPaths=True)
cx = CurveSelf(Curve=branch_7)  # -> Points, Params
pshift_6 = ShiftPaths(Data=cx.Points, Offset=-1)
lng_10 = ListLength(List=pshift_6)
larger_9 = LargerThan(FirstNumber=lng_10, SecondNumber="0")  # -> LargerThan, OrEqualTo
dispatch_6 = Dispatch(List=slice_curves_clsd_outer_2, DispatchPattern=larger_9.LargerThan)  # -> ListA, ListB
explode_4 = Explode(Curve=dispatch_6.ListA, Recursive=True)  # -> Segments, Vertices
pshift_7 = ShiftPaths(Data=explode_4.Segments, Offset=-1)
clean_8 = CleanTree(RemoveNulls=True, RemoveInvalid=True, RemoveEmpty=True, Tree=pshift_7)
join_3 = JoinCurves(Curves=clean_8, Preserve=False)
pshift_8 = ShiftPaths(Data=join_3, Offset=-1)
merge_3 = Merge(Data1=pshift_8, Data2=dispatch_6.ListB)
slice_curves_clsd_outer_rejoined = Curve(merge_3)

# ----
# comments & notes: increment paths if floor is added to open, np-sliced object to prevent merging errors with synthesized floor layers
add_floor_to_open_objects_5 = Data(add_floor_to_open_objects)
contours_5 = Data(contours_4)
filter_44 = StreamFilter(Gate=add_floor_to_open_objects_5, Stream1=contours_5)
tstat_9 = TreeStatistics(Tree=filter_44)  # -> Paths, Length, Count
dpath_4 = DeconstructPath(Branch=tstat_9.Paths)
lng_11 = ListLength(List=dpath_4)  # -> expr("x-1", Length)
floor_layer_count_6 = Data(floor_layer_count)
split_2 = SplitList(List=dpath_4, Index=lng_11)  # -> ListA, ListB
addition = Addition(A=split_2.ListB, B=floor_layer_count_6)
merge_4 = Merge(Data1=split_2.ListA, Data2=addition)
path = ConstructPath(Indices=merge_4)  # -> flatten(Branch)
replace = ReplacePaths(Data=filter_44, Search=tstat_9.Paths, Replace=path)
filter_45 = StreamFilter(Gate=add_floor_to_open_objects_5, Stream0=contours_5, Stream1=replace)
np_slice_curves = Curve(filter_45)

# ----
# comments & notes: NEW ALGORITHM TO CLASSIFY LAYERS
# TO BE VERIFIED!
regular_floor_slicing_enabled_2 = Boolean(regular_floor_slicing_enabled)
threshold = Slider(5, range=0..100)
cap_layer_count_2 = Data(cap_layer_count)
slice_curves_clsd_inner_2 = Curve(slice_curves_clsd_inner)
slice_curves_clsd_outer_3 = Curve(slice_curves_clsd_outer_rejoined)
floor_layer_count_7 = Data(floor_layer_count)
classifyclayprintlayers = ClassifyClayPrintLayers(
    InnerCurves=slice_curves_clsd_inner_2,
    OuterCurves=slice_curves_clsd_outer_3,
    FloorLayerCount=floor_layer_count_7,
    CapLayerCount=cap_layer_count_2,
    FloorEnabled=regular_floor_slicing_enabled_2,
    Threshold=threshold,
    Debug=Toggle(True))  # -> out, DebugMessage, OuterFloorLayers, InnerFloorLayers, OuterRegularLayers, InnerRegularLayers, OuterOverhangLayers, InnerOverhangLayers, OuterCapLayers, InnerCapLayers; inputs InnerCurves: tree of Curve, OuterCurves: tree of Curve, FloorLayerCount: Int32, CapLayerCount: Int32, FloorEnabled: Boolean, Threshold: Double, Debug: Boolean
# ---------- classifyclayprintlayers: C# ----------
#region Usings
using System;
using System.Linq;
using System.Collections;
using System.Collections.Generic;
using System.Drawing;

using Rhino;
using Rhino.Geometry;

using Grasshopper;
using Grasshopper.Kernel;
using Grasshopper.Kernel.Data;
using Grasshopper.Kernel.Types;
using TreeExtensions;
#endregion

public class Script_Instance : GH_ScriptInstance
{
    #region Notes
    /* 
      Members:
        RhinoDoc RhinoDocument
        GH_Document GrasshopperDocument
        IGH_Component Component
        int Iteration

      Methods (Virtual & overridable):
        Print(string text)
        Print(string format, params object[] args)
        Reflect(object obj)
        Reflect(object obj, string method_name)
    
    Author: Max Benjamin Eschenbach
    License: MIT License
    Version: 250410
    */
    #endregion

    private void RunScript(
		DataTree<Curve> InnerCurves,
		DataTree<Curve> OuterCurves,
		int FloorLayerCount,
		int CapLayerCount,
		bool FloorEnabled,
		double Threshold,
		bool Debug,
		ref object DebugMessage,
		ref object OuterFloorLayers,
		ref object InnerFloorLayers,
		ref object OuterRegularLayers,
		ref object InnerRegularLayers,
		ref object OuterOverhangLayers,
		ref object InnerOverhangLayers,
		ref object OuterCapLayers,
		ref object InnerCapLayers)
    {
        // set component params
        this.Component.Name = "ClassifyClayPrintLayers";
        this.Component.NickName = "ClassifyClayPrintLayers";
        this.Component.Category = "DDUClayPrintingSlicer";
        this.Component.SubCategory = "2 Slice Processing";

        // Output DataTrees (OuterCurves)
        DataTree<Curve> OuterFloors = new DataTree<Curve>();
        DataTree<Curve> OuterRegulars = new DataTree<Curve>();
        DataTree<Curve> OuterOverhangs = new DataTree<Curve>();
        DataTree<Curve> OuterCaps = new DataTree<Curve>();
        // Output DataTrees (InnerCurves)
        DataTree<Curve> InnerFloors = new DataTree<Curve>();
        DataTree<Curve> InnerRegulars = new DataTree<Curve>();
        DataTree<Curve> InnerOverhangs = new DataTree<Curve>();
        DataTree<Curve> InnerCaps = new DataTree<Curve>();
        // Debugging Message(s)
        DataTree<string> ReportMessages = new DataTree<string>();
        // DataTree Paths
        GH_Path lastPath;
        GH_Path thisPath;
        GH_Path nextPath;
        // Outer Layers
        List<Curve> lastLayer;
        List<Curve> thisLayer;
        List<Curve> nextLayer;
        // Inner Layers
        List<Curve> lastInnerLayer;
        List<Curve> thisInnerLayer;
        List<Curve> nextInnerLayer;

        // control flow int for looping and floor definition....
        int subfactor = 1;
        if (OuterCurves.BranchCount == FloorLayerCount)
        {
            subfactor = 0;
        }
        
        for (int i = 0; i < OuterCurves.BranchCount - subfactor; i++)
        {
            // THIS LAYER'S DATA ------------------------------------------------------
            thisPath = new GH_Path(OuterCurves.Paths[i]);
            thisLayer = OuterCurves.Branches[i];
            
            // FIRST LAYER(S) FLOOR DEFINITION -----------------------------------------
            if (i == 0 | i < FloorLayerCount)
            {
                if (FloorEnabled && FloorLayerCount > 0)
                {
                    // ADD INITIAL N LAYERS TO FLOORS IF FLOOR IS ACTIVE
                    OuterFloors.AddRange(thisLayer, thisPath);
                    InnerFloors.AddRangeGracefully(InnerCurves.Branch(thisPath), thisPath);
                    continue;
                }
                else
                {
                    // THISLAYER IS REGULAR/SPARSE LAYER
                    OuterRegulars.AddRange(thisLayer, thisPath);
                    InnerRegulars.AddRangeGracefully(InnerCurves.Branch(thisPath), thisPath);
                    continue;
                }
            }

            // GET NEXT AND LAST LAYER DATA ------------------------------------------
            // Paths
            lastPath = new GH_Path(OuterCurves.Paths[i - 1]);
            nextPath = new GH_Path(OuterCurves.Paths[i + 1]);
            // Layers
            lastLayer = OuterCurves.Branches[i - 1];
            nextLayer = OuterCurves.Branches[i + 1];

            // AREA COMPUTATION AND DIFFERENCE -----------------------------------------
            // Get cumulative area of outer layer curves
            double lastArea = this.GetLayerArea(lastLayer, lastPath);
            double thisArea = this.GetLayerArea(thisLayer, thisPath);
            double nextArea = this.GetLayerArea(nextLayer, nextPath);
            // Compute area difference between outer layers
            double diffLast = thisArea - lastArea;
            double diffNext = thisArea - nextArea;
            // Compute percentage difference
            double percLast = (diffLast / thisArea) * 100;
            double percNext = (diffNext / thisArea) * 100;

            // COMPILE REPORT MESSAGE
            if (Debug)
            {
                ReportMessages.Add(
                    string.Format(
                        "LAST {2} <- {0}% <--| {3} THIS {3} |--> {1}% -> {4} NEXT",
                        Math.Round(percLast, 2).ToString(),
                        Math.Round(percNext, 2).ToString(),
                        lastPath.ToString(),
                        thisPath.ToString(),
                        nextPath.ToString()
                    ), new GH_Path(0, 1)
                );
            }
            
            // CAP CLASSIFICATION --------------------------------------------------------
            if ((percNext > 0) && (Math.Abs(percNext) > Threshold) && CapLayerCount > 0)
            {
                // THISLAYER IS LARGER THAN NEXT LAYER --> THISLAYER IS CAP LAYER
                OuterCaps.AddRange(thisLayer, thisPath);
                InnerCaps.AddRangeGracefully(InnerCurves.Branch(thisPath), thisPath);
                // RE-CLASSIFY CAPS BACKWARDS
                for (int j = 1; j < CapLayerCount && (i - j) >= 0; j++) 
                {
                    GH_Path prevPath = new GH_Path(OuterCurves.Paths[i - j]);
                    List<Curve> prevLayer = OuterCurves.Branches[i - j];
                    // Add to CAP and remove REGULAR - Leave as is if it is already a FLOOR
                    if (!OuterFloors.Paths.Contains(prevPath) & !InnerFloors.Paths.Contains(prevPath)) 
                    {
                        OuterCaps.AddRange(prevLayer, prevPath);
                        InnerCaps.AddRangeGracefully(InnerCurves.Branch(prevPath), prevPath);
                        OuterRegulars.RemovePath(prevPath);
                        InnerRegulars.RemovePath(prevPath);
                        OuterOverhangs.RemovePath(prevPath);
                        InnerOverhangs.RemovePath(prevPath);
                    }
                }
                if (i >= OuterCurves.BranchCount - 2 && CapLayerCount > 0)
                {
                    OuterCaps.AddRange(nextLayer, nextPath);
                    InnerCaps.AddRangeGracefully(InnerCurves.Branch(nextPath), nextPath);
                }
                else
                {
                    // THISLAYER IS REGULAR/SPARSE LAYER
                    OuterRegulars.AddRange(nextLayer, nextPath);
                    InnerRegulars.AddRangeGracefully(InnerCurves.Branch(nextPath), nextPath);
                    continue;
                }
            }

            // LAST LAYER(S) CAP CLASSIFICATION --------------------------------------------
            if (i >= OuterCurves.BranchCount - 2)
            {
                if (CapLayerCount > 0)
                {
                    OuterCaps.AddRange(nextLayer, nextPath);
                    InnerCaps.AddRangeGracefully(InnerCurves.Branch(nextPath), nextPath);
                    // RE-CLASSIFY CAPS BACKWARDS
                    for (int j = 1; j < CapLayerCount && (i + 1 - j) >= 0; j++) 
                    {
                        GH_Path prevPath = new GH_Path(OuterCurves.Paths[i + 1 - j]);
                        List<Curve> prevLayer = OuterCurves.Branches[i + 1 - j];
                        // Add to CAP and remove REGULAR - Leave as is if it is already a FLOOR
                        if (!OuterFloors.Paths.Contains(prevPath) & !InnerFloors.Paths.Contains(prevPath)) 
                        {
                            OuterCaps.AddRange(prevLayer, prevPath);
                            InnerCaps.AddRangeGracefully(InnerCurves.Branch(prevPath), prevPath);
                            OuterRegulars.RemovePath(prevPath);
                            InnerRegulars.RemovePath(prevPath);
                            OuterOverhangs.RemovePath(prevPath);
                            InnerOverhangs.RemovePath(prevPath);
                        }
                    }
                }
                else
                {
                    // THISLAYER IS REGULAR/SPARSE LAYER
                    OuterRegulars.AddRange(thisLayer, thisPath);
                    InnerRegulars.AddRangeGracefully(InnerCurves.Branch(thisPath), thisPath);
                    OuterRegulars.AddRange(nextLayer, nextPath);
                    InnerRegulars.AddRangeGracefully(InnerCurves.Branch(nextPath), nextPath);
                }
                continue;
            }

            // OVERHANG CLASSIFICATION ---------------------------------------------------
            else if ((percLast > 0) && (Math.Abs(percLast) > Threshold))
            {
                // THISLAYER IS LARGER THAN LAST LAYER --> THISLAYER IS OVERHANG LAYER
                OuterOverhangs.AddRange(thisLayer, thisPath);
                InnerOverhangs.AddRangeGracefully(InnerCurves.Branch(thisPath), thisPath);
            }

            // REGULAR / SPARSE CLASSIFICATION ------------------------------------------
            else
            {
                // THISLAYER IS REGULAR/SPARSE LAYER
                OuterRegulars.AddRange(thisLayer, thisPath);
                InnerRegulars.AddRangeGracefully(InnerCurves.Branch(thisPath), thisPath);
            }

        }
        // Set outputs
        DebugMessage = ReportMessages;
        OuterFloorLayers = OuterFloors;
        OuterRegularLayers = OuterRegulars;
        OuterOverhangLayers = OuterOverhangs;
        OuterCapLayers = OuterCaps;
        InnerFloorLayers = InnerFloors;
        InnerRegularLayers = InnerRegulars;
        InnerOverhangLayers = InnerOverhangs;
        InnerCapLayers = InnerCaps;
    }

    private double GetLayerArea(List<Curve> Layer, GH_Path path = null)
    {
        double LayerArea = 0.0;
        for (int i = 0; i < Layer.Count; i++)
        {
            AreaMassProperties amp = AreaMassProperties.Compute(Layer[i], 1.0);
            if (amp == null)
            {
                this.Component.AddRuntimeMessage(
                    GH_RuntimeMessageLevel.Warning,
                    $"Area Computation failed for Layer {path}[{i}]!");
                continue;
            }
            LayerArea += amp.Area;
        }
        return LayerArea;
    }
}

    namespace TreeExtensions
    {
        public static class DataTreeExtensions
        {
            public static void AddRangeGracefully(this DataTree<Curve> tree, IEnumerable<Curve> data, GH_Path path)
            {
                try
                {
                    tree.AddRange(data, path);
                }
                catch (ArgumentNullException)
                {
                    tree.RemovePath(path);
                }
            }
        }
    }
# ---------- end classifyclayprintlayers ----------
debug_out = Panel(classifyclayprintlayers.DebugMessage)
print_out_2 = Panel(classifyclayprintlayers.out)
inner_layers_overhang = Data(classifyclayprintlayers.InnerOverhangLayers)
outer_layers_overhang = Data(classifyclayprintlayers.OuterOverhangLayers)
outer_layers_regular = Data(classifyclayprintlayers.OuterRegularLayers)
inner_layers_regular = Data(classifyclayprintlayers.InnerRegularLayers)
outer_layers_floor = Data(classifyclayprintlayers.OuterFloorLayers)
inner_layers_floor = Data(classifyclayprintlayers.InnerFloorLayers)
outer_layers_cap = Data(classifyclayprintlayers.OuterCapLayers)
inner_layers_cap = Data(classifyclayprintlayers.InnerCapLayers)
merge_5 = Merge(Data1=inner_layers_regular, Data2=inner_layers_overhang)
merge_6 = Merge(Data1=outer_layers_regular, Data2=outer_layers_overhang)

# ----
# comments & notes: COMPUTE INFILL AND FLOOR/CAP OFFSET DISTANCES
infill_wall_overlap_2 = Data(infill_wall_overlap)
infill_infill_overlap_2 = Data(infill_infill_overlap)
linewidth = Data(line_width)
subtraction_2 = Subtraction(A=linewidth, B=infill_wall_overlap_2)
subtraction_3 = Subtraction(A=linewidth, B=infill_infill_overlap_2)
offset_w_infill_wall_overlap = Data(subtraction_2)
offset_w_infill_infill_overlap = Data(subtraction_3)

# ----
# comments & notes: CREATE CAP INFILL BASE CURVES
offset_w_infill_wall_overlap_2 = Data(offset_w_infill_wall_overlap)
custom_curves_floorcurves = Curve(custom_curves_floor_wall_curves)
inner_layers_cap_2 = Data(inner_layers_cap)
outer_layers_cap_2 = Data(outer_layers_cap)
slice_planes_4 = Data(slice_planes_3)
tstat_10 = TreeStatistics(Tree=outer_layers_cap_2)  # -> Paths, Length, Count
tstat_11 = TreeStatistics(Tree=inner_layers_cap_2)  # -> Paths, Length, Count
c2offset = Clipper2Offset(Polylines=outer_layers_cap_2, Distance=offset_w_infill_wall_overlap_2, JoinType=1, EndType=0, MiterLimit=2, Precision=6)  # -> Holes, Outer, ClipperPaths
c2offset_2 = Clipper2Offset(Polylines=inner_layers_cap_2, Distance=offset_w_infill_wall_overlap_2, JoinType=1, EndType=0, MiterLimit=2, Precision=6)  # -> Holes, Outer, ClipperPaths
branch_8 = TreeBranch(Tree=slice_planes_4, Path=tstat_10.Paths, MaintainPaths=True)
branch_9 = TreeBranch(Tree=slice_planes_4, Path=tstat_11.Paths, MaintainPaths=True)
pshift_9 = ShiftPaths(Data=c2offset_2.Outer, Offset=-1)
pshift_10 = ShiftPaths(Data=c2offset.Holes, Offset=-1)
redpline_2 = Reduce(Polyline=pshift_9, Tolerance="0.025")  # -> Polyline, Reduction
redpline_3 = Reduce(Polyline=pshift_10, Tolerance="0.025")  # -> Polyline, Reduction
project = Project(Geometry=redpline_3.Polyline, Plane=branch_8)  # -> Geometry, Transform
project_2 = Project(Geometry=redpline_2.Polyline, Plane=branch_9)  # -> Geometry, Transform
outer_cap_infill_basecrvs = Curve(project.Geometry)
inner_cap_infill_basecrvs = Curve(project_2.Geometry)

# ----
# comments & notes: CREATE FLOOR INFILL BASE CURVES
custom_curves_slice_planes_2 = Data(custom_curves_slice_planes)
inner_layers_floor_2 = Data(inner_layers_floor)
slice_planes_5 = Data(slice_planes_3)
add_floor_custom_curves_enabled_2 = Boolean(add_floor_custom_curves_enabled)
custom_curves_floorcurves_2 = Curve(custom_curves_floor_wall_curves)
offset_w_infill_wall_overlap_3 = Data(offset_w_infill_wall_overlap)
outer_layers_floor_2 = Data(outer_layers_floor)
filter_46 = StreamFilter(Gate=add_floor_custom_curves_enabled_2, Stream0=slice_planes_5, Stream1=custom_curves_slice_planes_2)
filter_47 = StreamFilter(Gate=add_floor_custom_curves_enabled_2, Stream0=outer_layers_floor_2, Stream1=custom_curves_floorcurves_2)
tstat_12 = TreeStatistics(Tree=inner_layers_floor_2)  # -> Paths, Length, Count
tstat_13 = TreeStatistics(Tree=filter_47)  # -> Paths, Length, Count
c2offset_3 = Clipper2Offset(Polylines=filter_47, Distance=offset_w_infill_wall_overlap_3, JoinType=1, EndType=0, MiterLimit=2, Precision=6)  # -> Holes, Outer, ClipperPaths
c2offset_4 = Clipper2Offset(
    Polylines=inner_layers_floor_2,
    Distance=offset_w_infill_wall_overlap_3,
    JoinType=1,
    EndType=0,
    MiterLimit=2,
    Precision=6)  # -> Holes, Outer, ClipperPaths
branch_10 = TreeBranch(Tree=filter_46, Path=tstat_13.Paths, MaintainPaths=True)
branch_11 = TreeBranch(Tree=filter_46, Path=tstat_12.Paths, MaintainPaths=True)
pshift_11 = ShiftPaths(Data=c2offset_4.Outer, Offset=-1)
pshift_12 = ShiftPaths(Data=c2offset_3.Holes, Offset=-1)
redpline_4 = Reduce(Polyline=pshift_11, Tolerance="0.025")  # -> Polyline, Reduction
redpline_5 = Reduce(Polyline=pshift_12, Tolerance="0.025")  # -> Polyline, Reduction
project_3 = Project(Geometry=redpline_5.Polyline, Plane=branch_10)  # -> Geometry, Transform
project_4 = Project(Geometry=redpline_4.Polyline, Plane=branch_11)  # -> Geometry, Transform
outer_floor_infill_basecrvs = Curve(project_3.Geometry)
inner_floor_infill_basecrvs = Curve(project_4.Geometry)

inner_floor_infill_basecrvs_2 = Curve(inner_floor_infill_basecrvs)
outer_floor_infill_basecrvs_2 = Curve(outer_floor_infill_basecrvs)
floor_type_2 = Integer(floor_type)
comments_notes_26 = Panel("FLOOR INFILL GATE")
gate_12 = StreamGate(Stream=outer_floor_infill_basecrvs_2, Gate=floor_type_2)  # -> Target0, Target1
gate_13 = StreamGate(Stream=inner_floor_infill_basecrvs_2, Gate=floor_type_2)  # -> Target0, Target1
outer_floor_infill_basecrvs_3 = Curve(gate_12.Target0)
outer_floor_infill_basecrvs_4 = Curve(gate_12.Target1)
inner_floor_infill_basecrvs_3 = Curve(gate_13.Target0)
inner_floor_infill_basecrvs_4 = Curve(gate_13.Target1)

# ----
# comments & notes: FLOOR CRISS-CROSS INFILL
# BY XYLINUS
inner_floor_infill_basecrvs_5 = Curve(inner_floor_infill_basecrvs_3)
offset_w_infill_infill_overlap_2 = Data(offset_w_infill_infill_overlap)
outer_floor_infill_basecrvs_5 = Curve(outer_floor_infill_basecrvs_3)
full_ratio_on_floor_cap = Panel("1")
infill_fillet_radius_2 = Data(infill_fillet_radius)
null_5 = NullItem(Item=flatten(inner_floor_infill_basecrvs_5))  # -> NullFlags, InvalidFlags, Description
or_8 = GateOr(A=null_5.NullFlags, B=null_5.InvalidFlags)
rdiff = RegionDifference(CurvesA=outer_floor_infill_basecrvs_5, CurvesB=inner_floor_infill_basecrvs_5)
ma_11 = MassAddition(Input=or_8)  # -> Result, PartialResults
pshift_13 = ShiftPaths(Data=rdiff, Offset=-1)
bool = Boolean(invert(ma_11.Result))
filter_48 = StreamFilter(Gate=bool, Stream0=outer_floor_infill_basecrvs_5, Stream1=pshift_13)
infill_basecrvs_merged = Curve(filter_48)
tstat_14 = TreeStatistics(Tree=infill_basecrvs_merged)  # -> Paths, Length, Count
infill = CurveInfill(
    C=infill_basecrvs_merged,
    extrusion_width_or_xylinus_config=offset_w_infill_infill_overlap_2,
    infill_ratio_0_1=full_ratio_on_floor_cap)
lng_12 = ListLength(List=tstat_14.Paths)
path_mapper = PathMapper(infill, source="{A}", target="{0;A}")
equals_7 = Equality(FirstNumber=lng_12, SecondNumber="1")  # -> Equality, Inequality
gate_14 = StreamGate(Stream=path_mapper, Gate=equals_7.Equality)  # -> Target0, Target1
tstat_15 = TreeStatistics(Tree=gate_14.Target1)  # -> Paths, Length, Count
replace_2 = ReplacePaths(Data=gate_14.Target1, Search=tstat_15.Paths, Replace=tstat_14.Paths)
infill_fillet_radius_3 = Data(infill_fillet_radius_2)
filter_49 = StreamFilter(Gate=equals_7.Equality, Stream0=gate_14.Target0, Stream1=replace_2)
fillet = Fillet(Curve=filter_49, Radius=infill_fillet_radius_3)
explode_5 = Explode(Curve=fillet, Recursive=True)  # -> Segments, Vertices
pshift_14 = ShiftPaths(Data=explode_5.Segments, Offset=-1)
join_4 = JoinCurves(Curves=pshift_14, Preserve=False)
pshift_15 = ShiftPaths(Data=join_4, Offset=-1)
topoly_4 = CurveToPolyline(Curve=pshift_15, ToleranceDistance=Slider(0.01, range=0.001..0.5), ToleranceAngle=0)  # -> Polyline, Segments
floor_infill_curves_0 = Curve(topoly_4.Polyline)

add_floor_custom_curves_enabled_3 = Boolean(add_floor_custom_curves_enabled)
custom_curves_slice_planes_3 = Data(custom_curves_slice_planes)
outer_infill_base_crv_1 = Curve(outer_floor_infill_basecrvs_4)
inner_infill_base_crvs_1 = Curve(inner_floor_infill_basecrvs_4)
slice_planes_6 = Data(slice_planes_3)
offset_w_infill_infill_overlap_3 = Data(offset_w_infill_infill_overlap)
comments_notes_27 = Panel("FLOOR OFFSET INFILL")
filter_50 = StreamFilter(Gate=add_floor_custom_curves_enabled_3, Stream0=slice_planes_6, Stream1=custom_curves_slice_planes_3)
create_offset_infill = CREATE_OFFSET_INFILL(
    outer_infill_base_curves=outer_infill_base_crv_1,
    inner_infill_base_curves=inner_infill_base_crvs_1,
    slice_planes=filter_50,
    offset=offset_w_infill_infill_overlap_3)
floor_infill_curves_1 = Curve(create_offset_infill)

# ----
# comments & notes: COLLECT FLOOR INFILL CURVES
floor_infill_curves_0_2 = Curve(floor_infill_curves_0)
floor_infill_curves_1_2 = Curve(floor_infill_curves_1)
floor_type_3 = Integer(floor_type)
filter_51 = StreamFilter(Gate=floor_type_3, Stream0=floor_infill_curves_0_2, Stream1=floor_infill_curves_1_2)
pcen_9 = PolygonCenter(Polyline=filter_51)  # -> CenterV, CenterE, CenterA
Z_8 = UnitZ(Factor=1)
pl_4 = PlaneNormal(Origin=pcen_9.CenterA, ZAxis=Z_8)
crvensureccw_5 = CrvEnsureCCW(Crv=filter_51, Pln=pl_4)  # -> CCWCrv; inputs Crv: Curve, Pln: Plane; same code as crvensureccw
floor_infill_curves = Curve(crvensureccw_5)

# ----
# SPIRALIZE CONTOURS
comments_notes_28 = Panel("SPIRALIZE CONTOURS")

# ----
# VISUALIZATION OF PRINTING GEOMETRY,
# LAYERS AND GCODE GEOMETRY, HUD
# CONTROL FLOW FOR
# PRINT GEO / CUSTOM CURVES
# comments & notes: CONTROL FLOW FOR
# PRINT GEO / CUSTOM CURVES
render_print_geometry_2 = Data(render_print_geometry)
inject_custom_curves_9 = Data(inject_custom_curves)
and_12 = GateAnd(A=render_print_geometry_2, B=invert(inject_custom_curves_9))
render_print_geometry_and_not_inject_cus = Boolean(and_12)  # "RENDER_PRINT_GEOMETRY_AND_NOT_INJECT_CUSTOM_CURVES"

# ----
# PRINT PATH MANIPULATION
# OF SPIRALIZED CURVE
# comments & notes: PRINT PATH MANIPULATION
# OF SPIRALIZED CURVE
enable_ppm_after_spiral = BooleanToggle(False)

# ----
# comments & notes: EMOD functionality has been deprecated and has to be re-implemented if needed (it was not working well anyway...)
complete_emod_values = Data()
enableextrusionratemod = Boolean()
filter_52 = StreamFilter(Gate=enableextrusionratemod, Stream1=complete_emod_values)

# ----
# PRINTING TIME APPROXIMATION
comments_notes_29 = Panel("PRINTING TIME APPROXIMATION")

printing_geometry_closed_5 = Boolean(printing_geometry_closed)
inject_custom_curves_10 = Data(inject_custom_curves)
# CONTROL FLOW
# CONTOUR SPIRALIZATION
spiralize_contours_3 = Data(spiralize_contours)

# ----
# comments & notes: compile info message for HUD
panel_12 = Panel("[SETTING IGNORED] Back-Forth Stitching of Open Curves not possible, DataStructure does not align!")
panel_13 = Panel("[SETTING IGNORED] Back-Forth Stitching of Open Curves not possible, more than one open curve per branch!")
panel_14 = Panel("[SETTING IGNORED] Back-Forth Stitching of Open Curves is only available if Spiralization is activated!")
one_open_curve_per_branch_2 = Data(one_open_curve_per_branch)
datatree_paths_align_2 = Data(datatree_paths_align)
filter_53 = StreamFilter(Gate=datatree_paths_align_2, Stream0=panel_12)
filter_54 = StreamFilter(Gate=one_open_curve_per_branch_2, Stream0=panel_13)

panel_15 = Panel("[SETTING IGNORED] Spiralization is only available for open and non-branching objects!")
spiralize_contours_4 = Data(spiralize_contours)
filter_55 = StreamFilter(Gate=spiralize_contours_4, Stream1=panel_15)

enable_back_forth_on_open_curves_2 = Data(enable_back_forth_on_open_curves)
one_open_curve_per_branch_3 = Data(one_open_curve_per_branch)
datatree_paths_align_3 = Data(datatree_paths_align)

inner_cap_infill_basecrvs_2 = Curve(inner_cap_infill_basecrvs)
outer_cap_infill_basecrvs_2 = Curve(outer_cap_infill_basecrvs)
printing_geometry_closed_6 = Boolean(printing_geometry_closed)
np_slicing_enabled_4 = Boolean(np_slicing_enabled)
cap_type_2 = Integer(cap_type)
comments_notes_30 = Panel("CAP INFILL GATE")

# ----
# INFILL & FLOOR GENERATION
or_9 = GateOr(A=printing_geometry_closed_6, B=invert(np_slicing_enabled_4))
comments_notes_31 = Panel("SPARSE INFILL (TO-DO)")

filter_56 = StreamFilter(Gate=or_9, Stream1=outer_cap_infill_basecrvs_2)
filter_57 = StreamFilter(Gate=or_9, Stream1=inner_cap_infill_basecrvs_2)
gate_15 = StreamGate(Stream=filter_56, Gate=cap_type_2)  # -> Target0, Target1
gate_16 = StreamGate(Stream=filter_57, Gate=cap_type_2)  # -> Target0, Target1
outer_cap_infill_basecrvs_3 = Curve(gate_15.Target0)
outer_cap_infill_basecrvs_4 = Curve(gate_15.Target1)
inner_cap_infill_basecrvs_3 = Curve(gate_16.Target0)
inner_cap_infill_basecrvs_4 = Curve(gate_16.Target1)

# ----
# comments & notes: CAP CRISS-CROSS INFILL
# BY XYLINUS
outer_cap_infill_basecrvs_5 = Curve(outer_cap_infill_basecrvs_3)
inner_cap_infill_basecrvs_5 = Curve(inner_cap_infill_basecrvs_3)
infill_fillet_radius_4 = Data(infill_fillet_radius)
line_width_2 = Data(line_width)
null_6 = NullItem(Item=flatten(inner_cap_infill_basecrvs_5))  # -> NullFlags, InvalidFlags, Description
or_10 = GateOr(A=null_6.NullFlags, B=null_6.InvalidFlags)
ma_12 = MassAddition(Input=or_10)  # -> Result, PartialResults
rdiff_2 = RegionDifference(CurvesA=outer_cap_infill_basecrvs_5, CurvesB=inner_cap_infill_basecrvs_5)
bool_2 = Boolean(invert(ma_12.Result))
pshift_16 = ShiftPaths(Data=rdiff_2, Offset=-1)
filter_58 = StreamFilter(Gate=bool_2, Stream0=outer_cap_infill_basecrvs_5, Stream1=pshift_16)
infill_basecrvs_merged_2 = Curve(filter_58)
full_ratio_on_floor_cap_2 = Panel("1")
tstat_16 = TreeStatistics(Tree=infill_basecrvs_merged_2)  # -> Paths, Length, Count
infill_2 = CurveInfill(C=infill_basecrvs_merged_2, extrusion_width_or_xylinus_config=line_width_2, infill_ratio_0_1=full_ratio_on_floor_cap_2)
lng_13 = ListLength(List=tstat_16.Paths)
path_mapper_2 = PathMapper(infill_2, source="{A}", target="{0;A}")
equals_8 = Equality(FirstNumber=lng_13, SecondNumber="1")  # -> Equality, Inequality
gate_17 = StreamGate(Stream=path_mapper_2, Gate=equals_8.Equality)  # -> Target0, Target1
tstat_17 = TreeStatistics(Tree=gate_17.Target1)  # -> Paths, Length, Count
replace_3 = ReplacePaths(Data=gate_17.Target1, Search=tstat_17.Paths, Replace=tstat_16.Paths)
filter_59 = StreamFilter(Gate=equals_8.Equality, Stream0=gate_17.Target0, Stream1=replace_3)
fillet_2 = Fillet(Curve=filter_59, Radius=infill_fillet_radius_4)
explode_6 = Explode(Curve=fillet_2, Recursive=True)  # -> Segments, Vertices
pshift_17 = ShiftPaths(Data=explode_6.Segments, Offset=-1)
join_5 = JoinCurves(Curves=pshift_17, Preserve=False)
pshift_18 = ShiftPaths(Data=join_5, Offset=-1)
topoly_5 = CurveToPolyline(Curve=pshift_18, ToleranceDistance=Slider(0.01, range=0.001..0.5), ToleranceAngle=0)  # -> Polyline, Segments
cap_infill_curves_0 = Curve(topoly_5.Polyline)

offset_w_infill_infill_overlap_4 = Data(offset_w_infill_infill_overlap)
inner_cap_infill_basecrvs_6 = Curve(inner_cap_infill_basecrvs_4)
outer_cap_infill_basecrvs_6 = Curve(outer_cap_infill_basecrvs_4)
slice_planes_7 = Data(slice_planes_3)
create_offset_infill_2 = CREATE_OFFSET_INFILL(
    outer_infill_base_curves=outer_cap_infill_basecrvs_6,
    inner_infill_base_curves=inner_cap_infill_basecrvs_6,
    slice_planes=slice_planes_7,
    offset=offset_w_infill_infill_overlap_4)
cap_infill_curves_1 = Curve(create_offset_infill_2)

# ----
# comments & notes: COLLECT CAP INFILL CURVES
cap_infill_curves_0_2 = Curve(cap_infill_curves_0)
cap_infill_curves_1_2 = Curve(cap_infill_curves_1)
cap_type_3 = Integer(cap_type)
filter_60 = StreamFilter(Gate=cap_type_3, Stream0=cap_infill_curves_0_2, Stream1=cap_infill_curves_1_2)
pcen_10 = PolygonCenter(Polyline=filter_60)  # -> CenterV, CenterE, CenterA
Z_9 = UnitZ(Factor=1)
pl_5 = PlaneNormal(Origin=pcen_10.CenterA, ZAxis=Z_9)
crvensureccw_6 = CrvEnsureCCW(Crv=filter_60, Pln=pl_5)  # -> CCWCrv; inputs Crv: Curve, Pln: Plane; same code as crvensureccw
cap_infill_curves = Curve(crvensureccw_6)

# ----
# UNIFY AND MERGE WALL SLICE
# CURVES (INNER & OUTER WALLS!)
# comments & notes: UNIFY AND MERGE WALL SLICE CURVES (INNER & OUTER WALLS!)
slice_curves_clsd_outer_4 = Curve(slice_curves_clsd_outer)
outer_wall_curves = Curve(slice_curves_clsd_outer_4)
slice_curves_clsd_inner_3 = Curve(slice_curves_clsd_inner)
merge_7 = Merge(Data1=slice_curves_clsd_inner_3, Data2=slice_curves_clsd_outer_4)
tstat_18 = TreeStatistics(Tree=slice_curves_clsd_inner_3)  # -> Paths, Length, Count
branch_12 = TreeBranch(Tree=merge_7, Path=tstat_18.Paths, MaintainPaths=True)
outer_wall_curves_2 = Curve(outer_wall_curves)

# ----
# WE DON'T KNOW IF THIS FIX WORKS, YET!: FIND LEAVES (BRANCHES THAT HAVE 0 AT THE END)
# REMOVE LEAVES TO AVOID DOUBLE LAYERS!
tstat_19 = TreeStatistics(Tree=branch_12)  # -> Paths, Length, Count
compare = PathCompare(Path=tstat_19.Paths, Mask="{*;*;0}")
item_6 = ListItem(List=tstat_19.Paths, Index=0, Wrap=True)
dispatch_7 = Dispatch(List=tstat_19.Paths, DispatchPattern=compare)  # -> ListA, ListB
panel_16 = Panel(compare)
dpath_5 = DeconstructPath(Branch=item_6)
lng_14 = ListLength(List=dpath_5)
branch_13 = TreeBranch(Tree=branch_12, Path=dispatch_7.ListA, MaintainPaths=True)
larger_10 = LargerThan(FirstNumber=lng_14, SecondNumber="2")  # -> LargerThan, OrEqualTo
pshift_19 = ShiftPaths(Data=branch_13, Offset=-1)
filter_61 = StreamFilter(Gate=larger_10.LargerThan, Stream0=branch_12, Stream1=pshift_19)

merged_wall_curves = Curve(filter_61)
tstat_20 = TreeStatistics(Tree=merged_wall_curves)  # -> Paths, Length, Count
null_7 = NullItem(Item=merged_wall_curves)  # -> NullFlags, InvalidFlags, Description
culltreepaths = CullTreePaths(T=outer_wall_curves_2, P=tstat_20.Paths)  # -> out, C; inputs T: tree, P: list
# ---------- culltreepaths: C# ----------
// Grasshopper Script Instance
#region Usings
using System;
using System.Linq;
using System.Collections;
using System.Collections.Generic;
using System.Drawing;

using Rhino;
using Rhino.Geometry;

using Grasshopper;
using Grasshopper.Kernel;
using Grasshopper.Kernel.Data;
using Grasshopper.Kernel.Types;
#endregion

public class Script_Instance : GH_ScriptInstance
{
    #region Notes
    /* 
      Members:
        RhinoDoc RhinoDocument
        GH_Document GrasshopperDocument
        IGH_Component Component
        int Iteration

      Methods (Virtual & overridable):
        Print(string text)
        Print(string format, params object[] args)
        Reflect(object obj)
        Reflect(object obj, string method_name)
    
    Author: Max Benjamin Eschenbach
    License: MIT License
    Version: 250314
    */
    #endregion

    private void RunScript(DataTree<object> T, List<object> P, ref object C)
    {
        // set component params
        this.Component.Name = "CullTreePaths";
        this.Component.NickName = "CullTreePaths";
        this.Component.Category = "DDUClayPrintingSlicer";
        this.Component.SubCategory = "9 Utilities";
        
        DataTree<object> NewTree = new DataTree<object>(T);
        if (P != null)
        {
            for (int i = 0; i < P.Count; i++)
            {
                // cast gh path to object
                GH_Path ghp = (GH_Path) P[i];
                // remove path from tree
                NewTree.RemovePath(ghp);
            }
        }
        C = NewTree;
    }
}
# ---------- end culltreepaths ----------
or_11 = GateOr(A=null_7.NullFlags, B=null_7.InvalidFlags)
filter_62 = StreamFilter(Gate=or_11, Stream0=merged_wall_curves)
merge_8 = Merge(Data1=filter_62, Data2=culltreepaths.C)
unified_wall_curves = Curve(merge_8)

custom_curves_floor_wall_curves_2 = Curve(custom_curves_floor_wall_curves)
unified_wall_curves_2 = Curve(unified_wall_curves)
add_floor_custom_curves_enabled_4 = Boolean(add_floor_custom_curves_enabled)
filter_63 = StreamFilter(Gate=add_floor_custom_curves_enabled_4, Stream0=unified_wall_curves_2, Stream1=custom_curves_floor_wall_curves_2)
unified_wall_curves_3 = Data(filter_63)

# ----
# CONTROL FLOW
# - PARALLEL WALL CURVES
# - NP SLICE CURVES
# - INJECT CUSTOM CURVES
# comments & notes: inject custom printing curves based on toggle
custom_curves_wo_floor_wall_curves_2 = Curve(custom_curves_wo_floor_wall_curves)
synthesize_floor_for_custom_curves_4 = Data(synthesize_floor_for_custom_curves)
custom_curves_at_origin_3 = Curve(custom_curves_at_origin)
inject_custom_curves_11 = Data(inject_custom_curves)
unified_wall_curves_4 = Curve(unified_wall_curves_3)
np_slicing_enabled_5 = Boolean(np_slicing_enabled)
np_slice_curves_2 = Data(np_slice_curves)
filter_64 = StreamFilter(Gate=np_slicing_enabled_5, Stream0=unified_wall_curves_4, Stream1=np_slice_curves_2)
filter_65 = StreamFilter(
    Gate=synthesize_floor_for_custom_curves_4,
    Stream0=custom_curves_at_origin_3,
    Stream1=custom_curves_wo_floor_wall_curves_2)
filter_66 = StreamFilter(Gate=inject_custom_curves_11, Stream0=filter_64, Stream1=filter_65)
slice_curves_3 = Curve(filter_66)

# ----
# SEAM ADJUSTMENT
# comments & notes: adjust seam of all printing curves based on input params
slice_curves_4 = Curve(slice_curves_3)
comments_notes_33 = Panel("synchronize curve direction")
item_7 = ListItem(List=flatten(slice_curves_4), Index=0, Wrap=True)
flip = FlipCurve(Curve=slice_curves_4, Guide=item_7)  # -> Curve, Flag
lng_15 = ListLength(List=flip.Curve)  # -> flatten(Length)
larger_11 = LargerThan(FirstNumber=lng_15, SecondNumber="1")  # -> LargerThan, OrEqualTo
ma_13 = MassAddition(Input=larger_11.LargerThan)  # -> Result, PartialResults
spiralize_contours_5 = Data(spiralize_contours)
randomize_seam_2 = Boolean(randomize_seam)
geometryisbranching = Boolean(ma_13.Result)
rnd_seam_seed_2 = Data(rnd_seam_seed)
adjustseaminfo = AdjustSeamInfo(RandomizeSeam=randomize_seam_2, SpiralizeContours=spiralize_contours_5, GeometryIsBranching=geometryisbranching)  # -> GATE; inputs RandomizeSeam: Boolean, SpiralizeContours: Boolean, GeometryIsBranching: Boolean
# ---------- adjustseaminfo: Python ----------
import System
import Rhino
import Grasshopper
import rhinoscriptsyntax as rs

# GHENV COMPONENT SETTINGS
ghenv.Component.Name = "AdjustSeamInfo"
ghenv.Component.NickName = "AdjustSeamInfo"
ghenv.Component.Category = "DDUClayPrintingSlicer"
ghenv.Component.SubCategory = "9 Utilities"

class AdjustSeamInfo(Grasshopper.Kernel.GH_ScriptInstance):
    """
    Author: Max Benjamin Eschenbach
    License: MIT License
    Version: 250314
    """
    def RunScript(self,
            RandomizeSeam: bool,
            SpiralizeContours: bool,
            GeometryIsBranching: bool):
        GATE = 0
        if not RandomizeSeam:
            GATE = 0
        elif RandomizeSeam and not SpiralizeContours:
            GATE = 2
        elif RandomizeSeam and GeometryIsBranching:
            GATE = 2
        else:
            GATE = 1
        return GATE
# ---------- end adjustseaminfo ----------
panel_17 = Panel("[SETTING IGNORED] Seam randomization is not applicable with spiralization.")
adjust_seam_2 = Data(adjust_seam)
adjustsliceseams = AdjustSliceSeams(Curves=flip.Curve, SeamAdjust=adjust_seam_2, Randomize=adjustseaminfo, Seed=rnd_seam_seed_2)  # -> OutCurves; inputs Curves: tree of Curve, SeamAdjust: Double, Randomize: Boolean, Seed: Int32
# ---------- adjustsliceseams: C# ----------
#region Usings
using System;
using System.Linq;
using System.Collections;
using System.Collections.Generic;
using System.Drawing;

using Rhino;
using Rhino.Geometry;

using Grasshopper;
using Grasshopper.Kernel;
using Grasshopper.Kernel.Data;
using Grasshopper.Kernel.Types;
#endregion

public class Script_Instance : GH_ScriptInstance
{
    #region Notes
    /* 
      Members:
        RhinoDoc RhinoDocument
        GH_Document GrasshopperDocument
        IGH_Component Component
        int Iteration

      Methods (Virtual & overridable):
        Print(string text)
        Print(string format, params object[] args)
        Reflect(object obj)
        Reflect(object obj, string method_name)
    
    Author: Max Benjamin Eschenbach
    License: MIT License
    Version: 250517
    */
    #endregion

    private void RunScript(
		DataTree<Curve> Curves,
		double SeamAdjust,
		bool Randomize,
		int Seed,
		ref object OutCurves)
    {
        // set component params
        this.Component.Name = "AdjustSliceSeams";
        this.Component.NickName = "AdjustSliceSeams";
        this.Component.Category = "DDUClayPrintingSlicer";
        this.Component.SubCategory = "2 Slice Processing";

        if (Curves != null && Curves.DataCount > 0)
        {
            // reparametrize domain of first input curve
            Curves.Branches[0][0].Domain = new Rhino.Geometry.Interval(0.0, 1.0);
            // sanitize negative seam adjust values
            if (SeamAdjust < 0) SeamAdjust = 1.0 + SeamAdjust;
            // get normalized length parameter based on adjust value
            double CrvLP;
            Curves.Branches[0][0].NormalizedLengthParameter(SeamAdjust, out CrvLP);
            // use adjust value for first seam adjustment
            Curves.Branches[0][0].ChangeClosedCurveSeam(CrvLP);
            // get initial sample point after seam adjustment (is now point at start)
            Point3d samplePt = Curves.Branches[0][0].PointAtStart;
            // create random instance with seed for randomization
            Random RandSeam = new Random(Seed);

            // loop over all branches of curves
            for (int i = 0; i < Curves.BranchCount; i++)
            {
                for (int j = 0; j < Curves.Branches[i].Count; j++)
                {
                    // skip the first curve in the first branch
                    // because it is already preprocessed before the loop
                    if (i == 0 && j == 0) continue;
                    // skip open curves
                    if (!Curves.Branches[i][j].IsClosed) continue;
                    // init parameter var
                    double t;
                    // reparametrize domain
                    Curves.Branches[i][j].Domain = new Rhino.Geometry.Interval(0.0, 1.0);
                    if (Randomize)
                    {
                        Curves.Branches[i][j].ChangeClosedCurveSeam(RandSeam.NextDouble());
                    }
                    else
                    {
                        // get cp based on sample point
                        Curves.Branches[i][j].ClosestPoint(samplePt, out t);
                        // set seam
                        Curves.Branches[i][j].ChangeClosedCurveSeam(t);
                    }
                    // reparam again
                    Curves.Branches[i][j].Domain = new Rhino.Geometry.Interval(0.0, 1.0);
                }
                // set sample point for next branch
                samplePt = Curves.Branches[i][0].PointAtStart;
            }
        }
        else
        {
            Curves = new DataTree<Curve>();
        }
        OutCurves = Curves;
    }
}
# ---------- end adjustsliceseams ----------
bypass_seam_adjustment_2 = Data(bypass_seam_adjustment)
filter_67 = StreamFilter(Gate=adjustseaminfo, Stream1=panel_17, Stream2="[INFO] Seam is randomized.")
filter_68 = StreamFilter(Gate=bypass_seam_adjustment_2, Stream0=filter_67, Stream1="[INFO] Seam adjustment is bypassed!")
filter_69 = StreamFilter(Gate=bypass_seam_adjustment_2, Stream0=adjustsliceseams, Stream1=flip.Curve)
info_randomization = Data(filter_68)
slice_curves_5 = Curve(filter_69)

# ----
# comments & notes: shift curves to create layer pairs
overhang_offset_analysis_2 = Data(overhang_offset_analysis)
slice_curves_6 = Curve(slice_curves_5)
inject_custom_curves_12 = Data(inject_custom_curves)
filter_70 = StreamFilter(Gate=inject_custom_curves_12, Stream0=overhang_offset_analysis_2, Stream1="False")
filter_71 = StreamFilter(Gate=filter_70, Stream1=slice_curves_6)
overhang_offset_analysis_activated = Boolean(filter_70)
tstat_21 = TreeStatistics(Tree=filter_71)  # -> Paths, Length, Count
shift = ShiftList(List=tstat_21.Paths, Shift=1, Wrap=False)
shift_2 = ShiftList(List=tstat_21.Paths, Shift=-1, Wrap=False)
branch_14 = TreeBranch(Tree=filter_71, Path=shift, MaintainPaths=True)
branch_15 = TreeBranch(Tree=filter_71, Path=shift_2, MaintainPaths=True)
upper_crvs = Data(branch_14)
lower_crvs = Data(branch_15)

# ----
# OVERHANG ANGLE ANALYSIS
# comments & notes: shift curves to create layer pairs
# comments & notes: divide curve A and find CP on curve B
overhang_angle_analysis_2 = Data(overhang_angle_analysis)
inject_custom_curves_13 = Data(inject_custom_curves)
slice_curves_7 = Curve(slice_curves_5)
comments_notes_34 = Panel("OVERHANG ANGLE ANALYSIS")
filter_72 = StreamFilter(Gate=inject_custom_curves_13, Stream0=overhang_angle_analysis_2, Stream1="False")
filter_73 = StreamFilter(Gate=filter_72, Stream1=slice_curves_7)
overhang_angle_analysis_activated = Boolean(filter_72)
tstat_22 = TreeStatistics(Tree=filter_73)  # -> Paths, Length, Count
overhang_analysis_resolution_2 = Data(overhang_analysis_resolution)
shift_3 = ShiftList(List=tstat_22.Paths, Shift=-1, Wrap=False)
shift_4 = ShiftList(List=tstat_22.Paths, Shift=1, Wrap=False)
branch_16 = TreeBranch(Tree=filter_73, Path=shift_3, MaintainPaths=True)
branch_17 = TreeBranch(Tree=filter_73, Path=shift_4, MaintainPaths=True)
divide_2 = DivideCurve(Curve=branch_17, Count=overhang_analysis_resolution_2, Kinks=False)  # -> Points, Tangents, Parameters
pshift_20 = ShiftPaths(Data=divide_2.Points, Offset=-1)
crv_cp = CurveClosestPoint(Point=pshift_20, Curve=branch_16)  # -> Point, Parameter, Distance
vec2pt_3 = Vector2Pt(PointA=crv_cp.Point, PointB=pshift_20, Unitize=False)  # -> Vector, Length
Z_10 = UnitZ(Factor=1)
ln = Line(StartPoint=crv_cp.Point, EndPoint=pshift_20)
angle = Angle(VectorA=vec2pt_3.Vector, VectorB=Z_10)  # -> Angle, Reflex
deg = Degrees(Radians=angle.Angle)  # -> flatten(Degrees)
sort_3 = SortList(Keys=deg)  # -> reverse(Keys), ValuesA
overhang_angle_analysis_displaylines = Data(ln)
overhang_angle_analysis_values = Data(deg)
item_8 = ListItem(List=sort_3.Keys, Index=0, Wrap=True)
overhang_angle_analysis_activated_2 = Boolean(overhang_angle_analysis_activated)
rtd_2 = RoundToDecimal(Numbers=item_8)  # -> Rounded; inputs Numbers: list of Double, DecimalPlaces: list of Int32; same code as rtd
format_2 = Format(Format="Most Extreme Overhang Angle: {0}°", Culture=127, Data0=rtd_2)
filter_74 = StreamFilter(Gate=overhang_angle_analysis_activated_2, Stream1=format_2)
panel_18 = Panel(format_2)
overhang_angle_analysis_info = Data(filter_74)

overhang_analysis_resolution_3 = Data(overhang_analysis_resolution)
upper_crvs_2 = Data(upper_crvs)
lower_crvs_2 = Data(lower_crvs)
divide_3 = DivideCurve(Curve=reparameterize(lower_crvs_2), Count=overhang_analysis_resolution_3, Kinks=False)  # -> Points, Tangents, Parameters
lower_ref_points = Data(divide_3.Points)
crv_cp_2 = CurveClosestPoint(Point=lower_ref_points, Curve=upper_crvs_2)  # -> Point, Parameter, Distance
eval = EvaluateCurve(Curve=upper_crvs_2, Parameter=crv_cp_2.Parameter)  # -> Point, Tangent, Angle
pl_6 = PlaneNormal(Origin=lower_ref_points, ZAxis=divide_3.Tangents)
pl_7 = PlaneNormal(Origin=eval.Point, ZAxis=eval.Tangent)
deplane_2 = DeconstructPlane(Plane=pl_7)  # -> Origin, XAxis, YAxis, ZAxis
deplane_3 = DeconstructPlane(Plane=pl_6)  # -> Origin, XAxis, YAxis, ZAxis
data = Data(flatten(deplane_2.ZAxis))
data_2 = Data(flatten(deplane_3.ZAxis))
merge_9 = Merge(Data1=graft(data), Data2=graft(data_2))
avr_4 = Average(Input=merge_9)  # -> flatten(ArithmeticMean)
unflatten = UnflattenTree(Tree=avr_4, Guide=pl_7)
pl_8 = PlaneNormal(Origin=deplane_2.Origin, ZAxis=unflatten)
lower_ref_points_2 = Data(lower_ref_points)
pcx = CurvePlane(Curve=upper_crvs_2, Plane=pl_8)  # -> Points, ParamsC, ParamsP
dist = Distance(PointA=graft(lower_ref_points_2), PointB=pcx.Points)
sort_4 = SortList(Keys=dist, ValuesA=pcx.Points)  # -> Keys, ValuesA
item_9 = ListItem(List=sort_4.ValuesA, Index=0, Wrap=True)
pshift_21 = ShiftPaths(Data=item_9, Offset=-1)
upper_ref_points = Data(pshift_21)

# ----
# OVERHANG OFFSET ANALYSIS
comments_notes_35 = Panel("OVERHANG OFFSET ANALYSIS")
pcx_2 = CurvePlane(Curve=lower_crvs_2, Plane=pl_8)  # -> Points, ParamsC, ParamsP

overhang_angle_analysis_max_distance = Data(overhang_offset_maxdist)
lower_ref_points_3 = Data(lower_ref_points)
upper_ref_points_2 = Data(upper_ref_points)
dist_2 = Distance(PointA=upper_ref_points_2, PointB=lower_ref_points_3)
smaller_5 = SmallerThan(FirstNumber=dist_2, SecondNumber=overhang_angle_analysis_max_distance)  # -> SmallerThan, OrEqualTo
dispatch_8 = Dispatch(List=upper_ref_points_2, DispatchPattern=smaller_5.SmallerThan)  # -> ListA, ListB
dispatch_9 = Dispatch(List=lower_ref_points_3, DispatchPattern=smaller_5.SmallerThan)  # -> ListA, ListB
lower_ref_points_sanitized = Data(dispatch_9.ListA)
upper_ref_points_sanitized = Data(dispatch_8.ListA)

lower_ref_points_sanitized_2 = Data(lower_ref_points_sanitized)
upper_ref_points_sanitized_2 = Data(upper_ref_points_sanitized)
xy_6 = XYPlane(Origin=lower_ref_points_sanitized_2)
project_5 = Project(Geometry=upper_ref_points_sanitized_2, Plane=xy_6)  # -> Geometry, Transform
ln_2 = Line(StartPoint=upper_ref_points_sanitized_2, EndPoint=lower_ref_points_sanitized_2)
pshift_22 = ShiftPaths(Data=ln_2, Offset=-1)
dist_3 = Distance(PointA=project_5.Geometry, PointB=lower_ref_points_sanitized_2)
ln_3 = Line(StartPoint=project_5.Geometry, EndPoint=lower_ref_points_sanitized_2)
end = EndPoints(Curve=pshift_22)  # -> Start, End
pshift_23 = ShiftPaths(Data=dist_3, Offset=-1)
pshift_24 = ShiftPaths(Data=ln_3, Offset=-1)
end_2 = EndPoints(Curve=pshift_24)  # -> Start, End
ln_4 = Line(StartPoint=end_2.Start, EndPoint=end.Start)
overhang_offset_distance_displaylines = Data(pshift_24)
merge_10 = Merge(Data1=graft(pshift_24), Data2=graft(pshift_22), Data3=graft(ln_4))
overhang_offset_distance_values = Data(pshift_23)
join_6 = JoinCurves(Curves=merge_10, Preserve=False)
pshift_25 = ShiftPaths(Data=join_6, Offset=-2)
boundary = BoundarySurfaces(Edges=pshift_25)
overhang_offset_distance_displaytriangle = Data(boundary)  # "OVERHANG_OFFSET_DISTANCE_DISPLAYTRIANGLES"

overhang_offset_distance_values_2 = Data(overhang_offset_distance_values)
sort_5 = SortList(Keys=flatten(overhang_offset_distance_values_2))  # -> reverse(Keys), ValuesA
item_10 = ListItem(List=sort_5.Keys, Index=0, Wrap=True)
overhang_offset_analysis_activated_2 = Boolean(overhang_offset_analysis_activated)
rtd_3 = RoundToDecimal(Numbers=item_10)  # -> Rounded; inputs Numbers: list of Double, DecimalPlaces: list of Int32; same code as rtd
format_3 = Format(Format="Most Extreme Overhang Offset: {0} mm", Culture=127, Data0=rtd_3)
filter_75 = StreamFilter(Gate=overhang_offset_analysis_activated_2, Stream1=format_3)
panel_19 = Panel(format_3)
overhang_offset_analysis_info = Data(filter_75)

# ----
# comments & notes: create unified floor layers by extracting floor branches from wall curves and then merging the two
floor_infill_curves_2 = Curve(floor_infill_curves)
print_infill_before_walls_2 = Data(print_infill_before_walls)
unified_wall_curves_5 = Data(unified_wall_curves_3)
tstat_23 = TreeStatistics(Tree=floor_infill_curves_2)  # -> Paths, Length, Count
branch_18 = TreeBranch(Tree=unified_wall_curves_5, Path=tstat_23.Paths, MaintainPaths=True)
merge_11 = Merge(Data1=branch_18, Data2=floor_infill_curves_2)
merge_12 = Merge(Data1=floor_infill_curves_2, Data2=branch_18)
filter_76 = StreamFilter(Gate=print_infill_before_walls_2, Stream0=merge_11, Stream1=merge_12)
unified_wall_floor_layers = Geometry(filter_76)

# ----
# PRINT PATH MANIPULATION
# OF INDIVIDUAL LAYERS
# BEFORE SPIRALIZATION
# comments & notes: PRINT PATH MANIPULATION
# OF INDIVIDUAL LAYERS BEFORE SPIRALIZATION
# comments & notes: here you can script your own print path manipulation BEFORE any spiralization. Pay attention to the datasrtucture the print paths are in. Each Path of the DataTree contains the curves of one printing layer.
enable_ppm_before_spiral = BooleanToggle(False)
manipulated_slice_curves = Data()

enable_ppm_before_spiral_2 = Data(enable_ppm_before_spiral)
slice_curves_8 = Data(slice_curves_5)
gate_18 = StreamGate(Stream=slice_curves_8, Gate=enable_ppm_before_spiral_2)  # -> Target0, Target1
slice_curves_unmanipulated = Data(gate_18.Target0)
slice_curves_9 = Data(gate_18.Target1)

slice_curves_10 = Data(slice_curves_9)

manipulated_slice_curves_2 = Data(manipulated_slice_curves)
enableprintpathmanipulation_beforespiral = Data(enable_ppm_before_spiral_2)
slice_curves_11 = Data(slice_curves_9)
original_slice_curves = Data(slice_curves_unmanipulated)
end_3 = EndPoints(Curve=slice_curves_11)  # -> Start, End
crv_cp_3 = CurveClosestPoint(Point=end_3.Start, Curve=reparameterize(manipulated_slice_curves_2))  # -> Point, Parameter, Distance
seam = Seam(Curve=reparameterize(manipulated_slice_curves_2), Seam=crv_cp_3.Parameter)
filter_77 = StreamFilter(Gate=enableprintpathmanipulation_beforespiral, Stream0=original_slice_curves, Stream1=seam)
slice_curves_12 = Data(filter_77)

slice_curves_13 = Curve(slice_curves_12)
lng_16 = ListLength(List=slice_curves_13)
larger_12 = LargerThan(FirstNumber=flatten(lng_16), SecondNumber="1")  # -> LargerThan, OrEqualTo
ma_14 = MassAddition(Input=larger_12.LargerThan)  # -> Result, PartialResults
larger_13 = LargerThan(FirstNumber=ma_14.Result, SecondNumber="1")  # -> LargerThan, OrEqualTo
and_13 = GateAnd(A=spiralize_contours_3, B=invert(printing_geometry_closed_5), C=invert(larger_13.LargerThan))
and_14 = GateAnd(C=spiralize_contours_3, A=inject_custom_curves_10, B=invert(larger_13.LargerThan))
filter_78 = StreamFilter(Gate=inject_custom_curves_10, Stream0=and_13, Stream1=and_14)
filter_79 = StreamFilter(Gate=inject_custom_curves_10, Stream0=and_13, Stream1=and_14)
spiralization_gate_boolean = Boolean(filter_78)
spiralization_enabled = Boolean(filter_79)

spiralization_enabled_2 = Boolean(spiralization_enabled)
filter_80 = StreamFilter(Gate=spiralization_enabled_2, Stream0=filter_55, Stream1="[INFO] Spiralizing Contours...")
info_spiralize_contours = Data(filter_80)

spiralization_enabled_3 = Boolean(spiralization_enabled)
and_15 = GateAnd(A=enable_back_forth_on_open_curves_2, B=spiralization_enabled_3, C=one_open_curve_per_branch_3, D=datatree_paths_align_3)
back_forth_open_crvs_enabled = Data(and_15)

back_forth_open_crvs_enabled_2 = Data(back_forth_open_crvs_enabled)
spiralization_enabled_4 = Boolean(spiralization_enabled)
filter_81 = StreamFilter(Gate=spiralization_enabled_4, Stream0=panel_14)
not_8 = GateNot(A=back_forth_open_crvs_enabled_2)
not_9 = GateNot(A=spiralization_enabled_4)
merge_13 = Merge(Data1=filter_81, Data2=filter_54, Data3=filter_53)
and_16 = GateAnd(A=not_8, B=not_9)
filter_82 = StreamFilter(Gate=and_16, Stream0=merge_13)
filter_83 = StreamFilter(Gate=back_forth_open_crvs_enabled_2, Stream0=filter_82, Stream1="[INFO] Stitching Open Curves with Back-Forth Logic...")
info_backforth_open_crvs = Data(filter_83)

# ----
# CONTROL FLOW
# CONTOUR SPIRALIZATION
spiralization_gate_boolean_2 = Boolean(spiralization_gate_boolean)
slice_curves_14 = Curve(slice_curves_12)
gate_19 = StreamGate(Stream=slice_curves_14, Gate=spiralization_gate_boolean_2)  # -> Target0, Target1
slice_curves_15 = Curve(gate_19.Target0)
slice_curves_16 = Curve(gate_19.Target1)

# ----
# comments & notes: split off floor layers from slice curves before spiralization
outer_layers_floor_3 = Data(outer_layers_floor)
tstat_24 = TreeStatistics(Tree=outer_layers_floor_3)  # -> Paths, Length, Count
null_8 = NullItem(Item=tstat_24.Paths)  # -> NullFlags, InvalidFlags, Description
ma_15 = MassAddition(Input=null_8.NullFlags)  # -> Result, PartialResults
larger_14 = LargerThan(FirstNumber=ma_15.Result, SecondNumber="0")  # -> LargerThan, OrEqualTo
slice_curves_17 = Curve(slice_curves_16)
filter_84 = StreamFilter(Gate=larger_14.LargerThan, Stream0=tstat_24.Paths)
tstat_25 = TreeStatistics(Tree=slice_curves_17)  # -> Paths, Length, Count
txt = Text(filter_84)
txt_2 = Text(tstat_25.Paths)
difference = SetDifference(SetA=txt_2, SetB=txt)
branch_19 = TreeBranch(Tree=slice_curves_17, Path=difference, MaintainPaths=True)
floorcleaned_slice_curves = Curve(branch_19)

# ----
# comments & notes: create uniform resolution and this/next datastructure for spralization
spiral_resolution_2 = Integer(spiral_resolution)
slice_curves_18 = Curve(flatten(floorcleaned_slice_curves))
divide_4 = DivideCurve(Curve=slice_curves_18, Count=spiral_resolution_2, Kinks=False)  # -> Points, Tangents, Parameters
tstat_26 = TreeStatistics(Tree=divide_4.Points)  # -> Paths, Length, Count
shift_5 = ShiftList(List=tstat_26.Paths, Shift="-1", Wrap=False)
shift_6 = ShiftList(List=tstat_26.Paths, Shift="1", Wrap=False)
branch_20 = TreeBranch(Tree=divide_4.Points, Path=shift_5, MaintainPaths=True)
branch_21 = TreeBranch(Tree=divide_4.Points, Path=shift_6, MaintainPaths=True)
item_11 = ListItem(List=branch_20, Index=0, Wrap=True)
item_12 = ListItem(List=branch_21, Index=0, Wrap=True)
merge_14 = Merge(Data1=branch_21, Data2=item_12)
merge_15 = Merge(Data1=branch_20, Data2=item_11)
spiral_points_a = Data(merge_15)
spiral_points_b = Data(merge_14)

# ----
# CONTROL FLOW
# BACK-FORTH STITCHING
# OPEN CURVES
back_forth_open_crvs_enabled_3 = Data(back_forth_open_crvs_enabled)
slice_curves_open_6 = Curve(slice_curves_open_3)
gate_20 = StreamGate(Stream=slice_curves_open_6, Gate=back_forth_open_crvs_enabled_3)  # -> Target0, Target1
slice_curves_open_to_backforth = Curve(gate_20.Target1)
slice_curves_open_7 = Curve(gate_20.Target0)

# ----
# comments & notes: create base spiralizing paths
spiral_ramp_percentage_2 = Data(spiral_ramp_percentage)
spiral_points_a_2 = Data(spiral_points_a)
spiral_points_b_2 = Data(spiral_points_b)
lng_17 = ListLength(List=spiral_points_a_2)
multiplication_3 = Multiplication(A=spiral_ramp_percentage_2, B="0.01")
subtraction_4 = Subtraction(A="1", B=multiplication_3)
multiplication_4 = Multiplication(A=lng_17, B=subtraction_4)
round_2 = Round(Number=multiplication_4)  # -> Nearest, Floor, Ceiling
subtraction_5 = Subtraction(A=lng_17, B="1")
min = Minimum(A=round_2.Nearest, B=subtraction_5)
split_3 = SplitList(List=spiral_points_a_2, Index=min)  # -> ListA, ListB
split_4 = SplitList(List=spiral_points_b_2, Index=min)  # -> ListA, ListB
subtraction_6 = Subtraction(A=lng_17, B=round_2.Nearest)
dom = ConstructDomain(DomainStart="0", DomainEnd="1")
vec2pt_4 = Vector2Pt(PointA=split_3.ListB, PointB=split_4.ListB, Unitize=False)  # -> Vector, Length
range = Range(Domain=dom, Steps=expr("x-1", subtraction_6))
multiplication_5 = Multiplication(A=vec2pt_4.Vector, B=range)
move_5 = Move(Geometry=split_3.ListB, Motion=multiplication_5)  # -> Geometry, Transform
merge_16 = Merge(Data1=split_3.ListA, Data2=move_5.Geometry)
pshift_26 = ShiftPaths(Data=merge_16, Offset=-1)
pline_2 = PolyLine(Vertices=pshift_26, Closed=False)
spiral_ramp_points = Data(move_5.Geometry)
spiralcontours_base = Data(pline_2)

# ----
# LAYER HEIGHT ANALYSIS
spiralization_enabled_5 = Boolean(spiralization_enabled)
slice_curves_19 = Curve(slice_curves_5)
spiralcontours_base_2 = Data(spiralcontours_base)
inject_custom_curves_14 = Data(inject_custom_curves)
layer_height_analysis_2 = Data(layer_height_analysis)
filter_85 = StreamFilter(Gate=spiralization_enabled_5, Stream0=slice_curves_19, Stream1=spiralcontours_base_2)
filter_86 = StreamFilter(Gate=inject_custom_curves_14, Stream0=layer_height_analysis_2, Stream1="False")
filter_87 = StreamFilter(Gate=filter_86, Stream1=filter_85)
layer_height_analysis_activated = Data(filter_86)
contourdeviation = ContourDeviation(Contours=filter_87)  # -> MinDist, MaxDist, MinA, MaxA, MinB, MaxB; inputs Contours: tree of Curve
# ---------- contourdeviation: C# ----------
#region Usings
using System;
using System.Linq;
using System.Collections;
using System.Collections.Generic;
using System.Drawing;

using Rhino;
using Rhino.Geometry;

using Grasshopper;
using Grasshopper.Kernel;
using Grasshopper.Kernel.Data;
using Grasshopper.Kernel.Types;
#endregion

public class Script_Instance : GH_ScriptInstance
{
    #region Notes
    /* 
      Members:
        RhinoDoc RhinoDocument
        GH_Document GrasshopperDocument
        IGH_Component Component
        int Iteration

      Methods (Virtual & overridable):
        Print(string text)
        Print(string format, params object[] args)
        Reflect(object obj)
        Reflect(object obj, string method_name)

    Author: Max Benjamin Eschenbach
    License: MIT License
    Version: 250314
    */
    #endregion

  private void RunScript(
		DataTree<Curve> Contours,
		ref object MinDist,
		ref object MaxDist,
		ref object MinA,
		ref object MaxA,
		ref object MinB,
		ref object MaxB)
  {
    // set component params
    this.Component.Name = "ContourDeviation";
    this.Component.NickName = "ContourDeviation";
    this.Component.Category = "DDUClayPrintingSlicer";
    this.Component.SubCategory = "6 Analysis";

    DataTree<object> minDistances = new DataTree<object>();
    DataTree<object> maxDistances = new DataTree<object>();
    DataTree<object> minA = new DataTree<object>();
    DataTree<object> maxA = new DataTree<object>();
    DataTree<object> minB = new DataTree<object>();
    DataTree<object> maxB = new DataTree<object>();

    if (Contours != null)
    {
      for (int i = 0; i < Contours.BranchCount - 1; i++)
      {
        // measure distance from one curve to the next branch
        // branch can have one or many curves
        var this_branch = Contours.Branches[i];
        var next_branch = Contours.Branches[i + 1];

        // create path for output
        GH_Path ghp = new GH_Path(i);

        // case 1: both branches have one contour
        if (this_branch.Count == 1 && next_branch.Count == 1)
        {
          // get results
          List<object> results = GetMinMaxDistContours(this_branch[0], next_branch[0]);

          // add to output trees
          minDistances.Add((double) results[0], ghp);
          maxDistances.Add((double) results[1], ghp);
          minA.Add((Point3d) results[2], ghp);
          minB.Add((Point3d) results[3], ghp);
          maxA.Add((Point3d) results[4], ghp);
          maxB.Add((Point3d) results[5], ghp);
        }
          // case 2: both branches have multiple, but identical number of contours
        else if (this_branch.Count > 1 && this_branch.Count == next_branch.Count)
        {
          // compute min, max distance for every pair of contours

          //loop through branch pairs
          for (int j = 0; j < this_branch.Count; j++)
          {
            // get results
            List<object> results = GetMinMaxDistContours(this_branch[j], next_branch[j]);

            // add to output trees
            minDistances.Add((double) results[0], ghp);
            maxDistances.Add((double) results[1], ghp);
            minA.Add((Point3d) results[2], ghp);
            minB.Add((Point3d) results[3], ghp);
            maxA.Add((Point3d) results[4], ghp);
            maxB.Add((Point3d) results[5], ghp);
          }
        }
        // case 3: this branch has one contour, next branch has multiple contours
        // --> generate points on this branch's contour, pull cps for every other contour

        // case 4: this branch has multiple contours, next branch has one contour
        // --> generate points on next branch, pull cps for every contour in this branch

        // case 5: both branches have multiple contours but each has different number of contours
      }
      MinDist = minDistances;
      MaxDist = maxDistances;
      MinA = minA;
      MinB = minB;
      MaxA = maxA;
      MaxB = maxB;
    }
  }

  // <Custom additional code> 
  public List<object> GetMinMaxDistContours(Curve contourA, Curve contourB)
  {
    // init vars
    double minDist;
    double maxDist;

    Point3d minPtA = Point3d.Unset;
    Point3d minPtB = Point3d.Unset;

    Point3d maxPtA = Point3d.Unset;
    Point3d maxPtB = Point3d.Unset;

    // compute min, max distance
    double len = Math.Max(contourA.GetLength(), contourB.GetLength());
    int res = (int) Math.Round(len / 1.0, 0);

    Point3d[] ptA;
    contourA.DivideByCount(res, true, out ptA);

    minDist = double.MaxValue;
    maxDist = double.MinValue;

    for (int j = 0; j < ptA.Length; j++)
    {
      double tB;
      contourB.ClosestPoint(ptA[j], out tB);
      Point3d ptB = contourB.PointAt(tB);

      double dist = ptB.Z - ptA[j].Z;

      if (dist < minDist)
      {
        minDist = dist;
        minPtA = new Point3d(ptA[j]);
        minPtB = new Point3d(ptB);
      }

      if (dist > maxDist)
      {
        maxDist = dist;
        maxPtA = new Point3d(ptA[j]);
        maxPtB = new Point3d(ptB);
      }
    }
    return new List<object>{minDist, maxDist, minPtA, minPtB, maxPtA, maxPtB};
  }
  // </Custom additional code> 
}
# ---------- end contourdeviation ----------
comments_notes_36 = Panel("LAYER HEIGHT ANALYSIS")
avr_5 = Average(Input=[contourdeviation.MinDist, contourdeviation.MaxDist])  # -> flatten(ArithmeticMean)
ln_5 = Line(StartPoint=contourdeviation.MinA, EndPoint=contourdeviation.MinB)  # -> flatten(Line)
ln_6 = Line(StartPoint=contourdeviation.MaxA, EndPoint=contourdeviation.MaxB)  # -> flatten(Line)
bnd = Bounds(Numbers=flatten([contourdeviation.MinDist, contourdeviation.MaxDist]))
layer_height_analysis_domain = Data(bnd)
layer_height_analysis_minlines = Data(ln_5)
layer_height_analysis_maxlines = Data(ln_6)
avr_6 = Average(Input=avr_5)
bnd_2 = Bounds(Numbers=avr_5)
layer_height_analysis_activated_2 = Data(layer_height_analysis_activated)
panel_20 = Panel(avr_6)
panel_21 = Panel(layer_height_analysis_domain)
panel_22 = Panel(bnd_2)
format_4 = Format(Format="Average: {0}", Culture=127, Data0=panel_20)
format_5 = Format(Format="Average Bounds: {0}", Culture=127, Data0=panel_22)
format_6 = Format(Format="Extremes: {0}", Culture=127, Data0=panel_21)
merge_17 = Merge(Data1=format_6, Data2=format_5, Data3=format_4)
filter_88 = StreamFilter(Gate=layer_height_analysis_activated_2, Stream1=merge_17)
average = Panel(merge_17)
layer_height_analysis_info = Data(filter_88)

# ----
# comments & notes: create base spiralizing paths with Mirko's method
spiral_points_b_3 = Data(spiral_points_b)
spiral_points_a_3 = Data(spiral_points_a)
tstat_27 = TreeStatistics(Tree=spiral_points_b_3)  # -> Paths, Length, Count
item_13 = ListItem(List=tstat_27.Paths, Index=0, Wrap=True)  # -> Item1, Item
branch_22 = TreeBranch(Tree=spiral_points_b_3, Path=item_13.Item1, MaintainPaths=True)
merge_18 = Merge(Data1=spiral_points_a_3, Data2=branch_22)
spiral_points_zinterp = Data(merge_18)
pdecon_6 = Deconstruct(Point=flatten(spiral_points_zinterp))  # -> XComponent, YComponent, ZComponent
sort_6 = SortList(Keys=pdecon_6.ZComponent)  # -> Keys, ValuesA
item_14 = ListItem(List=sort_6.Keys, Index=0, Wrap=True)  # -> Item1, Item
Z_11 = UnitZ(Factor=item_14.Item1)
pt_4 = Point(Point(0, 0, 0))
lng_18 = ListLength(List=pdecon_6.ZComponent)
move_6 = Move(Geometry=pt_4, Motion=Z_11)  # -> Geometry, Transform
subtraction_7 = Subtraction(A=lng_18, B=1)
ln_7 = Line(StartPoint=pt_4, EndPoint=move_6.Geometry)
divide_5 = DivideCurve(Curve=ln_7, Count=subtraction_7, Kinks=False)  # -> Points, Tangents, Parameters
pdecon_7 = Deconstruct(Point=divide_5.Points)  # -> XComponent, YComponent, ZComponent
pt_5 = ConstructPoint(XCoordinate=pdecon_6.XComponent, YCoordinate=pdecon_6.YComponent, ZCoordinate=pdecon_7.ZComponent)
pline_3 = PolyLine(Vertices=pt_5, Closed=False)
spiralcontours_base_zinterp = Data(pline_3)

# ----
# BACK-FORTH PATHS FOR OPEN CURVES
# comments & notes: flip direction of all B curves and then use connect crvs to create the continuous path
# comments & notes: dispatch curves in A/B based on datatree paths
# comments & notes: flatten and use the lowest initial path to "remap" the datastructure to the continuous curve
slice_curves_open_to_backforth_2 = Curve(slice_curves_open_to_backforth)
tstat_28 = TreeStatistics(Tree=slice_curves_open_to_backforth_2)  # -> Paths, Length, Count
panel_23 = Panel("""True
False""")
item_15 = ListItem(List=tstat_28.Paths, Index=0, Wrap=True)
dispatch_10 = Dispatch(List=tstat_28.Paths, DispatchPattern=panel_23)  # -> ListA, ListB
branch_23 = TreeBranch(Tree=slice_curves_open_to_backforth_2, Path=dispatch_10.ListB, MaintainPaths=True)
# comments & notes: BACK-FORTH PATHS FOR OPEN CURVES
branch_24 = TreeBranch(Tree=slice_curves_open_to_backforth_2, Path=dispatch_10.ListA, MaintainPaths=True)
flip_2 = FlipCurve(Curve=branch_23)  # -> Curve, Flag
merge_19 = Merge(Data1=branch_24, Data2=flip_2.Curve)  # -> flatten(Result)
connect = ConnectCurves(Curves=merge_19, Continuity=0, Close=False, Bulge=1)  # -> flatten(Curve)
tstat_29 = TreeStatistics(Tree=connect)  # -> Paths, Length, Count
replace_4 = ReplacePaths(Data=connect, Search=tstat_29.Paths, Replace=item_15)
slice_curves_open_backforth = Curve(replace_4)

# ----
# comments & notes: create extension on last layer
spiral_points_b_4 = Data(spiral_points_b)
tstat_30 = TreeStatistics(Tree=spiral_points_b_4)  # -> Paths, Length, Count
item_16 = ListItem(List=tstat_30.Paths, Index="-1", Wrap=True)
branch_25 = TreeBranch(Tree=spiral_points_b_4, Path=item_16, MaintainPaths=True)
lng_19 = ListLength(List=branch_25)
spiral_outro_2 = Number(spiral_outro)
multiplication_6 = Multiplication(A=lng_19, B=spiral_outro_2)
subtraction_8 = Subtraction(A=lng_19, B="1")
round_3 = Round(Number=multiplication_6)  # -> Nearest, Floor, Ceiling
min_2 = Minimum(A=subtraction_8, B=round_3.Nearest)
split_5 = SplitList(List=branch_25, Index=min_2)  # -> ListA, ListB
pline_4 = PolyLine(Vertices=split_5.ListA, Closed=False)
spiralcontours_topextension = Data(pline_4)

# ----
# comments & notes: create intro on first layer
slice_curves_20 = Curve(floorcleaned_slice_curves)
tstat_31 = TreeStatistics(Tree=slice_curves_20)  # -> Paths, Length, Count
item_17 = ListItem(List=tstat_31.Paths, Index="0", Wrap=True)
branch_26 = TreeBranch(Tree=slice_curves_20, Path=item_17, MaintainPaths=True)
spiral_intro_2 = Number(spiral_intro)
subtraction_9 = Subtraction(A="1.0", B=spiral_intro_2)
item_18 = ListItem(List=branch_26, Index=0, Wrap=True)
dom_2 = ConstructDomain(DomainStart=subtraction_9, DomainEnd="1.0")
subcrv = SubCurve(BaseCurve=reparameterize(item_18), Domain=dom_2)
topoly_6 = CurveToPolyline(Curve=subcrv, ToleranceDistance="0.01", ToleranceAngle=0)  # -> Polyline, Segments
spiralcontours_botextension = Data(topoly_6.Polyline)

spiralcontours_base_zinterp_2 = Data(spiralcontours_base_zinterp)
mirkos_spiralization_enabled_2 = Data(mirkos_spiralization_enabled)
spiralcontours_base_3 = Data(spiralcontours_base)
spiralcontours_botextension_2 = Data(spiralcontours_botextension)
spiralcontours_topextension_2 = Data(spiralcontours_topextension)
filter_89 = StreamFilter(Gate=mirkos_spiralization_enabled_2, Stream0=spiralcontours_base_3, Stream1=spiralcontours_base_zinterp_2)
merge_20 = Merge(Data1=flatten(spiralcontours_botextension_2), Data2=flatten(filter_89), Data3=flatten(spiralcontours_topextension_2))  # -> flatten(Result)
join_7 = JoinCurves(Curves=merge_20, Preserve=False)
spiral_curve = Data(join_7)

enableprintpathmanipulation_afterspiral = Data(enable_ppm_after_spiral)
spiral_curve_2 = Data(spiral_curve)
gate_21 = StreamGate(Stream=spiral_curve_2, Gate=enableprintpathmanipulation_afterspiral)  # -> Target0, Target1
spiral_curve_3 = Data(gate_21.Target1)

# ----
# comments & notes: THIS IS JUST A FAIRLY SIMPLE EXAMPLE ...
spiral_curve_4 = Data(spiral_curve_3)
divlength = DivideLength(Curve=spiral_curve_4, Length=Slider(1, range=1..50))  # -> Points, Tangents, Parameters
partition = PartitionList(List=divlength.Points, Size=Slider(2, range=0..10))
geo = Geometry([<brep referenced from the Rhino model> x3])
printing_geometry_9 = Geometry(printing_geometry)
mesh = MeshBrep(
    Brep=geo,
    Settings={GridMaxCount=0, GridMinCount=16, JaggedSeams=False, MaxEdgeLength=0, MinEdgeLength=0.0001, MinTolerance=0, Refine=True, RefineAngle=0, RelativeTolerance=0.65, SimplePlanes=True, Tolerance=0})
split_6 = SplitList(List=partition, Index="2")  # -> ListA, ListB
pdecon_8 = Deconstruct(Point=split_6.ListA)  # -> XComponent, YComponent, ZComponent
bnd_3 = Bounds(Numbers=flatten(pdecon_8.ZComponent))
crv = Curve(<curve referenced from the Rhino model>)
remap = RemapNumbers(Value=pdecon_8.ZComponent, Source=bnd_3, Target=Domain(0, 1))  # -> Mapped, Clipped
mjoin_2 = MeshJoin(Meshes=mesh)
graph = GraphMapper(remap.Mapped, x0=0, x1=1, y0=0, y1=1, container_name="Bezier", cpx=[0, 0.2527412176, 0.7872578502, 1], cpy=[0, 1, 1, 0])
pull = PullPoint(Point=split_6.ListA, Geometry=mjoin_2, ClosestOnly=True)  # -> ClosestPoint, Distance, Index
dom_3 = ConstructDomain(DomainStart="0", DomainEnd=Slider(5, range=-100..100))
dom_4 = ConstructDomain(DomainStart="0", DomainEnd="1")
bnd_4 = Bounds(Numbers=flatten(pull.Distance))
remap_2 = RemapNumbers(Value=pull.Distance, Source=bnd_4, Target=dom_4)  # -> Mapped, Clipped
remap_3 = RemapNumbers(Value=graph, Source="0 To 1", Target=dom_3)  # -> Mapped, Clipped
meshcp = MeshClosestPoint(Point=split_6.ListA, Mesh=printing_geometry_9)  # -> Point, Index, Parameter
multiplication_7 = Multiplication(A=remap_2.Mapped, B=remap_3.Mapped)
meval = MeshEval(Mesh=printing_geometry_9, Parameter=meshcp.Parameter)  # -> Point, Normal, Colour
amp_2 = Amplitude(Vector=meval.Normal, Amplitude=multiplication_7)
devec = DeconstructVector(Vector=amp_2)  # -> XComponent, YComponent, ZComponent
vec = VectorXYZ(XComponent=devec.XComponent, YComponent=devec.YComponent, ZComponent=0)  # -> Vector, Length
move_7 = Move(Geometry=split_6.ListA, Motion=vec.Vector)  # -> Geometry, Transform
merge_21 = Merge(Data1=move_7.Geometry, Data2=split_6.ListB)  # -> flatten(Result)
intcrv = Interpolate(Vertices=merge_21, Degree=3, Periodic=False, KnotStyle=1)  # -> Curve, Length, Domain
divide_6 = DivideCurve(Count=10, Kinks=False)  # -> Points, Tangents, Parameters
topoly_7 = CurveToPolyline(Curve=intcrv.Curve, ToleranceDistance=Slider(0.01, range=0..1), ToleranceAngle=0)  # -> Polyline, Segments
manipulated_printpath = Data(topoly_7.Polyline)

enableprintpathmanipulation_afterspiral_2 = Data(enableprintpathmanipulation_afterspiral)
manipulated_printpath_2 = Data(manipulated_printpath)
filter_90 = StreamFilter(Gate=enableprintpathmanipulation_afterspiral_2, Stream0=gate_21.Target0, Stream1=manipulated_printpath_2)
spiral_curve_5 = Data(filter_90)

# ----
# comments & notes: merge spiral and floor curves if floor is enabled
unified_wall_floor_layers_2 = Geometry(unified_wall_floor_layers)
spiral_curve_6 = Data(spiral_curve_5)
null_9 = NullItem(Item=unified_wall_floor_layers_2)  # -> NullFlags, InvalidFlags, Description
tstat_32 = TreeStatistics(Tree=spiral_curve_6)  # -> Paths, Length, Count
tstat_33 = TreeStatistics(Tree=unified_wall_floor_layers_2)  # -> Paths, Length, Count
or_12 = GateOr(A=null_9.NullFlags, B=null_9.InvalidFlags)
item_19 = ListItem(List=tstat_33.Paths, Index=0, Wrap=True)  # -> Item1, Item
not_10 = GateNot(A=or_12)
dpath_6 = DeconstructPath(Branch=item_19.Item1)
lng_20 = ListLength(List=dpath_6)  # -> expr("x-1", Length)
split_7 = SplitList(List=dpath_6, Index=lng_20)  # -> ListA, ListB
addition_2 = Addition(A=split_7.ListB, B="1")
merge_22 = Merge(Data1=split_7.ListA, Data2=addition_2)
path_2 = ConstructPath(Indices=merge_22)
replace_5 = ReplacePaths(Data=spiral_curve_6, Search=tstat_32.Paths, Replace=path_2)
filter_91 = StreamFilter(Gate=not_10, Stream0=spiral_curve_6, Stream1=replace_5)
merge_23 = Merge(Data1=unified_wall_floor_layers_2, Data2=filter_91)
slice_curves_spiralized_floormerged = Curve(merge_23)

# ----
# comments & notes: merge final slice curves (from parallel slicing & addfloor slicing) with all infill curves
print_infill_before_walls_3 = Data(print_infill_before_walls)
slice_curves_21 = Curve(slice_curves_15)
floor_infill_curves_3 = Curve(floor_infill_curves)
cap_infill_curves_2 = Curve(cap_infill_curves)
merge_24 = Merge(Data1=floor_infill_curves_3, Data2=cap_infill_curves_2)
merge_25 = Merge(Data1=slice_curves_21, Data2=merge_24)
merge_26 = Merge(Data1=merge_24, Data2=slice_curves_21)
filter_92 = StreamFilter(Gate=print_infill_before_walls_3, Stream0=merge_25, Stream1=merge_26)
unified_slice_curves = Data(filter_92)

# ----
# CREATE SKIRT BASE CURVE
slice_curves_spiralized_floormerged_2 = Data(slice_curves_spiralized_floormerged)
skirt_polyline_tolerance = Slider(0.1, range=0..0.1)
skirt_entry_length = Slider(10, range=0..100)
# MERGE CURVES AND SLICES
# TO GET FINAL PRINTING CURVES
unified_slice_curves_2 = Curve(unified_slice_curves)
open_wall_curves = Curve(slice_curves_open)
# comments & notes: MERGE CURVES AND SLICES TO GET FINAL PRINTING CURVES
merge_27 = Merge(Data1=unified_slice_curves_2, Data2=open_wall_curves, Data3=slice_curves_spiralized_floormerged_2)
tstat_34 = TreeStatistics(Tree=merge_27)  # -> Paths, Length, Count
skirt_polyline_tolerance_2 = Data(skirt_polyline_tolerance)
item_20 = ListItem(List=tstat_34.Paths, Index=0, Wrap=True)  # -> Item, Item1, Item2, Item3, Item4
branch_27 = TreeBranch(Tree=merge_27, Path=[item_20.Item, item_20.Item1, item_20.Item2, item_20.Item3, item_20.Item4], MaintainPaths=True)  # -> flatten(Branch)
project_6 = Project(Geometry=branch_27, Plane=PlaneXY(0, 0, 0))  # -> Geometry, Transform
comments_notes_37 = Panel("create skirt curve")
explode_7 = Explode(Curve=project_6.Geometry, Recursive=True)  # -> Segments, flatten(Vertices)
hull = ConvexHull(Points=explode_7.Vertices, Plane=PlaneXY(0, 0, 0))  # -> Hull, HullZ, Indices
skirt_offset_2 = Data(skirt_offset)
xy_7 = XYPlane(Origin=Point(0, 0, 0))
offset = OffsetCurve(Curve=hull.HullZ, Distance=skirt_offset_2, Plane=xy_7, Corners=1)
skirt_base_crv = Data(offset)

# ----
# comments & notes: merge slices or spiral with open remaining printing curves
back_forth_open_crvs_enabled_4 = Data(back_forth_open_crvs_enabled)
slice_curves_open_backforth_2 = Curve(slice_curves_open_backforth)
slice_curves_spiralized_floormerged_3 = Data(slice_curves_spiralized_floormerged)
spiralization_enabled_6 = Boolean(spiralization_enabled)
unified_slice_curves_3 = Curve(unified_slice_curves)
np_slicing_enabled_6 = Boolean(np_slicing_enabled)
open_wall_curves_2 = Curve(slice_curves_open)
filter_93 = StreamFilter(Gate=back_forth_open_crvs_enabled_4, Stream0=open_wall_curves_2, Stream1=slice_curves_open_backforth_2)
gate_22 = StreamGate(Stream=slice_curves_spiralized_floormerged_3, Gate=np_slicing_enabled_6)  # -> Target0, Target1
gate_23 = StreamGate(Stream=unified_slice_curves_3, Gate=np_slicing_enabled_6)  # -> Target0, Target1
merge_28 = Merge(Data1=gate_22.Target0, Data2=filter_93)
merge_29 = Merge(Data1=gate_23.Target0, Data2=filter_93)
filter_94 = StreamFilter(Gate=np_slicing_enabled_6, Stream0=merge_28, Stream1=slice_curves_spiralized_floormerged_3)
filter_95 = StreamFilter(Gate=np_slicing_enabled_6, Stream0=merge_29, Stream1=unified_slice_curves_3)
filter_96 = StreamFilter(Gate=spiralization_enabled_6, Stream0=filter_95, Stream1=filter_94)
unified_layer_printing_curves = Geometry(filter_96)

# ----
# comments & notes: create skirt entry line
# comments & notes: move seam to midpt of longest segment
skirt_base_crv_2 = Data(skirt_base_crv)
explode_8 = Explode(Curve=skirt_base_crv_2, Recursive=True)  # -> Segments, Vertices
len_2 = Length(Curve=explode_8.Segments)
sort_7 = SortList(Keys=len_2, ValuesA=explode_8.Segments)  # -> Keys, reverse(ValuesA)
item_21 = ListItem(List=sort_7.ValuesA, Index=0, Wrap=True)
eval_2 = EvaluateCurve(Curve=reparameterize(item_21), Parameter="0.5")  # -> Point, Tangent, Angle
crv_cp_4 = CurveClosestPoint(Point=eval_2.Point, Curve=reparameterize(skirt_base_crv_2))  # -> Point, Parameter, Distance
seam_2 = Seam(Curve=reparameterize(skirt_base_crv_2), Seam=crv_cp_4.Parameter)
pcen_11 = PolygonCenter(Polyline=seam_2)  # -> CenterV, CenterE, CenterA
len_3 = Length(Curve=seam_2)
skirt_entry_length_2 = Data(skirt_entry_length)
crv_cp_5 = CurveClosestPoint(Point=pcen_11.CenterV, Curve=item_21)  # -> Point, Parameter, Distance
end_4 = EndPoints(Curve=seam_2)  # -> Start, End
subtraction_10 = Subtraction(A=len_3, B="1.0")
vec2pt_5 = Vector2Pt(PointA=pcen_11.CenterV, PointB=crv_cp_5.Point, Unitize=False)  # -> Vector, Length
eval_3 = EvaluateLength(Curve=reparameterize(seam_2), Length=subtraction_10, Normalized=invert(True))  # -> Point, Tangent, Parameter
amp_3 = Amplitude(Vector=unitize(vec2pt_5.Vector), Amplitude=skirt_entry_length_2)
dom_5 = ConstructDomain(DomainStart="0", DomainEnd=eval_3.Parameter)
move_8 = Move(Geometry=end_4.Start, Motion=amp_3)  # -> Geometry, Transform
subcrv_2 = SubCurve(BaseCurve=reparameterize(seam_2), Domain=dom_5)
ln_8 = Line(StartPoint=move_8.Geometry, EndPoint=end_4.Start)
merge_30 = Merge(Data1=flatten(ln_8), Data2=flatten(subcrv_2))
skirt_polyline_tolerance_3 = Data(skirt_polyline_tolerance_2)
join_8 = JoinCurves(Curves=merge_30, Preserve=False)
fillet_3 = Fillet(Curve=join_8, Radius="2.0")
topoly_8 = CurveToPolyline(Curve=fillet_3, ToleranceDistance=skirt_polyline_tolerance_3, ToleranceAngle=0)  # -> Polyline, Segments
skirt_curve = Curve(topoly_8.Polyline)

# ----
# CORRECT MODEL PLACEMENT
# comments & notes: move everything (!) by 1x layer height to avoid starting the print at ZMAX (0)
# comments & notes: center printing geometry to catch cases where the original input object is "flying" or "below 0"
unified_layer_printing_curves_2 = Geometry(unified_layer_printing_curves)
skirt_curve_2 = Curve(skirt_curve)
bbox_6 = BoundingBox(Content=flatten(unified_layer_printing_curves_2), Plane=PlaneXY(0, 0, 0), UnionBox=True)  # -> Box, Box_2
volume_4 = Volume(Geometry=bbox_6.Box)  # -> Volume, Centroid
debox_5 = DeconstructBox(Box=bbox_6.Box)  # -> Plane, X, Y, Z
pdecon_9 = Deconstruct(Point=volume_4.Centroid)  # -> XComponent, YComponent, ZComponent
dedomain_5 = DeconstructDomain(Domain=debox_5.Z)  # -> Start, End
pt_6 = ConstructPoint(XCoordinate=pdecon_9.XComponent, YCoordinate=pdecon_9.YComponent, ZCoordinate=dedomain_5.Start)
xy_8 = XYPlane(Origin=Point(0, 0, 0))
vec2pt_6 = Vector2Pt(PointA=pt_6, PointB=xy_8, Unitize=False)  # -> Vector, Length
move_9 = Move(Geometry=unified_layer_printing_curves_2, Motion=vec2pt_6.Vector)  # -> Geometry, Transform
layer_height_6 = Number(layer_height)
Z_12 = UnitZ(Factor=layer_height_6)
move_10 = Move(Geometry=skirt_curve_2, Motion=Z_12)  # -> Geometry, Transform
move_11 = Move(Geometry=move_9.Geometry, Motion=Z_12)  # -> Geometry, Transform
clean_9 = CleanTree(RemoveNulls=True, RemoveInvalid=True, RemoveEmpty=False, Tree=move_10.Geometry)
clean_10 = CleanTree(RemoveNulls=True, RemoveInvalid=True, RemoveEmpty=False, Tree=move_11.Geometry)
unified_layer_printing_curves_3 = Geometry(clean_10)
skirt_curve_3 = Curve(clean_9)

# ----
# comments & notes: CREATE  OFFSET VECTOR & LEADERS
# CREATE  OFFSET VECTOR & LEADERS
# comments & notes: construct a leader and a corresponding plane for the annotation
# comments & notes: compute offset vector for visualisation
unified_layer_printing_curves_4 = Geometry(unified_layer_printing_curves_3)
inject_custom_curves_15 = Data(inject_custom_curves)
printing_geometry_10 = Geometry(printing_geometry)
filter_97 = StreamFilter(Gate=inject_custom_curves_15, Stream0=printing_geometry_10, Stream1=flatten(unified_layer_printing_curves_4))
bbox_7 = BoundingBox(Content=filter_97, Plane=PlaneXY(0, 0, 0), UnionBox=True)  # -> Box, Box_2
debox_6 = DeconstructBox(Box=bbox_7.Box)  # -> Plane, X, Y, Z
dedomain_6 = DeconstructDomain(Domain=debox_6.X)  # -> Start, End
subtraction_11 = Subtraction(A=dedomain_6.End, B=dedomain_6.Start)
X_2 = UnitX(Factor=1)
multiplication_8 = Multiplication(A=subtraction_11, B="0.5")
Y = UnitY(Factor=1)  # -> expr("x*-1", UnitVector)
dedomain_7 = DeconstructDomain(Domain=debox_6.Y)  # -> Start, End
X_3 = UnitX(Factor=1)
amp_4 = Amplitude(Vector=X_2, Amplitude=subtraction_11)  # -> expr("x*2", Vector)
addition_3 = Addition(A=dedomain_6.Start, B=multiplication_8)
addition_4 = Addition(A=X_3, B=Y)
amp_5 = Amplitude(Vector=Y, Amplitude=Slider(20, range=0..100))
pt_7 = ConstructPoint(XCoordinate=addition_3, YCoordinate=expr("x*1.5", dedomain_7.Start), ZCoordinate=0)
amp_6 = Amplitude(Vector=addition_4, Amplitude=Slider(120, range=0..200))
move_12 = Move(Geometry=pt_7, Motion=amp_5)  # -> Geometry, Transform
move_13 = Move(Geometry=move_12.Geometry, Motion=expr("x*0.5", amp_6))  # -> Geometry, Transform
xy_9 = XYPlane(Origin=move_13.Geometry)
move_14 = Move(Geometry=move_12.Geometry, Motion=amp_6)  # -> Geometry, Transform
align_2 = AlignPlane(Plane=xy_9, Direction=addition_4)  # -> Plane, Angle
deplane_4 = DeconstructPlane(Plane=align_2.Plane)  # -> Origin, XAxis, YAxis, ZAxis
merge_31 = Merge(Data1=pt_7, Data2=move_12.Geometry, Data3=move_14.Geometry)
move_15 = Move(Geometry=align_2.Plane, Motion=expr("x*1.5", deplane_4.YAxis))  # -> Geometry, Transform
pline_5 = PolyLine(Vertices=merge_31, Closed=False)
vis_offset_vector = Vector(amp_4)
vis_leader_plane = Data(move_15.Geometry)
vis_leader = Curve(pline_5)

# ----
# NON-PLANAR SLICING HEAT
# MESH SIMULATION VISUALIZATION
# comments & notes: NON-PLANAR SLICING HEAT MESH SIMULATION VISUALIZATION
# comments & notes: only show heat colored mesh if NP slicing is enabled
# comments & notes: re-construct mesh with heat simulation colors
# comments & notes: move mesh according to visualization offset vector
heatmesh_3 = Mesh(heatmesh)
heatvalues_2 = Data(heatvalues)
np_only_bot_boundary_3 = Boolean(np_only_bot_boundary)
bnd_5 = Bounds(Numbers=heatvalues_2)
dedomain_8 = DeconstructDomain(Domain=bnd_5)  # -> Start, End
filter_98 = StreamFilter(Gate=np_only_bot_boundary_3, Stream0=dedomain_8.Start, Stream1=dedomain_8.End)
filter_99 = StreamFilter(Gate=np_only_bot_boundary_3, Stream0=dedomain_8.End, Stream1=dedomain_8.Start)
gradient = Gradient(
    LowerLimit=filter_98,
    UpperLimit=filter_99,
    Parameter=heatvalues_2,
    stops=[0: RGB(234, 38, 0), 0.25: RGB(234, 126, 0), 0.5: RGB(254, 244, 84), 0.75: RGB(173, 203, 249), 1: RGB(75, 107, 169)])
demesh_3 = DeconstructMesh(Mesh=heatmesh_3)  # -> Vertices, Faces, Colours, Normals
conmesh_2 = ConstructMesh(Vertices=demesh_3.Vertices, Faces=demesh_3.Faces, Colours=gradient)
render_print_geometry_and_not_inject_cus_2 = Boolean(render_print_geometry_and_not_inject_cus)  # "RENDER_PRINT_GEOMETRY_AND_NOT_INJECT_CUSTOM_CURVES"
vis_offset_vector_2 = Vector(vis_offset_vector)
np_slicing_enabled_7 = Boolean(np_slicing_enabled)
move_16 = Move(Geometry=conmesh_2, Motion=vis_offset_vector_2)  # -> Geometry, Transform
filter_100 = StreamFilter(Gate=np_slicing_enabled_7, Stream1=move_16.Geometry)
filter_101 = StreamFilter(Gate=render_print_geometry_and_not_inject_cus_2, Stream1=filter_100)
heatmesh_colored = Mesh(filter_101)

# ----
# NON-PLANAR SLICING HEAT
# MESH SIMULATION VISUALIZATION
# comments & notes: VISUALIZE DETECTED SHARP FEATURES (TRI-REMESHING)
sharp_features_3 = Curve(sharp_features)
# comments & notes: VISUALIZATION OF
# PRINTING, LAYER AND GCODE GEOMETRY
render_sharp_features_2 = Data(render_sharp_features)
vis_offset_vector_3 = Vector(vis_offset_vector)
move_17 = Move(Geometry=sharp_features_3, Motion=vis_offset_vector_3)  # -> Geometry, Transform
weight = Slider(2, range=0..5)
filter_102 = StreamFilter(Gate=render_sharp_features_2, Stream1=move_17.Geometry)
curvepreviewlw = CurvePreviewLW(Curves=filter_102, Colors=ColourSwatch(SwatchColor=RGB(255, 0, 0)), Thickness=weight)  # inputs Curves: list of Curve, Colors: list of Color, Thickness: list of Int32
# ---------- curvepreviewlw: C# ----------
#region Usings
using System;
using System.Linq;
using System.Collections;
using System.Collections.Generic;
using System.Drawing;

using Rhino;
using Rhino.Geometry;

using Grasshopper;
using Grasshopper.Kernel;
using Grasshopper.Kernel.Data;
using Grasshopper.Kernel.Types;
#endregion

public class Script_Instance : GH_ScriptInstance
{
    #region Notes
    /* 
      Members:
        RhinoDoc RhinoDocument
        GH_Document GrasshopperDocument
        IGH_Component Component
        int Iteration

      Methods (Virtual & overridable):
        Print(string text)
        Print(string format, params object[] args)
        Reflect(object obj)
        Reflect(object obj, string method_name)

        Author: Max Benjamin Eschenbach
        License: MIT License
        Version: 250314
    */
    #endregion

    List<Curve> drawCurves;
    List<Color> drawColors;
    List<int> drawThickness;

    private void RunScript(
		List<Curve> Curves,
		List<Color> Colors,
		List<int> Thickness)
    {
        // set component params
        this.Component.Name = "CurvePreviewLW";
        this.Component.NickName = "CurvePreviewLW";
        this.Component.Category = "DDUClayPrintingSlicer";
        this.Component.SubCategory = "8 Visualisation";

        this.drawCurves = new List<Curve>();   
        this.drawColors = new List<Color>();
        this.drawThickness = new List<int>();

        if (Curves == null) return;
        if (Colors == null) this.drawColors = new List<Color>{Color.Black};
        else this.drawColors = Colors;

        if (Thickness == null) this.drawThickness = new List<int>{1};
        else this.drawThickness = Thickness;

        for (int i = 0; i < Curves.Count; i++)
        {
            if (Curves[i] != null)
            {
                this.drawCurves.Add(Curves[i]);
            }
            else
            {
                continue;
            }
            if (Colors == null || i >= Colors.Count || Colors[i] == null)
            {
                this.drawColors.Add(drawColors.Last());
            }
            else
            {
                this.drawColors.Add(Colors[i]);
            }
            if (Thickness == null || i >= Thickness.Count || Thickness[i] == null)
            {
                this.drawThickness.Add(drawThickness.Last());
            }
            else
            {
                this.drawThickness.Add(Thickness[i]);
            }
        }
    }

    override public void DrawViewportWires(IGH_PreviewArgs args)
    {
        if (this.drawCurves != null)
        {
            try
            {
                for (int i = 0; i < this.drawCurves.Count; i++)
                {
                    args.Display.DrawCurve(
                        this.drawCurves[i],
                        this.drawColors[i],
                        this.drawThickness[i]
                    );
                }
                
            }
            catch (Exception e)
            {
                this.AddRuntimeMessage(GH_RuntimeMessageLevel.Warning, "Error while drawing Preview!");
                this.Print(e.ToString());
            }
        }
        else
        {
            return;
        }
    }
}
# ---------- end curvepreviewlw ----------

# ----
# INPUT GEOMETRY
# LEADER & ANNOTATION
comments_notes_38 = Panel("""INPUT GEOMETRY
LEADER & ANNOTATION""")
leader_curve_weight_2 = Data(leader_curve_weight)
vis_leader_2 = Curve(vis_leader)
leader_text_size_2 = Data(leader_text_size)
vis_leader_plane_2 = Data(vis_leader_plane)
swatch = ColourSwatch(SwatchColor=RGB(0, 0, 0))
curvepreviewlw_2 = CurvePreviewLW(Curves=vis_leader_2, Colors=swatch, Thickness=leader_curve_weight_2)  # inputs Curves: list of Curve, Colors: list of Color, Thickness: list of Int32; same code as curvepreviewlw
tag = TextTag3D(Location=vis_leader_plane_2, Text="Input Geometry", Size=leader_text_size_2, Colour=swatch, Justification=8)

# ----
# comments & notes: visualize naked mesh/brep edges with magenta
# VISUALIZE MESH/BREP EDGES
# comments & notes: visualize interior mesh/brep edges with black
# comments & notes: extract brep/mesh edges and split in naked and interior edges
printing_geometry_11 = Geometry(printing_geometry)
vis_offset_vector_4 = Vector(vis_offset_vector)
render_print_geometry_and_not_inject_cus_3 = Boolean(render_print_geometry_and_not_inject_cus)  # "RENDER_PRINT_GEOMETRY_AND_NOT_INJECT_CUSTOM_CURVES"
custom_curves_at_origin_4 = Curve(custom_curves_at_origin)
comments_notes_39 = Panel("VISUALIZE MESH/BREP EDGES")
move_18 = Move(Geometry=printing_geometry_11, Motion=vis_offset_vector_4)  # -> Geometry, Transform
ismesh = IsMesh(G=move_18.Geometry)  # -> M; inputs G: GeometryBase
# ---------- ismesh: C# ----------
#region Usings
using System;
using System.Linq;
using System.Collections;
using System.Collections.Generic;
using System.Drawing;

using Rhino;
using Rhino.Geometry;

using Grasshopper;
using Grasshopper.Kernel;
using Grasshopper.Kernel.Data;
using Grasshopper.Kernel.Types;
#endregion

public class Script_Instance : GH_ScriptInstance
{
    #region Notes
    /* 
      Members:
        RhinoDoc RhinoDocument
        GH_Document GrasshopperDocument
        IGH_Component Component
        int Iteration

      Methods (Virtual & overridable):
        Print(string text)
        Print(string format, params object[] args)
        Reflect(object obj)
        Reflect(object obj, string method_name)
    
    Author: Max Benjamin Eschenbach
    License: MIT License
    Version: 250314
    */
    #endregion

    private void RunScript(GeometryBase G, ref object M)
    {
        // set component params
        this.Component.Name = "IsMesh";
        this.Component.NickName = "IsMesh";
        this.Component.Category = "DDUClayPrintingSlicer";
        this.Component.SubCategory = "9 Utilities";

        if (G != null)
        {
            if (G is Mesh)
            {
                M = true;
            }
            else if (G is Brep)
            {
                M = false;
            }
        }
        else
        {
            M = new DataTree<object>();
        }
    }
}
# ---------- end ismesh ----------
move_19 = Move(Geometry=custom_curves_at_origin_4, Motion=vis_offset_vector_4)  # -> Geometry, Transform
gate_24 = StreamGate(Stream=move_18.Geometry, Gate=ismesh)  # -> Target0, Target1
medges_3 = MeshEdges(Mesh=gate_24.Target1)  # -> NakedEdges, InteriorEdges, NonManifoldEdges
edges_2 = BrepEdges(Brep=gate_24.Target0)  # -> Naked, Interior, NonManifold
filter_103 = StreamFilter(Gate=ismesh, Stream0=edges_2.Naked, Stream1=medges_3.NakedEdges)
filter_104 = StreamFilter(Gate=ismesh, Stream0=edges_2.Interior, Stream1=medges_3.InteriorEdges)
filter_105 = StreamFilter(Gate=render_print_geometry_and_not_inject_cus_3, Stream1=filter_103)
filter_106 = StreamFilter(Gate=render_print_geometry_and_not_inject_cus_3, Stream0=move_19.Geometry, Stream1=filter_104)
weight_2 = Slider(2, range=0..5)
weight_3 = Slider(1, range=0..5)
curvepreviewlw_3 = CurvePreviewLW(Curves=flatten(filter_106), Colors=ColourSwatch(SwatchColor=RGB(0, 0, 0)), Thickness=weight_3)  # inputs Curves: list of Curve, Colors: list of Color, Thickness: list of Int32; same code as curvepreviewlw
curvepreviewlw_4 = CurvePreviewLW(Curves=filter_105, Colors=ColourSwatch(SwatchColor=RGB(255, 0, 230)), Thickness=weight_2)  # inputs Curves: list of Curve, Colors: list of Color, Thickness: list of Int32; same code as curvepreviewlw

# ----
# comments & notes: RENDER PRINT GEOMETRY (MESH/BREP)
# RENDER PRINT GEOMETRY
# (MESH/BREP)
render_print_geometry_and_not_inject_cus_4 = Boolean(render_print_geometry_and_not_inject_cus)  # "RENDER_PRINT_GEOMETRY_AND_NOT_INJECT_CUSTOM_CURVES"
printing_geometry_12 = Geometry(printing_geometry)
vis_offset_vector_5 = Vector(vis_offset_vector)
move_20 = Move(Geometry=printing_geometry_12, Motion=vis_offset_vector_5)  # -> Geometry, Transform
np_slicing_enabled_8 = Boolean(np_slicing_enabled)
filter_107 = StreamFilter(Gate=render_print_geometry_and_not_inject_cus_4, Stream1=move_20.Geometry)
filter_108 = StreamFilter(Gate=np_slicing_enabled_8, Stream0=filter_107)
preview = CustomPreview(Geometry=filter_108, Material=ColourSwatch(SwatchColor=RGB(242, 242, 242)))

# ----
# PRINTING GEOMETRY
# LEADER & ANNOTATION
render_print_geometry_and_not_inject_cus_5 = Boolean(render_print_geometry_and_not_inject_cus)  # "RENDER_PRINT_GEOMETRY_AND_NOT_INJECT_CUSTOM_CURVES"
comments_notes_40 = Panel("""PRINTING GEOMETRY
LEADER & ANNOTATION""")
vis_offset_vector_6 = Vector(vis_offset_vector)
vis_offset_vector_7 = Vector(vis_offset_vector)
vis_leader_plane_3 = Data(vis_leader_plane)
vis_leader_3 = Curve(vis_leader)
move_21 = Move(Geometry=vis_leader_3, Motion=vis_offset_vector_6)  # -> Geometry, Transform
move_22 = Move(Geometry=vis_leader_plane_3, Motion=vis_offset_vector_7)  # -> Geometry, Transform
leader_text_size_3 = Data(leader_text_size)
leader_curve_weight_3 = Data(leader_curve_weight)
swatch_2 = ColourSwatch(SwatchColor=RGB(0, 0, 0))
filter_109 = StreamFilter(Gate=render_print_geometry_and_not_inject_cus_5, Stream0="Injected Custom Curves", Stream1="Printing Geometry")
curvepreviewlw_5 = CurvePreviewLW(Curves=move_21.Geometry, Colors=swatch_2, Thickness=leader_curve_weight_3)  # inputs Curves: list of Curve, Colors: list of Color, Thickness: list of Int32; same code as curvepreviewlw
tag_2 = TextTag3D(Location=move_22.Geometry, Text=filter_109, Size=leader_text_size_3, Colour=swatch_2, Justification=8)

# ----
# VISUALIZE
# SEAM POINTS
# comments & notes: visualize seam points as dots
# comments & notes: on spiralization, also visualize the spiralization ramp
spiralization_enabled_7 = Boolean(spiralization_enabled)
show_seam_points_2 = Data(show_seam_points)
slice_curves_22 = Curve(slice_curves_15)
vis_offset_vector_8 = Vector(expr("x*2", vis_offset_vector))
spiralcontours_base_4 = Data(spiralcontours_base)
spiral_ramp_points_2 = Data(spiral_ramp_points)
layer_height_7 = Data(layer_height)
filter_110 = StreamFilter(Gate=spiralization_enabled_7, Stream0=slice_curves_22, Stream1=spiralcontours_base_4)
end_5 = EndPoints(Curve=filter_110)  # -> Start, End
item_22 = ListItem(List=flatten(end_5.Start), Index=0, Wrap=True)
pdecon_10 = Deconstruct(Point=item_22)  # -> XComponent, YComponent, ZComponent
comments_notes_41 = Panel("VISUALIZE SEAM POINTS")
smaller_6 = SmallerThan(FirstNumber=pdecon_10.ZComponent, SecondNumber=layer_height_7)  # -> SmallerThan, OrEqualTo
subtraction_12 = Subtraction(A=layer_height_7, B=pdecon_10.ZComponent)
Z_13 = UnitZ(Factor=subtraction_12)
addition_5 = Addition(A=vis_offset_vector_8, B=Z_13)
filter_111 = StreamFilter(Gate=smaller_6.SmallerThan, Stream0=vis_offset_vector_8, Stream1=addition_5)
filter_112 = StreamFilter(Gate=spiralization_enabled_7, Stream1=spiral_ramp_points_2)
move_23 = Move(Geometry=filter_112, Motion=filter_111)  # -> Geometry, Transform
move_24 = Move(Geometry=end_5.Start, Motion=filter_111)  # -> Geometry, Transform
pline_6 = PolyLine(Vertices=move_23.Geometry, Closed=False)
filter_113 = StreamFilter(Gate=show_seam_points_2, Stream1=move_24.Geometry)
flip_3 = FlipCurve(Curve=pline_6)  # -> Curve, Flag
dom_6 = ConstructDomain(DomainStart="0", DomainEnd=Slider(0.075, range=0..1))
dots = DotDisplay(Point=flatten(filter_113), Colour=ColourSwatch(SwatchColor=RGB(0, 0, 0)), Size=Slider(1, range=0..1))
subcrv_3 = SubCurve(BaseCurve=reparameterize(flip_3.Curve), Domain=dom_6)
swatch_3 = ColourSwatch(SwatchColor=RGB(33, 166, 0))
item_23 = ListItem(List=move_23.Geometry, Index=0, Wrap=True)
subcrv_4 = SubCurve(BaseCurve=reparameterize(pline_6), Domain=dom_6)
flip_4 = FlipCurve(Curve=subcrv_3)  # -> Curve, Flag
curvepreviewlw_6 = CurvePreviewLW(Curves=flatten([subcrv_4, flip_4.Curve]), Colors=swatch_3, Thickness=Slider(4, range=0..20))  # inputs Curves: list of Curve, Colors: list of Color, Thickness: list of Int32; same code as curvepreviewlw
dots_2 = DotDisplay(Point=flatten(item_23), Colour=swatch_3, Size=Slider(0.5, range=0..1))

# ----
# GCODE VIS OFFSET VECTOR
# comments & notes: GCODE VIS OFFSET VECTOR
overhang_angle_analysis_activated_3 = Boolean(overhang_angle_analysis_activated)
layer_height_analysis_activated_3 = Data(layer_height_analysis_activated)
overhang_angle_analysis_activated_4 = Boolean(overhang_angle_analysis_activated)
overhang_offset_analysis_activated_3 = Boolean(overhang_offset_analysis_activated)
render_print_layers_2 = Data(render_print_layers)
render_layer_curves_2 = Data(render_layer_curves)
vis_offset_vector_9 = Vector(vis_offset_vector)
merge_32 = Merge(
    Data1=flatten(render_layer_curves_2),
    Data2=flatten(overhang_angle_analysis_activated_3),
    Data3=flatten(overhang_offset_analysis_activated_3),
    Data4=flatten(layer_height_analysis_activated_3))
int = Integer(merge_32)
ma_16 = MassAddition(Input=int)  # -> Result, PartialResults
addition_6 = Addition(A="3.5", B=ma_16.Result)
subtraction_13 = Subtraction(A=addition_6, B="1")
filter_114 = StreamFilter(Gate=render_print_layers_2, Stream0=subtraction_13, Stream1=addition_6)
multiplication_9 = Multiplication(A=vis_offset_vector_9, B=filter_114)
gcode_vis_offset_vector = Data(multiplication_9)

# ----
# LAYER CRV VIS LEADER
# comments & notes: LAYER CRV VIS LEADER
render_layer_curves_3 = Data(render_layer_curves)
vis_leader_plane_4 = Data(vis_leader_plane)
vis_offset_vector_10 = Vector(vis_offset_vector)
vis_leader_4 = Curve(vis_leader)
multiplication_10 = Multiplication(A=vis_offset_vector_10, B="2")
filter_115 = StreamFilter(Gate=render_layer_curves_3, Stream1=vis_leader_4)
filter_116 = StreamFilter(Gate=render_layer_curves_3, Stream1=vis_leader_plane_4)
leader_curve_weight_4 = Data(leader_curve_weight)
move_25 = Move(Geometry=filter_116, Motion=multiplication_10)  # -> Geometry, Transform
move_26 = Move(Geometry=filter_115, Motion=multiplication_10)  # -> Geometry, Transform
swatch_4 = ColourSwatch(SwatchColor=RGB(0, 0, 0))
leader_text_size_4 = Data(leader_text_size)
curvepreviewlw_7 = CurvePreviewLW(Curves=move_26.Geometry, Colors=swatch_4, Thickness=leader_curve_weight_4)  # inputs Curves: list of Curve, Colors: list of Color, Thickness: list of Int32; same code as curvepreviewlw
tag_3 = TextTag3D(Location=move_25.Geometry, Text="Printing Layers", Size=leader_text_size_4, Colour=swatch_4, Justification=8)

# ----
# comments & notes: PRINTING LAYER MESH VIS LEADER
# PRINTING LAYER MESH VIS LEADER
vis_offset_vector_11 = Vector(vis_offset_vector)
overhang_angle_analysis_activated_5 = Boolean(overhang_angle_analysis_activated)
overhang_offset_analysis_activated_4 = Boolean(overhang_offset_analysis_activated)
layer_height_analysis_activated_4 = Data(layer_height_analysis_activated)
render_layer_curves_4 = Data(render_layer_curves)
merge_33 = Merge(
    Data1=flatten(render_layer_curves_4),
    Data2=flatten(overhang_angle_analysis_activated_5),
    Data3=flatten(overhang_offset_analysis_activated_4),
    Data4=flatten(layer_height_analysis_activated_4))
int_2 = Integer(merge_33)
render_print_layers_3 = Data(render_print_layers)
vis_leader_plane_5 = Data(vis_leader_plane)
ma_17 = MassAddition(Input=int_2)  # -> Result, PartialResults
addition_7 = Addition(A="2", B=ma_17.Result)
multiplication_11 = Multiplication(A=vis_offset_vector_11, B=addition_7)
vis_leader_5 = Curve(vis_leader)
filter_117 = StreamFilter(Gate=render_print_layers_3, Stream1=vis_leader_plane_5)
filter_118 = StreamFilter(Gate=render_print_layers_3, Stream1=vis_leader_5)
leader_curve_weight_5 = Data(leader_curve_weight)
move_27 = Move(Geometry=filter_117, Motion=multiplication_11)  # -> Geometry, Transform
swatch_5 = ColourSwatch(SwatchColor=RGB(0, 0, 0))
move_28 = Move(Geometry=filter_118, Motion=multiplication_11)  # -> Geometry, Transform
leader_text_size_5 = Data(leader_text_size)
curvepreviewlw_8 = CurvePreviewLW(Curves=move_28.Geometry, Colors=swatch_5, Thickness=leader_curve_weight_5)  # inputs Curves: list of Curve, Colors: list of Color, Thickness: list of Int32; same code as curvepreviewlw
tag_4 = TextTag3D(Location=move_27.Geometry, Text="Print Layer Simulation", Size=leader_text_size_5, Colour=swatch_5, Justification=8)

# ----
# LAYER HEIGHT ANALYSIS VIS LEADER & TAG
# comments & notes: LAYER HEIGHT ANALYSIS VIS LEADER & TAG
layer_height_analysis_activated_5 = Boolean(layer_height_analysis_activated_2)
vis_offset_vector_12 = Vector(vis_offset_vector)
vis_leader_plane_6 = Data(vis_leader_plane)
vis_leader_6 = Curve(vis_leader)
filter_119 = StreamFilter(Gate=layer_height_analysis_activated_5, Stream1=vis_leader_plane_6)
filter_120 = StreamFilter(Gate=layer_height_analysis_activated_5, Stream1=vis_leader_6)
move_29 = Move(Geometry=filter_120, Motion=expr("x*3", vis_offset_vector_12))  # -> Geometry, Transform
move_30 = Move(Geometry=filter_119, Motion=expr("x*3", vis_offset_vector_12))  # -> Geometry, Transform
swatch_6 = ColourSwatch(SwatchColor=RGB(0, 0, 0))
curvepreviewlw_9 = CurvePreviewLW(Curves=move_29.Geometry, Colors=swatch_6)  # inputs Curves: list of Curve, Colors: list of Color, Thickness: list of Int32; same code as curvepreviewlw
tag_5 = TextTag3D(Location=move_30.Geometry, Text="Layer Height Analysis", Size=Slider(8, range=0..10), Colour=swatch_6, Justification=8)

# ----
# GCODE VIS LEADER & TAG
# comments & notes: GCODE VIS LEADER & TAG
vis_leader_plane_7 = Data(vis_leader_plane)
gcode_vis_offset_vector_2 = Data(gcode_vis_offset_vector)
vis_leader_7 = Curve(vis_leader)
move_31 = Move(Geometry=vis_leader_7, Motion=gcode_vis_offset_vector_2)  # -> Geometry, Transform
swatch_7 = ColourSwatch(SwatchColor=RGB(0, 0, 0))
move_32 = Move(Geometry=vis_leader_plane_7, Motion=gcode_vis_offset_vector_2)  # -> Geometry, Transform
curvepreviewlw_10 = CurvePreviewLW(Curves=move_31.Geometry, Colors=swatch_7)  # inputs Curves: list of Curve, Colors: list of Color, Thickness: list of Int32; same code as curvepreviewlw
tag_6 = TextTag3D(Location=move_32.Geometry, Text="GCODE Simulation", Size=Slider(8, range=0..10), Colour=swatch_7, Justification=8)

# ----
# OVERHANG ANGLE ANALYSIS VIS LEADER & TAG
# comments & notes: OVERHANG ANGLE ANALYSIS VIS LEADER & TAG
layer_height_analysis_activated_6 = Data(layer_height_analysis_activated)
overhang_angle_analysis_activated_6 = Boolean(overhang_angle_analysis_activated)
render_layer_curves_5 = Data(render_layer_curves)
vis_offset_vector_13 = Vector(vis_offset_vector)
vis_leader_plane_8 = Data(vis_leader_plane)
merge_34 = Merge(Data1=flatten(render_layer_curves_5), Data2=flatten(layer_height_analysis_activated_6))
vis_leader_8 = Curve(vis_leader)
filter_121 = StreamFilter(Gate=overhang_angle_analysis_activated_6, Stream1=vis_leader_8)
filter_122 = StreamFilter(Gate=overhang_angle_analysis_activated_6, Stream1=vis_leader_plane_8)
int_3 = Integer(merge_34)
ma_18 = MassAddition(Input=int_3)  # -> Result, PartialResults
addition_8 = Addition(A="2", B=ma_18.Result)
multiplication_12 = Multiplication(A=vis_offset_vector_13, B=addition_8)
move_33 = Move(Geometry=filter_121, Motion=multiplication_12)  # -> Geometry, Transform
move_34 = Move(Geometry=filter_122, Motion=multiplication_12)  # -> Geometry, Transform
swatch_8 = ColourSwatch(SwatchColor=RGB(0, 0, 0))
curvepreviewlw_11 = CurvePreviewLW(Curves=move_33.Geometry, Colors=swatch_8)  # inputs Curves: list of Curve, Colors: list of Color, Thickness: list of Int32; same code as curvepreviewlw
tag_7 = TextTag3D(Location=move_34.Geometry, Text="Overhang Angle Analysis", Size=Slider(8, range=0..10), Colour=swatch_8, Justification=8)

# ----
# OVERHANG OFFSET ANALYSIS VIS LEADER & TAG
# comments & notes: OVERHANG OFFSET ANALYSIS VIS LEADER & TAG
overhang_angle_analysis_activated_7 = Boolean(overhang_angle_analysis_activated)
layer_height_analysis_activated_7 = Data(layer_height_analysis_activated)
overhang_angle_analysis_activated_8 = Boolean(overhang_angle_analysis_activated)
render_layer_curves_6 = Data(render_layer_curves)
vis_offset_vector_14 = Vector(vis_offset_vector)
vis_leader_plane_9 = Data(vis_leader_plane)
merge_35 = Merge(
    Data1=flatten(render_layer_curves_6),
    Data2=flatten(layer_height_analysis_activated_7),
    Data3=flatten(overhang_angle_analysis_activated_7))
vis_leader_9 = Curve(vis_leader)
filter_123 = StreamFilter(Gate=overhang_angle_analysis_activated_8, Stream1=vis_leader_9)
filter_124 = StreamFilter(Gate=overhang_angle_analysis_activated_8, Stream1=vis_leader_plane_9)
int_4 = Integer(merge_35)
ma_19 = MassAddition(Input=int_4)  # -> Result, PartialResults
addition_9 = Addition(A="2", B=ma_19.Result)
multiplication_13 = Multiplication(A=vis_offset_vector_14, B=addition_9)
move_35 = Move(Geometry=filter_123, Motion=multiplication_13)  # -> Geometry, Transform
move_36 = Move(Geometry=filter_124, Motion=multiplication_13)  # -> Geometry, Transform
swatch_9 = ColourSwatch(SwatchColor=RGB(0, 0, 0))
curvepreviewlw_12 = CurvePreviewLW(Curves=move_35.Geometry, Colors=swatch_9)  # inputs Curves: list of Curve, Colors: list of Color, Thickness: list of Int32; same code as curvepreviewlw
tag_8 = TextTag3D(
    Location=move_36.Geometry,
    Text="Overhang Offset Analysis",
    Size=Slider(8, range=0..10),
    Colour=swatch_9,
    Justification=8)

# ----
# MERGE LAYERS AND SKIRT
# comments & notes: merge layer curves with skirt curve (insert skirt into first layer branch)
layer_printing_curves = Geometry(unified_layer_printing_curves_3)
skirt_curve_4 = Curve(skirt_curve_3)
tstat_35 = TreeStatistics(Tree=layer_printing_curves)  # -> Paths, Length, Count
tstat_36 = TreeStatistics(Tree=skirt_curve_4)  # -> Paths, Length, Count
item_24 = ListItem(List=tstat_35.Paths, Index=0, Wrap=True)
replace_6 = ReplacePaths(Data=skirt_curve_4, Search=tstat_36.Paths, Replace=item_24)
merge_36 = Merge(Data1=replace_6, Data2=layer_printing_curves)
printing_curves = Curve(merge_36)

# ----
# REDUCE POLYLINES
# comments & notes: reduce polylines by removing insignificant vertices, making computation more efficient.
reduce = BooleanToggle(True)
printing_curves_2 = Curve(printing_curves)
gate_25 = StreamGate(Stream=printing_curves_2, Gate=reduce)  # -> Target0, Target1
redpline_6 = Reduce(Polyline=gate_25.Target1, Tolerance=Slider(0.01, range=0.001..1))  # -> Polyline, Reduction
filter_125 = StreamFilter(Gate=reduce, Stream0=gate_25.Target0, Stream1=redpline_6.Polyline)
printing_curves_3 = Curve(filter_125)

# ----
# VISUALIZE PRINTING LAYER CRVS
# comments & notes: VISUALIZE PRINTING LAYER CRVS
vis_offset_vector_15 = Vector(vis_offset_vector)
printing_curves_4 = Geometry(printing_curves_3)
render_layer_curves_7 = Data(render_layer_curves)
multiplication_14 = Multiplication(A=vis_offset_vector_15, B="2")
move_37 = Move(Geometry=flatten(printing_curves_4), Motion=multiplication_14)  # -> Geometry, Transform
filter_126 = StreamFilter(Gate=render_layer_curves_7, Stream1=move_37.Geometry)
curvepreviewlw_13 = CurvePreviewLW(Curves=filter_126, Colors=ColourSwatch(SwatchColor=RGB(217, 212, 212)), Thickness=Slider(2, range=0..10))  # inputs Curves: list of Curve, Colors: list of Color, Thickness: list of Int32; same code as curvepreviewlw

# ----
# comments & notes: PRINTING LAYER MESH VISUALIZATION
# PRINTING LAYER MESH VISUALIZATION
overhang_angle_analysis_activated_9 = Boolean(overhang_angle_analysis_activated)
overhang_offset_analysis_activated_5 = Boolean(overhang_offset_analysis_activated)
render_layer_curves_8 = Data(render_layer_curves)
layer_height_analysis_activated_8 = Data(layer_height_analysis_activated)
vis_offset_vector_16 = Vector(vis_offset_vector)
printing_curves_5 = Geometry(printing_curves_3)
render_print_layers_4 = Data(render_print_layers)
merge_37 = Merge(
    Data1=flatten(render_layer_curves_8),
    Data2=flatten(overhang_angle_analysis_activated_9),
    Data3=flatten(overhang_offset_analysis_activated_5),
    Data4=flatten(layer_height_analysis_activated_8))
int_5 = Integer(merge_37)
ma_20 = MassAddition(Input=int_5)  # -> Result, PartialResults
addition_10 = Addition(A="2", B=ma_20.Result)
multiplication_15 = Multiplication(A=vis_offset_vector_16, B=addition_10)
move_38 = Move(Geometry=flatten(printing_curves_5), Motion=multiplication_15)  # -> Geometry, Transform
filter_127 = StreamFilter(Gate=render_print_layers_4, Stream1=move_38.Geometry)
hd_layer_visualisation_2 = Data(hd_layer_visualisation)
redpline_7 = Reduce(Polyline=filter_127, Tolerance=Slider(0.1, range=0..1))  # -> Polyline, Reduction
gate_26 = StreamGate(Stream=redpline_7.Polyline, Gate=hd_layer_visualisation_2)  # -> Target0, Target1
divlength_2 = DivideLength(Curve=reparameterize(flatten(gate_26.Target1)), Length=Slider(200, range=0..1000))  # -> Points, Tangents, Parameters
numsegments = Slider(10, range=0..10)
line_width_3 = Data(line_width)
shatter = Shatter(Curve=reparameterize(graft(gate_26.Target1)), Parameters=divlength_2.Parameters)  # -> flatten(Segments)
subsegments = Slider(10, range=0..100)
accuracy = Slider(1, range=0..1)
capstyle = Slider(3, range=0..3)
multiplication_16 = Multiplication(A=line_width_3, B="0.5")
hd_layer_visualisation_3 = Data(hd_layer_visualisation_2)
chromomeshpipe = ChromoMeshPipe(P=gate_26.Target0, N=numsegments, R=multiplication_16, C=Toggle(True))  # -> M; inputs P: list of Curve, N: Int32, R: Double, C: Boolean
# ---------- chromomeshpipe: C# ----------
#region Usings
using System;
using System.Linq;
using System.Collections;
using System.Collections.Generic;
using System.Drawing;

using Rhino;
using Rhino.Geometry;

using Grasshopper;
using Grasshopper.Kernel;
using Grasshopper.Kernel.Data;
using Grasshopper.Kernel.Types;
#endregion

public class Script_Instance : GH_ScriptInstance
{
    #region Notes
    /* 
      Members:
        RhinoDoc RhinoDocument
        GH_Document GrasshopperDocument
        IGH_Component Component
        int Iteration

      Methods (Virtual & overridable):
        Print(string text)
        Print(string format, params object[] args)
        Reflect(object obj)
        Reflect(object obj, string method_name)

    Author: Cameron Newnham 2015-2016
    Modified and Updated 2025 by Max Benjamin Eschenbach
    License: GNU GPL version 3
    Version: 250314

    *      ___  _  _  ____   __   _  _   __  ____   __  ____  __  ____
    *     / __)/ )( \(  _ \ /  \ ( \/ ) /  \(    \ /  \(  _ \(  )/ ___)
    *    ( (__ ) __ ( )   /(  O )/ \/ \(  O )) D ((  O ))   / )( \___ \
    *     \___)\_)(_/(__\_) \__/ \_)(_/ \__/(____/ \__/(__\_)(__)(____/
    *
    *    Copyright Cameron Newnham 2015-2016
    *
    *    This program is free software: you can redistribute it and/or modify
    *    it under the terms of the GNU General Public License as published by
    *    the Free Software Foundation, either version 3 of the License, or
    *    (at your option) any later version.
    *
    *    This program is distributed in the hope that it will be useful,
    *    but WITHOUT ANY WARRANTY; without even the implied warranty of
    *    MERCHANTABILITY or FITNESS FOR A PARTICULAR PURPOSE.  See the
    *    GNU General Public License for more details.
    *
    *    You should have received a copy of the GNU General Public License
    *    along with this program.  If not, see <http://www.gnu.org/licenses/>.
    */
    #endregion

    private void RunScript(List<Curve> P, int N, double R, bool C, ref object M)
    {
        // set component params
        this.Component.Name = "ChromoMeshPipe";
        this.Component.NickName = "ChromoMeshPipe";
        this.Component.Category = "DDUClayPrintingSlicer";
        this.Component.SubCategory = "8 Visualisation";

        List<Polyline> pls = new List<Polyline>();
        if (P == null)
        {
            M = new DataTree<object>();
            return;
        }
        foreach (var c in P)
        {
            Polyline p;
            if (c.TryGetPolyline(out p)) {
                pls.Add(p);
            }
            else
            {
                this.Component.AddRuntimeMessage(GH_RuntimeMessageLevel.Error, "Input must be polylines.");
                return;
            }
        }
        Mesh _M = GetPiped(pls, N, R, C);
        _M.UnifyNormals();
        M = new GH_Mesh(_M);
    }

    public Mesh GetPiped(List<Polyline> polylines, int numSides, double radius, bool cap)
    {
        var pt = new Point3d(radius, 0, 0);
        Polyline polygon = new Polyline();

        Point3d curr = new Point3d(pt);
        polygon.Add(curr);
        var xfm = Transform.Rotation(Math.PI * 2 / (double) numSides, Point3d.Origin);
        for (int i = 0; i < numSides; i++)
        {
            var pNew = new Point3d(curr);
            pNew.Transform(xfm);

            polygon.Add(pNew);
            curr = pNew;
        }
        var multimesh = new Mesh[polylines.Count];
        System.Threading.Tasks.Parallel.For(0, polylines.Count, pc =>
        {
            Polyline pl = polylines[pc];
            List<Plane> frames = new List<Plane>();
            for (int i = 0; i < pl.Count; i++)
            {
                Point3d o = pl[i];
                Vector3d dir = Vector3d.Unset;
                if (i == 0)
                {
                    if (!pl.IsClosed)
                    {
                        dir = pl[1] - pl[0];
                        dir.Unitize();
                    }
                    else
                    {
                        Vector3d prevDir = pl[0] - pl[pl.Count - 2];
                        Vector3d nextDir = pl[1] - pl[0];
                        prevDir.Unitize();
                        nextDir.Unitize();
                        dir = (prevDir + nextDir) / 2;
                        dir.Unitize();
                    }
                }
                else if (i == pl.Count - 1)
                {
                    if (!pl.IsClosed)
                    {
                        dir = pl[pl.Count - 1] - pl[pl.Count - 2];
                        dir.Unitize();
                    }
                }
                else
                {
                Vector3d prevDir = pl[i] - pl[i - 1];
                Vector3d nextDir = pl[i + 1] - pl[i];
                prevDir.Unitize();
                nextDir.Unitize();
                dir = (prevDir + nextDir) / 2;
                dir.Unitize();
                }
                if (frames.Count > 0)
                {
                    if (dir != Vector3d.Unset)
                    {
                        var prevFrame = frames.Last();
                        var newPlane = new Plane(o, dir);
                        double rotAng = Vector3d.VectorAngle(prevFrame.XAxis, newPlane.XAxis, newPlane);
                        newPlane.Rotate(-rotAng, newPlane.ZAxis);
                        frames.Add(newPlane);
                    }
                }
                else
                {
                    frames.Add(new Plane(o, dir));
                }
            }
            Mesh mesh = new Mesh();
            Mesh capm = null;
            var poly = new Polyline(polygon);
            poly.Transform(Transform.PlaneToPlane(Plane.WorldXY, frames.First()));
            int[] lastVerts = new int[numSides];
            for (int p = 0; p < poly.Count - 1; p++)
            {
                lastVerts[p] = mesh.Vertices.Add(poly[p]);
            }
            int[] firstVerts = lastVerts;
            if (cap && !pl.IsClosed)
            {
                capm = Mesh.CreateFromClosedPolyline(poly);
            }
            for (int i = 1; i < frames.Count; i++)
            {
                poly = new Polyline(polygon);
                poly.Transform(Transform.PlaneToPlane(Plane.WorldXY, frames[i]));
                int[] newVerts = new int[numSides];
                for (int p = 0; p < poly.Count - 1; p++)
                {
                    newVerts[p] = mesh.Vertices.Add(poly[p]);
                }
                for (int v = 1; v <= numSides; v++)
                {
                    if (v == numSides)
                    {
                        mesh.Faces.AddFace(lastVerts[v - 1], lastVerts[0], newVerts[0], newVerts[v - 1]);
                    }
                    else
                    {
                        mesh.Faces.AddFace(lastVerts[v - 1], lastVerts[v], newVerts[v], newVerts[v - 1]);

                    }
                }
                lastVerts = newVerts;
            }
            if (pl.IsClosed)
            {
                // resolve any twists
                for (int v = 1; v <= numSides; v++)
                {
                    if (v == numSides)
                    {
                        mesh.Faces.AddFace(lastVerts[v - 1], lastVerts[0], firstVerts[0], firstVerts[v - 1]);
                    }
                    else
                    {
                        mesh.Faces.AddFace(lastVerts[v - 1], lastVerts[v], firstVerts[v], firstVerts[v - 1]);

                    }
                }
            }
            else if (cap)
            {
                capm.Append(Mesh.CreateFromClosedPolyline(poly));
                mesh.Append(capm);
            }
            multimesh[pc] = mesh;
        });
        Mesh combined = new Mesh();
        foreach (var m in multimesh)
        {
            combined.Append(m);
        }
        combined.Normals.ComputeNormals();
        return combined;
    }
}
# ---------- end chromomeshpipe ----------
meshpipe = MeshPipe(Curves=shatter, Radius=multiplication_16, SubSegments=subsegments, Accuracy=accuracy, CapStyle=capstyle)  # -> MeshPipes; inputs Curves: list of Curve, Radius: Double, SubSegments: Int32, Accuracy: Int32, CapStyle: Int32
# ---------- meshpipe: C# ----------
#region Usings
using System;
using System.Linq;
using System.Collections;
using System.Collections.Generic;
using System.Collections.Concurrent;
using System.Drawing;
using System.Threading.Tasks;

using Rhino;
using Rhino.Geometry;

using Grasshopper;
using Grasshopper.Kernel;
using Grasshopper.Kernel.Data;
using Grasshopper.Kernel.Types;
#endregion

public class Script_Instance : GH_ScriptInstance
{
    #region Notes
    /* 
      Members:
        RhinoDoc RhinoDocument
        GH_Document GrasshopperDocument
        IGH_Component Component
        int Iteration

      Methods (Virtual & overridable):
        Print(string text)
        Print(string format, params object[] args)
        Reflect(object obj)
        Reflect(object obj, string method_name)

    Author: Max Benjamin Eschenbach
    License: MIT License
    Version: 250314
    */
    #endregion

  private void RunScript(
		List<Curve> Curves,
		double Radius,
		int SubSegments,
		int Accuracy,
		int CapStyle,
		ref object MeshPipes)
  {
    // set component params
    this.Component.Name = "MeshPipe";
    this.Component.NickName = "MeshPipe";
    this.Component.Category = "DDUClayPrintingSlicer";
    this.Component.SubCategory = "8 Visualisation";

    ConcurrentBag<Mesh> MeshPipesBag = new ConcurrentBag<Mesh>();
    MeshPipeCapStyle mpcs = (MeshPipeCapStyle) CapStyle;

    if (Curves == null)
    {
        MeshPipes = new DataTree<object>();
        return;
    }

    if (Curves.Count > 20)
    {
      // create pipes in parallel
      Parallel.For(0, Curves.Count,
        i => {
        // create mesh pipe
        Mesh MeshPipe = Mesh.CreateFromCurvePipe(Curves[i], Radius, SubSegments, Accuracy, mpcs, true);
        // add to tree
        MeshPipesBag.Add(MeshPipe);
        });
    }
    else
    {
      // create pipes sequential
      for (int i = 0; i < Curves.Count; i++)
      {
        // create mesh pipe
        Mesh mp = Mesh.CreateFromCurvePipe(Curves[i], Radius, SubSegments, Accuracy, mpcs, true);
        // add to tree
        MeshPipesBag.Add(mp);
      }
    }
    MeshPipes = MeshPipesBag.ToArray();
  }

}
# ---------- end meshpipe ----------
clean_11 = CombineClean(Meshes=chromomeshpipe)
filter_128 = StreamFilter(Gate=hd_layer_visualisation_3, Stream0=clean_11, Stream1=meshpipe)
preview_2 = CustomPreview(Geometry=filter_128, Material=ColourSwatch(SwatchColor=RGB(230, 230, 230)))

# ----
# LAYER HEIGHT ANALYSIS VIS
# comments & notes: LAYER HEIGHT ANALYSIS VIS
layer_height_analysis_maxlines_2 = Data(layer_height_analysis_maxlines)
layer_height_analysis_activated_9 = Data(layer_height_analysis_activated)
layer_height_analysis_minlines_2 = Data(layer_height_analysis_minlines)
printing_curves_6 = Geometry(printing_curves_3)
vis_offset_vector_17 = Vector(vis_offset_vector)
layer_height_analysis_domain_2 = Data(layer_height_analysis_domain)
move_39 = Move(Geometry=layer_height_analysis_maxlines_2, Motion=expr("x*3", vis_offset_vector_17))  # -> Geometry, Transform
move_40 = Move(Geometry=layer_height_analysis_minlines_2, Motion=expr("x*3", vis_offset_vector_17))  # -> Geometry, Transform
filter_129 = StreamFilter(Gate=layer_height_analysis_activated_9, Stream1=printing_curves_6)
len_4 = Length(Curve=move_40.Geometry)
len_5 = Length(Curve=move_39.Geometry)
maxlines = Data(move_39.Geometry)
minlines = Data(move_40.Geometry)
dedomain_9 = DeconstructDomain(Domain=layer_height_analysis_domain_2)  # -> Start, End
gradient_2 = Gradient(LowerLimit=dedomain_9.Start, UpperLimit=dedomain_9.End, Parameter=len_4, stops=[0: RGB(0, 0, 255), 1: RGB(255, 0, 0)])
gradient_3 = Gradient(LowerLimit=dedomain_9.Start, UpperLimit=dedomain_9.End, Parameter=len_5, stops=[0: RGB(0, 0, 255), 1: RGB(255, 0, 0)])
number_slider = Slider(2, range=0..10)
rtd_4 = RoundToDecimal(Numbers=len_4, DecimalPlaces="2")  # -> out, Rounded; inputs Numbers: list of Double, DecimalPlaces: list of Int32; same code as rtd
rtd_5 = RoundToDecimal(Numbers=len_5, DecimalPlaces="2")  # -> Rounded; inputs Numbers: list of Double, DecimalPlaces: list of Int32; same code as rtd
eval_4 = EvaluateCurve(Curve=reparameterize(maxlines), Parameter=0.5)  # -> Point, Tangent, Angle
eval_5 = EvaluateCurve(Curve=reparameterize(minlines), Parameter=0.5)  # -> Point, Tangent, Angle
move_41 = Move(Geometry=flatten(filter_129), Motion=expr("x*3", vis_offset_vector_17))  # -> Geometry, Transform
curvepreviewlw_14 = CurvePreviewLW(Curves=maxlines, Colors=gradient_3, Thickness=number_slider)  # inputs Curves: list of Curve, Colors: list of Color, Thickness: list of Int32; same code as curvepreviewlw
tag_9 = TextTag(Location=eval_4.Point, Text=rtd_5, Colour=gradient_3)
tag_10 = TextTag(Location=eval_5.Point, Text=rtd_4.Rounded, Colour=gradient_2)
curvepreviewlw_15 = CurvePreviewLW(Curves=minlines, Colors=gradient_2, Thickness=number_slider)  # inputs Curves: list of Curve, Colors: list of Color, Thickness: list of Int32; same code as curvepreviewlw
curvepreviewlw_16 = CurvePreviewLW(Curves=move_41.Geometry, Colors=ColourSwatch(SwatchColor=RGB(191, 191, 191)), Thickness=Slider(1, range=0..10))  # inputs Curves: list of Curve, Colors: list of Color, Thickness: list of Int32; same code as curvepreviewlw

# ----
# comments & notes: OVERHANG OFFSET ANALYSIS VIS
# OVERHANG OFFSET ANALYSIS VIS
overhang_offset_distance_values_3 = Data(overhang_offset_distance_values)
overhang_offset_distance_displaytriangle_2 = Data(overhang_offset_distance_displaytriangle)  # "OVERHANG_OFFSET_DISTANCE_DISPLAYTRIANGLES"
offset_analysis_threshold_mm_2 = Data(offset_analysis_threshold_mm)
overhang_angle_analysis_activated_10 = Boolean(overhang_angle_analysis_activated)
layer_height_analysis_activated_10 = Data(layer_height_analysis_activated)
printing_curves_7 = Geometry(printing_curves_3)
render_layer_curves_9 = Data(render_layer_curves)
vis_offset_vector_18 = Vector(vis_offset_vector)
overhang_offset_distance_displaylines_2 = Data(overhang_offset_distance_displaylines)
merge_38 = Merge(
    Data1=flatten(render_layer_curves_9),
    Data2=flatten(overhang_angle_analysis_activated_10),
    Data3=flatten(layer_height_analysis_activated_10))
gradient_4 = Gradient(
    LowerLimit="0",
    UpperLimit=offset_analysis_threshold_mm_2,
    Parameter=overhang_offset_distance_values_3,
    stops=[0: RGB(0, 128, 0), 0.5: RGB(255, 255, 0), 1: RGB(255, 0, 0)])
int_6 = Integer(merge_38)
slice_curves_23 = Curve(slice_curves_5)
number_slider_2 = Slider(3, range=0..10)
multiplication_17 = Multiplication(A=offset_analysis_threshold_mm_2, B="0.8")
ma_21 = MassAddition(Input=int_6)  # -> Result, PartialResults
eval_6 = EvaluateCurve(Curve=reparameterize(overhang_offset_distance_displaylines_2), Parameter=0.5)  # -> Point, Tangent, Angle
larger_15 = LargerThan(FirstNumber=overhang_offset_distance_values_3, SecondNumber=multiplication_17)  # -> LargerThan, OrEqualTo
addition_11 = Addition(A="2", B=ma_21.Result)
tstat_37 = TreeStatistics(Tree=slice_curves_23)  # -> Paths, Length, Count
multiplication_18 = Multiplication(A=vis_offset_vector_18, B=addition_11)
shift_7 = ShiftList(List=tstat_37.Paths, Shift=1, Wrap=False)
path_mapper_3 = PathMapper(eval_6.Point, source="{A;B}", target="{A;B+1}")
branch_28 = TreeBranch(Tree=slice_curves_23, Path=shift_7, MaintainPaths=True)
move_42 = Move(Geometry=overhang_offset_distance_displaytriangle_2, Motion=multiplication_18)  # -> Geometry, Transform
crv_cp_6 = CurveClosestPoint(Point=path_mapper_3, Curve=branch_28)  # -> Point, Parameter, Distance
dispatch_11 = Dispatch(List=gradient_4, DispatchPattern=larger_15.LargerThan)  # -> ListA, ListB
dispatch_12 = Dispatch(List=overhang_offset_distance_values_3, DispatchPattern=larger_15.LargerThan)  # -> ListA, ListB
shift_8 = ShiftList(List=crv_cp_6.Parameter, Shift=1, Wrap=True)
dispatch_13 = Dispatch(List=move_42.Geometry, DispatchPattern=larger_15.LargerThan)  # -> ListA, ListB
clean_12 = CleanTree(RemoveNulls=True, RemoveInvalid=True, RemoveEmpty=True, Tree=dispatch_12.ListA)
clean_13 = CleanTree(RemoveNulls=True, RemoveInvalid=True, RemoveEmpty=True, Tree=dispatch_11.ListA)
clean_14 = CleanTree(RemoveNulls=True, RemoveInvalid=True, RemoveEmpty=True, Tree=dispatch_13.ListA)
analysistrimcurves = AnalysisTrimCurves(A=crv_cp_6.Parameter, B=shift_8, C=branch_28)  # -> S, I; inputs A: list of Double, B: list of Double, C: Curve
# ---------- analysistrimcurves: Python ----------
# RHINO SDK IMPORTS
import System
import Rhino
import Grasshopper

# GHENV COMPONENT SETTINGS
ghenv.Component.Name = "AnalysisTrimCurves"
ghenv.Component.NickName = "AnalysisTrimCurves"
ghenv.Component.Category = "DDUClayPrintingSlicer"
ghenv.Component.SubCategory = "9 Utilities"

class AnalysisTrimCurves(Grasshopper.Kernel.GH_ScriptInstance):
    """
    Author: Max Benjamin Eschenbach
    License: MIT License
    Version: 250429
    """
    def RunScript(self,
            A: System.Collections.Generic.List[float],
            B: System.Collections.Generic.List[float],
            C: Rhino.Geometry.Curve):

        if not A or not B or not C:
            rml = ghenv.Component.RuntimeMessageLevel.Warning
            if not A:
                ghenv.Component.AddRuntimeMessage(
                    rml,
                    'Input Parameter A failed to collect Data!')
            if not B:
                ghenv.Component.AddRuntimeMessage(
                    rml,
                    'Input Parameter A failed to collect Data!')
            if not C:
                ghenv.Component.AddRuntimeMessage(
                    rml,
                    'Input Parameter A failed to collect Data!')
            return (Grasshopper.DataTree[object](),
                    Grasshopper.DataTree[object]())

        A = list(A)
        B = list(B)

        if len(A) != len(B):
            ghenv.Component.AddRuntimeMessage(
                ghenv.Component.RuntimeMessageLevel.Error,
                'List counts do not match!')
            return (Grasshopper.DataTree[object](),
                    Grasshopper.DataTree[object]())

        domains = []
        subcrvs = []
        # loop over all domains
        for i, ai in enumerate(A):
            first_bi = 0.0
            bi = B[i]
            # first list items
            if i == 0:
                if A[i] > B[i] and A[i] > 0.999:
                    A[i] = 0.0
                if B[-1] < A[-1] and B[-1] <= 0.001:
                    B[-1] = 1.0
                ai = (A[-1] + B[-1]) * 0.5
                bi = (A[i] + B[i]) * 0.5
                first_bi = bi
            # all regular list items
            elif i > 0 and i < len(A) - 1:
                ai = (A[i - 1] + B[i - 1]) * 0.5
                bi = (A[i] + B[i]) * 0.5
            # last list items
            elif i == len(A) - 1:
                ai = domains[-1].T1
                bi = domains[0].T0

            domain = Rhino.Geometry.Interval(ai, bi)
            domains.append(domain)

            subcrv = C.Trim(ai, bi)
            subcrvs.append(subcrv)

        return (subcrvs, domains)
# ---------- end analysistrimcurves ----------
move_43 = Move(Geometry=analysistrimcurves.S, Motion=multiplication_18)  # -> Geometry, Transform
rtd_6 = RoundToDecimal(Numbers=clean_12, DecimalPlaces="2")  # -> out, Rounded; inputs Numbers: list of Double, DecimalPlaces: list of Int32; same code as rtd
area = Area(Geometry=clean_14)  # -> Area, Centroid
preview_3 = CustomPreview(Geometry=clean_14, Material=clean_13)
curvepreviewlw_17 = CurvePreviewLW(Curves=flatten(move_43.Geometry), Colors=flatten(gradient_4), Thickness=Slider(2, range=0..10))  # inputs Curves: list of Curve, Colors: list of Color, Thickness: list of Int32; same code as curvepreviewlw
tag_11 = TextTag(Location=area.Centroid, Text=rtd_6.Rounded, Colour=ColourSwatch(SwatchColor=RGB(0, 0, 0)))

# ----
# CONTROL FLOW
# FLOOR LAYER PAUSE
# comments & notes: check if first layer has been skipped and adjust floor layer count accordingly
floor_layer_count_8 = Data(floor_layer_count)
printing_curves_8 = Geometry(printing_curves_3)
tstat_38 = TreeStatistics(Tree=printing_curves_8)  # -> Paths, Length, Count
item_25 = ListItem(List=tstat_38.Paths, Index=0, Wrap=True)
dpath_7 = DeconstructPath(Branch=item_25)
ma_22 = MassAddition(Input=dpath_7)  # -> Result, PartialResults
larger_16 = LargerThan(FirstNumber=ma_22.Result, SecondNumber="0")  # -> LargerThan, OrEqualTo
subtraction_14 = Subtraction(A=floor_layer_count_8, B=ma_22.Result)
filter_130 = StreamFilter(Gate=larger_16.LargerThan, Stream0=floor_layer_count_8, Stream1=subtraction_14)
real_floor_layer_count = Data(filter_130)

# ----
# GCODE CREATION
# DEVELOPMENT NOTES
# ---------------------------------------------------
# 3RD ITERATION OF GCODE GENERATOR
# ORIGINAL BY TOM SVILANS
# EDITED & EXTENDED BY MAX ESCHENBACH
# 
# 
# NOTES BY MAX
# ---------------------------------------------------
# GCODE Reference
# ------
# https://reprap.org/wiki/G-code
# 
# 
# Command Reference for Floor Pause
# ------
# G92 E0 ; Reset Extrusion Distance
# G1 X38.394 Y45.456 Z15.000 E0.000 F3000 ; Move to Pause position
# G04 P10000 ; DWELL
# 
# 
# First Test Evals 2023 Extrusion Rate
# ------
# Feed Setting: 15-20 %
# Adapt ExtrusionRate
# 15 % = 0,156
# 20 % = 0,208
# 
# 
# 4mm Nozzle Cura Settings (very old...)
# ------
# Line Width: 3.5
# Layer Height: 1.9
# Print Speed: 50 mm/s
# 
# 
# ORIGINAL NOTES BY TOM
# ---------------------------------------------------
# Wasp (60100), 4mm, 2mm lh, extrusion rate: 2.7
# Wasp (40100), 4mm, 2mm lh, extrusion rate: 0.28
# for 4mm 2.7
# for 2mm 1/4 of 2.7
# Toms original comment: I have since been working with an extrusion rate of 0.1 for the 40100 with the new extruder as it handles a much firmer material (c# tool)
add_floor_custom_curves_enabled_5 = Boolean(add_floor_custom_curves_enabled)
layer_height_8 = Number(layer_height)
regular_floor_slicing_enabled_3 = Boolean(regular_floor_slicing_enabled)
line_width_4 = Data(line_width)
add_floor_slicing_enabled_4 = Boolean(add_floor_slicing_enabled)
printing_curves_9 = Curve(printing_curves_3)
create_gcode_2 = Data(create_gcode)
retractextension = Slider(6, range=0..10)
curveextensionretraction = BooleanToggle(True)
floor_pause_time_seconds_2 = Data(floor_pause_time_seconds)
pause_print_after_floor_2 = Data(pause_print_after_floor)
print_speed_mm_min = Panel("3000")
linewidth_2 = Panel(line_width_4)
z_hop_distance = Panel("1.0")
travel_speed_mm_min = Panel("6000")
retraction_speed_mm_min = Panel("1500")
layerheight = Panel(layer_height_8)
new_extrusion_rate_250312 = Panel("0.16")
retraction_constant = Panel("5.0")
initial_extrusion_constant = Panel("6.0")
real_floor_layer_count_2 = Data(real_floor_layer_count)
comments_notes_42 = Panel("GCODE CREATION")
filter_131 = StreamFilter(Gate=create_gcode_2, Stream1=printing_curves_9)
or_13 = GateOr(A=add_floor_slicing_enabled_4, B=regular_floor_slicing_enabled_3, C=add_floor_custom_curves_enabled_5)
multiplication_19 = Multiplication(A=floor_pause_time_seconds_2, B="1000")
and_17 = GateAnd(A=or_13, B=pause_print_after_floor_2)
extrusion_rate_230316 = Panel("0.208")
generategcode = GenerateGCODE(
    Paths=filter_131,
    PrintSpeed=print_speed_mm_min,
    TravelSpeed=travel_speed_mm_min,
    RetractionSpeed=retraction_speed_mm_min,
    ExtrusionRate=new_extrusion_rate_250312,
    InitExtrusionConstant=initial_extrusion_constant,
    RetractionConstant=retraction_constant,
    LayerHeight=layerheight,
    LineWidth=linewidth_2,
    RetractExtension=retractextension,
    CurveExtensionRetraction=curveextensionretraction,
    ZHopDistance=z_hop_distance,
    FloorLayerCount=real_floor_layer_count_2,
    PauseAfterFloor=and_17,
    PauseTime=multiplication_19,
    ExtrusionRateMod=filter_52)  # -> out, GCODE; inputs Paths: tree of Polyline, PrintSpeed: Double, TravelSpeed: Double, RetractionSpeed: Double, ExtrusionRate: Double, InitExtrusionConstant: Double, RetractionConstant: Double, LayerHeight: Double, LineWidth: Double, RetractExtension: Double, CurveExtensionRetraction: Boolean, ZHopDistance: Double, FloorLayerCount: Int32, PauseAfterFloor: Boolean, PauseTime: Int32, ExtrusionRateMod: tree of Double
# ---------- generategcode: C# ----------
using System;
using System.Collections;
using System.Collections.Generic;

using Rhino;
using Rhino.Geometry;

using Grasshopper;
using Grasshopper.Kernel;
using Grasshopper.Kernel.Data;
using Grasshopper.Kernel.Types;
using System.Linq;

public class Script_Instance : GH_ScriptInstance
{
  #region Notes
    /* 
      Members:
        RhinoDoc RhinoDocument
        GH_Document GrasshopperDocument
        IGH_Component Component
        int Iteration

      Methods (Virtual & overridable):
        Print(string text)
        Print(string format, params object[] args)
        Reflect(object obj)
        Reflect(object obj, string method_name)

    Author: Max Benjamin Eschenbach (Original Base Script by Tom Svilans)
    License: MIT License
    Version: 250411
    */
    #endregion

  private void RunScript(
		DataTree<Polyline> Paths,
		double PrintSpeed,
		double TravelSpeed,
		double RetractionSpeed,
		double ExtrusionRate,
		double InitExtrusionConstant,
		double RetractionConstant,
		double LayerHeight,
		double LineWidth,
		double RetractExtension,
		bool CurveExtensionRetraction,
		double ZHopDistance,
		int FloorLayerCount,
		bool PauseAfterFloor,
		int PauseTime,
		DataTree<double> ExtrusionRateMod,
		ref object GCODE)
  {
    // set component params
    this.Component.Name = "GenerateGCODE";
    this.Component.NickName = "GenerateGCODE";
    this.Component.Category = "DDUClayPrintingSlicer";
    this.Component.SubCategory = "7 GCODE";
    
    // catch empty paths ttree and return empty tree
    if (Paths.DataCount < 1)
    {
      GCODE = new Grasshopper.DataTree<object>();
      return;
    }

    // check if extrusion rate modified values correspond
    bool e_mod = true;
    int ptsum = 0;
    for (int i = 0; i < Paths.BranchCount; i++)
    {
      foreach (Polyline pl in Paths.Branches[i])
      {
        ptsum += pl.Count;
      }
    }
    if (ptsum != ExtrusionRateMod.DataCount)
    {
      e_mod = false;
      Print("ExtrusionRateMod values do not correspond with supplied Paths. " +
        "Constant ExtrusionRate will be used!");
    }

    // init list for storing GCODE strings
    List<string> gcode = new List<string>();

    // get all data from Paths input
    List<Polyline> paths = Paths.AllData();

    // compute union bbx with each layer
    BoundingBox bbx = BoundingBox.Empty;
    foreach (Polyline path in paths)
    {
      bbx.Union(path.BoundingBox);
    }

    // compute offset value from bbx
    Vector3d offset = new Vector3d(-bbx.Center.X, -bbx.Center.Y, 0);
    Print("Offset: {0}", offset);

    // SET CONSTANTS -----------------------------------------------
    // value for safe approach before first layer
    double z_safety = 5.0;

    // initial extrusion rate constant and retraction constant
    double extrusion_rate_extra = InitExtrusionConstant;
    double retraction_amount = RetractionConstant;

    // CREATE HEADER -----------------------------------------------
    Point3d p0 = paths[0][0] + offset;
    gcode.AddRange(new string[]
      {
        "; GCODE Generation Script by: Arkitekturens Teknologi (AT) + SuperFormLab",
        "; Modified, adapted and extended by: Max Eschenbach, DDU - Digital Design Unit, TU Darmstadt",
        string.Format("; Created by : {0}", System.Environment.UserName),
        string.Format("; File name  : {0}", GrasshopperDocument.DisplayName),
        string.Format("; Date time  : {0}", System.DateTime.Now.ToString("yyyy-MM-ddTHH\\:mm\\:ss")),
        ";",
        "; --- BEGIN_DDU_3DCLAYPRINTING_HEADER ---",
        $"; PRINTSPEED={PrintSpeed}",
        $"; TRAVELSPEED={TravelSpeed}",
        $"; RETRACTIONSPEED={RetractionSpeed}",
        $"; EXTRUSIONRATE={ExtrusionRate}",
        $"; LAYERHEIGHT={LayerHeight}",
        $"; LINEWIDTH={LineWidth}",
        "; --- END_DDU_3DCLAYPRINTING_HEADER ---",
        ";",
        "M105 ; get extruder temperature",
        "M109 S0 ; set extruder temp to 0 (deactivate)",
        "M82 ; use absolute distances for extrusion",
        "G90 ; use absolute coordintes",
        "M106 S0 ; set fan speed to 0 (deactivate)",
        "M107 ; fan off",
        "M104 S0 T0 ; set hotend temperature to 0 (deactivate)",
        "G28 ; home all axes",
        "T0 ; set extruder to extruder 0 (first and only one)",
        "G21 ; set units to millimetres",
        // "M204 S200 ; set acceleration",
        "G92 E0 ; reset E distance",
        "; approach the first vertex using z safety height",
        string.Format("G0 X0.0 Y0.0 Z{0:0.000} F{1}", p0.Z + z_safety, 3000),
        "; approach first point with x and y coordinates",
        string.Format("G1 X{0:0.000} Y{1:0.000} Z{2:0.000}", p0.X, p0.Y, p0.Z + z_safety),
        "; --- END HEADER ---",
      });


    // CREATE PRINT PATHS GCODE  ------------------------------------
    Point3d temp = Paths.Branches[0][0][0];
    double emod_value = 1.0;

    // LOOP OVER ALL LAYERS (BRANCHES)
    for (int i = 0; i < Paths.BranchCount; i++)
    {
      // pause after floor printing on request
      if (PauseAfterFloor && FloorLayerCount > 0 && i == FloorLayerCount)
      {
        // add marker to GCODE out
        gcode.Add(string.Format("; ///// PAUSE AFTER FLOOR FOR {0} ms /////", PauseTime));
        // reset extrusion distance
        gcode.Add(string.Format("G92 E0 ; Reset Extrusion Distance"));
        // move 5mm upwards from last point
        gcode.Add(string.Format("G0 X{0:0.000} Y{1:0.000} Z{2:0.000} E{3:0.000} F{4}",
          p0.X, p0.Y, p0.Z + 5.0, 0.000, PrintSpeed));
        // move to pause position 100mm upwards from last point
        gcode.Add(string.Format("G0 X{0:0.000} Y{1:0.000} Z{2:0.000} E{3:0.000} F{4}",
          0.000, 0.000, p0.Z + 100.0, 0.000, PrintSpeed));
        // execute pause command
        gcode.Add(string.Format("G04 P{0:0} ; Dwell / Pause", PauseTime));
      }

      // add layer marker to GCODE out
      gcode.Add(string.Format("; ///// LAYER {0} /////", i + 1));

      // LOOP OVER ALL CURVES IN LAYER (BRANCH)
      for (int j = 0; j < Paths.Branches[i].Count; j++)
      {
        // set current path
        Polyline path = Paths.Branches[i][j];
        PolylineCurve pathcrv = path.ToPolylineCurve();
        // reset extrusion distance
        double ExtrusionDist = 0.0;
        // translate path according to offset
        path.Transform(Transform.Translation(offset));
        pathcrv.Transform(Transform.Translation(offset));
        // get first vertex
        p0 = path.First();
        // format first vertex to GCODE
        gcode.Add(string.Format("G1 X{0:0.000} Y{1:0.000} Z{2:0.000} E{3:0.000} F{4}",
          p0.X, p0.Y, p0.Z + ZHopDistance, ExtrusionDist, TravelSpeed));
        // set extrusion on first vertex (no distance here!)
        ExtrusionDist += extrusion_rate_extra;
        // set temporary vertex
        temp = p0;
        // loop over all vertices in path
        for (int k = 0; k < path.Count; k++)
        {

          // get point distance to previous point
          double ptDist = temp.DistanceTo(path[k]);
          if (k > 0 && ptDist < Rhino.RhinoDoc.ActiveDoc.ModelAbsoluteTolerance)
          {
            Print("Point Distance below tolerance, point is skipped!");
            continue;
          }

          // compute extrusion rate modified (if applicable)
          if (e_mod == true)
          {
            emod_value = ExtrusionRateMod.Branches[i][k];
          }

          // set extrusion distance based on pt distance and emod
          ExtrusionDist += ptDist * (ExtrusionRate * emod_value);

          // compile GCODE string
          // for first vertex use half print speed
          gcode.Add(string.Format("G1 X{0:0.000} Y{1:0.000} Z{2:0.000} E{3:0.000} F{4}",
            path[k].X, path[k].Y, path[k].Z, ExtrusionDist, (k == 0) ? PrintSpeed * 0.5 :  PrintSpeed));

          // set new temp vertex
          temp = path[k];
        }

        // retract on last vertex or extend during retraction move
        if (RetractExtension > 0.0)
        {
          if (CurveExtensionRetraction && path.IsClosedWithinTolerance(0.01) && path.Length > RetractExtension)
          {
            // move retractextension amount along the curve

            // find point on curve that is RetractionExtension mm along crv
            double ret_end_t;
            bool _suc = pathcrv.LengthParameter(RetractExtension, out ret_end_t);
            PolylineCurve subcrv = pathcrv.Split(new List<double>{0.0, ret_end_t})[0] as PolylineCurve;
            Polyline subpl = subcrv.ToPolyline();

            temp = subpl.First;
            for (int k = 1; k < subpl.Count; k++)
            {
              double ptDist = temp.DistanceTo(subpl[k]);
              if (k > 0 && ptDist < Rhino.RhinoDoc.ActiveDoc.ModelAbsoluteTolerance)
              {
                Print("Point Distance below tolerance, point is skipped!");
                continue;
              }

              // compute retraction amount for point
              ExtrusionDist -= (ptDist / RetractExtension) * retraction_amount;

              // create retraction gcode
              gcode.Add(string.Format("G1 X{0:0.000} Y{1:0.000} Z{2:0.000} E{3:0.000} F{4} ; RetractExtensionClosedCurve",
                subpl[k].X, subpl[k].Y, subpl[k].Z, ExtrusionDist, RetractionSpeed));

              // set new temp vertex
              temp = subpl[k];
            }

            // create z-hop gcode
            gcode.Add(string.Format("G1 X{0:0.000} Y{1:0.000} Z{2:0.000} E{3:0.000} F{4} ; Z-Hop",
              subpl.Last.X, subpl.Last.Y, subpl.Last.Z + ZHopDistance, ExtrusionDist, RetractionSpeed));
          }
          else
          {
            // move retract extension amount in direction of last move and retract
            Vector3d rvec = new Vector3d(path.Last - path[path.Count - 2]);
            rvec.Unitize();
            p0 = path.Last + (rvec * RetractExtension);
            ExtrusionDist -= retraction_amount;
            gcode.Add(string.Format("G1 X{0:0.000} Y{1:0.000} Z{2:0.000} E{3:0.000} F{4} ; RetractExtension",
              p0.X, p0.Y, p0.Z, ExtrusionDist, RetractionSpeed));

            gcode.Add(string.Format("G1 X{0:0.000} Y{1:0.000} Z{2:0.000} E{3:0.000} F{4} ; Z-Hop",
              p0.X, p0.Y, p0.Z + ZHopDistance, ExtrusionDist, RetractionSpeed));
          }
        }
        else
        {
          // use last point for retraction move and move upwards
          p0 = path.Last();
          ExtrusionDist -= retraction_amount;
          gcode.Add(string.Format("G1 X{0:0.000} Y{1:0.000} Z{2:0.000} E{3:0.000} F{4} ; Z-Hop with retraction",
            p0.X, p0.Y, p0.Z + ZHopDistance, ExtrusionDist, RetractionSpeed));
        }

        // reset extrusion distance
        gcode.Add(string.Format("G92 E0 ; Reset Extrusion Distance"));
      }
    }

    // CREATE FOOTER -----------------------------------------------------
    gcode.AddRange(new string[]
      {
      "G1 E-1 ; retract",
      "G92 E0 ; reset E value",
      "M104 S0 ; turn off extruder",
      "M140 S0 ; turn off bed",
      "G28 X0 Y0 ; home all axes",
      "M84; disable motors",
      "M82 ; absolute extrusion mode",
      "; --- END OF GCODE ---",
      });

    // set gcode to output
    GCODE = gcode;
  }

}
# ---------- end generategcode ----------
panel_24 = Panel(generategcode.out)
print_speed_mm_min_2 = Data(print_speed_mm_min)
gcode = Data(generategcode.GCODE)

# ----
# SAVE
# GCODE
# comments & notes: SAVE GCODE TO FILE
save_gcode_to_file_2 = Data(save_gcode_to_file)
gcode_2 = Data(gcode)
savegcode = SaveGCODE(Save=save_gcode_to_file_2, GCODE=gcode_2)  # inputs Save: Boolean, GCODE: list
#   port Save: Set to True to save the GCODE to a file. Connect a button here, ideally.
#   port GCODE: The GCODE to save to a file.
# ---------- savegcode: Python ----------
# PYTHON STANDARD LIBRARY IMPORTS
from __future__ import division, print_function
from os.path import abspath, basename, dirname, normpath

# GHPYTHON SDK IMPORTS
import System
import Rhino
import Grasshopper
import rhinoscriptsyntax as rs

# GHENV COMPONENT SETTINGS
ghenv.Component.Name = "SaveGCODE"
ghenv.Component.NickName = "SaveGCODE"
ghenv.Component.Category = "DDUClayPrintingSlicer"
ghenv.Component.SubCategory = "7 GCODE"

class SaveGCODE(Grasshopper.Kernel.GH_ScriptInstance):
    """
    Author: Max Benjamin Eschenbach
    License: MIT License
    Version: 250314
    """

    def SaveFileDialog(self, title=None, filter=None, folder=None,
                       filename=None, extension=None):
        """
        Opens a SaveFileDialog with the specified settings and lets the user
        pick a file. Returns the full path of the picked file.

        Based on:
        https://discourse.mcneel.com/t/rhino-ui-openfiledialog-showopendialog-
        with-multiselect-true-not-working/40068
        """

        fd = Rhino.UI.SaveFileDialog()
        if title:
            fd.Title = title
        if filter:
            fd.Filter = filter
        if folder:
            fd.InitialDirectory = folder
        if filename:
            fd.FileName = filename
        if extension:
            fd.DefaultExt = extension
        if fd.ShowSaveDialog():
            return normpath(abspath(fd.FileName))

        # return None if something goes wrong while picking the file
        return None

    def RunScript(self, Save: bool, GCODE: System.Collections.Generic.List[object]):
        # on button click, execute save
        if Save and GCODE:
            if not GCODE or GCODE == [None]:
                Rhino.UI.Dialogs.ShowMessage("No GCODE to save!", "Warning")
                return
            fp = self.SaveFileDialog(
                                "Save GCODE File",
                                "GCODE Files (*.gcode)",
                                dirname(ghenv.Component.OnPingDocument().FilePath),
                                None,
                                ".gcode")
            # write gcode to selected file
            if fp:
                # mac os file extension fix
                if not fp.endswith(".gcode"):
                    fp = fp + ".gcode"
                # write every line to file
                with open(fp, "w") as f:
                    for l in GCODE:
                        f.write(l + "\n")
                # report success
                rml = Grasshopper.Kernel.GH_RuntimeMessageLevel.Remark
                ghenv.Component.AddRuntimeMessage(rml,
                                       ("Successfully wrote {0} "
                                        "lines to {1}!".format(len(GCODE),
                                                               basename(fp))))
                return
        elif not GCODE:
            rml = Grasshopper.Kernel.GH_RuntimeMessageLevel.Warning
            ghenv.Component.AddRuntimeMessage(rml,
                                   "Parameter GCODE failed to collect data!")
            return
# ---------- end savegcode ----------

# ----
# GCODE PARSING & GCODE GEOMETRY
# comments & notes: COMPUTE GCODE GEOMETRY FOR VISUALISATION
gcode_3 = Data(gcode)
parsegcode = ParseGCODE(GCODE=gcode_3)  # -> PrintSpeed, TravelSpeed, RetractionSpeed, ExtrusionRate, LayerHeight, LineWidth, G, X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; inputs GCODE: list of String
# ---------- parsegcode: C# ----------
// Grasshopper Script Instance
#region Usings
using System;
using System.Linq;
using System.Collections;
using System.Collections.Generic;
using System.Drawing;
using System.Text.RegularExpressions;

using Rhino;
using Rhino.Geometry;

using Grasshopper;
using Grasshopper.Kernel;
using Grasshopper.Kernel.Data;
using Grasshopper.Kernel.Types;
#endregion

public class Script_Instance : GH_ScriptInstance
{
    #region Notes
    /* 
      Members:
        RhinoDoc RhinoDocument
        GH_Document GrasshopperDocument
        IGH_Component Component
        int Iteration

      Methods (Virtual & overridable):
        Print(string text)
        Print(string format, params object[] args)
        Reflect(object obj)
        Reflect(object obj, string method_name)
    
    Author: Max Benjamin Eschenbach
    License: MIT License
    Version: 2504152
    */
    #endregion

    private void RunScript(
		List<string> GCODE,
		ref object PrintSpeed,
		ref object TravelSpeed,
		ref object RetractionSpeed,
		ref object ExtrusionRate,
		ref object LayerHeight,
		ref object LineWidth,
		ref object G,
		ref object X,
		ref object Y,
		ref object Z,
		ref object E,
		ref object F)
    {
        // set component params
        this.Component.Name = "ParseGCODE";
        this.Component.NickName = "ParseGCODE";
        this.Component.Category = "DDUClayPrintingSlicer";
        this.Component.SubCategory = "7 GCODE";

        DataTree<double> _PrintSpeed = new DataTree<double>();
        DataTree<double> _TravelSpeed = new DataTree<double>();
        DataTree<double> _RetractionSpeed = new DataTree<double>();
        DataTree<double> _ExtrusionRate = new DataTree<double>();
        DataTree<double> _LayerHeight = new DataTree<double>();
        DataTree<double> _LineWidth = new DataTree<double>();

        List<string> _G = new List<string>();
        List<double> _X = new List<double>();
        List<double> _Y = new List<double>();
        List<double> _Z = new List<double>();
        List<double> _E = new List<double>();
        List<double> _F = new List<double>();

        if (GCODE == null)
        {
            this.AddRuntimeMessage(
                GH_RuntimeMessageLevel.Warning,
                "Input Parameter GCODE failed to collect Data!"
            );
            PrintSpeed = _PrintSpeed;
            TravelSpeed = _TravelSpeed;
            RetractionSpeed = _RetractionSpeed;
            ExtrusionRate = _ExtrusionRate;
            LayerHeight = _LayerHeight;
            LineWidth = _LineWidth;
            G = _G;
            X = _X;
            Y = _Y;
            Z = _Z;
            E = _E;
            F = _F;
            return;
        }

        // Temporary Variables
        double Ztemp = 0.0;
        double Etemp = 0.0;
        double Ftemp = 0.0;

        // Regex Definitions
        Regex re_colon_a = new Regex(" ;");
        Regex re_colon_b = new Regex(" |;");
        Regex re_colon_c = new Regex("=");

        // Define Invariant Culture
        var cult = System.Globalization.CultureInfo.InvariantCulture;

        for (int i = 0; i < GCODE.Count; i++)
        {
            // Define the current GCODE line
            string ln = GCODE[i];
            if (ln.StartsWith(";"))
            {
                // Detect Header
                if (ln.Contains("BEGIN_DDU_3DCLAYPRINTING_HEADER"))
                {
                    // READ HEADER INFORMATION, HEADER LOOKS LIKE THIS:
                    // ; --- BEGIN_DDU_3DCLAYPRINTING_HEADER ---
                    // ; PRINTSPEED=3000
                    // ; TRAVELSPEED=6000
                    // ; RETRACTIONSPEED=1500
                    // ; EXTRUSIONRATE=0.16
                    // ; LAYERHEIGHT=1.9
                    // ; LINEWIDTH=4
                    // ; --- END_DDU_3DCLAYPRINTING_HEADER ---
                    
                    // Process using RegEx patterns
                    _PrintSpeed.Add(double.Parse(re_colon_c.Split(re_colon_b.Split(re_colon_a.Split(GCODE[i + 1])[0])[2])[1], cult));
                    _TravelSpeed.Add(double.Parse(re_colon_c.Split(re_colon_b.Split(re_colon_a.Split(GCODE[i + 2])[0])[2])[1], cult));
                    _RetractionSpeed.Add(double.Parse(re_colon_c.Split(re_colon_b.Split(re_colon_a.Split(GCODE[i + 3])[0])[2])[1], cult));
                    _ExtrusionRate.Add(double.Parse(re_colon_c.Split(re_colon_b.Split(re_colon_a.Split(GCODE[i + 4])[0])[2])[1], cult));
                    _LayerHeight.Add(double.Parse(re_colon_c.Split(re_colon_b.Split(re_colon_a.Split(GCODE[i + 5])[0])[2])[1], cult));
                    _LineWidth.Add(double.Parse(re_colon_c.Split(re_colon_b.Split(re_colon_a.Split(GCODE[i + 6])[0])[2])[1], cult));
                }
                continue;
            }
            else if (ln.StartsWith("G0") || ln.StartsWith("G1"))
            {
                if (ln.Contains("X") && ln.Contains("Y"))
                {
                    _G.Add(ln.Substring(1, 1));
                }
                else
                {
                    continue;
                }
                // Split Line into parts using RegEx template
                string[] preparts = re_colon_a.Split(ln);
                string[] parts = re_colon_b.Split(preparts[0]);
                // loop over all string parts
                for (int j = 0; j < parts.Length; j++)
                {
                    string part = parts[j];

                    // catch X values
                    if (part.StartsWith("X")) _X.Add(double.Parse(part.Substring(1), cult));

                    // catch Y values
                    if (part.StartsWith("Y")) _Y.Add(double.Parse(part.Substring(1), cult));

                    // catch Z values
                    if (part.StartsWith("Z"))
                    {
                        double Zval = double.Parse(part.Substring(1), cult);
                        _Z.Add(Zval);
                        Ztemp = Zval;
                    }

                    // catch E values
                    if (part.StartsWith("E"))
                    {
                        double Eval = double.Parse(part.Substring(1), cult);
                        _E.Add(Eval);
                        Etemp = Eval;
                    }

                    // catch F values
                    if (part.StartsWith("F"))
                    {
                        double Fval = double.Parse(part.Substring(1), cult);
                        _F.Add(Fval);
                        Ftemp = Fval;
                    }
                }
                // catch missing Z values
                if (ln.Contains("X") && ln.Contains("Y") && !ln.Contains("Z")) _Z.Add(Ztemp);

                // catch missing E values
                if (!ln.Contains("E")) _E.Add(Etemp);

                // catch missing F values
                if (!ln.Contains("F")) _F.Add(Ftemp);
            }
            else
            {
                // Print(ln);
            }
        }
        PrintSpeed = _PrintSpeed;
        TravelSpeed = _TravelSpeed;
        RetractionSpeed = _RetractionSpeed;
        ExtrusionRate = _ExtrusionRate;
        LayerHeight = _LayerHeight;
        LineWidth = _LineWidth;
        G = _G;
        X = _X;
        Y = _Y;
        Z = _Z;
        E = _E;
        F = _F;
    }
}
# ---------- end parsegcode ----------
vis_printing_progress_2 = Data(vis_printing_progress)
pt_8 = ConstructPoint(XCoordinate=parsegcode.X, YCoordinate=parsegcode.Y, ZCoordinate=parsegcode.Z)
retractioncolor = ColourSwatch(SwatchColor=RGB(68, 194, 0))
extrusioncolor = ColourSwatch(SwatchColor=RGB(255, 94, 0))
travelcolor = ColourSwatch(SwatchColor=RGB(0, 85, 255))
classifygcodemovements = ClassifyGCODEMovements(
    ProgressPercentage=vis_printing_progress_2,
    Points=pt_8,
    E=parsegcode.E,
    ExtrusionColor=extrusioncolor,
    TravelColor=travelcolor,
    RetractionColor=retractioncolor)  # -> MoveLines, MoveLinesProg, Colors, ColorsProg, PrintLines, PrintPolyLines; inputs ProgressPercentage: Double, Points: list of Point3d, E: list of Double, ExtrusionColor: Color, TravelColor: Color, RetractionColor: Color
# ---------- classifygcodemovements: C# ----------
// Grasshopper Script Instance
#region Usings
using System;
using System.Linq;
using System.Collections;
using System.Collections.Generic;
using System.Drawing;

using Rhino;
using Rhino.Geometry;

using Grasshopper;
using Grasshopper.Kernel;
using Grasshopper.Kernel.Data;
using Grasshopper.Kernel.Types;
#endregion

public class Script_Instance : GH_ScriptInstance
{

    #region Notes
    /* 
        Members:
        RhinoDoc RhinoDocument
        GH_Document GrasshopperDocument
        IGH_Component Component
        int Iteration

        Methods (Virtual & overridable):
        Print(string text)
        Print(string format, params object[] args)
        Reflect(object obj)
        Reflect(object obj, string method_name)
    
    Author: Max Benjamin Eschenbach
    License: MIT License
    Version: 250415
    */
    #endregion

    private void RunScript(
		double ProgressPercentage,
		List<Point3d> Points,
		List<double> E,
		Color ExtrusionColor,
		Color TravelColor,
		Color RetractionColor,
		ref object MoveLines,
		ref object MoveLinesProg,
		ref object Colors,
		ref object ColorsProg,
		ref object PrintLines,
		ref object PrintPolyLines)
    {
        // set component params
        this.Component.Name = "ClassifyGCODEMovements";
        this.Component.NickName = "ClassifyGCODEMovements";
        this.Component.Category = "DDUClayPrintingSlicer";
        this.Component.SubCategory = "7 GCODE";

        List<LineCurve> _MoveLines = new List<LineCurve>();
        List<LineCurve> _MoveLinesProg = new List<LineCurve>();
        List<LineCurve> _PrintLines = new List<LineCurve>();
        List<System.Drawing.Color> _Colors = new List<System.Drawing.Color>();
        List<System.Drawing.Color> _ColorsProg = new List<System.Drawing.Color>();
        List<Polyline> _PrintPolyLines = new List<Polyline>();

        if (Points == null || E == null)
        {
            if (Points == null){
                this.Component.AddRuntimeMessage(
                    GH_RuntimeMessageLevel.Warning,
                    "Input Parameter Points failed to collect Data!"
                );
            }
            if (E == null)
            {
                this.Component.AddRuntimeMessage(
                    GH_RuntimeMessageLevel.Warning,
                    "Input Parameter E failed to collect Data!"
                );
            }
            MoveLines = _MoveLines;
            MoveLinesProg = _MoveLinesProg;
            Colors = _Colors;
            ColorsProg = _ColorsProg;
            PrintLines = _PrintLines;
            PrintPolyLines = _PrintPolyLines;
            return;
        }
        if (ExtrusionColor == null) ExtrusionColor = System.Drawing.Color.OrangeRed;
        if (TravelColor == null) TravelColor = System.Drawing.Color.SkyBlue;
        if (RetractionColor == null) RetractionColor = System.Drawing.Color.Green;

        Polyline pl_temp = new Polyline();

        int SplitIndex = (int) Math.Round((ProgressPercentage / 100.0) * Points.Count, 0);

        for (int i = 0; i < Points.Count - 1; i++)
        {
        // construct line curve
        LineCurve ln = new LineCurve(Points[i], Points[i + 1]);
        _MoveLines.Add(ln);

        if (i < SplitIndex) { _MoveLinesProg.Add(ln); }

        // set flags
        bool travel = E[i + 1] == 0 || E[i] == E[i + 1];
        bool retract = E[i + 1] < E[i];
        bool approach = E[i] == 0 && E[i + 1] > 0;

        // evaluate flags
        if (travel || approach)
        {
            _Colors.Add(TravelColor);
            if (i < SplitIndex) { _ColorsProg.Add(TravelColor); }

            // finish print polyline if it has at least two vertices
            if (pl_temp.Count > 1 && i <= SplitIndex)
            {
            _PrintPolyLines.Add(pl_temp.Duplicate());
            pl_temp = new Polyline();
            }
        }
        else if (retract)
        {
            _Colors.Add(RetractionColor);
            if (i < SplitIndex) { _ColorsProg.Add(RetractionColor); }

            // finish print polyline if it has at least two vertices
            if (pl_temp.Count > 1 && i <= SplitIndex)
            {
            _PrintPolyLines.Add(pl_temp.Duplicate());
            pl_temp = new Polyline();
            }
        }
        else
        {
            _Colors.Add(ExtrusionColor);
            if (i < SplitIndex) { _ColorsProg.Add(ExtrusionColor); }

            _PrintLines.Add(ln);

            // add points to print polyline
            if (i < SplitIndex)
            {
            if (pl_temp.Count == 0)
            {
                // add A point if this is the start of the PPL
                pl_temp.Add(Points[i]);
            }
            // always add B point
            pl_temp.Add(Points[i + 1]);
            }
        }

        // catch unfinished PPL and finalize it
        if (pl_temp.Count > 0 && i == Points.Count - 2)
        {
            _PrintPolyLines.Add(pl_temp.Duplicate());
            pl_temp = new Polyline();
        }

        MoveLines = _MoveLines;
        MoveLinesProg = _MoveLinesProg;
        Colors = _Colors;
        ColorsProg = _ColorsProg;
        PrintLines = _PrintLines;
        PrintPolyLines = _PrintPolyLines;
        }
    }

}
# ---------- end classifygcodemovements ----------
movelines_prog = Data(classifygcodemovements.MoveLinesProg)
printpolylines = Data(classifygcodemovements.PrintPolyLines)
colors_prog = Data(classifygcodemovements.ColorsProg)
movelines = Data(classifygcodemovements.MoveLines)
printlines = Data(classifygcodemovements.PrintLines)
colors = Data(classifygcodemovements.Colors)

# ----
# comments & notes: PRINTING SIM & MESH VISUALIZATION OF GCODE PATHS
# PRINTING SIM & MESH
# VISUALIZATION OF GCODE PATHS
gcode_vis_offset_vector_3 = Data(gcode_vis_offset_vector)
enable_print_simulation_2 = Data(enable_print_simulation)
printpolylines_progvis = Data(printpolylines)
hd_printing_visualisation_2 = Data(hd_printing_visualisation)
filter_132 = StreamFilter(Gate=enable_print_simulation_2, Stream1=printpolylines_progvis)
move_44 = Move(Geometry=filter_132, Motion=gcode_vis_offset_vector_3)  # -> Geometry, Transform
redpline_8 = Reduce(Polyline=move_44.Geometry, Tolerance=Slider(0.1, range=0..1))  # -> Polyline, Reduction
gate_27 = StreamGate(Stream=redpline_8.Polyline, Gate=hd_printing_visualisation_2)  # -> Target0, Target1
divlength_3 = DivideLength(Curve=reparameterize(flatten(gate_27.Target1)), Length=Slider(200, range=0..1000))  # -> Points, Tangents, Parameters
numsegments_2 = Slider(10, range=0..10)
shatter_2 = Shatter(Curve=reparameterize(graft(gate_27.Target1)), Parameters=divlength_3.Parameters)  # -> flatten(Segments)
subsegments_2 = Slider(10, range=0..100)
accuracy_2 = Slider(1, range=0..1)
line_width_5 = Data(line_width)
capstyle_2 = Slider(3, range=0..3)
multiplication_20 = Multiplication(A=line_width_5, B="0.5")
hd_printing_visualisation_3 = Data(hd_printing_visualisation_2)
chromomeshpipe_2 = ChromoMeshPipe(P=gate_27.Target0, N=numsegments_2, R=multiplication_20, C=Toggle(True))  # -> M; inputs P: list of Curve, N: Int32, R: Double, C: Boolean; same code as chromomeshpipe
meshpipe_2 = MeshPipe(Curves=shatter_2, Radius=multiplication_20, SubSegments=subsegments_2, Accuracy=accuracy_2, CapStyle=capstyle_2)  # -> MeshPipes; inputs Curves: list of Curve, Radius: Double, SubSegments: Int32, Accuracy: Int32, CapStyle: Int32; same code as meshpipe
filter_133 = StreamFilter(Gate=hd_printing_visualisation_3, Stream0=chromomeshpipe_2, Stream1=meshpipe_2)
preview_4 = CustomPreview(Geometry=filter_133, Material=ColourSwatch(SwatchColor=RGB(230, 230, 230)))

# ----
# GCODE MOVES VISUALIZATION
gcode_vis_offset_vector_4 = Data(gcode_vis_offset_vector)
enable_print_simulation_3 = Data(enable_print_simulation)
movelines_progvis = Data(movelines_prog)
colors_progvis = Data(colors_prog)
comments_notes_43 = Panel("GCODE MOVES VISUALISATION")
filter_134 = StreamFilter(Gate=enable_print_simulation_3, Stream0=movelines_progvis)
filter_135 = StreamFilter(Gate=enable_print_simulation_3, Stream0=colors_progvis)
move_45 = Move(Geometry=filter_134, Motion=gcode_vis_offset_vector_4)  # -> Geometry, Transform
curvepreviewlw_18 = CurvePreviewLW(Curves=move_45.Geometry, Colors=filter_135, Thickness=Slider(3, range=0..10))  # inputs Curves: list of Curve, Colors: list of Color, Thickness: list of Int32; same code as curvepreviewlw

# ----
# MATERIAL AMOUNT CALCULATION
# TESTED WEIGHT PARAMETERS: Intersecting Wall 937g
# Mirko Schlaufen 383g
# Vase 541g
line_width_6 = Data(line_width)
layer_height_9 = Number(layer_height)
printing_curves_10 = Geometry(printing_curves_3)
filletfactor = Slider(0.45, range=0..1)
dom_7 = ConstructDomain(DomainStart=expr("x*-0.5", line_width_6), DomainEnd=expr("x*0.5", line_width_6))
dom_8 = ConstructDomain(DomainStart=expr("x*-0.5", layer_height_9), DomainEnd=expr("x*0.5", layer_height_9))
min_3 = Minimum(A=line_width_6, B=layer_height_9)
len_6 = Length(Curve=printing_curves_10)  # -> flatten(Length)
multiplication_21 = Multiplication(A=min_3, B=filletfactor)
ma_23 = MassAddition(Input=len_6)  # -> Result, PartialResults
rectangle = Rectangle(Plane=PlaneXY(0, 0, 0), XSize=dom_7, YSize=dom_8, Radius=multiplication_21)  # -> Rectangle, Length
area_2 = Area(Geometry=rectangle.Rectangle)  # -> Area, Centroid
printing_curves_length_mm = Data(ma_23.Result)
print_profile_area_mm2 = Data(area_2.Area)
comments_notes_44 = Panel("MATERIAL AMOUNT CALCULATION")
multiplication_22 = Multiplication(A=printing_curves_length_mm, B=print_profile_area_mm2)
multiplication_23 = Multiplication(A=multiplication_22, B="0.001")
specific_weight_clay_in_g_cm3 = Panel("2.48")
addpercentage = Slider(0, range=0..100)
print_volume_mm3 = Data(multiplication_22)
print_volume_cm3 = Data(multiplication_23)
multiplication_24 = Multiplication(A=print_volume_cm3, B=specific_weight_clay_in_g_cm3)
num = Number(expr("x*0.01", addpercentage))
multiplication_25 = Multiplication(A=multiplication_24, B=num)
addition_12 = Addition(A=multiplication_24, B=multiplication_25)
rtd_7 = RoundToDecimal(Numbers=addition_12, DecimalPlaces="2")  # -> Rounded; inputs Numbers: list of Double, DecimalPlaces: list of Int32; same code as rtd
print_weight_in_g = Panel(rtd_7)
format_7 = Format(Format="[INFO] Approximate Material Weight is {0} g.", Culture=127, Data0=rtd_7)
info_approximate_print_weight = Data(format_7)
approximate_print_weight = Data(rtd_7)

# ----
# comments & notes: CONSTRUCT WASP40100
# FOR PRINT SIM / VIS
# CONSTRUCT WASP40100
# FOR PRINT SIMULATION / VIS
movelines_prog_2 = Data(movelines_prog)
item_26 = ListItem(List=movelines_prog_2, Index=0, Wrap=True)  # -> Item1, Item
end_6 = EndPoints(Curve=item_26.Item1)  # -> Start, End
enable_print_simulation_4 = Data(enable_print_simulation)
layer_height_10 = Number(layer_height)
wasp_40100_printing_diameter_2 = Data(wasp_40100_printing_diameter)
wasp40100_arm_length_2 = Data(wasp40100_arm_length)
gcode_last_pt = Point(end_6.End)
gcode_vis_offset_vector_5 = Data(gcode_vis_offset_vector)
constructwasp40100printer = ConstructWASP40100Printer(
    enable_print_simulation=enable_print_simulation_4,
    layer_height=layer_height_10,
    wasp_40100_printing_diameter=wasp_40100_printing_diameter_2,
    wasp40100_arm_length=wasp40100_arm_length_2,
    gcode_last_pt=gcode_last_pt,
    gcode_vis_offset_vector=gcode_vis_offset_vector_5)  # -> wasp40100_printing_area_srf_3, wasp40100_nozzle_bot_3, wasp40100_nozzle_transition_3, wasp40100_nozzle_toppart_3, wasp40100_extrudermount_srf_3, wasp40100_z_axis_crvs_4, wasp40100_arm_crv_3
wasp40100_extrudermount_srf = Data(constructwasp40100printer.wasp40100_extrudermount_srf_3)
wasp40100_nozzle_transition = Data(constructwasp40100printer.wasp40100_nozzle_transition_3)
wasp40100_printing_area_srf = Data(constructwasp40100printer.wasp40100_printing_area_srf_3)
wasp40100_nozzle_toppart = Data(constructwasp40100printer.wasp40100_nozzle_toppart_3)
wasp40100_nozzle_bot = Data(constructwasp40100printer.wasp40100_nozzle_bot_3)
wasp40100_z_axis_crvs = Data(constructwasp40100printer.wasp40100_z_axis_crvs_4)
wasp40100_arm_crv = Data(constructwasp40100printer.wasp40100_arm_crv_3)

# ----
# WASP40100 ARM VIS
wasp40100_z_axis_crvs_2 = Data(wasp40100_z_axis_crvs)  # disabled
wasp40100_arm_crv_2 = Data(wasp40100_arm_crv)
subsegments_3 = Slider(10, range=0..100)
accuracy_3 = Slider(1, range=0..1)
create_gcode_3 = Data(create_gcode)
wasp40100_arm_crv_3 = Data(wasp40100_arm_crv)
show_printer_2 = Data(show_printer)
capstyle_3 = Slider(3, range=0..3)
comments_notes_45 = Panel("WASP40100 ARM VIS")
merge_39 = Merge(Data1=wasp40100_z_axis_crvs_2, Data2=wasp40100_arm_crv_2)  # -> flatten(Result)
and_18 = GateAnd(A=create_gcode_3, B=show_printer_2)
filter_136 = StreamFilter(Gate=show_printer_2, Stream1=wasp40100_arm_crv_3)
filter_137 = StreamFilter(Gate=and_18, Stream1=merge_39)
meshpipe_3 = MeshPipe(Curves=filter_136, Radius=Slider(4, range=0..10), SubSegments=subsegments_3, Accuracy=accuracy_3, CapStyle=capstyle_3)  # -> MeshPipes; inputs Curves: list of Curve, Radius: Double, SubSegments: Int32, Accuracy: Int32, CapStyle: Int32; same code as meshpipe
curvepreviewlw_19 = CurvePreviewLW(Curves=filter_137, Colors=ColourSwatch(SwatchColor=RGB(191, 191, 191)), Thickness=Slider(2, range=0..10))  # inputs Curves: list of Curve, Colors: list of Color, Thickness: list of Int32; same code as curvepreviewlw
preview_5 = CustomPreview(Geometry=meshpipe_3, Material=ColourSwatch(SwatchColor=RGB(191, 191, 191)))

# ----
# WASP40100 PRINT AREA
comments_notes_46 = Panel("WASP40100 PRINT AREA")
wasp40100_printing_area_srf_2 = Data(wasp40100_printing_area_srf)
show_printer_3 = Data(show_printer)
filter_138 = StreamFilter(Gate=show_printer_3, Stream1=wasp40100_printing_area_srf_2)
preview_6 = CustomPreview(Geometry=filter_138, Material=ColourSwatch(SwatchColor=RGB(227, 227, 227)))

# ----
# WASP40100 PRINTHEAD VIS
show_printer_4 = Data(show_printer)
extrudermount_srf = Data(wasp40100_extrudermount_srf)
nozzle_bot = Data(wasp40100_nozzle_bot)
nozzle_transition = Data(wasp40100_nozzle_transition)
nozzle_toppart = Data(wasp40100_nozzle_toppart)
comments_notes_47 = Panel("WASP40100 PRINTHEAD VIS")
merge_40 = Merge(Data1=nozzle_bot, Data2=nozzle_transition, Data3=nozzle_toppart, Data4=extrudermount_srf)  # -> flatten(Result)
filter_139 = StreamFilter(Gate=show_printer_4, Stream1=merge_40)
preview_7 = CustomPreview(Geometry=filter_139, Material=ColourSwatch(SwatchColor=RGB(184, 184, 184)))

# ----
# GCODE VERIFICATION
# AND ANALYSIS
# comments & notes: GCODE VERIFICATION AND ANALYSIS
panel_25 = Panel(""";FLAVOR:Marlin
;TIME:949
;Filament used: 37.628m
;Layer height: 1.9
;MINX:-63.357
;MINY:-66.77
;MINZ:1.9
;MAXX:57.392
;MAXY:53.98
;MAXZ:53.2
;Generated with Cura_SteamEngine 5.0.0
M105
M109 S0
M82 ;absolute extrusion mode
G90 ; absolute programming
M106 S0 ; set fan speed to 0 (deactivate)
M104 S0 T0 ; set hotend temperature to 0 (deactivate)
G28 ; home all axes
T0 ; set extruder to extruder 0 (first and only one)
G92 E0
G92 E0
G1 F4800 E-0.01
;LAYER_COUNT:29
;LAYER:0
M107
G0 F3000 X45.961 Y53.98 Z1.9
;TYPE:SKIRT
G1 F4800 E0
G1 F3000 X-53.191 Y52.722 E103.65331
G1 X-53.895 Y52.701 E104.38954
G1 X-54.775 Y52.634 E105.31208
G1 X-55.646 Y52.489 E106.23508
G1 X-56.5 Y52.265 E107.15797
G1 X-57.33 Y51.965 E108.08052
G1 X-58.13 Y51.591 E109.00364
G1 X-58.893 Y51.146 E109.92695
G1 X-59.612 Y50.634 E110.84962
G1 X-60.282 Y50.059 E111.77253
G1 X-60.898 Y49.425 E112.69656
G1 X-61.453 Y48.739 E113.61894
G1 X-61.944 Y48.005 E114.54204
G1 X-62.367 Y47.23 E115.46498
G1 X-62.718 Y46.42 E116.38776
G1 X-62.994 Y45.581 E117.31101
G1 X-63.193 Y44.721 E118.23374
G1 X-63.313 Y43.846 E119.15695
G1 X-63.354 Y43.051 E119.98908
G1 X-63.357 Y42.426 E120.6424
G1 X-62.101 Y-56.542 E224.10337
G1 X-62.086 Y-57.229 E224.82167
G1 X-62.026 Y-58.11 E225.74472
G1 X-61.888 Y-58.982 E226.66758
G1 X-61.671 Y-59.838 E227.59067
G1 X-61.377 Y-60.67 E228.51308
G1 X-61.01 Y-61.473 E229.43597
G1 X-60.571 Y-62.239 E230.35886
G1 X-60.065 Y-62.963 E231.28218
G1 X-59.495 Y-63.637 E232.20489
G1 X-58.867 Y-64.258 E233.1281
G1 X-58.185 Y-64.819 E234.05121
G1 X-57.455 Y-65.315 E234.97376
G1 X-56.683 Y-65.744 E235.89697
G1 X-55.876 Y-66.102 E236.81982
G1 X-55.039 Y-66.384 E237.74307
G1 X-54.18 Y-66.59 E238.66646
G1 X-53.307 Y-66.718 E239.58877
G1 X-52.433 Y-66.766 E240.50375
G1 X-52.022 Y-66.77 E240.9334
G1 X47.184 Y-65.512 E344.64315
G1 X47.888 Y-65.494 E345.37929
G1 X48.769 Y-65.431 E346.30257
G1 X49.64 Y-65.289 E347.22505
G1 X50.495 Y-65.069 E348.14791
G1 X51.327 Y-64.773 E349.07101
G1 X52.128 Y-64.402 E349.99376
G1 X52.893 Y-63.96 E350.9173
G1 X53.615 Y-63.451 E351.84072
G1 X54.287 Y-62.879 E352.76318
G1 X54.905 Y-62.248 E353.68643
G1 X55.463 Y-61.564 E354.60916
G1 X55.958 Y-60.833 E355.532
G1 X56.383 Y-60.059 E356.45502
G1 X56.738 Y-59.251 E357.37756
G1 X57.017 Y-58.413 E358.3008
G1 X57.22 Y-57.554 E359.22346
G1 X57.344 Y-56.68 E360.14621
G1 X57.388 Y-55.856 E361.00878
G1 X57.392 Y-55.266 E361.62553
G1 X56.136 Y43.71 E465.09485
G1 X56.121 Y44.43 E465.84764
G1 X56.063 Y45.311 E466.77056
G1 X55.925 Y46.183 E467.69341
G1 X55.709 Y47.039 E468.61625
G1 X55.416 Y47.872 E469.53929
G1 X55.049 Y48.675 E470.46219
G1 X54.611 Y49.442 E471.38547
G1 X54.105 Y50.166 E472.30879
G1 X53.536 Y50.841 E473.23162
G1 X52.909 Y51.462 E474.15409
G1 X52.227 Y52.024 E475.07786
G1 X51.498 Y52.521 E476.00014
G1 X50.727 Y52.951 E476.92294
G1 X49.92 Y53.309 E477.84579
G1 X49.083 Y53.593 E478.76971
G1 X48.225 Y53.799 E479.69208
G1 X47.351 Y53.928 E480.61558
G1 X46.508 Y53.976 E481.49821
G1 X45.961 Y53.98 E482.07001
G1 F4800 E482.06001
;MESH:PRINTSUGI_CONN_01.stl
G0 F3000 X44.651 Y42.463
;TYPE:WALL-OUTER
G1 F4800 E482.07001
G1 F3000 X45.875 Y-54.028 E582.94151
G1 X-50.616 Y-55.252 E683.81302
G1 X-51.84 Y41.239 E784.68452
G1 X44.651 Y42.463 E885.55602
G0 X44.676 Y40.464
G0 X41.368 Y39.095
;TYPE:SKIN
G1 X41.938 Y-5.826 E932.51635
G1 X42.507 Y-50.745 E979.47457
G1 X-47.333 Y-51.884 E1073.39313
G1 X-48.472 Y37.956 E1167.31168
G1 X41.368 Y39.095 E1261.23023
G1 F4800 E1261.22023
G0 F3000 X40.727 Y-48.368
G1 F4800 E1261.23023
G1 F3000 X40.071 Y-49.024 E1262.19999
G0 X35.057 Y-49.088
G1 X40.665 Y-43.48 E1270.49028
G0 X40.602 Y-38.593
G1 X30.044 Y-49.151 E1286.09814
G0 X25.03 Y-49.215
G1 X40.541 Y-33.704 E1309.02801
G0 X40.479 Y-28.817
G1 X20.017 Y-49.278 E1339.27619
G0 X15.004 Y-49.342
G1 X40.416 Y-23.929 E1376.84342
G0 X40.355 Y-19.041
G1 X9.99 Y-49.406 E1421.73191
G0 X4.977 Y-49.469
G1 X40.293 Y-14.154 E1473.93871
G0 X40.23 Y-9.266
G1 X-0.035 Y-49.532 E1533.46309
G0 X-5.048 Y-49.596
G1 X40.169 Y-4.378 E1600.30799
G0 X40.107 Y0.509
G1 X-10.062 Y-49.66 E1674.47268
G0 X-15.075 Y-49.723
G1 X40.044 Y5.396 E1755.95494
G0 X39.983 Y10.284
G1 X-20.088 Y-49.787 E1844.75773
G0 X-25.102 Y-49.851
G1 X39.921 Y15.172 E1940.88105
G0 X39.858 Y20.059
G1 X-30.115 Y-49.914 E2044.32193
G0 X-35.129 Y-49.978
G1 X39.797 Y24.948 E2155.08483
G0 X39.735 Y29.835
G1 X-40.142 Y-50.041 E2273.16603
G0 X-45.155 Y-50.104
G1 X39.672 Y34.723 E2398.56554
G0 X37.292 Y37.292
G1 X-45.662 Y-45.662 E2521.1962
G0 X-45.724 Y-40.774
G1 X32.279 Y37.229 E2636.50782
G0 X27.266 Y37.166
G1 X-45.785 Y-35.886 E2744.49964
G0 X-45.848 Y-30.998
G1 X22.253 Y37.102 E2845.17242
G0 X17.239 Y37.038
G1 X-45.909 Y-26.11 E2938.52393
G0 X-45.971 Y-21.223
G1 X12.226 Y36.975 E3024.55713
G0 X7.213 Y36.911
G1 X-46.033 Y-16.334 E3103.2698
G0 X-46.095 Y-11.447
G1 X2.199 Y36.848 E3174.66342
G0 X-2.813 Y36.784
G1 X-46.157 Y-6.559 E3238.73799
G0 X-46.219 Y-1.671
G1 X-7.826 Y36.72 E3295.49278
G0 X-12.84 Y36.657
G1 X-46.28 Y3.216 E3344.92778
G0 X-46.343 Y8.104
G1 X-17.853 Y36.593 E3387.04372
G0 X-22.867 Y36.529
G1 X-46.404 Y12.992 E3421.8384
G0 X-46.466 Y17.879
G1 X-27.88 Y36.466 E3449.31477
G0 X-32.893 Y36.402
G1 X-46.528 Y22.768 E3469.47062
G0 X-46.59 Y27.655
G1 X-37.907 Y36.338 E3482.30667
G0 X-42.92 Y36.275
G1 X-46.652 Y32.543 E3487.82367
G1 F4800 E3487.81367
;MESH:NONMESH
G0 F600 X-46.652 Y32.543 Z3.8
G0 F3000 X45.263 Y-5.783
;TIME_ELAPSED:78.082594
;LAYER:1
;TYPE:WALL-OUTER
;MESH:PRINTSUGI_CONN_01.stl
G1 F4800 E3487.82367
G1 F3000 X45.875 Y-54.028 E3538.2589
G1 X-50.616 Y-55.252 E3639.13041
G1 X-51.84 Y41.239 E3740.00191
G1 X44.651 Y42.463 E3840.87341
G1 X45.263 Y-5.783 E3891.30969
G0 X45.288 Y-7.782
G1 F4800 E3891.29969
G0 F3000 X42.507 Y-50.745
;TYPE:SKIN
G1 F4800 E3891.30969
G1 F3300 X-2.414 Y-51.315 E3938.27001
G92 E0
G1 X-47.333 Y-51.884 E46.95822
G1 X-48.472 Y37.956 E140.87678
G1 X41.368 Y39.095 E234.79533
G1 X42.507 Y-50.745 E328.71388
G1 F4800 E328.70388
G0 F3000 X-43.954 Y-50.09
G1 F4800 E328.71388
G1 F3300 X-45.626 Y-48.418 E331.18559
G0 F3000 X-45.69 Y-43.405
G1 F3300 X-39.066 Y-50.028 E340.97709
G0 F3000 X-34.178 Y-49.966
G1 F3300 X-45.753 Y-38.392 E358.08765
G0 F3000 X-45.816 Y-33.378
G1 F3300 X-29.291 Y-49.904 E382.51724
G0 F3000 X-24.403 Y-49.842
G1 F3300 X-45.88 Y-28.365 E414.26663
G0 F3000 X-45.944 Y-23.352
G1 F3300 X-19.515 Y-49.781 E453.33655
G0 F3000 X-14.627 Y-49.718
G1 F3300 X-46.007 Y-18.339 E499.72477
G0 F3000 X-46.07 Y-13.326
G1 F3300 X-9.74 Y-49.656 E553.43131
G0 F3000 X-4.852 Y-49.595
G1 F3300 X-46.134 Y-8.312 E614.45911
G0 F3000 X-46.198 Y-3.299
G1 F3300 X0.035 Y-49.532 E682.80523
G0 F3000 X4.923 Y-49.471
G1 F3300 X-46.261 Y1.713 E758.47039
G0 F3000 X-46.324 Y6.726
G1 F3300 X9.811 Y-49.409 E841.4546
G0 F3000 X14.698 Y-49.346
G1 F3300 X-46.388 Y11.74 E931.75786
G0 F3000 X-46.451 Y16.753
G1 F3300 X19.586 Y-49.285 E1029.38091
G0 F3000 X24.474 Y-49.223
G1 F3300 X-46.515 Y21.766 E1134.32374
G0 F3000 X-46.578 Y26.779
G1 F3300 X29.361 Y-49.16 E1246.58415
G0 F3000 X34.25 Y-49.099
G1 F3300 X-46.642 Y31.792 E1366.16583
G0 F3000 X-46.135 Y36.235
G1 F3300 X39.137 Y-49.037 E1492.22318
G0 F3000 X40.691 Y-45.641
G1 F3300 X-41.246 Y36.297 E1613.35116
G0 F3000 X-36.359 Y36.359
G1 F3300 X40.628 Y-40.628 E1727.16082
G0 F3000 X40.564 Y-35.614
G1 F3300 X-31.471 Y36.421 E1833.64996
G0 F3000 X-26.583 Y36.483
G1 F3300 X40.5 Y-30.601 E1932.8193
G0 F3000 X40.437 Y-25.588
G1 F3300 X-21.696 Y36.545 E2024.67034
G0 F3000 X-16.808 Y36.607
G1 F3300 X40.373 Y-20.574 E2109.20085
G0 F3000 X40.31 Y-15.561
G1 F3300 X-11.92 Y36.669 E2186.41231
G0 F3000 X-7.032 Y36.731
G1 F3300 X40.246 Y-10.547 E2256.30325
G0 F3000 X40.182 Y-5.534
G1 F3300 X-2.145 Y36.793 E2318.87513
G0 F3000 X2.742 Y36.855
G1 F3300 X40.119 Y-.521 E2374.1287
G0 F3000 X40.056 Y4.491
G1 F3300 X7.63 Y36.917 E2422.06397
G0 F3000 X12.517 Y36.979
G1 F3300 X39.992 Y9.504 E2462.68018
G0 F3000 X39.928 Y14.518
G1 F3300 X17.405 Y37.041 E2495.97587
G0 F3000 X22.293 Y37.103
G1 F3300 X39.865 Y19.531 E2521.95251
G0 F3000 X39.801 Y24.545
G1 F3300 X27.181 Y37.165 E2540.60862
G0 F3000 X32.068 Y37.227
G1 F3300 X39.737 Y29.558 E2551.94568
G0 F3000 X39.674 Y34.571
G1 F3300 X36.956 Y37.289 E2555.96369
G1 F4800 E2555.95369
;MESH:NONMESH
G0 F600 X36.956 Y37.289 Z5.7
G0 F3000 X-5.51 Y40.601
;TIME_ELAPSED:139.048552
;LAYER:2
;TYPE:FILL
;MESH:PRINTSUGI_CONN_01.stl
G1 F4800 E2555.96369
G1 F3000 X-50.041 Y-3.93 E2621.79374
G0 X-50.096 Y0.43
G1 X-35.555 Y-53.835 E2680.51891
G0 X-28.983 Y-53.752
G1 X-49.477 Y-48.26 E2702.69745
G0 X-49.421 Y-52.807
G1 X43.455 Y40.069 E2839.99578
G0 X43.512 Y35.526
G1 X23.213 Y40.965 E2861.9631
G0 X19.556 Y40.919
G1 X-49.732 Y-28.369 E2964.39136
G1 X-49.709 Y-30.081
G1 X35.572 Y-52.932 E3056.68149
G1 X36.667 Y-52.918
G1 X11.55 Y40.818 E3158.12166
G1 F4800 E3158.11166
G0 F3000 X-6.504 Y40.589
G1 F4800 E3158.12166
G1 F3000 X18.612 Y-53.148 E3259.56258
G0 X24.559 Y-53.071
G1 X44.386 Y-33.245 E3288.87203
G0 X44.435 Y-37.19
G1 X-49.94 Y-11.902 E3391.00367
G1 F4800 E3390.99367
G0 F3000 X-50.17 Y6.277
G1 F4800 E3391.00367
G1 F3000 X44.204 Y-19.01 E3493.13402
G0 X44.13 Y-13.156
G1 X29.606 Y41.047 E3551.79198
G1 F4800 E3551.78198
G0 F3000 X43.743 Y17.347
G1 F4800 E3551.79198
G1 F3000 X-41.341 Y40.145 E3643.86887
G1 X-42.616 Y40.13
G1 X-17.499 Y-53.606 E3745.30904
G1 F4800 E3745.29904
G0 F3000 X-25.573 Y-53.708
G1 F4800 E3745.30904
G1 F3000 X43.765 Y15.631 E3847.81195
G1 F4800 E3847.80195
G0 F3000 X43.974 Y-.831
G1 F4800 E3847.81195
G1 F3000 X-50.401 Y24.456 E3949.94331
G0 X-50.351 Y20.508
G92 E0
G1 X-30.577 Y40.283 E29.23259
G0 X-24.56 Y40.36
G1 X0.556 Y-53.377 E130.6735
G1 X-.506 Y-53.39
G1 X44.076 Y-8.807 E196.57968
G0 X45.263 Y-5.783
;TYPE:WALL-OUTER
G1 X45.875 Y-54.028 E247.01491
G1 X-50.616 Y-55.252 E347.88641
G1 X-51.84 Y41.239 E448.75792
G1 X44.651 Y42.463 E549.62942
G1 X45.263 Y-5.783 E600.06569
G0 X45.288 Y-7.782
G1 F4800 E600.05569
;MESH:NONMESH
G0 F600 X45.288 Y-7.782 Z7.6
G0 F3000 X-5.51 Y40.601
;TIME_ELAPSED:182.317632
;LAYER:3
;TYPE:FILL
;MESH:PRINTSUGI_CONN_01.stl
G1 F4800 E600.06569
G1 F3000 X-50.041 Y-3.93 E665.89574
G0 X-50.096 Y0.43
G1 X-35.555 Y-53.835 E724.62091
G0 X-28.983 Y-53.752
G1 X-49.477 Y-48.26 E746.79946
G0 X-49.421 Y-52.807
G1 X43.455 Y40.069 E884.09779
G0 X43.512 Y35.526
G1 X23.213 Y40.965 E906.06511
G0 X19.556 Y40.919
G1 X-49.732 Y-28.369 E1008.49336
G1 X-49.709 Y-30.081
G1 X35.572 Y-52.932 E1100.7835
G1 X36.667 Y-52.918
G1 X11.55 Y40.818 E1202.22367
G1 F4800 E1202.21367
G0 F3000 X-6.504 Y40.589
G1 F4800 E1202.22367
G1 F3000 X18.612 Y-53.148 E1303.66458
G0 X24.559 Y-53.071
G1 X44.386 Y-33.245 E1332.97404
G0 X44.435 Y-37.19
G1 X-49.94 Y-11.902 E1435.10567
G1 F4800 E1435.09567
G0 F3000 X-50.17 Y6.277
G1 F4800 E1435.10567
G1 F3000 X44.204 Y-19.01 E1537.23602
G0 X44.13 Y-13.156
G1 X29.606 Y41.047 E1595.89399
G1 F4800 E1595.88399
G0 F3000 X43.743 Y17.347
G1 F4800 E1595.89399
G1 F3000 X-41.341 Y40.145 E1687.97087
G1 X-42.616 Y40.13
G1 X-17.499 Y-53.606 E1789.41105
G1 F4800 E1789.40105
G0 F3000 X-25.573 Y-53.708
G1 F4800 E1789.41105
G1 F3000 X43.765 Y15.631 E1891.91395
G1 F4800 E1891.90395
G0 F3000 X43.974 Y-.831
G1 F4800 E1891.91395
G1 F3000 X-50.401 Y24.456 E1994.04531
G0 X-50.351 Y20.508
G1 X-30.577 Y40.283 E2023.2779
G0 X-24.56 Y40.36
G1 X0.556 Y-53.377 E2124.71881
G1 X-.506 Y-53.39
G1 X44.076 Y-8.807 E2190.625
G0 X45.263 Y-5.783
;TYPE:WALL-OUTER
G1 X45.875 Y-54.028 E2241.06023
G1 X-50.616 Y-55.252 E2341.93173
G1 X-51.84 Y41.239 E2442.80323
G1 X44.651 Y42.463 E2543.67473
G1 X45.263 Y-5.783 E2594.11101
G0 X45.288 Y-7.782
G1 F4800 E2594.10101
;MESH:NONMESH
G0 F600 X45.288 Y-7.782 Z9.5
G0 F3000 X-5.51 Y40.601
;TIME_ELAPSED:225.589684
;LAYER:4
;TYPE:FILL
;MESH:PRINTSUGI_CONN_01.stl
G1 F4800 E2594.11101
G1 F3000 X-50.04 Y-3.928 E2659.93884
G0 X-50.095 Y0.427
G1 X-35.555 Y-53.835 E2718.66071
G0 X-28.983 Y-53.752
G1 X-49.477 Y-48.26 E2740.83926
G0 X-49.421 Y-52.807
G1 X43.455 Y40.069 E2878.13758
G0 X43.512 Y35.526
G1 X23.213 Y40.965 E2900.1049
G0 X19.556 Y40.919
G1 X-49.73 Y-28.367 E3002.5302
G1 X-49.708 Y-30.081
G1 X35.572 Y-52.932 E3094.81933
G1 X36.667 Y-52.918
G1 X11.55 Y40.818 E3196.2595
G1 F4800 E3196.2495
G0 F3000 X-6.504 Y40.589
G1 F4800 E3196.2595
G1 F3000 X18.612 Y-53.148 E3297.70041
G0 X24.559 Y-53.071
G1 X44.386 Y-33.245 E3327.00987
G0 X44.435 Y-37.19
G1 X-49.939 Y-11.902 E3429.14049
G1 F4800 E3429.13049
G0 F3000 X-50.169 Y6.276
G1 F4800 E3429.14049
G1 F3000 X44.204 Y-19.01 E3531.26956
G0 X44.13 Y-13.156
G1 X29.606 Y41.047 E3589.92753
G1 F4800 E3589.91753
G0 F3000 X43.743 Y17.347
G1 F4800 E3589.92753
G1 F3000 X-41.341 Y40.145 E3682.00441
G1 X-42.616 Y40.13
G1 X-17.499 Y-53.606 E3783.44459
G1 F4800 E3783.43459
G0 F3000 X-25.573 Y-53.708
G1 F4800 E3783.44459
G1 F3000 X43.765 Y15.631 E3885.9475
G1 F4800 E3885.9375
G0 F3000 X43.974 Y-.831
G1 F4800 E3885.9475
G1 F3000 X-50.401 Y24.456 E3988.07886
G0 X-50.351 Y20.508
G92 E0
G1 X-30.577 Y40.283 E29.23259
G0 X-24.56 Y40.36
G1 X0.556 Y-53.377 E130.6735
G1 X-.506 Y-53.39
G1 X44.076 Y-8.807 E196.57968
G0 X45.263 Y-5.783
;TYPE:WALL-OUTER
G1 X45.875 Y-54.028 E247.01491
G1 X-50.617 Y-55.252 E347.88746
G1 X-51.257 Y-4.737 E400.69573
G1 X-51.263 Y-3.637 E401.84559
G1 X-51.28 Y-2.834 E402.68517
G1 X-51.84 Y41.239 E448.75901
G1 X44.651 Y42.463 E549.63051
G1 X45.263 Y-5.783 E600.06679
G0 X45.288 Y-7.782
G1 F4800 E600.05679
;MESH:NONMESH
G0 F600 X45.288 Y-7.782 Z11.4
G0 F3000 X-5.51 Y40.601
;TIME_ELAPSED:268.858480
;LAYER:5
;TYPE:FILL
;MESH:PRINTSUGI_CONN_01.stl
G1 F4800 E600.06679
G1 F3000 X-50.036 Y-3.924 E665.88871
G0 X-50.094 Y0.423
G1 X-35.555 Y-53.835 E724.60626
G0 X-28.981 Y-53.752
G1 X-49.478 Y-48.26 E746.78784
G0 X-49.422 Y-52.808
G1 X43.455 Y40.069 E884.08765
G0 X43.512 Y35.526
G1 X23.213 Y40.965 E906.05497
G0 X19.556 Y40.919
G1 X-49.731 Y-28.368 E1008.48174
G1 X-49.709 Y-30.081
G1 X35.572 Y-52.932 E1100.77188
G1 X36.667 Y-52.918
G1 X11.55 Y40.818 E1202.21205
G1 F4800 E1202.20205
G0 F3000 X-6.504 Y40.589
G1 F4800 E1202.21205
G1 F3000 X18.612 Y-53.148 E1303.65296
G0 X24.559 Y-53.071
G1 X44.386 Y-33.245 E1332.96242
G0 X44.435 Y-37.19
G1 X-49.939 Y-11.902 E1435.09304
G1 F4800 E1435.08304
G0 F3000 X-50.168 Y6.276
G1 F4800 E1435.09304
G1 F3000 X44.204 Y-19.01 E1537.2211
G0 X44.13 Y-13.156
G1 X29.606 Y41.047 E1595.87907
G1 F4800 E1595.86907
G0 F3000 X43.743 Y17.347
G1 F4800 E1595.87907
G1 F3000 X-41.341 Y40.145 E1687.95596
G1 X-42.616 Y40.13
G1 X-17.499 Y-53.606 E1789.39613
G1 F4800 E1789.38613
G0 F3000 X-25.573 Y-53.708
G1 F4800 E1789.39613
G1 F3000 X43.765 Y15.631 E1891.89904
G1 F4800 E1891.88904
G0 F3000 X43.974 Y-.831
G1 F4800 E1891.89904
G1 F3000 X-50.4 Y24.455 E1994.02912
G0 X-50.35 Y20.509
G1 X-30.577 Y40.283 E2023.26023
G0 X-24.56 Y40.36
G1 X0.556 Y-53.377 E2124.70114
G1 X-.506 Y-53.39
G1 X44.076 Y-8.807 E2190.60732
G0 X45.263 Y-5.783
;TYPE:WALL-OUTER
G1 X45.875 Y-54.028 E2241.04255
G1 X-50.617 Y-55.252 E2341.9151
G1 X-51.263 Y-4.111 E2395.37776
G1 X-51.273 Y-2.845 E2396.70117
G1 X-51.289 Y-2.094 E2397.48638
G1 X-51.84 Y41.239 E2442.78663
G1 X44.651 Y42.463 E2543.65813
G1 X45.263 Y-5.783 E2594.09441
G0 X45.288 Y-7.782
G1 F4800 E2594.08441
;MESH:NONMESH
G0 F600 X45.288 Y-7.782 Z13.3
G0 F3000 X-27.355 Y-5.992
;TIME_ELAPSED:312.180207
;LAYER:6
;TYPE:FILL
;MESH:PRINTSUGI_CONN_01.stl
G1 F4800 E2594.09441
G1 F3000 X19.556 Y40.919 E2663.44281
G0 X23.213 Y40.965
G1 X43.512 Y35.526 E2685.41013
G0 X43.455 Y40.069
G1 X-49.422 Y-52.808 E2822.70993
G0 X-49.479 Y-48.26
G1 X-28.981 Y-53.752 E2844.89252
G0 X-25.573 Y-53.708
G1 X43.765 Y15.631 E2947.39543
G1 X43.743 Y17.347
G1 X-41.341 Y40.145 E3039.47231
G1 X-42.616 Y40.13
G1 X-30.554 Y-4.885 E3088.18711
G1 F4800 E3088.17711
G0 F3000 X-30.483 Y-17.115
G1 F4800 E3088.18711
G1 F3000 X-28.89 Y-17.542 E3089.91108
G0 X-26.827 Y-18.793
G1 X-17.499 Y-53.606 E3127.58528
G1 F4800 E3127.57528
G0 F3000 X-.506 Y-53.39
G1 F4800 E3127.58528
G1 F3000 X44.076 Y-8.807 E3193.49146
G0 X44.13 Y-13.156
G1 X29.606 Y41.047 E3252.14943
G1 F4800 E3252.13943
G0 F3000 X11.55 Y40.818
G1 F4800 E3252.14943
G1 F3000 X36.667 Y-52.918 E3353.5896
G1 X35.572 Y-52.932
G1 X-49.709 Y-30.081 E3445.87973
G1 X-49.732 Y-28.369
G1 X-40.539 Y-19.176 E3459.46972
G1 F4800 E3459.45972
G0 F3000 X-46.403 Y-13.35
G1 F4800 E3459.46972
G1 F3000 X-35.555 Y-53.835 E3503.28215
G1 F4800 E3503.27215
G0 F3000 X0.556 Y-53.377
G1 F4800 E3503.28215
G1 F3000 X-24.56 Y40.36 E3604.72306
G0 X-30.577 Y40.283
G1 X-50.351 Y20.508 E3633.95565
G0 X-50.401 Y24.456
G1 X43.974 Y-.831 E3736.08701
G1 F4800 E3736.07701
G0 F3000 X44.204 Y-19.01
G1 F4800 E3736.08701
G1 F3000 X-50.169 Y6.276 E3838.21608
G1 F4800 E3838.20608
G0 F3000 X-45.271 Y0.84
G1 F4800 E3838.21608
G1 F3000 X-5.51 Y40.601 E3896.99465
G1 X-6.504 Y40.589
G1 X18.612 Y-53.148 E3998.43556
G0 X24.559 Y-53.071
G92 E0
G1 X44.386 Y-33.245 E29.30946
G0 X44.435 Y-37.19
G1 X-23.606 Y-18.958 E102.94278
G1 F4800 E102.93278
G0 F3000 X-51.27 Y-3.594
;TYPE:WALL-OUTER
G1 F4800 E102.94278
G1 F3000 X-51.281 Y-2.088 E104.51707
G1 X-51.301 Y-1.242 E105.40165
G1 X-51.84 Y41.239 E149.81121
G1 X44.651 Y42.463 E250.68271
G1 X45.875 Y-54.028 E351.55421
G1 X-50.617 Y-55.252 E452.42676
G1 X-51.27 Y-3.594 E506.4299
G0 X-51.281 Y-2.088
G0 X-51.292 Y-1.594
G1 F4800 E506.4199
G0 F3000 X-24.911 Y-18.317
;TYPE:SKIN
G1 F4800 E506.4299
G1 F3600 X-25.514 Y-18.185 E507.07515
G1 X-26.013 Y-18.059 E507.61313
G1 X-26.444 Y-17.761 E508.16087
G1 X-26.831 Y-17.495 E508.65175
G1 X-27.441 Y-17.172 E509.37326
G1 X-28.062 Y-16.894 E510.08448
G1 X-28.362 Y-16.484 E510.61554
G1 X-28.669 Y-16.206 E511.04847
G1 X-29.12 Y-15.977 E511.5772
G1 X-29.562 Y-15.858 E512.05568
G1 X-30.039 Y-15.855 E512.5543
G1 X-30.513 Y-15.987 E513.06864
G1 X-31.473 Y-16.406 E514.16356
G1 X-32.015 Y-16.547 E514.74897
G1 X-33.06 Y-16.751 E515.86195
G1 X-33.488 Y-16.899 E516.33533
G1 X-33.868 Y-17.155 E516.81428
G1 X-34.114 Y-17.424 E517.19533
G1 X-34.343 Y-17.843 E517.69446
G1 X-34.42 Y-18.106 E517.98092
G1 X-34.449 Y-18.624 E518.52324
G1 X-34.453 Y-18.892 E518.80341
G1 X-35.373 Y-19.615 E520.02653
G1 X-36.296 Y-20.317 E521.23871
G1 X-36.536 Y-20.423 E521.51296
G1 X-37.244 Y-20.526 E522.26083
G1 X-37.768 Y-20.513 E522.80875
G1 X-38.88 Y-20.372 E523.98044
G1 X-39.125 Y-20.269 E524.25826
G1 X-39.465 Y-19.119 E525.51181
G1 X-39.571 Y-18.655 E526.00933
G1 X-39.527 Y-18.14 E526.54962
G1 X-39.475 Y-17.55 E527.16875
G1 X-39.547 Y-17.029 E527.71853
G1 X-39.714 Y-16.642 E528.15913
G1 X-39.978 Y-16.298 E528.6124
G1 X-40.3 Y-16.041 E529.04306
G1 X-40.732 Y-15.847 E529.53808
G1 X-41.151 Y-15.778 E529.98197
G1 X-41.676 Y-15.835 E530.53398
G1 X-41.937 Y-15.873 E530.80968
G1 X-42.853 Y-15.103 E532.06055
G1 X-43.459 Y-14.7 E532.8213
G1 X-43.769 Y-14.483 E533.21685
G1 X-43.836 Y-13.87 E533.86144
G1 X-44.026 Y-13.39 E534.40107
G1 X-44.353 Y-12.981 E534.94845
G1 X-44.711 Y-12.726 E535.4079
G1 X-45.392 Y-12.438 E536.1808
G1 X-45.703 Y-12.344 E536.52042
G1 X-46.236 Y-12.315 E537.07839
G1 X-46.657 Y-12.291 E537.51918
G1 X-47.524 Y-11.962 E538.48853
G1 X-47.842 Y-11.765 E538.87956
G1 X-47.942 Y-3.812 E547.1936
G1 X-47.956 Y-2.109 E548.97383
G1 X-47.971 Y-1.605 E549.5009
G1 X-48.024 Y2.627 E553.92501
G1 X-47.697 Y2.27 E554.43108
G1 X-47.193 Y1.513 E555.38172
G1 X-47.087 Y1.242 E555.6859
G1 X-46.785 Y0.725 E556.31177
G1 X-46.382 Y0.373 E556.8711
G1 X-46.045 Y0.129 E557.30601
G1 X-45.194 Y-.818 E558.63689
G1 X-45.068 Y-1.017 E558.8831
G1 X-45.006 Y-1.472 E559.36312
G1 X-44.773 Y-1.999 E559.96544
G1 X-44.351 Y-2.447 E560.60878
G1 X-43.943 Y-2.789 E561.16529
G1 X-43.305 Y-3.163 E561.93834
G1 X-42.643 Y-3.449 E562.69215
G1 X-42.173 Y-3.697 E563.24765
G1 X-41.685 Y-3.818 E563.77321
G1 X-41.15 Y-3.923 E564.34312
G1 X-40.436 Y-4.11 E565.11465
G1 X-39.707 Y-4.222 E565.88563
G1 X-38.76 Y-4.297 E566.87864
G1 X-38.256 Y-4.263 E567.40667
G1 X-37.793 Y-4.103 E567.91874
G1 X-36.994 Y-3.724 E568.84314
G1 X-36.275 Y-3.489 E569.63385
G1 X-35.438 Y-3.414 E570.51228
G1 X-35.08 Y-3.426 E570.88671
G1 X-34.181 Y-3.773 E571.89402
G1 X-33.697 Y-4.079 E572.49259
G1 X-33.229 Y-4.428 E573.10285
G1 X-32.756 Y-4.83 E573.75173
G1 X-32.264 Y-5.187 E574.38715
G1 X-31.781 Y-5.53 E575.00639
G1 X-31.36 Y-5.75 E575.50293
G1 X-30.736 Y-5.925 E576.18038
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""")  # disabled
analyzegcode = BooleanToggle(True)  # disabled
gcode_4 = Data(gcode)  # disabled
filter_140 = StreamFilter(Gate=analyzegcode, Stream1=gcode_4)  # disabled
parsegcode_2 = ParseGCODE(GCODE=filter_140)  # -> PrintSpeed, TravelSpeed, RetractionSpeed, ExtrusionRate, LayerHeight, LineWidth, G, X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; inputs GCODE: list of String; same code as parsegcode
gcode_5 = Data(panel_25)  # disabled
number_slider_3 = Slider(1000, range=0..1000)  # disabled
pt_9 = ConstructPoint(XCoordinate=parsegcode_2.X, YCoordinate=parsegcode_2.Y, ZCoordinate=parsegcode_2.Z)  # disabled
shift_9 = ShiftList(List=parsegcode_2.E, Shift=-1, Wrap=False)  # disabled
shift_10 = ShiftList(List=parsegcode_2.E, Shift=1, Wrap=False)  # disabled
shift_11 = ShiftList(List=pt_9, Shift=-1, Wrap=False)  # disabled
shift_12 = ShiftList(List=pt_9, Shift=1, Wrap=False)  # disabled
shift_13 = ShiftList(List=parsegcode_2.F, Shift=1, Wrap=False)  # disabled
item_27 = ListItem(List=shift_9, Index=number_slider_3, Wrap=True)  # disabled
item_28 = ListItem(List=shift_10, Index=number_slider_3, Wrap=True)  # disabled
ln_9 = Line(StartPoint=shift_11, EndPoint=shift_12)  # disabled
item_29 = ListItem(List=shift_13, Index=number_slider_3, Wrap=True)  # disabled
item_30 = ListItem(List=ln_9, Index=number_slider_3, Wrap=True)  # disabled
subtraction_15 = Subtraction(A=item_28, B=item_27)  # disabled
panel_26 = Panel("0")  # disabled
len_7 = Length(Curve=item_30)  # disabled
max_2 = Maximum(A=panel_26, B=subtraction_15)  # disabled
division_4 = Division(A=max_2, B=len_7)  # disabled
extrusionrate = Panel(division_4)  # disabled
f_value = Panel(item_29)  # disabled
move_length = Panel(len_7)  # disabled
e_value = Panel(item_28)  # disabled

# ----
# comments & notes: sum lengths of moves and divide by print speed, also multiply with a correction factor (tested experimentally)
print_speed_mm_min_3 = Data(print_speed_mm_min_2)
printing_time_correction_factor = Slider(1.45, range=0..2)
movelines_2 = Data(movelines)
null_10 = NullItem(Item=movelines_2)  # -> NullFlags, InvalidFlags, Description
lng_21 = ListLength(List=movelines_2)
equals_9 = Equality(FirstNumber=lng_21, SecondNumber="0")  # -> Equality, Inequality
ma_24 = MassAddition(Input=[null_10.NullFlags, null_10.InvalidFlags])  # -> Result, PartialResults
or_14 = GateOr(A=ma_24.Result, C=equals_9.Equality)
movelines_null = Data(or_14)
filter_141 = StreamFilter(Gate=movelines_null, Stream0=movelines_2)
len_8 = Length(Curve=filter_141)
ma_25 = MassAddition(Input=len_8)  # -> Result, PartialResults
division_5 = Division(A=ma_25.Result, B=print_speed_mm_min_3)
filter_142 = StreamFilter(Gate=movelines_null, Stream0=printing_time_correction_factor)
multiplication_26 = Multiplication(A=division_5, B=filter_142)
rtd_8 = RoundToDecimal(Numbers=multiplication_26, DecimalPlaces="2")  # -> Rounded; inputs Numbers: list of Double, DecimalPlaces: list of Int32; same code as rtd
approximate_printing_time_in_minutes = Panel(rtd_8)
approximate_print_time = Data(rtd_8)

# ----
# comments & notes: compute hours, minutes and seconds for formatting print time
approximate_print_time_2 = Data(approximate_print_time)
division_6 = Division(A=approximate_print_time_2, B="60")
round_4 = Round(Number=division_6)  # -> Nearest, Floor, Ceiling
subtraction_16 = Subtraction(A=division_6, B=round_4.Floor)
multiplication_27 = Multiplication(A=subtraction_16, B="60")
round_5 = Round(Number=multiplication_27)  # -> Nearest, Floor, Ceiling
subtraction_17 = Subtraction(A=multiplication_27, B=round_5.Floor)
multiplication_28 = Multiplication(A=subtraction_17, B="60")
round_6 = Round(Number=multiplication_28)  # -> Nearest, Floor, Ceiling
print_time_seconds = Data(round_6.Floor)
print_time_minutes = Data(round_5.Floor)
print_time_hours = Data(round_4.Floor)

# ----
# comments & notes: format print time and create info message
print_time_seconds_2 = Data(print_time_seconds)
print_time_minutes_2 = Data(print_time_minutes)
print_time_hours_2 = Data(print_time_hours)
printingtimeinfo = PrintingTimeInfo(Hours=print_time_hours_2, Minutes=print_time_minutes_2, Seconds=print_time_seconds_2)  # -> InfoString; inputs Hours: Int32, Minutes: Int32, Seconds: Int32
# ---------- printingtimeinfo: Python ----------
import System
import Rhino
import Grasshopper
import rhinoscriptsyntax as rs

# GHENV COMPONENT SETTINGS
ghenv.Component.Name = "PrintingTimeInfo"
ghenv.Component.NickName = "PrintingTimeInfo"
ghenv.Component.Category = "DDUClayPrintingSlicer"
ghenv.Component.SubCategory = "9 Utilities"


class PrintingTimeInfo(Grasshopper.Kernel.GH_ScriptInstance):
    """
    Author: Max Benjamin Eschenbach
    License: MIT License
    Version: 250411
    """
    def RunScript(self, Hours: int, Minutes: int, Seconds: int):
        InfoString = ''
        if Hours and Hours > 0:
            InfoString += '{0} hours'
        if Minutes and Minutes > 0:
            if Hours and Hours > 0:
                InfoString += ', '
            InfoString += '{1} minutes'
        if Seconds and Seconds > 0:
            if (Hours and Hours > 0) or (Minutes and Minutes > 0):
                InfoString += ', '
            InfoString += '{2} seconds'
        InfoString += '.'
        return InfoString
# ---------- end printingtimeinfo ----------
movelines_null_2 = Data(movelines_null)
concat = Concatenate(FragmentA="[INFO] Approximate Printing Time is ", FragmentB=printingtimeinfo)
filter_143 = StreamFilter(Gate=movelines_null_2, Stream0=concat)
format_8 = Format(Format=filter_143, Culture=127, Data0=print_time_hours_2, Data1=print_time_minutes_2, Data2=print_time_seconds_2)
info_approximate_print_time = Data(format_8)

# ----
# HEADS UP DISPLAY
# comments & notes: Info & Error Stream collection
info_approximate_print_weight_2 = Data(info_approximate_print_weight)
info_approximate_print_time_2 = Data(info_approximate_print_time)
info_backforth_open_crvs_2 = Data(info_backforth_open_crvs)
info_spiralize_contours_2 = Data(info_spiralize_contours)
info_randomization_2 = Data(info_randomization)
info_mirko_spiralize_2 = Data(info_mirko_spiralize)
base_mesh_closed_2 = Data(base_mesh_closed)
pg_meshbrep_info_2 = Data(pg_meshbrep_info)
shrinkwrap_info_2 = Data(shrinkwrap_info)
remeshing_info_2 = Data(remeshing_info)
inmesh_closed_2 = Data(inmesh_closed)
info_npslicing_2 = Data(info_npslicing)
floor_info_2 = Data(floor_info)
enable_heads_up_display_2 = Data(enable_heads_up_display)
geo_present_4 = Boolean(geo_present)
merge_41 = Merge(
    Data1=flatten(inmesh_closed_2),
    Data2=flatten(remeshing_info_2),
    Data3=flatten(shrinkwrap_info_2),
    Data4=flatten(base_mesh_closed_2),
    Data5=flatten(pg_meshbrep_info_2),
    Data6=flatten(info_npslicing_2),
    Data7=flatten(floor_info_2),
    Data8=flatten(info_randomization_2),
    Data9=flatten(info_spiralize_contours_2),
    Data10=flatten(info_mirko_spiralize_2),
    Data11=flatten(info_backforth_open_crvs_2),
    Data12=flatten(info_approximate_print_weight_2),
    Data13=flatten(info_approximate_print_time_2))  # -> flatten(Result)
filter_144 = StreamFilter(Gate=geo_present_4, Stream0="[ERROR] No input geometry is present!", Stream1=merge_41)
info_error_stream = Panel(filter_144)
overhang_offset_analysis_info_2 = Data(overhang_offset_analysis_info)
overhang_angle_analysis_info_2 = Data(overhang_angle_analysis_info)
comments_notes_48 = Panel("HEADS UP DISPLAY")
textsize = Slider(16, range=0..30)
layer_height_analysis_info_2 = Data(layer_height_analysis_info)
filter_145 = StreamFilter(Gate=enable_heads_up_display_2, Stream1=filter_144)
clayprintinghud = ClayPrintingHUD(
    INFO=filter_145,
    LHA=layer_height_analysis_info_2,
    OHA=overhang_angle_analysis_info_2,
    OHO=overhang_offset_analysis_info_2,
    MarginH=Slider(20, range=0..100),
    MarginV=Slider(40, range=0..100),
    Font="Titillium",
    TextSize=textsize,
    TextColor=ColourSwatch(SwatchColor=RGB(0, 0, 0)),
    ErrorColor=ColourSwatch(SwatchColor=RGB(255, 0, 0)),
    WarningColor=ColourSwatch(SwatchColor=RGB(255, 92, 33)),
    IgnoColor=ColourSwatch(SwatchColor=RGB(255, 119, 0)),
    ThrowDebugError=Toggle(False))  # inputs INFO: list of String, LHA: list of String, OHA: list of String, OHO: list of String, MarginH: Int32, MarginV: Int32, Font: String, TextSize: Int32, TextColor: Color, ErrorColor: Color, WarningColor: Color, IgnoColor: Color, ThrowDebugError: Boolean
# ---------- clayprintinghud: C# ----------
#region Usings
using System;
using System.Linq;
using System.Collections;
using System.Collections.Generic;
using System.Drawing;

using Rhino;
using Rhino.Geometry;

using Grasshopper;
using Grasshopper.Kernel;
using Grasshopper.Kernel.Data;
using Grasshopper.Kernel.Types;
#endregion

public class Script_Instance : GH_ScriptInstance
{
    #region Notes
    /* 
      Members:
        RhinoDoc RhinoDocument
        GH_Document GrasshopperDocument
        IGH_Component Component
        int Iteration

      Methods (Virtual & overridable):
        Print(string text)
        Print(string format, params object[] args)
        Reflect(object obj)
        Reflect(object obj, string method_name)
    
    Author: Max Eschenbach
    License: MIT License
    Version: 250423
    */
    #endregion

    List<string> INFO;
    List<string> LHA;
    List<string> OHA;
    List<string> OHO;

    int hmargin;
    int vmargin;
    string font;
    int txtsize;
    Color txtcolor;
    Color errcolor;
    Color warncolor;
    Color ignocolor;
    bool throwerror;

    private void RunScript(
		List<string> INFO,
		List<string> LHA,
		List<string> OHA,
		List<string> OHO,
		int MarginH,
		int MarginV,
		string Font,
		int TextSize,
		Color TextColor,
		Color ErrorColor,
		Color WarningColor,
		Color IgnoColor,
		bool ThrowDebugError)
    {
        // set component params
        this.Component.Name = "ClayPrintingHUD";
        this.Component.NickName = "ClayPrintingHUD";
        this.Component.Category = "DDUClayPrintingSlicer";
        this.Component.SubCategory = "8 Visualisation";

        // data
        this.INFO = INFO;
        this.LHA = LHA;
        this.OHA = OHA;
        this.OHO = OHO;
        
        // settings
        this.hmargin = MarginH;
        this.vmargin = MarginV;
        this.font = Font;
        this.txtsize = TextSize;
        this.txtcolor = TextColor;
        this.errcolor = ErrorColor;
        this.warncolor = WarningColor;
        this.ignocolor = IgnoColor;
        this.throwerror = ThrowDebugError;

    }

    override public void DrawViewportWires(IGH_PreviewArgs args)
    {
        if (args.Display.Viewport.Id == args.Document.RhinoDocument.Views.ActiveView.ActiveViewportID)
        {
            Point2d anchor_pt = new Point2d(this.hmargin, this.vmargin);
            

            // INFO, WARNING & ERROR STREAM
            if (this.INFO != null)
            {
                // Headline
                args.Display.Draw2dText(
                    "INFO & ERROR STREAM",
                    this.txtcolor,
                    anchor_pt,
                    false,
                    this.txtsize,
                    this.font + " Bold"
                );
                anchor_pt += new Point2d(0, this.txtsize * 1.25);
                // Stream
                foreach (string infostring in this.INFO)
                {
                    args.Display.Draw2dText(
                        infostring,
                        this.GetTextColor(infostring),
                        anchor_pt,
                        false,
                        this.txtsize,
                        this.font
                    );
                    anchor_pt += new Point2d(0, this.txtsize * 1.25);
                }


            }

            // LAYER HEIGHT ANALYSIS
            if (this.LHA != null)
            {
                anchor_pt += new Point2d(0, this.txtsize * 1.5);
                // Headline
                args.Display.Draw2dText(
                    "LAYER HEIGHT ANALYSIS",
                    this.txtcolor,
                    anchor_pt,
                    false,
                    this.txtsize,
                    this.font + " Bold"
                );
                anchor_pt += new Point2d(0, this.txtsize * 1.25);
                // Stream
                foreach (string lhastring in this.LHA)
                {
                    args.Display.Draw2dText(
                        lhastring,
                        this.txtcolor,
                        anchor_pt,
                        false,
                        this.txtsize,
                        this.font
                    );
                    anchor_pt += new Point2d(0, this.txtsize * 1.25);
                }
            }

            // OVERHANG ANGLE ANALYSIS
            if (this.OHA != null)
            {
                if (this.INFO != null && this.LHA != null) { anchor_pt += new Point2d(0, this.txtsize * 4.5); }
                else if (this.INFO != null && this.LHA == null) { anchor_pt += new Point2d(0, this.txtsize * 1.5); }
                // Headline
                args.Display.Draw2dText(
                    "OVERHANG ANGLE ANALYSIS",
                    this.txtcolor,
                    anchor_pt,
                    false,
                    this.txtsize,
                    this.font + " Bold"
                );
                anchor_pt += new Point2d(0, this.txtsize * 1.25);
                // Stream
                foreach (string ohastring in this.OHA)
                {
                    args.Display.Draw2dText(
                        ohastring,
                        this.txtcolor,
                        anchor_pt,
                        false,
                        this.txtsize,
                        this.font
                    );
                    anchor_pt += new Point2d(0, this.txtsize * 1.25);
                }
            }

            // OVERHANG OFFSET ANALYSIS
            if (this.OHO != null)
            {
                if (this.INFO != null && this.LHA != null) { anchor_pt += new Point2d(0, this.txtsize * 4.5); }
                else if (this.INFO != null && this.LHA == null) { anchor_pt += new Point2d(0, this.txtsize * 1.5); }
                // Headline
                args.Display.Draw2dText(
                    "OVERHANG OFFSET ANALYSIS",
                    this.txtcolor,
                    anchor_pt,
                    false,
                    this.txtsize,
                    this.font + " Bold"
                );
                anchor_pt += new Point2d(0, this.txtsize * 1.25);
                // Stream
                foreach (string ohostring in this.OHO)
                {
                    args.Display.Draw2dText(
                        ohostring,
                        this.txtcolor,
                        anchor_pt,
                        false,
                        this.txtsize,
                        this.font
                    );
                    anchor_pt += new Point2d(0, this.txtsize * 1.25);
                }
            }

        }
    }

    private Color GetTextColor(string infostring)
    {
        Color col = Color.Black;
        // options
        if (infostring.StartsWith("[INFO]")) { return this.txtcolor; }
        else if (infostring.StartsWith("[ERROR]")) { return this.errcolor; }
        else if (infostring.StartsWith("[WARNING]")) { return this.warncolor; }
        else if (infostring.StartsWith("[SETTING IGNORED]")) { return this.ignocolor; }
        else { return this.txtcolor; }
    }
}
# ---------- end clayprintinghud ----------

# ----
# OVERHANG ANGLE ANALYSIS VIS
# comments & notes: OVERHANG ANGLE ANALYSIS VIS
layer_height_analysis_activated_11 = Data(layer_height_analysis_activated)
overhang_angle_analysis_values_2 = Data(overhang_angle_analysis_values)
printing_curves_11 = Geometry(printing_curves_3)
render_layer_curves_10 = Data(render_layer_curves)
angle_analysis_threshold_degr_2 = Data(angle_analysis_threshold_degr)
merge_42 = Merge(Data1=flatten(render_layer_curves_10), Data2=flatten(layer_height_analysis_activated_11))
angle_analysis_threshold_degr_3 = Data(angle_analysis_threshold_degr)
overhang_angle_analysis_displaylines_2 = Data(overhang_angle_analysis_displaylines)
int_7 = Integer(merge_42)
gradient_5 = Gradient(
    LowerLimit="0",
    UpperLimit=angle_analysis_threshold_degr_2,
    Parameter=overhang_angle_analysis_values_2,
    stops=[0: RGB(0, 128, 0), 0.5: RGB(255, 255, 0), 1: RGB(255, 0, 0)])
ma_26 = MassAddition(Input=int_7)  # -> Result, PartialResults
vis_offset_vector_19 = Vector(vis_offset_vector)
multiplication_29 = Multiplication(A=angle_analysis_threshold_degr_3, B="0.75")
addition_13 = Addition(A="2", B=ma_26.Result)
larger_17 = LargerThan(FirstNumber=overhang_angle_analysis_values_2, SecondNumber=multiplication_29)  # -> LargerThan, OrEqualTo
multiplication_30 = Multiplication(A=vis_offset_vector_19, B=addition_13)
move_46 = Move(Geometry=overhang_angle_analysis_displaylines_2, Motion=multiplication_30)  # -> flatten(Geometry), Transform
dispatch_14 = Dispatch(List=move_46.Geometry, DispatchPattern=larger_17.LargerThan)  # -> ListA, ListB
dispatch_15 = Dispatch(List=gradient_5, DispatchPattern=larger_17.LargerThan)  # -> ListA, ListB
dispatch_16 = Dispatch(List=overhang_angle_analysis_values_2, DispatchPattern=larger_17.LargerThan)  # -> ListA, ListB
rtd_9 = RoundToDecimal(Numbers=dispatch_16.ListA)  # -> Rounded; inputs Numbers: list of Double, DecimalPlaces: list of Int32; same code as rtd
eval_7 = EvaluateCurve(Curve=reparameterize(dispatch_14.ListA), Parameter=0.5)  # -> Point, Tangent, Angle
curvepreviewlw_20 = CurvePreviewLW(Curves=move_46.Geometry, Colors=gradient_5, Thickness=Slider(3, range=0..10))  # inputs Curves: list of Curve, Colors: list of Color, Thickness: list of Int32; same code as curvepreviewlw
tag_12 = TextTag(Location=eval_7.Point, Text=rtd_9, Colour=dispatch_15.ListA)

overhang_angle_analysis_activated_11 = Boolean(overhang_angle_analysis_activated)
filter_146 = StreamFilter(Gate=overhang_angle_analysis_activated_11, Stream1=printing_curves_11)

move_47 = Move(Geometry=flatten(filter_146), Motion=multiplication_30)  # -> Geometry, Transform
curvepreviewlw_21 = CurvePreviewLW(Curves=move_47.Geometry, Colors=ColourSwatch(SwatchColor=RGB(191, 191, 191)), Thickness=Slider(1, range=0..10))  # inputs Curves: list of Curve, Colors: list of Color, Thickness: list of Int32; same code as curvepreviewlw

# ==== cluster CurveInfill: Take the given curve and creates an infill (based on the extrusion width and infill ratio) of the curve as a polyline. This polyline can be then be converted into g code.

C = ClusterInput()
trim_to = TrimTo(data_to_trim=simplify(C), branch_depth=1, F=False)
crv = Curve(trim_to)
join = JoinCurves(Curves=crv, Preserve=False)
trim = TrimTree(Tree=join, Depth=1)
boundary = BoundarySurfaces(Edges=trim)  # -> graft(Surfaces)

extrusion_width_or_xylinus_config = ClusterInput()  # input either the extrusion width in mm, or a Xlinus Config
extrusion_width = Data(extrusion_width_or_xylinus_config)
setting = ConfigSetting(config=extrusion_width, setting_number=3)  # -> flatten(setting_2)

# ---- group: infill ratio
infill_ratio_0_1 = ClusterInput()  # infill ratio
division = Division(A=1, B=infill_ratio_0_1)
multiplication = Multiplication(A=setting, B=division)

# ----
tstat = TreeStatistics(Tree=crv)  # -> Paths, Length, Count
long = LongestList(ListA=tstat.Paths, ListB=[0, 1], PaddingMode=4)  # -> ListA, simplify(graft(ListB))
larger = LargerThan(FirstNumber=tstat.Count, SecondNumber=1)  # -> LargerThan, OrEqualTo
filter = StreamFilter(Gate=larger.LargerThan, Stream0=0, Stream1=long.ListB)
trim_2 = TrimTree(Tree=boundary, Depth=1)

# ---- group: create lines for infill
bbox = BoundingBox(Content=flatten(boundary), Plane=PlaneXY(0, 0, 0), UnionBox=True)  # -> Box, Box_2
box = EvaluateBox(Box=bbox.Box, UParameter=0.5, VParameter=0.5, WParameter=0.5)  # -> Plane, Point, Include
rotate = Rotate(Geometry=bbox.Box, Angle=1.570796327, Plane=box.Plane)  # -> Geometry, Transform
bbox_2 = BoundingBox(Content=flatten([rotate.Geometry, bbox.Box]), Plane=PlaneXY(0, 0, 0), UnionBox=True)  # -> Box, Box_2
box_corners = BoxCorners(Box=flatten(bbox_2.Box))  # -> CornerA, CornerB, CornerC, CornerD, CornerE, CornerF, CornerG, CornerH
ln = Line(StartPoint=box_corners.CornerA, EndPoint=box_corners.CornerC)

# ----
ln_2 = Line(StartPoint=box_corners.CornerB, EndPoint=box_corners.CornerD)
p_n_c = PickNChoose(Pattern=filter, Stream0=ln, Stream1=ln_2)
long_2 = LongestList(ListA=trim_2, ListB=p_n_c, PaddingMode=2)  # -> ListA, graft(ListB)

# ---- group: create lines for infill (continued)
divlength = DivideLength(Curve=long_2.ListB, Length=multiplication)  # -> Points, Tangents, Parameters
pl = PlaneNormal(Origin=divlength.Points, ZAxis=long_2.ListB)
trim_3 = TrimTree(Tree=pl, Depth=1)
sec = BrepPlane(Brep=boundary, Plane=trim_3)  # -> Curves, Points
clean = CleanTree(RemoveNulls=True, RemoveInvalid=True, RemoveEmpty=True, Tree=sec.Curves)

# ----
path_mapper = PathMapper(clean, source="{A;B;C}(i)", target="{A;B;i}(C)")

# ---- group: split at nulls to establish consecutive lines
data = Data(path_mapper)
null = NullItem(Item=data)  # -> NullFlags, InvalidFlags, Description
lng = ListLength(List=data)
series = Series(Start=0, Step=1, Count=lng)
item = ListItem(List=series, Index=0, Wrap=True)  # -> Item1, Item
cull = CullPattern(List=series, CullPattern=null.NullFlags)
merge = Merge(Data1=item.Item, Data2=cull, Data3=item.Item1)
consec = ConsecutiveDomains(Numbers=merge, Additive=False)

# ----
trim_4 = TrimTree(Tree=consec, Depth=2)

# ---- group: split at nulls to establish consecutive lines (continued)
subset = SubList(List=data, Domain=trim_4, Wrap=True)  # -> List, Index
clean_2 = CleanTree(RemoveNulls=True, RemoveInvalid=True, RemoveEmpty=True, Tree=subset.List)

# ---- group: flip every other curve to make zig zags
dispatch = Dispatch(List=clean_2, DispatchPattern=[True, False])  # -> ListA, ListB
flip = FlipCurve(Curve=dispatch.ListB)  # -> Curve, Flag
weave = Weave(Pattern=[0, 1], Stream0=dispatch.ListA, Stream1=flip.Curve, NullGaps=False)
end = EndPoints(Curve=weave)  # -> Start, End
weave_2 = Weave(Pattern=[0, 1], Stream0=end.Start, Stream1=end.End, NullGaps=False)

# ---- group: split at long line shifts
data_2 = Data(weave_2)
lng_2 = ListLength(List=data_2)
series_2 = Series(Start=0, Step=1, Count=lng_2)
item_2 = ListItem(List=series_2, Index=0, Wrap=True)  # -> Item1, Item

# ---- group: split at long line shifts / if the distance between the end of one line and the start of the next is greater than X * the layer width then create a break
shift = ShiftList(List=data_2, Shift=1, Wrap=True)
dist = Distance(PointA=data_2, PointB=shift)
sift = SiftPattern(List=dist, SiftPattern=[0, 1])  # -> Output0, Output1
multiplication_2 = Multiplication(A=multiplication, B=Slider(2.5, range=0..10))
larger_2 = LargerThan(FirstNumber=sift.Output1, SecondNumber=multiplication_2)  # -> LargerThan, OrEqualTo

# ---- group: split at long line shifts
replace = ReplaceItems(List=larger_2.LargerThan, Item=True, Indices=-1, Wrap=True)
trim_5 = TrimTree(Tree=replace, Depth=1)

cull_2 = CullPattern(List=series_2, CullPattern=trim_5)
merge_2 = Merge(Data1=item_2.Item, Data2=cull_2)
consec_2 = ConsecutiveDomains(Numbers=merge_2, Additive=False)

# ---- group: split at long line shifts / increase start of domain by one unless it is 0
dedomain = DeconstructDomain(Domain=consec_2)  # -> Start, End
addition = Addition(A=dedomain.Start, B=1)
eval = Evaluate(F="if(x=1,0,x)", x=addition)
dom = ConstructDomain(DomainStart=eval, DomainEnd=dedomain.End)

# ---- group: split at long line shifts
trim_6 = TrimTree(Tree=dom, Depth=2)
subset_2 = SubList(List=data_2, Domain=trim_6, Wrap=False)  # -> List, Index
clean_3 = CleanTree(Tree=subset_2.List, CleanInvalid=True, CleanEmpty=False)
prune = PruneTree(Tree=clean_3, Minimum=1, Maximum=0)
pline = PolyLine(Vertices=prune, Closed=False)
trim_to_2 = TrimTo(data_to_trim=pline, branch_depth=1, F=False)
D = ClusterOutput(trim_to_2)

# ==== cluster CREATE_OFFSET_INFILL

slice_planes = ClusterInput()
outer_infill_base_curves = ClusterInput()
inner_infill_base_curves = ClusterInput()
offset = ClusterInput()
slice_planes_2 = Data(slice_planes)
outer_infill_base_curves_2 = Curve(outer_infill_base_curves)
inner_infill_base_curves_2 = Curve(inner_infill_base_curves)
offset_2 = Data(offset)

comments_notes = Panel("OFFSET INFILL")
outer_infill_base_curves_3 = Curve(outer_infill_base_curves_2)

null = NullItem(Item=flatten(inner_infill_base_curves_2))  # -> NullFlags, InvalidFlags, Description
or = GateOr(A=null.NullFlags, B=null.InvalidFlags)
tstat = TreeStatistics(Tree=outer_infill_base_curves_2)  # -> Paths, Length, Count
c2bool = Clipper2Boolean(PolylinesA=outer_infill_base_curves_2, PolylinesB=inner_infill_base_curves_2, Operation=1, Precision=6)
ma = MassAddition(Input=or)  # -> Result, PartialResults
branch = TreeBranch(Tree=slice_planes_2, Path=tstat.Paths, MaintainPaths=True)
pshift = ShiftPaths(Data=c2bool, Offset=-1)
bool = Boolean(invert(ma.Result))
project = Project(Geometry=pshift, Plane=branch)  # -> Geometry, Transform
filter = StreamFilter(Gate=bool, Stream0=outer_infill_base_curves_2, Stream1=project.Geometry)
infill_basecrvs_merged = Curve(filter)
bbox = BoundingBox(Content=infill_basecrvs_merged, Plane=PlaneXY(0, 0, 0), UnionBox=True)  # -> Box, Box_2
tstat_2 = TreeStatistics(Tree=infill_basecrvs_merged)  # -> Paths, Length, Count
debox = DeconstructBox(Box=bbox.Box)  # -> Plane, X, Y, Z
branch_2 = TreeBranch(Tree=slice_planes_2, Path=tstat_2.Paths, MaintainPaths=True)
dedomain = DeconstructDomain(Domain=debox.X)  # -> Start, End
dedomain_2 = DeconstructDomain(Domain=debox.Y)  # -> Start, End
subtraction = Subtraction(A=dedomain.End, B=dedomain.Start)
subtraction_2 = Subtraction(A=dedomain_2.End, B=dedomain_2.Start)
max = Maximum(A=subtraction, B=subtraction_2)
division = Division(A=max, B="2")
offset_3 = Data(offset_2)
division_2 = Division(A=division, B=offset_3)
inner_infill_base_crvs = Curve(inner_infill_base_curves_2)
round = Round(Number=division_2)  # -> Nearest, Floor, Ceiling
series = Series(Start=offset_3, Step=offset_3, Count=round.Ceiling)
null_2 = NullItem(Item=flatten(inner_infill_base_crvs))  # -> NullFlags, InvalidFlags, Description
pshift_2 = ShiftPaths(Data=series, Offset=-1)
comments_notes_2 = Panel("create infill offsets")
or_2 = GateOr(A=null_2.NullFlags, B=null_2.InvalidFlags)
c2offset = Clipper2Offset(Polylines=infill_basecrvs_merged, Distance=pshift_2, JoinType=1, EndType=4, MiterLimit=2, Precision=6)  # -> Holes, Outer, ClipperPaths
ma_2 = MassAddition(Input=or_2)  # -> Result, PartialResults
pshift_3 = ShiftPaths(Data=c2offset.Holes, Offset=-1)
pshift_4 = ShiftPaths(Data=c2offset.Outer, Offset=-1)
bool_2 = Boolean(invert(ma_2.Result))
inner_infill_base_crvs_2 = Curve(inner_infill_base_curves_2)

# ----
# comments & notes: sort crvs in inner and outer
infill_basecrvs_merged_2 = Curve(infill_basecrvs_merged)
boundary = BoundarySurfaces(Edges=infill_basecrvs_merged_2)
inneroutercurves = InnerOuterCurves(SliceSurfaces=boundary)  # -> InnerCurves, OuterCurves; inputs SliceSurfaces: tree of Brep
# ---------- inneroutercurves: C# ----------
#region Usings
using System;
using System.Linq;
using System.Collections;
using System.Collections.Generic;
using System.Drawing;

using Rhino;
using Rhino.Geometry;

using Grasshopper;
using Grasshopper.Kernel;
using Grasshopper.Kernel.Data;
using Grasshopper.Kernel.Types;
#endregion

public class Script_Instance : GH_ScriptInstance
{
    #region Notes
    /* 
      Members:
        RhinoDoc RhinoDocument
        GH_Document GrasshopperDocument
        IGH_Component Component
        int Iteration

      Methods (Virtual & overridable):
        Print(string text)
        Print(string format, params object[] args)
        Reflect(object obj)
        Reflect(object obj, string method_name)

    Author: Max Benjamin Eschenbach
    License: MIT License
    Version: 250314
    */
    #endregion

    private void RunScript(
		DataTree<Brep> SliceSurfaces,
		ref object InnerCurves,
		ref object OuterCurves)
    {
        // set component params
        this.Component.Name = "InnerOuterCurves";
        this.Component.NickName = "InnerOuterCurves";
        this.Component.Category = "DDUClayPrintingSlicer";
        this.Component.SubCategory = "2 Slice Processing";

        DataTree<Curve> iLoops = new DataTree<Curve>();
        DataTree<Curve> oLoops = new DataTree<Curve>();
        List<Brep> Breps;
        for (int i = 0; i < SliceSurfaces.BranchCount; i++)
        {
            Breps = SliceSurfaces.Branches[i];
            for (int j = 0; j < Breps.Count; j++)
            {
                int fc = Breps[j].Faces.Count;
                for (int k = 0; k < fc; k++)
                {
                    BrepFace bface = Breps[j].Faces[k];
                    int iCount = 0;
                    foreach (BrepLoop floop in bface.Loops)
                    {
                        if (floop.LoopType == BrepLoopType.Inner)
                        {
                            iLoops.Add(floop.To3dCurve(), SliceSurfaces.Paths[i]);
                        }
                        else if (floop.LoopType == BrepLoopType.Outer)
                        {
                            oLoops.Add(floop.To3dCurve(), SliceSurfaces.Paths[i]);
                        }
                    }
                }
            }
        }
        InnerCurves = iLoops;
        OuterCurves = oLoops;
    }
}
# ---------- end inneroutercurves ----------
pcen = PolygonCenter(Polyline=inneroutercurves.InnerCurves)  # -> CenterV, CenterE, CenterA
pcen_2 = PolygonCenter(Polyline=inneroutercurves.OuterCurves)  # -> CenterV, CenterE, CenterA
Z = UnitZ(Factor=1)
pl = PlaneNormal(Origin=pcen_2.CenterA, ZAxis=Z)
pl_2 = PlaneNormal(Origin=pcen.CenterV, ZAxis=Z)
crvensureccw = CrvEnsureCCW(Crv=inneroutercurves.InnerCurves, Pln=pl_2)  # -> CCWCrv; inputs Crv: Curve, Pln: Plane
# ---------- crvensureccw: C# ----------
#region Usings
using System;
using System.Linq;
using System.Collections;
using System.Collections.Generic;
using System.Drawing;

using Rhino;
using Rhino.Geometry;

using Grasshopper;
using Grasshopper.Kernel;
using Grasshopper.Kernel.Data;
using Grasshopper.Kernel.Types;
#endregion

public class Script_Instance : GH_ScriptInstance
{
    #region Notes
    /* 
      Members:
        RhinoDoc RhinoDocument
        GH_Document GrasshopperDocument
        IGH_Component Component
        int Iteration

      Methods (Virtual & overridable):
        Print(string text)
        Print(string format, params object[] args)
        Reflect(object obj)
        Reflect(object obj, string method_name)

    Author: Max Benjamin Eschenbach
    License: MIT License
    Version: 250317
    */
    #endregion

    private void RunScript(Curve Crv, Plane Pln, ref object CCWCrv)
    {
        // set component params
        this.Component.Name = "CrvEnsureCCW";
        this.Component.NickName = "CrvEnsureCCW";
        this.Component.Category = "DDUClayPrintingSlicer";
        this.Component.SubCategory = "2 Slice Processing";

        CCWCrv = new Grasshopper.DataTree<object>();

        if (Crv != null)
        {
            if (Crv.ClosedCurveOrientation(Pln) == CurveOrientation.Clockwise)
            {
                Crv.Reverse();
                CCWCrv = Crv;
            }
            else
            {
                CCWCrv = Crv;
            }
        }
    }
}
# ---------- end crvensureccw ----------
crvensureccw_2 = CrvEnsureCCW(Crv=inneroutercurves.OuterCurves, Pln=pl)  # -> CCWCrv; inputs Crv: Curve, Pln: Plane; same code as crvensureccw
clean = CleanTree(RemoveNulls=True, RemoveInvalid=True, RemoveEmpty=False, Tree=crvensureccw)
clean_2 = CleanTree(RemoveNulls=True, RemoveInvalid=True, RemoveEmpty=False, Tree=crvensureccw_2)
outercrvs = Curve(clean_2)
innercrvs = Curve(clean)

trim = TrimWithRegions(Curve=pshift_4, Regions=outer_infill_base_curves_3)  # -> Inside, Outside
pshift_5 = ShiftPaths(Data=trim.Inside, Offset=-1)
trim_2 = TrimWithRegions(Curve=pshift_3, Regions=pshift_5)  # -> Inside, Outside
pshift_6 = ShiftPaths(Data=trim_2.Outside, Offset=-1)
merge = Merge(Data1=pshift_6, Data2=pshift_5)

null_3 = NullItem(Item=pshift_5)  # -> flatten(NullFlags), flatten(InvalidFlags), Description
ma_3 = MassAddition(Input=null_3.InvalidFlags)  # -> Result, PartialResults
larger = LargerThan(FirstNumber=ma_3.Result, SecondNumber="0")  # -> LargerThan, OrEqualTo
not = GateNot(A=larger.LargerThan)

and = GateAnd(A=bool_2, B=not)
filter_2 = StreamFilter(Gate=and, Stream0=pshift_3, Stream1=merge)

project_2 = Project(Geometry=filter_2, Plane=branch_2)  # -> reverse(Geometry), Transform
gate = StreamGate(Stream=project_2.Geometry, Gate=bool_2)  # -> Target0, Target1
trim_3 = TrimWithRegions(Curve=gate.Target1, Regions=inner_infill_base_crvs_2)  # -> Inside, Outside
pshift_7 = ShiftPaths(Data=trim_3.Outside, Offset=-1)
filter_3 = StreamFilter(Gate=bool_2, Stream0=gate.Target0, Stream1=pshift_7)
merge_2 = Merge(Data1=innercrvs, Data2=filter_3, Data3=outercrvs)
infill_curves = Curve(merge_2)

infill_curves_2 = ClusterOutput(infill_curves)

# ==== cluster ConstructWASP40100Printer
wasp_40100_printing_diameter = ClusterInput()
gcode_last_pt = ClusterInput()
gcode_vis_offset_vector = ClusterInput()
enable_print_simulation = ClusterInput()
wasp40100_arm_length = ClusterInput()
layer_height = ClusterInput()

wasp_40100_printing_diameter_2 = Data(wasp_40100_printing_diameter)
gcode_last_pt_2 = Point(gcode_last_pt)
gcode_vis_offset_vector_2 = Data(gcode_vis_offset_vector)
enable_print_simulation_2 = Data(enable_print_simulation)
wasp40100_arm_length_2 = Data(wasp40100_arm_length)
layer_height_2 = Number(layer_height)

enable_print_simulation_3 = Data(enable_print_simulation_2)
gcode_last_pt_3 = Point(gcode_last_pt_2)
gcode_offset_vector = Data(gcode_vis_offset_vector_2)
home_pt = Point(Point(0, 0, 500))
layer_height_3 = Number(layer_height_2)
Z = UnitZ(Factor=layer_height_3)
filter = StreamFilter(Gate=enable_print_simulation_3, Stream1=home_pt)
filter_2 = StreamFilter(Gate=enable_print_simulation_3, Stream1=gcode_last_pt_3)
gcode_last_pt_4 = Point(filter_2)
move = Move(Geometry=filter, Motion=gcode_offset_vector)  # -> Geometry, Transform
move_2 = Move(Geometry=gcode_last_pt_4, Motion=gcode_offset_vector)  # -> Geometry, Transform
null = NullItem(Item=move_2.Geometry)  # -> NullFlags, InvalidFlags, Description
or = GateOr(A=null.NullFlags, B=null.InvalidFlags)
filter_3 = StreamFilter(Gate=or, Stream0=move_2.Geometry, Stream1=move.Geometry)
move_3 = Move(Geometry=filter_3, Motion=Z)  # -> Geometry, Transform
gcode_pt = Point(move_3.Geometry)

# ----
# comments & notes: construct extrudermount and nozzle
number_slider = Slider(4, range=0..10)
gcode_pt_2 = Point(gcode_pt)
xy = XYPlane(Origin=gcode_pt_2)
cir = Circle(Plane=xy, Radius=expr("x*0.5", number_slider))
Z_2 = UnitZ(Factor=Slider(15, range=0..100))
offset = OffsetCurve(Curve=cir, Distance=Slider(0.5, range=0..1), Corners=1)
boundary = BoundarySurfaces(Edges=flatten([cir, offset]))
Z_3 = UnitZ(Factor=Slider(26, range=0..100))
move_4 = Move(Geometry=offset, Motion=Z_3)  # -> Geometry, Transform
extr = Extrude(Base=boundary, Direction=Z_2)
darc = DeconstructArc(Arc=move_4.Geometry)  # -> BasePlane, Radius, Angle
move_5 = Move(Geometry=offset, Motion=Z_2)  # -> Geometry, Transform
polygon = Polygon(Plane=darc.BasePlane, Radius=Slider(12, range=0..100), Segments=6, FilletRadius=0)  # -> Polygon, Length
Z_4 = UnitZ(Factor=Slider(15, range=0..100))
merge = Merge(Data1=move_5.Geometry, Data2=polygon.Polygon)
move_6 = Move(Geometry=darc.BasePlane, Motion=Z_4)  # -> Geometry, Transform
extr_2 = Extrude(Base=polygon.Polygon, Direction=Z_4)
loft = Loft(Curves=merge, Options={Adjust=False, Closed=False, LoftEnds=0, LoftSimp=0, LoftType=0, Rebuild=10, Refit=0.01})
cutplane_extruderfixtures = Data(move_6.Geometry)
wasp40100_nozzle_transition = Data(loft)
wasp40100_nozzle_toppart = Data(extr_2)
wasp40100_nozzle_bot = Data(extr)

cir_2 = Circle(Plane=cutplane_extruderfixtures, Radius=Slider(30, range=0..100))
seam = Seam(Curve=reparameterize(cir_2), Seam=Slider(0.25, range=0..1))
boundary_2 = BoundarySurfaces(Edges=cir_2)
wasp40100_extrudermount_srf = Data(boundary_2)
divide = DivideCurve(Curve=seam, Count="3", Kinks=False)  # -> Points, Tangents, Parameters
extruder_attachmentpts = Data(divide.Points)

# ----
# comments & notes: construct wasp40100 printing area as surface
enable_print_simulation_4 = Data(enable_print_simulation_2)
gcode_vis_offset_vector_3 = Data(gcode_vis_offset_vector_2)
xy_2 = XYPlane(Origin=Point(0, 0, 0))
wasp_40100_printing_diameter_3 = Data(wasp_40100_printing_diameter_2)
Y = UnitY(Factor=expr("(x-10)*0.5", wasp_40100_printing_diameter_3))

# ----
# CONSTRUCT WASP40100 PRINTER
move_7 = Move(Geometry=xy_2, Motion=gcode_vis_offset_vector_3)  # -> Geometry, Transform
comments_notes = Panel("CONSTRUCT WASP40100 PRINTER")

move_8 = Move(Geometry=move_7.Geometry, Motion=Y)  # -> Geometry, Transform
cir_3 = Circle(Plane=move_7.Geometry, Radius=expr("x*0.5", wasp_40100_printing_diameter_3))
crv_cp = CurveClosestPoint(Point=move_8.Geometry, Curve=reparameterize(cir_3))  # -> Point, Parameter, Distance
seam_2 = Seam(Curve=reparameterize(cir_3), Seam=crv_cp.Parameter)
filter_4 = StreamFilter(Gate=enable_print_simulation_4, Stream1=seam_2)
boundary_3 = BoundarySurfaces(Edges=seam_2)
wasp40100_printing_area_srf = Data(boundary_3)
wasp40100_printing_area_crv = Data(filter_4)

wasp40100_printing_area_crv_2 = Data(wasp40100_printing_area_crv)
divide_2 = DivideCurve(Curve=wasp40100_printing_area_crv_2, Count="3", Kinks=False)  # -> Points, Tangents, Parameters
Z_5 = UnitZ(Factor=1)
line = LineSDL(Start=divide_2.Points, Direction=Z_5, Length=Slider(1000, range=0..1000))
wasp40100_z_axis_crvs = Data(line)

# ----
# comments & notes: compute inverse kinematics of arms
wasp40100_arm_length_3 = Data(wasp40100_arm_length_2)
cutplane_extruderfixtures_2 = Data(cutplane_extruderfixtures)
wasp40100_z_axis_crvs_2 = Data(wasp40100_z_axis_crvs)
extruder_attachmentpts_2 = Data(extruder_attachmentpts)
plx = LinePlane(Line=wasp40100_z_axis_crvs_2, Plane=cutplane_extruderfixtures_2)  # -> Point, ParamL, ParamP
ln = Line(StartPoint=extruder_attachmentpts_2, EndPoint=plx.Point)
len = Length(Curve=ln)
vec2pt = Vector2Pt(PointA=extruder_attachmentpts_2, PointB=plx.Point, Unitize=False)  # -> Vector, Length
Z_6 = UnitZ(Factor=1)
rtrig = RightTrigonometry(PLength=len, RLength=wasp40100_arm_length_3)  # -> Alpha, Beta, PLength, QLength, RLength
pl = ConstructPlane(Origin=extruder_attachmentpts_2, XAxis=vec2pt.Vector, YAxis=Z_6)
rotate = Rotate(Geometry=ln, Angle=rtrig.Alpha, Plane=pl)  # -> Geometry, Transform
end = EndPoints(Curve=rotate.Geometry)  # -> Start, End
wasp40100_arm_length_4 = Data(wasp40100_arm_length_3)
vec2pt_2 = Vector2Pt(PointA=end.Start, PointB=end.End, Unitize=False)  # -> unitize(Vector), Length
line_2 = LineSDL(Start=extruder_attachmentpts_2, Direction=vec2pt_2.Vector, Length=wasp40100_arm_length_4)
wasp40100_arm_crv = Data(line_2)

wasp40100_extrudermount_srf_2 = Data(wasp40100_extrudermount_srf)
wasp40100_nozzle_bot_2 = Data(wasp40100_nozzle_bot)
wasp40100_nozzle_toppart_2 = Data(wasp40100_nozzle_toppart)
wasp40100_nozzle_transition_2 = Data(wasp40100_nozzle_transition)
wasp40100_printing_area_srf_2 = Data(wasp40100_printing_area_srf)
wasp40100_z_axis_crvs_3 = Data(wasp40100_z_axis_crvs)
wasp40100_arm_crv_2 = Data(wasp40100_arm_crv)

wasp40100_nozzle_bot_3 = ClusterOutput(wasp40100_nozzle_bot_2)
wasp40100_arm_crv_3 = ClusterOutput(wasp40100_arm_crv_2)
wasp40100_z_axis_crvs_4 = ClusterOutput(wasp40100_z_axis_crvs_3)
wasp40100_nozzle_toppart_3 = ClusterOutput(wasp40100_nozzle_toppart_2)
wasp40100_nozzle_transition_3 = ClusterOutput(wasp40100_nozzle_transition_2)
wasp40100_extrudermount_srf_3 = ClusterOutput(wasp40100_extrudermount_srf_2)
wasp40100_printing_area_srf_3 = ClusterOutput(wasp40100_printing_area_srf_2)

# ==== cluster ConfigSetting: If an individual specific setting is input in S, it will be returned. Otherwise the config (C) setting, matching the input ID will be passed. The ID is an integer matching the branch number of the desired setting. The returned setting will have the data structure matching the input ID. Is anything other than a Xylinus Config is input to C, that data will simply be passed to S.
config = ClusterInput()
setting_number = ClusterInput()  # input an integer matching the branch number of the desired setting.
data = Data(config)
int = Integer(setting_number)

# ---- group: is it a config?
branch = TreeBranch(Tree=data, Path="{0}", MaintainPaths=True)
tmatch = MatchText(Text=branch, RegEx="config", Case=False)
int_2 = Integer(tmatch)
null = NullItem(Item=int_2)  # -> NullFlags, InvalidFlags, Description
filter = StreamFilter(Gate=null.NullFlags, Stream0=int_2, Stream1=0)

# ----
path = ConstructPath(Indices=int)

# ---- group: if so, pull the requested setting
branch_2 = TreeBranch(Tree=data, Path=path, MaintainPaths=True)

# ---- group: otherwise, just pass the input data
filter_2 = StreamFilter(Gate=filter, Stream0=data, Stream1=branch_2)
data_2 = Data(filter_2)

# ---- group: if something is passed in the Setting, use that value.
setting = ClusterInput()  # Individual specific setting. Will override the config setting.
data_3 = Data(setting)
null_coalescing = NullCoalescing(primary_data=data_3, secondary_data=data_2)

# ---- group: make the data structure match what is expected from the input
replace = ReplacePaths(Data=flatten(null_coalescing), Search="{0}", Replace=path)
setting_2 = ClusterOutput(replace)

# ==== cluster TrimTo: Trim the branches of a tree to a target length.
branch_depth = ClusterInput()  # The target branch depth. A flat terr is 0. {0} is one. {0;0} is two. etc.
data_to_trim = ClusterInput()
int = Integer(branch_depth)
data = Data(data_to_trim)
tstat = TreeStatistics(Tree=data)  # -> Paths, Length, Count
F = ClusterInput()
trim_front = Boolean(F)
split = TextSplit(Text=tstat.Paths, Separators="{;}")
empty = Text("")
mindex = MemberIndex(Set=split, Member=empty)  # -> Index, Count
cull_i = CullIndex(List=split, Indices=mindex.Index, Wrap=True)
dom = ConstructDomain(DomainStart=0, DomainEnd=expr("x-1", int))

lng = ListLength(List=cull_i)
subtraction = Subtraction(A=lng, B=int)

max = Maximum(A=0, B=subtraction)

dom_2 = ConstructDomain(DomainStart=max, DomainEnd=expr("x-1", lng))

filter = StreamFilter(Gate=trim_front, Stream0=dom, Stream1=dom_2)
subset = SubList(List=cull_i, Domain=filter, Wrap=False)  # -> List, Index
path = ConstructPath(Indices=subset.List)  # -> flatten(Branch)
replace = ReplacePaths(Data=data, Search=tstat.Paths, Replace=path)
D = ClusterOutput(replace)

# ==== cluster NullCoalescing: Passes the primary data input, unless it is null. In which case it passes the secondary data input to the output. (Like the ?? operator in C#)
primary_data = ClusterInput()  # If this input is not null, it will be passed tot he output.
secondary_data = ClusterInput()  # If the input to the primary data is null, this will be passed to the output.
data = Data(primary_data)
data_2 = Data(secondary_data)
null = NullItem(Item=data)  # -> NullFlags, InvalidFlags, Description
filter = StreamFilter(Gate=null.NullFlags, Stream0=data, Stream1=data_2)
data_3 = Data(filter)
data_4 = ClusterOutput(data_3)
