# Grasshopper definition 250303_Clay3DPrinting_Slicer.gh (Grasshopper 1.0.8)
# Copyright: Use it.  Mod it.  Share it. Just please give credit and kepp this party going.
# Copyright: Use it.  Mod it.  Share it. Just please give credit and keep this party going.
# plug-ins: Clipper2

# ----
# EXPERIMENTAL SLICER SETUP FOR CLAY PRINTING: Authors: Max Benjamin Eschenbach, Mirko Dutschke
# 
# Digital Design Unit (DDU)
# Prof. Dr.-Ing. Oliver Tessmann
# Fachbereich Architektur
# Technical University of Darmstadt
# 
# 
# 
# CREDITS:
# ------------
# ORIGINAL GCODE GENERATOR SCRIPT BY TOM SVILANS
# 
# ORIGINAL HEAT METHOD SCRIPT BY DANIEL PIKER
# 
# VCF AND DL COMPONENTS BY ANDERS HOLDEN DELEURAN
# 
# SOME XYLINUS CLUSTERS BY RYAN HOOVER ARE BEING USED
# BY Independent Studio  |  MICA dFab  |  BUGSS
# LEGEND
comments_notes = Panel("USER INTERACTION")
comments_notes_2 = Panel("GEOMETRY PROCESSING")
comments_notes_3 = Panel("VISUALISATION")
comments_notes_4 = Panel("OUTPUT")
comments_notes_5 = Panel("ANALYSIS")
comments_notes_6 = Panel("DO NOT TOUCH")
comments_notes_7 = Panel("CONTROL FLOW")
comments_notes_8 = Panel("ADVANCED FEATURE")

findscriptcomponents = Python3Script()  # -> out, a; disabled
# ---------- findscriptcomponents: Python ----------
"""Grasshopper Script Instance"""
import System
import Rhino
import Grasshopper

from pprint import pprint

import ScriptComponents as scomp
import RhinoCodePluginGH as rcpgh


class MyComponent(Grasshopper.Kernel.GH_ScriptInstance):

    def RunScript(self, Toggle):
        # Make GH component warning handler
        wh = Grasshopper.Kernel.GH_RuntimeMessageLevel.Remark
        
        # pprint(dir(scomp.Component_CSNET_Script.CreateSourceForEdit))
        
        cscomp = str(scomp.Component_CSNET_Script).split("'")[1]
        py3comp = str(rcpgh.Components.Python3Component).split("'")[1]
        pprint(dir(rcpgh.Components.Python3Component))
        
        # Iterate the canvas and get to the GHPython components
        TLOC = 0
        comps = ghenv.Component.OnPingDocument().Objects
        for obj in comps:
            obj_str = str(obj.GetType())
            if obj_str == cscomp:
                pprint(obj.NickName)
                pprint(obj.ScriptSource.ScriptCode)
            elif obj_str == py3comp:
                # pprint(obj.Code)
                pass
        
        return
# ---------- end findscriptcomponents ----------

# ----
# comments & notes: Save this File and aso save a .GHX copy of the file to the same folder as this file resides in.
# --> Please use this before pushing a new version to GitHub to make the changes somehow "trackable"
# DEPENDENCIES: DEPENDENCIES:
# 
# - Clipper2 Components
#   https://www.food4rhino.com/en/app/clipper2gh
autosave_gh_and_ghx = Trigger(Interval=10000, TimerInterval=10000, Target=autosave)  # disabled
autosave = BooleanToggle(True)  # disabled
save = Button()
or = GateOr(A=save, B=autosave)
saveandsaveghx = CSharpScript(Save=or)  # -> Message; inputs Save: Boolean
# ---------- saveandsaveghx: C# ----------
// Grasshopper Script Instance
#region Usings
using System;
using System.IO;
using System.Linq;
using System.Collections;
using System.Collections.Generic;
using System.Drawing;

using Rhino;
using Rhino.Geometry;

using Grasshopper;
using Grasshopper.Kernel;
using Grasshopper.Kernel.Data;
using Grasshopper.Kernel.Types;
#endregion

public class Script_Instance : GH_ScriptInstance
{
    #region Notes
    /* 
      Members:
        RhinoDoc RhinoDocument
        GH_Document GrasshopperDocument
        IGH_Component Component
        int Iteration

      Methods (Virtual & overridable):
        Print(string text)
        Print(string format, params object[] args)
        Reflect(object obj)
        Reflect(object obj, string method_name)
    */
    #endregion

    private void RunScript(bool Save, ref object Message)
    {
    // This output will tell us if the save succeeded or failed.
    // The active Grasshopper document in this scripting component context

    if (!Save)
    {
        return;
    }

    GH_Document doc = this.GrasshopperDocument;
    if (doc == null)
    {
        Message = "Error: GrasshopperDocument is null";
        return;
    }

    // Set current filepath
    string originalFilePath = doc.FilePath;
    string filePath = originalFilePath + "x";

    // Only attempt to save when 'saveTrigger' is set to true.
    if (!Save) return;
    
    // Make sure the parent directory exists
    if (!Directory.Exists(Path.GetDirectoryName(filePath)))
    {
        Message = "Error: directory does not exist";
        return;
    }

    // Create a GH_DocumentIO object based on our current GH_Document.
    GH_DocumentIO io = new GH_DocumentIO(doc);
    // Save this document
    io.Save();

    // Write the current document to an XML-based .ghx file
    bool success_a = io.SaveQuiet(filePath);
    bool success_b = io.SaveQuiet(originalFilePath);

    if (success_a && success_b)
        Message = $"File saved successfully:\n{filePath}";
    else
        Message = "Error: failed to save .ghx file.";
    }

}
# ---------- end saveandsaveghx ----------
panel = Panel(saveandsaveghx)

# ----
# VIEWCAPTURE &
# DEPENDENCIES
viewcapture = BooleanToggle(False)
openviewcapture = BooleanToggle(True)
viewcapturewidth = Slider(1920, range=0..10000)
viewcaptureheight = Slider(1080, range=0..10000)
vcf = ViewportCaptureToFile(
    Toggle=viewcapture,
    Width=viewcapturewidth,
    Height=viewcaptureheight,
    Grid=Toggle(False),
    WorldAxes=Toggle(False),
    CPlaneAxes=Toggle(False),
    OpenFile=openviewcapture)  # -> Path; inputs Width: Int32, Height: Int32, BackgroundColor: Color
# ---------- vcf: Python ----------
"""
Captures the Rhino viewport to an image file. Places the image in a folder called
Captures in the same directory as the GH definition. Names the image the same as 
the GH defintion followed by _hourMinuteSecond. Edit the script directly to set more options.
Note: Do not use this script with the GH button, freezes up the canvas for some reason.

    Inputs:
        Toggle: Activate the component using a boolean toggle. Do NOT use a Button {item,bool}
        BackgroundColor: Set the color of the Rhino viewport background {item,color,optional}
        Grid: Turn on the grid {item,bool,optional}
        WorldAxes:Turn on the world axes {item,bool,optional}
        CPlaneAxes: Turn on the cplane axes {item,bool,optional}
        OpenFile: If true the image will open in the default application {item,bool,optional}
    Outputs:
        Path: The path of the captured image {item,str}
    Remarks:
        Author: Anders Holden Deleuran (modified by Max Eschenbach)
        License: Apache License 2.0
        Version: 200324
"""
ghenv.Component.Name = "ViewportCaptureToFile"
ghenv.Component.NickName ="VCF"
ghenv.Component.Category = "FAHS"
ghenv.Component.SubCategory = "9 Utilities"

import os
import datetime
import System
import scriptcontext as sc
import Rhino as rc

def checkOrMakeFolder():
    """
    Check/makes a "Captures" folder in the GH def folder and a subfolder
    in the format 'YYMMDD'.
    """
    
    # construct timestamp for subfolder
    date = datetime.date.today()
    yy = str(date.year)[-2:]
    mm = str(date.month).zfill(2)
    dd = str(date.day).zfill(2)
    timestamp = yy + mm + dd
    
    if ghdoc.Path:
        folder = os.path.dirname(ghdoc.Path)
        captureFolder = folder + "\\Captures\\" + timestamp
        if not os.path.isdir(captureFolder):
            os.makedirs(captureFolder)
        return captureFolder

def makeFileName():
    
    """ Make a string with the gh def name + current hourMinuteSecond """
    
    # Make hour minute seconds string
    n = datetime.datetime.now()
    ho,mt,sc = str(n.hour),str(n.minute),str(n.second)
    if len(ho) == 1:
        ho = "0"+ ho
    if len(mt) == 1:
        mt = "0"+mt
    if len(sc) == 1:
        sc = "0"+ sc
    hms = ho+mt+sc
    
    # Get name of GH def
    ghDef = ghenv.LocalScope.ghdoc.Name.strip("*")
    
    # Concatenate and return
    fileName = ghDef + "_" + hms
    
    return fileName

def captureActiveViewToFile(width,height,path,grid,worldAxes,cplaneAxes):
    
    """
    Captures the active view to an image file at the path. Path looks like this:
    "C:\\Users\\adel\\Desktop\\Captures\\foooo_112747.png"
    """
    
    # Set the script context to the current Rhino doc
    sc.doc = rc.RhinoDoc.ActiveDoc
    
    # Get the active view and set image dimensions
    
    activeView = sc.doc.Views.ActiveView
    imageDim = System.Drawing.Size(width, height)
    
    # Perform the capture
    try:
        #imageCap = rc.Display.RhinoView.CaptureToBitmap(activeView,imageDim,grid,worldAxes,cplaneAxes)
        viewcap = rc.Display.ViewCapture()
        viewcap.DrawGrid = grid
        viewcap.DrawGridAxes = worldAxes
        viewcap.DrawAxes = cplaneAxes
        viewcap.Height = height
        viewcap.Width = width
        imageCap = viewcap.CaptureToBitmap(activeView)
        System.Drawing.Bitmap.Save(imageCap, path)
        rc.RhinoApp.WriteLine(path)
        sc.doc = ghdoc
        return path
    except Exception, e:
        print e
        sc.doc = ghdoc
        raise Exception(" Capture failed, check the path")

# Set background color
if BackgroundColor:
    rc.ApplicationSettings.AppearanceSettings.ViewportBackgroundColor = BackgroundColor


# Capture
if Toggle:
    
    if not Width:
        Width = 1920
    if not Height:
        Height = 1080
        
    capFolder = checkOrMakeFolder()
    
    fileName = makeFileName()
    try:
        path = os.path.join(capFolder,fileName + ".png")
        Path = captureActiveViewToFile(Width,Height,path,Grid,WorldAxes,CPlaneAxes)
        if OpenFile:
            os.startfile(path)
    except Exception, e:
        print e
        raise Exception(" Capture failed, save the GH definition")
# ---------- end vcf ----------

# ---- group: Check which plugins are being used
plugins = BooleanToggle(False)
dl = DefinitionLibraries(Toggle=plugins)  # -> Core, Adds
# ---------- dl: Python ----------
"""
Analyses the Grasshopper document for which plugins it uses (both vanilla and third party).

    Inputs:
        Toggle: Activate the component using a boolean toggle {item,bool}
    Outputs:
        Core: Standard plugins {item,str}
        Adds: Third party plugins {item,str}
    Remarks:
        Author: Giulio Piacentino (updated by Anders Holden Deleuran)
        License: Apache License 2.0
        Version: 200324
"""
ghenv.Component.Name = "DefinitionLibraries"
ghenv.Component.NickName ="DL"
ghenv.Component.Category = "GHPY_DEVTOOLS"
ghenv.Component.SubCategory = "0 Development"

import Grasshopper as gh

def libraries():
    
    coreLibraries = {}
    addonLibraries = {}
    objids = {}
    
    server = gh.Instances.ComponentServer
    for obj in ghenv.Component.OnPingDocument().Objects:
        
        if obj == ghenv.Component:
            continue #Ignore this component.
            
        objId = obj.ComponentGuid
        if objids.has_key(objId):
            continue
        objids[objId] = ""
        
        lib = server.FindAssemblyByObject(obj)
        if lib == None:
            continue
        if coreLibraries.has_key(lib.Id) or addonLibraries.has_key(lib.Id):
            continue
            
        if lib.IsCoreLibrary:
            coreLibraries[lib.Id] = lib
        else:
            addonLibraries[lib.Id] = lib
            
    return coreLibraries, addonLibraries


if Toggle:
    coreLibraries, addonLibraries = libraries()
    
    Core = []
    for id, lib in coreLibraries.iteritems():
        Core.append("{0} {1}".format(lib.Name, lib.Version))
    
    Adds = []
    for id, lib in addonLibraries.iteritems():
        Adds.append("{0} {1}".format(lib.Name, lib.Version))
# ---------- end dl ----------
panel_2 = Panel(dl.Adds)

# ----
# SETTINGS
comments_notes_9 = Panel("SETTINGS")

# ----
# ANALYSIS TOOLS
overhang_angle_analysis = BooleanToggle(False)
angle_analysis_resolution = Slider(50, range=0..100)
angle_analysis_threshold_degr = Slider(30, range=0..90)
layer_height_analysis = BooleanToggle(False)

# ----
# JUMP TO ...
# comments & notes: PRINT PATH MANIPULATION BEFORE SPIRAL
# comments & notes: PRINT PATH MANIPULATION AFTER SPIRAL
comments_notes_10 = Panel("EXTRUSION RATE MODIFIER")
comments_notes_11 = Panel("GCODE CREATION")
comments_notes_12 = Panel("CUSTOM CURVE INJECTION")

# ----
# GCODE GENERATION,
# SIMULATION & EXPORT
create_gcode = BooleanToggle(False)
enable_print_simulation = BooleanToggle(True)
hd_printing_visualisation = BooleanToggle(True)
show_printer = BooleanToggle(True)
vis_printing_progress = Slider(100, range=0..100)
save_gcode_to_file = Button()

# ----
# DO NOT CHANGE THIS!
wasp_40100_printing_diameter = Slider(400, range=0..1000)
wasp40100_arm_length = Slider(350, range=0..1500)

# ----
# Floor / Cap / Infill
# INFILL TYPES: INFILL / FLOOR / CAP TYPES
# 0 = CRISS-CROSS
# 1 = OFFSET
infill_before_walls = BooleanToggle(False)
add_floor_to_open_objects = BooleanToggle(False)
floor_type = Slider(1, range=0..1)
cap_type = Slider(1, range=0..1)
infill_wall_overlap = Slider(0.35, range=0..1)
cap_layer_count = Slider(2, range=0..10)
infill_fillet_radius = Slider(0.2, range=0..10)
infill_overlap = Slider(0.2, range=0..1)
synthesize_floor_for_custom_curves = BooleanToggle(False)
floor_layer_count = Slider(2, range=0..10)

# ----
# VISUALISATION
# Heads Up Display
# Base Geometry
# Layer Curves
# Print Layers
enable_heads_up_display = BooleanToggle(True)
render_print_geometry = BooleanToggle(True)
render_sharp_features = BooleanToggle(False)
render_layer_curves = BooleanToggle(True)
show_seam_points = BooleanToggle(True)
render_print_layers = BooleanToggle(True)
hd_layer_visualisation = BooleanToggle(True)

# ----
# SLICING SETTINGS
# General
# comments & notes: LAYER_HEIGHT: Controls the layer height of the print. For a 4mm Nozzle should be set to 1.9 mm for best results. You can modify it to create over/undercompressed layers on purpose.
# 
# LINE_WIDTH: Should be set exactly to the width of the nozzle. So 4mm for a 4mm nozzle.
# Seam Adjustment
# Spiralization
spiralize_contours = BooleanToggle(False)
mirkos_spiralization = BooleanToggle(False)
spiral_intro = Slider(0.6, range=0..0.95)
spiral_resolution = Slider(400, range=10..500)
spiral_outro = Slider(0.6, range=0..1)
layer_height = Slider(1.9, range=0.1..5)
skirt_offset = Slider(15, range=0..100)
line_width = Slider(4, range=0.1..10)
bypass_seam_adjustment = BooleanToggle(False)
randomize_seam = BooleanToggle(False)
rnd_seam_seed = Slider(15766, range=0..99999)
adjust_seam = Slider(0.15, range=0..1)

# ----
# CUSTOM CURVE INJECTION
# comments & notes: Using this toggle, you can inject custom curves that will be treated as print curves, without slicing or any other preprocessing of 3D geometry. This is useful if you want to experiment with very elaborate print paths.
inject_custom_curves = BooleanToggle(False)

spiral_ramp_percentage = Slider(100, range=0.01..100)

# ----
# PREPROCESSING
# & INPUT REMESHING
# comments & notes: TriRemesh: Will try to convert any input geometry to a homogeneous triangle mesh.
# 
# TriRemeshEdgeLength: Sets the desired edge length of each triangle for the remeshing process.
# 
# TriRemeshPreserveSharpfeatures: If set to 'True', will try to preserve sharp features (creases, pointy edges) during the remeshing process.
# comments & notes: ShrinkWrap: Will try to 'shrinkwrap' any input geometry by contracting a spherical mesh around it. Internal features will be lost!
# 
# RayMesh: Will try to 'prewrap' a spherical mesh around the geometry before shrinkwrapping / remeshing.
# 
# ReBrep: Will compute a Brep representation of a mesh. WARNING: Can take very very long!
triremesh = BooleanToggle(False)
trm_preserve_sharp_features = BooleanToggle(True)
trm_edge_length = Slider(8, range=0..100)

# ----
# INPUT & GEOMETRY PIPELINE
# comments & notes: DynamicUpdate: If set to 'True', will listen for changes in the Rhino document while a layer set is referenced.
# 
# CreateAndReference: If clicked, will create a new timestamped layer set and reference it.
# 
# LoadAndReference: If clicked, will try to load a previously created layer set (wherever the tick mark in the Rhino layer window is!).
dynamic_upadte = BooleanToggle(False)
create_and_reference = Button()
load_and_reference = Button()

# ----
# Non-Planar Slicing
# comments & notes: CAREFUL: This is quite an advanced option. If you want to experiment with it - great! You can do awesome things with NP slicing. But it may be still buggy and lead to some frustration ;-)
enable_non_planar_slicing = BooleanToggle(False)

# ----
# EXPERIMENTAL
# FEATURES
# BEST LEFT ALONE...
shrink_wrap = BooleanToggle(False)
ray_mesh = BooleanToggle(False)
re_brep = BooleanToggle(False)

panel_3 = Panel("""PrintingGeometry
NonPlanarBoundaries
AttractorGeometry""")
merge = Merge(
    Data1=ColourSwatch(SwatchColor=RGB(0, 0, 0)),
    Data2=ColourSwatch(SwatchColor=RGB(255, 0, 0)),
    Data3=ColourSwatch(SwatchColor=RGB(63, 209, 0)),
    Data4=ColourSwatch(SwatchColor=RGB(255, 0, 208)))

# ----
# DYNAMIC
# GEOMETRY
# INPUT
create_and_reference_2 = Data(create_and_reference)
load_and_reference_2 = Data(load_and_reference)
dynamic_upadte_2 = Data(dynamic_upadte)
comments_notes_13 = Panel("DYNAMIC GEOMETRY INPUT")
pc = PipelineController(
    DynamicUpdate=dynamic_upadte_2,
    CreateAndRef=create_and_reference_2,
    LoadAndRef=load_and_reference_2,
    ParentLayerPrefix="CLAYPRINT_",
    ReferenceLayers=panel_3,
    AssistanceLayers="AssistanceGeometry",
    LayerColours=merge)  # -> AssemblyGeo, CurrentLayers; inputs DynamicUpdate: Boolean, ReferenceLayers: list, AssistanceLayers: list, LayerColours: list of Color
# ---------- pc: Python ----------
"""
Provides an interface to work with interactive geometry pipelines.
    Inputs:
        DynamicUpdate: If True, the component will listen to changes in the Rhino document and update automatically. {item, boolean}
        CreateAndRef: Set to true to create new timestamped pipeline-layers and reference them. {item, boolean}
        LoadAndRef: Set to true to load existing pipeline-layers based on the currently active Rhino layer. {item, boolean}
        ParentLayerPrefix: The prefix for parent pipeline-layers {item, string}
        ReferenceLayers: Specify the referenced layer names here (i.e. connect a panel). {list, string}
        AssistanceLayers: Specify additional non-referenced assistance layers here (i.e. connect a panel). {list, string}
        LayerColours: Use this to specify a color for the layers that are created by the component. {list, string}
    Outputs:
        AssemblyGeo: The geometry in a datatree branched based on the specified layers. {tree, geometry}
        CurrentLayers: The currently referenced layers as strings. {list, string}
    Remarks:
        Author: Max Eschenbach
        License: MIT License
        Version: 200705
"""

# PYTHON STANDARD LIBRARY IMPORTS
from __future__ import division
import time

# GHPYTHON SDK IMPORTS
from ghpythonlib.componentbase import executingcomponent as component
import Grasshopper, GhPython
import System
import Rhino
import rhinoscriptsyntax as rs

# CUSTOM RHINO IMPORTS
import rhinoscriptsyntax as rs
import scriptcontext as sc
from scriptcontext import sticky as st

# ADDITIONAL IMPORTS
from System.Drawing import Color

# GHENV COMPONENT SETTINGS
ghenv.Component.Name = "PipelineController"
ghenv.Component.NickName = "PC"
ghenv.Component.Category = "Cockatoo"
ghenv.Component.SubCategory = "01 Pipeline Controlling"

class PipelineController(component):
    
    # UNIQUE STICKY KEY OR STORING LAYERNAMES
    LNKEY = str(ghenv.Component.InstanceGuid) + "___LAYERNAMES"
    EVKEY = str(ghenv.Component.InstanceGuid) + "___EVENTS"
    FLAG = str(ghenv.Component.InstanceGuid) + "___FLAG"
    
    # COMPONENT UPDATING -------------------------------------------------------
    
    def updateComponent(self):
        # define callback action
        def callBack(e):
            self.ExpireSolution(False)
        # get ghDoc
        ghDoc = self.OnPingDocument()
        # schedule new solution
        ghDoc.ScheduleSolution(1, Grasshopper.Kernel.GH_Document.GH_ScheduleDelegate(callBack))
    
    # EVENT HANDLING -----------------------------------------------------------
    
    def subscribe_to(self, event, func, key):
        if not self.EVKEY in st:
            st[self.EVKEY] = {}
        if key not in st[self.EVKEY]:
            st[self.EVKEY][key] = event
        ukey = str(self.InstanceGuid) + "_" + key
        if ukey not in st:
            st[ukey] = func
            event += st[ukey]
    
    def unsubscribe_all(self):
        if self.EVKEY in st:
            for key in st[self.EVKEY]:
                ukey = str(self.InstanceGuid) + "_" + key
                if ukey in st:
                    st[self.EVKEY][key] -= st[ukey]
                    st.Remove(ukey)
        st[self.EVKEY] = {}
    
    def flagEvent(self, sender, e):
        st[self.FLAG] = True
    
    def updateEvent(self, sender, e):
        if st[self.FLAG] == True:
            st[self.FLAG] = False
            self.updateComponent()
    
    def unsubEvent(self, sender, e):
        self.unsubscribe_all()
    
    # LAYER SET HANDLING -------------------------------------------------------
    
    def CreateReferenceLayers(self, parentPrefix, refLayers, norefLayers, colours):
        # get timestamp
        ts = time.strftime("%y%m%d_%H-%M")
        
        # create parent layer name
        parentLayername = parentPrefix + ts
        self.Message = "Referenced: " + str(parentLayername)
        
        # check if parent layer exists
        sc.doc = Rhino.RhinoDoc.ActiveDoc
        exists = rs.IsLayer(parentLayername)
        
        if exists:
            self.AddRuntimeMessage(self.RuntimeMessageLevel.Remark,
                "Parent Layer already exists! Returning valid existing layers.")
            # get all children layers
            allchildren = rs.LayerChildren(parentLayername)
            # check all children layers for validity
            validchildren = [parentLayername + "::" + vc for vc in refLayers]
            realchildren = []
            for c in allchildren:
                if c in validchildren:
                    realchildren.append(c)
            # set sticky to real found child layers
            st[self.LNKEY] = realchildren
            
            # switch back to ghdoc
            sc.doc = ghdoc
            
            # return layer names
            return realchildren
        else:
            # switch to Rhino doc
            sc.doc = Rhino.RhinoDoc.ActiveDoc
            
            # create parent layer
            parentLayer = rs.AddLayer(parentLayername, Color.Black)
            print parentLayername
            # create referenced layers
            newLayers = []
            for i, rl in enumerate(refLayers + norefLayers):
                lay = rs.AddLayer(parentLayername + '::' + rl, 
                                  colours[i])
                if rl in refLayers:
                    newLayers.append(lay)
            
            # add them to the sticky
            st[self.LNKEY] = newLayers
            
            # switch back to ghdoc
            scdoc = ghdoc
            
            # return layer names/paths
            return newLayers
    
    def LoadCurrentLayers(self, refLayers):
        # switch to RhinoDoc
        sc.doc = Rhino.RhinoDoc.ActiveDoc
        
        # retrieve current layer
        cl = rs.CurrentLayer()
        
        # check childcount
        childcount = rs.LayerChildCount(cl)
        
        # if no children, layer has to be childlayer or unrelated
        if childcount == 0:
            # get parent layer
            parent = rs.ParentLayer(cl)
            # switch back to GhDoc
            sc.doc = ghdoc
            if parent:
                allvalid = [parent + "::" + l for l in refLayers]
                # set message and return all valid children
                self.Message = "Referenced: " + str(parent)
                st[self.LNKEY] = allvalid
                return allvalid
            else:
                st[self.LNKEY] = None
                self.Message = None
                return None
        
        # if no children, layer has to be parent layer
        elif childcount > 0:
            parent = cl
            # switch back to GhDoc and return all valid layers
            scdoc = ghdoc
            if parent:
                allvalid = [parent + "::" + l for l in refLayers]
                # set message and return all valid children
                self.Message = "Referenced: " + str(parent)
                st[self.LNKEY] = allvalid
                return allvalid
        
        else:
            # switch back to GhDoc
            scdoc = ghdoc
            st[self.LNKEY] = None
            return None
    
    def retrieveGeometry(self, layers):
        geometry = []
        
        sc.doc = Rhino.RhinoDoc.ActiveDoc
        
        for i, layer in enumerate(layers):
            objs = [rs.coercegeometry(obj) for obj in rs.ObjectsByLayer(layer)]
            
            if objs == None:
                objs = []
            
            for i, obj in enumerate(objs):
                if type(obj) == Rhino.Geometry.Point:
                    objs[i] = Rhino.Geometry.Point3d(obj.Location)
            
            geometry.append(objs)
        
        sc.doc = ghdoc
        return geometry
    
    def RunScript(self, DynamicUpdate, CreateAndRef, LoadAndRef, ParentLayerPrefix, ReferenceLayers, AssistanceLayers, LayerColours):
        # check for unique key in sticky dictionary
        if not self.LNKEY in st:
            st[self.LNKEY] = None
        
        # define output variables ----------------------------------------------
        AssemblyGeo = Grasshopper.DataTree[object]()
        CurrentLayers = []
        
        # subscribe to events for automatic component updating -----------------
        if DynamicUpdate:
            self.subscribe_to(Rhino.RhinoDoc.BeforeTransformObjects, self.flagEvent, "BeforeTransformObjects")
            self.subscribe_to(Rhino.RhinoDoc.DeleteRhinoObject, self.flagEvent, "DeleteRhinoObject")
            self.subscribe_to(Rhino.RhinoDoc.AddRhinoObject, self.flagEvent, "AddRhinoObject")
            #self.subscribe_to(Rhino.RhinoDoc.LayerTableEvent, self.flagEvent, "LayerTableEvent")
            self.subscribe_to(Rhino.RhinoDoc.UndeleteRhinoObject, self.flagEvent, "UndeleteRhinoObjects")
            self.subscribe_to(Rhino.RhinoApp.Idle, self.updateEvent, "Idle")
            self.subscribe_to(Rhino.RhinoDoc.CloseDocument, self.unsubEvent, "CloseDocument")
            self.subscribe_to(Rhino.RhinoDoc.NewDocument, self.unsubEvent, "NewDocument")
        else:
            self.unsubscribe_all()
        
        # catch missing layer colours ------------------------------------------
        laycount = len(ReferenceLayers + AssistanceLayers)
        if not LayerColours or len(LayerColours) == 0:
            LayerColours = [Color.Black] * laycount
        elif len(LayerColours) < len(ReferenceLayers + AssistanceLayers):
            addCols = [Color.Black] * (laycount - len(LayerColours))
            LayerColours.extend(addCols)
        
        # if create button is pressed, create new layers and reference them ----
        if CreateAndRef == True:
            CurrentLayers = self.CreateReferenceLayers(ParentLayerPrefix,
                                                       ReferenceLayers,
                                                       AssistanceLayers,
                                                       LayerColours)
        # if load button is pressed, load from the current rhino-layer ---------
        elif LoadAndRef == True:
            # retrieve the current layerset based on the active rhino layer
            CurrentLayers = self.LoadCurrentLayers(ReferenceLayers)
        # if no button is pressed, make some checks and run standard procedure -
        elif self.LNKEY in st and st[self.LNKEY] != None:
            layer_names = st[self.LNKEY]
            CurrentLayers = layer_names
        # fall back and return if there are no layer names stored in sticky
        elif st[self.LNKEY] == None:
            try:
                # retrieve the current layerset based on the active rhino layer
                CurrentLayers = self.LoadCurrentLayers(ReferenceLayers)
            except:
                return AssemblyGeo, PipelineGeometry, CurrentLayers
        
        # retrieve all geometry
        if CurrentLayers:
            try:
                allgeometry = self.retrieveGeometry(CurrentLayers)
            except ValueError, errMsg:
                self.AddRuntimeMessage(self.RuntimeMessageLevel.Error,
                                       str(errMsg))
                allgeometry = None
        else:
            self.AddRuntimeMessage(self.RuntimeMessageLevel.Warning,
                "Could not load layerset. Check your current Rhino layer or " +
                "the controllers input parameters")
            allgeometry = None
        
        if allgeometry:
            for i, geo in enumerate(allgeometry):
                AssemblyGeo.AddRange(geo, Grasshopper.Kernel.Data.GH_Path(i))
        
        # return outputs
        return AssemblyGeo, CurrentLayers
# ---------- end pc ----------
assemblygeo = Data(pc.AssemblyGeo)
bang = ExplodeTree(Data=assemblygeo)  # -> Branch0, Branch1, Branch2
nonplanarboundaries = Data(bang.Branch1)
attractorgeometry = Data(bang.Branch2)
printinggeometry = Data(bang.Branch0)

# ----
# DEPRECATED / SAFEKEEPING
includeptsinmesh = CSharpScript()  # -> out, FM; inputs M: Mesh, P: list of Point3d; disabled
# ---------- includeptsinmesh: C# ----------
    if (M != null && P != null)
    {
      FM = IncludePtsInMesh(M, P);
    }
# ---------- includeptsinmesh: C# additional code ----------
  private Mesh IncludePtsInMesh(Mesh M, List<Point3d> Pts)
  {
    // duplicate the mesh
    Mesh FM = M.DuplicateMesh();

    // for every point in pts
    for (int i = 0; i < Pts.Count; i++)
    {
      MeshPoint mp = FM.ClosestMeshPoint(Pts[i], 0.0);

      // if meshpoint is valid
      if(mp != null)
      {
        // add meshpoint as vertex to mesh
        int v = FM.Vertices.Add(FM.PointAt(mp));

        // if meshpoint is on a face
        if (mp.ComponentIndex.ComponentIndexType == ComponentIndexType.MeshFace)
        {
          // print info
          // Print(String.Format("MeshFace type at index {0}!", i));
          // get face index
          int f = mp.FaceIndex;
          // get valence of face - 4 if quad, 3 if not
          int fi = FM.Faces[f].IsQuad ? 4 : 3;
          // for every vertex of the face
          for(int j = 0;j < fi;j++)
          {
            // add triangular face between this vtx, next vtx and the meshpoint vtx
            FM.Faces.AddFace(FM.Faces[f][j], FM.Faces[f][(j + 1) % fi], v);
          }
          // finally, remove the original face
          FM.Faces.RemoveAt(f);
          // set vertex position to real point
          FM.Vertices.SetVertex(v, Pts[i]);
        }
        // if meshpoint is on an edge
        else if (mp.ComponentIndex.ComponentIndexType == ComponentIndexType.MeshTopologyEdge)
        {
          // print info
          // Print(String.Format("MeshTopologyEdge type at index {0}!", i));
          // split the edge at the meshpoint's edge parameter
          FM.TopologyEdges.SplitEdge(mp.ComponentIndex.Index, mp.EdgeParameter);
          // set vertex position to real point
          FM.Vertices.SetVertex(v, Pts[i]);
        }

        else if (mp.ComponentIndex.ComponentIndexType == ComponentIndexType.MeshTopologyVertex)
        {
          // print info
          // Print(String.Format("TopologyVertex type at index {0}!", i));
          // get all vertex indices that this topologyvertex represents
          int[] vids = FM.TopologyVertices.MeshVertexIndices(mp.ComponentIndex.Index);

          // set all vertices to the real point
          for (int j = 0; j < vids.Length; j++)
          {
            FM.Vertices.SetVertex(vids[j], Pts[i]);
          }
        }
        else if (mp.ComponentIndex.ComponentIndexType == ComponentIndexType.MeshVertex)
        {
          // print info
          Print(String.Format("Vertex type at index {0}!", i));
        }
        else if (mp.ComponentIndex.ComponentIndexType == ComponentIndexType.MeshNgon)
        {
          // print info
          Print(String.Format("Ngon type at index {0}!", i));
        }

        // rebuild normals
        FM.RebuildNormals();
        // remove any unreferenced objects and re-index mesh
        FM.Compact();
      }
      else
      {
        Print("MeshPoint is invalid!");
      }
    }
    return FM;
  }
# ---------- end includeptsinmesh ----------
panel_4 = Panel(includeptsinmesh.out)  # disabled

orderbranchingslicecurves = CSharpScript()  # -> out, OC; inputs C: tree of Curve; disabled
# ---------- orderbranchingslicecurves: C# usings ----------
using Rhino.Collections;
# ---------- orderbranchingslicecurves: C# ----------
    OC = OrderSliceCurves(C);
# ---------- orderbranchingslicecurves: C# additional code ----------
  public DataTree<Curve> OrderSliceCurves(DataTree<Curve> SliceCurves)
  {
    // loop over datatree and ensure correct order
    for (int i = 0; i < SliceCurves.BranchCount - 1; i++)
    {
      // get branches
      var this_branch = SliceCurves.Branches[i];
      var next_branch = SliceCurves.Branches[i + 1];

      // case 1: this branch one curve and next branch one curve
      if (this_branch.Count == 1 && next_branch.Count == 1)
      {
        Print("Case 1, 1 -> 1 (nothing done)");
        // nothing needs to be done
      }
        // case 2: this branch one curve and next branch multiple curves
      else if (this_branch.Count == 1 && next_branch.Count > 1)
      {
        Print("Case 2, 1 -> N");
        // loop over next branch and find all centerpoints to compare against
        Point3dList ptL = new Point3dList();
        for (int k = 0; k < next_branch.Count; k++)
        {
          Point3d cpB = AreaMassProperties.Compute(next_branch[k]).Centroid;
          ptL.Add(cpB);
        }
        // create new list for storage
        List<Curve> OrderedNextBranch = new List<Curve>();
        // get curve centerpoint
        Point3d cpA = AreaMassProperties.Compute(this_branch[0]).Centroid;
        // compare against point3dlist of other centerpoints
        int idx = ptL.ClosestIndex(cpA);
        OrderedNextBranch.Add(next_branch[idx].DuplicateCurve());
        next_branch.RemoveAt(idx);
        OrderedNextBranch.AddRange(next_branch);
        // clear data
        ptL.Clear();
        // restructure next branch of contours tree
        SliceCurves.Branches[i + 1].Clear();
        SliceCurves.Branches[i + 1].AddRange(OrderedNextBranch);
      }
        // case 3: this branch and next branch have multiple curves but the same count
      else if (this_branch.Count > 1 && this_branch.Count == next_branch.Count)
      {
        Print("Case 3, N -> N");
        // create new list for storage
        List<Curve> OrderedNextBranch = new List<Curve>();
        // loop over all curves in this branch
        for (int j = 0; j < this_branch.Count; j++)
        {
          if (next_branch.Count < 1) break;
          // loop over next branch and find all centerpoints to compare against
          Point3dList ptL = new Point3dList();
          for (int k = 0; k < next_branch.Count; k++)
          {
            Point3d cpB = AreaMassProperties.Compute(next_branch[k]).Centroid;
            ptL.Add(cpB);
          }
          // get curve centerpoint
          Point3d cpA = AreaMassProperties.Compute(this_branch[j]).Centroid;
          // compare against point3dlist of other centerpoints
          int idx = ptL.ClosestIndex(cpA);
          // add closest item to ordered list
          OrderedNextBranch.Add(next_branch[idx].DuplicateCurve());
          // remove closest item from candidates
          next_branch.RemoveAt(idx);
          // clear data
          ptL.Clear();
        }
        // restructure next branch of contours tree
        SliceCurves.Branches[i + 1].Clear();
        SliceCurves.Branches[i + 1].AddRange(OrderedNextBranch);
      }
        // case 4: this branch has more curves than next branch
      else if (this_branch.Count > 1 && next_branch.Count > 1 && this_branch.Count > next_branch.Count)
      {
        Print("Case 4, N -> M>N (VERIFY!)");
        // create new list for storage
        List<Curve> OrderedNextBranch = new List<Curve>();
        // loop over all curves in this branch
        for (int j = 0; j < this_branch.Count; j++)
        {
          if (next_branch.Count < 1) break;
          // loop over next branch and find all centerpoints to compare against
          Point3dList ptL = new Point3dList();
          for (int k = 0; k < next_branch.Count; k++)
          {
            Point3d cpB = AreaMassProperties.Compute(next_branch[k]).Centroid;
            ptL.Add(cpB);
          }
          // get curve centerpoint
          Point3d cpA = AreaMassProperties.Compute(this_branch[j]).Centroid;
          // compare against point3dlist of other centerpoints
          int idx = ptL.ClosestIndex(cpA);
          // add closest item to ordered list
          OrderedNextBranch.Add(next_branch[idx].DuplicateCurve());
          // remove closest item from candidates
          next_branch.RemoveAt(idx);
          // clear data
          ptL.Clear();
        }
        // restructure next branch of contours tree
        SliceCurves.Branches[i + 1].Clear();
        SliceCurves.Branches[i + 1].AddRange(OrderedNextBranch);
      }
        // case 5: this branch has less curves than next branch
      else if (this_branch.Count > 1 && next_branch.Count > 1 && this_branch.Count < next_branch.Count)
      {
        Print("Case 5, N -> M<N (VERIFY)");
        // loop over next branch and find all centerpoints to compare against
        Point3dList ptL = new Point3dList();
        for (int k = 0; k < next_branch.Count; k++)
        {
          Point3d cpB = AreaMassProperties.Compute(next_branch[k]).Centroid;
          ptL.Add(cpB);
        }
        // create new list for storage
        List<Curve> OrderedNextBranch = new List<Curve>();
        // create duplicate list for looping
        List<Curve> next_branch_dup = new List<Curve>(next_branch);
        // loop over all curves in this branch
        for (int j = 0; j < this_branch.Count; j++)
        {
          // get curve centerpoint
          Point3d cpA = AreaMassProperties.Compute(this_branch[j]).Centroid;
          // compare against point3dlist of other centerpoints
          int idx = ptL.ClosestIndex(cpA);
          // add closest curve based on comparison to new list
          OrderedNextBranch.Add(next_branch[idx].DuplicateCurve());
          next_branch_dup.Remove(next_branch[idx]);
        }
        // add remaining curves from next branch to list
        OrderedNextBranch.AddRange(next_branch_dup);
        // clear data
        ptL.Clear();
        // restructure next branch of contours tree
        SliceCurves.Branches[i + 1].Clear();
        SliceCurves.Branches[i + 1].AddRange(OrderedNextBranch);
      }
        // case 6: this branch has multiple curves but next branch only has one
      else if (this_branch.Count > 1 && next_branch.Count == 1)
      {
        Print("Case 6, N -> 1 (nothing done)");
      }
    }

    return SliceCurves;
  }
# ---------- end orderbranchingslicecurves ----------
orderbranchingslicesurfacesamp = CSharpScript()  # -> out, OS; inputs S: tree of Brep; disabled
# ---------- orderbranchingslicesurfacesamp: C# ----------
    OS = OrderSliceSurfaces(S);
# ---------- orderbranchingslicesurfacesamp: C# additional code ----------
  public DataTree<Brep> OrderSliceSurfaces(DataTree<Brep> SliceSurfaces)
  {
    // loop over datatree and ensure correct order
    for (int i = 0; i < SliceSurfaces.BranchCount - 1; i++)
    {
      // get branches
      var this_branch = SliceSurfaces.Branches[i];
      var next_branch = SliceSurfaces.Branches[i + 1];

      // case 1: this branch one curve and next branch one curve
      if (this_branch.Count == 1 && next_branch.Count == 1)
      {
        Print("Case 1, 1 -> 1 (nothing done)");
        // nothing needs to be done
      }
        // case 2: this branch one curve and next branch multiple curves
      else if (this_branch.Count == 1 && next_branch.Count > 1)
      {
        Print("Case 2, 1 -> N");
        // loop over next branch and find all centerpoints to compare against
        Point3dList ptL = new Point3dList();
        for (int k = 0; k < next_branch.Count; k++)
        {
          Point3d cpB = AreaMassProperties.Compute(next_branch[k]).Centroid;
          ptL.Add(cpB);
        }
        // create new list for storage
        List<Brep> OrderedNextBranch = new List<Brep>();
        // get curve centerpoint
        Point3d cpA = AreaMassProperties.Compute(this_branch[0]).Centroid;
        // compare against point3dlist of other centerpoints
        int idx = ptL.ClosestIndex(cpA);
        OrderedNextBranch.Add((Brep) next_branch[idx].Duplicate());
        next_branch.RemoveAt(idx);
        OrderedNextBranch.AddRange(next_branch);
        // clear data
        ptL.Clear();
        // restructure next branch of contours tree
        SliceSurfaces.Branches[i + 1].Clear();
        SliceSurfaces.Branches[i + 1].AddRange(OrderedNextBranch);
      }
        // case 3: this branch and next branch have multiple curves but the same count
      else if (this_branch.Count > 1 && this_branch.Count == next_branch.Count)
      {
        Print("Case 3, N -> N");
        // create new list for storage
        List<Brep> OrderedNextBranch = new List<Brep>();
        // loop over all curves in this branch
        for (int j = 0; j < this_branch.Count; j++)
        {
          if (next_branch.Count < 1) break;
          // loop over next branch and find all centerpoints to compare against
          Point3dList ptL = new Point3dList();
          for (int k = 0; k < next_branch.Count; k++)
          {
            Point3d cpB = AreaMassProperties.Compute(next_branch[k]).Centroid;
            ptL.Add(cpB);
          }
          // get curve centerpoint
          Point3d cpA = AreaMassProperties.Compute(this_branch[j]).Centroid;
          // compare against point3dlist of other centerpoints
          int idx = ptL.ClosestIndex(cpA);
          // add closest item to ordered list
          OrderedNextBranch.Add((Brep) next_branch[idx].Duplicate());
          // remove closest item from candidates
          next_branch.RemoveAt(idx);
          // clear data
          ptL.Clear();
        }
        // restructure next branch of contours tree
        SliceSurfaces.Branches[i + 1].Clear();
        SliceSurfaces.Branches[i + 1].AddRange(OrderedNextBranch);
      }
        // case 4: this branch has more curves than next branch
      else if (this_branch.Count > 1 && next_branch.Count > 1 && this_branch.Count > next_branch.Count)
      {
        Print("Case 4, N -> M>N (VERIFY!)");
        // create new list for storage
        List<Brep> OrderedNextBranch = new List<Brep>();
        // loop over all curves in this branch
        for (int j = 0; j < this_branch.Count; j++)
        {
          if (next_branch.Count < 1) break;
          // loop over next branch and find all centerpoints to compare against
          Point3dList ptL = new Point3dList();
          for (int k = 0; k < next_branch.Count; k++)
          {
            Point3d cpB = AreaMassProperties.Compute(next_branch[k]).Centroid;
            ptL.Add(cpB);
          }
          // get curve centerpoint
          Point3d cpA = AreaMassProperties.Compute(this_branch[j]).Centroid;
          // compare against point3dlist of other centerpoints
          int idx = ptL.ClosestIndex(cpA);
          // add closest item to ordered list
          OrderedNextBranch.Add((Brep) next_branch[idx].Duplicate());
          // remove closest item from candidates
          next_branch.RemoveAt(idx);
          // clear data
          ptL.Clear();
        }
        // restructure next branch of contours tree
        SliceSurfaces.Branches[i + 1].Clear();
        SliceSurfaces.Branches[i + 1].AddRange(OrderedNextBranch);
      }
        // case 5: this branch has less curves than next branch
      else if (this_branch.Count > 1 && next_branch.Count > 1 && this_branch.Count < next_branch.Count)
      {
        Print("Case 5, N -> M<N (VERIFY)");
        // loop over next branch and find all centerpoints to compare against
        Point3dList ptL = new Point3dList();
        for (int k = 0; k < next_branch.Count; k++)
        {
          Point3d cpB = AreaMassProperties.Compute(next_branch[k]).Centroid;
          ptL.Add(cpB);
        }
        // create new list for storage
        List<Brep> OrderedNextBranch = new List<Brep>();
        // create duplicate list for looping
        List<Brep> next_branch_dup = new List<Brep>(next_branch);
        // loop over all curves in this branch
        for (int j = 0; j < this_branch.Count; j++)
        {
          // get curve centerpoint
          Point3d cpA = AreaMassProperties.Compute(this_branch[j]).Centroid;
          // compare against point3dlist of other centerpoints
          int idx = ptL.ClosestIndex(cpA);
          // add closest curve based on comparison to new list
          OrderedNextBranch.Add((Brep) next_branch[idx].Duplicate());
          next_branch_dup.Remove(next_branch[idx]);
        }
        // add remaining curves from next branch to list
        OrderedNextBranch.AddRange(next_branch_dup);
        // clear data
        ptL.Clear();
        // restructure next branch of contours tree
        SliceSurfaces.Branches[i + 1].Clear();
        SliceSurfaces.Branches[i + 1].AddRange(OrderedNextBranch);
      }
        // case 6: this branch has multiple curves but next branch only has one
      else if (this_branch.Count > 1 && next_branch.Count == 1)
      {
        Print("Case 6, N -> 1 (nothing done)");
      }
    }

    return SliceSurfaces;
  }
# ---------- end orderbranchingslicesurfacesamp ----------

# ----
# comments & notes: connect your input geometry here if you have specified or modeled it manually.
# 
# MAKE SURE THAT THE INPUT HERE IS ONE SINGLE OBJECT (BREP or MESH)!
input_geometry = Geometry(printinggeometry)

crv = Curve(<curve referenced from the Rhino model>)  # disabled
crv_2 = Curve(<curve referenced from the Rhino model>)  # disabled
number_slider = Slider(3, range=0..10)  # disabled
crv_3 = Curve(<curve referenced from the Rhino model>)  # disabled
crv_4 = Curve(<curve referenced from the Rhino model>)  # disabled
crv_5 = Curve(<curve referenced from the Rhino model>)  # disabled
number_slider_2 = Slider(1000, range=0..1000)  # disabled
merge_2 = Merge(Data1=crv, Data2=crv_5, Data3=crv_2, Data4=crv_4)  # disabled
number_slider_3 = Slider(0, range=0..100)  # disabled
number_slider_4 = Slider(0, range=0..4)  # disabled
toggle = BooleanToggle(True)  # disabled
reb = RebuildCurve(Curve=merge_2, Degree=number_slider, Count=number_slider_2, Tangents=True)  # disabled
loft_opt = LoftOptions(Closed=False, Adjust=toggle, Rebuild=number_slider_3, Refit=0, Type=number_slider_4)  # disabled
loft = Loft(Curves=reb, Options=loft_opt)  # disabled
preview = CustomPreview(
    Geometry=loft,
    Material={diffuse=RGB(221, 160, 221), emission=RGB(66, 48, 66), shine=0.5, specular=RGB(255, 255, 255), transparency=0})  # disabled

comments_notes_14 = Panel("ETO INTERFACE")
number_slider_5 = Slider(1, range=0..10)  # disabled
number_slider_6 = Slider(5, range=0..10)  # disabled
button = Button()  # disabled
python = GhPythonScript(x=number_slider_6, y=number_slider_5, z=button)  # -> out, a, b; disabled
# ---------- python: Python ----------
import System
import Rhino.UI
import Eto.Drawing as drawing
import Eto.Forms as forms
import Eto
import scriptcontext as sc

class OptionsPanel(forms.Form):

   def __init__(self):

       self.m_slider = forms.Slider()
       self.m_slider.TickFrequency = 10
       self.m_slider.MinValue = 1
       self.m_slider.MaxValue = 100
       self.m_slider.Value = x
       self.m_slider.ValueChanged += self.OnSliderValueChanged
       self.m_numeric_updown = forms.NumericUpDown()
       self.m_numeric_updown.DecimalPlaces = 0
       self.m_numeric_updown.Increment = 1
       self.m_numeric_updown.MaxValue = 100.0
       self.m_numeric_updown.MinValue = 1.0
       self.m_numeric_updown.Value = x
       self.m_numeric_updown.ValueChanged += self.OnNumericChanged
       self.o_slider = forms.Slider()
       self.o_slider.TickFrequency = 10
       self.o_slider.MinValue = 1
       self.o_slider.MaxValue = 60
       self.o_slider.Value = y
       self.o_slider.ValueChanged += self.OnSliderValueChanged
       self.o_numeric_updown = forms.NumericUpDown()
       self.o_numeric_updown.DecimalPlaces = 0
       self.o_numeric_updown.Increment = 1
       self.o_numeric_updown.MaxValue = 60
       self.o_numeric_updown.MinValue = 1.0
       self.o_numeric_updown.Value = y
       self.o_numeric_updown.ValueChanged += self.OnNumericChanged

       self.o_numeric_updown.ValueBinding.Bind(self.o_slider, "Value", Eto.Forms.DualBindingMode.TwoWay)
       self.m_numeric_updown.ValueBinding.Bind(self.m_slider, "Value", Eto.Forms.DualBindingMode.TwoWay)


       self.Initialize()
       self.CreateFormControls()

   def Initialize(self):
       self.Padding = drawing.Padding(10)
       self.Resizable = False
       self.Topmost = True
       self.Closed += self.OnFormClosed

   def CreateFormControls(self):
       layout = forms.DynamicLayout()
       layout.Spacing = drawing.Size(5, 5)
       layout.AddRow(None)
       layout.AddRow(self.m_slider, self.m_numeric_updown)
       layout.AddRow(None)
       layout.AddRow(self.o_slider, self.o_numeric_updown)
       layout.AddRow(None)
       self.Content = layout

   def OnSliderValueChanged(self, sender, e):
       ghenv.Component.ExpireSolution(True)

   def OnNumericChanged(self, sender, e):
       ghenv.Component.ExpireSolution(True)


   def GetNumber1(self):
       return self.m_numeric_updown.Value

   def GetNumber2(self):
       return self.o_slider.Value
       
   def OnFormClosed(self, sender, e):
       if sc.sticky.has_key('form'):
           form = sc.sticky['form']
           if form:
               form.Dispose()
               form = None
           sc.sticky.Remove('form')

def Dostuff():
   if sc.sticky.has_key('form'):
       return
   form = OptionsPanel();
   form.Show()
   sc.sticky['form'] = form

if z == True:
   Dostuff()

if sc.sticky.has_key('form'):
   form = sc.sticky['form']
   value1 = form.GetNumber1()
   value2 = form.GetNumber2()
else:
   value1 = x
   value2 = y

a = value1
b = value2
# ---------- end python ----------

# ----
# INPUT GEOMETRY
bbox = BoundingBox(Content=flatten(input_geometry), Plane=PlaneXY(0, 0, 0), UnionBox=True)  # -> Box, Box_2
comments_notes_15 = Panel("INPUT GEOMETRY")
volume = Volume(Geometry=bbox.Box)  # -> Volume, Centroid
debox = DeconstructBox(Box=bbox.Box)  # -> Plane, X, Y, Z
pdecon = Deconstruct(Point=volume.Centroid)  # -> XComponent, YComponent, ZComponent
dedomain = DeconstructDomain(Domain=debox.Z)  # -> Start, End
pt = ConstructPoint(XCoordinate=pdecon.XComponent, YCoordinate=pdecon.YComponent, ZCoordinate=dedomain.Start)
xy = XYPlane(Origin=Point(0, 0, 0))
vec2pt = Vector2Pt(PointA=pt, PointB=xy, Unitize=False)  # -> Vector, Length
inject_custom_curves_2 = Data(inject_custom_curves)
move = Move(Geometry=input_geometry, Motion=vec2pt.Vector)  # -> Geometry, Transform
filter = StreamFilter(Gate=inject_custom_curves_2, Stream0=move.Geometry)
input_geometry_2 = Geometry(filter)

# ----
# REMESHING
comments_notes_16 = Panel("REMESHING")

number_slider_7 = Slider(19, range=0..20)

infill_wall_overlap_2 = Data(infill_wall_overlap)
linewidth = Data(line_width)
infill_overlap_2 = Data(infill_overlap)
multiplication = Multiplication(A="0.5", B=linewidth)
multiplication_2 = Multiplication(A=multiplication, B=infill_overlap_2)
multiplication_3 = Multiplication(A=multiplication, B=infill_wall_overlap_2)
comments_notes_17 = Panel("compute offset distances")
subtraction = Subtraction(A=linewidth, B=multiplication_2)
subtraction_2 = Subtraction(A=linewidth, B=multiplication_3)
offset_inkl_ii_overlap = Data(subtraction)
offset_inkl_iw_overlap = Data(subtraction_2)
offset_half_linewidth = Data(multiplication)

osselector = GhPythonScript()  # -> out, B
# ---------- osselector: Python ----------
from __future__ import print_function
import os

__author__ = "EFESTWIN"
__version__ = "2023.05.10"

if os.name == "nt":
    print("OS is Microsoft Windows")
    B = False
elif os.name == "posix":
    print("OS is Mac OSX")
    B = True
# ---------- end osselector ----------
# comments & notes: NON-PLANAR SLICING FOR OPEN OBJECTS
panel_5 = Panel(osselector.out)

c_script = CSharpScript()  # -> out, a
# ---------- c_script: C# ----------
// Grasshopper Script Instance
#region Usings
using System;
using System.Linq;
using System.Collections;
using System.Collections.Generic;
using System.Drawing;

using Rhino;
using Rhino.Geometry;

using Grasshopper;
using Grasshopper.Kernel;
using Grasshopper.Kernel.Data;
using Grasshopper.Kernel.Types;
#endregion

public class Script_Instance : GH_ScriptInstance
{
    #region Notes
    /* 
      Members:
        RhinoDoc RhinoDocument
        GH_Document GrasshopperDocument
        IGH_Component Component
        int Iteration

      Methods (Virtual & overridable):
        Print(string text)
        Print(string format, params object[] args)
        Reflect(object obj)
        Reflect(object obj, string method_name)
    */
    #endregion

    private void RunScript(object x, object y, ref object a)
    {
        // Write your logic here
        a = null;
    }
}
# ---------- end c_script ----------

path = FilePath("C:\Users\EFESTWIN\Documents\07_tu_darmstadt_ddu\08_Forschung\2022_01_Printsugi\10_Grasshopper_Workflow\200704_HeatMethod_Texture.png")  # disabled
texshader = LoadTextureAsShader(Texture=path)  # -> Shader; inputs Texture: String; disabled
# ---------- texshader: C# usings ----------
using Rhino.DocObjects;
# ---------- texshader: C# ----------
                        /*
    Original Script by Daniel Piker 03/07/2020
    Modified by Max Eschenbach
    version: 230126
    */

    // set component params
    this.Component.Name = "LoadTextureAsShader";
    this.Component.NickName = "TexShader";
    this.Component.Category = "FindersKeepers";
    this.Component.SubCategory = "4 Visualisation";

    // sanitize data input
    if (Texture == null)
    {
      this.Component.AddRuntimeMessage(GH_RuntimeMessageLevel.Warning,
        "Input Parameter Texture failed to collect data!");
    }

    Material mat = new Material();
    mat.SetBitmapTexture(Texture);
    Shader = new GH_Material(Rhino.Render.RenderMaterial.CreateBasicMaterial(mat, RhinoDoc.ActiveDoc));
# ---------- end texshader ----------
heatmesh = Mesh(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)  # disabled
pt_2 = Point(Point(50, 50, 0))  # disabled
isoval = Slider(1, range=0..1)  # disabled
rendermeshtoscreen = RenderMeshToScreen(Mesh=heatmesh, ScreenPt=pt_2, Shader=texshader)  # inputs Mesh: Mesh, ScreenPt: Point3d; disabled
# ---------- rendermeshtoscreen: Python ----------
# PYTHON STANDARD LIBRARY IMPORTS
from __future__ import division, print_function
import json
import math
import traceback

# GHPYTHON SDK IMPORTS
from ghpythonlib.componentbase import executingcomponent as component
import Grasshopper, GhPython
import System
import Rhino
import rhinoscriptsyntax as rs

# GHENV COMPONENT SETTINGS
ghenv.Component.Name = "RenderMeshToScreen"
ghenv.Component.NickName = "RenderMeshToScreen"
ghenv.Component.Category = "FindersKeepers"
ghenv.Component.SubCategory = "03 Visualisation"

class RenderMeshToScreen(component):
    
    _is_bound = False
    
    def RunScript(self, Mesh, ScreenPt, Shader, Scale):
        
        if Mesh and ScreenPt:
            # event handling
            if not self._is_bound:
                self.__enter__()
            
            # compute vmp and centroid
            vmp = Rhino.Geometry.VolumeMassProperties.Compute(Mesh)
            meshcenter = vmp.Centroid
            
            # settings
            self.mesh = Mesh
            self.screenpt = ScreenPt
            self.shader = Shader
            self.scale = Scale
            self.meshcenter = meshcenter
            
        else:
            self.__exit__()
    
    
    def DrawForeground(self, sender, arg):
        if self.drawingWires and self.mesh:
            self.drawingWires = False
            try:
                if arg.Display.Viewport.Id == arg.RhinoDoc.Views.ActiveView.ActiveViewportID:
                    
                    # create initital anchorpt on top left with margins
                    anchorpt = self.screenpt.Clone()
                    
                    # draw mesh
                    self.DrawMeshToScreen(anchorpt, self.mesh.Duplicate(), self.shader, self.scale, arg)
            
            except Exception as e:
                tb = traceback.format_exc()
                System.Windows.Forms.MessageBox.Show(
                                    tb,
                                    'Error while drawing preview!')

    
    def DrawMeshToScreen(self, anchorpt, mesh, shader, scale, arg):
        
        """
        Draw a Mesh on the screen.
        """
        # get draw plane
        far_corners = arg.Display.Viewport.GetFarRect()
        near_corners = arg.Display.Viewport.GetNearRect()
        view_corners = [
            (far_corners[0] * 0.15 + near_corners[0] * 0.85),
            (far_corners[1] * 0.15 + near_corners[1] * 0.85),
            (far_corners[2] * 0.15 + near_corners[2] * 0.85)]
        
        view_width = view_corners[0].DistanceTo(view_corners[1])
        view_height = view_corners[0].DistanceTo(view_corners[2])
        
        # contruct drawing plane
        draw_plane = Rhino.Geometry.Plane(view_corners[0],
                                          view_corners[1],
                                          view_corners[2])
        draw_plane.Translate(draw_plane.ZAxis * -1)
        
        # get scaling factor
        uppx = arg.Display.Viewport.GetWorldToScreenScale(anchorpt)[1]
        wcs = Rhino.DocObjects.CoordinateSystem.World
        scs = Rhino.DocObjects.CoordinateSystem.Screen
        xstw = arg.Display.Viewport.GetTransform(scs, wcs)
        xwts = arg.Display.Viewport.GetTransform(wcs, scs)
        # transform anchor point from screen to world
        anchorpt.Transform(xstw)
        
        # move mesh to centerpt
        mesh.Translate(Rhino.Geometry.Plane.WorldXY.Origin - self.meshcenter)
        
        # move mesh to anchorpt
        mesh.Translate(anchorpt - draw_plane.Origin)
        
        # get scaling factor
        uppx = arg.Display.Viewport.GetWorldToScreenScale(anchorpt)[1]
        mesh.Scale(uppx)
        
        # draw the mesh
        arg.Display.DrawMeshShaded(mesh, shader)
    
    def DrawViewportWires(self, arg):
        self.drawingWires = True
    
    
    def __exit__(self):
        Rhino.Display.DisplayPipeline.DrawForeground -= self.DrawForeground
        self._is_bound = False
    
    
    def __enter__(self):
        Rhino.Display.DisplayPipeline.DrawForeground += self.DrawForeground
        self._is_bound = True
# ---------- end rendermeshtoscreen ----------
comments_notes_18 = Panel("!!!EXPERIMENTS & WIP!!!")
isoconmeshvalue = IsoContourMeshValue(IsoValue=isoval)  # -> Contours; inputs InMesh: Mesh, IsoValue: Double; disabled
# ---------- isoconmeshvalue: C# usings ----------
using System.Linq;
using System.Threading.Tasks;
using System.Collections.Concurrent;
# ---------- isoconmeshvalue: C# ----------
            /*
    Original Script by Daniel Piker 03/07/2020
    Modified by Max Eschenbach
    version: 230203
    */

    // set component params
    this.Component.Name = "IsoContourMeshValue";
    this.Component.NickName = "IsoConMeshValue";
    this.Component.Category = "FindersKeepers";
    this.Component.SubCategory = "1 Mesh";

    if (InMesh != null)
    {
      Contours = ContourAtValue(InMesh, IsoValue);
    }
    else
    {
      this.Component.AddRuntimeMessage(GH_RuntimeMessageLevel.Warning, "Input Parameter InMesh failed to collect data!");
    }
# ---------- isoconmeshvalue: C# additional code ----------
  private static Rhino.Geometry.Curve[] ContourAtValue(Mesh M, double Iso)
  {

    // extract gradient from texture coordinates
    double[] values = new double[M.Vertices.Count];
    for(int i = 0; i < M.Vertices.Count; i++) values[i] = M.TextureCoordinates[i].Y;

    // get bounds of gradient value domain
    double target_min = values.Min() + 1e-6;
    double target_max = values.Max() - 1e-6;

    // compute remapped iso value
    Iso = (Iso / 1) * (target_max - target_min) + target_min;

    // init list for geometry storage
    ConcurrentBag<Curve> curves = new ConcurrentBag<Curve>();

    // loop over all faces
    Parallel.For(0, M.Faces.Count,
      i =>
      {
      int va = M.Faces[i].A;
      int vb = M.Faces[i].B;
      int vc = M.Faces[i].C;

      double a = M.TextureCoordinates[va].Y - Iso;
      double b = M.TextureCoordinates[vb].Y - Iso;
      double c = M.TextureCoordinates[vc].Y - Iso;

      Point3d pa = M.Vertices.Point3dAt(va);
      Point3d pb = M.Vertices.Point3dAt(vb);
      Point3d pc = M.Vertices.Point3dAt(vc);

      List<Point3d> ends = new List<Point3d>();

      // find line segment
      if(a < 0 != b < 0)
      {
        double wa = b / (b - a);
        double wb = 1 - wa;
        ends.Add(wa * pa + wb * pb);
      }
      if(a < 0 != c < 0)
      {
        double wa = c / (c - a);
        double wc = 1 - wa;
        ends.Add(wa * pa + wc * pc);
      }
      if(c < 0 != b < 0)
      {
        double wb = c / (c - b);
        double wc = 1 - wb;
        ends.Add(wb * pb + wc * pc);
      }

      // if line segment is complete add it to list
      if(ends.Count == 2)
      {
        curves.Add(new Line(ends[0], ends[1]).ToNurbsCurve());
      }
      });

    return Curve.JoinCurves(curves);
  }
# ---------- end isoconmeshvalue ----------

panel_6 = Panel("0.000")
dom = ConstructDomain(DomainStart=Slider(0, range=0..1), DomainEnd=Slider(1, range=0..1))
branchindex = Slider(12, range=0..25)

my_example_custom_curves = Curve(Tree({0;0}: [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], {0;1}: [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], {0;2}: [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], {0;3}: [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], {0;4}: [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], {0;5}: [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]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))
panel_7 = Panel(my_example_custom_curves)
viewer = ParamViewer(my_example_custom_curves)

# ----
# comments & notes: ATTENTION: CURVES NEED TO BE SUPPLIED AS FOLLOWS:
# 
# - CURVES NEED TO BE ORDERED FROM BOTTOM TO TOP!
# - ONE TREE BRANCH PER LAYER
# - IF A LAYER HAS MULTIPLE CURVES (BRANCHING OBJECTS), THEY NEED TO BE IN THE SAME BRANCH
# 
# - PLEASE HAVE A LOOK AT THE DATA STRUCTURE IN THE EXAMPLE TO THE LEFT!
comments_notes_19 = Panel("CUSTOM CURVE INJECTION")
custom_curves_input = Curve(my_example_custom_curves)

# ----
# CONTROL FLOW
# comments & notes: check if any input geometry is present
custom_curves = Curve(custom_curves_input)
input_geometry_3 = Geometry(input_geometry_2)
inject_custom_curves_3 = Data(inject_custom_curves)
null = NullItem(Item=input_geometry_3)  # -> NullFlags, InvalidFlags, Description
null_2 = NullItem(Item=flatten(custom_curves))  # -> NullFlags, InvalidFlags, Description
or_2 = GateOr(A=null.NullFlags, B=null.InvalidFlags)
ma = MassAddition(Input=null_2.NullFlags)  # -> Result, PartialResults
ma_2 = MassAddition(Input=null_2.InvalidFlags)  # -> Result, PartialResults
or_3 = GateOr(A=ma.Result, B=ma_2.Result)
filter_2 = StreamFilter(Gate=inject_custom_curves_3, Stream0=or_2, Stream1=or_3)
geo_present = Boolean(invert(filter_2))

# ----
# CONTROL FLOW
inject_custom_curves_4 = Data(inject_custom_curves)
geo_present_2 = Boolean(invert(filter_2))
input_geometry_4 = Geometry(input_geometry_2)
and = GateAnd(A=inject_custom_curves_4, B=geo_present_2)
comments_notes_20 = Panel("check input geometry")
meshbrepanalysis = CSharpScript(G=input_geometry_4, T="Input ", CC=and)  # -> IsMesh, Closed, NakedEdges, Info; inputs G: GeometryBase, T: String, CC: Boolean
# ---------- meshbrepanalysis: C# ----------
    bool msh = true;
    bool clsd = false;
    int nB = 0;

    if (G is Mesh)
    {
      msh = true;
      Mesh tMesh = (Mesh) G;
      clsd = tMesh.IsClosed;
      if (clsd == false)
      {
        Curve[] nEdges = Curve.JoinCurves(Array.ConvertAll(tMesh.GetNakedEdges(), crv => crv.ToPolylineCurve()));
        NakedEdges = nEdges;
        nB = nEdges.Length;
      }
      else
      {
        NakedEdges = new Grasshopper.DataTree<object>();
      }
      IsMesh = msh;
      Closed = clsd;
    }
    else if (G is Brep)
    {
      msh = false;
      Brep tBrep = (Brep) G;
      clsd = tBrep.IsSolid;
      if (clsd == false)
      {
        Curve[] nEdges = Curve.JoinCurves(tBrep.DuplicateNakedEdgeCurves(true, true));
        NakedEdges = nEdges;
        nB = nEdges.Length;
      }
      else
      {
        NakedEdges = new Grasshopper.DataTree<object>();
      }
      IsMesh = msh;
      Closed = clsd;
    }

    string baseStr = "[INFO] {0}Geometry is a{1} {2}{3}!";
    string iclsd = (clsd) ? " closed" : "n open";
    string imsh = (msh) ? "MESH" : "BREP";
    string inb = (nB > 0) ? String.Format(" with {0} boundaries", nB) : "";
    Info = String.Format(baseStr, T, iclsd, imsh, inb);

    if (CC == true)
    {
      IsMesh = msh;
      Closed = clsd;
      NakedEdges = new Grasshopper.DataTree<object>();
      Info = new List<string> {"[INFO] Custom layer CURVES are being used!", "[INFO] Analysis tools DEACTIVATED (Custom Curves)!"};
    }
# ---------- end meshbrepanalysis ----------
inmesh_closed = Data(meshbrepanalysis.Info)
input_ismesh = Boolean(meshbrepanalysis.IsMesh)

input_geometry_5 = Geometry(input_geometry_2)
input_ismesh_2 = Boolean(input_ismesh)
gate = StreamGate(Stream=input_geometry_5, Gate=input_ismesh_2)  # -> Target0, Target1
unim = UnifyMesh(Mesh=gate.Target1)  # -> Result, Count
filter_3 = StreamFilter(Gate=input_ismesh_2, Stream0=gate.Target0, Stream1=unim.Result)
input_geometry_6 = Geometry(filter_3)

# ----
# comments & notes: construct ray mesh for shrink wrapping
input_geometry_7 = Geometry(input_geometry_6)
triremeshtoggle = Data(triremesh)
raymesh = Data(ray_mesh)
gate_2 = StreamGate(Stream=input_geometry_7, Gate=triremeshtoggle)  # -> Target0, Target1
mjoin = MeshJoin(Meshes=gate_2.Target1)
bbox_2 = BoundingBox(Content=mjoin, Plane=PlaneXY(0, 0, 0), UnionBox=True)  # -> Box, Box_2
boxprop = BoxProperties(Box=bbox_2.Box)  # -> Center, Diagonal, Area, Volume, Degeneracy
volume_2 = Volume(Geometry=bbox_2.Box)  # -> Volume, Centroid
msphere = MeshSphere(Base=volume_2.Centroid, Radius=boxprop.Diagonal, UCount="60", VCount="60")
gate_3 = StreamGate(Stream=msphere, Gate=raymesh)  # -> Target0, Target1
tri = Triangulate(Mesh=gate_3.Target1)  # -> Mesh, Count
demesh = DeconstructMesh(Mesh=tri.Mesh)  # -> Vertices, Faces, Colours, Normals
rev = Reverse(Vector=demesh.Normals)
meshray = MeshRay(Mesh=gate_2.Target1, Point=demesh.Vertices, Direction=rev)  # -> Point, Hit
conmesh = ConstructMesh(Vertices=meshray.Point, Faces=demesh.Faces)
filter_4 = StreamFilter(Gate=raymesh, Stream0=gate_3.Target0, Stream1=conmesh)
shrinkwrapmesh = Mesh(filter_4)
input_geometry_8 = Geometry(gate_2.Target0)

# ----
# comments & notes: extract sharp features using threshold angle between faces
input_geometry_9 = Geometry(input_geometry_6)
input_ismesh_3 = Boolean(input_ismesh)
anglethreshold = Slider(60, range=0..90)
gate_4 = StreamGate(Stream=input_geometry_9, Gate=input_ismesh_3)  # -> Target0, Target1
esf = CSharpScript(M=gate_4.Target1, A=anglethreshold)  # -> E; inputs M: Mesh, A: Double
# ---------- esf: C# usings ----------
using Rhino.Geometry.Collections;
using System.Threading.Tasks;
# ---------- esf: C# ----------
    // get topology edges
    MeshTopologyEdgeList Edges = M.TopologyEdges;
    MeshFaceNormalList FaceNormals = M.FaceNormals;
    // create list for storing sharp edges
    List<Line> SharpEdges = new List<Line>();
    // loop over all edges
    for (int i = 0; i < Edges.Count; i++)
    {
      // for every edge, get adjacent faces
      int[] fids = Edges.GetConnectedFaces(i);
      // only continue if there are exactly two faces adjacent to this edge
      if (fids.Length == 2)
      {
        // compute angle between face normals
        if (RhinoMath.ToDegrees(Vector3d.VectorAngle(FaceNormals[fids[0]], FaceNormals[fids[1]])) > A)
        {
          SharpEdges.Add(Edges.EdgeLine(i));
        }
      }
    }
    E = SharpEdges;
# ---------- end esf ----------
filter_5 = StreamFilter(Gate=input_ismesh_3, Stream1=esf)
sharp_features = Curve(filter_5)

# ----
# comments & notes: TriRemesh input Mesh on request. Be careful, you might lose some accuracy!
shrinkwrapmesh_2 = Mesh(shrinkwrapmesh)
trm_preserve_sharp_features_2 = Boolean(trm_preserve_sharp_features)
input_geometry_10 = Geometry(input_geometry_6)
triremesh_2 = Data(triremesh)
shrink_wrap_2 = Boolean(shrink_wrap)
iterations = Slider(50, range=0..100)
filter_6 = StreamFilter(Gate=shrink_wrap_2, Stream1=input_geometry_10)
filter_7 = StreamFilter(Gate=shrink_wrap_2, Stream0=input_geometry_10, Stream1=shrinkwrapmesh_2)
trm_edge_length_2 = Data(trm_edge_length)
sharp_features_2 = Curve(sharp_features)
filter_8 = StreamFilter(Gate=triremesh_2, Stream1=filter_7)
triremesh_3 = TriRemesh(
    Geometry=filter_8,
    Target=filter_6,
    Sharp=trm_preserve_sharp_features_2,
    Features=sharp_features_2,
    Length=trm_edge_length_2,
    Iterations=iterations)  # -> Triangulation, Dual, Creases
unim_2 = UnifyMesh(Mesh=triremesh_3.Triangulation)  # -> Result, Count
triremesh_4 = Mesh(unim_2.Result)
input_geometry_11 = Geometry(input_geometry_8)
triremeshtoggle_2 = Data(triremeshtoggle)
triremesh_5 = Mesh(triremesh_4)
filter_9 = StreamFilter(Gate=triremeshtoggle_2, Stream0=input_geometry_11, Stream1=triremesh_5)
base_geometry = Geometry(filter_9)

# ----
# CONTROL FLOW MESHING
panel_8 = Panel("[INFO] ShrinkWrapping during Remeshing...")
inject_custom_curves_5 = Data(inject_custom_curves)
base_geometry_2 = Geometry(filter_9)
triremesh_6 = Data(triremesh)
shrink_wrap_3 = Data(shrink_wrap)
comments_notes_21 = Panel("info & error messages")
filter_10 = StreamFilter(Gate=triremesh_6, Stream1=base_geometry_2)
filter_11 = StreamFilter(Gate=shrink_wrap_3, Stream0=panel_8, Stream1="[INFO] No ShrinkWrapping is being done.")
ismeshclosed = CSharpScript(M=filter_10)  # -> C, T; inputs M: Mesh
# ---------- ismeshclosed: C# ----------
    if (M.IsClosed == true)
    {
      C = true;
      T = "[INFO] Base Mesh is closed.";
    }
    else
    {
      C = false;
      T = "[INFO] Base Mesh is open and/or disjoint!";
    }
# ---------- end ismeshclosed ----------
filter_12 = StreamFilter(Gate=triremesh_6, Stream0="[INFO] No Remeshing is being done...", Stream1="[INFO] Using TriRemesh Pipeline...")
filter_13 = StreamFilter(Gate=triremesh_6, Stream1=ismeshclosed.T)
filter_14 = StreamFilter(Gate=triremesh_6, Stream1=filter_11)
filter_15 = StreamFilter(Gate=inject_custom_curves_5, Stream0=filter_13)
filter_16 = StreamFilter(Gate=inject_custom_curves_5, Stream0=filter_12)
filter_17 = StreamFilter(Gate=inject_custom_curves_5, Stream0=filter_14)
base_mesh_closed = Data(filter_15)
remeshing_info = Data(filter_16)
shrinkwrap_info = Data(filter_17)

# ----
# RE-BREP
trimmedtriangles = BooleanToggle(True)
base_mesh = Geometry(base_geometry)
rebrep = Boolean(re_brep)
gate_5 = StreamGate(Stream=base_mesh, Gate=rebrep)  # -> Target0, Target1
comments_notes_22 = Panel("ReBrep on request")
meshtobrep = CSharpScript(M=gate_5.Target1, TT=trimmedtriangles)  # -> B; inputs M: Mesh, TT: Boolean
# ---------- meshtobrep: C# ----------
    B = Brep.CreateFromMesh(M, TT);
# ---------- end meshtobrep ----------
filter_18 = StreamFilter(Gate=rebrep, Stream0=gate_5.Target0, Stream1=meshtobrep)
printing_geometry = Geometry(filter_18)

# ----
# CONTROL FLOW
# NON-PLANAR SLICING
# comments & notes: check if printing geometry is Mesh or Brep
enable_non_planar_slicing_2 = Data(enable_non_planar_slicing)
inject_custom_curves_6 = Data(inject_custom_curves)
printing_geometry_2 = Geometry(printing_geometry)
geo_present_3 = Boolean(invert(filter_2))
and_2 = GateAnd(A=inject_custom_curves_6, B=geo_present_3)
meshbrepanalysis_2 = CSharpScript(G=printing_geometry_2, T="Printing ", CC=and_2)  # -> IsMesh, Closed, NakedEdges, Info; inputs G: GeometryBase, T: String, CC: Boolean
# ---------- meshbrepanalysis_2: C# ----------
    bool msh = true;
    bool clsd = false;
    int nB = 0;

    if (G is Mesh)
    {
      msh = true;
      Mesh tMesh = (Mesh) G;
      clsd = tMesh.IsClosed;
      if (clsd == false)
      {
        Curve[] nEdges = Curve.JoinCurves(Array.ConvertAll(tMesh.GetNakedEdges(), crv => crv.ToPolylineCurve()));
        NakedEdges = nEdges;
        nB = nEdges.Length;
      }
      else
      {
        NakedEdges = new Grasshopper.DataTree<object>();
      }
      IsMesh = msh;
      Closed = clsd;
    }
    else if (G is Brep)
    {
      msh = false;
      Brep tBrep = (Brep) G;
      clsd = tBrep.IsSolid;
      if (clsd == false)
      {
        Curve[] nEdges = Curve.JoinCurves(tBrep.DuplicateNakedEdgeCurves(true, true));
        NakedEdges = nEdges;
        nB = nEdges.Length;
      }
      else
      {
        NakedEdges = new Grasshopper.DataTree<object>();
      }
      IsMesh = msh;
      Closed = clsd;
    }

    string baseStr = "[INFO] {0}Geometry is a{1} {2}{3}!";
    string iclsd = (clsd) ? " closed" : "n open";
    string imsh = (msh) ? "MESH" : "BREP";
    string inb = (nB > 0) ? String.Format(" with {0} boundaries", nB) : "";
    Info = String.Format(baseStr, T, iclsd, imsh, inb);

    if (CC == true)
    {
      IsMesh = msh;
      Closed = clsd;
      NakedEdges = new Grasshopper.DataTree<object>();
      Info = new Grasshopper.DataTree<object>();
    }
# ---------- end meshbrepanalysis_2 ----------
printing_geometry_ismesh = Boolean(meshbrepanalysis_2.IsMesh)
printing_geometry_closed = Boolean(meshbrepanalysis_2.Closed)
and_3 = GateAnd(A=enable_non_planar_slicing_2, B=printing_geometry_ismesh, C=invert(printing_geometry_closed))
python_2 = GhPythonScript(A=enable_non_planar_slicing_2, B=printing_geometry_ismesh, C=printing_geometry_closed, D=and_2)  # -> out, INFO; inputs A: Boolean, B: Boolean
# ---------- python_2: Python ----------
__author__ = "EFESTWIN"
__version__ = "2023.02.07"
import Grasshopper

if A and not B:
    INFO = '[SETTING IGNORED] Non Planar slicing is impossible for BREPs! To use this feature, activate remeshing.'
elif A and B and not C:
    INFO = '[INFO] Performing Non Planar slicing...'
elif A and C:
    INFO = ['[SETTING IGNORED] Non Planar slicing is currently not available for closed objects!',
            '[INFO] Performing parallel slicing...']
elif D:
    INFO = '[INFO] No slicing is being done! Custom CURVES are injected...'
else:
    INFO = '[INFO] Performing parallel slicing...'
# ---------- end python_2 ----------
gate_6 = StreamGate(Stream=printing_geometry_2, Gate=and_3)  # -> Target0, Target1
printing_geometry_3 = Geometry(gate_6.Target0)
printing_geometry_4 = Geometry(gate_6.Target1)
pg_meshbrep_info = Data(meshbrepanalysis_2.Info)
np_slicing_enabled = Boolean(and_3)
info_npslicing = Data(python_2.INFO)

# ----
# comments & notes: contour the printing geometry
panel_9 = Panel("0.1")
printing_geometry_5 = Geometry(printing_geometry_3)
layer_height_2 = Number(layer_height)
Z = UnitZ(Factor=1)
pt_3 = ConstructPoint(XCoordinate=0, YCoordinate=0, ZCoordinate=panel_9)
contour = Contour(Shape=printing_geometry_5, Point=pt_3, Direction=Z, Distance=layer_height_2)
tstat = TreeStatistics(Tree=contour)  # -> Paths, Length, Count
item = ListItem(List=tstat.Paths, Index=0, Wrap=True)
dpath = DeconstructPath(Branch=item)
lng = ListLength(List=dpath)  # -> expr("x-2", Length)
pshift = ShiftPaths(Data=contour, Offset=lng)

# ----
# comments & notes: CHECK FOR LOWER BOUNDARY
# CONTROL FLOW
printing_geometry_ismesh_2 = Boolean(printing_geometry_ismesh)
printing_geometry_6 = Geometry(printing_geometry)
gate_7 = StreamGate(Stream=printing_geometry_6, Gate=printing_geometry_ismesh_2)  # -> Target0, Target1
edges = BrepEdges(Brep=gate_7.Target0)  # -> Naked, Interior, NonManifold
medges = MeshEdges(Mesh=gate_7.Target1)  # -> NakedEdges, InteriorEdges, NonManifoldEdges
filter_19 = StreamFilter(Gate=printing_geometry_ismesh_2, Stream0=edges.Naked, Stream1=medges.NakedEdges)
join = JoinCurves(Curves=filter_19, Preserve=False)
topoly = CurveToPolyline(Curve=join, ToleranceDistance="0.01", ToleranceAngle=0)  # -> Polyline, Segments
pcen = PolygonCenter(Polyline=topoly.Polyline)  # -> CenterV, CenterE, CenterA
pdecon_2 = Deconstruct(Point=pcen.CenterV)  # -> XComponent, YComponent, ZComponent
sort = SortList(Keys=pdecon_2.ZComponent, ValuesA=join)  # -> Keys, ValuesA
item_2 = ListItem(List=sort.ValuesA, Index=0, Wrap=True)
explode = Explode(Curve=item_2, Recursive=True)  # -> Segments, Vertices
pdecon_3 = Deconstruct(Point=explode.Vertices)  # -> XComponent, YComponent, ZComponent
avr = Average(Input=pdecon_3.ZComponent)
rtd = RoundToDecimal(Numbers=avr, DecimalPlaces="5")  # -> Rounded; inputs Numbers: list, DecimalPlaces: list of Int32
# ---------- rtd: Python ----------
"""
Rounds input numbers to a decimal place.
    Inputs:
        Numbers: The numbers to round. {list, float}
        DecimalPlaces: Number of decimal places for the generated random
                       numbers. Set to 0 for integer numbers.
                       Defaults to 2.
                       {list, int}
    Output:
        Rounded: The number rounded to DecimalPlaces.
                 {list/tree, float/int}
    Remarks:
        Author: Max Eschenbach
        License: MIT License
        Version: 230103
"""

# PYTHON STANDARD LIBRARY IMPORTS
from __future__ import division, print_function

# GHPYTHONLIB SDK IMPORTS
from ghpythonlib.componentbase import executingcomponent as component
import Grasshopper, GhPython
import System
import Rhino

# GHENV COMPONENT SETTINGS
ghenv.Component.Name = "RoundToDecimal"
ghenv.Component.NickName = "RTD"
ghenv.Component.Category = "FindersKeepers"
ghenv.Component.SubCategory = "5 Math"

class RoundToDecimal(component):
    
    def RunScript(self, Numbers, DecimalPlaces):
        
        if not DecimalPlaces:
                DecimalPlaces = [0]
        
        if Numbers and Numbers != [None]:
            rounded = []
            for i, num in enumerate(Numbers):
                # retrieve decimalplaces
                if i < len(DecimalPlaces):
                    dp = DecimalPlaces[i]
                else:
                    dp = DecimalPlaces[-1]
                # round number
                rounded.append(round(num, dp))
        else:
            rounded = Grasshopper.DataTree[object]()
        
        # return outputs if you have them; here I try it for you:
        return rounded
# ---------- end rtd ----------
similar = Similarity(FirstNumber=rtd, SecondNumber="0", Threshold="1")  # -> Similarity, AbsoluteDifference
null_3 = NullItem(Item=rtd)  # -> NullFlags, InvalidFlags, Description
not = GateNot(A=null_3.InvalidFlags)
or_4 = GateOr(A=not, B=similar.Similarity)
has_lower_boundary = Boolean(or_4)

# ----
# comments & notes: check curve length. only accept curves that are longer than (average length * 0.001)
slice_polylines = Data(pshift)
len = Length(Curve=slice_polylines)
ma_3 = MassAddition(Input=flatten(len))  # -> Result, PartialResults
lng_2 = ListLength(List=flatten(len))
division = Division(A=ma_3.Result, B=lng_2)
multiplication_4 = Multiplication(A=division, B="0.001")
larger = LargerThan(FirstNumber=len, SecondNumber=multiplication_4)  # -> LargerThan, OrEqualTo
dispatch = Dispatch(List=slice_polylines, DispatchPattern=larger.LargerThan)  # -> ListA, ListB
slice_curves_length_thresholded = Data(dispatch.ListA)

topoly_2 = CurveToPolyline(Curve=graft(slice_curves_length_thresholded), ToleranceDistance="0.01", ToleranceAngle=0)  # -> Polyline, Segments
comments_notes_23 = Panel("POLYLINE CONVERSION")
explode_2 = Explode(Curve=topoly_2.Polyline, Recursive=True)  # -> Segments, Vertices
cullpt = CullDuplicates(Points=explode_2.Vertices, Tolerance="0.001", CullMode=3)  # -> Points, Indices, Valence
pshift_2 = ShiftPaths(Data=cullpt.Points, Offset=-2)
cls = Closed(Curve=topoly_2.Polyline)  # -> Closed, Periodic
pline = PolyLine(Vertices=pshift_2, Closed=cls.Closed)
redpline = Reduce(Polyline=pline, Tolerance="0.025")  # -> Polyline, Reduction
pshift_3 = ShiftPaths(Data=redpline.Polyline, Offset=-1)

# ----
# comments & notes: WHAT TO DO ABOUT OPEN CURVES/SURFACES??
orderbranchingslices = CSharpScript(B=pshift_3)  # -> out, OS; inputs B: tree of Curve
# ---------- orderbranchingslices: C# ----------
// Grasshopper Script Instance
#region Usings
using System;
using System.Linq;
using System.Collections;
using System.Collections.Generic;
using System.Drawing;

using Rhino;
using Rhino.Geometry;
using Rhino.Collections;

using Grasshopper;
using Grasshopper.Kernel;
using Grasshopper.Kernel.Data;
using Grasshopper.Kernel.Types;
#endregion

public class Script_Instance : GH_ScriptInstance
{
    #region Notes
    /* 
      Members:
        RhinoDoc RhinoDocument
        GH_Document GrasshopperDocument
        IGH_Component Component
        int Iteration

      Methods (Virtual & overridable):
        Print(string text)
        Print(string format, params object[] args)
        Reflect(object obj)
        Reflect(object obj, string method_name)
    */
    #endregion

    private void RunScript(DataTree<Curve> B, ref object OS)
    {
        double tol = Rhino.RhinoDoc.ActiveDoc.ModelAbsoluteTolerance;
        DataTree<Brep> SliceSurfaces = new DataTree<Brep>();
        for (int i = 0; i < B.BranchCount; i++)
        {
            GH_Path ghp = new GH_Path(B.Paths[i]);
            SliceSurfaces.AddRange(Brep.CreatePlanarBreps(B.Branches[i], tol), ghp);
        }
        OS = OrderSliceSurfaces(SliceSurfaces);
    }

    public Point3d GetSurfaceCentroid(Brep srf)
    {
        Curve[] borders = srf.DuplicateEdgeCurves(false);
        Point3d centroid_sum = new Point3d(0, 0, 0);
        for (int i = 0; i < borders.Length; i++)
        {

        centroid_sum += borders[i].ToPolyline(0.1, 0, 0, 0).ToPolyline().CenterPoint();
        }
        return centroid_sum / borders.Length;
    }

    public DataTree<Brep> OrderSliceSurfaces(DataTree<Brep> SliceSurfaces)
    {
        // loop over datatree and ensure correct order
        for (int i = 0; i < SliceSurfaces.BranchCount - 1; i++)
        {
        // get branches
        var this_branch = SliceSurfaces.Branches[i];
        var next_branch = SliceSurfaces.Branches[i + 1];

        // case 1: this branch one curve and next branch one curve
        if (this_branch.Count == 1 && next_branch.Count == 1)
        {
            Print("Case 1, 1 -> 1 (nothing done)");
            // nothing needs to be done
        }
            // case 2: this branch one curve and next branch multiple curves
        else if (this_branch.Count == 1 && next_branch.Count > 1)
        {
            Print("Case 2, 1 -> N");
            // loop over next branch and find all centerpoints to compare against
            Point3dList ptL = new Point3dList();
            for (int k = 0; k < next_branch.Count; k++)
            {
            //Point3d cpB = AreaMassProperties.Compute(next_branch[k]).Centroid;
            Point3d cpB = GetSurfaceCentroid(next_branch[k]);
            ptL.Add(cpB);
            }
            // create new list for storage
            List<Brep> OrderedNextBranch = new List<Brep>();
            // get curve centerpoint
            // Point3d cpA = AreaMassProperties.Compute(this_branch[0]).Centroid;
            Point3d cpA = GetSurfaceCentroid(this_branch[0]);
            // compare against point3dlist of other centerpoints
            int idx = ptL.ClosestIndex(cpA);
            OrderedNextBranch.Add((Brep) next_branch[idx].Duplicate());
            next_branch.RemoveAt(idx);
            OrderedNextBranch.AddRange(next_branch);
            // clear data
            ptL.Clear();
            // restructure next branch of contours tree
            SliceSurfaces.Branches[i + 1].Clear();
            SliceSurfaces.Branches[i + 1].AddRange(OrderedNextBranch);
        }
            // case 3: this branch and next branch have multiple curves but the same count
        else if (this_branch.Count > 1 && this_branch.Count == next_branch.Count)
        {
            Print("Case 3, N -> N");
            // create new list for storage
            List<Brep> OrderedNextBranch = new List<Brep>();
            // loop over all curves in this branch
            for (int j = 0; j < this_branch.Count; j++)
            {
            if (next_branch.Count < 1) break;
            // loop over next branch and find all centerpoints to compare against
            Point3dList ptL = new Point3dList();
            for (int k = 0; k < next_branch.Count; k++)
            {
                //Point3d cpB = AreaMassProperties.Compute(next_branch[k]).Centroid;
                Point3d cpB = GetSurfaceCentroid(next_branch[k]);
                ptL.Add(cpB);
            }
            // get curve centerpoint
            //Point3d cpA = AreaMassProperties.Compute(this_branch[j]).Centroid;
            Point3d cpA = GetSurfaceCentroid(this_branch[j]);
            // compare against point3dlist of other centerpoints
            int idx = ptL.ClosestIndex(cpA);
            // add closest item to ordered list
            OrderedNextBranch.Add((Brep) next_branch[idx].Duplicate());
            // remove closest item from candidates
            next_branch.RemoveAt(idx);
            // clear data
            ptL.Clear();
            }
            // restructure next branch of contours tree
            SliceSurfaces.Branches[i + 1].Clear();
            SliceSurfaces.Branches[i + 1].AddRange(OrderedNextBranch);
        }
            // case 4: this branch has more curves than next branch
        else if (this_branch.Count > 1 && next_branch.Count > 1 && this_branch.Count > next_branch.Count)
        {
            Print("Case 4, N -> M>N (VERIFY!)");
            // create new list for storage
            List<Brep> OrderedNextBranch = new List<Brep>();
            // loop over all curves in this branch
            for (int j = 0; j < this_branch.Count; j++)
            {
            if (next_branch.Count < 1) break;
            // loop over next branch and find all centerpoints to compare against
            Point3dList ptL = new Point3dList();
            for (int k = 0; k < next_branch.Count; k++)
            {
                //Point3d cpB = AreaMassProperties.Compute(next_branch[k]).Centroid;
                Point3d cpB = GetSurfaceCentroid(next_branch[k]);
                ptL.Add(cpB);
            }
            // get curve centerpoint
            //Point3d cpA = AreaMassProperties.Compute(this_branch[j]).Centroid;
            Point3d cpA = GetSurfaceCentroid(this_branch[j]);
            // compare against point3dlist of other centerpoints
            int idx = ptL.ClosestIndex(cpA);
            // add closest item to ordered list
            OrderedNextBranch.Add((Brep) next_branch[idx].Duplicate());
            // remove closest item from candidates
            next_branch.RemoveAt(idx);
            // clear data
            ptL.Clear();
            }
            // restructure next branch of contours tree
            SliceSurfaces.Branches[i + 1].Clear();
            SliceSurfaces.Branches[i + 1].AddRange(OrderedNextBranch);
        }
            // case 5: this branch has less curves than next branch
        else if (this_branch.Count > 1 && next_branch.Count > 1 && this_branch.Count < next_branch.Count)
        {
            Print("Case 5, N -> M<N (VERIFY)");
            // loop over next branch and find all centerpoints to compare against
            Point3dList ptL = new Point3dList();
            for (int k = 0; k < next_branch.Count; k++)
            {
            //Point3d cpB = AreaMassProperties.Compute(next_branch[k]).Centroid;
            Point3d cpB = GetSurfaceCentroid(next_branch[k]);
            ptL.Add(cpB);
            }
            // create new list for storage
            List<Brep> OrderedNextBranch = new List<Brep>();
            // create duplicate list for looping
            List<Brep> next_branch_dup = new List<Brep>(next_branch);
            // loop over all curves in this branch
            for (int j = 0; j < this_branch.Count; j++)
            {
            // get curve centerpoint
            //Point3d cpA = AreaMassProperties.Compute(this_branch[j]).Centroid;
            Point3d cpA = GetSurfaceCentroid(this_branch[j]);
            // compare against point3dlist of other centerpoints
            int idx = ptL.ClosestIndex(cpA);
            // add closest curve based on comparison to new list
            OrderedNextBranch.Add((Brep) next_branch[idx].Duplicate());
            next_branch_dup.Remove(next_branch[idx]);
            }
            // add remaining curves from next branch to list
            OrderedNextBranch.AddRange(next_branch_dup);
            // clear data
            ptL.Clear();
            // restructure next branch of contours tree
            SliceSurfaces.Branches[i + 1].Clear();
            SliceSurfaces.Branches[i + 1].AddRange(OrderedNextBranch);
        }
            // case 6: this branch has multiple curves but next branch only has one
        else if (this_branch.Count > 1 && next_branch.Count == 1)
        {
            Print("Case 6, N -> 1 (nothing done)");
        }
        }

        return SliceSurfaces;
    }
}
# ---------- end orderbranchingslices ----------
panel_10 = Panel(orderbranchingslices.out)

# ----
# comments & notes: check first layer for open curves, forward boolean for floor addition (no floor possible with open curves...)
tstat_2 = TreeStatistics(Tree=pshift_3)  # -> Paths, Length, Count
item_3 = ListItem(List=tstat_2.Paths, Index=0, Wrap=True)
branch = TreeBranch(Tree=pshift_3, Path=item_3, MaintainPaths=True)
cls_2 = Closed(Curve=branch)  # -> Closed, Periodic
ma_4 = MassAddition(Input=cls_2.Closed)  # -> Result, PartialResults
smaller = SmallerThan(FirstNumber=ma_4.Result, SecondNumber="1")  # -> SmallerThan, OrEqualTo
first_layer_open_curves = Data(smaller.SmallerThan)

# ----
# CONTROL FLOW
# comments & notes: VERIFY ADD FLOOR SLICING
floor_layer_count_2 = Integer(floor_layer_count)
panel_11 = Panel("[SETTING IGNORED] Additional Floor option is only available if there is a lower boundary in the brep/mesh!")
first_layer_open_curves_2 = Data(first_layer_open_curves)
has_lower_boundary_2 = Boolean(has_lower_boundary)
printing_geometry_closed_2 = Boolean(printing_geometry_closed)
add_floor_to_open_objects_2 = Boolean(add_floor_to_open_objects)
panel_12 = Panel("[SETTING IGNORED] Additional Floor option is only available for open objects!")
has_lower_boundary_3 = Boolean(has_lower_boundary)
larger_2 = LargerThan(FirstNumber=floor_layer_count_2, SecondNumber="0")  # -> LargerThan, OrEqualTo
python_3 = GhPythonScript(A=printing_geometry_closed_2, B=add_floor_to_open_objects_2, C=has_lower_boundary_3)  # -> out, O
# ---------- python_3: Python ----------
if A == True and B == True:
    O = 0
elif A == False and B == True:
    if C == False:
        O = 1
    else:
        O = 2
# ---------- end python_3 ----------
floor_layer_count_3 = Integer(floor_layer_count)
inject_custom_curves_7 = Data(inject_custom_curves)
and_4 = GateAnd(
    D=invert(first_layer_open_curves_2),
    C=has_lower_boundary_3,
    A=invert(printing_geometry_closed_2),
    B=add_floor_to_open_objects_2)
and_5 = GateAnd(B=invert(first_layer_open_curves_2), C=invert(has_lower_boundary_2), D=larger_2.LargerThan, A=printing_geometry_closed_2)
filter_20 = StreamFilter(Gate=python_3.O, Stream0=panel_12, Stream1=panel_11)
format = Format(Format="[INFO] {0} Floor Layers are being added.", Culture=127, Data0=floor_layer_count_3)
or_5 = GateOr(A=and_5, B=and_4)
filter_21 = StreamFilter(Gate=and_4, Stream0=filter_20, Stream1=format)
filter_22 = StreamFilter(Gate=inject_custom_curves_7, Stream0=or_5, Stream1="False")
floor_info = Data(filter_21)
floor_slicing_enabled = Boolean(filter_22)

# ----
# PLANAR SLICING
# comments & notes: explode and join to get a single curve again if input has self-intersections
null_4 = NullItem(Item=orderbranchingslices.OS)  # -> NullFlags, InvalidFlags, Description
cls_3 = Closed(Curve=pshift_3)  # -> Closed, Periodic
comments_notes_24 = Panel("PLANAR SLICING")
or_6 = GateOr(A=null_4.NullFlags, B=null_4.InvalidFlags, C=invert(cls_3.Closed))
dispatch_2 = Dispatch(List=pshift_3, DispatchPattern=or_6)  # -> ListA, ListB
dispatch_3 = Dispatch(List=orderbranchingslices.OS, DispatchPattern=or_6)  # -> ListA, ListB
clean = CleanTree(RemoveNulls=True, RemoveInvalid=True, RemoveEmpty=True, Tree=dispatch_2.ListA)
clean_2 = CleanTree(RemoveNulls=True, RemoveInvalid=True, RemoveEmpty=True, Tree=dispatch_3.ListB)
python_4 = GhPythonScript(Breps=clean_2)  # -> InnerCurves, OuterCurves; inputs Breps: list of Brep
# ---------- python_4: Python ----------
__author__ = "Max Eschenbach"
__version__ = "2022.05.18"

import Rhino

def _get_loops(breps):
    iLoops = []
    oLoops = []
    for i, brep in enumerate(breps):
        fc = brep.Faces.Count
        for j in range(fc):
            bface = brep.Faces[j]
            iCount = 0
            for floop in bface.Loops:
                if floop.LoopType == Rhino.Geometry.BrepLoopType.Inner:
                    iLoops.append(floop.To3dCurve())
                    iCount += 1
                elif floop.LoopType == Rhino.Geometry.BrepLoopType.Outer:
                    oLoops.append(floop.To3dCurve())
    return iLoops, oLoops

InnerCurves, OuterCurves = _get_loops(Breps)
# ---------- end python_4 ----------
pcen_2 = PolygonCenter(Polyline=python_4.InnerCurves)  # -> CenterV, CenterE, CenterA
pcen_3 = PolygonCenter(Polyline=python_4.OuterCurves)  # -> CenterV, CenterE, CenterA
pl = PlaneNormal(Origin=pcen_2.CenterV, ZAxis=Z)
pl_2 = PlaneNormal(Origin=pcen_3.CenterA, ZAxis=Z)
crvensureccw = GhPythonScript(Crv=python_4.InnerCurves, Pln=pl)  # -> CCWCrv; inputs Crv: Curve, Pln: Plane; same code as crvensureccw
crvensureccw_2 = GhPythonScript(Crv=python_4.OuterCurves, Pln=pl_2)  # -> CCWCrv; inputs Crv: Curve, Pln: Plane; same code as crvensureccw
clean_3 = CleanTree(RemoveNulls=True, RemoveInvalid=True, RemoveEmpty=False, Tree=crvensureccw)
tstat_3 = TreeStatistics(Tree=crvensureccw_2)  # -> Paths, Length, Count
branch_2 = TreeBranch(Tree=slice_curves_length_thresholded, Path=tstat_3.Paths, MaintainPaths=True)
cx = CurveSelf(Curve=branch_2)  # -> Points, Params
pshift_4 = ShiftPaths(Data=cx.Points, Offset=-1)
lng_3 = ListLength(List=pshift_4)
larger_3 = LargerThan(FirstNumber=lng_3, SecondNumber="0")  # -> LargerThan, OrEqualTo
dispatch_4 = Dispatch(List=crvensureccw_2, DispatchPattern=larger_3.LargerThan)  # -> ListA, ListB
explode_3 = Explode(Curve=dispatch_4.ListA, Recursive=True)  # -> Segments, Vertices
pshift_5 = ShiftPaths(Data=explode_3.Segments, Offset=-1)
join_2 = JoinCurves(Curves=pshift_5, Preserve=False)
pshift_6 = ShiftPaths(Data=join_2, Offset=-1)
merge_3 = Merge(Data1=pshift_6, Data2=dispatch_4.ListB)
slice_curves_clsd_outer = Curve(merge_3)
slice_curves_clsd_inner = Curve(clean_3)
slice_curves_open = Curve(clean)
slice_surfaces = Brep(orderbranchingslices.OS)

# ----
# comments & notes: TODO:
# - IMPLEMENT FLOOR/CAP LAYER COUNT!
# - APPLY TO INNER CURVES ASWELL
slice_curves_clsd_outer_2 = Curve(slice_curves_clsd_outer)
threshold = Slider(5, range=0..100)
slice_curves_clsd_inner_2 = Curve(slice_curves_clsd_inner)
cap_layer_count_2 = Data(cap_layer_count)
floor_layer_count_4 = Data(floor_layer_count)
classifylayers = CSharpScript(
    InnerCurves=slice_curves_clsd_inner_2,
    OuterCurves=slice_curves_clsd_outer_2,
    FloorLayerCount=floor_layer_count_4,
    CapLayerCount=cap_layer_count_2,
    Threshold=threshold)  # -> out, OuterFloorLayers, InnerFloorLayers, OuterRegularLayers, InnerRegularLayers, OuterOverhangLayers, InnerOverhangLayers, OuterCapLayers, InnerCapLayers; inputs InnerCurves: tree of Curve, OuterCurves: tree of Curve, FloorLayerCount: Int32, CapLayerCount: Int32, Threshold: Double
# ---------- classifylayers: C# ----------
// Grasshopper Script Instance
#region Usings
using System;
using System.Linq;
using System.Collections;
using System.Collections.Generic;
using System.Drawing;

using Rhino;
using Rhino.Geometry;

using Grasshopper;
using Grasshopper.Kernel;
using Grasshopper.Kernel.Data;
using Grasshopper.Kernel.Types;
using TreeExtensions;
#endregion

public class Script_Instance : GH_ScriptInstance
{
    #region Notes
    /* 
      Members:
        RhinoDoc RhinoDocument
        GH_Document GrasshopperDocument
        IGH_Component Component
        int Iteration

      Methods (Virtual & overridable):
        Print(string text)
        Print(string format, params object[] args)
        Reflect(object obj)
        Reflect(object obj, string method_name)
    */
    #endregion

    private void RunScript(
		DataTree<Curve> InnerCurves,
		DataTree<Curve> OuterCurves,
		int FloorLayerCount,
		int CapLayerCount,
		double Threshold,
		ref object OuterFloorLayers,
		ref object InnerFloorLayers,
		ref object OuterRegularLayers,
		ref object InnerRegularLayers,
		ref object OuterOverhangLayers,
		ref object InnerOverhangLayers,
		ref object OuterCapLayers,
		ref object InnerCapLayers)
    {
        // Init variables
        // Output DataTrees (OuterCurves)
        DataTree<Curve> OuterFloors = new DataTree<Curve>();
        DataTree<Curve> OuterRegulars = new DataTree<Curve>();
        DataTree<Curve> OuterOverhangs = new DataTree<Curve>();
        DataTree<Curve> OuterCaps = new DataTree<Curve>();
        // Output DataTrees (InnerCurves)
        DataTree<Curve> InnerFloors = new DataTree<Curve>();
        DataTree<Curve> InnerRegulars = new DataTree<Curve>();
        DataTree<Curve> InnerOverhangs = new DataTree<Curve>();
        DataTree<Curve> InnerCaps = new DataTree<Curve>();
        // DataTree Paths
        GH_Path lastPath;
        GH_Path thisPath;
        GH_Path nextPath;
        // Outer Layers
        List<Curve> lastLayer;
        List<Curve> thisLayer;
        List<Curve> nextLayer;
        // Inner Layers
        List<Curve> lastInnerLayer;
        List<Curve> thisInnerLayer;
        List<Curve> nextInnerLayer;
        // Temporary List to Store Redefinition Layers
        List<GH_Path> moveToCap = new List<GH_Path>();
        
        // Loop over all outercurve branches in pairs
        for (int i = 0; i < OuterCurves.BranchCount - 1; i++)
        {
            // Get this layer's data
            thisPath = new GH_Path(OuterCurves.Paths[i]);
            thisLayer = OuterCurves.Branches[i];
            
            // FIRST LAYER(S) FLOOR DEFINITION
            if (i == 0 | i < FloorLayerCount)
            {
                // ADD INITIAL LAYER TO FLOORS
                OuterFloors.AddRange(thisLayer, thisPath);
                // ALSO ADD INNER LAYER IF IT EXISTS
                InnerFloors.AddRangeGracefully(InnerCurves.Branch(thisPath), thisPath);
                continue;
            }

            // Get next and last layer data
            // Paths
            lastPath = new GH_Path(OuterCurves.Paths[i - 1]);
            nextPath = new GH_Path(OuterCurves.Paths[i + 1]);
            // Layers
            lastLayer = OuterCurves.Branches[i - 1];
            nextLayer = OuterCurves.Branches[i + 1];

            // CATCH LAST LAYER(S) AS CAP
            if (i >= OuterCurves.BranchCount - 2)
            {
                OuterCaps.AddRange(nextLayer, nextPath);
            }

            // Get cumulative area of layer curves
            double lastArea = this.GetLayerArea(lastLayer);
            double thisArea = this.GetLayerArea(thisLayer);
            double nextArea = this.GetLayerArea(nextLayer);
            // Compute area difference between layers
            double diffLast = thisArea - lastArea;
            double diffNext = thisArea - nextArea;
            // Compute percentage difference
            double percLast = (diffLast / thisArea) * 100;
            double percNext = (diffNext / thisArea) * 100;
            // REPORT MESSAGE
            this.Print(
                string.Format(
                    "LAST {2} <- {0}% <--| {3} THIS {3} |--> {1}% -> {4} NEXT",
                    Math.Round(percLast, 2).ToString(),
                    Math.Round(percNext, 2).ToString(),
                    lastPath.ToString(),
                    thisPath.ToString(),
                    nextPath.ToString()
                )
            );

            // LAYER CLASSIFICATION
            if ((percLast > 0) && (Math.Abs(percLast) > Threshold))
            {
                // THISLAYER IS LARGER THAN LAST LAYER
                // --> THISLAYER IS OVERHANG LAYER
                OuterOverhangs.AddRange(thisLayer, thisPath);
                InnerOverhangs.AddRangeGracefully(InnerCurves.Branch(thisPath), thisPath);
            }
            else if ((percNext > 0) && (Math.Abs(percNext) > Threshold))
            {
                // THISLAYER IS LARGER THAN NEXT LAYER
                // --> THISLAYER IS CAP LAYER
                OuterCaps.AddRange(thisLayer, thisPath);
                InnerCaps.AddRangeGracefully(InnerCurves.Branch(thisPath), thisPath);
            }
            else
            {
                // THISLAYER IS REGULAR/SPARSE LAYER
                OuterRegulars.AddRange(thisLayer, thisPath);
                InnerRegulars.AddRangeGracefully(InnerCurves.Branch(thisPath), thisPath);
            }
        }

        // Set outputs
        OuterFloorLayers = OuterFloors;
        OuterRegularLayers = OuterRegulars;
        OuterOverhangLayers = OuterOverhangs;
        OuterCapLayers = OuterCaps;
        InnerFloorLayers = InnerFloors;
        InnerRegularLayers = InnerRegulars;
        InnerOverhangLayers = InnerOverhangs;
        InnerCapLayers = InnerCaps;
    }

    private double GetLayerLength(List<Curve> Layer)
    {
        double LayerLength = 0.0;
        for (int i = 0; i < Layer.Count; i++)
        {
            LayerLength += Layer[i].GetLength();
        }
        return LayerLength;
    }

    private double GetLayerArea(List<Curve> Layer)
    {
        double LayerArea = 0.0;
        for (int i = 0; i < Layer.Count; i++)
        {
            AreaMassProperties amp = AreaMassProperties.Compute(Layer[i]);
            LayerArea += amp.Area;
        }
        return LayerArea;
    }
}

    namespace TreeExtensions
    {
        public static class DataTreeExtensions
        {
            public static void AddRangeGracefully(this DataTree<Curve> tree, IEnumerable<Curve> data, GH_Path path)
            {
                try
                {
                    tree.AddRange(data, path);
                }
                catch (ArgumentNullException)
                {
                    tree.RemovePath(path);
                }
            }
        }
    }
# ---------- end classifylayers ----------
panel_13 = Panel(classifylayers.out)
outeroverhanglayers = Data(classifylayers.OuterOverhangLayers)
outerregularlayers = Data(classifylayers.OuterRegularLayers)
outerfloorlayers = Data(classifylayers.OuterFloorLayers)
outercaplayers = Data(classifylayers.OuterCapLayers)

outerregularlayers_2 = Data(outerregularlayers)
pcen_4 = PolygonCenter(Polyline=outerregularlayers_2)  # -> CenterV, CenterE, CenterA
xy_2 = XYPlane(Origin=pcen_4.CenterV)
inneroverhanglayers = Data(classifylayers.InnerOverhangLayers)
innerregularlayers = Data(classifylayers.InnerRegularLayers)
innerregularlayers_2 = Data(innerregularlayers)
innerfloorlayers = Data(classifylayers.InnerFloorLayers)
innercaplayers = Data(classifylayers.InnerCapLayers)

custom_curves_2 = Curve(custom_curves_input)
bbox_3 = BoundingBox(Content=flatten(custom_curves_2), Plane=PlaneXY(0, 0, 0), UnionBox=True)  # -> Box, Box_2
debox_2 = DeconstructBox(Box=bbox_3.Box)  # -> Plane, X, Y, Z
volume_3 = Volume(Geometry=bbox_3.Box)  # -> Volume, Centroid
pdecon_4 = Deconstruct(Point=volume_3.Centroid)  # -> XComponent, YComponent, ZComponent
dedomain_2 = DeconstructDomain(Domain=debox_2.Z)  # -> Start, End
pt_4 = ConstructPoint(XCoordinate=pdecon_4.XComponent, YCoordinate=pdecon_4.YComponent, ZCoordinate=dedomain_2.Start)
xy_3 = XYPlane(Origin=Point(0, 0, 0))
vec2pt_2 = Vector2Pt(PointA=pt_4, PointB=xy_3, Unitize=False)  # -> Vector, Length
move_2 = Move(Geometry=custom_curves_2, Motion=vec2pt_2.Vector)  # -> Geometry, Transform
topoly_3 = CurveToPolyline(Curve=move_2.Geometry, ToleranceDistance="0.001", ToleranceAngle=0)  # -> Polyline, Segments
custom_curves_at_origin = Curve(topoly_3.Polyline)

synthesize_floor_for_custom_curves_2 = Data(synthesize_floor_for_custom_curves)
custom_curves_at_origin_2 = Curve(custom_curves_at_origin)
filter_23 = StreamFilter(Gate=synthesize_floor_for_custom_curves_2, Stream1=custom_curves_at_origin_2)
floor_layer_count_5 = Integer(floor_layer_count)
tstat_4 = TreeStatistics(Tree=filter_23)  # -> Paths, Length, Count
split = SplitList(List=tstat_4.Paths, Index=floor_layer_count_5)  # -> ListA, ListB
branch_3 = TreeBranch(Tree=filter_23, Path=split.ListA, MaintainPaths=True)
branch_4 = TreeBranch(Tree=filter_23, Path=split.ListB, MaintainPaths=True)
custom_curves_wo_floor = Curve(branch_4)
custom_curves_floorcurves = Curve(branch_3)

# ----
# SPIRALIZE CONTOURS
comments_notes_25 = Panel("SPIRALIZE CONTOURS")

# ----
# PRINT PATH MANIPULATION
# OF SPIRALIZED CURVE
# comments & notes: PRINT PATH MANIPULATION
# OF SPIRALIZED CURVE
enable_ppm_after_spiral = BooleanToggle(False)

enable_erm = BooleanToggle(False)
erm_divide_by_distance = BooleanToggle(False)
erm_division_count = Slider(100, range=0..1000)
erm_division_dist = Slider(10, range=0..1000)

enable_print_simulation_2 = Data(enable_print_simulation)
show_printer_2 = Data(show_printer)
wasp_40100_printing_diameter_2 = Data(wasp_40100_printing_diameter)
wasp40100_arm_length_2 = Data(wasp40100_arm_length)

# ----
# HUD & INFO/ERROR STREAM
# comments & notes: Info & Error Stream collection
panel_14 = Panel("[ERROR] No input geometry is present!")
base_mesh_closed_2 = Data(base_mesh_closed)
pg_meshbrep_info_2 = Data(pg_meshbrep_info)
shrinkwrap_info_2 = Data(shrinkwrap_info)
remeshing_info_2 = Data(remeshing_info)
inmesh_closed_2 = Data(inmesh_closed)
info_npslicing_2 = Data(info_npslicing)
floor_info_2 = Data(floor_info)
enable_heads_up_display_2 = Data(enable_heads_up_display)
geo_present_4 = Boolean(geo_present)
textsize = Slider(16, range=0..30)

# ----
# VISUALISATION
# OFFSET VECTOR & LEADERS
# comments & notes: compute offset vector for visualisation
inject_custom_curves_8 = Data(inject_custom_curves)
printing_geometry_7 = Geometry(printing_geometry)
X = UnitX(Factor=1)
Y = UnitY(Factor=1)  # -> expr("x*-1", UnitVector)
X_2 = UnitX(Factor=1)
addition = Addition(A=X_2, B=Y)
amp = Amplitude(Vector=Y, Amplitude=Slider(20, range=0..100))
amp_2 = Amplitude(Vector=addition, Amplitude=Slider(120, range=0..200))
swatch = ColourSwatch(SwatchColor=RGB(0, 0, 0))

# ----
# PRINTING GEOMETRY VIZ
render_sharp_features_2 = Data(render_sharp_features)
sharp_features_3 = Curve(sharp_features)
render_print_geometry_2 = Data(render_print_geometry)
inject_custom_curves_9 = Data(inject_custom_curves)
printing_geometry_8 = Geometry(printing_geometry)
np_slicing_enabled_2 = Boolean(np_slicing_enabled)
comments_notes_26 = Panel("PRINTING GEOMETRY VIZ")
and_6 = GateAnd(A=render_print_geometry_2, B=invert(inject_custom_curves_9))
ismesh = CSharpScript(G=printing_geometry_8)  # -> M; inputs G: GeometryBase
# ---------- ismesh: C# ----------
    if (G is Mesh)
    {
      M = true;
    }
    else if (G is Brep)
    {
      M = false;
    }
# ---------- end ismesh ----------
weight = Slider(1, range=0..5)
weight_2 = Slider(2, range=0..5)
weight_3 = Slider(2, range=0..5)
swatch_2 = ColourSwatch(SwatchColor=RGB(0, 0, 0))

# ----
# FLOOR SLICING
floor_slicing_enabled_2 = Boolean(floor_slicing_enabled)
printing_geometry_9 = Geometry(printing_geometry)
layer_height_3 = Number(layer_height)
floor_layer_count_6 = Integer(floor_layer_count)
printing_geometry_ismesh_3 = Boolean(printing_geometry_ismesh)
series = Series(Start=0, Step=1, Count=floor_layer_count_6)
filter_24 = StreamFilter(Gate=floor_slicing_enabled_2, Stream1=printing_geometry_9)
multiplication_5 = Multiplication(A=layer_height_3, B=series)
larger_4 = LargerThan(FirstNumber=floor_layer_count_6, SecondNumber="0")  # -> LargerThan, OrEqualTo
split_2 = SplitList(List=multiplication_5, Index=1)  # -> ListA, ListB
filter_25 = StreamFilter(Gate=larger_4.LargerThan, Stream1="0.1")
merge_4 = Merge(Data1=flatten(filter_25), Data2=flatten(split_2.ListB))
Z_2 = UnitZ(Factor=1)
xy_4 = XYPlane(Origin=Point(0, 0, 0))
amp_3 = Amplitude(Vector=Z_2, Amplitude=merge_4)
move_3 = Move(Geometry=xy_4, Motion=amp_3)  # -> Geometry, Transform
printing_geometry_ismesh_4 = Boolean(printing_geometry_ismesh_3)
floor_slice_planes = Plane(move_3.Geometry)
gate_8 = StreamGate(Stream=floor_slice_planes, Gate=printing_geometry_ismesh_4)  # -> Target0, Target1
gate_9 = StreamGate(Stream=filter_24, Gate=printing_geometry_ismesh_4)  # -> Target0, Target1
comments_notes_27 = Panel("FLOOR SLICING")
sec = MeshPlane(Mesh=gate_9.Target1, Plane=gate_8.Target1)
sec_2 = BrepPlane(Brep=gate_9.Target0, Plane=gate_8.Target0)  # -> Curves, Points
filter_26 = StreamFilter(Gate=printing_geometry_ismesh_4, Stream0=sec_2.Curves, Stream1=sec)
Z_3 = UnitZ(Factor=1)
Z_4 = UnitZ(Factor=1)
floor_slice_planes_2 = Plane(graft(floor_slice_planes))

tstat_5 = TreeStatistics(Tree=filter_26)  # -> Paths, Length, Count
dpath_2 = DeconstructPath(Branch=tstat_5.Paths)
lng_4 = ListLength(List=dpath_2)
larger_5 = LargerThan(FirstNumber=lng_4, SecondNumber="2")  # -> LargerThan, OrEqualTo
ma_5 = MassAddition(Input=flatten(larger_5.LargerThan))  # -> Result, PartialResults
larger_6 = LargerThan(FirstNumber=ma_5.Result, SecondNumber="0")  # -> LargerThan, OrEqualTo
gate_10 = StreamGate(Stream=filter_26, Gate=larger_6.LargerThan)  # -> Target0, Target1
pshift_7 = ShiftPaths(Data=gate_10.Target1, Offset="1")
filter_27 = StreamFilter(Gate=larger_6.LargerThan, Stream0=gate_10.Target0, Stream1=pshift_7)

topoly_4 = CurveToPolyline(Curve=filter_27, ToleranceDistance="0.01", ToleranceAngle=0)  # -> Polyline, Segments
explode_4 = Explode(Curve=topoly_4.Polyline, Recursive=True)  # -> Segments, Vertices
cullpt_2 = CullDuplicates(Points=explode_4.Vertices, Tolerance="0.001", CullMode=3)  # -> Points, Indices, Valence
cls_4 = Closed(Curve=topoly_4.Polyline)  # -> Closed, Periodic
pline_2 = PolyLine(Vertices=cullpt_2.Points, Closed=cls_4.Closed)
pshift_8 = ShiftPaths(Data=pline_2, Offset=-2)

floor_slicing_enabled_3 = Boolean(floor_slicing_enabled)
slice_curves_clsd_inner_3 = Curve(slice_curves_clsd_inner)
slice_curves_clsd_outer_3 = Curve(slice_curves_clsd_outer)
pcen_5 = PolygonCenter(Polyline=slice_curves_clsd_outer_3)  # -> CenterV, CenterE, CenterA
comments_notes_29 = Panel("MERGE SLICE PLANES")
synthesize_floor_for_custom_curves_3 = Data(synthesize_floor_for_custom_curves)
xy_5 = XYPlane(Origin=pcen_5.CenterA)
inject_custom_curves_10 = Data(inject_custom_curves)
floor_slice_planes_3 = Plane(floor_slice_planes_2)
null_5 = NullItem(Item=xy_5)  # -> NullFlags, InvalidFlags, Description
or_7 = GateOr(A=null_5.NullFlags, B=null_5.InvalidFlags)  # -> flatten(Result)
and_7 = GateAnd(A=synthesize_floor_for_custom_curves_3, B=inject_custom_curves_10)
ma_6 = MassAddition(Input=or_7)  # -> Result, PartialResults
and_8 = GateAnd(A=ma_6.Result, B=floor_slicing_enabled_3)
or_8 = GateOr(A=and_8, B=and_7)
filter_28 = StreamFilter(Gate=or_8, Stream0=xy_5, Stream1=floor_slice_planes_3)
slice_planes = Data(filter_28)

# ----
# comments & notes: get low/high points for heat and cold
# comments & notes: split mesh with plane if additional floor is enabled
# comments & notes: extract low and high boundaries to use as heat/cold points
# comments & notes: check for only one boundary case and if it is at the bottom
floor_slicing_enabled_4 = Boolean(floor_slicing_enabled)
printing_geometry_10 = Geometry(printing_geometry_4)
floor_slice_planes_4 = Plane(flatten(floor_slice_planes_2))
layer_height_4 = Data(layer_height)
filter_29 = StreamFilter(Gate=floor_slicing_enabled_4, Stream1=floor_slice_planes_4)
filter_30 = StreamFilter(Gate=floor_slicing_enabled_4, Stream1=printing_geometry_10)
item_4 = ListItem(List=filter_29, Index=0, Wrap=True)  # -> Item1, Item
Z_5 = UnitZ(Factor=layer_height_4)
move_4 = Move(Geometry=item_4.Item1, Motion=Z_5)  # -> Geometry, Transform
msplit = MeshSplitPlane(Mesh=filter_30, Plane=move_4.Geometry)  # -> Above, Below
filter_31 = StreamFilter(Gate=floor_slicing_enabled_4, Stream0=printing_geometry_10, Stream1=msplit.Above)
printing_geometry_floorfiltered = Geometry(filter_31)
medges_2 = MeshEdges(Mesh=printing_geometry_floorfiltered)  # -> NakedEdges, InteriorEdges, NonManifoldEdges
join_3 = JoinCurves(Curves=medges_2.NakedEdges, Preserve=False)
pcen_6 = PolygonCenter(Polyline=join_3)  # -> CenterV, CenterE, CenterA
pdecon_5 = Deconstruct(Point=pcen_6.CenterV)  # -> XComponent, YComponent, ZComponent
sort_2 = SortList(Keys=pdecon_5.ZComponent, ValuesA=join_3)  # -> Keys, ValuesA
lng_5 = ListLength(List=sort_2.ValuesA)
equals = Equality(FirstNumber=lng_5, SecondNumber="1")  # -> Equality, Inequality
explode_5 = Explode(Curve=sort_2.ValuesA, Recursive=True)  # -> Segments, Vertices
filter_32 = StreamFilter(Gate=equals.Equality, Stream1=printing_geometry_floorfiltered)
cullpt_3 = CullDuplicates(Points=explode_5.Vertices, Tolerance="0.001", CullMode=3)  # -> simplify(Points), Indices, Valence
bbox_4 = BoundingBox(Content=filter_32, Plane=PlaneXY(0, 0, 0), UnionBox=True)  # -> Box, Box_2
tstat_6 = TreeStatistics(Tree=cullpt_3.Points)  # -> Paths, Length, Count
debox_3 = DeconstructBox(Box=bbox_4.Box)  # -> Plane, X, Y, Z
item_5 = ListItem(List=tstat_6.Paths, Index=0, Wrap=True)  # -> Item1, Item
dedomain_3 = DeconstructDomain(Domain=debox_3.Z)  # -> Start, End
filter_33 = StreamFilter(Gate=equals.Equality, Stream1=sort_2.Keys)
branch_5 = TreeBranch(Tree=cullpt_3.Points, Path=item_5.Item1, MaintainPaths=True)
branch_6 = TreeBranch(Tree=cullpt_3.Points, Path=item_5.Item, MaintainPaths=True)
# NON-PLANAR SLICING FOR OPEN OBJECTS
# comments & notes: catch cases where input is
# - more boundaries?
printing_geometry_floorfiltered_2 = Geometry(printing_geometry_floorfiltered)
division_2 = Division(A=filter_33, B=dedomain_3.End)
highpts = Point(branch_5)
lowpts = Point(branch_6)
smaller_2 = SmallerThan(FirstNumber=division_2, SecondNumber="0.1")  # -> SmallerThan, OrEqualTo
and_9 = GateAnd(A=equals.Equality, B=smaller_2.OrEqualTo)
np_only_bot_boundary = Boolean(and_9)
only_bot_boundary = Boolean(np_only_bot_boundary)
highpts_2 = Point(highpts)
lowpts_2 = Point(lowpts)
filter_34 = StreamFilter(Gate=only_bot_boundary, Stream0=highpts_2, Stream1=lowpts_2)
filter_35 = StreamFilter(Gate=only_bot_boundary, Stream0=lowpts_2)
miniterations = Slider(2000, range=0..5000)
demesh_2 = DeconstructMesh(Mesh=printing_geometry_floorfiltered_2)  # -> Vertices, Faces, Colours, Normals
iterationspervertex = Slider(0.2, range=0..1)
isofixcurves = Curve(sort_2.ValuesA)
coldpts = Point(filter_35)
heatpts = Point(filter_34)
texturescale = Slider(5, range=0.01..100)
lng_6 = ListLength(List=demesh_2.Vertices)
multiplication_6 = Multiplication(A=lng_6, B=iterationspervertex)
max = Maximum(A=miniterations, B=multiplication_6)
gate_11 = StreamGate(Stream=printing_geometry_floorfiltered_2, Gate=osselector.B)  # -> Target0, Target1
gate_12 = StreamGate(Stream=heatpts, Gate=osselector.B)  # -> Target0, Target1
gate_13 = StreamGate(Stream=coldpts, Gate=osselector.B)  # -> Target0, Target1
gate_14 = StreamGate(Stream=isofixcurves, Gate=osselector.B)  # -> Target0, Target1
gate_15 = StreamGate(Stream=texturescale, Gate=osselector.B)  # -> Target0, Target1
gate_16 = StreamGate(Stream="1e-6", Gate=osselector.B)  # -> Target0, Target1
gate_17 = StreamGate(Stream=max, Gate=osselector.B)  # -> Target0, Target1
heatstat = CSharpScript(
    RefMesh=gate_11.Target0,
    HeatPoints=gate_12.Target0,
    ColdPoints=gate_13.Target0,
    IsoFixCurves=gate_14.Target0,
    TextureScale=gate_15.Target0,
    Threshold=gate_16.Target0,
    MaxIterations=gate_17.Target0)  # -> HeatMesh, Values, Gradient; inputs RefMesh: Mesh, HeatPoints: list of Point3d, ColdPoints: list of Point3d, IsoFixCurves: list of Polyline, TextureScale: Double, Threshold: Double, MaxIterations: Int32
# ---------- heatstat: C# ----------
// Grasshopper Script Instance
#region Usings
#r "C:\Program Files\Rhino 8\Plug-ins\Grasshopper\Components\KangarooSolver.dll"
using System;
using System.Linq;
using System.Collections;
using System.Collections.Generic;
using System.Drawing;
using System.Threading.Tasks;

using Rhino;
using Rhino.Geometry;

using Grasshopper;
using Grasshopper.Kernel;
using Grasshopper.Kernel.Data;
using Grasshopper.Kernel.Types;

using KPlankton;
#endregion

public class Script_Instance : GH_ScriptInstance
{
    #region Notes
    /* 
      Members:
        RhinoDoc RhinoDocument
        GH_Document GrasshopperDocument
        IGH_Component Component
        int Iteration

      Methods (Virtual & overridable):
        Print(string text)
        Print(string format, params object[] args)
        Reflect(object obj)
        Reflect(object obj, string method_name)
    */

    /*
    Original Script by Daniel Piker 03/07/2020
    Modified by Max Benjamin Eschenbach May 2021
    version: 250227
    */
    #endregion

    private void RunScript(
		Mesh RefMesh,
		List<Point3d> HeatPoints,
		List<Point3d> ColdPoints,
		List<Polyline> IsoFixCurves,
		double TextureScale,
		double Threshold,
		int MaxIterations,
		ref object HeatMesh,
		ref object Values,
		ref object Gradient)
    {
        // set defaults
        bool abort = false;
        if (RefMesh == null)
        {
        this.Component.AddRuntimeMessage(GH_RuntimeMessageLevel.Warning,
            "Input Parameter RefMesh failed to collect data!");
        abort = true;
        }

        if (MaxIterations == 0) MaxIterations = 200;
        if (abort)
        {
        HeatMesh = new DataTree<Object>();
        Values = new DataTree<Object>();
        Gradient = new DataTree<Object>();
        return;
        }

        // init variables
        double[] values;
        double[][] storedweights;
        int[][] storedneighbours;
        Vector3d[] gradient;
        Vector3d[] edgeGradient;
        int[] fix;
        int[][] equalize;
        Mesh ResultMesh;

        // init vars for threshold tracking
        double heat_avg = 0;
        double poisson_avg = 0;
        bool converged = false;

        // INITIALIZE HEAT METHOD -----------------------------------------------

        // convert all quads to triangles
        RefMesh.Faces.ConvertQuadsToTriangles();

        // get kplankton mesh
        KPlanktonMesh ReferencePMesh = KPlankton.RhinoSupport.ToKPlanktonMesh(RefMesh);

        int vc = ReferencePMesh.Vertices.Count;
        storedweights = new double[vc][];
        storedneighbours = new int[vc][];
        values = new double[vc];
        fix = new int[vc];
        equalize = new int[IsoFixCurves.Count][];
        for(int i = 0;i < vc;i++)
        {
            storedweights[i] = ComputeCotanWeights(ReferencePMesh, i);
            storedneighbours[i] = ReferencePMesh.Vertices.GetVertexNeighbours(i);
            for(int j = 0;j < HeatPoints.Count;j++)
            {
                if(ReferencePMesh.Vertices[i].ToPoint3d().DistanceToSquared(HeatPoints[j]) < Rhino.RhinoDoc.ActiveDoc.ModelAbsoluteTolerance)
                {
                    values[i] = 1;
                    fix[i] = 1;
                }
            }
            for(int j = 0;j < ColdPoints.Count;j++)
            {
                if(ReferencePMesh.Vertices[i].ToPoint3d().DistanceToSquared(ColdPoints[j]) < Rhino.RhinoDoc.ActiveDoc.ModelAbsoluteTolerance)
                {
                    values[i] = 0;
                    fix[i] = 2;
                }
            }
        }

        for(int i = 0;i < IsoFixCurves.Count;i++)
        {
            Polyline thisPoly = IsoFixCurves[i];
            int polyCount = thisPoly.Count;
            if(thisPoly[thisPoly.Count - 1].Equals(thisPoly[0])) polyCount--;//don't count first point twice for closed curves
            equalize[i] = new int[polyCount];
            for(int j = 0;j < polyCount;j++)
            {
                for(int k = 0;k < vc;k++)
                {
                    if(ReferencePMesh.Vertices[k].ToPoint3d().DistanceToSquared(thisPoly[j]) < Rhino.RhinoDoc.ActiveDoc.ModelAbsoluteTolerance)
                    {
                        equalize[i][j] = k;
                        break;
                    }
                }
            }
        }

        gradient = new Vector3d[vc];
        ResultMesh = RefMesh.DuplicateMesh();

        edgeGradient = null;

        // HEAT DIFFUSION -----------------------------------------------------

        int heat_iters = 0;
        for(int k = 0; k < MaxIterations; k++)
        {
        heat_iters += 1;
        double[] newValues = new double[values.Length];
        Parallel.For(0, ReferencePMesh.Vertices.Count,
            i => {

            if(fix[i] == 0)
            {
            int[] neighbours = storedneighbours[i];
            double[] weights = storedweights[i];
            double newValue = 0;
            for(int j = 0;j < neighbours.Length;j++)
            {
                newValue += weights[j] * values[neighbours[j]];
            }
            newValues[i] = newValue;
            }
            else newValues[i] = values[i];
            });

        for(int i = 0; i < equalize.Length; i++)
        {
            double avg = 0;
            for(int j = 0;j < equalize[i].Length;j++)avg += newValues[equalize[i][j]];
            avg /= equalize[i].Length;
            for(int j = 0;j < equalize[i].Length;j++) newValues[equalize[i][j]] = avg;
        }
        values = newValues;

        // track average heat value change
        double this_heat_avg = System.Linq.Enumerable.Average(values);
        double heat_avg_change = Math.Abs(this_heat_avg - heat_avg);
        heat_avg = this_heat_avg;

        // break if threshold is reached
        if (heat_avg <= Threshold)
        {
            converged = true;
            break;
        }
        }

        double min = values.Min();
        double max = values.Max();
        double mult = 1.0 / (max - min);
        for(int i = 0;i < values.Length;i++) values[i] = mult * (values[i] - min);

        edgeGradient = null;

        // POISSON AVERAGING --------------------------------------------------

        if(edgeGradient == null)
        {
        gradient = ComputeGradients(ReferencePMesh, values);
        double avgGradientLength = 0;
        for(int i = 0;i < gradient.Length;i++)
        {
            avgGradientLength += gradient[i].Length;
        }
        avgGradientLength /= gradient.Length;

        edgeGradient = new Vector3d[ReferencePMesh.Halfedges.Count / 2];
        for(int i = 0;i < ReferencePMesh.Halfedges.Count / 2;i++)
        {
            int start = ReferencePMesh.Halfedges[2 * i].StartVertex;
            int end = ReferencePMesh.Halfedges[(2 * i) + 1].StartVertex;
            Vector3d sv = gradient[start];
            Vector3d ev = gradient[end];
            Vector3d thisEdgeGradient = sv + ev;
            thisEdgeGradient.Unitize();
            thisEdgeGradient *= avgGradientLength;
            edgeGradient[i] = thisEdgeGradient;
        }
        }

        int ps_iters = 0;
        for(int k = 0; k < MaxIterations; k++)
        {
        ps_iters++;
        double[] heChange = new double[ReferencePMesh.Halfedges.Count];
        Parallel.For(0, ReferencePMesh.Halfedges.Count / 2,
            i => {
            int start = ReferencePMesh.Halfedges[2 * i].StartVertex;
            int end = ReferencePMesh.Halfedges[(2 * i) + 1].StartVertex;
            Vector3d edgeVector = ReferencePMesh.Vertices[end].ToPoint3d() - ReferencePMesh.Vertices[start].ToPoint3d();
            double projected = edgeVector * edgeGradient[i];
            double currentDifference = values[end] - values[start];
            double change = currentDifference - projected;
            heChange[2 * i] = 1 * change;
            heChange[(2 * i) + 1] = -1 * change;
            });

        Parallel.For(0, ReferencePMesh.Vertices.Count,
            i => {
            {
            {
                double[] weights = storedweights[i];
                int[] halfedges = ReferencePMesh.Vertices.GetHalfedges(i);
                for(int j = 0;j < halfedges.Length;j++)
                {
                values[i] += heChange[halfedges[j]] * weights[j];
                }
            }
            }
            });

        double this_poisson_avg = 0;
        for(int i = 0;i < equalize.Length;i++)
        {
            double avg = 0;
            for(int j = 0;j < equalize[i].Length;j++)avg += values[equalize[i][j]];
            avg /= equalize[i].Length;
            for(int j = 0;j < equalize[i].Length;j++) values[equalize[i][j]] = avg;
            this_poisson_avg = avg;
        }

        // track average value change for poisson step
        double poisson_avg_change = Math.Abs(this_poisson_avg - poisson_avg);
        poisson_avg = this_poisson_avg;

        /*
        if (poisson_avg_change <= Threshold)
        {
            converged = true;
            break;
        }
        */
        }

        if (converged == true)
        {
        this.Component.Message = String.Format("Converged.\n{0} Heat Diffusion iterations", heat_iters);
        }
        else
        {
        this.Component.Message = "MaxIterations reached!";
        }


        // SET TEXTURE COORDINATES ----------------------------------------------

        for(int i = 0;i < ResultMesh.Vertices.Count;i++)
        {
        ResultMesh.TextureCoordinates.SetTextureCoordinate(i, new Point2f(0, (float) (values[i] * TextureScale)));
        }

        // OUTPUT ----------------------------------------------------------------

        // input mesh with adjusted texture coordinates
        HeatMesh = ResultMesh;
        // the scalar values and gradient vectors per vertex
        Values = values;
        Gradient = gradient;
    }

    private static Vector3d[] ComputeGradients(KPlanktonMesh KPM, double[] values)
    {
        // compute halfedge gradients
        Vector3d[] halfedgeGradients = new Vector3d[KPM.Halfedges.Count];
        for(int i = 0;i < KPM.Halfedges.Count / 2;i++)
        {
        int start = KPM.Halfedges[2 * i].StartVertex;
        int end = KPM.Halfedges[2 * i + 1].StartVertex;
        Vector3d v = KPM.Vertices[end].ToPoint3d() - KPM.Vertices[start].ToPoint3d();
        double lengthSquared = v.SquareLength;
        double diff = values[end] - values[start];
        Vector3d edgeGradient = v * (diff / lengthSquared);
        halfedgeGradients[2 * i] = halfedgeGradients[2 * i + 1] = edgeGradient;
        }

        // compute vertex gradients from halfedge gradients
        Vector3d[] vertexGradients = new Vector3d[KPM.Vertices.Count];
        for(int i = 0;i < KPM.Vertices.Count;i++)
        {
        double[] weights = ComputeCotanWeights(KPM, i);
        Vector3d gradient = new Vector3d();
        int[] halfedges = KPM.Vertices.GetHalfedges(i);
        for(int j = 0;j < halfedges.Length;j++)
        {
            gradient += halfedgeGradients[halfedges[j]] * weights[j];
        }
        vertexGradients[i] = gradient;
        }
        return vertexGradients;
    }

    private static double[] ComputeCotanWeights(KPlanktonMesh KPM, int i)
    {
        int[] Neighbours = KPM.Vertices.GetVertexNeighbours(i);
        Point3d Vertex = KPM.Vertices[i].ToPoint3d();
        int valence = KPM.Vertices.GetValence(i);
        Point3d[] NeighbourPts = new Point3d[valence];
        Vector3d[] Radial = new Vector3d[valence];
        Vector3d[] Around = new Vector3d[valence];
        double[] CotWeight = new double[valence];
        double WeightSum = 0;
        for (int j = 0; j < valence; j++)
        {
        NeighbourPts[j] = KPM.Vertices[Neighbours[j]].ToPoint3d();
        Radial[j] = NeighbourPts[j] - Vertex;
        }
        for (int j = 0; j < valence; j++)
        {
        Around[j] = NeighbourPts[(j + 1) % valence] - NeighbourPts[j];
        }
        int[] halfEdges = KPM.Vertices.GetHalfedges(i);
        for (int j = 0; j < Neighbours.Length; j++)
        {
        int previous = (j + valence - 1) % valence;
        int next = (j + 1) % valence;

        Vector3d Cross1 = Vector3d.CrossProduct(Radial[previous], Around[previous]);
        double Dot1 = Radial[previous] * Around[previous];
        double cwa = Math.Abs(Dot1 / Cross1.Length);

        Vector3d Cross2 = Vector3d.CrossProduct(Radial[next], Around[j]);
        double Dot2 = Radial[next] * Around[j];
        double cwb = Math.Abs(Dot2 / Cross2.Length);

        if(KPM.Halfedges[halfEdges[j]].AdjacentFace == -1){cwa = 0;}
        if(KPM.Halfedges[KPM.Halfedges.GetPairHalfedge(halfEdges[j])].AdjacentFace == -1){cwb = 0;}
        CotWeight[j] = cwa + cwb;
        WeightSum += CotWeight[j];
        }
        for (int j = 0; j < CotWeight.Length; j++) CotWeight[j] /= WeightSum;
        return CotWeight;
    }

}
# ---------- end heatstat ----------
heatstat_osx = HeatMethodStatic_OSX(
    InMesh=gate_11.Target1,
    HeatPoints=gate_12.Target1,
    ColdPoints=gate_13.Target1,
    IsoFixCurves=gate_14.Target1,
    TextureScale=gate_15.Target1,
    Threshold=gate_16.Target1,
    MaxIterations=gate_17.Target1,
    TooltipDescriptionOverride="Uff uff",
    Reference="/Applications/Rhino 7.app/Contents/Frameworks/RhCore.framework/Versions/A/Resources/ManagedPlugIns/GrasshopperPlugin.rhp/Components/KangarooSolver.dll")  # -> Mesh, Values, Gradient; inputs InMesh: Mesh, HeatPoints: list of Point3d, ColdPoints: list of Point3d, IsoFixCurves: list of Polyline, TextureScale: Double, Threshold: Double, MaxIterations: Int32
# ---------- heatstat_osx: C# usings ----------
using System.Linq;
using System.Threading.Tasks;
using System.Reflection;

using KPlankton;
# ---------- heatstat_osx: C# ----------
        /*
    Original Script by Daniel Piker 03/07/2020
    Modified by Max Eschenbach May 2021
    version: 230510
    */

    // set component params
    this.Component.Name = "HeatMethodStatic_OSX";
    this.Component.NickName = "HeatStat_OSX";
    this.Component.Category = "FindersKeepers";
    this.Component.SubCategory = "1 Mesh";
    this.Component.Description = ("Static Geodesic Distance Solver using the heat method. Connect at least a " +
      "mesh and some HeatPoints and set MaxIterations to a value of your choice.\n----\n" +
      "This is an implementation of 'The Heat Method for Distance Computation' by Keenan Crane, Clarisse " +
      "Weischedel and Max Wardetzky.\nhttps://www.cs.cmu.edu/~kmcrane/Projects/HeatMethod/\n----\n" +
      "Based on a implementation by Daniel Piker\nsee https://discourse.mcneel.com/t/heat-method/105135/30");
    // set component param descriptions
    this.Component.Params.Input[0].Description = "The mesh for geodesic distance computation. \n{item, Mesh}";
    this.Component.Params.Input[1].Description = ("The points from which the heat spreads during the heat " +
      "diffusion step. The value of these points will stay 1 during the heat diffusion step.\n{list, Point3d}");
    this.Component.Params.Input[2].Description = ("The points that will stay cold during the heat diffusion " +
      "step. Their value will be 0 during this step.\n{list, Point3d}");
    this.Component.Params.Input[3].Description = ("Defines one or many polylines where the iso value will " +
      "be the same at every point of the polyline.\n----\nNOTE - The iso values are allowed to change but " +
      "will stay the same across the whole polyline!\n{list, Polyline}");
    this.Component.Params.Input[4].Description = ("Scaling factor for the TextureCoordinates. " +
      "Defaults to 1.0\n{item, float}");
    this.Component.Params.Input[5].Description = ("Maximum iterations to run the heat diffusion and poisson " +
      "setp for. Defaults to 200.\n{item, int}");

    // set defaults
    bool abort = false;
    if (InMesh == null)
    {
      this.Component.AddRuntimeMessage(GH_RuntimeMessageLevel.Warning,
        "Input Parameter InMesh failed to collect data!");
      abort = true;
    }

    if (MaxIterations == 0) MaxIterations = 200;
    if (abort)
    {
      Mesh = new DataTree<Object>();
      Values = new DataTree<Object>();
      Gradient = new DataTree<Object>();
      return;
    }

    // init variables
    double[] values;
    double[][] storedweights;
    int[][] storedneighbours;
    Vector3d[] gradient;
    Vector3d[] edgeGradient;
    int[] fix;
    int[][] equalize;
    Mesh ResultMesh;

    // init vars for threshold tracking
    double heat_avg = 0;
    double poisson_avg = 0;
    bool converged = false;

    // INITIALIZE HEAT METHOD -----------------------------------------------

    // convert all quads to triangles
    InMesh.Faces.ConvertQuadsToTriangles();

    // get kplankton mesh
    KPlanktonMesh ReferencePMesh = KPlankton.RhinoSupport.ToKPlanktonMesh(InMesh);

    int vc = ReferencePMesh.Vertices.Count;
    storedweights = new double[vc][];
    storedneighbours = new int[vc][];
    values = new double[vc];
    fix = new int[vc];
    equalize = new int[IsoFixCurves.Count][];
    for(int i = 0;i < vc;i++)
    {
      storedweights[i] = ComputeCotanWeights(ReferencePMesh, i);
      storedneighbours[i] = ReferencePMesh.Vertices.GetVertexNeighbours(i);
      for(int j = 0;j < HeatPoints.Count;j++)
      {
        if(ReferencePMesh.Vertices[i].ToPoint3d().DistanceToSquared(HeatPoints[j]) < Rhino.RhinoDoc.ActiveDoc.ModelAbsoluteTolerance)
        {
          values[i] = 1;
          fix[i] = 1;
        }
      }
      for(int j = 0;j < ColdPoints.Count;j++)
      {
        if(ReferencePMesh.Vertices[i].ToPoint3d().DistanceToSquared(ColdPoints[j]) < Rhino.RhinoDoc.ActiveDoc.ModelAbsoluteTolerance)
        {
          values[i] = 0;
          fix[i] = 2;
        }
      }
    }

    for(int i = 0;i < IsoFixCurves.Count;i++)
    {
      Polyline thisPoly = IsoFixCurves[i];
      int polyCount = thisPoly.Count;
      if(thisPoly[thisPoly.Count - 1].Equals(thisPoly[0])) polyCount--;//don't count first point twice for closed curves
      equalize[i] = new int[polyCount];
      for(int j = 0;j < polyCount;j++)
      {
        for(int k = 0;k < vc;k++)
        {
          if(ReferencePMesh.Vertices[k].ToPoint3d().DistanceToSquared(thisPoly[j]) < Rhino.RhinoDoc.ActiveDoc.ModelAbsoluteTolerance)
          {
            equalize[i][j] = k;
            break;
          }
        }
      }
    }

    gradient = new Vector3d[vc];
    ResultMesh = InMesh.DuplicateMesh();

    edgeGradient = null;

    // HEAT DIFFUSION -----------------------------------------------------

    int heat_iters = 0;
    for(int k = 0; k < MaxIterations; k++)
    {
      heat_iters += 1;
      double[] newValues = new double[values.Length];
      Parallel.For(0, ReferencePMesh.Vertices.Count,
        i => {

        if(fix[i] == 0)
        {
          int[] neighbours = storedneighbours[i];
          double[] weights = storedweights[i];
          double newValue = 0;
          for(int j = 0;j < neighbours.Length;j++)
          {
            newValue += weights[j] * values[neighbours[j]];
          }
          newValues[i] = newValue;
        }
        else newValues[i] = values[i];
        });

      for(int i = 0; i < equalize.Length; i++)
      {
        double avg = 0;
        for(int j = 0;j < equalize[i].Length;j++)avg += newValues[equalize[i][j]];
        avg /= equalize[i].Length;
        for(int j = 0;j < equalize[i].Length;j++) newValues[equalize[i][j]] = avg;
      }
      values = newValues;

      // track average heat value change
      double this_heat_avg = System.Linq.Enumerable.Average(values);
      double heat_avg_change = Math.Abs(this_heat_avg - heat_avg);
      heat_avg = this_heat_avg;

      // break if threshold is reached
      if (heat_avg <= Threshold)
      {
        converged = true;
        break;
      }
    }

    double min = values.Min();
    double max = values.Max();
    double mult = 1.0 / (max - min);
    for(int i = 0;i < values.Length;i++) values[i] = mult * (values[i] - min);

    edgeGradient = null;

    // POISSON AVERAGING --------------------------------------------------

    if(edgeGradient == null)
    {
      gradient = ComputeGradients(ReferencePMesh, values);
      double avgGradientLength = 0;
      for(int i = 0;i < gradient.Length;i++)
      {
        avgGradientLength += gradient[i].Length;
      }
      avgGradientLength /= gradient.Length;

      edgeGradient = new Vector3d[ReferencePMesh.Halfedges.Count / 2];
      for(int i = 0;i < ReferencePMesh.Halfedges.Count / 2;i++)
      {
        int start = ReferencePMesh.Halfedges[2 * i].StartVertex;
        int end = ReferencePMesh.Halfedges[(2 * i) + 1].StartVertex;
        Vector3d sv = gradient[start];
        Vector3d ev = gradient[end];
        Vector3d thisEdgeGradient = sv + ev;
        thisEdgeGradient.Unitize();
        thisEdgeGradient *= avgGradientLength;
        edgeGradient[i] = thisEdgeGradient;
      }
    }

    int ps_iters = 0;
    for(int k = 0; k < MaxIterations; k++)
    {
      ps_iters++;
      double[] heChange = new double[ReferencePMesh.Halfedges.Count];
      Parallel.For(0, ReferencePMesh.Halfedges.Count / 2,
        i => {
        int start = ReferencePMesh.Halfedges[2 * i].StartVertex;
        int end = ReferencePMesh.Halfedges[(2 * i) + 1].StartVertex;
        Vector3d edgeVector = ReferencePMesh.Vertices[end].ToPoint3d() - ReferencePMesh.Vertices[start].ToPoint3d();
        double projected = edgeVector * edgeGradient[i];
        double currentDifference = values[end] - values[start];
        double change = currentDifference - projected;
        heChange[2 * i] = 1 * change;
        heChange[(2 * i) + 1] = -1 * change;
        });

      Parallel.For(0, ReferencePMesh.Vertices.Count,
        i => {
        {
          {
            double[] weights = storedweights[i];
            int[] halfedges = ReferencePMesh.Vertices.GetHalfedges(i);
            for(int j = 0;j < halfedges.Length;j++)
            {
              values[i] += heChange[halfedges[j]] * weights[j];
            }
          }
        }
        });

      double this_poisson_avg = 0;
      for(int i = 0;i < equalize.Length;i++)
      {
        double avg = 0;
        for(int j = 0;j < equalize[i].Length;j++)avg += values[equalize[i][j]];
        avg /= equalize[i].Length;
        for(int j = 0;j < equalize[i].Length;j++) values[equalize[i][j]] = avg;
        this_poisson_avg = avg;
      }

      // track average value change for poisson step
      double poisson_avg_change = Math.Abs(this_poisson_avg - poisson_avg);
      poisson_avg = this_poisson_avg;

      /*
      if (poisson_avg_change <= Threshold)
      {
        converged = true;
        break;
      }
      */
    }

    if (converged == true)
    {
      this.Component.Message = String.Format("Converged.\n{0} Heat Diffusion iterations", heat_iters);
    }
    else
    {
      this.Component.Message = "MaxIterations reached!";
    }


    // SET TEXTURE COORDINATES ----------------------------------------------

    for(int i = 0;i < ResultMesh.Vertices.Count;i++)
    {
      ResultMesh.TextureCoordinates.SetTextureCoordinate(i, new Point2f(0, (float) (values[i] * TextureScale)));
    }

    // OUTPUT ----------------------------------------------------------------

    // input mesh with adjusted texture coordinates
    Mesh = ResultMesh;
    // the scalar values and gradient vectors per vertex
    Values = values;
    Gradient = gradient;
# ---------- heatstat_osx: C# additional code ----------
  private static Vector3d[] ComputeGradients(KPlanktonMesh KPM, double[] values)
  {
    // compute halfedge gradients
    Vector3d[] halfedgeGradients = new Vector3d[KPM.Halfedges.Count];
    for(int i = 0;i < KPM.Halfedges.Count / 2;i++)
    {
      int start = KPM.Halfedges[2 * i].StartVertex;
      int end = KPM.Halfedges[2 * i + 1].StartVertex;
      Vector3d v = KPM.Vertices[end].ToPoint3d() - KPM.Vertices[start].ToPoint3d();
      double lengthSquared = v.SquareLength;
      double diff = values[end] - values[start];
      Vector3d edgeGradient = v * (diff / lengthSquared);
      halfedgeGradients[2 * i] = halfedgeGradients[2 * i + 1] = edgeGradient;
    }

    // compute vertex gradients from halfedge gradients
    Vector3d[] vertexGradients = new Vector3d[KPM.Vertices.Count];
    for(int i = 0;i < KPM.Vertices.Count;i++)
    {
      double[] weights = ComputeCotanWeights(KPM, i);
      Vector3d gradient = new Vector3d();
      int[] halfedges = KPM.Vertices.GetHalfedges(i);
      for(int j = 0;j < halfedges.Length;j++)
      {
        gradient += halfedgeGradients[halfedges[j]] * weights[j];
      }
      vertexGradients[i] = gradient;
    }
    return vertexGradients;
  }

  private static double[] ComputeCotanWeights(KPlanktonMesh KPM, int i)
  {
    int[] Neighbours = KPM.Vertices.GetVertexNeighbours(i);
    Point3d Vertex = KPM.Vertices[i].ToPoint3d();
    int valence = KPM.Vertices.GetValence(i);
    Point3d[] NeighbourPts = new Point3d[valence];
    Vector3d[] Radial = new Vector3d[valence];
    Vector3d[] Around = new Vector3d[valence];
    double[] CotWeight = new double[valence];
    double WeightSum = 0;
    for (int j = 0; j < valence; j++)
    {
      NeighbourPts[j] = KPM.Vertices[Neighbours[j]].ToPoint3d();
      Radial[j] = NeighbourPts[j] - Vertex;
    }
    for (int j = 0; j < valence; j++)
    {
      Around[j] = NeighbourPts[(j + 1) % valence] - NeighbourPts[j];
    }
    int[] halfEdges = KPM.Vertices.GetHalfedges(i);
    for (int j = 0; j < Neighbours.Length; j++)
    {
      int previous = (j + valence - 1) % valence;
      int next = (j + 1) % valence;

      Vector3d Cross1 = Vector3d.CrossProduct(Radial[previous], Around[previous]);
      double Dot1 = Radial[previous] * Around[previous];
      double cwa = Math.Abs(Dot1 / Cross1.Length);

      Vector3d Cross2 = Vector3d.CrossProduct(Radial[next], Around[j]);
      double Dot2 = Radial[next] * Around[j];
      double cwb = Math.Abs(Dot2 / Cross2.Length);

      if(KPM.Halfedges[halfEdges[j]].AdjacentFace == -1){cwa = 0;}
      if(KPM.Halfedges[KPM.Halfedges.GetPairHalfedge(halfEdges[j])].AdjacentFace == -1){cwb = 0;}
      CotWeight[j] = cwa + cwb;
      WeightSum += CotWeight[j];
    }
    for (int j = 0; j < CotWeight.Length; j++) CotWeight[j] /= WeightSum;
    return CotWeight;
  }
# ---------- end heatstat_osx ----------
filter_36 = StreamFilter(Gate=osselector.B, Stream0=heatstat.HeatMesh, Stream1=heatstat_osx.Mesh)
filter_37 = StreamFilter(Gate=osselector.B, Stream0=heatstat.Values, Stream1=heatstat_osx.Values)
heatvalues = Data(filter_37)
heatmesh_2 = Mesh(filter_36)

# ----
# comments & notes: CREATE OUTER INFILL CAP BASE CRVS
printing_geometry_closed_3 = Boolean(printing_geometry_closed)
slice_curves_clsd_outer_4 = Curve(slice_curves_clsd_outer_3)
cap_layer_count_3 = Integer(cap_layer_count)
offset_inkl_iw_overlap_2 = Data(offset_inkl_iw_overlap)
slice_planes_2 = Data(slice_planes)
larger_7 = LargerThan(FirstNumber=cap_layer_count_3, SecondNumber="0")  # -> LargerThan, OrEqualTo
and_10 = GateAnd(A=larger_7.LargerThan, B=printing_geometry_closed_3)
filter_38 = StreamFilter(Gate=and_10, Stream1=slice_curves_clsd_outer_4)
series_2 = Series(Start=0, Step=1, Count=cap_layer_count_3)
tstat_7 = TreeStatistics(Tree=filter_38)  # -> reverse(Paths), Length, Count
item_6 = ListItem(List=tstat_7.Paths, Index=series_2, Wrap=True)  # -> reverse(Item)
branch_7 = TreeBranch(Tree=filter_38, Path=item_6, MaintainPaths=True)
branch_8 = TreeBranch(Tree=slice_planes_2, Path=item_6, MaintainPaths=True)
c2offset = Clipper2Offset(Polylines=branch_7, Distance=offset_inkl_iw_overlap_2, JoinType=0, EndType=0, MiterLimit=2, Precision=6)  # -> Holes, Outer, ClipperPaths
pshift_9 = ShiftPaths(Data=c2offset.Holes, Offset=-1)
redpline_2 = Reduce(Polyline=pshift_9, Tolerance="0.025")  # -> Polyline, Reduction
project = Project(Geometry=redpline_2.Polyline, Plane=branch_8)  # -> Geometry, Transform
outer_infill_base_crv_cap = Curve(project.Geometry)

# ----
# comments & notes: iso-contouring based on heatmesh texture coordinates
np_only_bot_boundary_2 = Boolean(np_only_bot_boundary)
heatmesh_3 = Mesh(heatmesh_2)
layer_height_5 = Data(layer_height)
bbox_5 = BoundingBox(Content=heatmesh_3, Plane=PlaneXY(0, 0, 0), UnionBox=True)  # -> Box, Box_2
debox_4 = DeconstructBox(Box=bbox_5.Box)  # -> Plane, X, Y, Z
dedomain_4 = DeconstructDomain(Domain=debox_4.Z)  # -> Start, End
subtraction_3 = Subtraction(A=dedomain_4.End, B=dedomain_4.Start)
division_3 = Division(A=subtraction_3, B=layer_height_5)
round = Round(Number=division_3)  # -> Nearest, Floor, Ceiling
isoconmeshcount = IsoContourMeshCount(InMesh=heatmesh_3, Count=round.Ceiling)  # -> out, Contours, DebuggingOut; inputs InMesh: Mesh, Count: Int32
# ---------- isoconmeshcount: C# ----------
// Grasshopper Script Instance
#region Usings
using System;
using System.Linq;
using System.Collections;
using System.Collections.Generic;
using System.Drawing;

using Rhino;
using Rhino.Geometry;

using System.Threading.Tasks;
using System.Collections.Concurrent;
using Rhino.Collections;

using Grasshopper;
using Grasshopper.Kernel;
using Grasshopper.Kernel.Data;
using Grasshopper.Kernel.Types;
#endregion

public class Script_Instance : GH_ScriptInstance
{
    #region Notes
    /* 
      Members:
        RhinoDoc RhinoDocument
        GH_Document GrasshopperDocument
        IGH_Component Component
        int Iteration

      Methods (Virtual & overridable):
        Print(string text)
        Print(string format, params object[] args)
        Reflect(object obj)
        Reflect(object obj, string method_name)
    */
    #endregion

    private void RunScript(
		Mesh InMesh,
		int Count,
		ref object Contours,
		ref object DebuggingOut)
    {
        
    /*
    Original Script by Daniel Piker 03/07/2020
    Modified by Max Eschenbach
    version: 240515
    */

    // set component params
    this.Component.Name = "IsoContourMeshCount";
    this.Component.NickName = "IsoConMeshCount";
    this.Component.Category = "FindersKeepers";
    this.Component.SubCategory = "1 Mesh";

    // sanitize data input
    if (InMesh == null)
    {
      this.Component.AddRuntimeMessage(GH_RuntimeMessageLevel.Warning,
        "Input Parameter InMesh failed to collect data!");
      Contours = new Grasshopper.DataTree<PolylineCurve>();
    }
    // only do something if mesh is present
    if (InMesh != null && Count > 0)
    {
      // Contours = OrderSliceCurves(CreateContours(InMesh, Count));
      var UnorderedContours = CreateContours(InMesh, Count);
      Contours = OrderSliceCurves(UnorderedContours);
    }
    else
    {
      this.Component.AddRuntimeMessage(GH_RuntimeMessageLevel.Warning, "Input Parameters failed to collect data!");
    }
    }

  public List<Curve> FindBoundaries(Mesh M)
  {
    // get naked mesh edges
    Polyline[] NakedEdges = M.GetNakedEdges();

    // join all the resulting naked edges
    Curve[] Boundaries = Curve.JoinCurves(NakedEdges.Select(pl => pl.ToPolylineCurve()));

    return Boundaries.ToList();
  }

  public DataTree<PolylineCurve> CreateContours(Mesh M, int Count)
  {
    // subtract from the count to make count match the outcome
    Count -= 2;

    // init concurrent bag for storing contours
    List<PolylineCurve>[] contours = new List<PolylineCurve>[Count];


    // extract gradient from texture coordinates
    double[] values = new double[M.Vertices.Count];
    for(int i = 0; i < M.Vertices.Count; i++) values[i] = M.TextureCoordinates[i].Y;

    // get bounds of gradient value domain
    double target_min = values.Min();
    double target_max = values.Max();

    // compute stepsize for iso values
    // increment count to avoid catching boundary extremes
    // (they will be found later)
    double stepsize = (target_max - target_min) / (Count + 1.0);

    // create contours in parallel
    Parallel.For(0, Count,
      j => {
      // compute current iso value
      double iso = target_min + ((j + 1) * stepsize);

      // init list for geometry storage
      List<Curve> curves = new List<Curve>();

      // loop over all faces
      for(int i = 0; i < M.Faces.Count; i++)
      {
        int va = M.Faces[i].A;
        int vb = M.Faces[i].B;
        int vc = M.Faces[i].C;

        double a = M.TextureCoordinates[va].Y - iso;
        double b = M.TextureCoordinates[vb].Y - iso;
        double c = M.TextureCoordinates[vc].Y - iso;

        Point3d pa = M.Vertices.Point3dAt(va);
        Point3d pb = M.Vertices.Point3dAt(vb);
        Point3d pc = M.Vertices.Point3dAt(vc);

        List<Point3d> ends = new List<Point3d>();

        // find line segment
        if(a < 0 != b < 0)
        {
          double wa = b / (b - a);
          double wb = 1 - wa;
          ends.Add(wa * pa + wb * pb);
        }
        if(a < 0 != c < 0)
        {
          double wa = c / (c - a);
          double wc = 1 - wa;
          ends.Add(wa * pa + wc * pc);
        }
        if(c < 0 != b < 0)
        {
          double wb = c / (c - b);
          double wc = 1 - wb;
          ends.Add(wb * pb + wc * pc);
        }

        // if line segment is complete add it to list
        if(ends.Count == 2)
        {
          curves.Add(new LineCurve(ends[0], ends[1]));
        }
      }

      // join contour lines
      Curve[] jcrvs = Curve.JoinCurves(curves);

      // init list for storing closed curves
      List<PolylineCurve> clsdcrvs = new List<PolylineCurve>();

      // only add closed curves
      for (int i = 0; i < jcrvs.Length; i++)
      {
        if (jcrvs[i].IsClosed)
        {
          clsdcrvs.Add(jcrvs[i] as PolylineCurve);
        }
      }
      // add list of closed curves to array
      contours[j] = clsdcrvs;

      // end parallel for
      });

    // convert array results to datatree for output
    DataTree<PolylineCurve> ContourTree = new DataTree<PolylineCurve>();
    for (int i = 0; i < contours.Length; i++)
    {
      // create path in datatre
      // increment i because of intentionally missing extremes
      GH_Path path = new GH_Path(0, i + 1);
      ContourTree.AddRange(contours[i], path);
    }

    // find extreme boundaries seperately
    // this is necessary because of stability issues
    // with the iso routine near the boundaries
    List<Curve> Boundaries = FindBoundaries(M);

    // loop through boundaries and for every boundary
    // find the corresponding tree path
    for (int i = 0; i < Boundaries.Count; i++)
    {
      // init vars for closest branch and minimum distance
      int closestBranch = 0;
      double minDist = double.MaxValue;
      // get closest point on every contour curve
      for (int j = 1; j < ContourTree.BranchCount; j++)
      {
        Point3d onCrv;
        Point3d onObj;
        int wG;
        // get cp pair for every branch
        bool ret = Boundaries[i].ClosestPoints(ContourTree.Branches[j], out onCrv, out onObj, out wG);
        // measure distance
        double dist = onCrv.DistanceTo(onObj);
        // set minimum distance
        if (dist < minDist)
        {
          minDist = dist;
          closestBranch = j;
        }
      }
      // correct closest branch
      if (closestBranch == 1)
      {
        closestBranch = 0;
      }
      else if (closestBranch == ContourTree.BranchCount - 1)
      {
        closestBranch = Count + 1;
      }
      else
      {
        continue;
      }

      //Print(closestBranch.ToString());

      // insert into contour tree
      GH_Path ghp = new GH_Path(0, closestBranch);
      ContourTree.EnsurePath(ghp);
      ContourTree.Add(Boundaries[i] as PolylineCurve, ghp);
    }

    // return tree with closed contour curves
    return ContourTree;
  }

  public DataTree<PolylineCurve> OrderSliceCurves(DataTree<PolylineCurve> ContourCurves)
  {
    // create copy of datatree to avoid messing up things
    DataTree<PolylineCurve> SliceCurves = new DataTree<PolylineCurve>(ContourCurves);

    // loop over datatree and ensure correct order
    for (int i = 0; i < SliceCurves.BranchCount - 1; i++)
    {
      // get branches
      var this_branch = SliceCurves.Branches[i];
      var next_branch = SliceCurves.Branches[i + 1];

      // case 1: this branch one curve and next branch one curve
      if (this_branch.Count == 1 && next_branch.Count == 1)
      {
        //Print("Case 1, 1 -> 1 (nothing done)");
        // nothing needs to be done
      }
        // case 2: this branch one curve and next branch multiple curves
      else if (this_branch.Count == 1 && next_branch.Count > 1)
      {
        //Print("Case 2, 1 -> N");
        // loop over next branch and find all centerpoints to compare against

        Point3dList ptL = new Point3dList();
        for (int k = 0; k < next_branch.Count; k++)
        {
          Point3d cpB = next_branch[k].ToPolyline().CenterPoint();
          ptL.Add(cpB);
        }
        // create new list for storage
        List<PolylineCurve> OrderedNextBranch = new List<PolylineCurve>();
        // get curve centerpoint
        Point3d cpA = this_branch[0].ToPolyline().CenterPoint();
        // compare against point3dlist of other centerpoints
        int idx = ptL.ClosestIndex(cpA);
        OrderedNextBranch.Add(next_branch[idx].Duplicate() as PolylineCurve);
        next_branch.RemoveAt(idx);
        OrderedNextBranch.AddRange(next_branch);
        // clear data
        ptL.Clear();
        // restructure next branch of contours tree
        SliceCurves.Branches[i + 1].Clear();
        SliceCurves.Branches[i + 1].AddRange(OrderedNextBranch);
      }
        // case 3: this branch and next branch have multiple curves but the same count
      else if (this_branch.Count > 1 && this_branch.Count == next_branch.Count)
      {
        //Print("Case 3, N -> N");
        // create new list for storage
        List<PolylineCurve> OrderedNextBranch = new List<PolylineCurve>();
        // loop over all curves in this branch
        for (int j = 0; j < this_branch.Count; j++)
        {
          if (next_branch.Count < 1) break;
          // loop over next branch and find all centerpoints to compare against
          Point3dList ptL = new Point3dList();
          for (int k = 0; k < next_branch.Count; k++)
          {
            Point3d cpB = next_branch[k].ToPolyline().CenterPoint();
            ptL.Add(cpB);
          }
          // get curve centerpoint
          Point3d cpA = this_branch[j].ToPolyline().CenterPoint();
          // compare against point3dlist of other centerpoints
          int idx = ptL.ClosestIndex(cpA);
          // add closest item to ordered list
          OrderedNextBranch.Add(next_branch[idx].Duplicate() as PolylineCurve);
          // remove closest item from candidates
          next_branch.RemoveAt(idx);
          // clear data
          ptL.Clear();
        }
        // restructure next branch of contours tree
        SliceCurves.Branches[i + 1].Clear();
        SliceCurves.Branches[i + 1].AddRange(OrderedNextBranch);
      }
        // case 4: this branch has more curves than next branch
      else if (this_branch.Count > 1 && next_branch.Count > 1 && this_branch.Count > next_branch.Count)
      {
        //Print("Case 4, N -> M>N (VERIFY!)");
        // create new list for storage
        List<PolylineCurve> OrderedNextBranch = new List<PolylineCurve>();
        // loop over all curves in this branch
        for (int j = 0; j < this_branch.Count; j++)
        {
          if (next_branch.Count < 1) break;
          // loop over next branch and find all centerpoints to compare against
          Point3dList ptL = new Point3dList();
          for (int k = 0; k < next_branch.Count; k++)
          {
            
            // Point3d cpB = AreaMassProperties.Compute(next_branch[k]).Centroid;
            Point3d cpB = next_branch[k].ToPolyline().CenterPoint();
            ptL.Add(cpB);
          }
          // get curve centerpoint
          //  Point3d cpA = AreaMassProperties.Compute(this_branch[j]).Centroid;
          Point3d cpA = this_branch[j].ToPolyline().CenterPoint();
          // compare against point3dlist of other centerpoints
          int idx = ptL.ClosestIndex(cpA);
          // add closest item to ordered list
          OrderedNextBranch.Add(next_branch[idx].Duplicate() as PolylineCurve);
          // remove closest item from candidates
          next_branch.RemoveAt(idx);
          // clear data
          ptL.Clear();
        }
        // restructure next branch of contours tree
        SliceCurves.Branches[i + 1].Clear();
        SliceCurves.Branches[i + 1].AddRange(OrderedNextBranch);
      }
        // case 5: this branch has less curves than next branch
      else if (this_branch.Count > 1 && next_branch.Count > 1 && this_branch.Count < next_branch.Count)
      {
        //Print("Case 5, N -> M<N (VERIFY)");
        // loop over next branch and find all centerpoints to compare against
        Point3dList ptL = new Point3dList();
        for (int k = 0; k < next_branch.Count; k++)
        {
          Point3d cpB = next_branch[k].ToPolyline().CenterPoint();
          ptL.Add(cpB);
        }
        // create new list for storage
        List<PolylineCurve> OrderedNextBranch = new List<PolylineCurve>();
        // create duplicate list for looping
        List<PolylineCurve> next_branch_dup = new List<PolylineCurve>(next_branch);
        // loop over all curves in this branch
        for (int j = 0; j < this_branch.Count; j++)
        {
          // get curve centerpoint
          Point3d cpA = this_branch[j].ToPolyline().CenterPoint();
          // compare against point3dlist of other centerpoints
          int idx = ptL.ClosestIndex(cpA);
          // add closest curve based on comparison to new list
          OrderedNextBranch.Add(next_branch[idx].Duplicate() as PolylineCurve);
          next_branch_dup.Remove(next_branch[idx]);
        }
        // add remaining curves from next branch to list
        OrderedNextBranch.AddRange(next_branch_dup);
        // clear data
        ptL.Clear();
        // restructure next branch of contours tree
        SliceCurves.Branches[i + 1].Clear();
        SliceCurves.Branches[i + 1].AddRange(OrderedNextBranch);
      }
        // case 6: this branch has multiple curves but next branch only has one
      else if (this_branch.Count > 1 && next_branch.Count == 1)
      {
        //Print("Case 6, N -> 1 (nothing done)");
      }
    }

    return SliceCurves;
  }

}
# ---------- end isoconmeshcount ----------
panel_15 = Panel(isoconmeshcount.out)
contours = Data(isoconmeshcount.Contours)
filter_39 = StreamFilter(Gate=np_only_bot_boundary_2, Stream1=contours)
tstat_8 = TreeStatistics(Tree=filter_39)  # -> reverse(Paths), Length, Count
branch_9 = TreeBranch(Tree=filter_39, Path=tstat_8.Paths, MaintainPaths=False)
filter_40 = StreamFilter(Gate=np_only_bot_boundary_2, Stream0=contours, Stream1=branch_9)
contours_2 = Data(filter_40)

# ----
# comments & notes: increment paths if floor is added to open, np-sliced object to prevent merging errors with synthesized floor layers
add_floor_to_open_objects_3 = Data(add_floor_to_open_objects)
contours_3 = Data(contours_2)
filter_41 = StreamFilter(Gate=add_floor_to_open_objects_3, Stream1=contours_3)
tstat_9 = TreeStatistics(Tree=filter_41)  # -> Paths, Length, Count
dpath_3 = DeconstructPath(Branch=tstat_9.Paths)
lng_7 = ListLength(List=dpath_3)  # -> expr("x-1", Length)
floor_layer_count_7 = Data(floor_layer_count)
split_3 = SplitList(List=dpath_3, Index=lng_7)  # -> ListA, ListB
addition_2 = Addition(A=split_3.ListB, B=floor_layer_count_7)
merge_5 = Merge(Data1=split_3.ListA, Data2=addition_2)
path_2 = ConstructPath(Indices=merge_5)  # -> flatten(Branch)
replace = ReplacePaths(Data=filter_41, Search=tstat_9.Paths, Replace=path_2)
filter_42 = StreamFilter(Gate=add_floor_to_open_objects_3, Stream0=contours_3, Stream1=replace)
np_slice_curves = Curve(filter_42)

np_only_bot_boundary_3 = Boolean(np_only_bot_boundary)
heatmesh_4 = Mesh(heatmesh_2)
heatvalues_2 = Data(heatvalues)
bnd = Bounds(Numbers=heatvalues_2)
dedomain_5 = DeconstructDomain(Domain=bnd)  # -> Start, End
filter_43 = StreamFilter(Gate=np_only_bot_boundary_3, Stream0=dedomain_5.Start, Stream1=dedomain_5.End)
filter_44 = StreamFilter(Gate=np_only_bot_boundary_3, Stream0=dedomain_5.End, Stream1=dedomain_5.Start)
gradient = Gradient(
    LowerLimit=filter_43,
    UpperLimit=filter_44,
    Parameter=heatvalues_2,
    stops=[0: RGB(234, 38, 0), 0.25: RGB(234, 126, 0), 0.5: RGB(254, 244, 84), 0.75: RGB(173, 203, 249), 1: RGB(75, 107, 169)])
demesh_3 = DeconstructMesh(Mesh=heatmesh_4)  # -> Vertices, Faces, Colours, Normals
conmesh_2 = ConstructMesh(Vertices=demesh_3.Vertices, Faces=demesh_3.Faces, Colours=gradient)

boundary = BoundarySurfaces(Edges=pshift_8)

# ----
# comments & notes: NEW, FASTER ALGORITHM. TO BE VERIFIED
orderbranchingslicesurfaces = CSharpScript(S=boundary)  # -> out, OS; inputs S: tree of Brep
# ---------- orderbranchingslicesurfaces: C# ----------
    OS = OrderSliceSurfaces(S);
# ---------- orderbranchingslicesurfaces: C# additional code ----------
  public Point3d GetSurfaceCentroid(Brep srf)
  {
    Curve[] borders = srf.DuplicateEdgeCurves(false);
    Point3d centroid_sum = new Point3d(0, 0, 0);
    for (int i = 0; i < borders.Length; i++)
    {

      centroid_sum += borders[i].ToPolyline(0.1, 0, 0, 0).ToPolyline().CenterPoint();
    }
    return centroid_sum / borders.Length;
  }

  public DataTree<Brep> OrderSliceSurfaces(DataTree<Brep> SliceSurfaces)
  {
    // loop over datatree and ensure correct order
    for (int i = 0; i < SliceSurfaces.BranchCount - 1; i++)
    {
      // get branches
      var this_branch = SliceSurfaces.Branches[i];
      var next_branch = SliceSurfaces.Branches[i + 1];

      // case 1: this branch one curve and next branch one curve
      if (this_branch.Count == 1 && next_branch.Count == 1)
      {
        Print("Case 1, 1 -> 1 (nothing done)");
        // nothing needs to be done
      }
        // case 2: this branch one curve and next branch multiple curves
      else if (this_branch.Count == 1 && next_branch.Count > 1)
      {
        Print("Case 2, 1 -> N");
        // loop over next branch and find all centerpoints to compare against
        Point3dList ptL = new Point3dList();
        for (int k = 0; k < next_branch.Count; k++)
        {
          //Point3d cpB = AreaMassProperties.Compute(next_branch[k]).Centroid;
          Point3d cpB = GetSurfaceCentroid(next_branch[k]);
          ptL.Add(cpB);
        }
        // create new list for storage
        List<Brep> OrderedNextBranch = new List<Brep>();
        // get curve centerpoint
        // Point3d cpA = AreaMassProperties.Compute(this_branch[0]).Centroid;
        Point3d cpA = GetSurfaceCentroid(this_branch[0]);
        // compare against point3dlist of other centerpoints
        int idx = ptL.ClosestIndex(cpA);
        OrderedNextBranch.Add((Brep) next_branch[idx].Duplicate());
        next_branch.RemoveAt(idx);
        OrderedNextBranch.AddRange(next_branch);
        // clear data
        ptL.Clear();
        // restructure next branch of contours tree
        SliceSurfaces.Branches[i + 1].Clear();
        SliceSurfaces.Branches[i + 1].AddRange(OrderedNextBranch);
      }
        // case 3: this branch and next branch have multiple curves but the same count
      else if (this_branch.Count > 1 && this_branch.Count == next_branch.Count)
      {
        Print("Case 3, N -> N");
        // create new list for storage
        List<Brep> OrderedNextBranch = new List<Brep>();
        // loop over all curves in this branch
        for (int j = 0; j < this_branch.Count; j++)
        {
          if (next_branch.Count < 1) break;
          // loop over next branch and find all centerpoints to compare against
          Point3dList ptL = new Point3dList();
          for (int k = 0; k < next_branch.Count; k++)
          {
            //Point3d cpB = AreaMassProperties.Compute(next_branch[k]).Centroid;
            Point3d cpB = GetSurfaceCentroid(next_branch[k]);
            ptL.Add(cpB);
          }
          // get curve centerpoint
          //Point3d cpA = AreaMassProperties.Compute(this_branch[j]).Centroid;
          Point3d cpA = GetSurfaceCentroid(this_branch[j]);
          // compare against point3dlist of other centerpoints
          int idx = ptL.ClosestIndex(cpA);
          // add closest item to ordered list
          OrderedNextBranch.Add((Brep) next_branch[idx].Duplicate());
          // remove closest item from candidates
          next_branch.RemoveAt(idx);
          // clear data
          ptL.Clear();
        }
        // restructure next branch of contours tree
        SliceSurfaces.Branches[i + 1].Clear();
        SliceSurfaces.Branches[i + 1].AddRange(OrderedNextBranch);
      }
        // case 4: this branch has more curves than next branch
      else if (this_branch.Count > 1 && next_branch.Count > 1 && this_branch.Count > next_branch.Count)
      {
        Print("Case 4, N -> M>N (VERIFY!)");
        // create new list for storage
        List<Brep> OrderedNextBranch = new List<Brep>();
        // loop over all curves in this branch
        for (int j = 0; j < this_branch.Count; j++)
        {
          if (next_branch.Count < 1) break;
          // loop over next branch and find all centerpoints to compare against
          Point3dList ptL = new Point3dList();
          for (int k = 0; k < next_branch.Count; k++)
          {
            //Point3d cpB = AreaMassProperties.Compute(next_branch[k]).Centroid;
            Point3d cpB = GetSurfaceCentroid(next_branch[k]);
            ptL.Add(cpB);
          }
          // get curve centerpoint
          //Point3d cpA = AreaMassProperties.Compute(this_branch[j]).Centroid;
          Point3d cpA = GetSurfaceCentroid(this_branch[j]);
          // compare against point3dlist of other centerpoints
          int idx = ptL.ClosestIndex(cpA);
          // add closest item to ordered list
          OrderedNextBranch.Add((Brep) next_branch[idx].Duplicate());
          // remove closest item from candidates
          next_branch.RemoveAt(idx);
          // clear data
          ptL.Clear();
        }
        // restructure next branch of contours tree
        SliceSurfaces.Branches[i + 1].Clear();
        SliceSurfaces.Branches[i + 1].AddRange(OrderedNextBranch);
      }
        // case 5: this branch has less curves than next branch
      else if (this_branch.Count > 1 && next_branch.Count > 1 && this_branch.Count < next_branch.Count)
      {
        Print("Case 5, N -> M<N (VERIFY)");
        // loop over next branch and find all centerpoints to compare against
        Point3dList ptL = new Point3dList();
        for (int k = 0; k < next_branch.Count; k++)
        {
          //Point3d cpB = AreaMassProperties.Compute(next_branch[k]).Centroid;
          Point3d cpB = GetSurfaceCentroid(next_branch[k]);
          ptL.Add(cpB);
        }
        // create new list for storage
        List<Brep> OrderedNextBranch = new List<Brep>();
        // create duplicate list for looping
        List<Brep> next_branch_dup = new List<Brep>(next_branch);
        // loop over all curves in this branch
        for (int j = 0; j < this_branch.Count; j++)
        {
          // get curve centerpoint
          //Point3d cpA = AreaMassProperties.Compute(this_branch[j]).Centroid;
          Point3d cpA = GetSurfaceCentroid(this_branch[j]);
          // compare against point3dlist of other centerpoints
          int idx = ptL.ClosestIndex(cpA);
          // add closest curve based on comparison to new list
          OrderedNextBranch.Add((Brep) next_branch[idx].Duplicate());
          next_branch_dup.Remove(next_branch[idx]);
        }
        // add remaining curves from next branch to list
        OrderedNextBranch.AddRange(next_branch_dup);
        // clear data
        ptL.Clear();
        // restructure next branch of contours tree
        SliceSurfaces.Branches[i + 1].Clear();
        SliceSurfaces.Branches[i + 1].AddRange(OrderedNextBranch);
      }
        // case 6: this branch has multiple curves but next branch only has one
      else if (this_branch.Count > 1 && next_branch.Count == 1)
      {
        Print("Case 6, N -> 1 (nothing done)");
      }
    }

    return SliceSurfaces;
  }
# ---------- end orderbranchingslicesurfaces ----------

null_6 = NullItem(Item=orderbranchingslicesurfaces.OS)  # -> NullFlags, InvalidFlags, Description
or_9 = GateOr(A=null_6.NullFlags, B=null_6.InvalidFlags)
dispatch_5 = Dispatch(List=orderbranchingslicesurfaces.OS, DispatchPattern=or_9)  # -> ListA, ListB
dispatch_6 = Dispatch(List=pshift_8, DispatchPattern=or_9)  # -> ListA, ListB
clean_4 = CleanTree(RemoveNulls=True, RemoveInvalid=True, RemoveEmpty=True, Tree=dispatch_6.ListA)
clean_5 = CleanTree(RemoveNulls=True, RemoveInvalid=True, RemoveEmpty=True, Tree=dispatch_5.ListB)
python_5 = GhPythonScript(Breps=clean_5)  # -> OuterCurves, InnerCurves; inputs Breps: list of Brep; same code as python_4
area = Area(Geometry=python_5.InnerCurves)  # -> Area, Centroid
area_2 = Area(Geometry=python_5.OuterCurves)  # -> Area, Centroid
pl_3 = PlaneNormal(Origin=area.Centroid, ZAxis=Z_3)
pl_4 = PlaneNormal(Origin=area_2.Centroid, ZAxis=Z_4)
crvensureccw_3 = GhPythonScript(Crv=python_5.OuterCurves, Pln=pl_4)  # -> CCWCrv; inputs Crv: Curve, Pln: Plane; same code as crvensureccw
crvensureccw_4 = GhPythonScript(Crv=python_5.InnerCurves, Pln=pl_3)  # -> CCWCrv; inputs Crv: Curve, Pln: Plane; same code as crvensureccw
clean_6 = CleanTree(RemoveNulls=True, RemoveInvalid=True, RemoveEmpty=False, Tree=crvensureccw_4)
slice_curves_floor_clsd_outer = Curve(crvensureccw_3)
slice_curves_floor_open = Curve(clean_4)
slice_curves_floor_inner = Curve(clean_6)
slice_surfaces_floor = Brep(orderbranchingslicesurfaces.OS)

# ----
# comments & notes: CREATE OUTER INFILL FLOOR BASE CURVES
synthesize_floor_for_custom_curves_4 = Data(synthesize_floor_for_custom_curves)
inject_custom_curves_11 = Data(inject_custom_curves)
np_slicing_enabled_3 = Boolean(np_slicing_enabled)
custom_curves_floorcurves_2 = Curve(custom_curves_floorcurves)
slice_curves_clsd_outer_5 = Curve(slice_curves_clsd_outer_3)
slice_curves_floor_clsd_outer_2 = Curve(slice_curves_floor_clsd_outer)
floor_slicing_enabled_5 = Boolean(floor_slicing_enabled)
slice_planes_3 = Data(slice_planes)
offset_inkl_iw_overlap_3 = Data(offset_inkl_iw_overlap)
and_11 = GateAnd(A=synthesize_floor_for_custom_curves_4, B=inject_custom_curves_11)
and_12 = GateAnd(A=floor_slicing_enabled_5, B=np_slicing_enabled_3)
filter_45 = StreamFilter(Gate=and_12, Stream0=slice_curves_clsd_outer_5, Stream1=slice_curves_floor_clsd_outer_2)
filter_46 = StreamFilter(Gate=floor_slicing_enabled_5, Stream0=slice_curves_clsd_outer_5, Stream1=slice_curves_floor_clsd_outer_2)
tstat_10 = TreeStatistics(Tree=filter_46)  # -> Paths, Length, Count
branch_10 = TreeBranch(Tree=slice_planes_3, Path=tstat_10.Paths, MaintainPaths=True)
filter_47 = StreamFilter(Gate=and_11, Stream0=filter_46, Stream1=custom_curves_floorcurves_2)
filter_48 = StreamFilter(Gate=and_11, Stream0=branch_10, Stream1=slice_planes_3)
c2offset_2 = Clipper2Offset(Polylines=filter_47, Distance=offset_inkl_iw_overlap_3, JoinType=1, EndType=0, MiterLimit=2, Precision=6)  # -> Holes, Outer, ClipperPaths
pshift_10 = ShiftPaths(Data=c2offset_2.Holes, Offset=-1)
redpline_3 = Reduce(Polyline=pshift_10, Tolerance="0.025")  # -> Polyline, Reduction
project_2 = Project(Geometry=redpline_3.Polyline, Plane=filter_48)  # -> Geometry, Transform
outer_infill_base_crv = Curve(project_2.Geometry)
slice_curves_clsd_outer_6 = Curve(filter_45)

# ----
# comments & notes: create INNER infill base crvs
offset_inkl_iw_overlap_4 = Data(offset_inkl_iw_overlap)
slice_planes_4 = Data(slice_planes)
slice_curves_clsd_inner_4 = Curve(slice_curves_clsd_inner_3)
np_slicing_enabled_4 = Boolean(np_slicing_enabled)
slice_curves_floor_inner_2 = Curve(slice_curves_floor_inner)
floor_slicing_enabled_6 = Boolean(floor_slicing_enabled)
and_13 = GateAnd(A=floor_slicing_enabled_6, B=np_slicing_enabled_4)
filter_49 = StreamFilter(Gate=and_13, Stream0=slice_curves_clsd_inner_4, Stream1=slice_curves_floor_inner_2)
filter_50 = StreamFilter(Gate=and_13, Stream0=slice_curves_clsd_inner_4, Stream1=slice_curves_floor_inner_2)
tstat_11 = TreeStatistics(Tree=filter_50)  # -> Paths, Length, Count
branch_11 = TreeBranch(Tree=slice_planes_4, Path=tstat_11.Paths, MaintainPaths=True)
c2offset_3 = Clipper2Offset(Polylines=filter_50, Distance=offset_inkl_iw_overlap_4, JoinType=1, EndType=0, MiterLimit=2, Precision=6)  # -> Holes, Outer, ClipperPaths
pshift_11 = ShiftPaths(Data=c2offset_3.Outer, Offset=-1)
redpline_4 = Reduce(Polyline=pshift_11, Tolerance="0.025")  # -> Polyline, Reduction
slice_curves_clsd_inner_5 = Curve(filter_49)
project_3 = Project(Geometry=redpline_4.Polyline, Plane=branch_11)  # -> Geometry, Transform
inner_infill_base_crvs = Curve(project_3.Geometry)

inject_custom_curves_12 = Data(inject_custom_curves)
outer_infill_base_crv_2 = Curve(outer_infill_base_crv)
floor_type_2 = Integer(floor_type)
inner_infill_base_crvs_2 = Curve(inner_infill_base_crvs)
synthesize_floor_for_custom_curves_5 = Data(synthesize_floor_for_custom_curves)
floor_slicing_enabled_7 = Boolean(floor_slicing_enabled)
and_14 = GateAnd(A=synthesize_floor_for_custom_curves_5, B=inject_custom_curves_12)
comments_notes_30 = Panel("FLOOR INFILL GATE")
or_10 = GateOr(A=and_14, B=floor_slicing_enabled_7)
filter_51 = StreamFilter(Gate=or_10, Stream1=inner_infill_base_crvs_2)
filter_52 = StreamFilter(Gate=or_10, Stream1=outer_infill_base_crv_2)
gate_18 = StreamGate(Stream=filter_52, Gate=floor_type_2)  # -> Target0, Target1
gate_19 = StreamGate(Stream=filter_51, Gate=floor_type_2)  # -> Target0, Target1
outer_infill_base_crv_0 = Curve(gate_18.Target0)
outer_infill_base_crv_1 = Curve(gate_18.Target1)
inner_infill_base_crvs_0 = Curve(gate_19.Target0)
inner_infill_base_crvs_1 = Curve(gate_19.Target1)

outer_infill_base_crv_cap_2 = Curve(outer_infill_base_crv_cap)
printing_geometry_closed_4 = Boolean(printing_geometry_closed)
cap_type_2 = Integer(cap_type)
inner_infill_base_crvs_3 = Curve(inner_infill_base_crvs)
np_slicing_enabled_5 = Boolean(np_slicing_enabled)
filter_53 = StreamFilter(Gate=np_slicing_enabled_5, Stream0=inner_infill_base_crvs_3)
filter_54 = StreamFilter(Gate=np_slicing_enabled_5, Stream0=outer_infill_base_crv_cap_2)
comments_notes_31 = Panel("CAP INFILL GATE")
filter_55 = StreamFilter(Gate=printing_geometry_closed_4, Stream1=filter_54)
filter_56 = StreamFilter(Gate=printing_geometry_closed_4, Stream1=filter_53)
gate_20 = StreamGate(Stream=filter_55, Gate=cap_type_2)  # -> Target0, Target1
gate_21 = StreamGate(Stream=filter_56, Gate=cap_type_2)  # -> Target0, Target1
outer_infill_base_crv_0_2 = Curve(gate_20.Target0)
outer_infill_base_crv_1_2 = Curve(gate_20.Target1)
inner_infill_base_crvs_0_2 = Curve(gate_21.Target0)
inner_infill_base_crvs_1_2 = Curve(gate_21.Target1)

# ----
# comments & notes: FLOOR CRISS-CROSS INFILL
# BY XYLINUS
offset_inkl_ii_overlap_2 = Data(offset_inkl_ii_overlap)
outer_infill_base_crv_0_3 = Curve(outer_infill_base_crv_0)
full_ratio_on_floor_cap = Panel("1")
infill_fillet_radius_2 = Data(infill_fillet_radius)
inner_infill_base_crvs_0_3 = Curve(inner_infill_base_crvs_0)
floor_layer_count_8 = Integer(floor_layer_count)
tstat_12 = TreeStatistics(Tree=outer_infill_base_crv_0_3)  # -> Paths, Length, Count
tstat_13 = TreeStatistics(Tree=outer_infill_base_crv_0_3)  # -> Paths, Length, Count
split_4 = SplitList(List=tstat_12.Paths, Index=floor_layer_count_8)  # -> ListA, ListB
split_5 = SplitList(List=tstat_13.Paths, Index=floor_layer_count_8)  # -> ListA, ListB
branch_12 = TreeBranch(Tree=outer_infill_base_crv_0_3, Path=split_4.ListA, MaintainPaths=True)
branch_13 = TreeBranch(Tree=inner_infill_base_crvs_0_3, Path=split_5.ListA, MaintainPaths=True)
null_7 = NullItem(Item=flatten(branch_13))  # -> NullFlags, InvalidFlags, Description
or_11 = GateOr(A=null_7.NullFlags, B=null_7.InvalidFlags)
ma_7 = MassAddition(Input=or_11)  # -> Result, PartialResults
rdiff = RegionDifference(CurvesA=branch_12, CurvesB=branch_13)
inner_infill_base_crvs_4 = Curve(branch_13)
bool = Boolean(invert(ma_7.Result))
pshift_12 = ShiftPaths(Data=rdiff, Offset=-1)
filter_57 = StreamFilter(Gate=bool, Stream0=branch_12, Stream1=pshift_12)
infill_basecrvs_merged = Curve(filter_57)
tstat_14 = TreeStatistics(Tree=infill_basecrvs_merged)  # -> Paths, Length, Count
infill = CurveInfill(
    C=infill_basecrvs_merged,
    extrusion_width_or_xylinus_config=offset_inkl_ii_overlap_2,
    infill_ratio_0_1=full_ratio_on_floor_cap)
lng_8 = ListLength(List=tstat_14.Paths)
path_mapper = PathMapper(infill, source="{A}", target="{0;A}")
equals_2 = Equality(FirstNumber=lng_8, SecondNumber="1")  # -> Equality, Inequality
gate_22 = StreamGate(Stream=path_mapper, Gate=equals_2.Equality)  # -> Target0, Target1
tstat_15 = TreeStatistics(Tree=gate_22.Target1)  # -> Paths, Length, Count
replace_2 = ReplacePaths(Data=gate_22.Target1, Search=tstat_15.Paths, Replace=tstat_14.Paths)
infill_fillet_radius_3 = Data(infill_fillet_radius_2)
filter_58 = StreamFilter(Gate=equals_2.Equality, Stream0=gate_22.Target0, Stream1=replace_2)
fillet = Fillet(Curve=filter_58, Radius=infill_fillet_radius_3)
explode_6 = Explode(Curve=fillet, Recursive=True)  # -> Segments, Vertices
pshift_13 = ShiftPaths(Data=explode_6.Segments, Offset=-1)
join_4 = JoinCurves(Curves=pshift_13, Preserve=False)
pshift_14 = ShiftPaths(Data=join_4, Offset=-1)
topoly_5 = CurveToPolyline(Curve=pshift_14, ToleranceDistance=Slider(0.01, range=0.001..0.5), ToleranceAngle=0)  # -> Polyline, Segments
floor_infill_curves_0 = Curve(topoly_5.Polyline)

# ----
# comments & notes: CAP CRISS-CROSS INFILL
# BY XYLINUS
outer_infill_base_crv_1_3 = Curve(outer_infill_base_crv_0_2)
inner_infill_base_crvs_0_4 = Curve(inner_infill_base_crvs_0_2)
infill_fillet_radius_4 = Data(infill_fillet_radius)
cap_layer_count_4 = Integer(cap_layer_count)
line_width_2 = Data(line_width)
tstat_16 = TreeStatistics(Tree=outer_infill_base_crv_1_3)  # -> reverse(Paths), Length, Count
tstat_17 = TreeStatistics(Tree=outer_infill_base_crv_1_3)  # -> reverse(Paths), Length, Count
null_8 = NullItem(Item=flatten(inner_infill_base_crvs_0_4))  # -> NullFlags, InvalidFlags, Description
split_6 = SplitList(List=tstat_16.Paths, Index=cap_layer_count_4)  # -> ListA, ListB
split_7 = SplitList(List=tstat_17.Paths, Index=cap_layer_count_4)  # -> ListA, ListB
or_12 = GateOr(A=null_8.NullFlags, B=null_8.InvalidFlags)
branch_14 = TreeBranch(Tree=outer_infill_base_crv_1_3, Path=split_6.ListA, MaintainPaths=True)
branch_15 = TreeBranch(Tree=inner_infill_base_crvs_0_4, Path=split_7.ListA, MaintainPaths=True)
ma_8 = MassAddition(Input=or_12)  # -> Result, PartialResults
inner_infill_base_crvs_5 = Curve(branch_15)
rdiff_2 = RegionDifference(CurvesA=branch_14, CurvesB=branch_15)
bool_2 = Boolean(invert(ma_8.Result))
filter_59 = StreamFilter(Gate=bool_2, Stream0=branch_14, Stream1=rdiff_2)
infill_basecrvs_merged_2 = Curve(filter_59)
full_ratio_on_floor_cap_2 = Panel("1")
tstat_18 = TreeStatistics(Tree=infill_basecrvs_merged_2)  # -> Paths, Length, Count
infill_2 = CurveInfill(C=infill_basecrvs_merged_2, extrusion_width_or_xylinus_config=line_width_2, infill_ratio_0_1=full_ratio_on_floor_cap_2)
lng_9 = ListLength(List=tstat_18.Paths)
path_mapper_2 = PathMapper(infill_2, source="{A}", target="{0;A}")
equals_3 = Equality(FirstNumber=lng_9, SecondNumber="1")  # -> Equality, Inequality
gate_23 = StreamGate(Stream=path_mapper_2, Gate=equals_3.Equality)  # -> Target0, Target1
tstat_19 = TreeStatistics(Tree=gate_23.Target1)  # -> Paths, Length, Count
replace_3 = ReplacePaths(Data=gate_23.Target1, Search=tstat_19.Paths, Replace=tstat_18.Paths)
filter_60 = StreamFilter(Gate=equals_3.Equality, Stream0=gate_23.Target0, Stream1=replace_3)
fillet_2 = Fillet(Curve=filter_60, Radius=infill_fillet_radius_4)
explode_7 = Explode(Curve=fillet_2, Recursive=True)  # -> Segments, Vertices
pshift_15 = ShiftPaths(Data=explode_7.Segments, Offset=-1)
join_5 = JoinCurves(Curves=pshift_15, Preserve=False)
pshift_16 = ShiftPaths(Data=join_5, Offset=-1)
topoly_6 = CurveToPolyline(Curve=pshift_16, ToleranceDistance=Slider(0.01, range=0.001..0.5), ToleranceAngle=0)  # -> Polyline, Segments
cap_infill_curves_0 = Curve(topoly_6.Polyline)

outer_infill_base_crv_1_4 = Curve(outer_infill_base_crv_1)
inner_infill_base_crvs_1_3 = Curve(inner_infill_base_crvs_1)
floor_layer_count_9 = Integer(floor_layer_count)
offset_inkl_ii_overlap_3 = Data(offset_inkl_ii_overlap)
slice_planes_5 = Data(slice_planes)
tstat_20 = TreeStatistics(Tree=outer_infill_base_crv_1_4)  # -> Paths, Length, Count
tstat_21 = TreeStatistics(Tree=outer_infill_base_crv_1_4)  # -> Paths, Length, Count
comments_notes_32 = Panel("FLOOR OFFSET INFILL")
split_8 = SplitList(List=tstat_20.Paths, Index=floor_layer_count_9)  # -> ListA, ListB
split_9 = SplitList(List=tstat_21.Paths, Index=floor_layer_count_9)  # -> ListA, ListB
branch_16 = TreeBranch(Tree=outer_infill_base_crv_1_4, Path=split_8.ListA, MaintainPaths=True)
branch_17 = TreeBranch(Tree=inner_infill_base_crvs_1_3, Path=split_9.ListA, MaintainPaths=True)
create_offset_infill = CREATE_OFFSET_INFILL(
    outer_infill_base_curves=branch_16,
    inner_infill_base_curves=branch_17,
    slice_planes=slice_planes_5,
    offset=offset_inkl_ii_overlap_3)
floor_infill_curves_1 = Curve(create_offset_infill)

outer_infill_base_crv_1_5 = Curve(outer_infill_base_crv_1_2)
offset_inkl_ii_overlap_4 = Data(offset_inkl_ii_overlap)
inner_infill_base_crvs_1_4 = Curve(inner_infill_base_crvs_1_2)
cap_layer_count_5 = Integer(cap_layer_count)
slice_planes_6 = Data(slice_planes)
tstat_22 = TreeStatistics(Tree=outer_infill_base_crv_1_5)  # -> Paths, Length, Count
tstat_23 = TreeStatistics(Tree=outer_infill_base_crv_1_5)  # -> Paths, Length, Count
split_10 = SplitList(List=tstat_22.Paths, Index=cap_layer_count_5)  # -> ListA, ListB
split_11 = SplitList(List=tstat_23.Paths, Index=cap_layer_count_5)  # -> ListA, ListB
branch_18 = TreeBranch(Tree=outer_infill_base_crv_1_5, Path=split_10.ListA, MaintainPaths=True)
branch_19 = TreeBranch(Tree=inner_infill_base_crvs_1_4, Path=split_11.ListA, MaintainPaths=True)
create_offset_infill_2 = CREATE_OFFSET_INFILL(
    outer_infill_base_curves=branch_18,
    inner_infill_base_curves=branch_19,
    slice_planes=slice_planes_6,
    offset=offset_inkl_ii_overlap_4)
cap_infill_curves_1 = Curve(create_offset_infill_2)

# ----
# comments & notes: SPARSE CRISS-CROSS INFILL WITH BOUNDARY CURVE CONTINUATION
sparse_infill_base_crvs = Data(outerregularlayers_2)
sparse_infill_inner_basecrvs = Data(innerregularlayers_2)
slice_planes_7 = Data(xy_2)
xy_6 = XYPlane(Origin=Point(0, 0, 0))
sparse_infill_inner_basecrvs_2 = Data(sparse_infill_inner_basecrvs)
prot = RotatePlane(Plane=xy_6, Angle=degrees(Slider(54.6, range=0..90)))
bbox_6 = BoundingBox(Content=flatten(sparse_infill_base_crvs), Plane=prot, UnionBox=True)  # -> Box, Box_2
line_distance = Slider(8, range=0..10)
debox_5 = DeconstructBox(Box=bbox_6.Box)  # -> Plane, X, Y, Z
range = Range(Domain=debox_5.X, Steps="2")
range_2 = Range(Domain=debox_5.Y, Steps="2")
dedomain_6 = DeconstructDomain(Domain=debox_5.X)  # -> Start, End
subtraction_4 = Subtraction(A=dedomain_6.End, B=dedomain_6.Start)
item_7 = ListItem(List=range, Index=0, Wrap=True)  # -> Item, Item1
item_8 = ListItem(List=range_2, Index=0, Wrap=True)  # -> Item, Item1
division_4 = Division(A=subtraction_4, B=line_distance)
pt_5 = PointOriented(BasePlane=prot, UComponent=item_7.Item1, VComponent=item_8.Item1, WComponent=0)
round_2 = Round(Number=division_4)  # -> Nearest, Floor, Ceiling
pl_origin = PlaneOrigin(Base=prot, Origin=pt_5)
division_5 = Division(A=subtraction_4, B=round_2.Floor)
dedomain_7 = DeconstructDomain(Domain=debox_5.Y)  # -> Start, End
subtraction_5 = Subtraction(A=dedomain_7.End, B=dedomain_7.Start)
deplane = DeconstructPlane(Plane=pl_origin)  # -> Origin, XAxis, YAxis, ZAxis
amp_4 = Amplitude(Vector=deplane.XAxis, Amplitude=division_5)
amp_5 = Amplitude(Vector=deplane.XAxis, Amplitude=expr("x*-0.5", subtraction_4))
arrlinear = LinearArray(Geometry=pt_5, Direction=amp_4, Count=round_2.Ceiling)  # -> Geometry, Transform
move_5 = Move(Geometry=arrlinear.Geometry, Motion=amp_5)  # -> Geometry, Transform
amp_6 = Amplitude(Vector=deplane.YAxis, Amplitude=expr("x*-0.5", subtraction_5))
line = LineSDL(Start=move_5.Geometry, Direction=deplane.YAxis, Length=subtraction_5)
move_6 = Move(Geometry=line, Motion=amp_6)  # -> Geometry, Transform
panel_16 = Panel("""0
1""")

dedomain_8 = DeconstructDomain(Domain=debox_5.X)  # -> Start, End
subtraction_6 = Subtraction(A=dedomain_8.End, B=dedomain_8.Start)
division_6 = Division(A=subtraction_6, B=line_distance)
round_3 = Round(Number=division_6)  # -> Nearest, Floor, Ceiling
division_7 = Division(A=subtraction_6, B=round_3.Floor)
dedomain_9 = DeconstructDomain(Domain=debox_5.X)  # -> Start, End
subtraction_7 = Subtraction(A=dedomain_9.End, B=dedomain_9.Start)
amp_7 = Amplitude(Vector=deplane.YAxis, Amplitude=division_7)
amp_8 = Amplitude(Vector=deplane.YAxis, Amplitude=expr("x*-0.5", subtraction_6))
arrlinear_2 = LinearArray(Geometry=pt_5, Direction=amp_7, Count=round_3.Ceiling)  # -> Geometry, Transform
move_7 = Move(Geometry=arrlinear_2.Geometry, Motion=amp_8)  # -> Geometry, Transform
amp_9 = Amplitude(Vector=deplane.XAxis, Amplitude=expr("x*-0.5", subtraction_7))
line_2 = LineSDL(Start=move_7.Geometry, Direction=deplane.XAxis, Length=subtraction_7)
move_8 = Move(Geometry=line_2, Motion=amp_9)  # -> Geometry, Transform

entwine = Entwine(Branch00=move_6.Geometry, Branch01=move_8.Geometry, FlattenInputs=True)
tstat_24 = TreeStatistics(Tree=slice_planes_7)  # -> Paths, Length, Count
tstat_25 = TreeStatistics(Tree=entwine)  # -> Paths, Length, Count
repeat = RepeatData(Data=tstat_25.Paths, Length=tstat_24.Count)
branch_20 = TreeBranch(Tree=entwine, Path=repeat, MaintainPaths=False)
tstat_26 = TreeStatistics(Tree=branch_20)  # -> Paths, Length, Count
replace_4 = ReplacePaths(Data=branch_20, Search=tstat_26.Paths, Replace=tstat_24.Paths)
infill_lines_raw = Data(replace_4)

sparse_infill_base_crvs_2 = Data(sparse_infill_base_crvs)
infill_lines_raw_2 = Data(infill_lines_raw)
slice_planes_8 = Data(slice_planes_7)
project_4 = Project(Geometry=infill_lines_raw_2, Plane=slice_planes_8)  # -> Geometry, Transform
tstat_27 = TreeStatistics(Tree=sparse_infill_base_crvs_2)  # -> Paths, Length, Count
dup = DuplicateData(Data=graft(tstat_27.Paths), Number=graft(tstat_27.Length), Order=True)  # -> flatten(Data)
branch_21 = TreeBranch(Tree=project_4.Geometry, Path=dup, MaintainPaths=False)
sparse_infill_base_crvs_3 = Data(sparse_infill_base_crvs_2)
tstat_28 = TreeStatistics(Tree=graft(sparse_infill_base_crvs_2))  # -> Paths, Length, Count
tstat_29 = TreeStatistics(Tree=branch_21)  # -> Paths, Length, Count
replace_5 = ReplacePaths(Data=branch_21, Search=tstat_29.Paths, Replace=tstat_28.Paths)
trim = TrimWithRegions(Curve=replace_5, Regions=graft(sparse_infill_base_crvs_3), Plane=graft(slice_planes_8))  # -> Inside, Outside
pshift_17 = ShiftPaths(Data=trim.Inside, Offset=-1)

sparse_infill_base_crvs_4 = Data(sparse_infill_base_crvs_2)

# ----
# comments & notes: MAKE LINE DIRECTIONS ALTERNATING
panel_17 = Panel("""True
False""")
trimmedlines = Data(pshift_17)
lng_10 = ListLength(List=trimmedlines)
repeat_2 = RepeatData(Data=panel_17, Length=lng_10)
dispatch_7 = Dispatch(List=trimmedlines, DispatchPattern=repeat_2)  # -> ListA, ListB
flip = FlipCurve(Curve=dispatch_7.ListB)  # -> Curve, Flag
weave = Weave(Pattern=panel_17, Stream0=flip.Curve, Stream1=dispatch_7.ListA, NullGaps=False)

c_script_2 = CSharpScript(OuterCurves=sparse_infill_base_crvs_2, InfillCurves=weave)  # -> out, Bounds, SplitParams; inputs OuterCurves: Curve, InfillCurves: list of Curve
# ---------- c_script_2: C# ----------
    Grasshopper.DataTree<double> splitparams = new Grasshopper.DataTree<double>();

    double tS;
    OuterCurve.ClosestPoint(InfillCurves[0].PointAtNormalizedLength(0.5), out tS);
    OuterCurve.ChangeClosedCurveSeam(tS);

    for (int i = 0; i < InfillCurves.Count; i++)
    {
      double tA;
      OuterCurve.ClosestPoint(InfillCurves[i].PointAtStart, out tA);
      double tB;
      OuterCurve.ClosestPoint(InfillCurves[i].PointAtEnd, out tB);

      splitparams.Add(tA, new Grasshopper.Kernel.Data.GH_Path(0, i));
      splitparams.Add(tB, new Grasshopper.Kernel.Data.GH_Path(0, i));
    }
    Bounds = OuterCurve;
    SplitParams = splitparams;
# ---------- end c_script_2 ----------
item_9 = ListItem(List=c_script_2.SplitParams, Index=0, Wrap=True)  # -> Item, Item1
clean_7 = CleanTree(RemoveNulls=True, RemoveInvalid=True, RemoveEmpty=True, Tree=weave)
consec = ConsecutiveDomains(Numbers=flatten(item_9.Item), Additive=invert(True))
consec_2 = ConsecutiveDomains(Numbers=flatten(item_9.Item1), Additive=invert(True))
lng_11 = ListLength(List=consec)
repeat_3 = RepeatData(Data=panel_16, Length=lng_11)
p_n_c = PickNChoose(Pattern=repeat_3, Stream0=consec, Stream1=consec_2)
subcrv = SubCurve(BaseCurve=c_script_2.Bounds, Domain=graft(p_n_c))
data = Data(subcrv)
data_2 = Data(clean_7)
join_6 = JoinCurves(Curves=flatten([data, data_2]), Preserve=False)

connectinfillcurves = CSharpScript(OuterCurves=graft(sparse_infill_base_crvs_4), InfillCurves=weave)  # -> out, a; inputs OuterCurves: tree of Curve, InfillCurves: tree of Curve
# ---------- connectinfillcurves: C# ----------
// Grasshopper Script Instance
#region Usings
using System;
using System.Linq;
using System.Collections;
using System.Collections.Generic;
using System.Drawing;

using Rhino;
using Rhino.Geometry;

using Grasshopper;
using Grasshopper.Kernel;
using Grasshopper.Kernel.Data;
using Grasshopper.Kernel.Types;
#endregion

public class Script_Instance : GH_ScriptInstance
{
    #region Notes
    /* 
      Members:
        RhinoDoc RhinoDocument
        GH_Document GrasshopperDocument
        IGH_Component Component
        int Iteration

      Methods (Virtual & overridable):
        Print(string text)
        Print(string format, params object[] args)
        Reflect(object obj)
        Reflect(object obj, string method_name)
    */
    #endregion

    private void RunScript(
		DataTree<Curve> OuterCurves,
		DataTree<Curve> InfillCurves,
		ref object a)
    {

        List<Curve> infill;
        Curve bounds;
        Curve inline;
        double tS;
        // Write your logic here
        for (int i = 0; i < InfillCurves.BranchCount; i++)
        {
            infill = InfillCurves.Branches[i];
            bounds = OuterCurves.Branches[i][0];
            // Loop over infillcurves
            for (int j = 0; j < infill.Count - 1; j++)
            {
                inline = infill[j];
                if (j == 0)
                {
                    // Get CP of InfillCurve END-Point
                    bounds.ClosestPoint(inline.PointAtEnd, out tS);
                    bounds.ChangeClosedCurveSeam(tS);
                    bounds.Domain = new Rhino.Geometry.Interval(0.0, 1.0);
                }
                // get subcurve from THIS startpoint to NEXT endpoint
                // build consecutive curve from that (in script / out script?)
            }
        }
    }
}
# ---------- end connectinfillcurves ----------
panel_18 = Panel(p_n_c)
subcrv_2 = SubCurve(BaseCurve=reparameterize(join_6), Domain=dom)
datatree = Data(subcrv)
tstat_30 = TreeStatistics(Tree=datatree)  # -> Paths, Length, Count
item_10 = ListItem(List=tstat_30.Paths, Index=branchindex, Wrap=True)
branch_22 = TreeBranch(Tree=datatree, Path=item_10, MaintainPaths=True)

# ----
# comments & notes: UNIFY AND MERGE WALL SLICE CURVES (INNER & OUTER WALLS!)
# UNIFY AND MERGE WALL SLICE
# CURVES (INNER & OUTER WALLS!)
outer_wall_curves = Curve(slice_curves_clsd_outer_6)
slice_curves_clsd_outer_7 = Curve(slice_curves_clsd_outer_6)
slice_curves_clsd_inner_6 = Curve(slice_curves_clsd_inner_5)
# INFILL & FLOOR GENERATION
merge_6 = Merge(Data1=slice_curves_clsd_inner_6, Data2=slice_curves_clsd_outer_7)
tstat_31 = TreeStatistics(Tree=slice_curves_clsd_inner_6)  # -> Paths, Length, Count
branch_23 = TreeBranch(Tree=merge_6, Path=tstat_31.Paths, MaintainPaths=True)
outer_wall_curves_2 = Curve(outer_wall_curves)

# ----
# WE DON'T KNOW IF THIS FIX WORKS, YET!: FIND LEAVES (BRANCHES THAT HAVE 0 AT THE END)
# REMOVE LEAVES TO AVOID DOUBLE LAYERS!
tstat_32 = TreeStatistics(Tree=branch_23)  # -> Paths, Length, Count
compare = PathCompare(Path=tstat_32.Paths, Mask="{*;*;0}")
item_11 = ListItem(List=tstat_32.Paths, Index=0, Wrap=True)
dispatch_8 = Dispatch(List=tstat_32.Paths, DispatchPattern=compare)  # -> ListA, ListB
panel_19 = Panel(compare)
dpath_4 = DeconstructPath(Branch=item_11)
lng_12 = ListLength(List=dpath_4)
branch_24 = TreeBranch(Tree=branch_23, Path=dispatch_8.ListA, MaintainPaths=True)
larger_8 = LargerThan(FirstNumber=lng_12, SecondNumber="2")  # -> LargerThan, OrEqualTo
pshift_18 = ShiftPaths(Data=branch_24, Offset=-1)
filter_61 = StreamFilter(Gate=larger_8.LargerThan, Stream0=branch_23, Stream1=pshift_18)

merged_wall_curves = Curve(filter_61)
tstat_33 = TreeStatistics(Tree=merged_wall_curves)  # -> Paths, Length, Count
culltreepaths = CSharpScript(T=outer_wall_curves_2, P=tstat_33.Paths)  # -> out, C; inputs T: tree, P: list
# ---------- culltreepaths: C# ----------
// Grasshopper Script Instance
#region Usings
using System;
using System.Linq;
using System.Collections;
using System.Collections.Generic;
using System.Drawing;

using Rhino;
using Rhino.Geometry;

using Grasshopper;
using Grasshopper.Kernel;
using Grasshopper.Kernel.Data;
using Grasshopper.Kernel.Types;
#endregion

public class Script_Instance : GH_ScriptInstance
{
    #region Notes
    /* 
      Members:
        RhinoDoc RhinoDocument
        GH_Document GrasshopperDocument
        IGH_Component Component
        int Iteration

      Methods (Virtual & overridable):
        Print(string text)
        Print(string format, params object[] args)
        Reflect(object obj)
        Reflect(object obj, string method_name)
    */
    #endregion

    private void RunScript(DataTree<object> T, List<object> P, ref object C)
    {
        DataTree<object> NewTree = new DataTree<object>(T);
        for (int i = 0; i < P.Count; i++)
        {
            // cast gh path to object
            GH_Path ghp = (GH_Path) P[i];
            // remove path from tree
            NewTree.RemovePath(ghp);
        }
        C = NewTree;
    }
}
# ---------- end culltreepaths ----------
merge_7 = Merge(Data1=merged_wall_curves, Data2=culltreepaths.C)
unified_wall_curves = Curve(merge_7)

synthesize_floor_for_custom_curves_6 = Data(synthesize_floor_for_custom_curves)
inject_custom_curves_13 = Data(inject_custom_curves)
infillbeforewalls = Data(infill_before_walls)
floor_type_3 = Integer(floor_type)
cap_type_3 = Integer(cap_type)
cap_infill_curves_0_2 = Curve(cap_infill_curves_0)
cap_infill_curves_1_2 = Curve(cap_infill_curves_1)
unified_wall_curves_2 = Curve(unified_wall_curves)
custom_curves_floorcurves_3 = Curve(custom_curves_floorcurves)
floor_infill_curves_0_2 = Curve(floor_infill_curves_0)
floor_infill_curves_1_2 = Curve(floor_infill_curves_1)
floor_slicing_enabled_8 = Boolean(floor_slicing_enabled)
np_slicing_enabled_6 = Boolean(np_slicing_enabled)
filter_62 = StreamFilter(Gate=floor_type_3, Stream0=floor_infill_curves_0_2, Stream1=floor_infill_curves_1_2)
filter_63 = StreamFilter(Gate=cap_type_3, Stream0=cap_infill_curves_0_2, Stream1=cap_infill_curves_1_2)
and_15 = GateAnd(A=floor_slicing_enabled_8, B=invert(np_slicing_enabled_6))
and_16 = GateAnd(A=synthesize_floor_for_custom_curves_6, B=inject_custom_curves_13)
floor_infill_curves = Curve(filter_62)
cap_infill_curves = Curve(filter_63)
add_floor_and_reg_slicing = Boolean(and_15)
merge_8 = Merge(Data1=floor_infill_curves, Data2=cap_infill_curves)
floor_cap_infill_curves = Data(merge_8)
filter_64 = StreamFilter(Gate=and_16, Stream0=unified_wall_curves_2, Stream1=custom_curves_floorcurves_3)
infillbeforewalls_2 = Data(infillbeforewalls)
merge_9 = Merge(Data1=filter_64, Data2=floor_cap_infill_curves)
merge_10 = Merge(Data1=floor_cap_infill_curves, Data2=filter_64)
unified_wall_curves_3 = Curve(unified_wall_curves_2)
floor_cap_infill_curves_2 = Data(floor_cap_infill_curves)
filter_65 = StreamFilter(Gate=infillbeforewalls_2, Stream0=merge_9, Stream1=merge_10)
tstat_34 = TreeStatistics(Tree=floor_cap_infill_curves_2)  # -> Paths, Length, Count
unified_slice_curves = Data(filter_65)
branch_25 = TreeBranch(Tree=unified_wall_curves_3, Path=tstat_34.Paths, MaintainPaths=True)
infillbeforewalls_3 = Data(infillbeforewalls)
merge_11 = Merge(Data1=floor_cap_infill_curves_2, Data2=branch_25)
merge_12 = Merge(Data1=branch_25, Data2=floor_cap_infill_curves_2)
filter_66 = StreamFilter(Gate=infillbeforewalls_3, Stream0=merge_12, Stream1=merge_11)
floor_cap_curves = Data(filter_66)
add_floor_and_reg_slicing_2 = Boolean(add_floor_and_reg_slicing)
unified_slice_curves_2 = Data(unified_slice_curves)
unified_wall_curves_4 = Curve(unified_wall_curves_2)
synthesize_floor_for_custom_curves_7 = Data(synthesize_floor_for_custom_curves)
add_floor_slicing_enabled = Boolean(floor_slicing_enabled_8)
filter_67 = StreamFilter(Gate=add_floor_and_reg_slicing_2, Stream0=unified_slice_curves_2, Stream1=floor_cap_curves)
inject_custom_curves_14 = Data(inject_custom_curves)
floor_layer_count_10 = Integer(floor_layer_count)
tstat_35 = TreeStatistics(Tree=unified_wall_curves_4)  # -> Paths, Length, Count
and_17 = GateAnd(A=synthesize_floor_for_custom_curves_7, B=inject_custom_curves_14)
split_12 = SplitList(List=tstat_35.Paths, Index=floor_layer_count_10)  # -> ListA, ListB
or_13 = GateOr(A=add_floor_slicing_enabled, B=and_17)
add_floor_and_reg_slicing_3 = Boolean(add_floor_and_reg_slicing)
branch_26 = TreeBranch(Tree=unified_wall_curves_4, Path=split_12.ListB, MaintainPaths=True)
gate_24 = StreamGate(Stream=filter_67, Gate=or_13)  # -> Target0, Target1
filter_68 = StreamFilter(Gate=add_floor_and_reg_slicing_3, Stream0=gate_24.Target0, Stream1=branch_26)
add_floor_printing_curves = Geometry(gate_24.Target1)
unified_slice_curves_3 = Data(filter_68)

# ----
# CONTROL FLOW
# INJECT CUSTOM CURVES
# comments & notes: inject custom printing curves based on toggle
inject_custom_curves_15 = Data(inject_custom_curves)
unified_slice_curves_4 = Curve(unified_slice_curves_3)
np_slicing_enabled_7 = Boolean(np_slicing_enabled)
synthesize_floor_for_custom_curves_8 = Data(synthesize_floor_for_custom_curves)
np_slice_curves_2 = Data(np_slice_curves)
custom_curves_at_origin_3 = Curve(custom_curves_at_origin)
custom_curves_wo_floor_2 = Curve(custom_curves_wo_floor)
filter_69 = StreamFilter(Gate=np_slicing_enabled_7, Stream0=unified_slice_curves_4, Stream1=np_slice_curves_2)
filter_70 = StreamFilter(Gate=synthesize_floor_for_custom_curves_8, Stream0=custom_curves_at_origin_3, Stream1=custom_curves_wo_floor_2)
filter_71 = StreamFilter(Gate=inject_custom_curves_15, Stream0=filter_69, Stream1=filter_70)
slice_curves = Curve(filter_71)

# ----
# SEAM ADJUSTMENT
# comments & notes: adjust seam of all printing curves based on input params
slice_curves_2 = Curve(slice_curves)
comments_notes_34 = Panel("synchronize curve direction")
item_12 = ListItem(List=flatten(slice_curves_2), Index=0, Wrap=True)
flip_2 = FlipCurve(Curve=slice_curves_2, Guide=item_12)  # -> Curve, Flag
lng_13 = ListLength(List=flip_2.Curve)  # -> flatten(Length)
larger_9 = LargerThan(FirstNumber=lng_13, SecondNumber="1")  # -> LargerThan, OrEqualTo
ma_9 = MassAddition(Input=larger_9.LargerThan)  # -> Result, PartialResults
spiralize_contours_2 = Data(spiralize_contours)
randomize_seam_2 = Boolean(randomize_seam)
adjust_seam_2 = Data(adjust_seam)
rnd_seam_seed_2 = Data(rnd_seam_seed)
boolbranches = Boolean(ma_9.Result)
panel_20 = Panel("[SETTING IGNORED] Seam randomization is not applicable with spiralization.")
python_6 = GhPythonScript(A=randomize_seam_2, B=spiralize_contours_2, C=boolbranches)  # -> R
# ---------- python_6: Python ----------
__author__ = "EFESTWIN"
__version__ = "2023.04.24"

if not A:
    R = 0
elif A and not B:
    R = 2
elif A and C:
    R = 2
else:
    R = 1
# ---------- end python_6 ----------
adjustseam = CSharpScript(Curves=flip_2.Curve, SeamAdjust=adjust_seam_2, Randomize=python_6, Seed=rnd_seam_seed_2)  # -> OutCurves; inputs Curves: tree of Curve, SeamAdjust: Double, Randomize: Boolean, Seed: Int32
# ---------- adjustseam: C# ----------
// Grasshopper Script Instance
#region Usings
using System;
using System.Linq;
using System.Collections;
using System.Collections.Generic;
using System.Drawing;

using Rhino;
using Rhino.Geometry;

using Grasshopper;
using Grasshopper.Kernel;
using Grasshopper.Kernel.Data;
using Grasshopper.Kernel.Types;
#endregion

public class Script_Instance : GH_ScriptInstance
{
    #region Notes
    /* 
      Members:
        RhinoDoc RhinoDocument
        GH_Document GrasshopperDocument
        IGH_Component Component
        int Iteration

      Methods (Virtual & overridable):
        Print(string text)
        Print(string format, params object[] args)
        Reflect(object obj)
        Reflect(object obj, string method_name)
    */
    #endregion

    private void RunScript(
		DataTree<Curve> Curves,
		double SeamAdjust,
		bool Randomize,
		int Seed,
		ref object OutCurves)
    {
        if (Curves != null && Curves.DataCount > 0)
        {
            // reparametrize domain of first input curve
            Curves.Branches[0][0].Domain = new Rhino.Geometry.Interval(0.0, 1.0);
            // use adjust value for first seam adjustment
            Curves.Branches[0][0].ChangeClosedCurveSeam(SeamAdjust);
            // get initial sample point
            Point3d samplePt = Curves.Branches[0][0].PointAtStart;
            // create random instance with seed
            Random RandSeam = new Random(Seed);

            // loop over all branches of curves
            for (int i = 0; i < Curves.BranchCount; i++)
            {
                for (int j = 0; j < Curves.Branches[i].Count; j++)
                {
                    // skip the first curve in the first branch
                    // because it is already preprocessed before the loop
                    if (i == 0 && j == 0) continue;
                    // skip open curves
                    if (!Curves.Branches[i][j].IsClosed) continue;
                    // init parameter var
                    double t;
                    // reparametrize domain
                    Curves.Branches[i][j].Domain = new Rhino.Geometry.Interval(0.0, 1.0);
                    if (Randomize)
                    {
                        Curves.Branches[i][j].ChangeClosedCurveSeam(RandSeam.NextDouble());
                    }
                    else
                    {
                        // get cp based on sample point
                        Curves.Branches[i][j].ClosestPoint(samplePt, out t);
                        // set seam
                        Curves.Branches[i][j].ChangeClosedCurveSeam(t);
                    }
                    // reparam again
                    Curves.Branches[i][j].Domain = new Rhino.Geometry.Interval(0.0, 1.0);
                }
                // set sample point for next branch
                samplePt = Curves.Branches[i][0].PointAtStart;
            }
        }
        else
        {
            Curves = new DataTree<Curve>();
        }
        OutCurves = Curves;
    }
}
# ---------- end adjustseam ----------
bypass_seam_adjustment_2 = Data(bypass_seam_adjustment)
filter_72 = StreamFilter(Gate=python_6, Stream1=panel_20, Stream2="[INFO] Seam is randomized.")
filter_73 = StreamFilter(Gate=bypass_seam_adjustment_2, Stream0=filter_72, Stream1="[INFO] Seam adjustment is bypassed!")
filter_74 = StreamFilter(Gate=bypass_seam_adjustment_2, Stream0=adjustseam, Stream1=flip_2.Curve)
info_randomization = Data(filter_73)
slice_curves_3 = Curve(filter_74)

# ----
# comments & notes: create extrusion rate modifier values for floor paths (100 % regular extrusion rate)
add_floor_printing_curves_2 = Geometry(add_floor_printing_curves)
explode_8 = Explode(Curve=add_floor_printing_curves_2, Recursive=True)  # -> Segments, Vertices
pshift_19 = ShiftPaths(Data=explode_8.Vertices, Offset=-1)
lng_14 = ListLength(List=pshift_19)
dup_2 = DuplicateData(Data="1", Number=lng_14, Order=True)
pshift_20 = ShiftPaths(Data=dup_2, Offset=-1)
emod_values_floor = Data(pshift_20)

info_randomization_2 = Data(info_randomization)

# ----
# PRINT PATH MANIPULATION
# OF INDIVIDUAL LAYERS
# BEFORE SPIRALIZATION
# comments & notes: PRINT PATH MANIPULATION
# OF INDIVIDUAL LAYERS BEFORE SPIRALIZATION
enable_ppm_before_spiral = BooleanToggle(False)
manipulated_slice_curves = Data()

slice_curves_4 = Data(slice_curves_3)
enable_ppm_before_spiral_2 = Data(enable_ppm_before_spiral)
gate_25 = StreamGate(Stream=slice_curves_4, Gate=enable_ppm_before_spiral_2)  # -> Target0, Target1
slice_curves_5 = Data(gate_25.Target1)

slice_curves_6 = Data(slice_curves_5)

enableprintpathmanipulation_beforespiral = Data(enable_ppm_before_spiral_2)
manipulated_slice_curves_2 = Data(manipulated_slice_curves)
filter_75 = StreamFilter(Gate=enableprintpathmanipulation_beforespiral, Stream0=gate_25.Target0, Stream1=manipulated_slice_curves_2)
slice_curves_7 = Data(filter_75)

# ----
# CONTROL FLOW
# CONTOUR SPIRALIZATION
slice_curves_8 = Curve(slice_curves_7)
lng_15 = ListLength(List=slice_curves_8)
panel_21 = Panel("[SETTING IGNORED] Spiralization is only available for open and non-branching objects!")
larger_10 = LargerThan(FirstNumber=flatten(lng_15), SecondNumber="1")  # -> LargerThan, OrEqualTo
printing_geometry_closed_5 = Boolean(printing_geometry_closed)
inject_custom_curves_16 = Data(inject_custom_curves)
ma_10 = MassAddition(Input=larger_10.LargerThan)  # -> Result, PartialResults
spiralize_contours_3 = Data(spiralize_contours)
larger_11 = LargerThan(FirstNumber=ma_10.Result, SecondNumber="1")  # -> LargerThan, OrEqualTo
panel_22 = Panel("[SETTING IGNORED] Mirkos Spiralization method is only available with planar printing paths!")
mirkos_spiralization_2 = Data(mirkos_spiralization)
and_18 = GateAnd(A=spiralize_contours_3, B=invert(printing_geometry_closed_5), C=invert(larger_11.LargerThan))
and_19 = GateAnd(C=spiralize_contours_3, A=inject_custom_curves_16, B=invert(larger_11.LargerThan))
np_slicing_enabled_8 = Boolean(np_slicing_enabled)
filter_76 = StreamFilter(Gate=spiralize_contours_3, Stream1=panel_21)
filter_77 = StreamFilter(Gate=inject_custom_curves_16, Stream0=and_18, Stream1=and_19)
filter_78 = StreamFilter(Gate=inject_custom_curves_16, Stream0=and_18, Stream1=and_19)
equals_4 = Equality(FirstNumber=mirkos_spiralization_2, SecondNumber="1")  # -> Equality, Inequality
and_20 = GateAnd(C=spiralize_contours_3, A=mirkos_spiralization_2, B=np_slicing_enabled_8)
equals_5 = Equality(FirstNumber=np_slicing_enabled_8, SecondNumber="0")  # -> Equality, Inequality
filter_79 = StreamFilter(Gate=filter_78, Stream0=filter_76, Stream1="[INFO] Spiralizing Contours...")
gate_26 = StreamGate(Stream=slice_curves_8, Gate=filter_77)  # -> Target0, Target1
filter_80 = StreamFilter(Gate=and_20, Stream1=panel_22)
and_21 = GateAnd(C=spiralize_contours_3, A=equals_4.Equality, B=equals_5.Equality)
filter_81 = StreamFilter(Gate=and_21, Stream0=filter_80, Stream1="[INFO] Using Mirkos Spiralization Method...")
topoly_7 = CurveToPolyline(Curve=gate_26.Target0, ToleranceDistance="0.01", ToleranceAngle=0)  # -> Polyline, Segments
mirkos_spiralization_enabled = Data(and_21)
info_mirko_spiralize = Data(filter_81)
info_spiralize_contours = Data(filter_79)
spiralization_enabled = Boolean(filter_78)
slice_curves_9 = Curve(topoly_7.Polyline)
slice_curves_10 = Curve(gate_26.Target1)

add_floor_printing_curves_3 = Geometry(add_floor_printing_curves)
open_wall_curves = Curve(slice_curves_open)
# MERGE CURVES AND SLICES
# TO GET FINAL PRINTING CURVES
slice_curves_11 = Curve(slice_curves_7)
merge_13 = Merge(Data1=slice_curves_11, Data2=open_wall_curves, Data3=add_floor_printing_curves_3)
tstat_36 = TreeStatistics(Tree=merge_13)  # -> Paths, Length, Count
item_13 = ListItem(List=tstat_36.Paths, Index=0, Wrap=True)  # -> Item, Item1, Item2, Item3
number_slider_8 = Slider(0.1, range=0..0.1)
branch_27 = TreeBranch(Tree=merge_13, Path=[item_13.Item, item_13.Item1, item_13.Item2, item_13.Item3], MaintainPaths=True)  # -> flatten(Branch)
project_5 = Project(Geometry=branch_27, Plane=PlaneXY(0, 0, 0))  # -> Geometry, Transform
# comments & notes: MERGE CURVES AND SLICES TO GET FINAL PRINTING CURVES
comments_notes_35 = Panel("create skirt curve")
topoly_8 = CurveToPolyline(Curve=project_5.Geometry, ToleranceDistance=number_slider_8, ToleranceAngle=0)  # -> Polyline, Segments
explode_9 = Explode(Curve=topoly_8.Polyline, Recursive=True)  # -> Segments, flatten(Vertices)
cullpt_4 = CullDuplicates(Points=explode_9.Vertices, Tolerance=0.1, CullMode=3)  # -> Points, Indices, Valence
skirt_offset_2 = Data(skirt_offset)
hull = ConvexHull(Points=cullpt_4.Points, Plane=PlaneXY(0, 0, 0))  # -> Hull, HullZ, Indices
xy_7 = XYPlane(Origin=Point(0, 0, 0))
offset = OffsetCurve(Curve=hull.HullZ, Distance=skirt_offset_2, Plane=xy_7, Corners=1)
topoly_9 = CurveToPolyline(Curve=offset, ToleranceDistance=number_slider_8, ToleranceAngle=0)  # -> Polyline, Segments
skirt_curve = Curve(topoly_9.Polyline)

# ----
# comments & notes: create extrusion rate modifier values for skirt paths (100 % regular extrusion rate)
skirt_curve_2 = Curve(skirt_curve)
explode_10 = Explode(Curve=skirt_curve_2, Recursive=True)  # -> Segments, Vertices
pshift_21 = ShiftPaths(Data=explode_10.Vertices, Offset=-1)
lng_16 = ListLength(List=pshift_21)
dup_3 = DuplicateData(Data="1", Number=lng_16, Order=True)
pshift_22 = ShiftPaths(Data=dup_3, Offset=-1)
emod_values_skirt = Data(pshift_22)

info_spiralize_contours_2 = Data(info_spiralize_contours)
info_mirko_spiralize_2 = Data(info_mirko_spiralize)

# ----
# LAYER HEIGHT ANALYSIS
inject_custom_curves_17 = Data(inject_custom_curves)
layer_height_analysis_2 = Data(layer_height_analysis)
spiralization_enabled_2 = Boolean(spiralization_enabled)
slice_curves_12 = Curve(slice_curves_3)
filter_82 = StreamFilter(Gate=inject_custom_curves_17, Stream0=layer_height_analysis_2, Stream1="False")
comments_notes_36 = Panel("LAYER HEIGHT ANALYSIS")
number_slider_9 = Slider(2, range=0..10)

# ----
# OVERHANG ANGLE ANALYSIS
overhang_angle_analysis_2 = Data(overhang_angle_analysis)
slice_curves_13 = Curve(slice_curves_3)
inject_custom_curves_18 = Data(inject_custom_curves)
filter_83 = StreamFilter(Gate=inject_custom_curves_18, Stream0=overhang_angle_analysis_2, Stream1="False")
filter_84 = StreamFilter(Gate=filter_83, Stream1=slice_curves_13)
tstat_37 = TreeStatistics(Tree=filter_84)  # -> Paths, Length, Count
angle_analysis_threshold_degr_2 = Data(angle_analysis_threshold_degr)
angle_analysis_resolution_2 = Data(angle_analysis_resolution)
shift = ShiftList(List=tstat_37.Paths, Shift=-1, Wrap=False)
shift_2 = ShiftList(List=tstat_37.Paths, Shift=1, Wrap=False)
branch_28 = TreeBranch(Tree=filter_84, Path=shift, MaintainPaths=True)
branch_29 = TreeBranch(Tree=filter_84, Path=shift_2, MaintainPaths=True)
comments_notes_37 = Panel("OVERHANG ANGLE ANALYSIS")
divide = DivideCurve(Curve=branch_29, Count=angle_analysis_resolution_2, Kinks=False)  # -> Points, Tangents, Parameters
pshift_23 = ShiftPaths(Data=divide.Points, Offset=-1)
crv_cp = CurveClosestPoint(Point=pshift_23, Curve=branch_28)  # -> Point, Parameter, Distance
vec2pt_3 = Vector2Pt(PointA=crv_cp.Point, PointB=pshift_23, Unitize=False)  # -> Vector, Length
Z_6 = UnitZ(Factor=1)
ln = Line(StartPoint=crv_cp.Point, EndPoint=pshift_23)
angle = Angle(VectorA=vec2pt_3.Vector, VectorB=Z_6)  # -> Angle, Reflex
deg = Degrees(Radians=angle.Angle)  # -> flatten(Degrees)
multiplication_7 = Multiplication(A=angle_analysis_threshold_degr_2, B="0.75")
gradient_2 = Gradient(
    LowerLimit="0",
    UpperLimit=angle_analysis_threshold_degr_2,
    Parameter=deg,
    stops=[0: RGB(0, 128, 0), 0.5: RGB(255, 255, 0), 1: RGB(255, 0, 0)])
larger_12 = LargerThan(FirstNumber=deg, SecondNumber=multiplication_7)  # -> LargerThan, OrEqualTo
sort_3 = SortList(Keys=deg)  # -> reverse(Keys), ValuesA
item_14 = ListItem(List=sort_3.Keys, Index=0, Wrap=True)
rtd_2 = RoundToDecimal(Numbers=item_14, DecimalPlaces=2)  # -> Rounded; inputs Numbers: list, DecimalPlaces: list of Int32
# ---------- rtd_2: Python ----------
"""
Rounds input numbers to a decimal place.
    Inputs:
        Numbers: The numbers to round. {list, float}
        DecimalPlaces: Number of decimal places for the generated random
                       numbers. Set to 0 for integer numbers.
                       Defaults to 2.
                       {list, int}
    Output:
        Rounded: The number rounded to DecimalPlaces.
                 {list/tree, float/int}
    Remarks:
        Author: Max Eschenbach
        License: MIT License
        Version: 230103
"""

# PYTHON STANDARD LIBRARY IMPORTS
from __future__ import division, print_function

# GHPYTHONLIB SDK IMPORTS
from ghpythonlib.componentbase import executingcomponent as component
import Grasshopper, GhPython
import System
import Rhino

# GHENV COMPONENT SETTINGS
ghenv.Component.Name = "RoundToDecimal"
ghenv.Component.NickName = "RTD"
ghenv.Component.Category = "FindersKeepers"
ghenv.Component.SubCategory = "5 Math"

class RoundToDecimal(component):
    
    def RunScript(self, Numbers, DecimalPlaces):
        
        if not DecimalPlaces:
                DecimalPlaces = [0]
        
        if Numbers:
            rounded = []
            for i, num in enumerate(Numbers):
                # retrieve decimalplaces
                if i < len(DecimalPlaces):
                    dp = DecimalPlaces[i]
                else:
                    dp = DecimalPlaces[-1]
                # round number
                rounded.append(round(num, dp))
        else:
            rounded = Grasshopper.DataTree[object]()
        
        # return outputs if you have them; here I try it for you:
        return rounded
# ---------- end rtd_2 ----------
dispatch_9 = Dispatch(List=deg, DispatchPattern=larger_12.LargerThan)  # -> ListA, ListB
dispatch_10 = Dispatch(List=gradient_2, DispatchPattern=larger_12.LargerThan)  # -> ListA, ListB
swatch_3 = ColourSwatch(SwatchColor=RGB(0, 0, 0))
rtd_3 = RoundToDecimal(Numbers=dispatch_9.ListA, DecimalPlaces=2)  # -> Rounded; inputs Numbers: list, DecimalPlaces: list of Int32; same code as rtd_2
format_2 = Format(Format="Most Extreme Overhang: {0}°", Culture=127, Data0=rtd_2)
filter_85 = StreamFilter(Gate=filter_83, Stream1=format_2)
panel_23 = Panel(format_2)
overhanganalysis = Data(filter_85)

overhanganalysis_2 = Data(overhanganalysis)

# ----
# comments & notes: create uniform resolution and this/next datastructure for spralization
slice_curves_14 = Curve(flatten(slice_curves_10))
spiral_resolution_2 = Integer(spiral_resolution)
spiral_intro_2 = Number(spiral_intro)

divide_2 = DivideCurve(Curve=slice_curves_14, Count=spiral_resolution_2, Kinks=False)  # -> Points, Tangents, Parameters
tstat_38 = TreeStatistics(Tree=divide_2.Points)  # -> Paths, Length, Count
shift_3 = ShiftList(List=tstat_38.Paths, Shift="1", Wrap=False)
shift_4 = ShiftList(List=tstat_38.Paths, Shift="-1", Wrap=False)
branch_30 = TreeBranch(Tree=divide_2.Points, Path=shift_3, MaintainPaths=True)
branch_31 = TreeBranch(Tree=divide_2.Points, Path=shift_4, MaintainPaths=True)
spiral_points_a_raw = Data(branch_31)

# ----
# comments & notes: create intro on first layer
spiral_points_a_raw_2 = Data(spiral_points_a_raw)
tstat_39 = TreeStatistics(Tree=spiral_points_a_raw_2)  # -> Paths, Length, Count
item_15 = ListItem(List=tstat_39.Paths, Index="0", Wrap=True)
branch_32 = TreeBranch(Tree=spiral_points_a_raw_2, Path=item_15, MaintainPaths=True)
item_16 = ListItem(List=branch_32, Index=0, Wrap=True)
merge_14 = Merge(Data1=flatten(branch_32), Data2=flatten(item_16))
lng_17 = ListLength(List=merge_14)
spiral_intro_3 = Number(spiral_intro)
multiplication_8 = Multiplication(A=lng_17, B=spiral_intro_3)
subtraction_8 = Subtraction(A=lng_17, B="1")
round_4 = Round(Number=multiplication_8)  # -> Nearest, Floor, Ceiling
min = Minimum(A=subtraction_8, B=round_4.Ceiling)
split_13 = SplitList(List=merge_14, Index=min)  # -> ListA, ListB
pline_3 = PolyLine(Vertices=split_13.ListA, Closed=False)
spiralcontours_botextension = Data(pline_3)

lng_18 = ListLength(List=branch_30)
lng_19 = ListLength(List=branch_31)
multiplication_9 = Multiplication(A=lng_18, B=spiral_intro_2)
multiplication_10 = Multiplication(A=lng_19, B=spiral_intro_2)
round_5 = Round(Number=multiplication_9)  # -> Nearest, Floor, Ceiling
round_6 = Round(Number=multiplication_10)  # -> Nearest, Floor, Ceiling
min_2 = Minimum(A=lng_18, B=round_5.Nearest)
min_3 = Minimum(A=lng_19, B=round_6.Nearest)
shift_5 = ShiftList(List=branch_30, Shift=min_2, Wrap=True)
shift_6 = ShiftList(List=spiral_points_a_raw, Shift=min_3, Wrap=True)

pshift_24 = ShiftPaths(Data=shift_5, Offset=-1)
pshift_25 = ShiftPaths(Data=shift_6, Offset=-1)

item_17 = ListItem(List=pshift_24, Index=0, Wrap=True)
item_18 = ListItem(List=pshift_25, Index=0, Wrap=True)
merge_15 = Merge(Data1=pshift_24, Data2=item_17)
merge_16 = Merge(Data1=pshift_25, Data2=item_18)
tstat_40 = TreeStatistics(Tree=merge_15)  # -> Paths, Length, Count
item_19 = ListItem(List=tstat_40.Paths, Index=0, Wrap=True)  # -> Item1, Item
branch_33 = TreeBranch(Tree=merge_15, Path=item_19.Item1, MaintainPaths=True)
merge_17 = Merge(Data1=merge_16, Data2=branch_33)
spiral_points_zinterp = Data(merge_17)
spiral_points_b = Data(merge_15)
spiral_points_a = Data(merge_16)

# ----
# comments & notes: create base spiralizing paths
spiral_ramp_percentage_2 = Data(spiral_ramp_percentage)
spiral_points_a_2 = Data(spiral_points_a)
spiral_points_b_2 = Data(spiral_points_b)
lng_20 = ListLength(List=spiral_points_a_2)
multiplication_11 = Multiplication(A=spiral_ramp_percentage_2, B="0.01")
subtraction_9 = Subtraction(A="1", B=multiplication_11)
multiplication_12 = Multiplication(A=lng_20, B=subtraction_9)
round_7 = Round(Number=multiplication_12)  # -> Nearest, Floor, Ceiling
subtraction_10 = Subtraction(A=lng_20, B="1")
min_4 = Minimum(A=round_7.Nearest, B=subtraction_10)
split_14 = SplitList(List=spiral_points_a_2, Index=min_4)  # -> ListA, ListB
split_15 = SplitList(List=spiral_points_b_2, Index=min_4)  # -> ListA, ListB
subtraction_11 = Subtraction(A=lng_20, B=round_7.Nearest)
dom_2 = ConstructDomain(DomainStart="0", DomainEnd="1")
vec2pt_4 = Vector2Pt(PointA=split_14.ListB, PointB=split_15.ListB, Unitize=False)  # -> Vector, Length
range_3 = Range(Domain=dom_2, Steps=expr("x-1", subtraction_11))
multiplication_13 = Multiplication(A=vec2pt_4.Vector, B=range_3)
move_9 = Move(Geometry=split_14.ListB, Motion=multiplication_13)  # -> Geometry, Transform
merge_18 = Merge(Data1=split_14.ListA, Data2=move_9.Geometry)
pshift_26 = ShiftPaths(Data=merge_18, Offset=-1)
pline_4 = PolyLine(Vertices=pshift_26, Closed=False)
spiralcontours_base = Data(pline_4)

# ----
# comments & notes: create extension on last layer
spiral_points_b_3 = Data(spiral_points_b)
tstat_41 = TreeStatistics(Tree=spiral_points_b_3)  # -> Paths, Length, Count
item_20 = ListItem(List=tstat_41.Paths, Index="-1", Wrap=True)
branch_34 = TreeBranch(Tree=spiral_points_b_3, Path=item_20, MaintainPaths=True)
lng_21 = ListLength(List=branch_34)
spiral_outro_2 = Number(spiral_outro)
multiplication_14 = Multiplication(A=lng_21, B=spiral_outro_2)
subtraction_12 = Subtraction(A=lng_21, B="1")
round_8 = Round(Number=multiplication_14)  # -> Nearest, Floor, Ceiling
min_5 = Minimum(A=subtraction_12, B=round_8.Nearest)
split_16 = SplitList(List=branch_34, Index=min_5)  # -> ListA, ListB
pline_5 = PolyLine(Vertices=split_16.ListA, Closed=False)
spiralcontours_topextension = Data(pline_5)

spiralcontours_base_2 = Data(spiralcontours_base)
filter_86 = StreamFilter(Gate=spiralization_enabled_2, Stream0=slice_curves_12, Stream1=spiralcontours_base_2)
filter_87 = StreamFilter(Gate=filter_82, Stream1=filter_86)
orderbranchingslicecurves_2 = CSharpScript(C=filter_87)  # -> out, OC; inputs C: tree of Curve
# ---------- orderbranchingslicecurves_2: C# ----------
    DataTree<PolylineCurve> PLCS = new DataTree<PolylineCurve>();

    for (int i = 0; i < C.BranchCount; i++)
    {
      for (int j = 0; j < C.Branches[i].Count; j++)
      {
        PLCS.Add(C.Branches[i][j].ToPolyline(0.1, 0, 0, 0), C.Paths[i]);
      }
    }

    OC = OrderSliceCurves(PLCS);
# ---------- orderbranchingslicecurves_2: C# additional code ----------
  public DataTree<PolylineCurve> OrderSliceCurves(DataTree<PolylineCurve> ContourCurves)
  {
    // create copy of datatree to avoid messing up things
    DataTree<PolylineCurve> SliceCurves = new DataTree<PolylineCurve>(ContourCurves);

    // loop over datatree and ensure correct order
    for (int i = 0; i < SliceCurves.BranchCount - 1; i++)
    {
      // get branches
      var this_branch = SliceCurves.Branches[i];
      var next_branch = SliceCurves.Branches[i + 1];

      // case 1: this branch one curve and next branch one curve
      if (this_branch.Count == 1 && next_branch.Count == 1)
      {
        //Print("Case 1, 1 -> 1 (nothing done)");
        // nothing needs to be done
      }
        // case 2: this branch one curve and next branch multiple curves
      else if (this_branch.Count == 1 && next_branch.Count > 1)
      {
        //Print("Case 2, 1 -> N");
        // loop over next branch and find all centerpoints to compare against

        Point3dList ptL = new Point3dList();
        for (int k = 0; k < next_branch.Count; k++)
        {
          Point3d cpB = next_branch[k].ToPolyline().CenterPoint();
          ptL.Add(cpB);
        }
        // create new list for storage
        List<PolylineCurve> OrderedNextBranch = new List<PolylineCurve>();
        // get curve centerpoint
        Point3d cpA = this_branch[0].ToPolyline().CenterPoint();
        // compare against point3dlist of other centerpoints
        int idx = ptL.ClosestIndex(cpA);
        OrderedNextBranch.Add(next_branch[idx].Duplicate() as PolylineCurve);
        next_branch.RemoveAt(idx);
        OrderedNextBranch.AddRange(next_branch);
        // clear data
        ptL.Clear();
        // restructure next branch of contours tree
        SliceCurves.Branches[i + 1].Clear();
        SliceCurves.Branches[i + 1].AddRange(OrderedNextBranch);
      }
        // case 3: this branch and next branch have multiple curves but the same count
      else if (this_branch.Count > 1 && this_branch.Count == next_branch.Count)
      {
        //Print("Case 3, N -> N");
        // create new list for storage
        List<PolylineCurve> OrderedNextBranch = new List<PolylineCurve>();
        // loop over all curves in this branch
        for (int j = 0; j < this_branch.Count; j++)
        {
          if (next_branch.Count < 1) break;
          // loop over next branch and find all centerpoints to compare against
          Point3dList ptL = new Point3dList();
          for (int k = 0; k < next_branch.Count; k++)
          {
            Point3d cpB = next_branch[k].ToPolyline().CenterPoint();
            ptL.Add(cpB);
          }
          // get curve centerpoint
          Point3d cpA = this_branch[j].ToPolyline().CenterPoint();
          // compare against point3dlist of other centerpoints
          int idx = ptL.ClosestIndex(cpA);
          // add closest item to ordered list
          OrderedNextBranch.Add(next_branch[idx].Duplicate() as PolylineCurve);
          // remove closest item from candidates
          next_branch.RemoveAt(idx);
          // clear data
          ptL.Clear();
        }
        // restructure next branch of contours tree
        SliceCurves.Branches[i + 1].Clear();
        SliceCurves.Branches[i + 1].AddRange(OrderedNextBranch);
      }
        // case 4: this branch has more curves than next branch
      else if (this_branch.Count > 1 && next_branch.Count > 1 && this_branch.Count > next_branch.Count)
      {
        //Print("Case 4, N -> M>N (VERIFY!)");
        // create new list for storage
        List<PolylineCurve> OrderedNextBranch = new List<PolylineCurve>();
        // loop over all curves in this branch
        for (int j = 0; j < this_branch.Count; j++)
        {
          if (next_branch.Count < 1) break;
          // loop over next branch and find all centerpoints to compare against
          Point3dList ptL = new Point3dList();
          for (int k = 0; k < next_branch.Count; k++)
          {
            Point3d cpB = AreaMassProperties.Compute(next_branch[k]).Centroid;
            ptL.Add(cpB);
          }
          // get curve centerpoint
          Point3d cpA = AreaMassProperties.Compute(this_branch[j]).Centroid;
          // compare against point3dlist of other centerpoints
          int idx = ptL.ClosestIndex(cpA);
          // add closest item to ordered list
          OrderedNextBranch.Add(next_branch[idx].Duplicate() as PolylineCurve);
          // remove closest item from candidates
          next_branch.RemoveAt(idx);
          // clear data
          ptL.Clear();
        }
        // restructure next branch of contours tree
        SliceCurves.Branches[i + 1].Clear();
        SliceCurves.Branches[i + 1].AddRange(OrderedNextBranch);
      }
        // case 5: this branch has less curves than next branch
      else if (this_branch.Count > 1 && next_branch.Count > 1 && this_branch.Count < next_branch.Count)
      {
        //Print("Case 5, N -> M<N (VERIFY)");
        // loop over next branch and find all centerpoints to compare against
        Point3dList ptL = new Point3dList();
        for (int k = 0; k < next_branch.Count; k++)
        {
          Point3d cpB = next_branch[k].ToPolyline().CenterPoint();
          ptL.Add(cpB);
        }
        // create new list for storage
        List<PolylineCurve> OrderedNextBranch = new List<PolylineCurve>();
        // create duplicate list for looping
        List<PolylineCurve> next_branch_dup = new List<PolylineCurve>(next_branch);
        // loop over all curves in this branch
        for (int j = 0; j < this_branch.Count; j++)
        {
          // get curve centerpoint
          Point3d cpA = this_branch[j].ToPolyline().CenterPoint();
          // compare against point3dlist of other centerpoints
          int idx = ptL.ClosestIndex(cpA);
          // add closest curve based on comparison to new list
          OrderedNextBranch.Add(next_branch[idx].Duplicate() as PolylineCurve);
          next_branch_dup.Remove(next_branch[idx]);
        }
        // add remaining curves from next branch to list
        OrderedNextBranch.AddRange(next_branch_dup);
        // clear data
        ptL.Clear();
        // restructure next branch of contours tree
        SliceCurves.Branches[i + 1].Clear();
        SliceCurves.Branches[i + 1].AddRange(OrderedNextBranch);
      }
        // case 6: this branch has multiple curves but next branch only has one
      else if (this_branch.Count > 1 && next_branch.Count == 1)
      {
        //Print("Case 6, N -> 1 (nothing done)");
      }
    }

    return SliceCurves;
  }
# ---------- end orderbranchingslicecurves_2 ----------
contourdeviation = CSharpScript(Contours=orderbranchingslicecurves_2.OC)  # -> out, MinDist, MaxDist, MinA, MaxA, MinB, MaxB; inputs Contours: tree of Curve
# ---------- contourdeviation: C# usings ----------
using System.Linq;
# ---------- contourdeviation: C# ----------
    DataTree<object> minDistances = new DataTree<object>();
    DataTree<object> maxDistances = new DataTree<object>();
    DataTree<object> minA = new DataTree<object>();
    DataTree<object> maxA = new DataTree<object>();
    DataTree<object> minB = new DataTree<object>();
    DataTree<object> maxB = new DataTree<object>();

    if (Contours != null)
    {
      for (int i = 0; i < Contours.BranchCount - 1; i++)
      {
        // measure distance from one curve to the next branch
        // branch can have one or many curves
        var this_branch = Contours.Branches[i];
        var next_branch = Contours.Branches[i + 1];

        // create path for output
        GH_Path ghp = new GH_Path(i);

        // case 1: both branches have one contour
        if (this_branch.Count == 1 && next_branch.Count == 1)
        {
          // get results
          List<object> results = GetMinMaxDistContours(this_branch[0], next_branch[0]);

          // add to output trees
          minDistances.Add((double) results[0], ghp);
          maxDistances.Add((double) results[1], ghp);
          minA.Add((Point3d) results[2], ghp);
          minB.Add((Point3d) results[3], ghp);
          maxA.Add((Point3d) results[4], ghp);
          maxB.Add((Point3d) results[5], ghp);
        }
          // case 2: both branches have multiple, but identical number of contours
        else if (this_branch.Count > 1 && this_branch.Count == next_branch.Count)
        {
          // compute min, max distance for every pair of contours

          //loop through branch pairs
          for (int j = 0; j < this_branch.Count; j++)
          {
            // get results
            List<object> results = GetMinMaxDistContours(this_branch[j], next_branch[j]);

            // add to output trees
            minDistances.Add((double) results[0], ghp);
            maxDistances.Add((double) results[1], ghp);
            minA.Add((Point3d) results[2], ghp);
            minB.Add((Point3d) results[3], ghp);
            maxA.Add((Point3d) results[4], ghp);
            maxB.Add((Point3d) results[5], ghp);
          }
        }
        // case 3: this branch has one contour, next branch has multiple contours
        // --> generate points on this branch's contour, pull cps for every other contour

        // case 4: this branch has multiple contours, next branch has one contour
        // --> generate points on next branch, pull cps for every contour in this branch

        // case 5: both branches have multiple contours but each has different number of contours
      }
      MinDist = minDistances;
      MaxDist = maxDistances;
      MinA = minA;
      MinB = minB;
      MaxA = maxA;
      MaxB = maxB;
    }
# ---------- contourdeviation: C# additional code ----------
  public List<object> GetMinMaxDistContours(Curve contourA, Curve contourB)
  {
    // init vars
    double minDist;
    double maxDist;

    Point3d minPtA = Point3d.Unset;
    Point3d minPtB = Point3d.Unset;

    Point3d maxPtA = Point3d.Unset;
    Point3d maxPtB = Point3d.Unset;

    // compute min, max distance
    double len = Math.Max(contourA.GetLength(), contourB.GetLength());
    int res = (int) Math.Round(len / 1.0, 0);

    Point3d[] ptA;
    contourA.DivideByCount(res, true, out ptA);

    minDist = double.MaxValue;
    maxDist = double.MinValue;

    for (int j = 0; j < ptA.Length; j++)
    {
      double tB;
      contourB.ClosestPoint(ptA[j], out tB);
      Point3d ptB = contourB.PointAt(tB);

      double dist = ptB.Z - ptA[j].Z;

      if (dist < minDist)
      {
        minDist = dist;
        minPtA = new Point3d(ptA[j]);
        minPtB = new Point3d(ptB);
      }

      if (dist > maxDist)
      {
        maxDist = dist;
        maxPtA = new Point3d(ptA[j]);
        maxPtB = new Point3d(ptB);
      }
    }
    return new List<object>{minDist, maxDist, minPtA, minPtB, maxPtA, maxPtB};
  }
# ---------- end contourdeviation ----------
ln_2 = Line(StartPoint=contourdeviation.MinA, EndPoint=contourdeviation.MinB)  # -> flatten(Line)
ln_3 = Line(StartPoint=contourdeviation.MaxA, EndPoint=contourdeviation.MaxB)  # -> flatten(Line)
avr_2 = Average(Input=[contourdeviation.MinDist, contourdeviation.MaxDist])  # -> flatten(ArithmeticMean)
avr_3 = Average(Input=avr_2)
bnd_2 = Bounds(Numbers=flatten([contourdeviation.MinDist, contourdeviation.MaxDist]))
bnd_3 = Bounds(Numbers=avr_2)
panel_24 = Panel(bnd_2)
panel_25 = Panel(bnd_3)
panel_26 = Panel(avr_3)
dedomain_10 = DeconstructDomain(Domain=bnd_2)  # -> Start, End
format_3 = Format(Format="Average: {0}", Culture=127, Data0=panel_26)
format_4 = Format(Format="Average Bounds: {0}", Culture=127, Data0=panel_25)
format_5 = Format(Format="Extremes: {0}", Culture=127, Data0=panel_24)
merge_19 = Merge(Data1=format_5, Data2=format_4, Data3=format_3)
filter_88 = StreamFilter(Gate=filter_82, Stream1=merge_19)
average = Panel(merge_19)
layerheightanalysis = Data(filter_88)

layerheightanalysis_2 = Data(layerheightanalysis)

# ----
# comments & notes: create base spiralizing paths with Mirko's method
spiral_points_zinterp_2 = Data(spiral_points_zinterp)
pdecon_6 = Deconstruct(Point=flatten(spiral_points_zinterp_2))  # -> XComponent, YComponent, ZComponent
sort_4 = SortList(Keys=pdecon_6.ZComponent)  # -> Keys, ValuesA
item_21 = ListItem(List=sort_4.Keys, Index=0, Wrap=True)  # -> Item1, Item
Z_7 = UnitZ(Factor=item_21.Item1)
pt_6 = Point(Point(0, 0, 0))
lng_22 = ListLength(List=pdecon_6.ZComponent)
move_10 = Move(Geometry=pt_6, Motion=Z_7)  # -> Geometry, Transform
subtraction_13 = Subtraction(A=lng_22, B=1)
ln_4 = Line(StartPoint=pt_6, EndPoint=move_10.Geometry)
divide_3 = DivideCurve(Curve=ln_4, Count=subtraction_13, Kinks=False)  # -> Points, Tangents, Parameters
pdecon_7 = Deconstruct(Point=divide_3.Points)  # -> XComponent, YComponent, ZComponent
pt_7 = ConstructPoint(XCoordinate=pdecon_6.XComponent, YCoordinate=pdecon_6.YComponent, ZCoordinate=pdecon_7.ZComponent)

pline_6 = PolyLine(Vertices=pt_7, Closed=False)

spiralcontours_base_zinterp = Data(pline_6)

spiralcontours_base_zinterp_2 = Data(spiralcontours_base_zinterp)
mirkos_spiralization_enabled_2 = Data(mirkos_spiralization_enabled)
spiralcontours_base_3 = Data(spiralcontours_base)
spiralcontours_botextension_2 = Data(spiralcontours_botextension)
spiralcontours_topextension_2 = Data(spiralcontours_topextension)
filter_89 = StreamFilter(Gate=mirkos_spiralization_enabled_2, Stream0=spiralcontours_base_3, Stream1=spiralcontours_base_zinterp_2)
merge_20 = Merge(Data1=flatten(spiralcontours_botextension_2), Data2=flatten(filter_89), Data3=flatten(spiralcontours_topextension_2))  # -> flatten(Result)
join_7 = JoinCurves(Curves=merge_20, Preserve=False)
spiral_curve = Data(join_7)

enableprintpathmanipulation_afterspiral = Data(enable_ppm_after_spiral)
spiral_curve_2 = Data(spiral_curve)
gate_27 = StreamGate(Stream=spiral_curve_2, Gate=enableprintpathmanipulation_afterspiral)  # -> Target0, Target1
spiral_curve_3 = Data(gate_27.Target1)

# ----
# comments & notes: THIS IS JUST A FAIRLY SIMPLE EXAMPLE ...
spiral_curve_4 = Data(spiral_curve_3)
divlength = DivideLength(Curve=spiral_curve_4, Length=Slider(1, range=1..50))  # -> Points, Tangents, Parameters
partition = PartitionList(List=divlength.Points, Size=Slider(2, range=0..10))
geo = Geometry([<brep referenced from the Rhino model> x3])
printing_geometry_11 = Geometry(printing_geometry)
mesh = MeshBrep(
    Brep=geo,
    Settings={GridMaxCount=0, GridMinCount=16, JaggedSeams=False, MaxEdgeLength=0, MinEdgeLength=0.0001, MinTolerance=0, Refine=True, RefineAngle=0, RelativeTolerance=0.65, SimplePlanes=True, Tolerance=0})
crv_6 = Curve(<curve referenced from the Rhino model>)
split_17 = SplitList(List=partition, Index="2")  # -> ListA, ListB
pdecon_8 = Deconstruct(Point=split_17.ListA)  # -> XComponent, YComponent, ZComponent
bnd_4 = Bounds(Numbers=flatten(pdecon_8.ZComponent))
remap = RemapNumbers(Value=pdecon_8.ZComponent, Source=bnd_4, Target=Domain(0, 1))  # -> Mapped, Clipped
mjoin_2 = MeshJoin(Meshes=mesh)
graph = GraphMapper(remap.Mapped, x0=0, x1=1, y0=0, y1=1, container_name="Bezier", cpx=[0, 0.2527412176, 0.7872578502, 1], cpy=[0, 1, 1, 0])
pull = PullPoint(Point=split_17.ListA, Geometry=mjoin_2, ClosestOnly=True)  # -> ClosestPoint, Distance, Index
dom_3 = ConstructDomain(DomainStart="0", DomainEnd=Slider(5, range=-100..100))
dom_4 = ConstructDomain(DomainStart="0", DomainEnd="1")
bnd_5 = Bounds(Numbers=flatten(pull.Distance))
remap_2 = RemapNumbers(Value=pull.Distance, Source=bnd_5, Target=dom_4)  # -> Mapped, Clipped
remap_3 = RemapNumbers(Value=graph, Source="0 To 1", Target=dom_3)  # -> Mapped, Clipped
meshcp = MeshClosestPoint(Point=split_17.ListA, Mesh=printing_geometry_11)  # -> Point, Index, Parameter
multiplication_15 = Multiplication(A=remap_2.Mapped, B=remap_3.Mapped)
meval = MeshEval(Mesh=printing_geometry_11, Parameter=meshcp.Parameter)  # -> Point, Normal, Colour
amp_10 = Amplitude(Vector=meval.Normal, Amplitude=multiplication_15)
devec = DeconstructVector(Vector=amp_10)  # -> XComponent, YComponent, ZComponent
vec = VectorXYZ(XComponent=devec.XComponent, YComponent=devec.YComponent, ZComponent=0)  # -> Vector, Length
move_11 = Move(Geometry=split_17.ListA, Motion=vec.Vector)  # -> Geometry, Transform
merge_21 = Merge(Data1=move_11.Geometry, Data2=split_17.ListB)  # -> flatten(Result)
intcrv = Interpolate(Vertices=merge_21, Degree=3, Periodic=False, KnotStyle=1)  # -> Curve, Length, Domain
divide_4 = DivideCurve(Count=10, Kinks=False)  # -> Points, Tangents, Parameters
topoly_10 = CurveToPolyline(Curve=intcrv.Curve, ToleranceDistance=Slider(0.01, range=0..1), ToleranceAngle=0)  # -> Polyline, Segments
manipulated_printpath = Data(topoly_10.Polyline)

enableprintpathmanipulation_afterspiral_2 = Data(enableprintpathmanipulation_afterspiral)
manipulated_printpath_2 = Data(manipulated_printpath)
filter_90 = StreamFilter(Gate=enableprintpathmanipulation_afterspiral_2, Stream0=gate_27.Target0, Stream1=manipulated_printpath_2)
spiral_curve_5 = Data(filter_90)

spiralization_enabled_3 = Boolean(spiralization_enabled)
slice_curves_15 = Curve(slice_curves_9)
spiral_curve_6 = Data(spiral_curve_5)
enableextrusionratemod = Data(enable_erm)
filter_91 = StreamFilter(Gate=spiralization_enabled_3, Stream0=slice_curves_15, Stream1=spiral_curve_6)
gate_28 = StreamGate(Stream=filter_91, Gate=enableextrusionratemod)  # -> Target0, Target1
curves_before_mod = Data(gate_28.Target1)

# ----
# comments & notes: THIS IS JUST AN EXAMPLE ...
extrusionmoddividebydistance = Data(erm_divide_by_distance)
extrusionmoddivisioncount = Data(erm_division_count)
extrusionmoddivisiondist = Data(erm_division_dist)
curves_before_mod_2 = Data(curves_before_mod)
gate_29 = StreamGate(Stream=curves_before_mod_2, Gate=extrusionmoddividebydistance)  # -> Target0, Target1
divide_5 = DivideCurve(Curve=gate_29.Target0, Count=extrusionmoddivisioncount, Kinks=False)  # -> Points, Tangents, Parameters
divdist = DivideDistance(Curve=gate_29.Target1, Distance=extrusionmoddivisiondist)  # -> Points, Tangents, Parameters
# EXTRUSION RATE MODIFIER
filter_92 = StreamFilter(Gate=extrusionmoddividebydistance, Stream0=divide_5.Points, Stream1=divdist.Points)
item_22 = ListItem(List=filter_92, Index=0, Wrap=True)
# comments & notes: PRINT PATH MANIPULATION
# USING EXTRUSION RATE PERCENTAGE MODIFIER
merge_22 = Merge(Data1=filter_92, Data2=item_22)
lng_23 = ListLength(List=merge_22)
series_3 = Series(Start=0, Step=1, Count=lng_23)
pshift_27 = ShiftPaths(Data=series_3, Offset=-2)
bnd_6 = Bounds(Numbers=pshift_27)
extrusion_rate_mod_max = Slider(2, range=0..3)
extrusion_rate_mod_min = Slider(1, range=0..3)
remap_4 = RemapNumbers(Value=pshift_27, Source=bnd_6, Target="0 To 1")  # -> Mapped, Clipped
graph_2 = GraphMapper(
    remap_4.Mapped,
    x0=0,
    x1=1,
    y0=0,
    y1=1,
    container_name="Bezier",
    cpx=[0, 1, 0.9840636253, 1],
    cpy=[0, 1, 0.8605072498, 0])
dom_5 = ConstructDomain(DomainStart=extrusion_rate_mod_min, DomainEnd=extrusion_rate_mod_max)
pline_7 = PolyLine(Vertices=merge_22, Closed=False)
remap_5 = RemapNumbers(Value=graph_2, Source="0 To 1", Target=dom_5)  # -> Mapped, Clipped
pshift_28 = ShiftPaths(Data=pline_7, Offset=-1)
emod_values = Data(remap_5.Mapped)
curves_after_mod = Data(pshift_28)

enableextrusionratemod_2 = Data(enableextrusionratemod)
curves_after_mod_2 = Data(curves_after_mod)
filter_93 = StreamFilter(Gate=enableextrusionratemod_2, Stream0=gate_28.Target0, Stream1=curves_after_mod_2)
gate_30 = StreamGate(Stream=filter_93, Gate=spiralization_enabled_3)  # -> Target0, Target1
slice_curves_16 = Data(gate_30.Target0)
spiral_curve_7 = Data(gate_30.Target1)

# ----
# comments & notes: merge spiral and floor curves if floor is enabled
synthesize_floor_for_custom_curves_9 = Data(synthesize_floor_for_custom_curves)
inject_custom_curves_19 = Data(inject_custom_curves)
floor_slicing_enabled_9 = Boolean(floor_slicing_enabled)
add_floor_printing_curves_4 = Geometry(add_floor_printing_curves)
spiral_curve_8 = Data(spiral_curve_7)
and_22 = GateAnd(A=synthesize_floor_for_custom_curves_9, B=inject_custom_curves_19)
or_14 = GateOr(A=and_22, B=floor_slicing_enabled_9)
gate_31 = StreamGate(Stream=spiral_curve_8, Gate=or_14)  # -> Target0, Target1
tstat_42 = TreeStatistics(Tree=add_floor_printing_curves_4)  # -> Paths, Length, Count
tstat_43 = TreeStatistics(Tree=gate_31.Target1)  # -> Paths, Length, Count
item_23 = ListItem(List=tstat_42.Paths, Index=0, Wrap=True)  # -> Item1, Item
dpath_5 = DeconstructPath(Branch=item_23.Item1)
lng_24 = ListLength(List=dpath_5)  # -> expr("x-1", Length)
split_18 = SplitList(List=dpath_5, Index=lng_24)  # -> ListA, ListB
addition_3 = Addition(A=split_18.ListB, B="1")
merge_23 = Merge(Data1=split_18.ListA, Data2=addition_3)
path_3 = ConstructPath(Indices=merge_23)
replace_6 = ReplacePaths(Data=gate_31.Target1, Search=tstat_43.Paths, Replace=path_3)
merge_24 = Merge(Data1=add_floor_printing_curves_4, Data2=replace_6)
filter_94 = StreamFilter(Gate=or_14, Stream0=gate_31.Target0, Stream1=merge_24)
slice_curves_spiralized_floormerged = Curve(filter_94)

# ----
# comments & notes: merge slices and floor curves if floor is enabled
synthesize_floor_for_custom_curves_10 = Data(synthesize_floor_for_custom_curves)
inject_custom_curves_20 = Data(inject_custom_curves)
floor_slicing_enabled_10 = Boolean(floor_slicing_enabled)
add_floor_printing_curves_5 = Geometry(add_floor_printing_curves)
slice_curves_17 = Curve(slice_curves_16)
and_23 = GateAnd(A=synthesize_floor_for_custom_curves_10, B=inject_custom_curves_20)
or_15 = GateOr(A=and_23, B=floor_slicing_enabled_10)
merge_25 = Merge(Data1=add_floor_printing_curves_5, Data2=slice_curves_17)
gate_32 = StreamGate(Stream=slice_curves_17, Gate=or_15)  # -> Target0, Target1
filter_95 = StreamFilter(Gate=or_15, Stream0=gate_32.Target0, Stream1=merge_25)
slice_curves_floormerged = Curve(filter_95)

# ----
# comments & notes: merge slices or spiral with open remaining printing curves
slice_curves_spiralized_floormerged_2 = Data(slice_curves_spiralized_floormerged)
spiralization_enabled_4 = Boolean(spiralization_enabled)
slice_curves_floormerged_2 = Curve(slice_curves_floormerged)
open_wall_curves_2 = Curve(slice_curves_open)
np_slicing_enabled_9 = Boolean(np_slicing_enabled)
gate_33 = StreamGate(Stream=slice_curves_spiralized_floormerged_2, Gate=np_slicing_enabled_9)  # -> Target0, Target1
gate_34 = StreamGate(Stream=slice_curves_floormerged_2, Gate=np_slicing_enabled_9)  # -> Target0, Target1
merge_26 = Merge(Data1=gate_33.Target0, Data2=open_wall_curves_2)
merge_27 = Merge(Data1=gate_34.Target0, Data2=open_wall_curves_2)
filter_96 = StreamFilter(Gate=np_slicing_enabled_9, Stream0=merge_26, Stream1=slice_curves_spiralized_floormerged_2)
filter_97 = StreamFilter(Gate=np_slicing_enabled_9, Stream0=merge_27, Stream1=slice_curves_floormerged_2)
filter_98 = StreamFilter(Gate=spiralization_enabled_4, Stream0=filter_97, Stream1=filter_96)
layer_printing_curves = Geometry(filter_98)

# ----
# comments & notes: merge emod values for all object prining paths
emod_values_floor_2 = Data(emod_values_floor)
open_wall_curves_3 = Curve(slice_curves_open)
emod_values_2 = Data(emod_values)
explode_11 = Explode(Curve=open_wall_curves_3, Recursive=True)  # -> Segments, Vertices
merge_28 = Merge(Data1=emod_values_floor_2, Data2=emod_values_2)
pshift_29 = ShiftPaths(Data=explode_11.Vertices, Offset=-1)
emod_values_floormerged = Data(merge_28)
lng_25 = ListLength(List=pshift_29)
dup_4 = DuplicateData(Data="1", Number=lng_25, Order=True)
pshift_30 = ShiftPaths(Data=dup_4, Offset=-1)
merge_29 = Merge(Data1=emod_values_floormerged, Data2=pshift_30)
printpath_emod_values = Data(merge_29)

# ----
# CORRECT MODEL PLACEMENT
# comments & notes: center printing geometry to catch cases where the original input object is "flying" or "below 0"
# comments & notes: move everything (!) by 1x layer height to avoid starting the print at ZMAX (0)
printing_curves = Geometry(layer_printing_curves)
skirt_curve_3 = Curve(skirt_curve)
bbox_7 = BoundingBox(Content=flatten(printing_curves), Plane=PlaneXY(0, 0, 0), UnionBox=True)  # -> Box, Box_2
debox_6 = DeconstructBox(Box=bbox_7.Box)  # -> Plane, X, Y, Z
volume_4 = Volume(Geometry=bbox_7.Box)  # -> Volume, Centroid
pdecon_9 = Deconstruct(Point=volume_4.Centroid)  # -> XComponent, YComponent, ZComponent
dedomain_11 = DeconstructDomain(Domain=debox_6.Z)  # -> Start, End
pt_8 = ConstructPoint(XCoordinate=pdecon_9.XComponent, YCoordinate=pdecon_9.YComponent, ZCoordinate=dedomain_11.Start)
xy_8 = XYPlane(Origin=Point(0, 0, 0))
vec2pt_5 = Vector2Pt(PointA=pt_8, PointB=xy_8, Unitize=False)  # -> Vector, Length
layer_height_6 = Number(layer_height)
move_12 = Move(Geometry=printing_curves, Motion=vec2pt_5.Vector)  # -> Geometry, Transform
move_13 = Move(Geometry=skirt_curve_3, Motion=vec2pt_5.Vector)  # -> Geometry, Transform
Z_8 = UnitZ(Factor=layer_height_6)
move_14 = Move(Geometry=move_13.Geometry, Motion=Z_8)  # -> Geometry, Transform
move_15 = Move(Geometry=move_12.Geometry, Motion=Z_8)  # -> Geometry, Transform
layer_printing_curves_2 = Geometry(move_15.Geometry)
skirt_curve_4 = Curve(move_14.Geometry)

layer_printing_curves_3 = Geometry(layer_printing_curves_2)
filter_99 = StreamFilter(Gate=inject_custom_curves_8, Stream0=printing_geometry_7, Stream1=flatten(layer_printing_curves_3))
bbox_8 = BoundingBox(Content=filter_99, Plane=PlaneXY(0, 0, 0), UnionBox=True)  # -> Box, Box_2
debox_7 = DeconstructBox(Box=bbox_8.Box)  # -> Plane, X, Y, Z
dedomain_12 = DeconstructDomain(Domain=debox_7.X)  # -> Start, End
subtraction_14 = Subtraction(A=dedomain_12.End, B=dedomain_12.Start)
multiplication_16 = Multiplication(A=subtraction_14, B="0.5")
dedomain_13 = DeconstructDomain(Domain=debox_7.Y)  # -> Start, End
addition_4 = Addition(A=dedomain_12.Start, B=multiplication_16)
pt_9 = ConstructPoint(XCoordinate=addition_4, YCoordinate=expr("x*1.2", dedomain_13.Start), ZCoordinate=0)
amp_11 = Amplitude(Vector=X, Amplitude=subtraction_14)  # -> expr("x*2", Vector)
move_16 = Move(Geometry=pt_9, Motion=amp)  # -> Geometry, Transform
move_17 = Move(Geometry=move_16.Geometry, Motion=expr("x*0.5", amp_2))  # -> Geometry, Transform
move_18 = Move(Geometry=move_16.Geometry, Motion=amp_2)  # -> Geometry, Transform
xy_9 = XYPlane(Origin=move_17.Geometry)
merge_30 = Merge(Data1=pt_9, Data2=move_16.Geometry, Data3=move_18.Geometry)
align = AlignPlane(Plane=xy_9, Direction=addition)  # -> Plane, Angle
pline_8 = PolyLine(Vertices=merge_30, Closed=False)
deplane_2 = DeconstructPlane(Plane=align.Plane)  # -> Origin, XAxis, YAxis, ZAxis
move_19 = Move(Geometry=align.Plane, Motion=expr("x*1.5", deplane_2.YAxis))  # -> Geometry, Transform
cpl = CustomPreviewLineweights(Geometry=pline_8, Color=swatch)  # inputs Geometry: list, Color: list of Color
# ---------- cpl: Python ----------
"""
Custom Preview with Lineweights.
    Inputs:
        Geometry: The geometry to preview. {list, GeometryBase}
        Color: The preview color per geometry item. {list, System.Drawing.Color}
        Thickness: The thickness of the wire display. {item, int}
    Remarks:
        Author: Max Eschenbach
        License: MIT License
        Version: 231122
"""

# PYTHON STANDARD LIBRARY IMPORTS
from __future__ import division, print_function
import json
import math

# GHPYTHON SDK IMPORTS
from ghpythonlib.componentbase import executingcomponent as component
import Grasshopper, GhPython
import System
import Rhino
import rhinoscriptsyntax as rs

# GHENV COMPONENT SETTINGS
ghenv.Component.Name = "CustomPreviewLineweights"
ghenv.Component.NickName = "CPL"
ghenv.Component.Category = "FindersKeepers"
ghenv.Component.SubCategory = "4 Visualisation"

class CustomPreviewLineweights(component):
    
    def __init__(self):
        super(CustomPreviewLineweights, self).__init__()
        
        self.draw_lines = System.Collections.Generic.List[Rhino.Geometry.Line]()
        self.draw_curves = []
        self.draw_color = []
        self.draw_thickness = None
    
    
    def RunScript(self, Geometry, Color, Thickness):
        
        self.draw_lines = System.Collections.Generic.List[Rhino.Geometry.Line]()
        self.draw_curves = []
        self.draw_color = None
        self.draw_thickness = None
        
        if not Color:
            self.draw_color = [System.Drawing.Color.Black]
        else:
            self.draw_color = Color
        
        if not Thickness:
            self.draw_thickness = 1
        else:
            self.draw_thickness = Thickness
        
        if Geometry:
            for i, geo in enumerate(Geometry):
                if isinstance(geo, Rhino.Geometry.Line):
                    self.draw_curves.Add(Rhino.Geometry.LineCurve(geo))
                elif isinstance(geo, Rhino.Geometry.Curve):
                    self.draw_curves.append(geo)
                elif isinstance(geo, Rhino.Geometry.LineCurve):
                    self.draw_curves.Add(geo)
                elif isinstance(geo, Rhino.Geometry.Rectangle3d):
                    self.draw_curves.append(geo.ToNurbsCurve())
                else:
                    print(type(geo))
    
    
    def get_ClippingBox(self):
        return Rhino.Geometry.BoundingBox()
    
    
    def DrawViewportWires(self, arg):
        try:
            for i, crv in enumerate(self.draw_curves):
                if i >= len(self.draw_color):
                    col = self.draw_color[-1]
                else:
                    col = self.draw_color[i]
                if not col:
                    rml = self.RuntimeMessageLevel.Remark
                    self.AddRuntimeMessage(rml, 'Expected Color, got NoneType! '
                                                 'Substituting with Black...')
                    col = System.Drawing.Color.Black
                arg.Display.DrawCurve(crv, col, self.draw_thickness)
        except Exception, e:
            rml = self.RuntimeMessageLevel.Warning
            self.AddRuntimeMessage(rml, 'Error while drawing Preview!')
            # System.Windows.Forms.MessageBox.Show(
            #                     str(e),
            #                     'Error while drawing preview!')
# ---------- end cpl ----------
vis_offset_vector = Vector(amp_11)
vis_leader_plane = Data(move_19.Geometry)
vis_leader = Curve(pline_8)
tag = TextTag3D(Location=move_19.Geometry, Text="Input Geometry", Size=Slider(8, range=0..10), Colour=swatch, Justification=8)

vis_offset_vector_2 = Vector(vis_offset_vector)
move_20 = Move(Geometry=printing_geometry_8, Motion=vis_offset_vector_2)  # -> Geometry, Transform
move_21 = Move(Geometry=conmesh_2, Motion=vis_offset_vector_2)  # -> Geometry, Transform
gate_35 = StreamGate(Stream=move_20.Geometry, Gate=ismesh)  # -> Target0, Target1
move_22 = Move(Geometry=sharp_features_3, Motion=vis_offset_vector_2)  # -> Geometry, Transform
edges_2 = BrepEdges(Brep=gate_35.Target0)  # -> Naked, Interior, NonManifold
medges_3 = MeshEdges(Mesh=gate_35.Target1)  # -> NakedEdges, InteriorEdges, NonManifoldEdges
filter_100 = StreamFilter(Gate=render_sharp_features_2, Stream1=move_22.Geometry)
filter_101 = StreamFilter(Gate=and_6, Stream1=move_20.Geometry)
vis_leader_plane_2 = Data(vis_leader_plane)
vis_leader_2 = Curve(vis_leader)
filter_102 = StreamFilter(Gate=ismesh, Stream0=edges_2.Naked, Stream1=medges_3.NakedEdges)
filter_103 = StreamFilter(Gate=ismesh, Stream0=edges_2.Interior, Stream1=medges_3.InteriorEdges)
move_23 = Move(Geometry=vis_leader_2, Motion=vis_offset_vector_2)  # -> Geometry, Transform
filter_104 = StreamFilter(Gate=np_slicing_enabled_2, Stream1=move_21.Geometry)
filter_105 = StreamFilter(Gate=np_slicing_enabled_2, Stream0=filter_101)
move_24 = Move(Geometry=vis_leader_plane_2, Motion=vis_offset_vector_2)  # -> Geometry, Transform
filter_106 = StreamFilter(Gate=and_6, Stream1=filter_102)
filter_107 = StreamFilter(Gate=and_6, Stream1=filter_103)
filter_108 = StreamFilter(Gate=and_6, Stream1=move_23.Geometry)
cpl_2 = CustomPreviewLineweights(Geometry=filter_100, Color=ColourSwatch(SwatchColor=RGB(255, 0, 0)), Thickness=weight_3)  # inputs Geometry: list, Color: list of Color; same code as cpl
filter_109 = StreamFilter(Gate=and_6, Stream1=move_24.Geometry)
preview_2 = CustomPreview(
    Geometry=filter_104,
    Material={diffuse=RGB(221, 160, 221), emission=RGB(66, 48, 66), shine=0.5, specular=RGB(255, 255, 255), transparency=0})
preview_3 = CustomPreview(Geometry=filter_105, Material=ColourSwatch(SwatchColor=RGB(242, 242, 242)))
cpl_3 = CustomPreviewLineweights(Geometry=flatten(filter_106), Color=ColourSwatch(SwatchColor=RGB(255, 0, 187)), Thickness=weight_2)  # inputs Geometry: list, Color: list of Color; same code as cpl
cpl_4 = CustomPreviewLineweights(Geometry=flatten(filter_107), Color=ColourSwatch(SwatchColor=RGB(0, 0, 0)), Thickness=weight)  # inputs Geometry: list, Color: list of Color; same code as cpl
cpl_5 = CustomPreviewLineweights(Geometry=filter_108, Color=swatch_2)  # inputs Geometry: list, Color: list of Color; same code as cpl
tag_2 = TextTag3D(Location=filter_109, Text="Printing Geometry", Size=Slider(8, range=0..10), Colour=swatch_2, Justification=8)

vis_offset_vector_3 = Vector(vis_offset_vector)
move_25 = Move(Geometry=ln, Motion=expr("x*3", vis_offset_vector_3))  # -> flatten(Geometry), Transform
vis_leader_plane_3 = Data(vis_leader_plane)
vis_leader_3 = Curve(vis_leader)
filter_110 = StreamFilter(Gate=filter_83, Stream1=vis_leader_3)
filter_111 = StreamFilter(Gate=filter_83, Stream1=vis_leader_plane_3)
dispatch_11 = Dispatch(List=move_25.Geometry, DispatchPattern=larger_12.LargerThan)  # -> ListA, ListB
move_26 = Move(Geometry=filter_110, Motion=expr("x*3", vis_offset_vector_3))  # -> Geometry, Transform
move_27 = Move(Geometry=filter_111, Motion=expr("x*3", vis_offset_vector_3))  # -> Geometry, Transform
eval = EvaluateCurve(Curve=reparameterize(dispatch_11.ListA), Parameter=0.5)  # -> Point, Tangent, Angle
cpl_6 = CustomPreviewLineweights(Geometry=move_26.Geometry, Color=swatch_3)  # inputs Geometry: list, Color: list of Color; same code as cpl
cpl_7 = CustomPreviewLineweights(Geometry=move_25.Geometry, Color=gradient_2, Thickness=Slider(3, range=0..10))  # inputs Geometry: list, Color: list of Color; same code as cpl
tag_3 = TextTag3D(Location=move_27.Geometry, Text="Overhang Analysis", Size=Slider(8, range=0..10), Colour=swatch_3, Justification=8)
tag_4 = TextTag(Location=eval.Point, Text=rtd_3, Colour=dispatch_10.ListA)

vis_offset_vector_4 = Vector(vis_offset_vector)
move_28 = Move(Geometry=ln_3, Motion=expr("x*2", vis_offset_vector_4))  # -> Geometry, Transform
move_29 = Move(Geometry=ln_2, Motion=expr("x*2", vis_offset_vector_4))  # -> Geometry, Transform
len_2 = Length(Curve=move_28.Geometry)
len_3 = Length(Curve=move_29.Geometry)
maxlines = Data(move_28.Geometry)
minlines = Data(move_29.Geometry)
gradient_3 = Gradient(LowerLimit=dedomain_10.Start, UpperLimit=dedomain_10.End, Parameter=len_3, stops=[0: RGB(0, 0, 255), 1: RGB(255, 0, 0)])
gradient_4 = Gradient(LowerLimit=dedomain_10.Start, UpperLimit=dedomain_10.End, Parameter=len_2, stops=[0: RGB(0, 0, 255), 1: RGB(255, 0, 0)])
eval_2 = EvaluateCurve(Curve=reparameterize(minlines), Parameter=0.5)  # -> Point, Tangent, Angle
eval_3 = EvaluateCurve(Curve=reparameterize(maxlines), Parameter=0.5)  # -> Point, Tangent, Angle
rtd_4 = RoundToDecimal(Numbers=len_3, DecimalPlaces=2)  # -> Rounded; inputs Numbers: list, DecimalPlaces: list of Int32; same code as rtd_2
rtd_5 = RoundToDecimal(Numbers=len_2, DecimalPlaces=2)  # -> Rounded; inputs Numbers: list, DecimalPlaces: list of Int32; same code as rtd_2
cpl_8 = CustomPreviewLineweights(Geometry=minlines, Color=gradient_3, Thickness=number_slider_9)  # inputs Geometry: list, Color: list of Color; same code as cpl
cpl_9 = CustomPreviewLineweights(Geometry=maxlines, Color=gradient_4, Thickness=number_slider_9)  # inputs Geometry: list, Color: list of Color; same code as cpl
tag_5 = TextTag(Location=eval_2.Point, Text=rtd_4, Colour=gradient_3)
tag_6 = TextTag(Location=eval_3.Point, Text=rtd_5, Colour=gradient_4)

# ----
# VISUALIZE
# SEAM POINTS
show_seam_points_2 = Data(show_seam_points)
spiralization_enabled_5 = Boolean(spiralization_enabled)
slice_curves_18 = Curve(slice_curves_9)
spiralcontours_base_4 = Data(spiralcontours_base)
vis_offset_vector_5 = Vector(expr("x*2", vis_offset_vector))
filter_112 = StreamFilter(Gate=spiralization_enabled_5, Stream0=slice_curves_18, Stream1=spiralcontours_base_4)
and_24 = GateAnd(A=show_seam_points_2, B=invert(spiralization_enabled_5))
end = EndPoints(Curve=filter_112)  # -> Start, End
item_24 = ListItem(List=flatten(end.Start), Index=0, Wrap=True)
pdecon_10 = Deconstruct(Point=item_24)  # -> XComponent, YComponent, ZComponent
layer_height_7 = Data(layer_height)
equals_6 = Equality(FirstNumber=pdecon_10.ZComponent, SecondNumber="0")  # -> Equality, Inequality
Z_9 = UnitZ(Factor=layer_height_7)
addition_5 = Addition(A=vis_offset_vector_5, B=Z_9)
filter_113 = StreamFilter(Gate=equals_6.Equality, Stream0=vis_offset_vector_5, Stream1=addition_5)
move_30 = Move(Geometry=end.Start, Motion=filter_113)  # -> Geometry, Transform
filter_114 = StreamFilter(Gate=show_seam_points_2, Stream1=move_30.Geometry)
dots = DotDisplay(Point=filter_114, Colour=ColourSwatch(SwatchColor=RGB(0, 0, 0)), Size=Slider(1, range=0..1))

# ----
# comments & notes: merge extrusion rate mod values for skirt and paths
printpath_emod_values_2 = Data(printpath_emod_values)
emod_values_skirt_2 = Data(emod_values_skirt)
tstat_44 = TreeStatistics(Tree=printpath_emod_values_2)  # -> Paths, Length, Count
tstat_45 = TreeStatistics(Tree=emod_values_skirt_2)  # -> Paths, Length, Count
item_25 = ListItem(List=tstat_44.Paths, Index=0, Wrap=True)
replace_7 = ReplacePaths(Data=emod_values_skirt_2, Search=tstat_45.Paths, Replace=item_25)
merge_31 = Merge(Data1=replace_7, Data2=printpath_emod_values_2)
complete_emod_values = Data(merge_31)

# ----
# MERGE LAYERS AND SKIRT
# comments & notes: merge layer curves with skirt curve (insert skirt into first layer branch)
layer_printing_curves_4 = Geometry(layer_printing_curves_2)
skirt_curve_5 = Curve(skirt_curve_4)
tstat_46 = TreeStatistics(Tree=layer_printing_curves_4)  # -> Paths, Length, Count
tstat_47 = TreeStatistics(Tree=skirt_curve_5)  # -> Paths, Length, Count
item_26 = ListItem(List=tstat_46.Paths, Index=0, Wrap=True)
replace_8 = ReplacePaths(Data=skirt_curve_5, Search=tstat_47.Paths, Replace=item_26)
merge_32 = Merge(Data1=replace_8, Data2=layer_printing_curves_4)
printing_curves_2 = Curve(merge_32)

# ----
# REDUCE POLYLINES
# comments & notes: reduce polylines by removing insignificant vertices, making computation more efficient.
reduce = BooleanToggle(False)
printing_curves_3 = Curve(printing_curves_2)
gate_36 = StreamGate(Stream=printing_curves_3, Gate=reduce)  # -> Target0, Target1
redpline_5 = Reduce(Polyline=gate_36.Target1, Tolerance=Slider(0.01, range=0.001..1))  # -> Polyline, Reduction
filter_115 = StreamFilter(Gate=reduce, Stream0=gate_36.Target0, Stream1=redpline_5.Polyline)
printing_curves_4 = Curve(filter_115)

# ----
# CONTROL FLOW
# FLOOR LAYER PAUSE
# comments & notes: check if first layer has been skipped and adjust floor layer count accordingly
printing_curves_5 = Geometry(printing_curves_4)
floor_layer_count_11 = Data(floor_layer_count)
tstat_48 = TreeStatistics(Tree=printing_curves_5)  # -> Paths, Length, Count
item_27 = ListItem(List=tstat_48.Paths, Index=0, Wrap=True)
dpath_6 = DeconstructPath(Branch=item_27)
ma_11 = MassAddition(Input=dpath_6)  # -> Result, PartialResults
larger_13 = LargerThan(FirstNumber=ma_11.Result, SecondNumber="0")  # -> LargerThan, OrEqualTo
subtraction_15 = Subtraction(A=floor_layer_count_11, B=ma_11.Result)
filter_116 = StreamFilter(Gate=larger_13.LargerThan, Stream0=floor_layer_count_11, Stream1=subtraction_15)
real_floor_layer_count = Data(filter_116)

# ----
# PRINT LAYER
# VISUALISATION
printing_curves_6 = Geometry(flatten(printing_curves_4))
vis_offset_vector_6 = Vector(vis_offset_vector)
vis_leader_plane_4 = Data(vis_leader_plane)
layer_height_8 = Number(layer_height)
render_layer_curves_2 = Data(render_layer_curves)
render_print_layers_2 = Data(render_print_layers)
line_width_3 = Data(line_width)
overhangangleanalysis = Boolean(filter_83)
vis_leader_4 = Curve(vis_leader)
filter_117 = StreamFilter(Gate=overhangangleanalysis, Stream0="3", Stream1="4")
multiplication_17 = Multiplication(A=vis_offset_vector_6, B=filter_117)
move_31 = Move(Geometry=printing_curves_6, Motion=multiplication_17)  # -> Geometry, Transform
filter_118 = StreamFilter(Gate=render_print_layers_2, Stream1=move_31.Geometry)
comments_notes_38 = Panel("PRINT LAYER VISUALISATION")
redpline_6 = Reduce(Polyline=filter_118, Tolerance=Slider(0.1, range=0..1))  # -> Polyline, Reduction
filter_119 = StreamFilter(Gate=render_print_layers_2, Stream1=vis_leader_plane_4)
filter_120 = StreamFilter(Gate=render_print_layers_2, Stream1=vis_leader_4)
move_32 = Move(Geometry=printing_curves_6, Motion=expr("x*2", vis_offset_vector_6))  # -> Geometry, Transform
hd_layer_visualisation_2 = Data(hd_layer_visualisation)
filter_121 = StreamFilter(Gate=render_layer_curves_2, Stream1=move_32.Geometry)
gate_37 = StreamGate(Stream=redpline_6.Polyline, Gate=hd_layer_visualisation_2)  # -> Target0, Target1
filter_122 = StreamFilter(Gate=render_layer_curves_2, Stream1=vis_leader_4)
filter_123 = StreamFilter(Gate=render_layer_curves_2, Stream1=vis_leader_plane_4)
move_33 = Move(Geometry=filter_120, Motion=multiplication_17)  # -> Geometry, Transform
swatch_4 = ColourSwatch(SwatchColor=RGB(0, 0, 0))
move_34 = Move(Geometry=filter_119, Motion=multiplication_17)  # -> Geometry, Transform
leader_text_size = Slider(8, range=0..10)
cpl_10 = CustomPreviewLineweights(Geometry=move_33.Geometry, Color=swatch_4)  # inputs Geometry: list, Color: list of Color; same code as cpl
tag_7 = TextTag3D(Location=move_34.Geometry, Text="Print Layer Simulation", Size=leader_text_size, Colour=swatch_4, Justification=8)
divlength_2 = DivideLength(Curve=reparameterize(flatten(gate_37.Target1)), Length=Slider(200, range=0..1000))  # -> Points, Tangents, Parameters
move_35 = Move(Geometry=filter_122, Motion=expr("x*2", vis_offset_vector_6))  # -> Geometry, Transform
move_36 = Move(Geometry=filter_123, Motion=expr("x*2", vis_offset_vector_6))  # -> Geometry, Transform
swatch_5 = ColourSwatch(SwatchColor=RGB(0, 0, 0))
numsegments = Slider(10, range=0..10)
line_width_4 = Data(line_width)
subsegments = Slider(10, range=0..100)
shatter = Shatter(Curve=reparameterize(graft(gate_37.Target1)), Parameters=divlength_2.Parameters)  # -> flatten(Segments)
accuracy = Slider(1, range=0..1)
capstyle = Slider(3, range=0..3)
multiplication_18 = Multiplication(A=line_width_4, B="0.5")
cpl_11 = CustomPreviewLineweights(Geometry=flatten(filter_121), Color=ColourSwatch(SwatchColor=RGB(217, 212, 212)), Thickness=Slider(2, range=0..10))  # inputs Geometry: list, Color: list of Color; same code as cpl
cpl_12 = CustomPreviewLineweights(Geometry=move_35.Geometry, Color=swatch_5)  # inputs Geometry: list, Color: list of Color; same code as cpl
tag_8 = TextTag3D(Location=move_36.Geometry, Text="Printing Layers", Size=leader_text_size, Colour=swatch_5, Justification=8)
hd_layer_visualisation_3 = Data(hd_layer_visualisation_2)
meshpipe = CSharpScript(Curves=shatter, Radius=multiplication_18, SubSegments=subsegments, Accuracy=accuracy, CapStyle=capstyle)  # -> M; inputs Curves: list of Curve, Radius: Double, SubSegments: Int32, Accuracy: Int32, CapStyle: Int32
# ---------- meshpipe: C# usings ----------
using System.Threading.Tasks;
using System.Collections.Concurrent;
# ---------- meshpipe: C# ----------
    ConcurrentBag<Mesh> MeshPipesBag = new ConcurrentBag<Mesh>();
    MeshPipeCapStyle mpcs = (MeshPipeCapStyle) CapStyle;

    if (Curves.Count > 20)
    {
      // create pipes in parallel
      Parallel.For(0, Curves.Count,
        i => {
        // create mesh pipe
        Mesh MeshPipe = Mesh.CreateFromCurvePipe(Curves[i], Radius, SubSegments, Accuracy, mpcs, true);
        // add to tree
        MeshPipesBag.Add(MeshPipe);
        });
    }
    else
    {
      // create pipes sequential
      for (int i = 0; i < Curves.Count; i++)
      {
        // create mesh pipe
        Mesh MeshPipe = Mesh.CreateFromCurvePipe(Curves[i], Radius, SubSegments, Accuracy, mpcs, true);
        // add to tree
        MeshPipesBag.Add(MeshPipe);
      }
    }
    M = MeshPipesBag.ToArray();
# ---------- end meshpipe ----------
meshpipechromo = CSharpScript(P=gate_37.Target0, N=numsegments, R=multiplication_18, C=Toggle(True))  # -> M; inputs P: list of Curve, N: Int32, R: Double, C: Boolean
# ---------- meshpipechromo: C# ----------
    ﻿/*
     *      ___  _  _  ____   __   _  _   __  ____   __  ____  __  ____
     *     / __)/ )( \(  _ \ /  \ ( \/ ) /  \(    \ /  \(  _ \(  )/ ___)
     *    ( (__ ) __ ( )   /(  O )/ \/ \(  O )) D ((  O ))   / )( \___ \
     *     \___)\_)(_/(__\_) \__/ \_)(_/ \__/(____/ \__/(__\_)(__)(____/
     *
     *    Copyright Cameron Newnham 2015-2016
     *
     *    This program is free software: you can redistribute it and/or modify
     *    it under the terms of the GNU General Public License as published by
     *    the Free Software Foundation, either version 3 of the License, or
     *    (at your option) any later version.
     *
     *    This program is distributed in the hope that it will be useful,
     *    but WITHOUT ANY WARRANTY; without even the implied warranty of
     *    MERCHANTABILITY or FITNESS FOR A PARTICULAR PURPOSE.  See the
     *    GNU General Public License for more details.
     *
     *    You should have received a copy of the GNU General Public License
     *    along with this program.  If not, see <http://www.gnu.org/licenses/>.
     *
     */

    List<Polyline> pls = new List<Polyline>();

    foreach (var c in P)
    {
      Polyline p;
      if (c.TryGetPolyline(out p)) {
        pls.Add(p);
      }
      else
      {
        this.Component.AddRuntimeMessage(GH_RuntimeMessageLevel.Error, "Input must be polylines.");
        return;
      }
    }
    Mesh _M = GetPiped(pls, N, R, C);
    _M.UnifyNormals();
    M = new GH_Mesh(_M);
# ---------- meshpipechromo: C# additional code ----------
  public Mesh GetPiped(List<Polyline> polylines, int numSides, double radius, bool cap)
  {
    var pt = new Point3d(radius, 0, 0);
    Polyline polygon = new Polyline();

    Point3d curr = new Point3d(pt);
    polygon.Add(curr);
    var xfm = Transform.Rotation(Math.PI * 2 / (double) numSides, Point3d.Origin);
    for (int i = 0; i < numSides; i++)
    {
      var pNew = new Point3d(curr);
      pNew.Transform(xfm);

      polygon.Add(pNew);
      curr = pNew;
    }

    var multimesh = new Mesh[polylines.Count];

    System.Threading.Tasks.Parallel.For(0, polylines.Count, pc => {
      Polyline pl = polylines[pc];
      List<Plane> frames = new List<Plane>();
      for (int i = 0; i < pl.Count; i++)
      {
        Point3d o = pl[i];
        Vector3d dir = Vector3d.Unset;
        if (i == 0)
        {
          if (!pl.IsClosed)
          {
            dir = pl[1] - pl[0];
            dir.Unitize();
          }
          else
          {
            Vector3d prevDir = pl[0] - pl[pl.Count - 2];
            Vector3d nextDir = pl[1] - pl[0];
            prevDir.Unitize();
            nextDir.Unitize();
            dir = (prevDir + nextDir) / 2;
            dir.Unitize();
          }
        }
        else if (i == pl.Count - 1)
        {
          if (!pl.IsClosed)
          {
            dir = pl[pl.Count - 1] - pl[pl.Count - 2];
            dir.Unitize();
          }
        }
        else
        {
          Vector3d prevDir = pl[i] - pl[i - 1];
          Vector3d nextDir = pl[i + 1] - pl[i];
          prevDir.Unitize();
          nextDir.Unitize();
          dir = (prevDir + nextDir) / 2;
          dir.Unitize();
        }

        if (frames.Count > 0)
        {
          if (dir != Vector3d.Unset)
          {
            var prevFrame = frames.Last();
            var newPlane = new Plane(o, dir);
            double rotAng = Vector3d.VectorAngle(prevFrame.XAxis, newPlane.XAxis, newPlane);
            newPlane.Rotate(-rotAng, newPlane.ZAxis);
            frames.Add(newPlane);
          }
        }
        else
        {
          frames.Add(new Plane(o, dir));
        }
      }

      Mesh mesh = new Mesh();
      Mesh capm = null;
      var poly = new Polyline(polygon);
      poly.Transform(Transform.PlaneToPlane(Plane.WorldXY, frames.First()));

      int[] lastVerts = new int[numSides];
      for (int p = 0; p < poly.Count - 1; p++)
      {
        lastVerts[p] = mesh.Vertices.Add(poly[p]);
      }

      int[] firstVerts = lastVerts;

      if (cap && !pl.IsClosed)
      {
        capm = Mesh.CreateFromClosedPolyline(poly);
      }

      for (int i = 1; i < frames.Count; i++)
      {
        poly = new Polyline(polygon);
        poly.Transform(Transform.PlaneToPlane(Plane.WorldXY, frames[i]));

        int[] newVerts = new int[numSides];
        for (int p = 0; p < poly.Count - 1; p++)
        {
          newVerts[p] = mesh.Vertices.Add(poly[p]);
        }

        for (int v = 1; v <= numSides; v++)
        {

          if (v == numSides)
          {
            mesh.Faces.AddFace(lastVerts[v - 1], lastVerts[0], newVerts[0], newVerts[v - 1]);
          }
          else
          {
            mesh.Faces.AddFace(lastVerts[v - 1], lastVerts[v], newVerts[v], newVerts[v - 1]);

          }
        }

        lastVerts = newVerts;
      }

      if (pl.IsClosed)
      {

        // resolve any twists
        for (int v = 1; v <= numSides; v++)
        {
          if (v == numSides)
          {
            mesh.Faces.AddFace(lastVerts[v - 1], lastVerts[0], firstVerts[0], firstVerts[v - 1]);
          }
          else
          {
            mesh.Faces.AddFace(lastVerts[v - 1], lastVerts[v], firstVerts[v], firstVerts[v - 1]);

          }
        }
      } else if (cap)
      {
        capm.Append(Mesh.CreateFromClosedPolyline(poly));
        mesh.Append(capm);
      }

      multimesh[pc] = mesh;
      });

    Mesh combined = new Mesh();

    foreach (var m in multimesh)
    {
      combined.Append(m);
    }

    combined.Normals.ComputeNormals();

    return combined;
  }
# ---------- end meshpipechromo ----------
filter_124 = StreamFilter(Gate=hd_layer_visualisation_3, Stream0=meshpipechromo, Stream1=meshpipe)
preview_4 = CustomPreview(Geometry=filter_124, Material=ColourSwatch(SwatchColor=RGB(230, 230, 230)))

# ----
# MATERIAL AMOUNT CALCULATION
# TESTED WEIGHT PARAMETERS: Intersecting Wall 937g
# Mirko Schlaufen 383g
# Vase 541g
line_width_5 = Data(line_width)
printing_curves_7 = Geometry(printing_curves_4)
layer_height_9 = Number(layer_height)
filletfactor = Slider(0.3, range=0..1)
dom_6 = ConstructDomain(DomainStart=expr("x*-0.5", line_width_5), DomainEnd=expr("x*0.5", line_width_5))
dom_7 = ConstructDomain(DomainStart=expr("x*-0.5", layer_height_9), DomainEnd=expr("x*0.5", layer_height_9))
min_6 = Minimum(A=line_width_5, B=layer_height_9)
len_4 = Length(Curve=printing_curves_7)  # -> flatten(Length)
multiplication_19 = Multiplication(A=min_6, B=filletfactor)
ma_12 = MassAddition(Input=len_4)  # -> Result, PartialResults
rectangle = Rectangle(Plane=PlaneXY(0, 0, 0), XSize=dom_6, YSize=dom_7, Radius=multiplication_19)  # -> Rectangle, Length
area_3 = Area(Geometry=rectangle.Rectangle)  # -> Area, Centroid
printing_curves_length_mm = Data(ma_12.Result)
print_profile_area_mm2 = Data(area_3.Area)
comments_notes_39 = Panel("MATERIAL AMOUNT CALCULATION")
multiplication_20 = Multiplication(A=printing_curves_length_mm, B=print_profile_area_mm2)
multiplication_21 = Multiplication(A=multiplication_20, B="0.001")
specific_weight_clay_in_g_cm3 = Panel("1.99")
addpercentage = Slider(20, range=0..100)
print_volume_mm3 = Data(multiplication_20)
print_volume_cm3 = Data(multiplication_21)
multiplication_22 = Multiplication(A=print_volume_cm3, B=specific_weight_clay_in_g_cm3)
num = Number(expr("x*0.01", addpercentage))
multiplication_23 = Multiplication(A=multiplication_22, B=num)
addition_6 = Addition(A=multiplication_22, B=multiplication_23)
rtd_6 = RoundToDecimal(Numbers=addition_6, DecimalPlaces="2")  # -> Rounded; inputs Numbers: list, DecimalPlaces: list of Int32; same code as rtd_2
print_weight_in_g = Panel(rtd_6)
format_6 = Format(Format="[INFO] Approximate Material Weight is {0} g.", Culture=127, Data0=rtd_6)
info_approximate_print_weight = Data(format_6)
approximate_print_weight = Data(rtd_6)

# ----
# GCODE CREATION
# 3RD ITERATION OF GCODE GENERATOR
# ORIGINAL BY TOM SVILANS
# EDITED & EXTENDED BY MAX ESCHENBACH
# 
# Wasp (60100), 4mm, 2mm lh, extrusion rate: 2.7
# Wasp (40100), 4mm, 2mm lh, extrusion rate: 0.28
# 
# for 4mm 2.7
# for 2mm 1/4 of 2.7
# 
# Toms original comment: I have since been working with an extrusion rate of 0.1 for the 40100 with the new extruder as it handles a much firmer material (c# tool)
# 4mm Nozzle Cura Settings: Line Width: 3.5
# Layer Height: 1.9
# Print Speed: 50 mm/s
# Test Results: Feed Setting: 15-20 %
# 
# Adapt ExtrusionRate
# 15 % = 0,156
# 20 % = 0,208
# G92 E0 ; Reset Extrusion Distance
# G1 X38.394 Y45.456 Z15.000 E0.000 F3000 ; Move to Pause position
# G04 P10000 ; DWELL
printing_curves_8 = Curve(printing_curves_4)
create_gcode_2 = Data(create_gcode)
layer_height_10 = Number(layer_height)
line_width_6 = Data(line_width)
retractextension = Slider(6, range=0..10)
curveextensionretraction = BooleanToggle(True)
pauseafterfloor = BooleanToggle(True)
filter_125 = StreamFilter(Gate=create_gcode_2, Stream1=printing_curves_8)
complete_emod_values_2 = Data(complete_emod_values)
floor_slicing_enabled_11 = Boolean(floor_slicing_enabled)
pausetime_ms = Slider(25000, range=0..99999)
enableextrusionratemod_3 = Boolean(enable_erm)
linewidth_2 = Panel(line_width_6)
print_speed_mm_min = Panel("3000")
z_hop_distance = Panel("1.0")
travel_speed_mm_min = Panel("6000")
retraction_speed_mm_min = Panel("1500")
layerheight = Panel(layer_height_10)
new_extrusion_rate_230316 = Panel("0.208")
retraction_constant = Panel("5.0")
real_floor_layer_count_2 = Data(real_floor_layer_count)
initial_extrusion_constant = Panel("6.0")
end_2 = EndPoints(Curve=printing_curves_8)  # -> Start, End
pdecon_11 = Deconstruct(Point=end_2.Start)  # -> XComponent, YComponent, ZComponent
panel_27 = Panel(pdecon_11.ZComponent)
and_25 = GateAnd(A=floor_slicing_enabled_11, B=pauseafterfloor)
filter_126 = StreamFilter(Gate=enableextrusionratemod_3, Stream1=complete_emod_values_2)
gcode_command_reference = Panel("https://reprap.org/wiki/G-code")
print_speed_mm_min_2 = Data(print_speed_mm_min)
generategcode = CSharpScript(
    Paths=filter_125,
    PrintSpeed=print_speed_mm_min,
    TravelSpeed=travel_speed_mm_min,
    RetractionSpeed=retraction_speed_mm_min,
    ExtrusionRate=new_extrusion_rate_230316,
    InitExtrusionConstant=initial_extrusion_constant,
    RetractionConstant=retraction_constant,
    LayerHeight=layerheight,
    LineWidth=linewidth_2,
    RetractExtension=retractextension,
    CurveExtensionRetraction=curveextensionretraction,
    ZHopDistance=z_hop_distance,
    FloorLayerCount=real_floor_layer_count_2,
    PauseAfterFloor=and_25,
    PauseTime=pausetime_ms,
    ExtrusionRateMod=filter_126)  # -> out, GCODE; inputs Paths: tree of Polyline, PrintSpeed: Double, TravelSpeed: Double, RetractionSpeed: Double, ExtrusionRate: Double, InitExtrusionConstant: Double, RetractionConstant: Double, LayerHeight: Double, LineWidth: Double, RetractExtension: Double, CurveExtensionRetraction: Boolean, ZHopDistance: Double, FloorLayerCount: Int32, PauseAfterFloor: Boolean, PauseTime: Int32, ExtrusionRateMod: tree of Double
# ---------- generategcode: C# ----------
    // catch empty paths ttree and return empty tree
    if (Paths.DataCount < 1)
    {
      GCODE = new Grasshopper.DataTree<object>();
      return;
    }

    // check if extrusion rate modified values correspond
    bool e_mod = true;
    int ptsum = 0;
    for (int i = 0; i < Paths.BranchCount; i++)
    {
      foreach (Polyline pl in Paths.Branches[i])
      {
        ptsum += pl.Count;
      }
    }
    if (ptsum != ExtrusionRateMod.DataCount)
    {
      e_mod = false;
      Print("ExtrusionRateMod values do not correspond with supplied Paths. " +
        "Constant ExtrusionRate will be used!");
    }

    // init list for storing GCODE strings
    List<string> gcode = new List<string>();

    // get all data from Paths input
    List<Polyline> paths = Paths.AllData();

    // compute union bbx with each layer
    BoundingBox bbx = BoundingBox.Empty;
    foreach (Polyline path in paths)
    {
      bbx.Union(path.BoundingBox);
    }

    // compute offset value from bbx
    Vector3d offset = new Vector3d(-bbx.Center.X, -bbx.Center.Y, 0);
    Print("Offset: {0}", offset);

    // SET CONSTANTS -----------------------------------------------
    // value for safe approach before first layer
    double z_safety = 5.0;

    // initial extrusion rate constant and retraction constant
    double extrusion_rate_extra = InitExtrusionConstant;
    double retraction_amount = RetractionConstant;

    // CREATE HEADER -----------------------------------------------
    Point3d p0 = paths[0][0] + offset;
    gcode.AddRange(new string[]
      {
      "; GCODE Generation Script by: Arkitekturens Teknologi (AT) + SuperFormLab",
      "; Modified, adapted and extended by: Max Eschenbach, DDU - Digital Design Unit, TU Darmstadt",
      string.Format("; Created by : {0}", System.Environment.UserName),
      string.Format("; File name  : {0}", GrasshopperDocument.DisplayName),
      string.Format("; Date time  : {0}", System.DateTime.Now.ToString("yyyy-MM-ddTHH\\:mm\\:ss")),
      ";",
      "M105 ; get extruder temperature",
      "M109 S0 ; set extruder temp to 0 (deactivate)",
      "M82 ; use absolute distances for extrusion",
      "G90 ; use absolute coordintes",
      "M106 S0 ; set fan speed to 0 (deactivate)",
      "M107 ; fan off",
      "M104 S0 T0 ; set hotend temperature to 0 (deactivate)",
      "G28 ; home all axes",
      "T0 ; set extruder to extruder 0 (first and only one)",
      "G21 ; set units to millimetres",
      // "M204 S200 ; set acceleration",
      "G92 E0 ; reset E distance",
      "; approach the first vertex using z safety height",
      string.Format("G0 X0.0 Y0.0 Z{0:0.000} F{1}", p0.Z + z_safety, 3000),
      "; approach first point with x and y coordinates",
      string.Format("G1 X{0:0.000} Y{1:0.000} Z{2:0.000}", p0.X, p0.Y, p0.Z + z_safety),
      "; --- END HEADER ---",
      });


    // CREATE PRINT PATHS GCODE  ------------------------------------
    Point3d temp = Paths.Branches[0][0][0];
    double emod_value = 1.0;

    // LOOP OVER ALL LAYERS (BRANCHES)
    for (int i = 0; i < Paths.BranchCount; i++)
    {
      // pause after floor printing on request
      if (PauseAfterFloor && FloorLayerCount > 0 && i == FloorLayerCount)
      {
        // add marker to GCODE out
        gcode.Add(string.Format("; ///// PAUSE AFTER FLOOR FOR {0} ms /////", PauseTime));
        // reset extrusion distance
        gcode.Add(string.Format("G92 E0 ; Reset Extrusion Distance"));
        // move 5mm upwards from last point
        gcode.Add(string.Format("G0 X{0:0.000} Y{1:0.000} Z{2:0.000} E{3:0.000} F{4}",
          p0.X, p0.Y, p0.Z + 5.0, 0.000, PrintSpeed));
        // move to pause position
        gcode.Add(string.Format("G0 X{0:0.000} Y{1:0.000} Z{2:0.000} E{3:0.000} F{4}",
          0.000, 0.000, p0.Z + 100.0, 0.000, PrintSpeed));
        // execute pause command
        gcode.Add(string.Format("G04 P{0:0} ; Dwell / Pause", PauseTime));
      }

      // add layer marker to GCODE out
      gcode.Add(string.Format("; ///// LAYER {0} /////", i + 1));

      // LOOP OVER ALL CURVES IN LAYER (BRANCH)
      for (int j = 0; j < Paths.Branches[i].Count; j++)
      {
        // set current path
        Polyline path = Paths.Branches[i][j];
        PolylineCurve pathcrv = path.ToPolylineCurve();
        // reset extrusion distance
        double ExtrusionDist = 0.0;
        // translate path according to offset
        path.Transform(Transform.Translation(offset));
        pathcrv.Transform(Transform.Translation(offset));
        // get first vertex
        p0 = path.First();
        // format first vertex to GCODE
        gcode.Add(string.Format("G1 X{0:0.000} Y{1:0.000} Z{2:0.000} E{3:0.000} F{4}",
          p0.X, p0.Y, p0.Z + ZHopDistance, ExtrusionDist, TravelSpeed));
        // set extrusion on first vertex (no distance here!)
        ExtrusionDist += extrusion_rate_extra;
        // set temporary vertex
        temp = p0;
        // loop over all vertices in path
        for (int k = 0; k < path.Count; k++)
        {

          // get point distance to previous point
          double ptDist = temp.DistanceTo(path[k]);
          if (k > 0 && ptDist < Rhino.RhinoDoc.ActiveDoc.ModelAbsoluteTolerance)
          {
            Print("Point Distance below tolerance, point is skipped!");
            continue;
          }

          // compute extrusion rate modified (if applicable)
          if (e_mod == true)
          {
            emod_value = ExtrusionRateMod.Branches[i][k];
          }

          // set extrusion distance based on pt distance and emod
          ExtrusionDist += ptDist * (ExtrusionRate * emod_value);

          // compile GCODE string
          // for first vertex use half print speed
          gcode.Add(string.Format("G1 X{0:0.000} Y{1:0.000} Z{2:0.000} E{3:0.000} F{4}",
            path[k].X, path[k].Y, path[k].Z, ExtrusionDist, (k == 0) ? PrintSpeed * 0.5 :  PrintSpeed));
          
          // set new temp vertex
          temp = path[k];
        }

        // retract on last vertex or extend during retraction move
        if (RetractExtension > 0.0)
        {
          if (CurveExtensionRetraction && path.IsClosedWithinTolerance(0.01) && path.Length > RetractExtension)
          {
            // move retractextension amount along the curve

            // find point on curve that is RetractionExtension mm along crv
            double ret_end_t;
            bool _suc = pathcrv.LengthParameter(RetractExtension, out ret_end_t);
            PolylineCurve subcrv = pathcrv.Split(new List<double>{0.0, ret_end_t})[0] as PolylineCurve;
            Polyline subpl = subcrv.ToPolyline();

            temp = subpl.First;
            for (int k = 1; k < subpl.Count; k++)
            {
              double ptDist = temp.DistanceTo(subpl[k]);
              if (k > 0 && ptDist < Rhino.RhinoDoc.ActiveDoc.ModelAbsoluteTolerance)
              {
                Print("Point Distance below tolerance, point is skipped!");
                continue;
              }

              // compute retraction amount for point
              ExtrusionDist -= (ptDist / RetractExtension) * retraction_amount;

              // create retraction gcode
              gcode.Add(string.Format("G1 X{0:0.000} Y{1:0.000} Z{2:0.000} E{3:0.000} F{4} ; RetractExtensionClosedCurve",
                subpl[k].X, subpl[k].Y, subpl[k].Z, ExtrusionDist, RetractionSpeed));

              // set new temp vertex
              temp = subpl[k];
            }

            // create z-hop gcode
            gcode.Add(string.Format("G1 X{0:0.000} Y{1:0.000} Z{2:0.000} E{3:0.000} F{4} ; Z-Hop",
              subpl.Last.X, subpl.Last.Y, subpl.Last.Z + ZHopDistance, ExtrusionDist, RetractionSpeed));
          }
          else
          {
            // move retract extension amount in direction of last move and retract
            Vector3d rvec = new Vector3d(path.Last - path[path.Count - 2]);
            rvec.Unitize();
            p0 = path.Last + (rvec * RetractExtension);
            ExtrusionDist -= retraction_amount;
            gcode.Add(string.Format("G1 X{0:0.000} Y{1:0.000} Z{2:0.000} E{3:0.000} F{4} ; RetractExtension",
              p0.X, p0.Y, p0.Z, ExtrusionDist, RetractionSpeed));

            gcode.Add(string.Format("G1 X{0:0.000} Y{1:0.000} Z{2:0.000} E{3:0.000} F{4} ; Z-Hop",
              p0.X, p0.Y, p0.Z + ZHopDistance, ExtrusionDist, RetractionSpeed));
          }
        }
        else
        {
          // use last point for retraction move and move upwards
          p0 = path.Last();
          ExtrusionDist -= retraction_amount;
          gcode.Add(string.Format("G1 X{0:0.000} Y{1:0.000} Z{2:0.000} E{3:0.000} F{4} ; Z-Hop with retraction",
            p0.X, p0.Y, p0.Z + ZHopDistance, ExtrusionDist, RetractionSpeed));
        }

        // reset extrusion distance
        gcode.Add(string.Format("G92 E0 ; Reset Extrusion Distance"));
      }
    }

    // CREATE FOOTER -----------------------------------------------------
    gcode.AddRange(new string[]
      {
      "G1 E-1 ; retract",
      "G92 E0 ; reset E value",
      "M104 S0 ; turn off extruder",
      "M140 S0 ; turn off bed",
      "G28 X0 Y0 ; home all axes",
      "M84; disable motors",
      "M82 ; absolute extrusion mode",
      "; --- END OF GCODE ---",
      });

    // set gcode to output
    GCODE = gcode;
# ---------- end generategcode ----------
panel_28 = Panel(generategcode.GCODE)
panel_29 = Panel(generategcode.out)
gcode = Data(generategcode.GCODE)

# ----
# comments & notes: SAVE GCODE TO FILE
save_gcode_to_file_2 = Data(save_gcode_to_file)
gcode_2 = Data(gcode)
sg = SaveGCODE(Save=save_gcode_to_file_2, GCODE=gcode_2)  # inputs GCODE: list
# ---------- sg: Python ----------
"""
Saves GCODE to a specified file.
    Inputs:
        Save: Set to True to save the GCODE to a file. Connect a button here,
              ideally. {item, bool}
        GCODE: The GCODE to save to a file. {list, str}
    Remarks:
        Author: Max Eschenbach, based on an example by McNeel Forum User "spb"
        License: Apache License 2.0
        Version: 230203
"""

# PYTHON STANDARD LIBRARY IMPORTS
from __future__ import division, print_function
from os.path import abspath, basename, dirname, normpath

# GHPYTHON SDK IMPORTS
from ghpythonlib.componentbase import executingcomponent as component
import Grasshopper, GhPython
import System
import Rhino
import rhinoscriptsyntax as rs

# GHENV COMPONENT SETTINGS
ghenv.Component.Name = "SaveGCODE"
ghenv.Component.NickName ="SG"
ghenv.Component.Category = "FindersKeepers"
ghenv.Component.SubCategory = "9 Utilities"

class SaveGCODE(component):
    
    def SaveFileDialog(self, title=None, filter=None, folder=None,
                       filename=None, extension=None):
        """
        Opens a SaveFileDialog with the specified settings and lets the user
        pick a file. Returns the full path of the picked file.
        
        Based on:
        https://discourse.mcneel.com/t/rhino-ui-openfiledialog-showopendialog-
        with-multiselect-true-not-working/40068
        """
        
        fd = Rhino.UI.SaveFileDialog()
        if title:
            fd.Title = title
        if filter:
            fd.Filter = filter
        if folder:
            fd.InitialDirectory = folder
        if filename:
            fd.FileName = filename
        if extension:
            fd.DefaultExt = extension
        if fd.ShowSaveDialog():
            return normpath(abspath(fd.FileName))
        
        # return None if something goes wrong while picking the file
        return None
    
    def RunScript(self, Save, GCODE):
        # on button click, execute save
        if Save and GCODE:
            if not GCODE or GCODE == [None]:
                Rhino.UI.Dialogs.ShowMessage("No GCODE to save!", "Warning")
                return
            fp = self.SaveFileDialog(
                                "Save GCODE File",
                                "GCODE Files (*.gcode)",
                                dirname(self.OnPingDocument().FilePath),
                                None,
                                ".gcode")
            # write gcode to selected file
            if fp:
                # mac os file extension fix
                if not fp.endswith(".gcode"):
                    fp = fp + ".gcode"
                # write every line to file
                with open(fp, "w") as f:
                    for l in GCODE:
                        f.write(l + "\n")
                # report success
                rml = self.RuntimeMessageLevel.Remark
                self.AddRuntimeMessage(rml,
                                       ("Successfully wrote {0} "
                                        "lines to {1}!".format(len(GCODE),
                                                               basename(fp))))
        elif not GCODE:
            rml = self.RuntimeMessageLevel.Warning
            self.AddRuntimeMessage(rml,
                                   "Parameter GCODE failed to collect data!")
# ---------- end sg ----------

# ----
# comments & notes: COMPUTE GCODE GEOMETRY FOR VISUALISATION
gcode_3 = Data(gcode)
parsegcode = CSharpScript(GCODE=gcode_3)  # -> out, G, X, Y, Z, E, F; inputs GCODE: list of String
# ---------- parsegcode: C# usings ----------
using System.Text.RegularExpressions;
# ---------- parsegcode: C# ----------
    List<string> _G = new List<string>();
    List<double> _X = new List<double>();
    List<double> _Y = new List<double>();
    List<double> _Z = new List<double>();
    List<double> _E = new List<double>();
    List<double> _F = new List<double>();

    double Ztemp = 0.0;
    double Etemp = 0.0;
    double Ftemp = 0.0;

    Regex re_colon_a = new Regex(" ;");
    Regex re_colon_b = new Regex(" |;");

    var cult = System.Globalization.CultureInfo.InvariantCulture;

    for (int i = 0; i < GCODE.Count; i++)
    {
      string ln = GCODE[i];

      if (ln.StartsWith(";"))
      {
        continue;
      }
      else if (ln.StartsWith("G0") || ln.StartsWith("G1"))
      {
        if (ln.Contains("X") && ln.Contains("Y"))
        {
          _G.Add(ln.Substring(1, 1));
        }
        else
        {
          continue;
        }

        string[] preparts = re_colon_a.Split(ln);
        string[] parts = re_colon_b.Split(preparts[0]);

        // loop over all string parts
        for (int j = 0; j < parts.Length; j++)
        {
          string part = parts[j];

          // catch X values
          if (part.StartsWith("X")) _X.Add(double.Parse(part.Substring(1), cult));

          // catch Y values
          if (part.StartsWith("Y")) _Y.Add(double.Parse(part.Substring(1), cult));

          // catch Z values
          if (part.StartsWith("Z"))
          {
            double Zval = double.Parse(part.Substring(1), cult);
            _Z.Add(Zval);
            Ztemp = Zval;
          }

          // catch E values
          if (part.StartsWith("E"))
          {
            double Eval = double.Parse(part.Substring(1), cult);
            _E.Add(Eval);
            Etemp = Eval;
          }

          // catch F values
          if (part.StartsWith("F"))
          {
            double Fval = double.Parse(part.Substring(1), cult);
            _F.Add(Fval);
            Ftemp = Fval;
          }
        }
        // catch missing Z values
        if (ln.Contains("X") && ln.Contains("Y") && !ln.Contains("Z")) _Z.Add(Ztemp);

        // catch missing E values
        if (!ln.Contains("E")) _E.Add(Etemp);

        // catch missing F values
        if (!ln.Contains("F")) _F.Add(Ftemp);
      }
      else
      {
        Print(ln);
      }
    }

    G = _G;
    X = _X;
    Y = _Y;
    Z = _Z;
    E = _E;
    F = _F;
# ---------- end parsegcode ----------
pt_10 = ConstructPoint(XCoordinate=parsegcode.X, YCoordinate=parsegcode.Y, ZCoordinate=parsegcode.Z)
retractioncolor = ColourSwatch(SwatchColor=RGB(68, 194, 0))
extrusioncolor = ColourSwatch(SwatchColor=RGB(255, 94, 0))
vis_printing_progress_2 = Data(vis_printing_progress)
travelcolor = ColourSwatch(SwatchColor=RGB(0, 85, 255))
classifymovements = CSharpScript(
    ProgressPercentage=vis_printing_progress_2,
    Points=pt_10,
    E=parsegcode.E,
    ExtrusionColor=extrusioncolor,
    TravelColor=travelcolor,
    RetractionColor=retractioncolor)  # -> out, MoveLines, MoveLinesProg, Colors, ColorsProg, PrintLines, PrintPolyLines; inputs ProgressPercentage: Double, Points: list of Point3d, E: list of Double, ExtrusionColor: Color, TravelColor: Color, RetractionColor: Color
# ---------- classifymovements: C# ----------
    List<LineCurve> _MoveLines = new List<LineCurve>();
    List<LineCurve> _MoveLinesProg = new List<LineCurve>();
    List<LineCurve> _PrintLines = new List<LineCurve>();
    List<System.Drawing.Color> _Colors = new List<System.Drawing.Color>();
    List<System.Drawing.Color> _ColorsProg = new List<System.Drawing.Color>();
    List<Polyline> _PrintPolyLines = new List<Polyline>();

    Polyline pl_temp = new Polyline();

    int SplitIndex = (int) Math.Round((ProgressPercentage / 100.0) * Points.Count, 0);

    for (int i = 0; i < Points.Count - 1; i++)
    {
      // construct line curve
      LineCurve ln = new LineCurve(Points[i], Points[i + 1]);
      _MoveLines.Add(ln);

      if (i < SplitIndex) { _MoveLinesProg.Add(ln); }

      // set flags
      bool travel = E[i + 1] == 0 || E[i] == E[i + 1];
      bool retract = E[i + 1] < E[i];
      bool approach = E[i] == 0 && E[i + 1] > 0;

      // evaluate flags
      if (travel || approach)
      {
        _Colors.Add(TravelColor);
        if (i < SplitIndex) { _ColorsProg.Add(TravelColor); }

        // finish print polyline if it has at least two vertices
        if (pl_temp.Count > 1 && i <= SplitIndex)
        {
          _PrintPolyLines.Add(pl_temp.Duplicate());
          pl_temp = new Polyline();
        }
      }
      else if (retract)
      {
        _Colors.Add(RetractionColor);
        if (i < SplitIndex) { _ColorsProg.Add(RetractionColor); }

        // finish print polyline if it has at least two vertices
        if (pl_temp.Count > 1 && i <= SplitIndex)
        {
          _PrintPolyLines.Add(pl_temp.Duplicate());
          pl_temp = new Polyline();
        }
      }
      else
      {
        _Colors.Add(ExtrusionColor);
        if (i < SplitIndex) { _ColorsProg.Add(ExtrusionColor); }

        _PrintLines.Add(ln);

        // add points to print polyline
        if (i < SplitIndex)
        {
          if (pl_temp.Count == 0)
          {
            // add A point if this is the start of the PPL
            pl_temp.Add(Points[i]);
          }
          // always add B point
          pl_temp.Add(Points[i + 1]);
        }
      }

      // catch unfinished PPL and finalize it
      if (pl_temp.Count > 0 && i == Points.Count - 2)
      {
        _PrintPolyLines.Add(pl_temp.Duplicate());
        pl_temp = new Polyline();
      }

      MoveLines = _MoveLines;
      MoveLinesProg = _MoveLinesProg;
      Colors = _Colors;
      ColorsProg = _ColorsProg;
      PrintLines = _PrintLines;
      PrintPolyLines = _PrintPolyLines;
    }
# ---------- end classifymovements ----------
item_28 = ListItem(List=classifymovements.MoveLinesProg, Index=0, Wrap=True)  # -> Item1, Item
end_3 = EndPoints(Curve=item_28.Item1)  # -> Start, End
movelines_prog = Data(classifymovements.MoveLinesProg)
printpolylines = Data(classifymovements.PrintPolyLines)
colors_prog = Data(classifymovements.ColorsProg)
gcode_last_pt = Data(end_3.End)
movelines = Data(classifymovements.MoveLines)
printlines = Data(classifymovements.PrintLines)
colors = Data(classifymovements.Colors)

# ----
# comments & notes: COMPUTE GCODE OFFSET VECTOR FOR VISUALISATION
overhang_angle_analysis_3 = Boolean(filter_83)
render_print_layers_3 = Data(render_print_layers)
vis_offset_vector_7 = Vector(vis_offset_vector)
filter_127 = StreamFilter(Gate=overhang_angle_analysis_3, Stream0="4.5", Stream1="5.5")
subtraction_16 = Subtraction(A=filter_127, B="1")
filter_128 = StreamFilter(Gate=render_print_layers_3, Stream0=subtraction_16, Stream1=filter_127)
multiplication_24 = Multiplication(A=vis_offset_vector_7, B=filter_128)
gcode_offset_vector = Data(multiplication_24)

# ----
# GCODE VERIFICATION
# AND ANALYSIS
# comments & notes: GCODE VERIFICATION AND ANALYSIS
panel_30 = Panel(""";FLAVOR:Marlin
;TIME:949
;Filament used: 37.628m
;Layer height: 1.9
;MINX:-63.357
;MINY:-66.77
;MINZ:1.9
;MAXX:57.392
;MAXY:53.98
;MAXZ:53.2
;Generated with Cura_SteamEngine 5.0.0
M105
M109 S0
M82 ;absolute extrusion mode
G90 ; absolute programming
M106 S0 ; set fan speed to 0 (deactivate)
M104 S0 T0 ; set hotend temperature to 0 (deactivate)
G28 ; home all axes
T0 ; set extruder to extruder 0 (first and only one)
G92 E0
G92 E0
G1 F4800 E-0.01
;LAYER_COUNT:29
;LAYER:0
M107
G0 F3000 X45.961 Y53.98 Z1.9
;TYPE:SKIRT
G1 F4800 E0
G1 F3000 X-53.191 Y52.722 E103.65331
G1 X-53.895 Y52.701 E104.38954
G1 X-54.775 Y52.634 E105.31208
G1 X-55.646 Y52.489 E106.23508
G1 X-56.5 Y52.265 E107.15797
G1 X-57.33 Y51.965 E108.08052
G1 X-58.13 Y51.591 E109.00364
G1 X-58.893 Y51.146 E109.92695
G1 X-59.612 Y50.634 E110.84962
G1 X-60.282 Y50.059 E111.77253
G1 X-60.898 Y49.425 E112.69656
G1 X-61.453 Y48.739 E113.61894
G1 X-61.944 Y48.005 E114.54204
G1 X-62.367 Y47.23 E115.46498
G1 X-62.718 Y46.42 E116.38776
G1 X-62.994 Y45.581 E117.31101
G1 X-63.193 Y44.721 E118.23374
G1 X-63.313 Y43.846 E119.15695
G1 X-63.354 Y43.051 E119.98908
G1 X-63.357 Y42.426 E120.6424
G1 X-62.101 Y-56.542 E224.10337
G1 X-62.086 Y-57.229 E224.82167
G1 X-62.026 Y-58.11 E225.74472
G1 X-61.888 Y-58.982 E226.66758
G1 X-61.671 Y-59.838 E227.59067
G1 X-61.377 Y-60.67 E228.51308
G1 X-61.01 Y-61.473 E229.43597
G1 X-60.571 Y-62.239 E230.35886
G1 X-60.065 Y-62.963 E231.28218
G1 X-59.495 Y-63.637 E232.20489
G1 X-58.867 Y-64.258 E233.1281
G1 X-58.185 Y-64.819 E234.05121
G1 X-57.455 Y-65.315 E234.97376
G1 X-56.683 Y-65.744 E235.89697
G1 X-55.876 Y-66.102 E236.81982
G1 X-55.039 Y-66.384 E237.74307
G1 X-54.18 Y-66.59 E238.66646
G1 X-53.307 Y-66.718 E239.58877
G1 X-52.433 Y-66.766 E240.50375
G1 X-52.022 Y-66.77 E240.9334
G1 X47.184 Y-65.512 E344.64315
G1 X47.888 Y-65.494 E345.37929
G1 X48.769 Y-65.431 E346.30257
G1 X49.64 Y-65.289 E347.22505
G1 X50.495 Y-65.069 E348.14791
G1 X51.327 Y-64.773 E349.07101
G1 X52.128 Y-64.402 E349.99376
G1 X52.893 Y-63.96 E350.9173
G1 X53.615 Y-63.451 E351.84072
G1 X54.287 Y-62.879 E352.76318
G1 X54.905 Y-62.248 E353.68643
G1 X55.463 Y-61.564 E354.60916
G1 X55.958 Y-60.833 E355.532
G1 X56.383 Y-60.059 E356.45502
G1 X56.738 Y-59.251 E357.37756
G1 X57.017 Y-58.413 E358.3008
G1 X57.22 Y-57.554 E359.22346
G1 X57.344 Y-56.68 E360.14621
G1 X57.388 Y-55.856 E361.00878
G1 X57.392 Y-55.266 E361.62553
G1 X56.136 Y43.71 E465.09485
G1 X56.121 Y44.43 E465.84764
G1 X56.063 Y45.311 E466.77056
G1 X55.925 Y46.183 E467.69341
G1 X55.709 Y47.039 E468.61625
G1 X55.416 Y47.872 E469.53929
G1 X55.049 Y48.675 E470.46219
G1 X54.611 Y49.442 E471.38547
G1 X54.105 Y50.166 E472.30879
G1 X53.536 Y50.841 E473.23162
G1 X52.909 Y51.462 E474.15409
G1 X52.227 Y52.024 E475.07786
G1 X51.498 Y52.521 E476.00014
G1 X50.727 Y52.951 E476.92294
G1 X49.92 Y53.309 E477.84579
G1 X49.083 Y53.593 E478.76971
G1 X48.225 Y53.799 E479.69208
G1 X47.351 Y53.928 E480.61558
G1 X46.508 Y53.976 E481.49821
G1 X45.961 Y53.98 E482.07001
G1 F4800 E482.06001
;MESH:PRINTSUGI_CONN_01.stl
G0 F3000 X44.651 Y42.463
;TYPE:WALL-OUTER
G1 F4800 E482.07001
G1 F3000 X45.875 Y-54.028 E582.94151
G1 X-50.616 Y-55.252 E683.81302
G1 X-51.84 Y41.239 E784.68452
G1 X44.651 Y42.463 E885.55602
G0 X44.676 Y40.464
G0 X41.368 Y39.095
;TYPE:SKIN
G1 X41.938 Y-5.826 E932.51635
G1 X42.507 Y-50.745 E979.47457
G1 X-47.333 Y-51.884 E1073.39313
G1 X-48.472 Y37.956 E1167.31168
G1 X41.368 Y39.095 E1261.23023
G1 F4800 E1261.22023
G0 F3000 X40.727 Y-48.368
G1 F4800 E1261.23023
G1 F3000 X40.071 Y-49.024 E1262.19999
G0 X35.057 Y-49.088
G1 X40.665 Y-43.48 E1270.49028
G0 X40.602 Y-38.593
G1 X30.044 Y-49.151 E1286.09814
G0 X25.03 Y-49.215
G1 X40.541 Y-33.704 E1309.02801
G0 X40.479 Y-28.817
G1 X20.017 Y-49.278 E1339.27619
G0 X15.004 Y-49.342
G1 X40.416 Y-23.929 E1376.84342
G0 X40.355 Y-19.041
G1 X9.99 Y-49.406 E1421.73191
G0 X4.977 Y-49.469
G1 X40.293 Y-14.154 E1473.93871
G0 X40.23 Y-9.266
G1 X-0.035 Y-49.532 E1533.46309
G0 X-5.048 Y-49.596
G1 X40.169 Y-4.378 E1600.30799
G0 X40.107 Y0.509
G1 X-10.062 Y-49.66 E1674.47268
G0 X-15.075 Y-49.723
G1 X40.044 Y5.396 E1755.95494
G0 X39.983 Y10.284
G1 X-20.088 Y-49.787 E1844.75773
G0 X-25.102 Y-49.851
G1 X39.921 Y15.172 E1940.88105
G0 X39.858 Y20.059
G1 X-30.115 Y-49.914 E2044.32193
G0 X-35.129 Y-49.978
G1 X39.797 Y24.948 E2155.08483
G0 X39.735 Y29.835
G1 X-40.142 Y-50.041 E2273.16603
G0 X-45.155 Y-50.104
G1 X39.672 Y34.723 E2398.56554
G0 X37.292 Y37.292
G1 X-45.662 Y-45.662 E2521.1962
G0 X-45.724 Y-40.774
G1 X32.279 Y37.229 E2636.50782
G0 X27.266 Y37.166
G1 X-45.785 Y-35.886 E2744.49964
G0 X-45.848 Y-30.998
G1 X22.253 Y37.102 E2845.17242
G0 X17.239 Y37.038
G1 X-45.909 Y-26.11 E2938.52393
G0 X-45.971 Y-21.223
G1 X12.226 Y36.975 E3024.55713
G0 X7.213 Y36.911
G1 X-46.033 Y-16.334 E3103.2698
G0 X-46.095 Y-11.447
G1 X2.199 Y36.848 E3174.66342
G0 X-2.813 Y36.784
G1 X-46.157 Y-6.559 E3238.73799
G0 X-46.219 Y-1.671
G1 X-7.826 Y36.72 E3295.49278
G0 X-12.84 Y36.657
G1 X-46.28 Y3.216 E3344.92778
G0 X-46.343 Y8.104
G1 X-17.853 Y36.593 E3387.04372
G0 X-22.867 Y36.529
G1 X-46.404 Y12.992 E3421.8384
G0 X-46.466 Y17.879
G1 X-27.88 Y36.466 E3449.31477
G0 X-32.893 Y36.402
G1 X-46.528 Y22.768 E3469.47062
G0 X-46.59 Y27.655
G1 X-37.907 Y36.338 E3482.30667
G0 X-42.92 Y36.275
G1 X-46.652 Y32.543 E3487.82367
G1 F4800 E3487.81367
;MESH:NONMESH
G0 F600 X-46.652 Y32.543 Z3.8
G0 F3000 X45.263 Y-5.783
;TIME_ELAPSED:78.082594
;LAYER:1
;TYPE:WALL-OUTER
;MESH:PRINTSUGI_CONN_01.stl
G1 F4800 E3487.82367
G1 F3000 X45.875 Y-54.028 E3538.2589
G1 X-50.616 Y-55.252 E3639.13041
G1 X-51.84 Y41.239 E3740.00191
G1 X44.651 Y42.463 E3840.87341
G1 X45.263 Y-5.783 E3891.30969
G0 X45.288 Y-7.782
G1 F4800 E3891.29969
G0 F3000 X42.507 Y-50.745
;TYPE:SKIN
G1 F4800 E3891.30969
G1 F3300 X-2.414 Y-51.315 E3938.27001
G92 E0
G1 X-47.333 Y-51.884 E46.95822
G1 X-48.472 Y37.956 E140.87678
G1 X41.368 Y39.095 E234.79533
G1 X42.507 Y-50.745 E328.71388
G1 F4800 E328.70388
G0 F3000 X-43.954 Y-50.09
G1 F4800 E328.71388
G1 F3300 X-45.626 Y-48.418 E331.18559
G0 F3000 X-45.69 Y-43.405
G1 F3300 X-39.066 Y-50.028 E340.97709
G0 F3000 X-34.178 Y-49.966
G1 F3300 X-45.753 Y-38.392 E358.08765
G0 F3000 X-45.816 Y-33.378
G1 F3300 X-29.291 Y-49.904 E382.51724
G0 F3000 X-24.403 Y-49.842
G1 F3300 X-45.88 Y-28.365 E414.26663
G0 F3000 X-45.944 Y-23.352
G1 F3300 X-19.515 Y-49.781 E453.33655
G0 F3000 X-14.627 Y-49.718
G1 F3300 X-46.007 Y-18.339 E499.72477
G0 F3000 X-46.07 Y-13.326
G1 F3300 X-9.74 Y-49.656 E553.43131
G0 F3000 X-4.852 Y-49.595
G1 F3300 X-46.134 Y-8.312 E614.45911
G0 F3000 X-46.198 Y-3.299
G1 F3300 X0.035 Y-49.532 E682.80523
G0 F3000 X4.923 Y-49.471
G1 F3300 X-46.261 Y1.713 E758.47039
G0 F3000 X-46.324 Y6.726
G1 F3300 X9.811 Y-49.409 E841.4546
G0 F3000 X14.698 Y-49.346
G1 F3300 X-46.388 Y11.74 E931.75786
G0 F3000 X-46.451 Y16.753
G1 F3300 X19.586 Y-49.285 E1029.38091
G0 F3000 X24.474 Y-49.223
G1 F3300 X-46.515 Y21.766 E1134.32374
G0 F3000 X-46.578 Y26.779
G1 F3300 X29.361 Y-49.16 E1246.58415
G0 F3000 X34.25 Y-49.099
G1 F3300 X-46.642 Y31.792 E1366.16583
G0 F3000 X-46.135 Y36.235
G1 F3300 X39.137 Y-49.037 E1492.22318
G0 F3000 X40.691 Y-45.641
G1 F3300 X-41.246 Y36.297 E1613.35116
G0 F3000 X-36.359 Y36.359
G1 F3300 X40.628 Y-40.628 E1727.16082
G0 F3000 X40.564 Y-35.614
G1 F3300 X-31.471 Y36.421 E1833.64996
G0 F3000 X-26.583 Y36.483
G1 F3300 X40.5 Y-30.601 E1932.8193
G0 F3000 X40.437 Y-25.588
G1 F3300 X-21.696 Y36.545 E2024.67034
G0 F3000 X-16.808 Y36.607
G1 F3300 X40.373 Y-20.574 E2109.20085
G0 F3000 X40.31 Y-15.561
G1 F3300 X-11.92 Y36.669 E2186.41231
G0 F3000 X-7.032 Y36.731
G1 F3300 X40.246 Y-10.547 E2256.30325
G0 F3000 X40.182 Y-5.534
G1 F3300 X-2.145 Y36.793 E2318.87513
G0 F3000 X2.742 Y36.855
G1 F3300 X40.119 Y-.521 E2374.1287
G0 F3000 X40.056 Y4.491
G1 F3300 X7.63 Y36.917 E2422.06397
G0 F3000 X12.517 Y36.979
G1 F3300 X39.992 Y9.504 E2462.68018
G0 F3000 X39.928 Y14.518
G1 F3300 X17.405 Y37.041 E2495.97587
G0 F3000 X22.293 Y37.103
G1 F3300 X39.865 Y19.531 E2521.95251
G0 F3000 X39.801 Y24.545
G1 F3300 X27.181 Y37.165 E2540.60862
G0 F3000 X32.068 Y37.227
G1 F3300 X39.737 Y29.558 E2551.94568
G0 F3000 X39.674 Y34.571
G1 F3300 X36.956 Y37.289 E2555.96369
G1 F4800 E2555.95369
;MESH:NONMESH
G0 F600 X36.956 Y37.289 Z5.7
G0 F3000 X-5.51 Y40.601
;TIME_ELAPSED:139.048552
;LAYER:2
;TYPE:FILL
;MESH:PRINTSUGI_CONN_01.stl
G1 F4800 E2555.96369
G1 F3000 X-50.041 Y-3.93 E2621.79374
G0 X-50.096 Y0.43
G1 X-35.555 Y-53.835 E2680.51891
G0 X-28.983 Y-53.752
G1 X-49.477 Y-48.26 E2702.69745
G0 X-49.421 Y-52.807
G1 X43.455 Y40.069 E2839.99578
G0 X43.512 Y35.526
G1 X23.213 Y40.965 E2861.9631
G0 X19.556 Y40.919
G1 X-49.732 Y-28.369 E2964.39136
G1 X-49.709 Y-30.081
G1 X35.572 Y-52.932 E3056.68149
G1 X36.667 Y-52.918
G1 X11.55 Y40.818 E3158.12166
G1 F4800 E3158.11166
G0 F3000 X-6.504 Y40.589
G1 F4800 E3158.12166
G1 F3000 X18.612 Y-53.148 E3259.56258
G0 X24.559 Y-53.071
G1 X44.386 Y-33.245 E3288.87203
G0 X44.435 Y-37.19
G1 X-49.94 Y-11.902 E3391.00367
G1 F4800 E3390.99367
G0 F3000 X-50.17 Y6.277
G1 F4800 E3391.00367
G1 F3000 X44.204 Y-19.01 E3493.13402
G0 X44.13 Y-13.156
G1 X29.606 Y41.047 E3551.79198
G1 F4800 E3551.78198
G0 F3000 X43.743 Y17.347
G1 F4800 E3551.79198
G1 F3000 X-41.341 Y40.145 E3643.86887
G1 X-42.616 Y40.13
G1 X-17.499 Y-53.606 E3745.30904
G1 F4800 E3745.29904
G0 F3000 X-25.573 Y-53.708
G1 F4800 E3745.30904
G1 F3000 X43.765 Y15.631 E3847.81195
G1 F4800 E3847.80195
G0 F3000 X43.974 Y-.831
G1 F4800 E3847.81195
G1 F3000 X-50.401 Y24.456 E3949.94331
G0 X-50.351 Y20.508
G92 E0
G1 X-30.577 Y40.283 E29.23259
G0 X-24.56 Y40.36
G1 X0.556 Y-53.377 E130.6735
G1 X-.506 Y-53.39
G1 X44.076 Y-8.807 E196.57968
G0 X45.263 Y-5.783
;TYPE:WALL-OUTER
G1 X45.875 Y-54.028 E247.01491
G1 X-50.616 Y-55.252 E347.88641
G1 X-51.84 Y41.239 E448.75792
G1 X44.651 Y42.463 E549.62942
G1 X45.263 Y-5.783 E600.06569
G0 X45.288 Y-7.782
G1 F4800 E600.05569
;MESH:NONMESH
G0 F600 X45.288 Y-7.782 Z7.6
G0 F3000 X-5.51 Y40.601
;TIME_ELAPSED:182.317632
;LAYER:3
;TYPE:FILL
;MESH:PRINTSUGI_CONN_01.stl
G1 F4800 E600.06569
G1 F3000 X-50.041 Y-3.93 E665.89574
G0 X-50.096 Y0.43
G1 X-35.555 Y-53.835 E724.62091
G0 X-28.983 Y-53.752
G1 X-49.477 Y-48.26 E746.79946
G0 X-49.421 Y-52.807
G1 X43.455 Y40.069 E884.09779
G0 X43.512 Y35.526
G1 X23.213 Y40.965 E906.06511
G0 X19.556 Y40.919
G1 X-49.732 Y-28.369 E1008.49336
G1 X-49.709 Y-30.081
G1 X35.572 Y-52.932 E1100.7835
G1 X36.667 Y-52.918
G1 X11.55 Y40.818 E1202.22367
G1 F4800 E1202.21367
G0 F3000 X-6.504 Y40.589
G1 F4800 E1202.22367
G1 F3000 X18.612 Y-53.148 E1303.66458
G0 X24.559 Y-53.071
G1 X44.386 Y-33.245 E1332.97404
G0 X44.435 Y-37.19
G1 X-49.94 Y-11.902 E1435.10567
G1 F4800 E1435.09567
G0 F3000 X-50.17 Y6.277
G1 F4800 E1435.10567
G1 F3000 X44.204 Y-19.01 E1537.23602
G0 X44.13 Y-13.156
G1 X29.606 Y41.047 E1595.89399
G1 F4800 E1595.88399
G0 F3000 X43.743 Y17.347
G1 F4800 E1595.89399
G1 F3000 X-41.341 Y40.145 E1687.97087
G1 X-42.616 Y40.13
G1 X-17.499 Y-53.606 E1789.41105
G1 F4800 E1789.40105
G0 F3000 X-25.573 Y-53.708
G1 F4800 E1789.41105
G1 F3000 X43.765 Y15.631 E1891.91395
G1 F4800 E1891.90395
G0 F3000 X43.974 Y-.831
G1 F4800 E1891.91395
G1 F3000 X-50.401 Y24.456 E1994.04531
G0 X-50.351 Y20.508
G1 X-30.577 Y40.283 E2023.2779
G0 X-24.56 Y40.36
G1 X0.556 Y-53.377 E2124.71881
G1 X-.506 Y-53.39
G1 X44.076 Y-8.807 E2190.625
G0 X45.263 Y-5.783
;TYPE:WALL-OUTER
G1 X45.875 Y-54.028 E2241.06023
G1 X-50.616 Y-55.252 E2341.93173
G1 X-51.84 Y41.239 E2442.80323
G1 X44.651 Y42.463 E2543.67473
G1 X45.263 Y-5.783 E2594.11101
G0 X45.288 Y-7.782
G1 F4800 E2594.10101
;MESH:NONMESH
G0 F600 X45.288 Y-7.782 Z9.5
G0 F3000 X-5.51 Y40.601
;TIME_ELAPSED:225.589684
;LAYER:4
;TYPE:FILL
;MESH:PRINTSUGI_CONN_01.stl
G1 F4800 E2594.11101
G1 F3000 X-50.04 Y-3.928 E2659.93884
G0 X-50.095 Y0.427
G1 X-35.555 Y-53.835 E2718.66071
G0 X-28.983 Y-53.752
G1 X-49.477 Y-48.26 E2740.83926
G0 X-49.421 Y-52.807
G1 X43.455 Y40.069 E2878.13758
G0 X43.512 Y35.526
G1 X23.213 Y40.965 E2900.1049
G0 X19.556 Y40.919
G1 X-49.73 Y-28.367 E3002.5302
G1 X-49.708 Y-30.081
G1 X35.572 Y-52.932 E3094.81933
G1 X36.667 Y-52.918
G1 X11.55 Y40.818 E3196.2595
G1 F4800 E3196.2495
G0 F3000 X-6.504 Y40.589
G1 F4800 E3196.2595
G1 F3000 X18.612 Y-53.148 E3297.70041
G0 X24.559 Y-53.071
G1 X44.386 Y-33.245 E3327.00987
G0 X44.435 Y-37.19
G1 X-49.939 Y-11.902 E3429.14049
G1 F4800 E3429.13049
G0 F3000 X-50.169 Y6.276
G1 F4800 E3429.14049
G1 F3000 X44.204 Y-19.01 E3531.26956
G0 X44.13 Y-13.156
G1 X29.606 Y41.047 E3589.92753
G1 F4800 E3589.91753
G0 F3000 X43.743 Y17.347
G1 F4800 E3589.92753
G1 F3000 X-41.341 Y40.145 E3682.00441
G1 X-42.616 Y40.13
G1 X-17.499 Y-53.606 E3783.44459
G1 F4800 E3783.43459
G0 F3000 X-25.573 Y-53.708
G1 F4800 E3783.44459
G1 F3000 X43.765 Y15.631 E3885.9475
G1 F4800 E3885.9375
G0 F3000 X43.974 Y-.831
G1 F4800 E3885.9475
G1 F3000 X-50.401 Y24.456 E3988.07886
G0 X-50.351 Y20.508
G92 E0
G1 X-30.577 Y40.283 E29.23259
G0 X-24.56 Y40.36
G1 X0.556 Y-53.377 E130.6735
G1 X-.506 Y-53.39
G1 X44.076 Y-8.807 E196.57968
G0 X45.263 Y-5.783
;TYPE:WALL-OUTER
G1 X45.875 Y-54.028 E247.01491
G1 X-50.617 Y-55.252 E347.88746
G1 X-51.257 Y-4.737 E400.69573
G1 X-51.263 Y-3.637 E401.84559
G1 X-51.28 Y-2.834 E402.68517
G1 X-51.84 Y41.239 E448.75901
G1 X44.651 Y42.463 E549.63051
G1 X45.263 Y-5.783 E600.06679
G0 X45.288 Y-7.782
G1 F4800 E600.05679
;MESH:NONMESH
G0 F600 X45.288 Y-7.782 Z11.4
G0 F3000 X-5.51 Y40.601
;TIME_ELAPSED:268.858480
;LAYER:5
;TYPE:FILL
;MESH:PRINTSUGI_CONN_01.stl
G1 F4800 E600.06679
G1 F3000 X-50.036 Y-3.924 E665.88871
G0 X-50.094 Y0.423
G1 X-35.555 Y-53.835 E724.60626
G0 X-28.981 Y-53.752
G1 X-49.478 Y-48.26 E746.78784
G0 X-49.422 Y-52.808
G1 X43.455 Y40.069 E884.08765
G0 X43.512 Y35.526
G1 X23.213 Y40.965 E906.05497
G0 X19.556 Y40.919
G1 X-49.731 Y-28.368 E1008.48174
G1 X-49.709 Y-30.081
G1 X35.572 Y-52.932 E1100.77188
G1 X36.667 Y-52.918
G1 X11.55 Y40.818 E1202.21205
G1 F4800 E1202.20205
G0 F3000 X-6.504 Y40.589
G1 F4800 E1202.21205
G1 F3000 X18.612 Y-53.148 E1303.65296
G0 X24.559 Y-53.071
G1 X44.386 Y-33.245 E1332.96242
G0 X44.435 Y-37.19
G1 X-49.939 Y-11.902 E1435.09304
G1 F4800 E1435.08304
G0 F3000 X-50.168 Y6.276
G1 F4800 E1435.09304
G1 F3000 X44.204 Y-19.01 E1537.2211
G0 X44.13 Y-13.156
G1 X29.606 Y41.047 E1595.87907
G1 F4800 E1595.86907
G0 F3000 X43.743 Y17.347
G1 F4800 E1595.87907
G1 F3000 X-41.341 Y40.145 E1687.95596
G1 X-42.616 Y40.13
G1 X-17.499 Y-53.606 E1789.39613
G1 F4800 E1789.38613
G0 F3000 X-25.573 Y-53.708
G1 F4800 E1789.39613
G1 F3000 X43.765 Y15.631 E1891.89904
G1 F4800 E1891.88904
G0 F3000 X43.974 Y-.831
G1 F4800 E1891.89904
G1 F3000 X-50.4 Y24.455 E1994.02912
G0 X-50.35 Y20.509
G1 X-30.577 Y40.283 E2023.26023
G0 X-24.56 Y40.36
G1 X0.556 Y-53.377 E2124.70114
G1 X-.506 Y-53.39
G1 X44.076 Y-8.807 E2190.60732
G0 X45.263 Y-5.783
;TYPE:WALL-OUTER
G1 X45.875 Y-54.028 E2241.04255
G1 X-50.617 Y-55.252 E2341.9151
G1 X-51.263 Y-4.111 E2395.37776
G1 X-51.273 Y-2.845 E2396.70117
G1 X-51.289 Y-2.094 E2397.48638
G1 X-51.84 Y41.239 E2442.78663
G1 X44.651 Y42.463 E2543.65813
G1 X45.263 Y-5.783 E2594.09441
G0 X45.288 Y-7.782
G1 F4800 E2594.08441
;MESH:NONMESH
G0 F600 X45.288 Y-7.782 Z13.3
G0 F3000 X-27.355 Y-5.992
;TIME_ELAPSED:312.180207
;LAYER:6
;TYPE:FILL
;MESH:PRINTSUGI_CONN_01.stl
G1 F4800 E2594.09441
G1 F3000 X19.556 Y40.919 E2663.44281
G0 X23.213 Y40.965
G1 X43.512 Y35.526 E2685.41013
G0 X43.455 Y40.069
G1 X-49.422 Y-52.808 E2822.70993
G0 X-49.479 Y-48.26
G1 X-28.981 Y-53.752 E2844.89252
G0 X-25.573 Y-53.708
G1 X43.765 Y15.631 E2947.39543
G1 X43.743 Y17.347
G1 X-41.341 Y40.145 E3039.47231
G1 X-42.616 Y40.13
G1 X-30.554 Y-4.885 E3088.18711
G1 F4800 E3088.17711
G0 F3000 X-30.483 Y-17.115
G1 F4800 E3088.18711
G1 F3000 X-28.89 Y-17.542 E3089.91108
G0 X-26.827 Y-18.793
G1 X-17.499 Y-53.606 E3127.58528
G1 F4800 E3127.57528
G0 F3000 X-.506 Y-53.39
G1 F4800 E3127.58528
G1 F3000 X44.076 Y-8.807 E3193.49146
G0 X44.13 Y-13.156
G1 X29.606 Y41.047 E3252.14943
G1 F4800 E3252.13943
G0 F3000 X11.55 Y40.818
G1 F4800 E3252.14943
G1 F3000 X36.667 Y-52.918 E3353.5896
G1 X35.572 Y-52.932
G1 X-49.709 Y-30.081 E3445.87973
G1 X-49.732 Y-28.369
G1 X-40.539 Y-19.176 E3459.46972
G1 F4800 E3459.45972
G0 F3000 X-46.403 Y-13.35
G1 F4800 E3459.46972
G1 F3000 X-35.555 Y-53.835 E3503.28215
G1 F4800 E3503.27215
G0 F3000 X0.556 Y-53.377
G1 F4800 E3503.28215
G1 F3000 X-24.56 Y40.36 E3604.72306
G0 X-30.577 Y40.283
G1 X-50.351 Y20.508 E3633.95565
G0 X-50.401 Y24.456
G1 X43.974 Y-.831 E3736.08701
G1 F4800 E3736.07701
G0 F3000 X44.204 Y-19.01
G1 F4800 E3736.08701
G1 F3000 X-50.169 Y6.276 E3838.21608
G1 F4800 E3838.20608
G0 F3000 X-45.271 Y0.84
G1 F4800 E3838.21608
G1 F3000 X-5.51 Y40.601 E3896.99465
G1 X-6.504 Y40.589
G1 X18.612 Y-53.148 E3998.43556
G0 X24.559 Y-53.071
G92 E0
G1 X44.386 Y-33.245 E29.30946
G0 X44.435 Y-37.19
G1 X-23.606 Y-18.958 E102.94278
G1 F4800 E102.93278
G0 F3000 X-51.27 Y-3.594
;TYPE:WALL-OUTER
G1 F4800 E102.94278
G1 F3000 X-51.281 Y-2.088 E104.51707
G1 X-51.301 Y-1.242 E105.40165
G1 X-51.84 Y41.239 E149.81121
G1 X44.651 Y42.463 E250.68271
G1 X45.875 Y-54.028 E351.55421
G1 X-50.617 Y-55.252 E452.42676
G1 X-51.27 Y-3.594 E506.4299
G0 X-51.281 Y-2.088
G0 X-51.292 Y-1.594
G1 F4800 E506.4199
G0 F3000 X-24.911 Y-18.317
;TYPE:SKIN
G1 F4800 E506.4299
G1 F3600 X-25.514 Y-18.185 E507.07515
G1 X-26.013 Y-18.059 E507.61313
G1 X-26.444 Y-17.761 E508.16087
G1 X-26.831 Y-17.495 E508.65175
G1 X-27.441 Y-17.172 E509.37326
G1 X-28.062 Y-16.894 E510.08448
G1 X-28.362 Y-16.484 E510.61554
G1 X-28.669 Y-16.206 E511.04847
G1 X-29.12 Y-15.977 E511.5772
G1 X-29.562 Y-15.858 E512.05568
G1 X-30.039 Y-15.855 E512.5543
G1 X-30.513 Y-15.987 E513.06864
G1 X-31.473 Y-16.406 E514.16356
G1 X-32.015 Y-16.547 E514.74897
G1 X-33.06 Y-16.751 E515.86195
G1 X-33.488 Y-16.899 E516.33533
G1 X-33.868 Y-17.155 E516.81428
G1 X-34.114 Y-17.424 E517.19533
G1 X-34.343 Y-17.843 E517.69446
G1 X-34.42 Y-18.106 E517.98092
G1 X-34.449 Y-18.624 E518.52324
G1 X-34.453 Y-18.892 E518.80341
G1 X-35.373 Y-19.615 E520.02653
G1 X-36.296 Y-20.317 E521.23871
G1 X-36.536 Y-20.423 E521.51296
G1 X-37.244 Y-20.526 E522.26083
G1 X-37.768 Y-20.513 E522.80875
G1 X-38.88 Y-20.372 E523.98044
G1 X-39.125 Y-20.269 E524.25826
G1 X-39.465 Y-19.119 E525.51181
G1 X-39.571 Y-18.655 E526.00933
G1 X-39.527 Y-18.14 E526.54962
G1 X-39.475 Y-17.55 E527.16875
G1 X-39.547 Y-17.029 E527.71853
G1 X-39.714 Y-16.642 E528.15913
G1 X-39.978 Y-16.298 E528.6124
G1 X-40.3 Y-16.041 E529.04306
G1 X-40.732 Y-15.847 E529.53808
G1 X-41.151 Y-15.778 E529.98197
G1 X-41.676 Y-15.835 E530.53398
G1 X-41.937 Y-15.873 E530.80968
G1 X-42.853 Y-15.103 E532.06055
G1 X-43.459 Y-14.7 E532.8213
G1 X-43.769 Y-14.483 E533.21685
G1 X-43.836 Y-13.87 E533.86144
G1 X-44.026 Y-13.39 E534.40107
G1 X-44.353 Y-12.981 E534.94845
G1 X-44.711 Y-12.726 E535.4079
G1 X-45.392 Y-12.438 E536.1808
G1 X-45.703 Y-12.344 E536.52042
G1 X-46.236 Y-12.315 E537.07839
G1 X-46.657 Y-12.291 E537.51918
G1 X-47.524 Y-11.962 E538.48853
G1 X-47.842 Y-11.765 E538.87956
G1 X-47.942 Y-3.812 E547.1936
G1 X-47.956 Y-2.109 E548.97383
G1 X-47.971 Y-1.605 E549.5009
G1 X-48.024 Y2.627 E553.92501
G1 X-47.697 Y2.27 E554.43108
G1 X-47.193 Y1.513 E555.38172
G1 X-47.087 Y1.242 E555.6859
G1 X-46.785 Y0.725 E556.31177
G1 X-46.382 Y0.373 E556.8711
G1 X-46.045 Y0.129 E557.30601
G1 X-45.194 Y-.818 E558.63689
G1 X-45.068 Y-1.017 E558.8831
G1 X-45.006 Y-1.472 E559.36312
G1 X-44.773 Y-1.999 E559.96544
G1 X-44.351 Y-2.447 E560.60878
G1 X-43.943 Y-2.789 E561.16529
G1 X-43.305 Y-3.163 E561.93834
G1 X-42.643 Y-3.449 E562.69215
G1 X-42.173 Y-3.697 E563.24765
G1 X-41.685 Y-3.818 E563.77321
G1 X-41.15 Y-3.923 E564.34312
G1 X-40.436 Y-4.11 E565.11465
G1 X-39.707 Y-4.222 E565.88563
G1 X-38.76 Y-4.297 E566.87864
G1 X-38.256 Y-4.263 E567.40667
G1 X-37.793 Y-4.103 E567.91874
G1 X-36.994 Y-3.724 E568.84314
G1 X-36.275 Y-3.489 E569.63385
G1 X-35.438 Y-3.414 E570.51228
G1 X-35.08 Y-3.426 E570.88671
G1 X-34.181 Y-3.773 E571.89402
G1 X-33.697 Y-4.079 E572.49259
G1 X-33.229 Y-4.428 E573.10285
G1 X-32.756 Y-4.83 E573.75173
G1 X-32.264 Y-5.187 E574.38715
G1 X-31.781 Y-5.53 E575.00639
G1 X-31.36 Y-5.75 E575.50293
G1 X-30.736 Y-5.925 E576.18038
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""")  # disabled
analyzegcode = BooleanToggle(False)  # disabled
gcode_4 = Data(gcode)  # disabled
filter_129 = StreamFilter(Gate=analyzegcode, Stream1=gcode_4)  # disabled
parsegcode_2 = GhPythonScript(GCODE=filter_129)  # -> out, G, X, Y, Z, E, F; inputs GCODE: list; disabled
# ---------- parsegcode_2: Python ----------
from __future__ import division, print_function
import re

import rhinoscriptsyntax as rs

G = []
X = []
Y = []
Z = []
E = []
F = []

Ztemp = 0.0
Etemp = 0.0
Ftemp = 0.0

for i, ln in enumerate(GCODE):
    if ln.startswith(';'):
        continue
    
    elif ln.startswith('G0') or ln.startswith('G1'):
        if 'X' in ln and 'Y' in ln:
            G.append(ln[1])
        else:
            continue
        
        parts = re.split(' ;', ln)
        parts = re.split(' |;', parts[0])
        for part in parts:
            # catch X values
            if part.startswith('X'):
                X.append(float(part[1:]))
            
            # catch Y values
            if part.startswith('Y'):
                Y.append(float(part[1:]))
            
            # catch Z values
            if part.startswith('Z'):
                Zval = float(part[1:])
                Z.append(Zval)
                Ztemp = Zval
            
            # catch E values
            if part.startswith('E'):
                Eval = float(part[1:])
                E.append(Eval)
                Etemp = Eval
        
            if part.startswith('F'):
                Fval = float(part[1:])
                F.append(Fval)
                Ftemp = Fval
        
        # catch missing Z values
        if 'X' in ln and 'Y' in ln and not 'Z' in ln:
            Z.append(Ztemp)
        
        # catch missing E values
        if not 'E' in ln:
            E.append(Etemp)
        
        # catch missing F values
        if not 'F' in ln:
            F.append(Ftemp)
    
    else:
        print(ln)
# ---------- end parsegcode_2 ----------
gcode_5 = Data(panel_30)  # disabled
number_slider_10 = Slider(1000, range=0..1000)  # disabled
pt_11 = ConstructPoint(XCoordinate=parsegcode_2.X, YCoordinate=parsegcode_2.Y, ZCoordinate=parsegcode_2.Z)  # disabled
shift_7 = ShiftList(List=parsegcode_2.E, Shift=-1, Wrap=False)  # disabled
shift_8 = ShiftList(List=parsegcode_2.E, Shift=1, Wrap=False)  # disabled
shift_9 = ShiftList(List=pt_11, Shift=-1, Wrap=False)  # disabled
shift_10 = ShiftList(List=pt_11, Shift=1, Wrap=False)  # disabled
shift_11 = ShiftList(List=parsegcode_2.F, Shift=1, Wrap=False)  # disabled
item_29 = ListItem(List=shift_7, Index=number_slider_10, Wrap=True)  # disabled
item_30 = ListItem(List=shift_8, Index=number_slider_10, Wrap=True)  # disabled
ln_5 = Line(StartPoint=shift_9, EndPoint=shift_10)  # disabled
item_31 = ListItem(List=shift_11, Index=number_slider_10, Wrap=True)  # disabled
item_32 = ListItem(List=ln_5, Index=number_slider_10, Wrap=True)  # disabled
subtraction_17 = Subtraction(A=item_30, B=item_29)  # disabled
panel_31 = Panel("0")  # disabled
len_5 = Length(Curve=item_32)  # disabled
max_2 = Maximum(A=panel_31, B=subtraction_17)  # disabled
division_8 = Division(A=max_2, B=len_5)  # disabled
extrusionrate = Panel(division_8)  # disabled
f_value = Panel(item_31)  # disabled
move_length = Panel(len_5)  # disabled
e_value = Panel(item_30)  # disabled

# ----
# PRINTING TIME APPROXIMATION
print_speed_mm_min_3 = Data(print_speed_mm_min_2)
movelines_2 = Data(movelines)
len_6 = Length(Curve=movelines_2)
ma_13 = MassAddition(Input=len_6)  # -> Result, PartialResults
addition_factor = Slider(1.45, range=0..2)
division_9 = Division(A=ma_13.Result, B=print_speed_mm_min_3)
multiplication_25 = Multiplication(A=division_9, B=addition_factor)
rtd_7 = RoundToDecimal(Numbers=multiplication_25, DecimalPlaces="2")  # -> Rounded; inputs Numbers: list, DecimalPlaces: list of Int32; same code as rtd_2
comments_notes_41 = Panel("PRINTING TIME APPROXIMATION")
division_10 = Division(A=rtd_7, B="60")
round_9 = Round(Number=division_10)  # -> Nearest, Floor, Ceiling
subtraction_18 = Subtraction(A=division_10, B=round_9.Floor)
approximate_printing_time_in_minutes = Panel(rtd_7)
multiplication_26 = Multiplication(A=subtraction_18, B="60")
panel_32 = Panel("[INFO] Approximate Printing Time is {0} hours, {1} minutes, {2} seconds.")
round_10 = Round(Number=multiplication_26)  # -> Nearest, Floor, Ceiling
subtraction_19 = Subtraction(A=multiplication_26, B=round_10.Floor)
multiplication_27 = Multiplication(A=subtraction_19, B="60")
round_11 = Round(Number=multiplication_27)  # -> Nearest, Floor, Ceiling
format_7 = Format(Format=panel_32, Culture=127, Data0=round_9.Floor, Data1=round_10.Floor, Data2=round_11.Floor)
info_approximate_print_time = Data(format_7)
approximate_print_time = Data(rtd_7)

info_approximate_print_weight_2 = Data(info_approximate_print_weight)
info_approximate_print_time_2 = Data(info_approximate_print_time)
merge_33 = Merge(
    Data1=flatten(inmesh_closed_2),
    Data2=flatten(remeshing_info_2),
    Data3=flatten(shrinkwrap_info_2),
    Data4=flatten(base_mesh_closed_2),
    Data5=flatten(pg_meshbrep_info_2),
    Data6=flatten(info_npslicing_2),
    Data7=flatten(floor_info_2),
    Data8=flatten(info_randomization_2),
    Data9=flatten(info_spiralize_contours_2),
    Data10=flatten(info_mirko_spiralize_2),
    Data11=flatten(info_approximate_print_weight_2),
    Data12=flatten(info_approximate_print_time_2))  # -> flatten(Result)
filter_130 = StreamFilter(Gate=geo_present_4, Stream0=panel_14, Stream1=merge_33)
info_error_stream = Panel(filter_130)
filter_131 = StreamFilter(Gate=enable_heads_up_display_2, Stream1=filter_130)
printsugihud = PrintsugiHUD(
    INFO=filter_131,
    LHA=layerheightanalysis_2,
    OHA=overhanganalysis_2,
    MarginH=Slider(20, range=0..100),
    MarginV=Slider(40, range=0..100),
    Font="Titillium",
    TextSize=textsize,
    TextColor=ColourSwatch(SwatchColor=RGB(0, 0, 0)),
    ErrorColor=ColourSwatch(SwatchColor=RGB(255, 0, 0)),
    WarningColor=ColourSwatch(SwatchColor=RGB(255, 132, 0)),
    IgnoColor=ColourSwatch(SwatchColor=RGB(61, 61, 61)),
    ThrowDebugError=Toggle(False))  # inputs INFO: list, LHA: list, OHA: list, MarginH: Int32, MarginV: Int32, TextSize: Int32, TextColor: Color, ErrorColor: Color, WarningColor: Color, ThrowDebugError: Boolean
# ---------- printsugihud: Python ----------
# PYTHON STANDARD LIBRARY IMPORTS
from __future__ import division, print_function
import json
import math
import traceback

# GHPYTHON SDK IMPORTS
from ghpythonlib.componentbase import executingcomponent as component
import Grasshopper, GhPython
import System
import Rhino
import rhinoscriptsyntax as rs

# GHENV COMPONENT SETTINGS
ghenv.Component.Name = "PrintsugiHUD"
ghenv.Component.NickName = "PrintsugiHUD"
ghenv.Component.Category = "Printsugi"
ghenv.Component.SubCategory = "03 Visualisation"

class PrintsugiHUD(component):
    
    _is_bound = False
    
    def RunScript(self, INFO, LHA, OHA, MarginH, MarginV, Font, TextSize, TextColor, ErrorColor, WarningColor, IgnoColor, ThrowDebugError):
        
        if INFO:
            # event handling
            if not self._is_bound:
                self.__enter__()
            
            # data
            self.INFO = INFO
            self.LHA = LHA
            self.OHA = OHA
            
            # settings
            self.hmargin = MarginH
            self.vmargin = MarginV
            self.font = Font
            self.txtsize = TextSize
            self.txtcolor = TextColor
            self.errcolor = ErrorColor
            self.warncolor = WarningColor
            self.ignocolor = IgnoColor
            self.throwerror = ThrowDebugError
            
        else:
            self.__exit__()
    
    
    def DrawForeground(self, sender, arg):
        if self.drawingWires:
            self.drawingWires = False
            try:
                if arg.Display.Viewport.Id == arg.RhinoDoc.Views.ActiveView.ActiveViewportID:
                    # create initital anchorpt on top left with margins
                    anchor_pt = Rhino.Geometry.Point2d(self.hmargin, self.vmargin)
                    
                    # SOLUTION IMPACT HEADING ----------------------------------
                    
                    if self.INFO:
                        arg.Display.Draw2dText('INFO & ERROR STREAM',
                                               self.txtcolor,
                                               anchor_pt,
                                               False,
                                               self.txtsize,
                                               self.font + ' Bold')
                        anchor_pt += Rhino.Geometry.Point2d(0, self.txtsize * 1.25)
                        
                        """
                        infostream = '\n'.join(self.INFO)
                        arg.Display.Draw2dText(infostream,
                                               self.txtcolor,
                                               anchor_pt,
                                               False,
                                               self.txtsize,
                                               self.font)
                        """
                        for i, infostr in enumerate(self.INFO):
                            if infostr.startswith("[INFO]"):
                                arg.Display.Draw2dText(infostr,
                                               self.txtcolor,
                                               anchor_pt,
                                               False,
                                               self.txtsize,
                                               self.font)
                            elif infostr.startswith("[ERROR]"):
                                arg.Display.Draw2dText(infostr,
                                               self.errcolor,
                                               anchor_pt,
                                               False,
                                               self.txtsize,
                                               self.font)
                            elif infostr.startswith("[WARNING]"):
                                arg.Display.Draw2dText(infostr,
                                               self.warncolor,
                                               anchor_pt,
                                               False,
                                               self.txtsize,
                                               self.font)
                            elif infostr.startswith("[SETTING IGNORED]"):
                                arg.Display.Draw2dText(infostr,
                                               self.ignocolor,
                                               anchor_pt,
                                               False,
                                               self.txtsize,
                                               self.font)
                            else:
                                arg.Display.Draw2dText(infostr,
                                               self.txtcolor,
                                               anchor_pt,
                                               False,
                                               self.txtsize,
                                               self.font)
                            anchor_pt += Rhino.Geometry.Point2d(
                                                        0,
                                                        self.txtsize * 1.25)
                    
                    if self.LHA:
                        anchor_pt += Rhino.Geometry.Point2d(0, self.txtsize * 1.5)
                        
                        arg.Display.Draw2dText('LAYER HEIGHT ANALYSIS',
                                               self.txtcolor,
                                               anchor_pt,
                                               False,
                                               self.txtsize,
                                               self.font + ' Bold')
                        anchor_pt += Rhino.Geometry.Point2d(0, self.txtsize * 1.25)
                        
                        lhastream = '\n'.join(self.LHA)
                        arg.Display.Draw2dText(lhastream,
                                               self.txtcolor,
                                               anchor_pt,
                                               False,
                                               self.txtsize,
                                               self.font)
                    if self.OHA:
                        if self.INFO and self.LHA:
                            anchor_pt += Rhino.Geometry.Point2d(0,
                                self.txtsize * 4.5)
                        elif self.INFO and not self.LHA:
                            anchor_pt += Rhino.Geometry.Point2d(0,
                                self.txtsize * 1.5)
                        
                        arg.Display.Draw2dText('OVERHANG ANALYSIS',
                                               self.txtcolor,
                                               anchor_pt,
                                               False,
                                               self.txtsize,
                                               self.font + ' Bold')
                        anchor_pt += Rhino.Geometry.Point2d(0, self.txtsize * 1.25)
                        
                        lhastream = '\n'.join(self.OHA)
                        arg.Display.Draw2dText(lhastream,
                                               self.txtcolor,
                                               anchor_pt,
                                               False,
                                               self.txtsize,
                                               self.font)
            
            
            except Exception:
                    if self.throwerror:
                        tb = traceback.format_exc()
                        System.Windows.Forms.MessageBox.Show(
                                tb,
                                'Error while drawing preview in PrintsugiHUD!')
                    else:
                        return
    
    def DrawViewportWires(self, arg):
        self.drawingWires = True
    
    
    def __exit__(self):
        Rhino.Display.DisplayPipeline.DrawForeground -= self.DrawForeground
        self._is_bound = False
    
    
    def __enter__(self):
        Rhino.Display.DisplayPipeline.DrawForeground += self.DrawForeground
        self._is_bound = True
# ---------- end printsugihud ----------

# ----
# GCODE VISUALISATION
comments_notes_42 = Panel("GCODE VISUALISATION")
enable_print_simulation_3 = Data(enable_print_simulation)
gcode_offset_vector_2 = Data(gcode_offset_vector)
movelines_progvis = Data(movelines_prog)
vis_leader_plane_5 = Data(vis_leader_plane)
colors_progvis = Data(colors_prog)
vis_leader_5 = Curve(vis_leader)
move_37 = Move(Geometry=vis_leader_5, Motion=gcode_offset_vector_2)  # -> Geometry, Transform
swatch_6 = ColourSwatch(SwatchColor=RGB(0, 0, 0))
move_38 = Move(Geometry=vis_leader_plane_5, Motion=gcode_offset_vector_2)  # -> Geometry, Transform
filter_132 = StreamFilter(Gate=enable_print_simulation_3, Stream0=movelines_progvis)
filter_133 = StreamFilter(Gate=enable_print_simulation_3, Stream0=colors_progvis)
move_39 = Move(Geometry=filter_132, Motion=gcode_offset_vector_2)  # -> Geometry, Transform
cpl_13 = CustomPreviewLineweights(Geometry=move_37.Geometry, Color=swatch_6)  # inputs Geometry: list, Color: list of Color; same code as cpl
tag_9 = TextTag3D(Location=move_38.Geometry, Text="GCODE Simulation", Size=Slider(8, range=0..10), Colour=swatch_6, Justification=8)
cpl_14 = CustomPreviewLineweights(Geometry=move_39.Geometry, Color=filter_133, Thickness=Slider(3, range=0..10))  # inputs Geometry: list, Color: list of Color; same code as cpl

enable_print_simulation_4 = Data(enable_print_simulation_2)
gcode_last_pt_2 = Point(gcode_last_pt)
home_pt = Point(Point(0, 0, 500))
gcode_offset_vector_3 = Data(gcode_offset_vector)
layer_height_11 = Number(layer_height)
Z_10 = UnitZ(Factor=layer_height_11)
filter_134 = StreamFilter(Gate=enable_print_simulation_4, Stream1=home_pt)
filter_135 = StreamFilter(Gate=enable_print_simulation_4, Stream1=gcode_last_pt_2)
gcode_last_pt_3 = Point(filter_135)
move_40 = Move(Geometry=filter_134, Motion=gcode_offset_vector_3)  # -> Geometry, Transform
move_41 = Move(Geometry=gcode_last_pt_3, Motion=gcode_offset_vector_3)  # -> Geometry, Transform
null_9 = NullItem(Item=move_41.Geometry)  # -> NullFlags, InvalidFlags, Description
or_16 = GateOr(A=null_9.NullFlags, B=null_9.InvalidFlags)
filter_136 = StreamFilter(Gate=or_16, Stream0=move_41.Geometry, Stream1=move_40.Geometry)
move_42 = Move(Geometry=filter_136, Motion=Z_10)  # -> Geometry, Transform
gcode_pt = Point(move_42.Geometry)

gcode_pt_2 = Point(gcode_pt)
xy_10 = XYPlane(Origin=gcode_pt_2)
cir = Circle(Plane=xy_10, Radius=expr("x*0.5", Slider(4, range=0..10)))
Z_11 = UnitZ(Factor=Slider(15, range=0..100))
offset_2 = OffsetCurve(Curve=cir, Distance=Slider(0.5, range=0..1), Corners=1)
boundary_2 = BoundarySurfaces(Edges=flatten([cir, offset_2]))
Z_12 = UnitZ(Factor=Slider(26, range=0..100))
move_43 = Move(Geometry=offset_2, Motion=Z_12)  # -> Geometry, Transform
extr = Extrude(Base=boundary_2, Direction=Z_11)
darc = DeconstructArc(Arc=move_43.Geometry)  # -> BasePlane, Radius, Angle
move_44 = Move(Geometry=offset_2, Motion=Z_11)  # -> Geometry, Transform
polygon = Polygon(Plane=darc.BasePlane, Radius=Slider(12, range=0..100), Segments=6, FilletRadius=0)  # -> Polygon, Length
Z_13 = UnitZ(Factor=Slider(15, range=0..100))
merge_34 = Merge(Data1=move_44.Geometry, Data2=polygon.Polygon)
move_45 = Move(Geometry=darc.BasePlane, Motion=Z_13)  # -> Geometry, Transform
extr_2 = Extrude(Base=polygon.Polygon, Direction=Z_13)
loft_2 = Loft(Curves=merge_34, Options={Adjust=False, Closed=False, LoftEnds=0, LoftSimp=0, LoftType=0, Rebuild=10, Refit=0.01})
cutplane_extruderfixtures = Data(move_45.Geometry)
nozzle_transition = Data(loft_2)
nozzle_toppart = Data(extr_2)
nozzle_bot = Data(extr)

cir_2 = Circle(Plane=cutplane_extruderfixtures, Radius=Slider(30, range=0..100))
seam = Seam(Curve=reparameterize(cir_2), Seam=Slider(0.25, range=0..1))
boundary_3 = BoundarySurfaces(Edges=cir_2)
extrudermount_srf = Data(boundary_3)
divide_6 = DivideCurve(Curve=seam, Count="3", Kinks=False)  # -> Points, Tangents, Parameters
extruder_attachmentpts = Data(divide_6.Points)

extrudermount_srf_2 = Data(extrudermount_srf)
showprinter = Data(show_printer_2)
nozzle_bot_2 = Data(nozzle_bot)
nozzle_transition_2 = Data(nozzle_transition)
nozzle_toppart_2 = Data(nozzle_toppart)
merge_35 = Merge(Data1=nozzle_bot_2, Data2=nozzle_transition_2, Data3=nozzle_toppart_2, Data4=extrudermount_srf_2)  # -> flatten(Result)
filter_137 = StreamFilter(Gate=showprinter, Stream1=merge_35)
preview_5 = CustomPreview(Geometry=filter_137, Material=ColourSwatch(SwatchColor=RGB(184, 184, 184)))

gcode_offset_vector_4 = Data(gcode_offset_vector)
xy_11 = XYPlane(Origin=Point(0, 0, 0))
wasp_40100_printing_diameter_3 = Data(wasp_40100_printing_diameter_2)
printingsimulation = Data(enable_print_simulation_2)
Y_2 = UnitY(Factor=expr("(x-10)*0.5", wasp_40100_printing_diameter_3))

# ----
# PRINTER SIM / VISUALIZATION
move_46 = Move(Geometry=xy_11, Motion=gcode_offset_vector_4)  # -> Geometry, Transform
comments_notes_43 = Panel("PRINTER SIM & VISUALISATION")

move_47 = Move(Geometry=move_46.Geometry, Motion=Y_2)  # -> Geometry, Transform
cir_3 = Circle(Plane=move_46.Geometry, Radius=expr("x*0.5", wasp_40100_printing_diameter_3))
crv_cp_2 = CurveClosestPoint(Point=move_47.Geometry, Curve=reparameterize(cir_3))  # -> Point, Parameter, Distance
seam_2 = Seam(Curve=reparameterize(cir_3), Seam=crv_cp_2.Parameter)
filter_138 = StreamFilter(Gate=printingsimulation, Stream1=seam_2)
boundary_4 = BoundarySurfaces(Edges=seam_2)
wasp40100_printing_area_srf = Data(boundary_4)
wasp40100_printing_area_crv = Data(filter_138)

wasp40100_printing_area_srf_2 = Data(wasp40100_printing_area_srf)
showprinter_2 = Data(show_printer_2)
filter_139 = StreamFilter(Gate=showprinter_2, Stream1=wasp40100_printing_area_srf_2)
preview_6 = CustomPreview(Geometry=filter_139, Material=ColourSwatch(SwatchColor=RGB(227, 227, 227)))

wasp40100_printing_area_crv_2 = Data(wasp40100_printing_area_crv)
divide_7 = DivideCurve(Curve=wasp40100_printing_area_crv_2, Count="3", Kinks=False)  # -> Points, Tangents, Parameters
Z_14 = UnitZ(Factor=1)
line_3 = LineSDL(Start=divide_7.Points, Direction=Z_14, Length=Slider(1000, range=0..1000))
wasp40100_z_axis_crvs = Data(line_3)

wasp40100_arm_length_3 = Data(wasp40100_arm_length_2)
cutplane_extruderfixtures_2 = Data(cutplane_extruderfixtures)
wasp40100_z_axis_crvs_2 = Data(wasp40100_z_axis_crvs)
extruder_attachmentpts_2 = Data(extruder_attachmentpts)
plx = LinePlane(Line=wasp40100_z_axis_crvs_2, Plane=cutplane_extruderfixtures_2)  # -> Point, ParamL, ParamP
ln_6 = Line(StartPoint=extruder_attachmentpts_2, EndPoint=plx.Point)
len_7 = Length(Curve=ln_6)
vec2pt_6 = Vector2Pt(PointA=extruder_attachmentpts_2, PointB=plx.Point, Unitize=False)  # -> Vector, Length
Z_15 = UnitZ(Factor=1)
rtrig = RightTrigonometry(PLength=len_7, RLength=wasp40100_arm_length_3)  # -> Alpha, Beta, PLength, QLength, RLength
pl_5 = ConstructPlane(Origin=extruder_attachmentpts_2, XAxis=vec2pt_6.Vector, YAxis=Z_15)
rotate = Rotate(Geometry=ln_6, Angle=rtrig.Alpha, Plane=pl_5)  # -> Geometry, Transform
end_4 = EndPoints(Curve=rotate.Geometry)  # -> Start, End
wasp40100_arm_length_4 = Data(wasp40100_arm_length_3)
vec2pt_7 = Vector2Pt(PointA=end_4.Start, PointB=end_4.End, Unitize=False)  # -> unitize(Vector), Length
line_4 = LineSDL(Start=extruder_attachmentpts_2, Direction=vec2pt_7.Vector, Length=wasp40100_arm_length_4)
wasp40100_arm_crv = Data(line_4)

subsegments_2 = Slider(10, range=0..100)
wasp40100_arm_crv_2 = Data(wasp40100_arm_crv)
accuracy_2 = Slider(1, range=0..1)
wasp40100_z_axis_crvs_3 = Data(wasp40100_z_axis_crvs)
wasp40100_arm_crv_3 = Data(wasp40100_arm_crv)
capstyle_2 = Slider(3, range=0..3)
showprinter_3 = Data(show_printer_2)
merge_36 = Merge(Data1=wasp40100_z_axis_crvs_3, Data2=wasp40100_arm_crv_2)  # -> flatten(Result)
filter_140 = StreamFilter(Gate=showprinter_3, Stream1=wasp40100_arm_crv_3)
meshpipe_2 = CSharpScript(Curves=filter_140, Radius=Slider(4, range=0..10), SubSegments=subsegments_2, Accuracy=accuracy_2, CapStyle=capstyle_2)  # -> M; inputs Curves: list of Curve, Radius: Double, SubSegments: Int32, Accuracy: Int32, CapStyle: Int32; same code as meshpipe
cpl_15 = CustomPreviewLineweights(Geometry=merge_36, Color=ColourSwatch(SwatchColor=RGB(191, 191, 191)), Thickness=Slider(2, range=0..10))  # inputs Geometry: list, Color: list of Color; same code as cpl
preview_7 = CustomPreview(Geometry=meshpipe_2, Material=ColourSwatch(SwatchColor=RGB(191, 191, 191)))

# ----
# PRINTING SIM & MESH
# VISUALISATION
# OF GCODE PATHS
# comments & notes: PRINTING SIM & MESH VISUALISATION OF GCODE PATHS
printpolylines_progvis = Data(printpolylines)
enable_print_simulation_5 = Data(enable_print_simulation)
gcode_offset_vector_5 = Data(gcode_offset_vector)
filter_141 = StreamFilter(Gate=enable_print_simulation_5, Stream1=printpolylines_progvis)
move_48 = Move(Geometry=filter_141, Motion=gcode_offset_vector_5)  # -> Geometry, Transform
hd_printing_visualisation_2 = Data(hd_printing_visualisation)
redpline_7 = Reduce(Polyline=move_48.Geometry, Tolerance=Slider(0.1, range=0..1))  # -> Polyline, Reduction
gate_38 = StreamGate(Stream=redpline_7.Polyline, Gate=hd_printing_visualisation_2)  # -> Target0, Target1
divlength_3 = DivideLength(Curve=reparameterize(flatten(gate_38.Target1)), Length=Slider(200, range=0..1000))  # -> Points, Tangents, Parameters
numsegments_2 = Slider(10, range=0..10)
line_width_7 = Data(line_width)
subsegments_3 = Slider(10, range=0..100)
shatter_2 = Shatter(Curve=reparameterize(graft(gate_38.Target1)), Parameters=divlength_3.Parameters)  # -> flatten(Segments)
accuracy_3 = Slider(1, range=0..1)
capstyle_3 = Slider(3, range=0..3)
multiplication_28 = Multiplication(A=line_width_7, B="0.5")
meshpipechromo_2 = CSharpScript(P=gate_38.Target0, N=numsegments_2, R=multiplication_28, C=Toggle(True))  # -> M; inputs P: list of Curve, N: Int32, R: Double, C: Boolean; same code as meshpipechromo
meshpipe_3 = CSharpScript(Curves=shatter_2, Radius=multiplication_28, SubSegments=subsegments_3, Accuracy=accuracy_3, CapStyle=capstyle_3)  # -> M; inputs Curves: list of Curve, Radius: Double, SubSegments: Int32, Accuracy: Int32, CapStyle: Int32; same code as meshpipe

hd_printing_visualisation_3 = Data(hd_printing_visualisation_2)
filter_142 = StreamFilter(Gate=hd_printing_visualisation_3, Stream0=meshpipechromo_2, Stream1=meshpipe_3)

preview_8 = CustomPreview(Geometry=filter_142, Material=ColourSwatch(SwatchColor=RGB(230, 230, 230)))

# ==== cluster CurveInfill: Take the given curve and creates an infill (based on the extrusion width and infill ratio) of the curve as a polyline. This polyline can be then be converted into g code.

C = ClusterInput()
trim_to = TrimTo(data_to_trim=simplify(C), branch_depth=1, F=False)
crv = Curve(trim_to)
join = JoinCurves(Curves=crv, Preserve=False)
trim = TrimTree(Tree=join, Depth=1)
boundary = BoundarySurfaces(Edges=trim)  # -> graft(Surfaces)

extrusion_width_or_xylinus_config = ClusterInput()  # input either the extrusion width in mm, or a Xlinus Config
extrusion_width = Data(extrusion_width_or_xylinus_config)
setting = ConfigSetting(config=extrusion_width, setting_number=3)  # -> flatten(setting_2)

# ---- group: infill ratio
infill_ratio_0_1 = ClusterInput()  # infill ratio
division = Division(A=1, B=infill_ratio_0_1)
multiplication = Multiplication(A=setting, B=division)

# ----
tstat = TreeStatistics(Tree=crv)  # -> Paths, Length, Count
long = LongestList(ListA=tstat.Paths, ListB=[0, 1], PaddingMode=4)  # -> ListA, simplify(graft(ListB))
larger = LargerThan(FirstNumber=tstat.Count, SecondNumber=1)  # -> LargerThan, OrEqualTo
filter = StreamFilter(Gate=larger.LargerThan, Stream0=0, Stream1=long.ListB)
trim_2 = TrimTree(Tree=boundary, Depth=1)

# ---- group: create lines for infill
bbox = BoundingBox(Content=flatten(boundary), Plane=PlaneXY(0, 0, 0), UnionBox=True)  # -> Box, Box_2
box = EvaluateBox(Box=bbox.Box, UParameter=0.5, VParameter=0.5, WParameter=0.5)  # -> Plane, Point, Include
rotate = Rotate(Geometry=bbox.Box, Angle=1.570796327, Plane=box.Plane)  # -> Geometry, Transform
bbox_2 = BoundingBox(Content=flatten([rotate.Geometry, bbox.Box]), Plane=PlaneXY(0, 0, 0), UnionBox=True)  # -> Box, Box_2
box_corners = BoxCorners(Box=flatten(bbox_2.Box))  # -> CornerA, CornerB, CornerC, CornerD, CornerE, CornerF, CornerG, CornerH
ln = Line(StartPoint=box_corners.CornerA, EndPoint=box_corners.CornerC)

# ----
ln_2 = Line(StartPoint=box_corners.CornerB, EndPoint=box_corners.CornerD)
p_n_c = PickNChoose(Pattern=filter, Stream0=ln, Stream1=ln_2)
long_2 = LongestList(ListA=trim_2, ListB=p_n_c, PaddingMode=2)  # -> ListA, graft(ListB)

# ---- group: create lines for infill (continued)
divlength = DivideLength(Curve=long_2.ListB, Length=multiplication)  # -> Points, Tangents, Parameters
pl = PlaneNormal(Origin=divlength.Points, ZAxis=long_2.ListB)
trim_3 = TrimTree(Tree=pl, Depth=1)
sec = BrepPlane(Brep=boundary, Plane=trim_3)  # -> Curves, Points
clean = CleanTree(RemoveNulls=True, RemoveInvalid=True, RemoveEmpty=True, Tree=sec.Curves)

# ----
path_mapper = PathMapper(clean, source="{A;B;C}(i)", target="{A;B;i}(C)")

# ---- group: split at nulls to establish consecutive lines
data = Data(path_mapper)
null = NullItem(Item=data)  # -> NullFlags, InvalidFlags, Description
lng = ListLength(List=data)
series = Series(Start=0, Step=1, Count=lng)
item = ListItem(List=series, Index=0, Wrap=True)  # -> Item1, Item
cull = CullPattern(List=series, CullPattern=null.NullFlags)
merge = Merge(Data1=item.Item, Data2=cull, Data3=item.Item1)
consec = ConsecutiveDomains(Numbers=merge, Additive=False)

# ----
trim_4 = TrimTree(Tree=consec, Depth=2)

# ---- group: split at nulls to establish consecutive lines (continued)
subset = SubList(List=data, Domain=trim_4, Wrap=True)  # -> List, Index
clean_2 = CleanTree(RemoveNulls=True, RemoveInvalid=True, RemoveEmpty=True, Tree=subset.List)

# ---- group: flip every other curve to make zig zags
dispatch = Dispatch(List=clean_2, DispatchPattern=[True, False])  # -> ListA, ListB
flip = FlipCurve(Curve=dispatch.ListB)  # -> Curve, Flag
weave = Weave(Pattern=[0, 1], Stream0=dispatch.ListA, Stream1=flip.Curve, NullGaps=False)
end = EndPoints(Curve=weave)  # -> Start, End
weave_2 = Weave(Pattern=[0, 1], Stream0=end.Start, Stream1=end.End, NullGaps=False)

# ---- group: split at long line shifts
data_2 = Data(weave_2)
lng_2 = ListLength(List=data_2)
series_2 = Series(Start=0, Step=1, Count=lng_2)
item_2 = ListItem(List=series_2, Index=0, Wrap=True)  # -> Item1, Item

# ---- group: split at long line shifts / if the distance between the end of one line and the start of the next is greater than X * the layer width then create a break
shift = ShiftList(List=data_2, Shift=1, Wrap=True)
dist = Distance(PointA=data_2, PointB=shift)
sift = SiftPattern(List=dist, SiftPattern=[0, 1])  # -> Output0, Output1
multiplication_2 = Multiplication(A=multiplication, B=Slider(2.5, range=0..10))
larger_2 = LargerThan(FirstNumber=sift.Output1, SecondNumber=multiplication_2)  # -> LargerThan, OrEqualTo

# ---- group: split at long line shifts
replace = ReplaceItems(List=larger_2.LargerThan, Item=True, Indices=-1, Wrap=True)
trim_5 = TrimTree(Tree=replace, Depth=1)

cull_2 = CullPattern(List=series_2, CullPattern=trim_5)
merge_2 = Merge(Data1=item_2.Item, Data2=cull_2)
consec_2 = ConsecutiveDomains(Numbers=merge_2, Additive=False)

# ---- group: split at long line shifts / increase start of domain by one unless it is 0
dedomain = DeconstructDomain(Domain=consec_2)  # -> Start, End
addition = Addition(A=dedomain.Start, B=1)
eval = Evaluate(F="if(x=1,0,x)", x=addition)
dom = ConstructDomain(DomainStart=eval, DomainEnd=dedomain.End)

# ---- group: split at long line shifts
trim_6 = TrimTree(Tree=dom, Depth=2)
subset_2 = SubList(List=data_2, Domain=trim_6, Wrap=False)  # -> List, Index
clean_3 = CleanTree(Tree=subset_2.List, CleanInvalid=True, CleanEmpty=False)
prune = PruneTree(Tree=clean_3, Minimum=1, Maximum=0)
pline = PolyLine(Vertices=prune, Closed=False)
trim_to_2 = TrimTo(data_to_trim=pline, branch_depth=1, F=False)
D = ClusterOutput(trim_to_2)

# ==== cluster CREATE_OFFSET_INFILL

slice_planes = ClusterInput()
outer_infill_base_curves = ClusterInput()
inner_infill_base_curves = ClusterInput()
offset = ClusterInput()
slice_planes_2 = Data(slice_planes)
outer_infill_base_curves_2 = Curve(outer_infill_base_curves)
inner_infill_base_curves_2 = Curve(inner_infill_base_curves)
offset_2 = Data(offset)

comments_notes = Panel("OFFSET INFILL")
outer_infill_base_curves_3 = Curve(outer_infill_base_curves_2)

null = NullItem(Item=flatten(inner_infill_base_curves_2))  # -> NullFlags, InvalidFlags, Description
or = GateOr(A=null.NullFlags, B=null.InvalidFlags)
inner_infill_base_crvs = Curve(inner_infill_base_curves_2)
tstat = TreeStatistics(Tree=outer_infill_base_curves_2)  # -> Paths, Length, Count
c2bool = Clipper2Boolean(PolylinesA=outer_infill_base_curves_2, PolylinesB=inner_infill_base_curves_2, Operation=1, Precision=6)
ma = MassAddition(Input=or)  # -> Result, PartialResults
branch = TreeBranch(Tree=slice_planes_2, Path=tstat.Paths, MaintainPaths=True)
pshift = ShiftPaths(Data=c2bool, Offset=-1)
bool = Boolean(invert(ma.Result))
project = Project(Geometry=pshift, Plane=branch)  # -> Geometry, Transform
filter = StreamFilter(Gate=bool, Stream0=outer_infill_base_curves_2, Stream1=project.Geometry)
infill_basecrvs_merged = Curve(filter)
bbox = BoundingBox(Content=infill_basecrvs_merged, Plane=PlaneXY(0, 0, 0), UnionBox=True)  # -> Box, Box_2
tstat_2 = TreeStatistics(Tree=infill_basecrvs_merged)  # -> Paths, Length, Count
debox = DeconstructBox(Box=bbox.Box)  # -> Plane, X, Y, Z
branch_2 = TreeBranch(Tree=slice_planes_2, Path=tstat_2.Paths, MaintainPaths=True)
dedomain = DeconstructDomain(Domain=debox.X)  # -> Start, End
dedomain_2 = DeconstructDomain(Domain=debox.Y)  # -> Start, End
subtraction = Subtraction(A=dedomain.End, B=dedomain.Start)
subtraction_2 = Subtraction(A=dedomain_2.End, B=dedomain_2.Start)
max = Maximum(A=subtraction, B=subtraction_2)
division = Division(A=max, B="2")
offset_3 = Data(offset_2)
division_2 = Division(A=division, B=offset_3)
inner_infill_base_crvs_2 = Curve(inner_infill_base_crvs)
round = Round(Number=division_2)  # -> Nearest, Floor, Ceiling
series = Series(Start=offset_3, Step=offset_3, Count=round.Ceiling)
null_2 = NullItem(Item=flatten(inner_infill_base_crvs_2))  # -> NullFlags, InvalidFlags, Description
pshift_2 = ShiftPaths(Data=series, Offset=-1)
comments_notes_2 = Panel("create infill offsets")
or_2 = GateOr(A=null_2.NullFlags, B=null_2.InvalidFlags)
c2offset = Clipper2Offset(Polylines=infill_basecrvs_merged, Distance=pshift_2, JoinType=1, EndType=4, MiterLimit=2, Precision=6)  # -> Holes, Outer, ClipperPaths
ma_2 = MassAddition(Input=or_2)  # -> Result, PartialResults
pshift_3 = ShiftPaths(Data=c2offset.Outer, Offset=-1)
pshift_4 = ShiftPaths(Data=c2offset.Holes, Offset=-1)
bool_2 = Boolean(invert(ma_2.Result))
inner_infill_base_crvs_3 = Curve(inner_infill_base_crvs)

# ----
# comments & notes: sort crvs in inner and outer
infill_basecrvs_merged_2 = Curve(infill_basecrvs_merged)
boundary = BoundarySurfaces(Edges=infill_basecrvs_merged_2)
inneroutercurves = CSharpScript(Layers=boundary)  # -> InnerCurves, OuterCurves; inputs Layers: tree of Brep
# ---------- inneroutercurves: C# ----------
// Grasshopper Script Instance
#region Usings
using System;
using System.Linq;
using System.Collections;
using System.Collections.Generic;
using System.Drawing;

using Rhino;
using Rhino.Geometry;

using Grasshopper;
using Grasshopper.Kernel;
using Grasshopper.Kernel.Data;
using Grasshopper.Kernel.Types;
#endregion

public class Script_Instance : GH_ScriptInstance
{
    #region Notes
    /* 
      Members:
        RhinoDoc RhinoDocument
        GH_Document GrasshopperDocument
        IGH_Component Component
        int Iteration

      Methods (Virtual & overridable):
        Print(string text)
        Print(string format, params object[] args)
        Reflect(object obj)
        Reflect(object obj, string method_name)
    */
    #endregion

    private void RunScript(
		DataTree<Brep> Layers,
		ref object InnerCurves,
		ref object OuterCurves)
    {

        DataTree<Curve> iLoops = new DataTree<Curve>();
        DataTree<Curve> oLoops = new DataTree<Curve>();
        List<Brep> Breps;
        for (int i = 0; i < Layers.BranchCount; i++)
        {
            Breps = Layers.Branches[i];
            for (int j = 0; j < Breps.Count; j++)
            {
                int fc = Breps[j].Faces.Count;
                for (int k = 0; k < fc; k++)
                {
                    BrepFace bface = Breps[j].Faces[k];
                    int iCount = 0;
                    foreach (BrepLoop floop in bface.Loops)
                    {
                        if (floop.LoopType == BrepLoopType.Inner)
                        {
                            iLoops.Add(floop.To3dCurve(), Layers.Paths[i]);
                        }
                        else if (floop.LoopType == BrepLoopType.Outer)
                        {
                            oLoops.Add(floop.To3dCurve(), Layers.Paths[i]);
                        }
                    }
                }
            }
        }
        InnerCurves = iLoops;
        OuterCurves = oLoops;
    }
}
# ---------- end inneroutercurves ----------
pcen = PolygonCenter(Polyline=inneroutercurves.InnerCurves)  # -> CenterV, CenterE, CenterA
pcen_2 = PolygonCenter(Polyline=inneroutercurves.OuterCurves)  # -> CenterV, CenterE, CenterA
Z = UnitZ(Factor=1)
pl = PlaneNormal(Origin=pcen_2.CenterA, ZAxis=Z)
pl_2 = PlaneNormal(Origin=pcen.CenterV, ZAxis=Z)
crvensureccw = GhPythonScript(Crv=inneroutercurves.InnerCurves, Pln=pl_2)  # -> CCWCrv; inputs Crv: Curve, Pln: Plane
# ---------- crvensureccw: Python ----------
__author__ = "Max Eschenbach"
__version__ = "2022.05.19"

import Rhino
import Grasshopper

if Crv and Pln:
    if Crv.ClosedCurveOrientation(Pln) == Rhino.Geometry.CurveOrientation.Clockwise:
        Crv.Reverse()
    CCWCrv = Crv
else:
    CCWCrv = Grasshopper.DataTree[object]()
# ---------- end crvensureccw ----------
crvensureccw_2 = GhPythonScript(Crv=inneroutercurves.OuterCurves, Pln=pl)  # -> CCWCrv; inputs Crv: Curve, Pln: Plane; same code as crvensureccw
clean = CleanTree(RemoveNulls=True, RemoveInvalid=True, RemoveEmpty=False, Tree=crvensureccw)
outercrvs = Curve(crvensureccw_2)
innercrvs = Curve(clean)

trim = TrimWithRegions(Curve=pshift_3, Regions=outer_infill_base_curves_3)  # -> Inside, Outside
pshift_5 = ShiftPaths(Data=trim.Inside, Offset=-1)
trim_2 = TrimWithRegions(Curve=pshift_4, Regions=pshift_5)  # -> Inside, Outside
pshift_6 = ShiftPaths(Data=trim_2.Outside, Offset=-1)
merge = Merge(Data1=pshift_6, Data2=pshift_5)
filter_2 = StreamFilter(Gate=bool_2, Stream0=pshift_4, Stream1=merge)

project_2 = Project(Geometry=filter_2, Plane=branch_2)  # -> reverse(Geometry), Transform
gate = StreamGate(Stream=project_2.Geometry, Gate=bool_2)  # -> Target0, Target1
trim_3 = TrimWithRegions(Curve=gate.Target1, Regions=inner_infill_base_crvs_3)  # -> Inside, Outside
pshift_7 = ShiftPaths(Data=trim_3.Outside, Offset=-1)
filter_3 = StreamFilter(Gate=bool_2, Stream0=gate.Target0, Stream1=pshift_7)
merge_2 = Merge(Data1=innercrvs, Data2=filter_3, Data3=outercrvs)

infill_curves = Curve(merge_2)
infill_curves_2 = ClusterOutput(infill_curves)

# ==== cluster ConfigSetting: If an individual specific setting is input in S, it will be returned. Otherwise the config (C) setting, matching the input ID will be passed. The ID is an integer matching the branch number of the desired setting. The returned setting will have the data structure matching the input ID. Is anything other than a Xylinus Config is input to C, that data will simply be passed to S.
config = ClusterInput()
setting_number = ClusterInput()  # input an integer matching the branch number of the desired setting.
data = Data(config)
int = Integer(setting_number)

# ---- group: is it a config?
branch = TreeBranch(Tree=data, Path="{0}", MaintainPaths=True)
tmatch = MatchText(Text=branch, RegEx="config", Case=False)
int_2 = Integer(tmatch)
null = NullItem(Item=int_2)  # -> NullFlags, InvalidFlags, Description
filter = StreamFilter(Gate=null.NullFlags, Stream0=int_2, Stream1=0)

# ----
path = ConstructPath(Indices=int)

# ---- group: if so, pull the requested setting
branch_2 = TreeBranch(Tree=data, Path=path, MaintainPaths=True)

# ---- group: otherwise, just pass the input data
filter_2 = StreamFilter(Gate=filter, Stream0=data, Stream1=branch_2)
data_2 = Data(filter_2)

# ---- group: if something is passed in the Setting, use that value.
setting = ClusterInput()  # Individual specific setting. Will override the config setting.
data_3 = Data(setting)
null_coalescing = NullCoalescing(primary_data=data_3, secondary_data=data_2)

# ---- group: make the data structure match what is expected from the input
replace = ReplacePaths(Data=flatten(null_coalescing), Search="{0}", Replace=path)
setting_2 = ClusterOutput(replace)

# ==== cluster TrimTo: Trim the branches of a tree to a target length.
branch_depth = ClusterInput()  # The target branch depth. A flat terr is 0. {0} is one. {0;0} is two. etc.
data_to_trim = ClusterInput()
int = Integer(branch_depth)
data = Data(data_to_trim)
tstat = TreeStatistics(Tree=data)  # -> Paths, Length, Count
F = ClusterInput()
trim_front = Boolean(F)
split = TextSplit(Text=tstat.Paths, Separators="{;}")
empty = Text("")
mindex = MemberIndex(Set=split, Member=empty)  # -> Index, Count
cull_i = CullIndex(List=split, Indices=mindex.Index, Wrap=True)
dom = ConstructDomain(DomainStart=0, DomainEnd=expr("x-1", int))

lng = ListLength(List=cull_i)
subtraction = Subtraction(A=lng, B=int)

max = Maximum(A=0, B=subtraction)

dom_2 = ConstructDomain(DomainStart=max, DomainEnd=expr("x-1", lng))

filter = StreamFilter(Gate=trim_front, Stream0=dom, Stream1=dom_2)
subset = SubList(List=cull_i, Domain=filter, Wrap=False)  # -> List, Index
path = ConstructPath(Indices=subset.List)  # -> flatten(Branch)
replace = ReplacePaths(Data=data, Search=tstat.Paths, Replace=path)
D = ClusterOutput(replace)

# ==== cluster NullCoalescing: Passes the primary data input, unless it is null. In which case it passes the secondary data input to the output. (Like the ?? operator in C#)
primary_data = ClusterInput()  # If this input is not null, it will be passed tot he output.
secondary_data = ClusterInput()  # If the input to the primary data is null, this will be passed to the output.
data = Data(primary_data)
data_2 = Data(secondary_data)
null = NullItem(Item=data)  # -> NullFlags, InvalidFlags, Description
filter = StreamFilter(Gate=null.NullFlags, Stream0=data, Stream1=data_2)
data_3 = Data(filter)
data_4 = ClusterOutput(data_3)
