# Grasshopper definition DDU_Clay3DPrinting_Simulator.gh (Grasshopper 1.0.8)

# DEPENDENCIES: DEPENDENCIES:
# 
# - Clipper2GH Components
#   https://www.food4rhino.com/en/app/clipper2gh
panel = Panel("\"C:\\Users\\EFESTWIN\\NEXTCLOUD_FB15\\fg-ddu_intern\\FG_Lehre\\2025_SoSe\\2_STUDIO\\06_WORK\\04_PREPARATION_EXAMPLES\\250422_TestPrints_B3_C9\\B3 Gcode.gcode\"")
panel_2 = Panel("\"C:\\Users\\EFESTWIN\\NEXTCLOUD_FB15\\fg-ddu_intern\\FG_Lehre\\2025_SoSe\\2_STUDIO\\06_WORK\\04_PREPARATION_EXAMPLES\\250422_TestPrints_B3_C9\\c9 gcode.gcode\"")

sample_gcode_path = Panel("..\resources\SampleGcode.gcode")
file_input = Data("\"C:\\Users\\EFESTWIN\\Desktop\\FGPG_TST_01.gcode\"")
selectgcodefile = Python3Script(FilePath=file_input, SampleGcodeFilePath=sample_gcode_path)  # -> SFP; inputs FilePath: String, SampleGcodeFilePath: String
# ---------- selectgcodefile: Python ----------
import os

import System
import Rhino
import Grasshopper

class ReadGCODEFile(Grasshopper.Kernel.GH_ScriptInstance):
    def RunScript(self, FilePath: str, SampleGcodeFilePath: str):
        if FilePath.startswith('"'):
                FilePath = FilePath[1:]
        if FilePath.endswith('"'):
            FilePath = FilePath[:-1]
        if os.path.isfile(os.path.normpath(FilePath)):
            SFP = FilePath
        else:
            if SampleGcodeFilePath:
                grasshopper_document = ghenv.Component.OnPingDocument()
                gh_dir = os.path.dirname(grasshopper_document.FilePath)
                SampleGcodeFilePath = os.path.normpath(os.path.abspath(os.path.join(gh_dir, SampleGcodeFilePath)))
            SFP = SampleGcodeFilePath
        
        return SFP
# ---------- end selectgcodefile ----------
file_input_2 = FilePath(selectgcodefile)

enable_print_simulation = BooleanToggle(True)
show_printer = BooleanToggle(True)
visprintingprogress = Slider(100, range=0..100)

# ----
# PRINTING TIME APPROXIMATION
comments_notes = Panel("PRINTING TIME APPROXIMATION")

gcode_input = Data(file_input_2)
file = ReadFile(File=gcode_input, PerLineParse=True)
gcode = Data(file)

# ----
# GCODE PARSING & GCODE GEOMETRY
# comments & notes: COMPUTE GCODE GEOMETRY FOR VISUALISATION
gcode_2 = Data(gcode)
parsegcode = ParseGCODE(GCODE=gcode_2)  # -> PrintSpeed, TravelSpeed, RetractionSpeed, ExtrusionRate, LayerHeight, LineWidth, G, X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; inputs GCODE: list of String
# ---------- parsegcode: C# ----------
// Grasshopper Script Instance
#region Usings
using System;
using System.Linq;
using System.Collections;
using System.Collections.Generic;
using System.Drawing;
using System.Text.RegularExpressions;

using Rhino;
using Rhino.Geometry;

using Grasshopper;
using Grasshopper.Kernel;
using Grasshopper.Kernel.Data;
using Grasshopper.Kernel.Types;
#endregion

public class Script_Instance : GH_ScriptInstance
{
    #region Notes
    /* 
      Members:
        RhinoDoc RhinoDocument
        GH_Document GrasshopperDocument
        IGH_Component Component
        int Iteration

      Methods (Virtual & overridable):
        Print(string text)
        Print(string format, params object[] args)
        Reflect(object obj)
        Reflect(object obj, string method_name)
    
    Author: Max Benjamin Eschenbach
    License: MIT License
    Version: 2504152
    */
    #endregion

    private void RunScript(
		List<string> GCODE,
		ref object PrintSpeed,
		ref object TravelSpeed,
		ref object RetractionSpeed,
		ref object ExtrusionRate,
		ref object LayerHeight,
		ref object LineWidth,
		ref object G,
		ref object X,
		ref object Y,
		ref object Z,
		ref object E,
		ref object F)
    {
        // set component params
        this.Component.Name = "ParseGCODE";
        this.Component.NickName = "ParseGCODE";
        this.Component.Category = "DDUClayPrintingSlicer";
        this.Component.SubCategory = "7 GCODE";

        DataTree<double> _PrintSpeed = new DataTree<double>();
        DataTree<double> _TravelSpeed = new DataTree<double>();
        DataTree<double> _RetractionSpeed = new DataTree<double>();
        DataTree<double> _ExtrusionRate = new DataTree<double>();
        DataTree<double> _LayerHeight = new DataTree<double>();
        DataTree<double> _LineWidth = new DataTree<double>();

        List<string> _G = new List<string>();
        List<double> _X = new List<double>();
        List<double> _Y = new List<double>();
        List<double> _Z = new List<double>();
        List<double> _E = new List<double>();
        List<double> _F = new List<double>();

        if (GCODE == null)
        {
            this.AddRuntimeMessage(
                GH_RuntimeMessageLevel.Warning,
                "Input Parameter GCODE failed to collect Data!"
            );
            PrintSpeed = _PrintSpeed;
            TravelSpeed = _TravelSpeed;
            RetractionSpeed = _RetractionSpeed;
            ExtrusionRate = _ExtrusionRate;
            LayerHeight = _LayerHeight;
            LineWidth = _LineWidth;
            G = _G;
            X = _X;
            Y = _Y;
            Z = _Z;
            E = _E;
            F = _F;
            return;
        }

        // Temporary Variables
        double Ztemp = 0.0;
        double Etemp = 0.0;
        double Ftemp = 0.0;

        // Regex Definitions
        Regex re_colon_a = new Regex(" ;");
        Regex re_colon_b = new Regex(" |;");
        Regex re_colon_c = new Regex("=");

        // Define Invariant Culture
        var cult = System.Globalization.CultureInfo.InvariantCulture;

        for (int i = 0; i < GCODE.Count; i++)
        {
            // Define the current GCODE line
            string ln = GCODE[i];
            if (ln.StartsWith(";"))
            {
                // Detect Header
                if (ln.Contains("BEGIN_DDU_3DCLAYPRINTING_HEADER"))
                {
                    // READ HEADER INFORMATION, HEADER LOOKS LIKE THIS:
                    // ; --- BEGIN_DDU_3DCLAYPRINTING_HEADER ---
                    // ; PRINTSPEED=3000
                    // ; TRAVELSPEED=6000
                    // ; RETRACTIONSPEED=1500
                    // ; EXTRUSIONRATE=0.16
                    // ; LAYERHEIGHT=1.9
                    // ; LINEWIDTH=4
                    // ; --- END_DDU_3DCLAYPRINTING_HEADER ---
                    
                    // Process using RegEx patterns
                    _PrintSpeed.Add(double.Parse(re_colon_c.Split(re_colon_b.Split(re_colon_a.Split(GCODE[i + 1])[0])[2])[1], cult));
                    _TravelSpeed.Add(double.Parse(re_colon_c.Split(re_colon_b.Split(re_colon_a.Split(GCODE[i + 2])[0])[2])[1], cult));
                    _RetractionSpeed.Add(double.Parse(re_colon_c.Split(re_colon_b.Split(re_colon_a.Split(GCODE[i + 3])[0])[2])[1], cult));
                    _ExtrusionRate.Add(double.Parse(re_colon_c.Split(re_colon_b.Split(re_colon_a.Split(GCODE[i + 4])[0])[2])[1], cult));
                    _LayerHeight.Add(double.Parse(re_colon_c.Split(re_colon_b.Split(re_colon_a.Split(GCODE[i + 5])[0])[2])[1], cult));
                    _LineWidth.Add(double.Parse(re_colon_c.Split(re_colon_b.Split(re_colon_a.Split(GCODE[i + 6])[0])[2])[1], cult));
                }
                continue;
            }
            else if (ln.StartsWith("G0") || ln.StartsWith("G1"))
            {
                if (ln.Contains("X") && ln.Contains("Y"))
                {
                    _G.Add(ln.Substring(1, 1));
                }
                else
                {
                    continue;
                }
                // Split Line into parts using RegEx template
                string[] preparts = re_colon_a.Split(ln);
                string[] parts = re_colon_b.Split(preparts[0]);
                // loop over all string parts
                for (int j = 0; j < parts.Length; j++)
                {
                    string part = parts[j];

                    // catch X values
                    if (part.StartsWith("X")) _X.Add(double.Parse(part.Substring(1), cult));

                    // catch Y values
                    if (part.StartsWith("Y")) _Y.Add(double.Parse(part.Substring(1), cult));

                    // catch Z values
                    if (part.StartsWith("Z"))
                    {
                        double Zval = double.Parse(part.Substring(1), cult);
                        _Z.Add(Zval);
                        Ztemp = Zval;
                    }

                    // catch E values
                    if (part.StartsWith("E"))
                    {
                        double Eval = double.Parse(part.Substring(1), cult);
                        _E.Add(Eval);
                        Etemp = Eval;
                    }

                    // catch F values
                    if (part.StartsWith("F"))
                    {
                        double Fval = double.Parse(part.Substring(1), cult);
                        _F.Add(Fval);
                        Ftemp = Fval;
                    }
                }
                // catch missing Z values
                if (ln.Contains("X") && ln.Contains("Y") && !ln.Contains("Z")) _Z.Add(Ztemp);

                // catch missing E values
                if (!ln.Contains("E")) _E.Add(Etemp);

                // catch missing F values
                if (!ln.Contains("F")) _F.Add(Ftemp);
            }
            else
            {
                // Print(ln);
            }
        }
        PrintSpeed = _PrintSpeed;
        TravelSpeed = _TravelSpeed;
        RetractionSpeed = _RetractionSpeed;
        ExtrusionRate = _ExtrusionRate;
        LayerHeight = _LayerHeight;
        LineWidth = _LineWidth;
        G = _G;
        X = _X;
        Y = _Y;
        Z = _Z;
        E = _E;
        F = _F;
    }
}
# ---------- end parsegcode ----------
vis_printing_progress = Data(visprintingprogress)
printspeed = Data(parsegcode.PrintSpeed)
travelspeed = Data(parsegcode.TravelSpeed)
retractionspeed = Data(parsegcode.RetractionSpeed)
extrusionrate = Data(parsegcode.ExtrusionRate)
layerheight = Data(parsegcode.LayerHeight)
linewidth = Data(parsegcode.LineWidth)
pt = ConstructPoint(XCoordinate=parsegcode.X, YCoordinate=parsegcode.Y, ZCoordinate=parsegcode.Z)
retractioncolor = ColourSwatch(SwatchColor=RGB(68, 194, 0))
extrusioncolor = ColourSwatch(SwatchColor=RGB(255, 94, 0))
travelcolor = ColourSwatch(SwatchColor=RGB(0, 85, 255))
classifygcodemovements = ClassifyGCODEMovements(
    ProgressPercentage=vis_printing_progress,
    Points=pt,
    E=parsegcode.E,
    ExtrusionColor=extrusioncolor,
    TravelColor=travelcolor,
    RetractionColor=retractioncolor)  # -> MoveLines, MoveLinesProg, Colors, ColorsProg, PrintLines, PrintPolyLines; inputs ProgressPercentage: Double, Points: list of Point3d, E: list of Double, ExtrusionColor: Color, TravelColor: Color, RetractionColor: Color
# ---------- classifygcodemovements: C# ----------
// Grasshopper Script Instance
#region Usings
using System;
using System.Linq;
using System.Collections;
using System.Collections.Generic;
using System.Drawing;

using Rhino;
using Rhino.Geometry;

using Grasshopper;
using Grasshopper.Kernel;
using Grasshopper.Kernel.Data;
using Grasshopper.Kernel.Types;
#endregion

public class Script_Instance : GH_ScriptInstance
{

    #region Notes
    /* 
        Members:
        RhinoDoc RhinoDocument
        GH_Document GrasshopperDocument
        IGH_Component Component
        int Iteration

        Methods (Virtual & overridable):
        Print(string text)
        Print(string format, params object[] args)
        Reflect(object obj)
        Reflect(object obj, string method_name)
    
    Author: Max Benjamin Eschenbach
    License: MIT License
    Version: 250415
    */
    #endregion

    private void RunScript(
		double ProgressPercentage,
		List<Point3d> Points,
		List<double> E,
		Color ExtrusionColor,
		Color TravelColor,
		Color RetractionColor,
		ref object MoveLines,
		ref object MoveLinesProg,
		ref object Colors,
		ref object ColorsProg,
		ref object PrintLines,
		ref object PrintPolyLines)
    {
        // set component params
        this.Component.Name = "ClassifyGCODEMovements";
        this.Component.NickName = "ClassifyGCODEMovements";
        this.Component.Category = "DDUClayPrintingSlicer";
        this.Component.SubCategory = "7 GCODE";

        List<LineCurve> _MoveLines = new List<LineCurve>();
        List<LineCurve> _MoveLinesProg = new List<LineCurve>();
        List<LineCurve> _PrintLines = new List<LineCurve>();
        List<System.Drawing.Color> _Colors = new List<System.Drawing.Color>();
        List<System.Drawing.Color> _ColorsProg = new List<System.Drawing.Color>();
        List<Polyline> _PrintPolyLines = new List<Polyline>();

        if (Points == null || E == null)
        {
            if (Points == null){
                this.Component.AddRuntimeMessage(
                    GH_RuntimeMessageLevel.Warning,
                    "Input Parameter Points failed to collect Data!"
                );
            }
            if (E == null)
            {
                this.Component.AddRuntimeMessage(
                    GH_RuntimeMessageLevel.Warning,
                    "Input Parameter E failed to collect Data!"
                );
            }
            MoveLines = _MoveLines;
            MoveLinesProg = _MoveLinesProg;
            Colors = _Colors;
            ColorsProg = _ColorsProg;
            PrintLines = _PrintLines;
            PrintPolyLines = _PrintPolyLines;
            return;
        }
        if (ExtrusionColor == null) ExtrusionColor = System.Drawing.Color.OrangeRed;
        if (TravelColor == null) TravelColor = System.Drawing.Color.SkyBlue;
        if (RetractionColor == null) RetractionColor = System.Drawing.Color.Green;

        Polyline pl_temp = new Polyline();

        int SplitIndex = (int) Math.Round((ProgressPercentage / 100.0) * Points.Count, 0);

        for (int i = 0; i < Points.Count - 1; i++)
        {
        // construct line curve
        LineCurve ln = new LineCurve(Points[i], Points[i + 1]);
        _MoveLines.Add(ln);

        if (i < SplitIndex) { _MoveLinesProg.Add(ln); }

        // set flags
        bool travel = E[i + 1] == 0 || E[i] == E[i + 1];
        bool retract = E[i + 1] < E[i];
        bool approach = E[i] == 0 && E[i + 1] > 0;

        // evaluate flags
        if (travel || approach)
        {
            _Colors.Add(TravelColor);
            if (i < SplitIndex) { _ColorsProg.Add(TravelColor); }

            // finish print polyline if it has at least two vertices
            if (pl_temp.Count > 1 && i <= SplitIndex)
            {
            _PrintPolyLines.Add(pl_temp.Duplicate());
            pl_temp = new Polyline();
            }
        }
        else if (retract)
        {
            _Colors.Add(RetractionColor);
            if (i < SplitIndex) { _ColorsProg.Add(RetractionColor); }

            // finish print polyline if it has at least two vertices
            if (pl_temp.Count > 1 && i <= SplitIndex)
            {
            _PrintPolyLines.Add(pl_temp.Duplicate());
            pl_temp = new Polyline();
            }
        }
        else
        {
            _Colors.Add(ExtrusionColor);
            if (i < SplitIndex) { _ColorsProg.Add(ExtrusionColor); }

            _PrintLines.Add(ln);

            // add points to print polyline
            if (i < SplitIndex)
            {
            if (pl_temp.Count == 0)
            {
                // add A point if this is the start of the PPL
                pl_temp.Add(Points[i]);
            }
            // always add B point
            pl_temp.Add(Points[i + 1]);
            }
        }

        // catch unfinished PPL and finalize it
        if (pl_temp.Count > 0 && i == Points.Count - 2)
        {
            _PrintPolyLines.Add(pl_temp.Duplicate());
            pl_temp = new Polyline();
        }

        MoveLines = _MoveLines;
        MoveLinesProg = _MoveLinesProg;
        Colors = _Colors;
        ColorsProg = _ColorsProg;
        PrintLines = _PrintLines;
        PrintPolyLines = _PrintPolyLines;
        }
    }

}
# ---------- end classifygcodemovements ----------
movelines_prog = Data(classifygcodemovements.MoveLinesProg)
printpolylines = Data(classifygcodemovements.PrintPolyLines)
colors_prog = Data(classifygcodemovements.ColorsProg)
movelines = Data(classifygcodemovements.MoveLines)
printlines = Data(classifygcodemovements.PrintLines)
colors = Data(classifygcodemovements.Colors)

# ----
# MATERIAL AMOUNT CALCULATION
# TESTED WEIGHT PARAMETERS: Intersecting Wall 937g
# Mirko Schlaufen 383g
# Vase 541g
line_width = Data(linewidth)
layer_height = Number(layerheight)
printing_curves = Geometry(printpolylines)
filletfactor = Slider(0.45, range=0..1)
dom = ConstructDomain(DomainStart=expr("x*-0.5", line_width), DomainEnd=expr("x*0.5", line_width))
dom_2 = ConstructDomain(DomainStart=expr("x*-0.5", layer_height), DomainEnd=expr("x*0.5", layer_height))
min = Minimum(A=line_width, B=layer_height)
len = Length(Curve=printing_curves)  # -> flatten(Length)
multiplication = Multiplication(A=min, B=filletfactor)
ma = MassAddition(Input=len)  # -> Result, PartialResults
rectangle = Rectangle(Plane=PlaneXY(0, 0, 0), XSize=dom, YSize=dom_2, Radius=multiplication)  # -> Rectangle, Length
area = Area(Geometry=rectangle.Rectangle)  # -> Area, Centroid
printing_curves_length_mm = Data(ma.Result)
print_profile_area_mm2 = Data(area.Area)
comments_notes_2 = Panel("MATERIAL AMOUNT CALCULATION")
multiplication_2 = Multiplication(A=printing_curves_length_mm, B=print_profile_area_mm2)
multiplication_3 = Multiplication(A=multiplication_2, B="0.001")
specific_weight_clay_in_g_cm3 = Panel("2.48")
addpercentage = Slider(0, range=0..100)
print_volume_mm3 = Data(multiplication_2)
print_volume_cm3 = Data(multiplication_3)
multiplication_4 = Multiplication(A=print_volume_cm3, B=specific_weight_clay_in_g_cm3)
num = Number(expr("x*0.01", addpercentage))
multiplication_5 = Multiplication(A=multiplication_4, B=num)
addition = Addition(A=multiplication_4, B=multiplication_5)
rtd = RoundToDecimal(Numbers=addition, DecimalPlaces="2")  # -> Rounded; inputs Numbers: list of Double, DecimalPlaces: list of Int32
# ---------- rtd: Python ----------
# PYTHON STANDARD LIBRARY IMPORTS
from __future__ import division, print_function

# GHPYTHONLIB SDK IMPORTS
import Grasshopper
import System
import Rhino

# GHENV COMPONENT SETTINGS
ghenv.Component.Name = "RoundToDecimal"
ghenv.Component.NickName = "RTD"
ghenv.Component.Category = "DDUClayPrintingSlicer"
ghenv.Component.SubCategory = "9 Utilities"

class RoundToDecimal(Grasshopper.Kernel.GH_ScriptInstance):
    """
    Author: Max Benjamin Eschenbach
    License: MIT License
    Version: 250314
    """

    def RunScript(self,
            Numbers: System.Collections.Generic.List[float],
            DecimalPlaces: System.Collections.Generic.List[int]):

        if not DecimalPlaces:
            DecimalPlaces = [0]

        if Numbers and Numbers != [None]:
            rounded = []
            for i, num in enumerate(Numbers):
                # retrieve decimalplaces
                if i < len(DecimalPlaces):
                    dp = DecimalPlaces[i]
                else:
                    dp = DecimalPlaces[-1]
                # round number
                rounded.append(round(num, dp))
        else:
            rounded = Grasshopper.DataTree[object]()

        # return outputs if you have them; here I try it for you:
        return rounded
# ---------- end rtd ----------
print_weight_in_g = Panel(rtd)
format = Format(Format="[INFO] Approximate Material Weight is {0} g.", Culture=127, Data0=rtd)
info_approximate_print_weight = Data(format)
approximate_print_weight = Data(rtd)

# ----
# comments & notes: sum lengths of moves and divide by print speed, also multiply with a correction factor (tested experimentally)
print_speed_mm_min = Data(printspeed)
printing_time_correction_factor = Slider(1.45, range=0..2)
movelines_2 = Data(movelines)
null = NullItem(Item=movelines_2)  # -> NullFlags, InvalidFlags, Description
lng = ListLength(List=movelines_2)
equals = Equality(FirstNumber=lng, SecondNumber="0")  # -> Equality, Inequality
ma_2 = MassAddition(Input=[null.NullFlags, null.InvalidFlags])  # -> Result, PartialResults
or = GateOr(A=ma_2.Result, C=equals.Equality)
movelines_null = Data(or)
filter = StreamFilter(Gate=movelines_null, Stream0=movelines_2)
len_2 = Length(Curve=filter)
ma_3 = MassAddition(Input=len_2)  # -> Result, PartialResults
division = Division(A=ma_3.Result, B=print_speed_mm_min)
filter_2 = StreamFilter(Gate=movelines_null, Stream0=printing_time_correction_factor)
multiplication_6 = Multiplication(A=division, B=filter_2)
rtd_2 = RoundToDecimal(Numbers=multiplication_6, DecimalPlaces="2")  # -> Rounded; inputs Numbers: list of Double, DecimalPlaces: list of Int32
# ---------- rtd_2: Python ----------
# PYTHON STANDARD LIBRARY IMPORTS
from __future__ import division, print_function

# GHPYTHONLIB SDK IMPORTS
import Grasshopper
import System
import Rhino

# GHENV COMPONENT SETTINGS
ghenv.Component.Name = "RoundToDecimal"
ghenv.Component.NickName = "RTD"
ghenv.Component.Category = "DDUClayPrintingSlicer"
ghenv.Component.SubCategory = "9 Utilities"

class RoundToDecimal(Grasshopper.Kernel.GH_ScriptInstance):
    """
    Author: Max Benjamin Eschenbach
    License: MIT License
    Version: 250423
    """

    def RunScript(self,
            Numbers: System.Collections.Generic.List[float],
            DecimalPlaces: System.Collections.Generic.List[int]):
        
        if not DecimalPlaces:
            DecimalPlaces = [0]
        else:
            DecimalPlaces = list(DecimalPlaces)

        if Numbers and Numbers != [None]:
            rounded = []
            for i, num in enumerate(Numbers):
                # retrieve decimalplaces
                if i < len(DecimalPlaces):
                    dp = DecimalPlaces[i]
                else:
                    dp = DecimalPlaces[-1]
                # round number
                rounded.append(round(num, dp))
        else:
            rounded = Grasshopper.DataTree[object]()

        # return outputs if you have them; here I try it for you:
        return rounded
# ---------- end rtd_2 ----------
approximate_printing_time_in_minutes = Panel(rtd_2)
approximate_print_time = Data(rtd_2)

# ----
# comments & notes: CONSTRUCT WASP40100
# FOR PRINT SIM / VIS
# CONSTRUCT WASP40100
# FOR PRINT SIMULATION / VIS
wasp_40100_printing_diameter = Slider(400, range=0..1000)
wasp40100_arm_length = Slider(350, range=0..1500)
movelines_prog_2 = Data(movelines_prog)
item = ListItem(List=movelines_prog_2, Index=0, Wrap=True)  # -> Item1, Item
end = EndPoints(Curve=item.Item1)  # -> Start, End
vec = Vector(Vector(0, 0, 0))
enable_print_simulation_2 = Data(enable_print_simulation)
layer_height_2 = Number(layerheight)
wasp_40100_printing_diameter_2 = Data(wasp_40100_printing_diameter)
wasp40100_arm_length_2 = Data(wasp40100_arm_length)
gcode_last_pt = Data(end.End)
gcode_vis_offset_vector = Data(vec)
constructwasp40100printer = ConstructWASP40100Printer(
    enable_print_simulation=enable_print_simulation_2,
    layer_height=layer_height_2,
    wasp_40100_printing_diameter=wasp_40100_printing_diameter_2,
    wasp40100_arm_length=wasp40100_arm_length_2,
    gcode_last_pt=gcode_last_pt,
    gcode_vis_offset_vector=gcode_vis_offset_vector)  # -> wasp40100_printing_area_srf_3, wasp40100_nozzle_bot_3, wasp40100_nozzle_transition_3, wasp40100_nozzle_toppart_3, wasp40100_extrudermount_srf_3, wasp40100_ldm_extruderbody_3, wasp40100_z_axis_crvs_4, wasp40100_arm_crv_3
wasp40100_extrudermount_srf = Data(constructwasp40100printer.wasp40100_extrudermount_srf_3)
wasp40100_ldm_extruderbody = Data(constructwasp40100printer.wasp40100_ldm_extruderbody_3)
wasp40100_nozzle_transition = Data(constructwasp40100printer.wasp40100_nozzle_transition_3)
wasp40100_printing_area_srf = Data(constructwasp40100printer.wasp40100_printing_area_srf_3)
wasp40100_nozzle_toppart = Data(constructwasp40100printer.wasp40100_nozzle_toppart_3)
wasp40100_nozzle_bot = Data(constructwasp40100printer.wasp40100_nozzle_bot_3)
wasp40100_z_axis_crvs = Data(constructwasp40100printer.wasp40100_z_axis_crvs_4)
wasp40100_arm_crv = Data(constructwasp40100printer.wasp40100_arm_crv_3)

# ----
# comments & notes: compute hours, minutes and seconds for formatting print time
approximate_print_time_2 = Data(approximate_print_time)
division_2 = Division(A=approximate_print_time_2, B="60")
round = Round(Number=division_2)  # -> Nearest, Floor, Ceiling
subtraction = Subtraction(A=division_2, B=round.Floor)
multiplication_7 = Multiplication(A=subtraction, B="60")
round_2 = Round(Number=multiplication_7)  # -> Nearest, Floor, Ceiling
subtraction_2 = Subtraction(A=multiplication_7, B=round_2.Floor)
multiplication_8 = Multiplication(A=subtraction_2, B="60")
round_3 = Round(Number=multiplication_8)  # -> Nearest, Floor, Ceiling
print_time_seconds = Data(round_3.Floor)
print_time_minutes = Data(round_2.Floor)
print_time_hours = Data(round.Floor)

# ----
# GCODE MOVES VISUALIZATION
vec_2 = Vector(Vector(0, 0, 0))
gcode_vis_offset_vector_2 = Data(vec_2)
enable_print_simulation_3 = Data(enable_print_simulation)
movelines_progvis = Data(movelines_prog)
comments_notes_3 = Panel("GCODE MOVES VISUALISATION")
colors_progvis = Data(colors_prog)
filter_3 = StreamFilter(Gate=enable_print_simulation_3, Stream0=movelines_progvis)
filter_4 = StreamFilter(Gate=enable_print_simulation_3, Stream0=colors_progvis)
move = Move(Geometry=filter_3, Motion=gcode_vis_offset_vector_2)  # -> Geometry, Transform
curvepreviewlw = CurvePreviewLW(Curves=move.Geometry, Colors=filter_4, Thickness=Slider(3, range=0..10))  # inputs Curves: list of Curve, Colors: list of Color, Thickness: list of Int32
# ---------- curvepreviewlw: C# ----------
#region Usings
using System;
using System.Linq;
using System.Collections;
using System.Collections.Generic;
using System.Drawing;

using Rhino;
using Rhino.Geometry;

using Grasshopper;
using Grasshopper.Kernel;
using Grasshopper.Kernel.Data;
using Grasshopper.Kernel.Types;
#endregion

public class Script_Instance : GH_ScriptInstance
{
    #region Notes
    /* 
      Members:
        RhinoDoc RhinoDocument
        GH_Document GrasshopperDocument
        IGH_Component Component
        int Iteration

      Methods (Virtual & overridable):
        Print(string text)
        Print(string format, params object[] args)
        Reflect(object obj)
        Reflect(object obj, string method_name)

        Author: Max Benjamin Eschenbach
        License: MIT License
        Version: 250314
    */
    #endregion

    List<Curve> drawCurves;
    List<Color> drawColors;
    List<int> drawThickness;

    private void RunScript(
		List<Curve> Curves,
		List<Color> Colors,
		List<int> Thickness)
    {
        // set component params
        this.Component.Name = "CurvePreviewLW";
        this.Component.NickName = "CurvePreviewLW";
        this.Component.Category = "DDUClayPrintingSlicer";
        this.Component.SubCategory = "8 Visualisation";

        this.drawCurves = new List<Curve>();   
        this.drawColors = new List<Color>();
        this.drawThickness = new List<int>();

        if (Curves == null) return;
        if (Colors == null) this.drawColors = new List<Color>{Color.Black};
        else this.drawColors = Colors;

        if (Thickness == null) this.drawThickness = new List<int>{1};
        else this.drawThickness = Thickness;

        for (int i = 0; i < Curves.Count; i++)
        {
            if (Curves[i] != null)
            {
                this.drawCurves.Add(Curves[i]);
            }
            else
            {
                continue;
            }
            if (Colors == null || i >= Colors.Count || Colors[i] == null)
            {
                this.drawColors.Add(drawColors.Last());
            }
            else
            {
                this.drawColors.Add(Colors[i]);
            }
            if (Thickness == null || i >= Thickness.Count || Thickness[i] == null)
            {
                this.drawThickness.Add(drawThickness.Last());
            }
            else
            {
                this.drawThickness.Add(Thickness[i]);
            }
        }
    }

    override public void DrawViewportWires(IGH_PreviewArgs args)
    {
        if (this.drawCurves != null)
        {
            try
            {
                for (int i = 0; i < this.drawCurves.Count; i++)
                {
                    args.Display.DrawCurve(
                        this.drawCurves[i],
                        this.drawColors[i],
                        this.drawThickness[i]
                    );
                }
                
            }
            catch (Exception e)
            {
                this.AddRuntimeMessage(GH_RuntimeMessageLevel.Warning, "Error while drawing Preview!");
                this.Print(e.ToString());
            }
        }
        else
        {
            return;
        }
    }
}
# ---------- end curvepreviewlw ----------

# ----
# WASP40100 PRINTHEAD VIS
extrudermount_srf = Data(wasp40100_extrudermount_srf)
nozzle_bot = Data(wasp40100_nozzle_bot)
nozzle_transition = Data(wasp40100_nozzle_transition)
nozzle_toppart = Data(wasp40100_nozzle_toppart)
wasp40100_ldm_extruderbody_2 = Data(wasp40100_ldm_extruderbody)
show_printer_2 = Data(show_printer)
comments_notes_4 = Panel("WASP40100 PRINTHEAD VIS")
merge = Merge(
    Data1=nozzle_bot,
    Data2=nozzle_transition,
    Data3=nozzle_toppart,
    Data4=extrudermount_srf,
    Data5=wasp40100_ldm_extruderbody_2)  # -> flatten(Result)
filter_5 = StreamFilter(Gate=show_printer_2, Stream1=merge)
preview = CustomPreview(Geometry=filter_5, Material=ColourSwatch(SwatchColor=RGB(184, 184, 184)))

# ----
# PRINTING SIM & MESH
# VISUALIZATION OF GCODE PATHS
# comments & notes: PRINTING SIM & MESH VISUALIZATION OF GCODE PATHS
vec_3 = Vector(Vector(0, 0, 0))
gcode_vis_offset_vector_3 = Data(vec_3)
enable_print_simulation_4 = Data(enable_print_simulation)
printpolylines_progvis = Data(printpolylines)
filter_6 = StreamFilter(Gate=enable_print_simulation_4, Stream1=printpolylines_progvis)
move_2 = Move(Geometry=filter_6, Motion=gcode_vis_offset_vector_3)  # -> Geometry, Transform
redpline = Reduce(Polyline=move_2.Geometry, Tolerance=Slider(0.1, range=0..1))  # -> Polyline, Reduction
divlength = DivideLength(Curve=reparameterize(flatten(redpline.Polyline)), Length=Slider(200, range=0..1000))  # -> Points, Tangents, Parameters
shatter = Shatter(Curve=reparameterize(graft(redpline.Polyline)), Parameters=divlength.Parameters)  # -> flatten(Segments)
subsegments = Slider(10, range=0..100)
accuracy = Slider(1, range=0..1)
line_width_2 = Data(linewidth)
capstyle = Slider(3, range=0..3)
multiplication_9 = Multiplication(A=line_width_2, B="0.5")
meshpipe = MeshPipe(Curves=shatter, Radius=multiplication_9, SubSegments=subsegments, Accuracy=accuracy, CapStyle=capstyle)  # -> MeshPipes; inputs Curves: list of Curve, Radius: Double, SubSegments: Int32, Accuracy: Int32, CapStyle: Int32
# ---------- meshpipe: C# ----------
#region Usings
using System;
using System.Linq;
using System.Collections;
using System.Collections.Generic;
using System.Collections.Concurrent;
using System.Drawing;
using System.Threading.Tasks;

using Rhino;
using Rhino.Geometry;

using Grasshopper;
using Grasshopper.Kernel;
using Grasshopper.Kernel.Data;
using Grasshopper.Kernel.Types;
#endregion

public class Script_Instance : GH_ScriptInstance
{
    #region Notes
    /* 
      Members:
        RhinoDoc RhinoDocument
        GH_Document GrasshopperDocument
        IGH_Component Component
        int Iteration

      Methods (Virtual & overridable):
        Print(string text)
        Print(string format, params object[] args)
        Reflect(object obj)
        Reflect(object obj, string method_name)

    Author: Max Benjamin Eschenbach
    License: MIT License
    Version: 250314
    */
    #endregion

  private void RunScript(
		List<Curve> Curves,
		double Radius,
		int SubSegments,
		int Accuracy,
		int CapStyle,
		ref object MeshPipes)
  {
    // set component params
    this.Component.Name = "MeshPipe";
    this.Component.NickName = "MeshPipe";
    this.Component.Category = "DDUClayPrintingSlicer";
    this.Component.SubCategory = "8 Visualisation";

    ConcurrentBag<Mesh> MeshPipesBag = new ConcurrentBag<Mesh>();
    MeshPipeCapStyle mpcs = (MeshPipeCapStyle) CapStyle;

    if (Curves == null)
    {
        MeshPipes = new DataTree<object>();
        return;
    }

    if (Curves.Count > 20)
    {
      // create pipes in parallel
      Parallel.For(0, Curves.Count,
        i => {
        // create mesh pipe
        Mesh MeshPipe = Mesh.CreateFromCurvePipe(Curves[i], Radius, SubSegments, Accuracy, mpcs, true);
        // add to tree
        MeshPipesBag.Add(MeshPipe);
        });
    }
    else
    {
      // create pipes sequential
      for (int i = 0; i < Curves.Count; i++)
      {
        // create mesh pipe
        Mesh mp = Mesh.CreateFromCurvePipe(Curves[i], Radius, SubSegments, Accuracy, mpcs, true);
        // add to tree
        MeshPipesBag.Add(mp);
      }
    }
    MeshPipes = MeshPipesBag.ToArray();
  }

}
# ---------- end meshpipe ----------
preview_2 = CustomPreview(Geometry=meshpipe, Material=ColourSwatch(SwatchColor=RGB(230, 230, 230)))

# ----
# WASP40100 PRINT AREA
comments_notes_5 = Panel("WASP40100 PRINT AREA")
wasp40100_printing_area_srf_2 = Data(wasp40100_printing_area_srf)
show_printer_3 = Data(show_printer)
filter_7 = StreamFilter(Gate=show_printer_3, Stream1=wasp40100_printing_area_srf_2)
preview_3 = CustomPreview(Geometry=filter_7, Material=ColourSwatch(SwatchColor=RGB(227, 227, 227)))

# ----
# WASP40100 ARM VIS
wasp40100_z_axis_crvs_2 = Data(wasp40100_z_axis_crvs)  # disabled
wasp40100_arm_crv_2 = Data(wasp40100_arm_crv)
subsegments_2 = Slider(10, range=0..100)
accuracy_2 = Slider(1, range=0..1)
wasp40100_arm_crv_3 = Data(wasp40100_arm_crv)
show_printer_4 = Data(show_printer)
capstyle_2 = Slider(3, range=0..3)
comments_notes_6 = Panel("WASP40100 ARM VIS")
merge_2 = Merge(Data1=wasp40100_z_axis_crvs_2, Data2=wasp40100_arm_crv_2)  # -> flatten(Result)
filter_8 = StreamFilter(Gate=show_printer_4, Stream1=wasp40100_arm_crv_3)
filter_9 = StreamFilter(Gate=show_printer_4, Stream1=merge_2)
meshpipe_2 = MeshPipe(Curves=filter_8, Radius=Slider(4, range=0..10), SubSegments=subsegments_2, Accuracy=accuracy_2, CapStyle=capstyle_2)  # -> MeshPipes; inputs Curves: list of Curve, Radius: Double, SubSegments: Int32, Accuracy: Int32, CapStyle: Int32; same code as meshpipe
curvepreviewlw_2 = CurvePreviewLW(Curves=filter_9, Colors=ColourSwatch(SwatchColor=RGB(191, 191, 191)), Thickness=Slider(2, range=0..10))  # inputs Curves: list of Curve, Colors: list of Color, Thickness: list of Int32; same code as curvepreviewlw
preview_4 = CustomPreview(Geometry=meshpipe_2, Material=ColourSwatch(SwatchColor=RGB(191, 191, 191)))

# ----
# comments & notes: format print time and create info message
print_time_minutes_2 = Data(print_time_minutes)
print_time_seconds_2 = Data(print_time_seconds)
print_time_hours_2 = Data(print_time_hours)
printingtimeinfo = PrintingTimeInfo(Hours=print_time_hours_2, Minutes=print_time_minutes_2, Seconds=print_time_seconds_2)  # -> InfoString; inputs Hours: Int32, Minutes: Int32, Seconds: Int32
# ---------- printingtimeinfo: Python ----------
import System
import Rhino
import Grasshopper
import rhinoscriptsyntax as rs

# GHENV COMPONENT SETTINGS
ghenv.Component.Name = "PrintingTimeInfo"
ghenv.Component.NickName = "PrintingTimeInfo"
ghenv.Component.Category = "DDUClayPrintingSlicer"
ghenv.Component.SubCategory = "9 Utilities"


class PrintingTimeInfo(Grasshopper.Kernel.GH_ScriptInstance):
    """
    Author: Max Benjamin Eschenbach
    License: MIT License
    Version: 250411
    """
    def RunScript(self, Hours: int, Minutes: int, Seconds: int):
        InfoString = ''
        if Hours and Hours > 0:
            InfoString += '{0} hours'
        if Minutes and Minutes > 0:
            if Hours and Hours > 0:
                InfoString += ', '
            InfoString += '{1} minutes'
        if Seconds and Seconds > 0:
            if (Hours and Hours > 0) or (Minutes and Minutes > 0):
                InfoString += ', '
            InfoString += '{2} seconds'
        InfoString += '.'
        return InfoString
# ---------- end printingtimeinfo ----------
movelines_null_2 = Data(movelines_null)
concat = Concatenate(FragmentA="[INFO] Approximate Printing Time is ", FragmentB=printingtimeinfo)
filter_10 = StreamFilter(Gate=movelines_null_2, Stream0=concat)
format_2 = Format(Format=filter_10, Culture=127, Data0=print_time_hours_2, Data1=print_time_minutes_2, Data2=print_time_seconds_2)
info_approximate_print_time = Data(format_2)

approximate_printing_time_in_minutes_2 = Panel(info_approximate_print_time)
# EXPERIMENTAL SLICER SETUP FOR CLAY PRINTING: Author: Max Benjamin Eschenbach
# Contributors: Nadja Gaudillière-Jami, Mirko Dutschke, Iyad Ghazal
# 
# Digital Design Unit (DDU)
# Prof. Dr.-Ing. Oliver Tessmann
# Fachbereich Architektur
# Technical University of Darmstadt
# 
# 
# CREDITS:
# ------------
# ORIGINAL GCODE GENERATOR SCRIPT BY TOM SVILANS
# ADAPTED BY MAX BENJAMIN ESCHENBACH 2023
# 
# ORIGINAL HEAT METHOD SCRIPT BY DANIEL PIKER
# ADAPTED FOR NONPLANAR SLICING BY MAX BENJAMIN ESCHENBACH
# 
# ORIGINAL "DefinitionDependencies" COMPONENT BY ANDERS HOLDEN DELEURAN, ADAPTED BY MAX BENJAMIN ESCHENBACH 2025
# 
# ORIGINAL ViewCaptureToFile COMPONENT BY ANDERS HOLDEN DELEURAN, ADAPTED BY MAX BENJAMIN ESCHENBACH 2025
# 
# "MeshPipeChromo" COMPONENT FOR FAST MESH PIPING
# BY CAMERON NEWNHAM (CHROMODORIS PLUGIN), COPYRIGHT 2015-2016; LICENSED UNDER GNU GPL
# 
# SOME XYLINUS CLUSTERS BY RYAN HOOVER ARE BEING USED
# BY Independent Studio  |  MICA dFab  |  BUGSS
print_weight_in_g_2 = Panel(approximate_print_weight)
line_width_3 = Data(linewidth)
print_speed_mm_min_2 = Data(printspeed)
layer_height_3 = Number(layerheight)
line_width_in_mm = Panel(line_width_3)
layer_height_in_mm = Panel(layer_height_3)
print_speed_in_mm_s = Panel(print_speed_mm_min_2)

# ==== cluster ConstructWASP40100Printer

enable_print_simulation = ClusterInput()
layer_height = ClusterInput()
wasp_40100_printing_diameter = ClusterInput()
wasp40100_arm_length = ClusterInput()
gcode_last_pt = ClusterInput()
gcode_vis_offset_vector = ClusterInput()
wasp_40100_printing_diameter_2 = Data(wasp_40100_printing_diameter)
gcode_vis_offset_vector_2 = Data(gcode_vis_offset_vector)
enable_print_simulation_2 = Data(enable_print_simulation)
wasp40100_arm_length_2 = Data(wasp40100_arm_length)
gcode_last_pt_2 = Point(gcode_last_pt)
layer_height_2 = Number(layer_height)

enable_print_simulation_3 = Data(enable_print_simulation_2)
gcode_last_pt_3 = Point(gcode_last_pt_2)
home_pt = Point(Point(0, 0, 500))
layer_height_3 = Number(layer_height_2)
gcode_offset_vector = Data(gcode_vis_offset_vector_2)
Z = UnitZ(Factor=layer_height_3)
filter = StreamFilter(Gate=enable_print_simulation_3, Stream1=home_pt)
filter_2 = StreamFilter(Gate=enable_print_simulation_3, Stream1=gcode_last_pt_3)
gcode_last_pt_4 = Point(filter_2)
move = Move(Geometry=filter, Motion=gcode_offset_vector)  # -> Geometry, Transform
move_2 = Move(Geometry=gcode_last_pt_4, Motion=gcode_offset_vector)  # -> Geometry, Transform
null = NullItem(Item=move_2.Geometry)  # -> NullFlags, InvalidFlags, Description
or = GateOr(A=null.NullFlags, B=null.InvalidFlags)
filter_3 = StreamFilter(Gate=or, Stream0=move_2.Geometry, Stream1=move.Geometry)
move_3 = Move(Geometry=filter_3, Motion=Z)  # -> Geometry, Transform
gcode_pt = Point(move_3.Geometry)

# ----
# comments & notes: construct extrudermount and nozzle
number_slider = Slider(4, range=0..10)
gcode_pt_2 = Point(gcode_pt)
xy = XYPlane(Origin=gcode_pt_2)
cir = Circle(Plane=xy, Radius=expr("x*0.5", number_slider))
Z_2 = UnitZ(Factor=Slider(15, range=0..100))
offset = OffsetCurve(Curve=cir, Distance=Slider(0.5, range=0..1), Corners=1)
boundary = BoundarySurfaces(Edges=flatten([cir, offset]))
Z_3 = UnitZ(Factor=Slider(26, range=0..100))
move_4 = Move(Geometry=offset, Motion=Z_3)  # -> Geometry, Transform
extr = Extrude(Base=boundary, Direction=Z_2)
darc = DeconstructArc(Arc=move_4.Geometry)  # -> BasePlane, Radius, Angle
move_5 = Move(Geometry=offset, Motion=Z_2)  # -> Geometry, Transform
polygon = Polygon(Plane=darc.BasePlane, Radius=Slider(15, range=0..100), Segments=6, FilletRadius=0)  # -> Polygon, Length
Z_4 = UnitZ(Factor=Slider(15, range=0..100))
merge = Merge(Data1=move_5.Geometry, Data2=polygon.Polygon)
move_6 = Move(Geometry=darc.BasePlane, Motion=Z_4)  # -> Geometry, Transform
extr_2 = Extrude(Base=polygon.Polygon, Direction=Z_4)
loft = Loft(Curves=merge, Options={Adjust=False, Closed=False, LoftEnds=0, LoftSimp=0, LoftType=0, Rebuild=10, Refit=0.01})
cutplane_extruderfixtures = Data(move_6.Geometry)
wasp40100_nozzle_toppart = Data(extr_2)
wasp40100_nozzle_transition = Data(loft)
wasp40100_nozzle_bot = Data(extr)

cir_2 = Circle(Plane=cutplane_extruderfixtures, Radius=Slider(30, range=0..100))
seam = Seam(Curve=reparameterize(cir_2), Seam=Slider(0.25, range=0..1))
boundary_2 = BoundarySurfaces(Edges=cir_2)
divide = DivideCurve(Curve=seam, Count="3", Kinks=False)  # -> Points, Tangents, Parameters
wasp40100_extrudermount_srf = Data(boundary_2)
extruder_attachmentpts = Data(divide.Points)

# ----
# comments & notes: position blue ldm extruderbody on top of nozzle
wasp40100_ldm_extruderbody_blue_int = Mesh(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)
cutplane_extruderfixtures_2 = Data(cutplane_extruderfixtures)
xy_2 = XYPlane(Origin=Point(0, 0, 0))
orient = Orient(Geometry=wasp40100_ldm_extruderbody_blue_int, Source=xy_2, Target=cutplane_extruderfixtures_2)  # -> Geometry, Transform
wasp40100_ldm_extruderbody = Mesh(orient.Geometry)

# ----
# comments & notes: construct wasp40100 printing area as surface
xy_3 = XYPlane(Origin=Point(0, 0, 0))
enable_print_simulation_4 = Data(enable_print_simulation_2)
gcode_vis_offset_vector_3 = Data(gcode_vis_offset_vector_2)
wasp_40100_printing_diameter_3 = Data(wasp_40100_printing_diameter_2)
Y = UnitY(Factor=expr("(x-10)*0.5", wasp_40100_printing_diameter_3))

# ----
# CONSTRUCT WASP40100 PRINTER
move_7 = Move(Geometry=xy_3, Motion=gcode_vis_offset_vector_3)  # -> Geometry, Transform
comments_notes = Panel("CONSTRUCT WASP40100 PRINTER")

move_8 = Move(Geometry=move_7.Geometry, Motion=Y)  # -> Geometry, Transform
cir_3 = Circle(Plane=move_7.Geometry, Radius=expr("x*0.5", wasp_40100_printing_diameter_3))
crv_cp = CurveClosestPoint(Point=move_8.Geometry, Curve=reparameterize(cir_3))  # -> Point, Parameter, Distance
seam_2 = Seam(Curve=reparameterize(cir_3), Seam=crv_cp.Parameter)
filter_4 = StreamFilter(Gate=enable_print_simulation_4, Stream1=seam_2)
boundary_3 = BoundarySurfaces(Edges=seam_2)
wasp40100_printing_area_srf = Data(boundary_3)
wasp40100_printing_area_crv = Data(filter_4)

wasp40100_printing_area_crv_2 = Data(wasp40100_printing_area_crv)
divide_2 = DivideCurve(Curve=wasp40100_printing_area_crv_2, Count="3", Kinks=False)  # -> Points, Tangents, Parameters
Z_5 = UnitZ(Factor=1)
line = LineSDL(Start=divide_2.Points, Direction=Z_5, Length=Slider(1000, range=0..1000))
wasp40100_z_axis_crvs = Data(line)

# ----
# comments & notes: compute inverse kinematics of arms
wasp40100_arm_length_3 = Data(wasp40100_arm_length_2)
wasp40100_z_axis_crvs_2 = Data(wasp40100_z_axis_crvs)
cutplane_extruderfixtures_3 = Data(cutplane_extruderfixtures)
extruder_attachmentpts_2 = Data(extruder_attachmentpts)
plx = LinePlane(Line=wasp40100_z_axis_crvs_2, Plane=cutplane_extruderfixtures_3)  # -> Point, ParamL, ParamP
ln = Line(StartPoint=extruder_attachmentpts_2, EndPoint=plx.Point)
len = Length(Curve=ln)
vec2pt = Vector2Pt(PointA=extruder_attachmentpts_2, PointB=plx.Point, Unitize=False)  # -> Vector, Length
Z_6 = UnitZ(Factor=1)
rtrig = RightTrigonometry(PLength=len, RLength=wasp40100_arm_length_3)  # -> Alpha, Beta, PLength, QLength, RLength
pl = ConstructPlane(Origin=extruder_attachmentpts_2, XAxis=vec2pt.Vector, YAxis=Z_6)
rotate = Rotate(Geometry=ln, Angle=rtrig.Alpha, Plane=pl)  # -> Geometry, Transform
end = EndPoints(Curve=rotate.Geometry)  # -> Start, End
vec2pt_2 = Vector2Pt(PointA=end.Start, PointB=end.End, Unitize=False)  # -> unitize(Vector), Length
wasp40100_arm_length_4 = Data(wasp40100_arm_length_3)
line_2 = LineSDL(Start=extruder_attachmentpts_2, Direction=vec2pt_2.Vector, Length=wasp40100_arm_length_4)
wasp40100_arm_crv = Data(line_2)

wasp40100_arm_crv_2 = Data(wasp40100_arm_crv)
wasp40100_nozzle_bot_2 = Data(wasp40100_nozzle_bot)
wasp40100_z_axis_crvs_3 = Data(wasp40100_z_axis_crvs)
wasp40100_nozzle_toppart_2 = Data(wasp40100_nozzle_toppart)
wasp40100_printing_area_srf_2 = Data(wasp40100_printing_area_srf)
wasp40100_nozzle_transition_2 = Data(wasp40100_nozzle_transition)
wasp40100_ldm_extruderbody_2 = Mesh(wasp40100_ldm_extruderbody)
wasp40100_extrudermount_srf_2 = Data(wasp40100_extrudermount_srf)
wasp40100_extrudermount_srf_3 = ClusterOutput(wasp40100_extrudermount_srf_2)
wasp40100_ldm_extruderbody_3 = ClusterOutput(wasp40100_ldm_extruderbody_2)
wasp40100_nozzle_transition_3 = ClusterOutput(wasp40100_nozzle_transition_2)
wasp40100_printing_area_srf_3 = ClusterOutput(wasp40100_printing_area_srf_2)
wasp40100_nozzle_toppart_3 = ClusterOutput(wasp40100_nozzle_toppart_2)
wasp40100_nozzle_bot_3 = ClusterOutput(wasp40100_nozzle_bot_2)
wasp40100_z_axis_crvs_4 = ClusterOutput(wasp40100_z_axis_crvs_3)
wasp40100_arm_crv_3 = ClusterOutput(wasp40100_arm_crv_2)
